# Grasshopper definition 005_lists.gh (Grasshopper 1.0.7)
# plug-ins: Bifocals

# MGSM
# Grasshopper for Rhino3D
# 001_Introduction
# 002_ribbon_vanilla_grasshopper
# 003_Params
# Containers:
# Geometry/Primitives
# Grasshopper Canvas for Rhino3D:
# 
# Ribbon:
# 
# File
# - new/open
# - save document/saveas
# - export image
# - document properties
# - user objects/ clusters
# - special folders (components/user objects)
# - preferences
# http://grasshopperdocs.com/
# https://www.food4rhino.com/en
# Ribbon Vanilla Grasshopper
# 
# Params
# Maths
# Sets - data trees
# Vectors
# Curves
# Surfaces
# IntersectionTransformations
# Display
# Meshedit is a set of components which
#  extend Grasshopper's ability to work with
#  meshes.
# Vanilla Grasshopper
# Data Trees
# Ladybug
# Weaverbird
# FireFly
# Lunchbox
# Pufferfish
# Hal/Kuka/Robotics/tocoABB
# Paneling tools
# Kangaroo
# fologram
# Galapogos
# ghpython
# ghpython remote
# C#
# Weaverbird
# Weaverbird is a topological mesh editor
#  where it allows both Rhino and
# Grasshopper used to do mesh editing,
# subdivisions, and mesh transformations. In
#  other words, Weaverbird can make some
# nice looking mesh 'skins' of your model with
# fewer and less complicated scripts. This
# plug-in is able to reconstruct the shape of
# the model and subdivisions of any mesh
# (including ones made with polylines).
# 
# Hal/Kuka/Robotics/tocoABB
# KUKA|prc enables you to program
#  industrial
#  robots directly out of the parametric
#  modelling environment, including a full
#  kinematic simulation of the robot. The
#  generated files can be executed at the
#  KUKA robot, without requiring any additional
#  software.
# 
# fologram
# Use Fologram to view and share Rhino and
# Grasshopper instantly in mixed reality on
# HoloLens 1, HoloLens 2, Oculus Quest, iOS
#  and Android. Geometry, layers and
# grasshopper parameters can be edited in
# real time in Fologram to create powerful
# tools for design, communication,
# collaboration and fabrication.
# 
# Galapogos
# goat is an optimization add-on component
#  for Rhino's Grasshopper. It perfectly
#  complements galapagos, David Rutten's
#  evolutionary solver. Relying on gradient-free
#  optimization algorithms, the component
# pursues a mathematical rigorous approach
#  delivering fast and deterministic results. At
# every run, goat will yield the same optimal
#  result.
# 
# ghpython remote
# GH Python Remote is a special component
#  that lets you use regular Python code
#  directly in the GHPython component, like
#  importing Numpy, Scipy, matlplotib et al.
# 
# C#
point = Point()
curve = Curve()
line = Line()
surface = Surface()
vector = Vector()
plane = Plane()
# Ladybug allows you to import and analyze
#  standard weather data in Grasshopper;
# draw diagrams like Sun-path, wind-rose,
#  radiation-rose, etc; customize the diagrams
#  in several ways; run radiation analysis,
# shadow studies, and view analysis.
brep = Brep()
# Edit
# 
# - cut/copy/paste/delete
# - arrange groups
# - group/ungroup
# - cluster
# - find
# - create component popup
mesh = Mesh()
# Components:
# Firefly offers a set of software tools
#  dedicated to bridging the gap between
#  Grasshopper (a free plug-in for Rhino) and
#  micro-controllers like the Arduino. It allows
#  near real-time data flow between the digital
#  and physical worlds – enabling the possibility
#  to explore virtual and physical prototypes
#  with unprecedented fluidity.
geometry = Geometry()
# View
# 
# - obscure components
# - zoom options on canvas
# LunchBox is a plug-in for Grasshopper for
#  exploring mathematical shapes, paneling,
#  structures, and workflow.  We have also
#  introduced new components for general
#  machine learning implementations such as
#  regression analysis, clustering, and
#  networks.
# Display
# 
# - icons, wires, names
# - (consider Bifocals plugin)
# - selected only preview
# - plane size
# - mesh edges
# - gumball
# - canvas widgets
# (Markov, profiler, message balloons)
# The Pufferfish is one of few animals which
#  is capable of changing its shape.
# This plugin is a set of 330 components
# which focuses on Tweens, Blends, Morphs,
#  Averages, Transformations, & Interpolations
#  - essentially Shape Changing. Pufferfish mainly
#  uses parameters and factors for inputs for more
#  custom control over operations like tweens and
#  grids as opposed to grasshoppers usual division
#  count inputs. These components are
#  accompanied by support components which
#  are useful methods for tween / blend /
#  morph / lattice operations such as making
# curves compatible, a custom curve graph
#  mapper, and a multi-threaded morph to
# twisted box.
# Solution
# 
# - disable solver
# - scroll button/spacebar
# (cluster/group/preview/enable/solver/
# bake/zoom/find/preferences)
# Help
# 
# - tutorials
# - online forums
# - node references
# PanelingTools for Rhino and Grasshopper
#  by Robert McNeel & Associates is widely
#  used by designers, architects, and building
#  professionals. It supports intuitive design of
#  paneling concepts as well as help
#  rationalize complex geometry into a format
#  that is suitable for analysis and fabrication.
# Elk is a set of tools to generate map and
#  topographical surfaces using open source
#  data from OpenStreetMap.org and USGS.
# Kangaroo is a Live Physics engine for
# interactive simulation, form-finding,
#  optimization and constraint solving.
# ghPython
# This is the Rhino 5 for Windows version.
#  Rhino for Mac and Rhino WIP+6 all come
#  with their own GhPython interpreter, that is
#  specific and needs no tweaking.
geometry_pipeline = GeometryPipeline(
    GroupByLayer=False,
    GroupByType=False,
    IncludeHidden=True,
    IncludeLocked=True,
    LayerFilter="*",
    NameFilter="*",
    SublayerFiltering=True,
    TypeFilter=0)
integer = Integer()
# preview
# enable
# set geometries
# internalize
# extract
boolean = Boolean()
number = Number()
text = Text()
domain = Domain()
domain² = Domain²()
guid = Guid()
file_path = FilePath()
# Inputs:
number_slider = Slider(0.25, range=0..1)
md_slider = MDSlider(SliderMode=0, slider_value=Point(0.5, 0.5, 0.5), x_domain=Domain(0, 1), y_domain=Domain(0, 1), z_domain=Domain(0, 1))
value_list = ValueList({"One": 1, "Two": 2, "Three": 2² - 1, "Four": Sqrt(16)}, selected="One")
graph_mapper = GraphMapper()
boolean_toggle = BooleanToggle(False)
image_sampler = ImageSampler(Filter="Colour", Interpolate=False, Umax=1, Umin=0, Vmax=1, Vmin=0, Wrap=1)
colour_swatch = ColourSwatch(SwatchColor=RGB(255, 255, 255))
# Utilities:
cherry_picker = CherryPicker(ListIndex=0)
gene_pool = GenePool(Decimals=2, Maximum=100, Minimum=0, Value=[50, 50, 50, 50, 50, 50, 50, 50, 50, 50])
data_recorder = DataRecorder(DataLimit=-10, RecordData=True)
fitness_landscape = FitnessLandscape(Count=-1, ColourMode=1, ContourMode=2, Remap=False)
cluster_input = ClusterInput()
cluster_output = ClusterOutput()
galapagos = Galapagos()
param_viewer = ParamViewer()
# 004_Maths
# Domain:
construct_domain = ConstructDomain(DomainStart=0, DomainEnd=1)
divide_domain² = DivideDomain²(UCount=10, VCount=10)
divide_domain = DivideDomain(Domain=Domain(0, 1), Count=10)
construct_domain² = ConstructDomain²(UMin=0, UMax=1, VMin=0, VMax=1)
bounds = Bounds()
remap = Remap(min=0, max=1)
deconstruct_domain² = DeconstructDomain²()  # -> UComponent, VComponent
bounds_2d = Bounds2D()
remap_numbers = RemapNumbers(Source=Domain(0, 1), Target=Domain(0, 1))  # -> Mapped, Clipped
deconstruct_domain²_2 = DeconstructDomain²()  # -> UMin, UMax, VMin, VMax
deconstruct_domain = DeconstructDomain()  # -> Start, End
mass_addition = MassAddition()  # -> Result, PartialResults
integer_division = IntegerDivision()
# Operators:
addition = Addition()
division = Division()
gate_and = GateAnd()
smaller_than = SmallerThan(SecondNumber=0)  # -> SmallerThan, OrEqualTo
larger_than = LargerThan(SecondNumber=0)  # -> LargerThan, OrEqualTo
equality = Equality()  # -> Equality, Inequality
absolute = Absolute()
negative = Negative()
power = Power()
subtraction = Subtraction()
modulus = Modulus()
multiplication = Multiplication()
gate_or = GateOr()
mass_multiplication = MassMultiplication()  # -> Result, PartialResults
# Polynomials
square = Square()
square_root = SquareRoot()
expression = Expression(Expression="Format(\"{0}, {1}\", x, y)")
# Script
evaluate = Evaluate()
ghpython_script = GhPythonScript()  # -> Out, A
c_script = CSharpScript()  # -> Out, A
degrees = Degrees()
# Trig:
sine = Sine()
radians = Radians()
cosine = Cosine()
# Utilities:
golden_ratio = GoldenRatio(Factor=1)
maximum = Maximum()
average = Average()
round = Round()  # -> Nearest, Floor, Ceiling
pi = Pi(Factor=1)
# 005_Sets
# List
minimum = Minimum()

# ==== cluster Remap: Remaps numbers
data = ClusterInput()
min = ClusterInput()
max = ClusterInput()
bnd = Bounds(Numbers=data)
dom = ConstructDomain(DomainStart=min, DomainEnd=max)
remap = RemapNumbers(Value=data, Source=bnd, Target=dom)  # -> Mapped, Clipped
R = ClusterOutput(remap.Mapped)
