# Grasshopper definition 014_gh_scripting_MASTER.gh (Grasshopper 1.0.7)
# plug-ins: Bifocals, Kangaroo2 Components, MeshEdit Components, MarchingCubes, Weaverbird

# ----
# Cellular Growth (Metaball - Cocoon - Voronoi - Weaverbird - Octree)
# 
# https://www.cs.cmu.edu/afs/cs.cmu.edu/academic/class/15394u-s20/lectures/weaverbird/weaverbird.html
# Metaball - Cocoon - Voronoi - Weaverbird - Octree - SubD
# 009_Mesh
# Create
# Define
# Extract
# Smoothen
# SubD
# Transform
mesh_area = MeshArea()  # -> Area, Centroid
mesh_edges = MeshEdges()  # -> NakedEdges, InteriorEdges, NonManifoldEdges
mesh_convertquads = MeshConvertQuads(ShortDiagonal=True)  # -> Mesh, Split
mesh_triangulate = MeshTriangulate(ShortDiagonal=True)
mesh_eval = MeshEval()  # -> Point, Normal, Colour
mesh_closest_point = MeshClosestPoint()  # -> Point, Index, Parameter
# Analysis
face_normals = FaceNormals()  # -> Centers, Normals
# Ladybug allows you to import and analyze
#  standard weather data in Grasshopper;
# draw diagrams like Sun-path, wind-rose,
#  radiation-rose, etc; customize the diagrams
#  in several ways; run radiation analysis,
# shadow studies, and view analysis.
# 
# Ladybug allows you to import and analyze
#  standard weather data in Grasshopper;
#  draw diagrams like Sun-path, wind-rose,
#  radiation-rose, etc; customize the diagrams
#  in several ways; run radiation analysis,
#  shadow studies, and view analysis.
# 
# Honeybee connects Grasshopper3D to
#  validated simulation engines such as
#  EnergyPlus/OpenStudio and Radiance for
#  building energy, comfort, daylighting and
#  lighting simulation.
# 
# Dragonfly enables the creation and
#  manipulation of large-scale EnergyPlus and
#  Radiance models by capitalizing on an
#  abstracted 2D representation of building
#  geometry, where all rooms are assumed to
#  be extrusions of floor plates.
# 
# Butterfly connects Grasshopper to the
#  OpenFOAM engine, wich can be used to
#  run advanced computational fluid dynamic
#  (CFD) simulations.
# Ladybug (environmental analysis)
# 
# https://www.food4rhino.com/en/app/ladybug-tools
# 
# all sample files depend on ghpython node
# which comes with Rhino 6/7
mesh_nakededge = MeshNakedEdge()  # -> V, A, B
mesh_volume = MeshVolume()  # -> Volume, Centroid
face_boundaries = FaceBoundaries()
mesh_explode = MeshExplode(Interpolate=False)
deconstruct_mesh = DeconstructMesh()  # -> Vertices, Faces, Colours, Normals
deconstruct_face = DeconstructFace()  # -> CornerA, CornerB, CornerC, CornerD
mesh_inclusion = MeshInclusion(Strict=False)
mesh_quad = MeshQuad(CornerA=0, CornerB=1, CornerC=2, CornerD=3)
mesh_plane = MeshPlane(Boundary={Plane=PlaneXY(0, 0, 0), Size=Domain2(u=-10..10, v=-10..10)}, WidthCount=10, HeightCount=10)  # -> Mesh, Area
mesh_sphere = MeshSphere(Base=PlaneXY(0, 0, 0), Radius=10, UCount=10, VCount=20)
mesh_box = MeshBox(Base={Plane=PlaneXY(0, 0, 0), X=Domain(-10, 10), Y=Domain(-10, 10), Z=Domain(-10, 10)}, XCount=10, YCount=10, ZCount=10)
# Primitive
construct_mesh = ConstructMesh(Vertices=[Point(0, 0, 0), Point(10, 0, 0), Point(10, 10, 0), Point(0, 10, 0)], Faces={A=0, B=1, C=2, D=3})
mesh_sphere_ex = MeshSphereEx(Base=PlaneXY(0, 0, 0), Radius=10, Count=5)
mesh_triangle = MeshTriangle(CornerA=0, CornerB=1, CornerC=2)
mesh_colours = MeshColours(Colours=[RGB(127, 255, 0), RGB(0, 100, 0), RGB(34, 139, 34), RGB(124, 252, 0), RGB(154, 205, 50), RGB(173, 255, 47), RGB(50, 205, 50), RGB(152, 251, 152)])
mesh_spray = MeshSpray(SprayMode=11)
metaball = MetaBall(Plane=PlaneXY(0, 0, 0))
voronoi = Voronoi(BruteForceOverride=False)
# Tiangulation
delaunay_edges = DelaunayEdges(Plane=PlaneXY(0, 0, 0))  # -> Connectivity, Edges
delaunay_mesh = DelaunayMesh(Plane=PlaneXY(0, 0, 0))
octree = OcTree(Square=False, Group=5)  # -> Boxes, Points
metaball_t = MetaBallT(Plane=PlaneXY(0, 0, 0), Threshold=0.5)
voronoi_3d = Voronoi3D()  # -> Cells, Boundary
metaball_t_custom = MetaBallTCustom(Plane=PlaneXY(0, 0, 0), Threshold=0.5)
convex_hull = ConvexHull(Plane=PlaneXY(0, 0, 0))  # -> Hull, HullZ, Indices
delete_faces = DeleteFaces()
mesh_surface = MeshSurface(UCount=5, VCount=5, Overhang=True, Equalize=False)
cull_faces = CullFaces()
# Utilities
mesh_brep = MeshBrep(Settings={GridMaxCount=0, GridMinCount=16, JaggedSeams=False, MaxEdgeLength=0, MinEdgeLength=0.0001, MinTolerance=0, Refine=True, RefineAngle=0, RelativeTolerance=0.65, SimplePlanes=True, Tolerance=0})
unweld_mesh = UnweldMesh(Angle=1.570796327)
mesh_shadow = MeshShadow(Light=Vector(0, 0, -1), Plane=PlaneXY(0, 0, 0))
mesh_join = MeshJoin()
delete_vertices = DeleteVertices(Shrink=True)
cull_vertices = CullVertices(Shrink=True)
weld_mesh = WeldMesh(Angle=3.141592654)
flip_mesh = FlipMesh(VertexNormals=True, FaceNormals=True, FaceOrientation=True)
mesh_weldvertices = MeshWeldVertices(Tolerance=0.01)  # -> RuntimeMessage, Mesh
mesh_frompoints = MeshFromPoints()
occlusion = Occlusion()  # -> Hits, Occlusion
simple_mesh = SimpleMesh()
mesh_unifynormals = MeshUnifyNormals()
quadrangulate = Quadrangulate(Angle=0.03490658504, Ratio=0.875)  # -> Mesh, Count
triangulate = Triangulate()  # -> Mesh, Count
mesh_flip = MeshFlip()
metaball_t_custom_2 = MetaBallTCustom(Plane=PlaneXY(0, 0, 0), Threshold=0.5)
metaball_t_2 = MetaBallT(Plane=PlaneXY(0, 0, 0), Threshold=0.5)
metaball_t_3 = MetaBallT(Plane=PlaneXY(0, 0, 0), Threshold=0.5)
curve_charge = CurveCharge()
curve_group_charge = CurveGroupCharge()
point_charge = PointCharge()
brep_charge = BrepCharge()
refine = Refine()
# Panelling Tools
# Curve
# Grid
# Grid Attractors
# Grid Utility
# Panel 2D
# Panel 3D
# Panel Utility
# Param
cocoon = Cocoon(Simple=False)  # -> Mesh, RefinementData
_3d_voronoi = _3DVoronoi()  # -> _3DVoronoiCells, Connectivity
voronoi_groups = VoronoiGroups(Boundary={Plane=PlaneXY(0, 0, 0), Size=Domain2(u=-10..10, v=-10..10)})  # -> Diagram1, Diagram2
voronoi_3d_2 = Voronoi3D()  # -> Cells, Boundary
voronoi_cell = VoronoiCell()
voronoi_2 = Voronoi(BruteForceOverride=False)
weaverbird_s_tile = WeaverbirdsTile(FillStrategy=1, OptIn=2)
weaverbird_s_mesh_from_lines_weave_back = WeaverbirdsMeshFromLinesWeaveBack(MaximumValence=4)
quad_remesh_settings = QuadRemeshSettings(TargetCount=1000, AdaptiveSize=0, AdaptiveCount=False, HardEdges=False, SeamEdges=0, Symmetry=0, GuideCurves=0)
quad_remesh = QuadRemesh(Settings={aqc=True, as=50, dhe=True, gci=0, null=False, pme=0, sa=0, tqc=2000})
octree_2 = OcTree(Square=False, Group=5)  # -> Boxes, Points
quadtree = QuadTree(Plane=PlaneXY(0, 0, 0), Square=False, Group=5)  # -> Quads, Points
subd_fuse = SubDFuse(BooleanOption=0, Smoothing=10)
subd_from_mesh = SubDFromMesh(Creases=1, Corners=1, Interpolate=False)
multipipe = MultiPipe(NodeSize=0.5, EndOffset=1, StrutSize=1, Segment=0, KinkAngle=0.6, CubeFit=0, Caps=0)
mesh_from_subd = MeshFromSubD(Density=2)
subd_control_polygon = SubDControlPolygon()
subd_edges = SubDEdges(NewFormatting=False)  # -> Line, Edge, Tag, Id

# ----
# Tree (Data Trees)
simplify_tree = SimplifyTree(Front=False)
flip_matrix = FlipMatrix()
merge = Merge()
flatten_tree = FlattenTree(Path="{0}")
graft_tree = GraftTree(IncludeEmptyLists=True, IncludeNullItems=True)
# Lunchbox (panelization and structure creation)
# Data
# Generate
# Machine Learning (proving ground)
# Math
# Panels
# Structure
# Utilities
# Workflow
relative_item = RelativeItem(WrapPaths=False, WrapItems=False)  # -> ItemA, ItemB
# The Pufferfish is one of few animals which
#  is capable of changing its shape.
# This plugin is a set of 330 components
# which focuses on Tweens, Blends, Morphs,
#  Averages, Transformations, & Interpolations
#  - essentially Shape Changing. Pufferfish mainly
#  uses parameters and factors for inputs for more
#  custom control over operations like tweens and
#  grids as opposed to grasshoppers usual division
#  count inputs. These components are
#  accompanied by support components which
#  are useful methods for tween / blend /
#  morph / lattice operations such as making
# curves compatible, a custom curve graph
#  mapper, and a multi-threaded morph to
# twisted box.
# Ladybug allows you to import and analyze
#  standard weather data in Grasshopper;
# draw diagrams like Sun-path, wind-rose,
#  radiation-rose, etc; customize the diagrams
#  in several ways; run radiation analysis,
# shadow studies, and view analysis.
# PanelingTools for Rhino and Grasshopper
#  by Robert McNeel & Associates is widely
#  used by designers, architects, and building
#  professionals. It supports intuitive design of
#  paneling concepts as well as help
#  rationalize complex geometry into a format
#  that is suitable for analysis and fabrication.
# Kangaroo is a Live Physics engine for
# interactive simulation, form-finding,
#  optimization and constraint solving.
# ghPython
# This is the Rhino 5 for Windows version.
#  Rhino for Mac and Rhino WIP+6 all come
#  with their own GhPython interpreter, that is
#  specific and needs no tweaking.
# Galapogos
# goat is an optimization add-on component
#  for Rhino's Grasshopper. It perfectly
#  complements galapagos, David Rutten's
#  evolutionary solver. Relying on gradient-free
#  optimization algorithms, the component
# pursues a mathematical rigorous approach
#  delivering fast and deterministic results. At
# every run, goat will yield the same optimal
#  result.
clean_tree = CleanTree(RemoveNulls=True, RemoveInvalid=True, RemoveEmpty=False)
split_tree = SplitTree()  # -> Positive, Negative
path_mapper = PathMapper()
explode_tree = ExplodeTree()  # -> Branch0, Branch1
tree_statistics = TreeStatistics()  # -> Paths, Length, Count
tree_branch = TreeBranch(MaintainPaths=True)
shift_paths = ShiftPaths(Offset=-1)
entwine = Entwine(FlattenInputs=True)
relative_items = RelativeItems(WrapPaths=False, WrapItems=False)  # -> ItemA, ItemB
construct_path = ConstructPath()
stream_gate = StreamGate(Gate=0)  # -> Target0, Target1
prune_tree = PruneTree(Minimum=0, Maximum=0)
tree_item = TreeItem(Index=0, Wrap=True)
trim_tree = TrimTree(Depth=1)
match_tree = MatchTree()
stream_filter = StreamFilter(Gate=0)
deconstruct_path = DeconstructPath()

# ----
# Kangaroo - Galapagos (form finding)
# Kangaroo is a Live Physics engine for
# interactive simulation, form-finding,
#  optimization and constraint solving.
solver = Solver(Reset=False, Threshold=1e-15, Tolerance=0.0001, On=True)  # -> I, V, O
gene_pool = GenePool(Decimals=2, Maximum=100, Minimum=0, Value=[50, 50, 50, 50, 50, 50, 50, 50, 50, 50])
fitness_landscape = FitnessLandscape(Count=-1, ColourMode=1, ContourMode=2, Remap=False)
galapagos = Galapagos()

# ----
# MGSM
# Grasshopper for Rhino3D
# http://grasshopperdocs.com/
# https://www.food4rhino.com/en
# 002_ribbon_vanilla_grasshopper
# 003_Params
# 001_Introduction
# Vanilla Grasshopper
# Data Trees
# Ladybug
# Weaverbird
# FireFly
# Lunchbox
# Pufferfish
# Hal/Kuka/Robotics/tocoABB
# Paneling tools
# Kangaroo
# fologram
# Galapogos
# ghpython
# ghpython remote
# C#
# Grasshopper Canvas for Rhino3D:
# 
# Ribbon:
# 
# File
# - new/open
# - save document/saveas
# - export image
# - document properties
# - user objects/ clusters
# - special folders (components/user objects)
# - preferences
# Ribbon Vanilla Grasshopper
# 
# Params
# Maths
# Sets - data trees
# Vectors
# Curves
# Surfaces
# IntersectionTransformations
# Display
# Containers:
# Geometry/Primitives
# Meshedit is a set of components which
#  extend Grasshopper's ability to work with
#  meshes.
# preview
# enable
# set geometries
# internalize
# extract
# Utilities:
# Inputs:
# Hal/Kuka/Robotics/tocoABB
# KUKA|prc enables you to program
#  industrial
#  robots directly out of the parametric
#  modelling environment, including a full
#  kinematic simulation of the robot. The
#  generated files can be executed at the
#  KUKA robot, without requiring any additional
#  software.
# Components:
point = Point()
curve = Curve()
line = Line()
# fologram
# Use Fologram to view and share Rhino and
# Grasshopper instantly in mixed reality on
# HoloLens 1, HoloLens 2, Oculus Quest, iOS
#  and Android. Geometry, layers and
# grasshopper parameters can be edited in
# real time in Fologram to create powerful
# tools for design, communication,
# collaboration and fabrication.
surface = Surface()
vector = Vector()
plane = Plane()
# LunchBox is a plug-in for Grasshopper for
#  exploring mathematical shapes, paneling,
#  structures, and workflow.  We have also
#  introduced new components for general
#  machine learning implementations such as
#  regression analysis, clustering, and
#  networks.
brep = Brep()
# Edit
# 
# - cut/copy/paste/delete
# - arrange groups
# - group/ungroup
# - cluster
# - find
# - create component popup
mesh = Mesh()
# Weaverbird
# Weaverbird is a topological mesh editor
#  where it allows both Rhino and
# Grasshopper used to do mesh editing,
# subdivisions, and mesh transformations. In
#  other words, Weaverbird can make some
# nice looking mesh 'skins' of your model with
# fewer and less complicated scripts. This
# plug-in is able to reconstruct the shape of
# the model and subdivisions of any mesh
# (including ones made with polylines).
# ghpython remote
# GH Python Remote is a special component
#  that lets you use regular Python code
#  directly in the GHPython component, like
#  importing Numpy, Scipy, matlplotib et al.
# 
# C#
geometry = Geometry()
# View
# 
# - obscure components
# - zoom options on canvas
# Display
# 
# - icons, wires, names
# - (consider Bifocals plugin)
# - selected only preview
# - plane size
# - mesh edges
# - gumball
# - canvas widgets
# (Markov, profiler, message balloons)
# Elk is a set of tools to generate map and
#  topographical surfaces using open source
#  data from OpenStreetMap.org and USGS.
# Firefly offers a set of software tools
#  dedicated to bridging the gap between
#  Grasshopper (a free plug-in for Rhino) and
#  micro-controllers like the Arduino. It allows
#  near real-time data flow between the digital
#  and physical worlds – enabling the possibility
#  to explore virtual and physical prototypes
#  with unprecedented fluidity.
# Solution
# 
# - disable solver
# - scroll button/spacebar
# (cluster/group/preview/enable/solver/
# bake/zoom/find/preferences)
# Help
# 
# - tutorials
# - online forums
# - node references
geometry_pipeline = GeometryPipeline(
    GroupByLayer=False,
    GroupByType=False,
    IncludeHidden=True,
    IncludeLocked=True,
    LayerFilter="*",
    NameFilter="*",
    SublayerFiltering=True,
    TypeFilter=0)
boolean = Boolean()
integer = Integer()
number = Number()
text = Text()
domain = Domain()
domain² = Domain²()
guid = Guid()
file_path = FilePath()
number_slider = Slider(0.25, range=0..1)
md_slider = MDSlider(SliderMode=0, slider_value=Point(0.5, 0.5, 0.5), x_domain=Domain(0, 1), y_domain=Domain(0, 1), z_domain=Domain(0, 1))
value_list = ValueList({"One": 1, "Two": 2, "Three": 2² - 1, "Four": Sqrt(16)}, selected="One")
boolean_toggle = BooleanToggle(False)
graph_mapper = GraphMapper()
image_sampler = ImageSampler(Filter="Colour", Interpolate=False, Umax=1, Umin=0, Vmax=1, Vmin=0, Wrap=1)
colour_swatch = ColourSwatch(SwatchColor=RGB(255, 255, 255))
cherry_picker = CherryPicker(ListIndex=0)
gene_pool_2 = GenePool(Decimals=2, Maximum=100, Minimum=0, Value=[50, 50, 50, 50, 50, 50, 50, 50, 50, 50])
data_recorder = DataRecorder(DataLimit=-10, RecordData=True)
fitness_landscape_2 = FitnessLandscape(Count=-1, ColourMode=1, ContourMode=2, Remap=False)
cluster_input = ClusterInput()
cluster_output = ClusterOutput()
galapagos_2 = Galapagos()
param_viewer = ParamViewer()

# ----
# 004_Maths
# Domain:
# Operators:
# Trig:
# Utilities:
# Script
# Polynomials
construct_domain = ConstructDomain(DomainStart=0, DomainEnd=1)
divide_domain² = DivideDomain²(UCount=10, VCount=10)
divide_domain = DivideDomain(Domain=Domain(0, 1), Count=10)
construct_domain² = ConstructDomain²(UMin=0, UMax=1, VMin=0, VMax=1)
bounds = Bounds()
remap = Remap(min=0, max=1)
deconstruct_domain² = DeconstructDomain²()  # -> UComponent, VComponent
bounds_2d = Bounds2D()
remap_numbers = RemapNumbers(Source=Domain(0, 1), Target=Domain(0, 1))  # -> Mapped, Clipped
deconstruct_domain²_2 = DeconstructDomain²()  # -> UMin, UMax, VMin, VMax
deconstruct_domain = DeconstructDomain()  # -> Start, End
mass_addition = MassAddition()  # -> Result, PartialResults
integer_division = IntegerDivision()
addition = Addition()
division = Division()
gate_and = GateAnd()
smaller_than = SmallerThan(SecondNumber=0)  # -> SmallerThan, OrEqualTo
larger_than = LargerThan(SecondNumber=0)  # -> LargerThan, OrEqualTo
equality = Equality()  # -> Equality, Inequality
absolute = Absolute()
negative = Negative()
power = Power()
subtraction = Subtraction()
modulus = Modulus()
multiplication = Multiplication()
gate_or = GateOr()
mass_multiplication = MassMultiplication()  # -> Result, PartialResults
square = Square()
square_root = SquareRoot()
expression = Expression(Expression="Format(\"{0}, {1}\", x, y)")
evaluate = Evaluate()
ghpython_script = GhPythonScript()  # -> Out, A
c_script = CSharpScript()  # -> Out, A
degrees = Degrees()
sine = Sine()
radians = Radians()
cosine = Cosine()
golden_ratio = GoldenRatio(Factor=1)
maximum = Maximum()
average = Average()
round = Round()  # -> Nearest, Floor, Ceiling
pi = Pi(Factor=1)
minimum = Minimum()

# ----
# 005_Sets
# Tree (Data Trees)
# Text
# Sequence
# List
dispatch = Dispatch(DispatchPattern=[True, False])  # -> ListA, ListB
sort_list = SortList()  # -> Keys, ValuesValuesA
cross_reference = CrossReference(CrossMode=1)  # -> ListListA, ListListB
weave = Weave(Pattern=[0, 1], NullGaps=False)
pick_n_choose = PickNChoose(Pattern=[0, 1])
list_length = ListLength()
list_item = ListItem(Index=0, Wrap=True)
reverse_list = ReverseList()
combine_data = CombineData()  # -> Result, Index
longest_list = LongestList(PaddingMode=2)  # -> ListListA, ListListB
shortest_list = ShortestList(TrimMode=2)  # -> ListListA, ListListB
sub_list = SubList(Wrap=True)  # -> List, Index
partition_list = PartitionList(Size=[3, 2])
split_list = SplitList()  # -> ListA, ListB
insert_items = InsertItems(Wrap=True)
replace_items = ReplaceItems(Wrap=False)
item_index = ItemIndex()
shift_list = ShiftList(Shift=1, Wrap=True)
random = Random(Range=Domain(0, 1), Number=1, Seed=2)
range = Range(Domain=Domain(0, 1), Steps=10)
random_reduce = RandomReduce(Seed=1)
duplicate_data = DuplicateData(Number=2, Order=True)
series = Series(Start=0, Step=1, Count=10)
jitter = Jitter(Jitter=1, Seed=2)  # -> Values, Indices
repeat_data = RepeatData()
cull_index = CullIndex(Wrap=True)
cull_nth = CullNth(CullFrequency=2)
cull_pattern = CullPattern(CullPattern=[False, False, True, True])
fibonacci = Fibonacci(SeedA=0, SeedB=1, Number=10)
concatenate = Concatenate()
simplify_tree_2 = SimplifyTree(Front=False)
flip_matrix_2 = FlipMatrix()
flatten_tree_2 = FlattenTree(Path="{0}")
graft_tree_2 = GraftTree(IncludeEmptyLists=True, IncludeNullItems=True)
merge_2 = Merge()
stream_filter_2 = StreamFilter(Gate=0)
relative_item_2 = RelativeItem(WrapPaths=False, WrapItems=False)  # -> ItemA, ItemB
clean_tree_2 = CleanTree(RemoveNulls=True, RemoveInvalid=True, RemoveEmpty=False)
split_tree_2 = SplitTree()  # -> Positive, Negative
path_mapper_2 = PathMapper()
explode_tree_2 = ExplodeTree()  # -> Branch0, Branch1
tree_statistics_2 = TreeStatistics()  # -> Paths, Length, Count
tree_branch_2 = TreeBranch(MaintainPaths=True)
shift_paths_2 = ShiftPaths(Offset=-1)
entwine_2 = Entwine(FlattenInputs=True)
relative_items_2 = RelativeItems(WrapPaths=False, WrapItems=False)  # -> ItemA, ItemB
construct_path_2 = ConstructPath()
stream_gate_2 = StreamGate(Gate=0)  # -> Target0, Target1
prune_tree_2 = PruneTree(Minimum=0, Maximum=0)
tree_item_2 = TreeItem(Index=0, Wrap=True)
trim_tree_2 = TrimTree(Depth=1)
match_tree_2 = MatchTree()
deconstruct_path_2 = DeconstructPath()

# ----
# 006_Vector
# Grid
# Plane
# Point
# Vector
populate_geometry = PopulateGeometry(Count=100, Seed=1)
populate_2d = Populate2D(Region={Plane=PlaneXY(0, 0, 0), Size=Domain2(u=0..20, v=0..10)}, Count=100, Seed=1)
populate_3d = Populate3D(Region={Plane=PlaneXY(0, 0, 0), X=Domain(0, 10), Y=Domain(0, 10), Z=Domain(0, 2)}, Count=100, Seed=1)
rectangular = Rectangular(Plane=PlaneXY(0, 0, 0), SizeX=1, SizeY=2, ExtentX=10, ExtentY=5)  # -> Cells, Points
square_2 = Square(Plane=PlaneXY(0, 0, 0), Size=1, ExtentX=5, ExtentY=5)  # -> Cells, Points
triangular = Triangular(Plane=PlaneXY(0, 0, 0), Size=1, ExtentX=5, ExtentY=5)  # -> Cells, Points
hexagonal = Hexagonal(Plane=PlaneXY(0, 0, 0), Size=1, ExtentX=5, ExtentY=5)  # -> Cells, Points
radial = Radial(Plane=PlaneXY(0, 0, 0), Size=1, ExtentR=5, ExtentP=20)  # -> Cells, Points
xy_plane = XYPlane(Origin=Point(0, 0, 0))
xz_plane = XZPlane(Origin=Point(0, 0, 0))
yz_plane = YZPlane(Origin=Point(0, 0, 0))
construct_plane = ConstructPlane(Origin=Point(0, 0, 0), XAxis=Vector(1, 0, 0), YAxis=Vector(0, 1, 0))
flip_plane = FlipPlane(Plane=PlaneXY(0, 0, 0), ReverseX=False, ReverseY=False, SwapAxes=True)
plane_closest_point = PlaneClosestPoint()  # -> Point, UVPoint, Distance
plane_normal = PlaneNormal(Origin=Point(0, 0, 0), ZAxis=Vector(0, 0, 1))
plane_origin = PlaneOrigin()
rotate_plane = RotatePlane()
deconstruct_plane = DeconstructPlane(Plane=PlaneXY(0, 0, 0))  # -> Origin, XAxis, YAxis, ZAxis
align_plane = AlignPlane()  # -> Plane, Angle
plane_coordinates = PlaneCoordinates(System=PlaneXY(0, 0, 0))  # -> XCoordinate, YCoordinate, ZCoordinate
plane_offset = PlaneOffset(BasePlane=PlaneXY(0, 0, 0), Offset=1)
plane_fit = PlaneFit()  # -> Plane, Deviation
adjust_plane = AdjustPlane(Normal=Vector(0, 0, 1))
plane_3pt = Plane3Pt()
line_pt = LinePt()
line_line = LineLine()
align_planes = AlignPlanes()
pull_point = PullPoint(ClosestOnly=True)  # -> ClosestPoint, Distance
closest_point = ClosestPoint()  # -> ClosestPoint, CPIndex, Distance
construct_point = ConstructPoint(XCoordinate=0, YCoordinate=0, ZCoordinate=0)
cull_duplicates = CullDuplicates(Tolerance=0.1, CullMode=3)  # -> Points, Indices, Valence
distance = Distance()
project_point = ProjectPoint(Direction=Vector(0, 0, -1))  # -> Point, Index
sort_along_curve = SortAlongCurve()  # -> Points, Indices
deconstruct = Deconstruct()  # -> XComponent, YComponent, ZComponent
closest_points = ClosestPoints(Count=3)  # -> ClosestPoint, CPIndex, Distance
sort_points = SortPoints()  # -> Points, Indices
vector_xyz = VectorXYZ(XComponent=0, YComponent=0, ZComponent=0)  # -> Vector, Length
vector_2pt = Vector2Pt(Unitize=False)  # -> Vector, Length
unit_x = UnitX(Factor=1)
unit_y = UnitY(Factor=1)
unit_z = UnitZ(Factor=1)
amplitude = Amplitude(Amplitude=1)
cross_product = CrossProduct(Unitize=False)  # -> Vector, Length
unit_vector = UnitVector()
reverse = Reverse()
rotate = Rotate()
dot_product = DotProduct(Unitize=False)
deconstruct_vector = DeconstructVector()  # -> XComponent, YComponent, ZComponent
angle = Angle()  # -> Angle, Reflex
vector_length = VectorLength()

# ----
# 007_Curve
# Utility
# Spline
# Analysis
# Primitive
# Division
evaluate_length = EvaluateLength(Normalized=True)  # -> Point, Tangent, Parameter
evaluate_curve = EvaluateCurve()  # -> Point, Tangent, Angle
horizontal_frame = HorizontalFrame()
perp_frame = PerpFrame()
curve_closest_point = CurveClosestPoint()  # -> Point, Parameter, Distance
curve_domain = CurveDomain()  # -> Curve, Domain
curve_middle = CurveMiddle()
point_on_curve = PointOnCurve(parameter=0.5)
length = Length()
end_points = EndPoints()  # -> Start, End
derivatives = Derivatives()  # -> Point, FirstDerivative
point_in_curves = PointInCurves()  # -> Relationship, Index, Point
point_in_curve = PointInCurve()  # -> Relationship, Point
polygon_center = PolygonCenter()  # -> CenterV, CenterE, CenterA
planar = Planar()  # -> Planar, Plane, Deviation
control_points = ControlPoints()  # -> Points, Weights, Knots
extremes = Extremes(Plane=PlaneXY(0, 0, 0))  # -> Highest, Lowest
divide_distance = DivideDistance()  # -> Points, Tangents, Parameters
divide_length = DivideLength()  # -> Points, Tangents, Parameters
divide_curve = DivideCurve(Count=10, Kinks=False)  # -> Points, Tangents, Parameters
curve_frames = CurveFrames(Count=10)  # -> Frames, Parameters
horizontal_frames = HorizontalFrames(Count=10)  # -> Frames, Parameters
perp_frames = PerpFrames(Count=10, Align=True)  # -> Frames, Parameters
polygon = Polygon(Plane=PlaneXY(0, 0, 0), Radius=3, Segments=6, FilletRadius=0)  # -> Polygon, Length
rectangle = Rectangle(Plane=PlaneXY(0, 0, 0), XSize=Domain(-1, 1), YSize=Domain(-2, 2), Radius=0)  # -> Rectangle, Length
ellipse = Ellipse(Plane=PlaneXY(0, 0, 0), Radius1=1, Radius2=1)  # -> Ellipse, Focus1, Focus2
line_2 = Line()
arc_3pt = Arc3Pt()  # -> Arc, Plane, Radius
arc = Arc(Plane=PlaneXY(0, 0, 0), Radius=1, Angle=Domain(0, 3.141592654))  # -> Arc, Length
line_sdl = LineSDL(Direction=Vector(0, 0, 1), Length=1)
circle_cnr = CircleCNR(Normal=Vector(0, 0, 1), Radius=1)
circle = Circle(Plane=PlaneXY(0, 0, 0), Radius=1)
tangent_lines_ex = TangentLinesEx()  # -> Tangent1, Tangent2
tangent_lines = TangentLines()  # -> Tangent1, Tangent2
iso_curve = IsoCurve()  # -> UIsocurve, VIsocurve
interpolate = Interpolate(Degree=3, Periodic=False, KnotStyle=1)  # -> Curve, Length, Domain
nurbs_curve = NurbsCurve(Degree=3, Periodic=False)  # -> Curve, Length, Domain
polyline = PolyLine(Closed=False)
tween_curve = TweenCurve(Factor=0.5, BlendType=0)
curve_on_surface = CurveOnSurface(Closed=False)  # -> Curve, Length, Domain
catenary = Catenary(Gravity=Vector(0, 0, -1))
blend_curve = BlendCurve(BulgeA=1, BulgeB=1, Continuity=2)
explode = Explode(Recursive=True)  # -> Segments, Vertices
join_curves = JoinCurves(Preserve=False)
project = Project(Direction=Vector(0, 0, 1))
offset_curve = OffsetCurve(Distance=1, Corners=1)
flip_curve = FlipCurve()  # -> Curve, Flag
rebuild_curve = RebuildCurve(Count=10, Tangents=False)
pull_curve = PullCurve()
fillet = Fillet()
extend_curve = ExtendCurve(Type=0)
seam = Seam()

# ----
# 008_Surface
# Freeform
# Primitive
# Analysis
# SubD
# Utilities
surface_closest_point = SurfaceClosestPoint()  # -> Point, UVPoint, Distance
area = Area()  # -> Area, Centroid
volume = Volume()  # -> Volume, Centroid
evaluate_surface = EvaluateSurface()  # -> Point, Normal, UDirection, VDirection, Frame
deconstruct_brep = DeconstructBrep()  # -> Faces, Edges, Vertices
brep_closest_point = BrepClosestPoint()  # -> Point, Normal, Distance
point_in_brep = PointInBrep(Strict=False)
brep_edges = BrepEdges()  # -> Naked, Interior, NonManifold
point_in_breps = PointInBreps(Strict=False)  # -> Inside, Index
surface_from_points = SurfaceFromPoints(Interpolate=False)
extrude = Extrude()
sweep2 = Sweep2(SameHeight=False)
_4point_surface = _4PointSurface()
pipe_variable = PipeVariable(Caps=0)
revolution = Revolution(Domain=Domain(0, 6.283185307))
boundary_surfaces = BoundarySurfaces()
rail_revolution = RailRevolution(Scale=False)
sweep1 = Sweep1(Miter=1)
loft = Loft(Options={Adjust=False, Closed=False, LoftEnds=0, LoftSimp=0, LoftType=0, Rebuild=10, Refit=0.01})
pipe = Pipe(Radius=1, Caps=0)
extrude_linear = ExtrudeLinear(OrientationP=PlaneXY(0, 0, 0))
extrude_along = ExtrudeAlong()
extrude_point = ExtrudePoint()
patch = Patch(Spans=20, Flexibility=1, Trim=True)
bounding_box = BoundingBox(Plane=PlaneXY(0, 0, 0))  # -> Box, Box_2
cylinder = Cylinder(Base=PlaneXY(0, 0, 0), Radius=0.5, Length=1)
plane_surface = PlaneSurface(Plane=PlaneXY(0, 0, 0), XSize=Domain(-10, 10), YSize=Domain(-10, 10))
quad_sphere = QuadSphere(Base=PlaneXY(0, 0, 0), Radius=1)
sphere = Sphere(Base=PlaneXY(0, 0, 0), Radius=1)
cone = Cone(Base=PlaneXY(0, 0, 0), Radius=0.5, Length=1)  # -> Cone, Tip
center_box = CenterBox(Base=PlaneXY(0, 0, 0), X=1, Y=1, Z=1)
bounding_box_2 = BoundingBox(Plane=PlaneXY(0, 0, 0), UnionBox=True)  # -> Box, Box_2
plane_through_shape = PlaneThroughShape(Inflate=1, SectionLogic=False)
multipipe_2 = MultiPipe(NodeSize=0.5, EndOffset=1, StrutSize=1, Segment=0, KinkAngle=0.6, CubeFit=0, Caps=0)
subd_fuse_2 = SubDFuse(BooleanOption=0, Smoothing=10)
subd_from_mesh_2 = SubDFromMesh(Creases=1, Corners=1, Interpolate=False)
mesh_from_subd_2 = MeshFromSubD(Density=2)
subd_control_polygon_2 = SubDControlPolygon()
subd_edges_2 = SubDEdges(NewFormatting=False)  # -> Line, Edge, Tag, Id
divide_surface = DivideSurface(UCount=10, VCount=10)  # -> Points, Normals, Parameters
offset_surface = OffsetSurface(Distance=0, Retrim=True)
isotrim = Isotrim()
flip = Flip()  # -> Surface, Result
fillet_edge = FilletEdge(Blend=0, Metric=0)
brep_join = BrepJoin()  # -> Breps, Closed
cap_holes = CapHoles()
surface_frames = SurfaceFrames(UCount=10, VCount=10)  # -> Frames, Parameters

# ----
# 009_Mesh
# Tiangulation
# Primitive
# Analysis
# Utilities
mesh_area_2 = MeshArea()  # -> Area, Centroid
mesh_edges_2 = MeshEdges()  # -> NakedEdges, InteriorEdges, NonManifoldEdges
mesh_convertquads_2 = MeshConvertQuads(ShortDiagonal=True)  # -> Mesh, Split
mesh_triangulate_2 = MeshTriangulate(ShortDiagonal=True)
mesh_eval_2 = MeshEval()  # -> Point, Normal, Colour
mesh_closest_point_2 = MeshClosestPoint()  # -> Point, Index, Parameter
face_normals_2 = FaceNormals()  # -> Centers, Normals
mesh_nakededge_2 = MeshNakedEdge()  # -> V, A, B
mesh_volume_2 = MeshVolume()  # -> Volume, Centroid
face_boundaries_2 = FaceBoundaries()
mesh_explode_2 = MeshExplode(Interpolate=False)
deconstruct_mesh_2 = DeconstructMesh()  # -> Vertices, Faces, Colours, Normals
deconstruct_face_2 = DeconstructFace()  # -> CornerA, CornerB, CornerC, CornerD
mesh_inclusion_2 = MeshInclusion(Strict=False)
mesh_quad_2 = MeshQuad(CornerA=0, CornerB=1, CornerC=2, CornerD=3)
mesh_plane_2 = MeshPlane(Boundary={Plane=PlaneXY(0, 0, 0), Size=Domain2(u=-10..10, v=-10..10)}, WidthCount=10, HeightCount=10)  # -> Mesh, Area
mesh_sphere_2 = MeshSphere(Base=PlaneXY(0, 0, 0), Radius=10, UCount=10, VCount=20)
mesh_box_2 = MeshBox(Base={Plane=PlaneXY(0, 0, 0), X=Domain(-10, 10), Y=Domain(-10, 10), Z=Domain(-10, 10)}, XCount=10, YCount=10, ZCount=10)
construct_mesh_2 = ConstructMesh(Vertices=[Point(0, 0, 0), Point(10, 0, 0), Point(10, 10, 0), Point(0, 10, 0)], Faces={A=0, B=1, C=2, D=3})
mesh_sphere_ex_2 = MeshSphereEx(Base=PlaneXY(0, 0, 0), Radius=10, Count=5)
mesh_triangle_2 = MeshTriangle(CornerA=0, CornerB=1, CornerC=2)
mesh_colours_2 = MeshColours(Colours=[RGB(127, 255, 0), RGB(0, 100, 0), RGB(34, 139, 34), RGB(124, 252, 0), RGB(154, 205, 50), RGB(173, 255, 47), RGB(50, 205, 50), RGB(152, 251, 152)])
mesh_spray_2 = MeshSpray(SprayMode=11)
metaball_2 = MetaBall(Plane=PlaneXY(0, 0, 0))
voronoi_3 = Voronoi(BruteForceOverride=False)
delaunay_edges_2 = DelaunayEdges(Plane=PlaneXY(0, 0, 0))  # -> Connectivity, Edges
delaunay_mesh_2 = DelaunayMesh(Plane=PlaneXY(0, 0, 0))
octree_3 = OcTree(Square=False, Group=5)  # -> Boxes, Points
metaball_t_4 = MetaBallT(Plane=PlaneXY(0, 0, 0), Threshold=0.5)
voronoi_3d_3 = Voronoi3D()  # -> Cells, Boundary
metaball_t_custom_3 = MetaBallTCustom(Plane=PlaneXY(0, 0, 0), Threshold=0.5)
convex_hull_2 = ConvexHull(Plane=PlaneXY(0, 0, 0))  # -> Hull, HullZ, Indices
delete_faces_2 = DeleteFaces()
mesh_surface_2 = MeshSurface(UCount=5, VCount=5, Overhang=True, Equalize=False)
cull_faces_2 = CullFaces()
mesh_brep_2 = MeshBrep(Settings={GridMaxCount=0, GridMinCount=16, JaggedSeams=False, MaxEdgeLength=0, MinEdgeLength=0.0001, MinTolerance=0, Refine=True, RefineAngle=0, RelativeTolerance=0.65, SimplePlanes=True, Tolerance=0})
unweld_mesh_2 = UnweldMesh(Angle=1.570796327)
mesh_shadow_2 = MeshShadow(Light=Vector(0, 0, -1), Plane=PlaneXY(0, 0, 0))
mesh_join_2 = MeshJoin()
delete_vertices_2 = DeleteVertices(Shrink=True)
cull_vertices_2 = CullVertices(Shrink=True)
weld_mesh_2 = WeldMesh(Angle=3.141592654)
flip_mesh_2 = FlipMesh(VertexNormals=True, FaceNormals=True, FaceOrientation=True)
mesh_weldvertices_2 = MeshWeldVertices(Tolerance=0.01)  # -> RuntimeMessage, Mesh
mesh_frompoints_2 = MeshFromPoints()
occlusion_2 = Occlusion()  # -> Hits, Occlusion
simple_mesh_2 = SimpleMesh()
mesh_unifynormals_2 = MeshUnifyNormals()
quadrangulate_2 = Quadrangulate(Angle=0.03490658504, Ratio=0.875)  # -> Mesh, Count
triangulate_2 = Triangulate()  # -> Mesh, Count
mesh_flip_2 = MeshFlip()

# ----
# 010_Intersect
# Physical
# Region
# Mathematical
# Shape
contour = Contour(Point=Point(0, 0, 0), Direction=Vector(0, 0, 1))
isovist = IsoVist(Count=10, Radius=100)  # -> Points, Distance, Index
curve_plane = CurvePlane()  # -> Points, ParamsC, ParamsP
line_line_2 = LineLine()  # -> ParamA, ParamB, PointA, PointB
mesh_ray = MeshRay()  # -> Point, Hit
plane_region = PlaneRegion(Plane=PlaneXY(0, 0, 0))
brep_plane = BrepPlane(Plane=PlaneXY(0, 0, 0))  # -> Curves, Points
mesh_plane_3 = MeshPlane()
plane_plane = PlanePlane()
brep_line = BrepLine(LimitToFirst=False)  # -> Curves, Points
surface_line = SurfaceLine(LimitToFirst=False)  # -> Curves, Points, UVPoints, Normal
isovist_ray = IsoVistRay(Radius=100)  # -> Point, Distance, Index
plane_plane_plane = PlanePlanePlane()  # -> Point, LineAB, LineAC, LineBC
mesh_mesh = MeshMesh()
surface_split = SurfaceSplit()
curve_curve = CurveCurve()  # -> Points, ParamsA, ParamsB
multiple_curves = MultipleCurves()  # -> Points, IndexA, IndexB, ParamA, ParamB
brep_brep = BrepBrep()  # -> Curves, Points
brep_curve = BrepCurve()  # -> Curves, Points
mesh_curve = MeshCurve()  # -> Points, Faces
surface_curve = SurfaceCurve()  # -> Curves, Points, UVPoints, Normals, Parameters, Tangents
curve_self = CurveSelf()  # -> Points, Params
trim_with_region = TrimWithRegion()  # -> Inside, Outside
trim_with_brep = TrimWithBrep()  # -> Inside, Outside
split_with_brep = SplitWithBrep()  # -> Curve, Points
trim_with_regions = TrimWithRegions()  # -> Inside, Outside
split_with_breps = SplitWithBreps()  # -> Curve, Points
trim_with_breps = TrimWithBreps()  # -> Inside, Outside
boundary_volume = BoundaryVolume()
mesh_difference = MeshDifference()
mesh_intersection = MeshIntersection()
region_difference = RegionDifference()
region_intersection = RegionIntersection()
mesh_split = MeshSplit()
solid_difference = SolidDifference()
solid_intersection = SolidIntersection()
mesh_union = MeshUnion()
trim_solid = TrimSolid()
region_union = RegionUnion()
split_brep = SplitBrep()
solid_union = SolidUnion()
split_brep_multiple = SplitBrepMultiple()

# ----
# 011_Transformations
# Array
# Morph
# Euclidean
# Utility
# Affine
scale = Scale(Center=Point(0, 0, 0), Factor=0.5)  # -> Geometry, Transform
scale_nu = ScaleNU(Plane=PlaneXY(0, 0, 0), ScaleX=1, ScaleY=1, ScaleZ=1)  # -> Geometry, Transform
project_2 = Project(Plane=PlaneXY(0, 0, 0))  # -> Geometry, Transform
project_along = ProjectAlong(Plane=PlaneXY(0, 0, 0), Direction=Vector(0, 0, -1))  # -> Geometry, Transform
orient_direction = OrientDirection(PointA=Point(0, 0, 0), DirectionA=Vector(0, 0, 1), PointB=Point(0, 0, 0), DirectionB=Vector(0, 0, 1))  # -> Geometry, Transform
camera_obscura = CameraObscura(Point=Point(0, 0, 0), Factor=1)  # -> Geometry, Transform
box_mapping = BoxMapping()  # -> Geometry, Transform
rectangle_mapping = RectangleMapping()  # -> Geometry, Transform
triangle_mapping = TriangleMapping()  # -> Geometry, Transform
box_array = BoxArray(Cell={Plane=PlaneXY(0, 0, 0), X=Domain(0, 10), Y=Domain(0, 5), Z=Domain(0, 2)}, XCount=4, YCount=3, ZCount=2)  # -> Geometry, Transform
curve_array = CurveArray(Count=10)  # -> Geometry, Transform
linear_array = LinearArray(Direction=Vector(10, 0, 0), Count=10)  # -> Geometry, Transform
polar_array = PolarArray(Plane=PlaneXY(0, 0, 0), Count=10, Angle=6.283185307)  # -> Geometry, Transform
rectangular_array = RectangularArray(Cell={Plane=PlaneXY(0, 0, 0), Size=Domain2(u=0..10, v=0..5)}, XCount=6, YCount=3)  # -> Geometry, Transform
kaleidoscope = Kaleidoscope(Plane=PlaneXY(0, 0, 0), Segments=10)  # -> Geometry, Transform
mirror = Mirror(Plane=PlaneYZ(0, 0, 0))  # -> Geometry, Transform
move = Move(Motion=Vector(0, 0, 10))  # -> Geometry, Transform
orient = Orient(Source=PlaneXY(0, 0, 0), Target=PlaneXY(0, 0, 0))  # -> Geometry, Transform
move_to_plane = MoveToPlane(Plane=PlaneXY(0, 0, 0), Above=True, Below=True)  # -> Geometry, Transform
rotate_2 = Rotate(Angle=1.570796327, Plane=PlaneXY(0, 0, 0))  # -> Geometry, Transform
rotate_3d = Rotate3D(Angle=1.570796327, Center=Point(0, 0, 0), Axis=Vector(0, 0, 1))  # -> Geometry, Transform
rotate_axis = RotateAxis(Angle=1.570796327, Axis=Line((0, 0, 0), (10, 0, 0)))  # -> Geometry, Transform
rotate_direction = RotateDirection(Center=Point(0, 0, 0), From=Vector(1, 0, 0), To=Vector(0, 1, 0))  # -> Geometry, Transform
flow = Flow(ReverseBase=False, ReverseTarget=False, Stretch=True, Rigid=False)
bend_deform = BendDeform()
twisted_box = TwistedBox()
surface_morph = SurfaceMorph()
splop = Splop(Plane=PlaneXY(0, 0, 0), Angle=0, Rigid=False)
sporph = Sporph(Rigid=False)
box_morph = BoxMorph()
maelstrom = Maelstrom(Plane=PlaneXY(0, 0, 0), First=0.1, Second=10, Angle=1.570796327, Rigid=False)
stretch = Stretch(Axis=Line((0, 0, 0), (10, 10, 0)), Length=20, Rigid=False)
twist = Twist(Angle=1.570796327, Infinite=False, Rigid=False)
transform_matrix = TransformMatrix(Digits=3)
inverse_transform = InverseTransform()
transform = Transform()
merge_group = MergeGroup()
group = Group()
split_group = SplitGroup(Wrap=False)  # -> GroupA, GroupB
ungroup = Ungroup()
compound = Compound()
split = Split()

# ----
# 012_Display
# Preview
# Vector
# Dimensions
make2d = Make2D(TangentEdges=False, TangentSeams=False, AutoComputeMake2D=False)  # -> VisibleCurves, VisibleIndex, VisibleType, HiddenCurves, HiddenIndex, HiddenType
make2d_parallel_view = Make2DParallelView()
make2d_perspective_view = Make2DPerspectiveView()
make2d_rhino_view = Make2DRhinoView(Clip=True)
text_tag_3d = TextTag3D(Size=1, Justification=7)
gradient_hatch = GradientHatch(Colour1=RGB(255, 20, 147), Colour2=RGB(139, 0, 139))
pattern_hatch = PatternHatch(Pattern=0, Scale=1, Angle=0)
aligned_dimension = AlignedDimension(Plane=PlaneXY(0, 0, 0), Offset=1, Text="{0:0.00}", Size=1)
angular_dimension = AngularDimension(Reflex=False, Text="{0:0.0}°", Size=1)
arc_dimension = ArcDimension(Offset=2, Text="{0:0.0}°", Size=1)
line_dimension = LineDimension(Text="{0:0.00}", Size=1)
angular_dimensions_mesh = AngularDimensionsMesh(Text="{0:0.0}°", Size=1, LengthFactor=0.5)
text_tag = TextTag()
linear_dimension = LinearDimension(Text="{0:0.00}", Size=1)
circular_dimension = CircularDimension(Text="{0:0.0}°", Size=1)
create_material = CreateMaterial(Diffuse=RGB(255, 105, 180), Specular=RGB(255, 255, 255), Emission=RGB(0, 0, 0), Transparency=0, Shine=0)
custom_preview = CustomPreview(Material={diffuse=RGB(221, 160, 221), emission=RGB(66, 48, 66), shine=0.5, specular=RGB(255, 255, 255), transparency=0})
vector_display = VectorDisplay()
point_list = PointList()
point_order = PointOrder()
vector_display_ex = VectorDisplayEx(Colour=RGB(0, 0, 0), Width=2)

# ==== cluster Remap: Remaps numbers
data = ClusterInput()
min = ClusterInput()
max = ClusterInput()
bnd = Bounds(Numbers=data)
dom = ConstructDomain(DomainStart=min, DomainEnd=max)
remap = RemapNumbers(Value=data, Source=bnd, Target=dom)  # -> Mapped, Clipped
R = ClusterOutput(remap.Mapped)
