# Grasshopper definition 015_exercises.gh (Grasshopper 1.0.7)
# plug-ins: Bifocals, Kangaroo2 Components, MeshEdit Components, MarchingCubes, Weaverbird

# ----
# Cellular Growth (Metaball - Cocoon - Voronoi - Weaverbird - Octree)
# 
# https://www.cs.cmu.edu/afs/cs.cmu.edu/academic/class/15394u-s20/lectures/weaverbird/weaverbird.html
# Metaball - Cocoon - Voronoi - Weaverbird - Octree - SubD
# 009_Mesh
# Create
# Define
# Extract
# Smoothen
# SubD
# Transform
mesh_area = MeshArea()  # -> Area, Centroid; disabled
mesh_edges = MeshEdges()  # -> NakedEdges, InteriorEdges, NonManifoldEdges; disabled
mesh_convertquads = MeshConvertQuads(ShortDiagonal=True)  # -> Mesh, Split; disabled
mesh_triangulate = MeshTriangulate(ShortDiagonal=True)  # disabled
mesh_eval = MeshEval()  # -> Point, Normal, Colour; disabled
mesh_closest_point = MeshClosestPoint()  # -> Point, Index, Parameter; disabled
# PLUGINS
# Lunchbox (panelization and structure creation)
# Data
# Generate
# Machine Learning (proving ground)
# Math
# Panels
# Structure
# Utilities
# Workflow
# Analysis
face_normals = FaceNormals()  # -> Centers, Normals; disabled
# Ladybug allows you to import and analyze
#  standard weather data in Grasshopper;
# draw diagrams like Sun-path, wind-rose,
#  radiation-rose, etc; customize the diagrams
#  in several ways; run radiation analysis,
# shadow studies, and view analysis.
# 
# Ladybug allows you to import and analyze
#  standard weather data in Grasshopper;
#  draw diagrams like Sun-path, wind-rose,
#  radiation-rose, etc; customize the diagrams
#  in several ways; run radiation analysis,
#  shadow studies, and view analysis.
# 
# Honeybee connects Grasshopper3D to
#  validated simulation engines such as
#  EnergyPlus/OpenStudio and Radiance for
#  building energy, comfort, daylighting and
#  lighting simulation.
# 
# Dragonfly enables the creation and
#  manipulation of large-scale EnergyPlus and
#  Radiance models by capitalizing on an
#  abstracted 2D representation of building
#  geometry, where all rooms are assumed to
#  be extrusions of floor plates.
# 
# Butterfly connects Grasshopper to the
#  OpenFOAM engine, wich can be used to
#  run advanced computational fluid dynamic
#  (CFD) simulations.
# Ladybug (environmental analysis)
# 
# https://www.food4rhino.com/en/app/ladybug-tools
# 
# all sample files depend on ghpython node
# which comes with Rhino 6/7
mesh_nakededge = MeshNakedEdge()  # -> V, A, B; disabled
mesh_volume = MeshVolume()  # -> Volume, Centroid; disabled
face_boundaries = FaceBoundaries()  # disabled
mesh_explode = MeshExplode(Interpolate=False)  # disabled
deconstruct_mesh = DeconstructMesh()  # -> Vertices, Faces, Colours, Normals; disabled
deconstruct_face = DeconstructFace()  # -> CornerA, CornerB, CornerC, CornerD; disabled
mesh_inclusion = MeshInclusion(Strict=False)  # disabled
mesh_quad = MeshQuad(CornerA=0, CornerB=1, CornerC=2, CornerD=3)  # disabled
mesh_plane = MeshPlane(Boundary={Plane=PlaneXY(0, 0, 0), Size=Domain2(u=-10..10, v=-10..10)}, WidthCount=10, HeightCount=10)  # -> Mesh, Area; disabled
mesh_sphere = MeshSphere(Base=PlaneXY(0, 0, 0), Radius=10, UCount=10, VCount=20)  # disabled
mesh_box = MeshBox(Base={Plane=PlaneXY(0, 0, 0), X=Domain(-10, 10), Y=Domain(-10, 10), Z=Domain(-10, 10)}, XCount=10, YCount=10, ZCount=10)  # disabled
# Primitive
construct_mesh = ConstructMesh(Vertices=[Point(0, 0, 0), Point(10, 0, 0), Point(10, 10, 0), Point(0, 10, 0)], Faces={A=0, B=1, C=2, D=3})  # disabled
mesh_sphere_ex = MeshSphereEx(Base=PlaneXY(0, 0, 0), Radius=10, Count=5)  # disabled
mesh_triangle = MeshTriangle(CornerA=0, CornerB=1, CornerC=2)  # disabled
mesh_colours = MeshColours(Colours=[RGB(127, 255, 0), RGB(0, 100, 0), RGB(34, 139, 34), RGB(124, 252, 0), RGB(154, 205, 50), RGB(173, 255, 47), RGB(50, 205, 50), RGB(152, 251, 152)])  # disabled
mesh_spray = MeshSpray(SprayMode=11)  # disabled
metaball = MetaBall(Plane=PlaneXY(0, 0, 0))  # disabled
voronoi = Voronoi(BruteForceOverride=False)  # disabled
# Tiangulation
delaunay_edges = DelaunayEdges(Plane=PlaneXY(0, 0, 0))  # -> Connectivity, Edges; disabled
delaunay_mesh = DelaunayMesh(Plane=PlaneXY(0, 0, 0))  # disabled
octree = OcTree(Square=False, Group=5)  # -> Boxes, Points; disabled
metaball_t = MetaBallT(Plane=PlaneXY(0, 0, 0), Threshold=0.5)  # disabled
voronoi_3d = Voronoi3D()  # -> Cells, Boundary; disabled
metaball_t_custom = MetaBallTCustom(Plane=PlaneXY(0, 0, 0), Threshold=0.5)  # disabled
convex_hull = ConvexHull(Plane=PlaneXY(0, 0, 0))  # -> Hull, HullZ, Indices; disabled
delete_faces = DeleteFaces()  # disabled
mesh_surface = MeshSurface(UCount=5, VCount=5, Overhang=True, Equalize=False)  # disabled
cull_faces = CullFaces()  # disabled
# Utilities
mesh_brep = MeshBrep(Settings={GridMaxCount=0, GridMinCount=16, JaggedSeams=False, MaxEdgeLength=0, MinEdgeLength=0.0001, MinTolerance=0, Refine=True, RefineAngle=0, RelativeTolerance=0.65, SimplePlanes=True, Tolerance=0})  # disabled
unweld_mesh = UnweldMesh(Angle=1.570796327)  # disabled
mesh_shadow = MeshShadow(Light=Vector(0, 0, -1), Plane=PlaneXY(0, 0, 0))  # disabled
mesh_join = MeshJoin()  # disabled
delete_vertices = DeleteVertices(Shrink=True)  # disabled
cull_vertices = CullVertices(Shrink=True)  # disabled
weld_mesh = WeldMesh(Angle=3.141592654)  # disabled
flip_mesh = FlipMesh(VertexNormals=True, FaceNormals=True, FaceOrientation=True)  # disabled
mesh_weldvertices = MeshWeldVertices(Tolerance=0.01)  # -> RuntimeMessage, Mesh; disabled
mesh_frompoints = MeshFromPoints()  # disabled
occlusion = Occlusion()  # -> Hits, Occlusion; disabled
simple_mesh = SimpleMesh()  # disabled
mesh_unifynormals = MeshUnifyNormals()  # disabled
quadrangulate = Quadrangulate(Angle=0.03490658504, Ratio=0.875)  # -> Mesh, Count; disabled
triangulate = Triangulate()  # -> Mesh, Count; disabled
mesh_flip = MeshFlip()  # disabled
metaball_t_custom_2 = MetaBallTCustom(Plane=PlaneXY(0, 0, 0), Threshold=0.5)  # disabled
metaball_t_2 = MetaBallT(Plane=PlaneXY(0, 0, 0), Threshold=0.5)  # disabled
metaball_t_3 = MetaBallT(Plane=PlaneXY(0, 0, 0), Threshold=0.5)  # disabled
curve_charge = CurveCharge()  # disabled
curve_group_charge = CurveGroupCharge()  # disabled
point_charge = PointCharge()  # disabled
brep_charge = BrepCharge()  # disabled
refine = Refine()  # disabled
# Panelling Tools
# Curve
# Grid
# Grid Attractors
# Grid Utility
# Panel 2D
# Panel 3D
# Panel Utility
# Param
cocoon = Cocoon(Simple=False)  # -> Mesh, RefinementData; disabled
_3d_voronoi = _3DVoronoi()  # -> _3DVoronoiCells, Connectivity; disabled
voronoi_groups = VoronoiGroups(Boundary={Plane=PlaneXY(0, 0, 0), Size=Domain2(u=-10..10, v=-10..10)})  # -> Diagram1, Diagram2; disabled
voronoi_3d_2 = Voronoi3D()  # -> Cells, Boundary; disabled
voronoi_cell = VoronoiCell()  # disabled
voronoi_2 = Voronoi(BruteForceOverride=False)  # disabled
weaverbird_s_tile = WeaverbirdsTile(FillStrategy=1, OptIn=2)  # disabled
weaverbird_s_mesh_from_lines_weave_back = WeaverbirdsMeshFromLinesWeaveBack(MaximumValence=4)  # disabled
quad_remesh_settings = QuadRemeshSettings(TargetCount=1000, AdaptiveSize=0, AdaptiveCount=False, HardEdges=False, SeamEdges=0, Symmetry=0, GuideCurves=0)  # disabled
quad_remesh = QuadRemesh(Settings={aqc=True, as=50, dhe=True, gci=0, null=False, pme=0, sa=0, tqc=2000})  # disabled
octree_2 = OcTree(Square=False, Group=5)  # -> Boxes, Points; disabled
quadtree = QuadTree(Plane=PlaneXY(0, 0, 0), Square=False, Group=5)  # -> Quads, Points; disabled
subd_fuse = SubDFuse(BooleanOption=0, Smoothing=10)  # disabled
subd_from_mesh = SubDFromMesh(Creases=1, Corners=1, Interpolate=False)  # disabled
multipipe = MultiPipe(NodeSize=0.5, EndOffset=1, StrutSize=1, Segment=0, KinkAngle=0.6, CubeFit=0, Caps=0)  # disabled
mesh_from_subd = MeshFromSubD(Density=2)  # disabled
subd_control_polygon = SubDControlPolygon()  # disabled
subd_edges = SubDEdges(NewFormatting=False)  # -> Line, Edge, Tag, Id; disabled

# ----
# EXERCISES
# 001_params_geometry
# - generate objects in the rhino environment
# - set single and multiple objects into gh containers
# - activate the geometry pipeline
# - preview
# - enable
# - set geometries and objects
# - internalize
# - extract
point = Point()  # disabled
vector = Vector()  # disabled
brep = Brep()  # disabled
mesh = Mesh()  # disabled
curve = Curve()  # disabled
line = Line()  # disabled
plane = Plane()  # disabled
surface = Surface()  # disabled
geometry = Geometry()  # disabled
# Ladybug allows you to import and analyze
#  standard weather data in Grasshopper;
# draw diagrams like Sun-path, wind-rose,
#  radiation-rose, etc; customize the diagrams
#  in several ways; run radiation analysis,
# shadow studies, and view analysis.
# PanelingTools for Rhino and Grasshopper
#  by Robert McNeel & Associates is widely
#  used by designers, architects, and building
#  professionals. It supports intuitive design of
#  paneling concepts as well as help
#  rationalize complex geometry into a format
#  that is suitable for analysis and fabrication.
# Kangaroo is a Live Physics engine for
# interactive simulation, form-finding,
#  optimization and constraint solving.
# ghPython
# This is the Rhino 5 for Windows version.
#  Rhino for Mac and Rhino WIP+6 all come
#  with their own GhPython interpreter, that is
#  specific and needs no tweaking.
# Galapogos
# goat is an optimization add-on component
#  for Rhino's Grasshopper. It perfectly
#  complements galapagos, David Rutten's
#  evolutionary solver. Relying on gradient-free
#  optimization algorithms, the component
# pursues a mathematical rigorous approach
#  delivering fast and deterministic results. At
# every run, goat will yield the same optimal
#  result.
geometry_2 = Geometry()  # disabled
geometry_pipeline = GeometryPipeline(
    GroupByLayer=False,
    GroupByType=False,
    IncludeHidden=True,
    IncludeLocked=True,
    LayerFilter="*",
    NameFilter="*",
    SublayerFiltering=True,
    TypeFilter=1073741885)  # disabled

# ----
# Kangaroo - Galapagos (form finding)
# Kangaroo is a Live Physics engine for
# interactive simulation, form-finding,
#  optimization and constraint solving.
solver = Solver(Reset=False, Threshold=1e-15, Tolerance=0.0001, On=True)  # -> I, V, O; disabled
gene_pool = GenePool(Decimals=2, Maximum=100, Minimum=0, Value=[50, 50, 50, 50, 50, 50, 50, 50, 50, 50])  # disabled
fitness_landscape = FitnessLandscape(Count=-1, ColourMode=1, ContourMode=2, Remap=False)  # disabled
galapagos = Galapagos()

# ----
# 002_params_inputs
# - edit/edit snapping/animate on number slider
# - shortcuts to setting sliders
# - input/output features of panel tool
# - multiline data/wire display in panel node
# - shortcuts for setting panel data
# - toggle boolean and consider output
# - lt double click MD slider and set domains
# - apply to surface evaluation
# - reparametize surface
#  - reset MD slider settings
# - construct point and consider x and y values
# - set values list
# - play with display options
# - careful on strings
# - lt click and set color swatch
# - lt double click graph mapper and
# consider domain settings
# - set graph types
# - set graph mapper domain to match your domain
# - generate points and curves
number_slider = Slider(36, range=0..100)  # disabled
number_slider_2 = Slider(100, range=0..100)  # disabled
number_slider_3 = Slider(12, range=0..100)  # disabled
number_slider_4 = Slider(12, range=0..100)  # disabled
number_slider_5 = Slider(0.25, range=0..1)  # disabled
number_slider_6 = Slider(0.52, range=0..1)  # disabled
number_slider_7 = Slider(0.38, range=0..1)  # disabled
md_slider = MDSlider(
    SliderMode=0,
    slider_value=Point(0.5813018054, 0.5129692264, 0.5),
    x_domain=Domain(0, 1),
    y_domain=Domain(0, 1),
    z_domain=Domain(0, 1))  # disabled
boolean_toggle = BooleanToggle(False)  # disabled
sphere = Sphere(Base=PlaneXY(0, 0, 0), Radius=number_slider)  # disabled
value_list = ValueList({"One": 1, "Two": 2, "Three": 2² - 12, "Four": Sqrt(100), "Five": "red", "Six": "blue"}, selected="Six")  # disabled
quad_sphere = QuadSphere(Base=PlaneXY(0, 0, 0), Radius=number_slider)  # disabled
colour_swatch = ColourSwatch(SwatchColor=RGB(77, 169, 255))  # disabled
construct_domain = ConstructDomain(DomainStart=number_slider_4, DomainEnd=number_slider_2)  # disabled
panel = Panel(boolean_toggle)  # disabled
range = Range(Domain=construct_domain, Steps=number_slider_3)  # disabled
panel_2 = Panel(value_list)  # disabled
evaluate_surface = EvaluateSurface(Surface=reparameterize(sphere), Point=md_slider)  # -> Point, Normal, UDirection, VDirection, Frame; disabled
construct_point = ConstructPoint(XCoordinate=number_slider_6, YCoordinate=number_slider_7, ZCoordinate=0)  # disabled
deconstruct_brep = DeconstructBrep(Brep=quad_sphere)  # -> Faces, Edges, Vertices; disabled
graph_mapper = GraphMapper(
    range,
    x0=0,
    x1=100,
    y0=0,
    y1=100,
    container_name="Bezier",
    cpx=[0, 0.1654530466, 1, 1],
    cpy=[0, 0.7908847332, 0.366101265, 1])  # disabled
evaluate_surface_2 = EvaluateSurface(Surface=reparameterize(deconstruct_brep.Faces), Point=construct_point)  # -> Point, Normal, UDirection, VDirection, Frame; disabled
construct_point_2 = ConstructPoint(XCoordinate=range, YCoordinate=graph_mapper, ZCoordinate=0)  # disabled
interpolate = Interpolate(Vertices=construct_point_2, Degree=3, Periodic=False, KnotStyle=1)  # -> Curve, Length, Domain; disabled

# ----
# - lt double click image sampler
# - consider tyhe domains
# - set image
# - set to black and white
# - interpolate
# 
# tutorial online:
# https://www.youtube.com/watch?v=HZzj-d68zCI
# 
# - bring image into grasshopper
# with imgage import and path
# - create bounding box
# - walk through script
# - turn on mesh lines in display
# 
# Consider a circle on every point
# - note interpolate option reduces noise
# - consider displacements
# - custom previews
# - attractor points
# - assign rotations to other geometries
# - into manufacturing...etc.
number_slider_8 = Slider(12, range=0..100)  # disabled
number_slider_9 = Slider(12, range=0..100)  # disabled
file_path = FilePath("C:\Users\Sculpture\Documents\2020Grasshopper\ghfiles2019\January2019\GrassHooperRhino\Image Sampler\10933805_828435007199774_4643817663222164453_n.jpg")  # disabled
number_slider_10 = Slider(12, range=0..100)  # disabled
number_slider_11 = Slider(12, range=0..100)  # disabled
number_slider_12 = Slider(12, range=0..100)  # disabled
number_slider_13 = Slider(12, range=0..100)  # disabled
file_path_2 = FilePath("C:\Users\Sculpture\Documents\2020Grasshopper\ghfiles2019\January2019\GrassHooperRhino\Image Sampler\10933805_828435007199774_4643817663222164453_n.jpg")  # disabled
file_path_3 = FilePath("C:\Users\Sculpture\Documents\2020Grasshopper\ghfiles2019\January2019\GrassHooperRhino\Image Sampler\10933805_828435007199774_4643817663222164453_n.jpg")  # disabled
import_image = ImportImage(File=file_path)  # disabled
import_image_2 = ImportImage(File=file_path_3)  # disabled
import_image_3 = ImportImage(File=file_path_2)  # disabled
bounding_box = BoundingBox(Content=import_image, Plane=PlaneXY(0, 0, 0))  # -> Box, Box_2; disabled
bounding_box_2 = BoundingBox(Content=import_image_2, Plane=PlaneXY(0, 0, 0))  # -> Box, Box_2; disabled
bounding_box_3 = BoundingBox(Content=import_image_3, Plane=PlaneXY(0, 0, 0))  # -> Box, Box_2; disabled
deconstruct_brep_2 = DeconstructBrep(Brep=bounding_box.Box)  # -> Faces, Edges, Vertices; disabled
deconstruct_brep_3 = DeconstructBrep(Brep=bounding_box_2.Box)  # -> Faces, Edges, Vertices; disabled
deconstruct_brep_4 = DeconstructBrep(Brep=bounding_box_3.Box)  # -> Faces, Edges, Vertices; disabled
number_slider_14 = Slider(100, range=0..100)  # disabled
dimensions = Dimensions(Surface=deconstruct_brep_2.Faces)  # -> UDimension, VDimension; disabled
number_slider_15 = Slider(200, range=0..200)  # disabled
number_slider_16 = Slider(200, range=0..200)  # disabled
dimensions_2 = Dimensions(Surface=deconstruct_brep_3.Faces)  # -> UDimension, VDimension; disabled
dimensions_3 = Dimensions(Surface=deconstruct_brep_4.Faces)  # -> UDimension, VDimension; disabled
division = Division(A=dimensions.UDimension, B=dimensions.VDimension)  # disabled
division_2 = Division(A=dimensions_2.UDimension, B=dimensions_2.VDimension)  # disabled
division_3 = Division(A=dimensions_3.UDimension, B=dimensions_3.VDimension)  # disabled
multiplication = Multiplication(A=division, B=number_slider_14)  # disabled
multiplication_2 = Multiplication(A=division_2, B=number_slider_16)  # disabled
multiplication_3 = Multiplication(A=division_3, B=number_slider_15)  # disabled
number_slider_17 = Slider(1, range=0..1)  # disabled
number_slider_18 = Slider(1, range=0..1)  # disabled
number_slider_19 = Slider(1, range=0..1)  # disabled
integer = Integer(multiplication)  # disabled
integer_2 = Integer(multiplication_3)  # disabled
integer_3 = Integer(multiplication_2)  # disabled
one_over_x = OneOverX(Value=integer)  # disabled
one_over_x_2 = OneOverX(Value=integer)  # disabled
one_over_x_3 = OneOverX(Value=integer_3)  # disabled
one_over_x_4 = OneOverX(Value=integer_3)  # disabled
one_over_x_5 = OneOverX(Value=integer_2)  # disabled
one_over_x_6 = OneOverX(Value=integer_2)  # disabled
rectangular = Rectangular(Plane=PlaneXY(0, 0, 0), SizeX=one_over_x_2, SizeY=one_over_x, ExtentX=integer, ExtentY=number_slider_14)  # -> Cells, Points; disabled
rectangular_2 = Rectangular(Plane=PlaneXY(0, 0, 0), SizeX=one_over_x_4, SizeY=one_over_x_3, ExtentX=integer_3, ExtentY=number_slider_16)  # -> Cells, Points; disabled
rectangular_3 = Rectangular(Plane=PlaneXY(0, 0, 0), SizeX=one_over_x_6, SizeY=one_over_x_5, ExtentX=integer_2, ExtentY=number_slider_15)  # -> Cells, Points; disabled
deconstruct = Deconstruct(Point=rectangular.Points)  # -> XComponent, YComponent, ZComponent; disabled
deconstruct_2 = Deconstruct(Point=rectangular_2.Points)  # -> XComponent, YComponent, ZComponent; disabled
deconstruct_3 = Deconstruct(Point=rectangular_3.Points)  # -> XComponent, YComponent, ZComponent; disabled
rectangular_4 = Rectangular(Plane=PlaneXY(0, 0, 0), SizeX=number_slider_17, SizeY=number_slider_17, ExtentX=integer, ExtentY=number_slider_14)  # -> Cells, Points; disabled
rectangular_5 = Rectangular(Plane=PlaneXY(0, 0, 0), SizeX=number_slider_19, SizeY=number_slider_19, ExtentX=integer_3, ExtentY=number_slider_16)  # -> Cells, Points; disabled
rectangular_6 = Rectangular(Plane=PlaneXY(0, 0, 0), SizeX=number_slider_18, SizeY=number_slider_18, ExtentX=integer_2, ExtentY=number_slider_15)  # -> Cells, Points; disabled
number_slider_20 = Slider(0.25, range=0..1)  # disabled
image_sampler = ImageSampler(
    rectangular.Points,
    FilePath="C:\Users\Sculpture\Documents\2020Grasshopper\ghfiles2019\January2019\GrassHooperRhino\Image Sampler\10933805_828435007199774_4643817663222164453_n.jpg",
    Filter="Value",
    Interpolate=True,
    Umax=1,
    Umin=0,
    Vmax=1,
    Vmin=0,
    Wrap=1)  # disabled
image_sampler_2 = ImageSampler(
    rectangular_3.Points,
    FilePath="C:\Users\Sculpture\Documents\2020Grasshopper\ghfiles2019\January2019\GrassHooperRhino\Image Sampler\10933805_828435007199774_4643817663222164453_n.jpg",
    Filter="Value",
    Interpolate=True,
    Umax=1,
    Umin=0,
    Vmax=1,
    Vmin=0,
    Wrap=1)  # disabled
image_sampler_3 = ImageSampler(
    rectangular_2.Points,
    FilePath="C:\Users\Sculpture\Documents\2020Grasshopper\ghfiles2019\January2019\GrassHooperRhino\Image Sampler\10933805_828435007199774_4643817663222164453_n.jpg",
    Filter="Value",
    Interpolate=True,
    Umax=1,
    Umin=0,
    Vmax=1,
    Vmin=0,
    Wrap=1)  # disabled
bounds = Bounds(Numbers=flatten(deconstruct.XComponent))  # disabled
bounds_2 = Bounds(Numbers=flatten(deconstruct_2.XComponent))  # disabled
bounds_3 = Bounds(Numbers=flatten(deconstruct_3.XComponent))  # disabled
panel_3 = Panel("12")  # disabled
panel_4 = Panel(".5")  # disabled
multiplication_4 = Multiplication(A=image_sampler, B=panel_3)  # disabled
panel_5 = Panel(image_sampler)  # disabled
panel_6 = Panel(bounds)  # disabled
panel_7 = Panel(image_sampler_2)  # disabled
panel_8 = Panel(image_sampler_3)  # disabled
panel_9 = Panel(bounds_2)  # disabled
expression = Expression(x=image_sampler_3, y=number_slider_20, Expression="if(x>y,True,False)")  # disabled
panel_10 = Panel(bounds_3)  # disabled
unit_z = UnitZ(Factor=multiplication_4)  # disabled
multiplication_5 = Multiplication(A=image_sampler_2, B=panel_4)  # disabled
move = Move(Geometry=rectangular_4.Points, Motion=unit_z)  # -> Geometry, Transform; disabled
cull_pattern = CullPattern(List=rectangular_5.Points, CullPattern=expression)  # disabled
cull_pattern_2 = CullPattern(List=image_sampler_3, CullPattern=expression)  # disabled
circle = Circle(Plane=rectangular_6.Points, Radius=multiplication_5)  # disabled
panel_11 = Panel(".5")  # disabled
multiplication_6 = Multiplication(A=panel_11, B=cull_pattern_2)  # disabled
surface_from_points = SurfaceFromPoints(Points=flatten(move.Geometry), UCount=expr("x+1", integer), Interpolate=False)  # disabled
circle_2 = Circle(Plane=cull_pattern, Radius=multiplication_6)  # disabled

# ----
# MGSM
# Grasshopper for Rhino3D
# http://grasshopperdocs.com/
# https://www.food4rhino.com/en
# 002_ribbon_vanilla_grasshopper
# 003_Params
# 001_Introduction
# Vanilla Grasshopper
# Data Trees
# Ladybug
# Weaverbird
# FireFly
# Lunchbox
# Pufferfish
# Hal/Kuka/Robotics/tocoABB
# Paneling tools
# Kangaroo
# fologram
# Galapogos
# ghpython
# ghpython remote
# C#
# Grasshopper Canvas for Rhino3D:
# 
# Ribbon:
# 
# File
# - new/open
# - save document/saveas
# - export image
# - document properties
# - user objects/ clusters
# - special folders (components/user objects)
# - preferences
# Ribbon Vanilla Grasshopper
# 
# Params
# Maths
# Sets - data trees
# Vectors
# Curves
# Surfaces
# IntersectionTransformations
# Display
# Containers:
# Geometry/Primitives
# Meshedit is a set of components which
#  extend Grasshopper's ability to work with
#  meshes.
# Utilities:
# Inputs:
# Hal/Kuka/Robotics/tocoABB
# KUKA|prc enables you to program
#  industrial
#  robots directly out of the parametric
#  modelling environment, including a full
#  kinematic simulation of the robot. The
#  generated files can be executed at the
#  KUKA robot, without requiring any additional
#  software.
# Components:
point_2 = Point()  # disabled
curve_2 = Curve()  # disabled
line_2 = Line()  # disabled
# fologram
# Use Fologram to view and share Rhino and
# Grasshopper instantly in mixed reality on
# HoloLens 1, HoloLens 2, Oculus Quest, iOS
#  and Android. Geometry, layers and
# grasshopper parameters can be edited in
# real time in Fologram to create powerful
# tools for design, communication,
# collaboration and fabrication.
surface_2 = Surface()  # disabled
vector_2 = Vector()  # disabled
plane_2 = Plane()  # disabled
# LunchBox is a plug-in for Grasshopper for
#  exploring mathematical shapes, paneling,
#  structures, and workflow.  We have also
#  introduced new components for general
#  machine learning implementations such as
#  regression analysis, clustering, and
#  networks.
brep_2 = Brep()  # disabled
# Edit
# 
# - cut/copy/paste/delete
# - arrange groups
# - group/ungroup
# - cluster
# - find
# - create component popup
mesh_2 = Mesh()  # disabled
# Weaverbird
# Weaverbird is a topological mesh editor
#  where it allows both Rhino and
# Grasshopper used to do mesh editing,
# subdivisions, and mesh transformations. In
#  other words, Weaverbird can make some
# nice looking mesh 'skins' of your model with
# fewer and less complicated scripts. This
# plug-in is able to reconstruct the shape of
# the model and subdivisions of any mesh
# (including ones made with polylines).
geometry_3 = Geometry()  # disabled
# View
# 
# - obscure components
# - zoom options on canvas
# ghpython remote
# GH Python Remote is a special component
#  that lets you use regular Python code
#  directly in the GHPython component, like
#  importing Numpy, Scipy, matlplotib et al.
# 
# C#
# Display
# 
# - icons, wires, names
# - (consider Bifocals plugin)
# - selected only preview
# - plane size
# - mesh edges
# - gumball
# - canvas widgets
# (Markov, profiler, message balloons)
# The Pufferfish is one of few animals which
#  is capable of changing its shape.
# This plugin is a set of 330 components
# which focuses on Tweens, Blends, Morphs,
#  Averages, Transformations, & Interpolations
#  - essentially Shape Changing. Pufferfish mainly
#  uses parameters and factors for inputs for more
#  custom control over operations like tweens and
#  grids as opposed to grasshoppers usual division
#  count inputs. These components are
#  accompanied by support components which
#  are useful methods for tween / blend /
#  morph / lattice operations such as making
# curves compatible, a custom curve graph
#  mapper, and a multi-threaded morph to
# twisted box.
# Elk is a set of tools to generate map and
#  topographical surfaces using open source
#  data from OpenStreetMap.org and USGS.
# Firefly offers a set of software tools
#  dedicated to bridging the gap between
#  Grasshopper (a free plug-in for Rhino) and
#  micro-controllers like the Arduino. It allows
#  near real-time data flow between the digital
#  and physical worlds – enabling the possibility
#  to explore virtual and physical prototypes
#  with unprecedented fluidity.
# Solution
# 
# - disable solver
# - scroll button/spacebar
# (cluster/group/preview/enable/solver/
# bake/zoom/find/preferences)
# Help
# 
# - tutorials
# - online forums
# - node references
geometry_pipeline_2 = GeometryPipeline(
    GroupByLayer=False,
    GroupByType=False,
    IncludeHidden=True,
    IncludeLocked=True,
    LayerFilter="*",
    NameFilter="*",
    SublayerFiltering=True,
    TypeFilter=1073741885)  # disabled
boolean = Boolean()  # disabled
integer_4 = Integer()  # disabled
number = Number()  # disabled
text = Text()  # disabled
domain = Domain()  # disabled
domain² = Domain²()  # disabled
guid = Guid()  # disabled
file_path_4 = FilePath()  # disabled
number_slider_21 = Slider(0.25, range=0..1)  # disabled
md_slider_2 = MDSlider(SliderMode=0, slider_value=Point(0.5, 0.5, 0.5), x_domain=Domain(0, 1), y_domain=Domain(0, 1), z_domain=Domain(0, 1))  # disabled
value_list_2 = ValueList({"One": 1, "Two": 2, "Three": 2² - 1, "Four": Sqrt(16)}, selected="One")  # disabled
boolean_toggle_2 = BooleanToggle(False)  # disabled
graph_mapper_2 = GraphMapper()  # disabled
image_sampler_4 = ImageSampler(Filter="Colour", Interpolate=False, Umax=1, Umin=0, Vmax=1, Vmin=0, Wrap=1)  # disabled
colour_swatch_2 = ColourSwatch(SwatchColor=RGB(255, 255, 255))  # disabled
cherry_picker = CherryPicker(ListIndex=0)  # disabled
gene_pool_2 = GenePool(Decimals=2, Maximum=100, Minimum=0, Value=[50, 50, 50, 50, 50, 50, 50, 50, 50, 50])  # disabled
data_recorder = DataRecorder(DataLimit=-10, RecordData=True)  # disabled
fitness_landscape_2 = FitnessLandscape(Count=-1, ColourMode=1, ContourMode=2, Remap=False)  # disabled
cluster_input = ClusterInput()  # disabled
cluster_output = ClusterOutput()  # disabled
galapagos_2 = Galapagos()
param_viewer = ParamViewer()  # disabled

# ----
# 004_Maths
# Domain:
# Operators:
# Trig:
# Utilities:
# Script
# Polynomials
construct_domain_2 = ConstructDomain(DomainStart=0, DomainEnd=1)  # disabled
divide_domain² = DivideDomain²(UCount=10, VCount=10)  # disabled
divide_domain = DivideDomain(Domain=Domain(0, 1), Count=10)  # disabled
construct_domain² = ConstructDomain²(UMin=0, UMax=1, VMin=0, VMax=1)  # disabled
bounds_4 = Bounds()  # disabled
remap = Remap(min=0, max=1)  # disabled
deconstruct_domain² = DeconstructDomain²()  # -> UComponent, VComponent; disabled
bounds_2d = Bounds2D()  # disabled
remap_numbers = RemapNumbers(Source=Domain(0, 1), Target=Domain(0, 1))  # -> Mapped, Clipped; disabled
deconstruct_domain²_2 = DeconstructDomain²()  # -> UMin, UMax, VMin, VMax; disabled
deconstruct_domain = DeconstructDomain()  # -> Start, End; disabled
mass_addition = MassAddition()  # -> Result, PartialResults; disabled
integer_division = IntegerDivision()  # disabled
addition = Addition()  # disabled
division_4 = Division()  # disabled
gate_and = GateAnd()  # disabled
smaller_than = SmallerThan(SecondNumber=0)  # -> SmallerThan, OrEqualTo; disabled
larger_than = LargerThan(SecondNumber=0)  # -> LargerThan, OrEqualTo; disabled
equality = Equality()  # -> Equality, Inequality; disabled
absolute = Absolute()  # disabled
negative = Negative()  # disabled
power = Power()  # disabled
subtraction = Subtraction()  # disabled
modulus = Modulus()  # disabled
multiplication_7 = Multiplication()  # disabled
gate_or = GateOr()  # disabled
mass_multiplication = MassMultiplication()  # -> Result, PartialResults; disabled
square = Square()  # disabled
square_root = SquareRoot()  # disabled
expression_2 = Expression(Expression="Format(\"{0}, {1}\", x, y)")  # disabled
evaluate = Evaluate()  # disabled
ghpython_script = GhPythonScript()  # -> Out, A; disabled
c_script = CSharpScript()  # -> Out, A; disabled
degrees = Degrees()  # disabled
sine = Sine()  # disabled
radians = Radians()  # disabled
cosine = Cosine()  # disabled
golden_ratio = GoldenRatio(Factor=1)  # disabled
maximum = Maximum()  # disabled
average = Average()  # disabled
round = Round()  # -> Nearest, Floor, Ceiling; disabled
pi = Pi(Factor=1)  # disabled
minimum = Minimum()  # disabled

# ----
# Mesh Edit Plugin
mesh_frompoints_2 = MeshFromPoints(Points=flatten(move.Geometry), UDirection=expr("x+1", integer), VDirection=expr("x+1", number_slider_14))  # disabled

# ----
# - try to create these three curves
# parametrically
# from points in grasshopper
# 
# and  use internalized curves in script by
#  extracting them to rhino environment
number_slider_22 = Slider(4, range=0..10)
curve_3 = Curve(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)
curve_4 = Curve(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)
curve_5 = Curve(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)
param_viewer_2 = ParamViewer(curve_3)
panel_12 = Panel([curve_3, curve_4, curve_5])
divide_curve = DivideCurve(Curve=curve_3, Count=number_slider_22, Kinks=False)  # -> Points, Tangents, Parameters
divide_curve_2 = DivideCurve(Curve=curve_5, Count=Slider(4, range=0..10), Kinks=False)  # -> Points, Tangents, Parameters
sweep2 = Sweep2(Rail1=curve_3, Rail2=curve_4, Sections=curve_5, SameHeight=False)
param_viewer_3 = ParamViewer(divide_curve.Points)
panel_13 = Panel(divide_curve.Points)
surface_3 = Surface(sweep2)
surface_closest_point = SurfaceClosestPoint(Point=divide_curve.Points, Surface=surface_3)  # -> Point, UVPoint, Distance
surface_closest_point_2 = SurfaceClosestPoint(Point=divide_curve_2.Points, Surface=surface_3)  # -> Point, UVPoint, Distance
param_viewer_4 = ParamViewer(surface_3)
panel_14 = Panel(surface_3)
param_viewer_5 = ParamViewer(surface_closest_point.Point)
panel_15 = Panel(surface_closest_point.Point)
iso_curve = IsoCurve(Surface=surface_3, UVPoint=[surface_closest_point.UVPoint, surface_closest_point_2.UVPoint])  # -> flatten(UIsocurve), flatten(VIsocurve)
param_viewer_6 = ParamViewer(iso_curve.UIsocurve)
surface_split = SurfaceSplit(Surface=surface_3, Curves=[iso_curve.UIsocurve, iso_curve.VIsocurve])
panel_16 = Panel(iso_curve.UIsocurve)
param_viewer_7 = ParamViewer(surface_split)
panel_17 = Panel(surface_split)

# ----
# - create tri and quads from circle
number_slider_23 = Slider(4, range=0..10)
circle_3 = Circle(Plane=PlaneXY(0, 0, 0), Radius=number_slider_23)
tri_quad = Slider(3, range=3..4)
unit_x = UnitX(Factor=Slider(12, range=0..100))
boundary_surfaces = BoundarySurfaces(Edges=circle_3)
linear_array = LinearArray(Geometry=boundary_surfaces, Direction=unit_x, Count=Slider(4, range=0..10))  # -> Geometry, Transform
param_viewer_8 = ParamViewer(linear_array.Geometry)
panel_18 = Panel(linear_array.Geometry)
divide_curve_3 = DivideCurve(Curve=linear_array.Geometry, Count=tri_quad, Kinks=False)  # -> Points, Tangents, Parameters
panel_19 = Panel(divide_curve_3.Points)
param_viewer_9 = ParamViewer(divide_curve_3.Points)
polyline = PolyLine(Vertices=divide_curve_3.Points, Closed=False)
panel_20 = Panel(polyline)
param_viewer_10 = ParamViewer(polyline)
polyline_2 = PolyLine(Vertices=flatten(divide_curve_3.Points), Closed=False)
list_item = ListItem(List=divide_curve_3.Points, Index=0, Wrap=True)  # -> Item, Item1, Item2, Item3
panel_21 = Panel(polyline_2)
param_viewer_11 = ParamViewer(polyline_2)
_4point_surface = _4PointSurface(CornerA=list_item.Item, CornerB=list_item.Item1, CornerC=list_item.Item2, CornerD=list_item.Item3)
panel_22 = Panel(_4point_surface)
param_viewer_12 = ParamViewer(_4point_surface)

# ----
# 003_params_utilities
# - download plugin Bicocals from food4rhino
# - put into special component folder
# - chech properties  and unblock
# - close and open rhino
# - play with the path mapper
# - display fancy wires
# - consider the paths, indicies, and elements
# - graft and flatten and simplify
# - view tree
# - bake
# 
# - online example:
# https://www.youtube.com/watch?v=MCxo0WWneC4
number_slider_24 = Slider(12, range=0..100)
construct_point_3 = ConstructPoint(XCoordinate=0, YCoordinate=number_slider_24, ZCoordinate=0)
construct_point_4 = ConstructPoint(XCoordinate=0, YCoordinate=0, ZCoordinate=0)
param_viewer_13 = ParamViewer(construct_point_3)
panel_23 = Panel([construct_point_3, construct_point_4])
line_3 = Line(StartPoint=construct_point_3, EndPoint=construct_point_4)
panel_24 = Panel(line_3)
divide_curve_4 = DivideCurve(Curve=line_3, Count=Slider(4, range=0..10), Kinks=False)  # -> Points, Tangents, Parameters
param_viewer_14 = ParamViewer(line_3)
shatter = Shatter(Curve=line_3, Parameters=divide_curve_4.Parameters)
panel_25 = Panel(divide_curve_4.Points)
unit_z_2 = UnitZ(Factor=Slider(4, range=0..10))
param_viewer_15 = ParamViewer(divide_curve_4.Points)
panel_26 = Panel(shatter)
extrude = Extrude(Base=shatter, Direction=unit_z_2)
param_viewer_16 = ParamViewer(shatter)
linear_array_2 = LinearArray(Geometry=extrude, Direction=unit_z_2, Count=Slider(5, range=0..10))  # -> Geometry, Transform
panel_27 = Panel(extrude)
param_viewer_17 = ParamViewer(extrude)
panel_28 = Panel(linear_array_2.Geometry)
deconstruct_brep_5 = DeconstructBrep(Brep=linear_array_2.Geometry)  # -> Faces, Edges, Vertices
param_viewer_18 = ParamViewer(linear_array_2.Geometry)
panel_29 = Panel(deconstruct_brep_5.Vertices)
list_item_2 = ListItem(List=deconstruct_brep_5.Vertices, Index=0, Wrap=True)  # -> Item, Item1, Item2, Item3
param_viewer_19 = ParamViewer(deconstruct_brep_5.Vertices)
_4point_surface_2 = _4PointSurface(CornerA=list_item_2.Item, CornerB=list_item_2.Item1, CornerC=list_item_2.Item2, CornerD=list_item_2.Item3)
param_viewer_20 = ParamViewer(_4point_surface_2)
panel_30 = Panel(_4point_surface_2)

cherry_picker_2 = CherryPicker(ListIndex=9999999)
gene_pool_3 = GenePool(Decimals=2, Maximum=100, Minimum=0, Value=[50, 72.02, 100, 50, 50, 50, 50, 50, 50, 50])
data_recorder_2 = DataRecorder(DataLimit=-10, RecordData=True)
fitness_landscape_3 = FitnessLandscape(Count=-1, ColourMode=1, ContourMode=2, Remap=False)
cluster_input_2 = ClusterInput()
cluster_output_2 = ClusterOutput()
galapagos_3 = Galapagos()
polyline_3 = PolyLine(Vertices=divide_curve_3.Points, Closed=False)
polyline_4 = PolyLine(Vertices=divide_curve_3.Points, Closed=False)
polyline_5 = PolyLine(Vertices=divide_curve_3.Points, Closed=False)

# ----
# 005_Sets
# Tree (Data Trees)
# Text
# Sequence
# List
dispatch = Dispatch(DispatchPattern=[True, False])  # -> ListA, ListB; disabled
sort_list = SortList()  # -> Keys, ValuesValuesA; disabled
cross_reference = CrossReference(CrossMode=1)  # -> ListListA, ListListB; disabled
weave = Weave(Pattern=[0, 1], NullGaps=False)  # disabled
pick_n_choose = PickNChoose(Pattern=[0, 1])  # disabled
list_length = ListLength()  # disabled
list_item_3 = ListItem(Index=0, Wrap=True)  # disabled
reverse_list = ReverseList()  # disabled
combine_data = CombineData()  # -> Result, Index; disabled
longest_list = LongestList(PaddingMode=2)  # -> ListListA, ListListB; disabled
shortest_list = ShortestList(TrimMode=2)  # -> ListListA, ListListB; disabled
sub_list = SubList(Wrap=True)  # -> List, Index; disabled
partition_list = PartitionList(Size=[3, 2])  # disabled
split_list = SplitList()  # -> ListA, ListB; disabled
insert_items = InsertItems(Wrap=True)  # disabled
replace_items = ReplaceItems(Wrap=False)  # disabled
item_index = ItemIndex()  # disabled
shift_list = ShiftList(Shift=1, Wrap=True)  # disabled
random = Random(Range=Domain(0, 1), Number=1, Seed=2)  # disabled
range_2 = Range(Domain=Domain(0, 1), Steps=10)  # disabled
random_reduce = RandomReduce(Seed=1)  # disabled
duplicate_data = DuplicateData(Number=2, Order=True)  # disabled
series = Series(Start=0, Step=1, Count=10)  # disabled
jitter = Jitter(Jitter=1, Seed=2)  # -> Values, Indices; disabled
repeat_data = RepeatData()  # disabled
cull_index = CullIndex(Wrap=True)  # disabled
cull_nth = CullNth(CullFrequency=2)  # disabled
cull_pattern_3 = CullPattern(CullPattern=[False, False, True, True])  # disabled
fibonacci = Fibonacci(SeedA=0, SeedB=1, Number=10)  # disabled
concatenate = Concatenate()  # disabled
simplify_tree = SimplifyTree(Front=False)  # disabled
flip_matrix = FlipMatrix()  # disabled
flatten_tree = FlattenTree(Path="{0}")  # disabled
graft_tree = GraftTree(IncludeEmptyLists=True, IncludeNullItems=True)  # disabled
merge = Merge()  # disabled
stream_filter = StreamFilter(Gate=0)  # disabled
relative_item = RelativeItem(WrapPaths=False, WrapItems=False)  # -> ItemA, ItemB; disabled
clean_tree = CleanTree(RemoveNulls=True, RemoveInvalid=True, RemoveEmpty=False)  # disabled
split_tree = SplitTree()  # -> Positive, Negative; disabled
path_mapper = PathMapper()  # disabled
explode_tree = ExplodeTree()  # -> Branch0, Branch1; disabled
tree_statistics = TreeStatistics()  # -> Paths, Length, Count; disabled
tree_branch = TreeBranch(MaintainPaths=True)  # disabled
shift_paths = ShiftPaths(Offset=-1)  # disabled
entwine = Entwine(FlattenInputs=True)  # disabled
relative_items = RelativeItems(WrapPaths=False, WrapItems=False)  # -> ItemA, ItemB; disabled
construct_path = ConstructPath()  # disabled
stream_gate = StreamGate(Gate=0)  # -> Target0, Target1; disabled
prune_tree = PruneTree(Minimum=0, Maximum=0)  # disabled
tree_item = TreeItem(Index=0, Wrap=True)  # disabled
trim_tree = TrimTree(Depth=1)  # disabled
match_tree = MatchTree()  # disabled
deconstruct_path = DeconstructPath()  # disabled

# ----
# Tree (Data Trees)
simplify_tree_2 = SimplifyTree(Front=False)  # disabled
flip_matrix_2 = FlipMatrix()  # disabled
merge_2 = Merge()  # disabled
flatten_tree_2 = FlattenTree(Path="{0}")  # disabled
graft_tree_2 = GraftTree(IncludeEmptyLists=True, IncludeNullItems=True)  # disabled
relative_item_2 = RelativeItem(WrapPaths=False, WrapItems=False)  # -> ItemA, ItemB; disabled
clean_tree_2 = CleanTree(RemoveNulls=True, RemoveInvalid=True, RemoveEmpty=False)  # disabled
split_tree_2 = SplitTree()  # -> Positive, Negative; disabled
path_mapper_2 = PathMapper()  # disabled
explode_tree_2 = ExplodeTree()  # -> Branch0, Branch1; disabled
tree_statistics_2 = TreeStatistics()  # -> Paths, Length, Count; disabled
tree_branch_2 = TreeBranch(MaintainPaths=True)  # disabled
shift_paths_2 = ShiftPaths(Offset=-1)  # disabled
entwine_2 = Entwine(FlattenInputs=True)  # disabled
relative_items_2 = RelativeItems(WrapPaths=False, WrapItems=False)  # -> ItemA, ItemB; disabled
construct_path_2 = ConstructPath()  # disabled
stream_gate_2 = StreamGate(Gate=0)  # -> Target0, Target1; disabled
prune_tree_2 = PruneTree(Minimum=0, Maximum=0)  # disabled
tree_item_2 = TreeItem(Index=0, Wrap=True)  # disabled
trim_tree_2 = TrimTree(Depth=1)  # disabled
match_tree_2 = MatchTree()  # disabled
stream_filter_2 = StreamFilter(Gate=0)  # disabled
deconstruct_path_2 = DeconstructPath()  # disabled

# ----
# 006_Vector
# Grid
# Plane
# Point
# Vector
populate_geometry = PopulateGeometry(Count=100, Seed=1)  # disabled
populate_2d = Populate2D(Region={Plane=PlaneXY(0, 0, 0), Size=Domain2(u=0..20, v=0..10)}, Count=100, Seed=1)  # disabled
populate_3d = Populate3D(Region={Plane=PlaneXY(0, 0, 0), X=Domain(0, 10), Y=Domain(0, 10), Z=Domain(0, 2)}, Count=100, Seed=1)  # disabled
rectangular_7 = Rectangular(Plane=PlaneXY(0, 0, 0), SizeX=1, SizeY=2, ExtentX=10, ExtentY=5)  # -> Cells, Points; disabled
square_2 = Square(Plane=PlaneXY(0, 0, 0), Size=1, ExtentX=5, ExtentY=5)  # -> Cells, Points; disabled
triangular = Triangular(Plane=PlaneXY(0, 0, 0), Size=1, ExtentX=5, ExtentY=5)  # -> Cells, Points; disabled
hexagonal = Hexagonal(Plane=PlaneXY(0, 0, 0), Size=1, ExtentX=5, ExtentY=5)  # -> Cells, Points; disabled
radial = Radial(Plane=PlaneXY(0, 0, 0), Size=1, ExtentR=5, ExtentP=20)  # -> Cells, Points; disabled
xy_plane = XYPlane(Origin=Point(0, 0, 0))  # disabled
xz_plane = XZPlane(Origin=Point(0, 0, 0))  # disabled
yz_plane = YZPlane(Origin=Point(0, 0, 0))  # disabled
construct_plane = ConstructPlane(Origin=Point(0, 0, 0), XAxis=Vector(1, 0, 0), YAxis=Vector(0, 1, 0))  # disabled
flip_plane = FlipPlane(Plane=PlaneXY(0, 0, 0), ReverseX=False, ReverseY=False, SwapAxes=True)  # disabled
plane_closest_point = PlaneClosestPoint()  # -> Point, UVPoint, Distance; disabled
plane_normal = PlaneNormal(Origin=Point(0, 0, 0), ZAxis=Vector(0, 0, 1))  # disabled
plane_origin = PlaneOrigin()  # disabled
rotate_plane = RotatePlane()  # disabled
deconstruct_plane = DeconstructPlane(Plane=PlaneXY(0, 0, 0))  # -> Origin, XAxis, YAxis, ZAxis; disabled
align_plane = AlignPlane()  # -> Plane, Angle; disabled
plane_coordinates = PlaneCoordinates(System=PlaneXY(0, 0, 0))  # -> XCoordinate, YCoordinate, ZCoordinate; disabled
plane_offset = PlaneOffset(BasePlane=PlaneXY(0, 0, 0), Offset=1)  # disabled
plane_fit = PlaneFit()  # -> Plane, Deviation; disabled
adjust_plane = AdjustPlane(Normal=Vector(0, 0, 1))  # disabled
plane_3pt = Plane3Pt()  # disabled
line_pt = LinePt()  # disabled
line_line = LineLine()  # disabled
align_planes = AlignPlanes()  # disabled
pull_point = PullPoint(ClosestOnly=True)  # -> ClosestPoint, Distance; disabled
closest_point = ClosestPoint()  # -> ClosestPoint, CPIndex, Distance; disabled
construct_point_5 = ConstructPoint(XCoordinate=0, YCoordinate=0, ZCoordinate=0)  # disabled
cull_duplicates = CullDuplicates(Tolerance=0.1, CullMode=3)  # -> Points, Indices, Valence; disabled
distance = Distance()  # disabled
project_point = ProjectPoint(Direction=Vector(0, 0, -1))  # -> Point, Index; disabled
sort_along_curve = SortAlongCurve()  # -> Points, Indices; disabled
deconstruct_4 = Deconstruct()  # -> XComponent, YComponent, ZComponent; disabled
closest_points = ClosestPoints(Count=3)  # -> ClosestPoint, CPIndex, Distance; disabled
sort_points = SortPoints()  # -> Points, Indices; disabled
vector_xyz = VectorXYZ(XComponent=0, YComponent=0, ZComponent=0)  # -> Vector, Length; disabled
vector_2pt = Vector2Pt(Unitize=False)  # -> Vector, Length; disabled
unit_x_2 = UnitX(Factor=1)  # disabled
unit_y = UnitY(Factor=1)  # disabled
unit_z_3 = UnitZ(Factor=1)  # disabled
amplitude = Amplitude(Amplitude=1)  # disabled
cross_product = CrossProduct(Unitize=False)  # -> Vector, Length; disabled
unit_vector = UnitVector()  # disabled
reverse = Reverse()  # disabled
rotate = Rotate()  # disabled
dot_product = DotProduct(Unitize=False)  # disabled
deconstruct_vector = DeconstructVector()  # -> XComponent, YComponent, ZComponent; disabled
angle = Angle()  # -> Angle, Reflex; disabled
vector_length = VectorLength()  # disabled

# ----
# 007_Curve
# Utility
# Spline
# Analysis
# Primitive
# Division
evaluate_length = EvaluateLength(Normalized=True)  # -> Point, Tangent, Parameter; disabled
evaluate_curve = EvaluateCurve()  # -> Point, Tangent, Angle; disabled
horizontal_frame = HorizontalFrame()  # disabled
perp_frame = PerpFrame()  # disabled
curve_closest_point = CurveClosestPoint()  # -> Point, Parameter, Distance; disabled
curve_domain = CurveDomain()  # -> Curve, Domain; disabled
curve_middle = CurveMiddle()  # disabled
point_on_curve = PointOnCurve(parameter=0.5)  # disabled
length = Length()  # disabled
end_points = EndPoints()  # -> Start, End; disabled
derivatives = Derivatives()  # -> Point, FirstDerivative; disabled
point_in_curves = PointInCurves()  # -> Relationship, Index, Point; disabled
point_in_curve = PointInCurve()  # -> Relationship, Point; disabled
polygon_center = PolygonCenter()  # -> CenterV, CenterE, CenterA; disabled
planar = Planar()  # -> Planar, Plane, Deviation; disabled
control_points = ControlPoints()  # -> Points, Weights, Knots; disabled
extremes = Extremes(Plane=PlaneXY(0, 0, 0))  # -> Highest, Lowest; disabled
divide_distance = DivideDistance()  # -> Points, Tangents, Parameters; disabled
divide_length = DivideLength()  # -> Points, Tangents, Parameters; disabled
divide_curve_5 = DivideCurve(Count=10, Kinks=False)  # -> Points, Tangents, Parameters; disabled
curve_frames = CurveFrames(Count=10)  # -> Frames, Parameters; disabled
horizontal_frames = HorizontalFrames(Count=10)  # -> Frames, Parameters; disabled
perp_frames = PerpFrames(Count=10, Align=True)  # -> Frames, Parameters; disabled
polygon = Polygon(Plane=PlaneXY(0, 0, 0), Radius=3, Segments=6, FilletRadius=0)  # -> Polygon, Length; disabled
rectangle = Rectangle(Plane=PlaneXY(0, 0, 0), XSize=Domain(-1, 1), YSize=Domain(-2, 2), Radius=0)  # -> Rectangle, Length; disabled
ellipse = Ellipse(Plane=PlaneXY(0, 0, 0), Radius1=1, Radius2=1)  # -> Ellipse, Focus1, Focus2; disabled
line_4 = Line()  # disabled
arc_3pt = Arc3Pt()  # -> Arc, Plane, Radius; disabled
arc = Arc(Plane=PlaneXY(0, 0, 0), Radius=1, Angle=Domain(0, 3.141592654))  # -> Arc, Length; disabled
line_sdl = LineSDL(Direction=Vector(0, 0, 1), Length=1)  # disabled
circle_cnr = CircleCNR(Normal=Vector(0, 0, 1), Radius=1)  # disabled
circle_4 = Circle(Plane=PlaneXY(0, 0, 0), Radius=1)  # disabled
tangent_lines_ex = TangentLinesEx()  # -> Tangent1, Tangent2; disabled
tangent_lines = TangentLines()  # -> Tangent1, Tangent2; disabled
iso_curve_2 = IsoCurve()  # -> UIsocurve, VIsocurve; disabled
interpolate_2 = Interpolate(Degree=3, Periodic=False, KnotStyle=1)  # -> Curve, Length, Domain; disabled
nurbs_curve = NurbsCurve(Degree=3, Periodic=False)  # -> Curve, Length, Domain; disabled
polyline_6 = PolyLine(Closed=False)  # disabled
tween_curve = TweenCurve(Factor=0.5, BlendType=0)  # disabled
curve_on_surface = CurveOnSurface(Closed=False)  # -> Curve, Length, Domain; disabled
catenary = Catenary(Gravity=Vector(0, 0, -1))  # disabled
blend_curve = BlendCurve(BulgeA=1, BulgeB=1, Continuity=2)  # disabled
explode = Explode(Recursive=True)  # -> Segments, Vertices; disabled
join_curves = JoinCurves(Preserve=False)  # disabled
project = Project(Direction=Vector(0, 0, 1))  # disabled
offset_curve = OffsetCurve(Distance=1, Corners=1)  # disabled
flip_curve = FlipCurve()  # -> Curve, Flag; disabled
rebuild_curve = RebuildCurve(Count=10, Tangents=False)  # disabled
pull_curve = PullCurve()  # disabled
fillet = Fillet()  # disabled
extend_curve = ExtendCurve(Type=0)  # disabled
seam = Seam()  # disabled

# ----
# 008_Surface
# Freeform
# Primitive
# Analysis
# SubD
# Utilities
surface_closest_point_3 = SurfaceClosestPoint()  # -> Point, UVPoint, Distance; disabled
area = Area()  # -> Area, Centroid; disabled
volume = Volume()  # -> Volume, Centroid; disabled
evaluate_surface_3 = EvaluateSurface()  # -> Point, Normal, UDirection, VDirection, Frame; disabled
deconstruct_brep_6 = DeconstructBrep()  # -> Faces, Edges, Vertices; disabled
brep_closest_point = BrepClosestPoint()  # -> Point, Normal, Distance; disabled
point_in_brep = PointInBrep(Strict=False)  # disabled
brep_edges = BrepEdges()  # -> Naked, Interior, NonManifold; disabled
point_in_breps = PointInBreps(Strict=False)  # -> Inside, Index; disabled
surface_from_points_2 = SurfaceFromPoints(Interpolate=False)  # disabled
extrude_2 = Extrude()  # disabled
sweep2_2 = Sweep2(SameHeight=False)  # disabled
_4point_surface_3 = _4PointSurface()  # disabled
pipe_variable = PipeVariable(Caps=0)  # disabled
revolution = Revolution(Domain=Domain(0, 6.283185307))  # disabled
boundary_surfaces_2 = BoundarySurfaces()  # disabled
rail_revolution = RailRevolution(Scale=False)  # disabled
sweep1 = Sweep1(Miter=1)  # disabled
loft = Loft(Options={Adjust=False, Closed=False, LoftEnds=0, LoftSimp=0, LoftType=0, Rebuild=10, Refit=0.01})  # disabled
pipe = Pipe(Radius=1, Caps=0)  # disabled
extrude_linear = ExtrudeLinear(OrientationP=PlaneXY(0, 0, 0))  # disabled
extrude_along = ExtrudeAlong()  # disabled
extrude_point = ExtrudePoint()  # disabled
patch = Patch(Spans=20, Flexibility=1, Trim=True)  # disabled
bounding_box_4 = BoundingBox(Plane=PlaneXY(0, 0, 0))  # -> Box, Box_2; disabled
cylinder = Cylinder(Base=PlaneXY(0, 0, 0), Radius=0.5, Length=1)  # disabled
plane_surface = PlaneSurface(Plane=PlaneXY(0, 0, 0), XSize=Domain(-10, 10), YSize=Domain(-10, 10))  # disabled
quad_sphere_2 = QuadSphere(Base=PlaneXY(0, 0, 0), Radius=1)  # disabled
sphere_2 = Sphere(Base=PlaneXY(0, 0, 0), Radius=1)  # disabled
cone = Cone(Base=PlaneXY(0, 0, 0), Radius=0.5, Length=1)  # -> Cone, Tip; disabled
center_box = CenterBox(Base=PlaneXY(0, 0, 0), X=1, Y=1, Z=1)  # disabled
bounding_box_5 = BoundingBox(Plane=PlaneXY(0, 0, 0), UnionBox=True)  # -> Box, Box_2; disabled
plane_through_shape = PlaneThroughShape(Inflate=1, SectionLogic=False)  # disabled
multipipe_2 = MultiPipe(NodeSize=0.5, EndOffset=1, StrutSize=1, Segment=0, KinkAngle=0.6, CubeFit=0, Caps=0)  # disabled
subd_fuse_2 = SubDFuse(BooleanOption=0, Smoothing=10)  # disabled
subd_from_mesh_2 = SubDFromMesh(Creases=1, Corners=1, Interpolate=False)  # disabled
mesh_from_subd_2 = MeshFromSubD(Density=2)  # disabled
subd_control_polygon_2 = SubDControlPolygon()  # disabled
subd_edges_2 = SubDEdges(NewFormatting=False)  # -> Line, Edge, Tag, Id; disabled
divide_surface = DivideSurface(UCount=10, VCount=10)  # -> Points, Normals, Parameters; disabled
offset_surface = OffsetSurface(Distance=0, Retrim=True)  # disabled
isotrim = Isotrim()  # disabled
flip = Flip()  # -> Surface, Result; disabled
fillet_edge = FilletEdge(Blend=0, Metric=0)  # disabled
brep_join = BrepJoin()  # -> Breps, Closed; disabled
cap_holes = CapHoles()  # disabled
surface_frames = SurfaceFrames(UCount=10, VCount=10)  # -> Frames, Parameters; disabled

# ----
# 009_Mesh
# Tiangulation
# Primitive
# Analysis
# Utilities
mesh_area_2 = MeshArea()  # -> Area, Centroid; disabled
mesh_edges_2 = MeshEdges()  # -> NakedEdges, InteriorEdges, NonManifoldEdges; disabled
mesh_convertquads_2 = MeshConvertQuads(ShortDiagonal=True)  # -> Mesh, Split; disabled
mesh_triangulate_2 = MeshTriangulate(ShortDiagonal=True)  # disabled
mesh_eval_2 = MeshEval()  # -> Point, Normal, Colour; disabled
mesh_closest_point_2 = MeshClosestPoint()  # -> Point, Index, Parameter; disabled
face_normals_2 = FaceNormals()  # -> Centers, Normals; disabled
mesh_nakededge_2 = MeshNakedEdge()  # -> V, A, B; disabled
mesh_volume_2 = MeshVolume()  # -> Volume, Centroid; disabled
face_boundaries_2 = FaceBoundaries()  # disabled
mesh_explode_2 = MeshExplode(Interpolate=False)  # disabled
deconstruct_mesh_2 = DeconstructMesh()  # -> Vertices, Faces, Colours, Normals; disabled
deconstruct_face_2 = DeconstructFace()  # -> CornerA, CornerB, CornerC, CornerD; disabled
mesh_inclusion_2 = MeshInclusion(Strict=False)  # disabled
mesh_quad_2 = MeshQuad(CornerA=0, CornerB=1, CornerC=2, CornerD=3)  # disabled
mesh_plane_2 = MeshPlane(Boundary={Plane=PlaneXY(0, 0, 0), Size=Domain2(u=-10..10, v=-10..10)}, WidthCount=10, HeightCount=10)  # -> Mesh, Area; disabled
mesh_sphere_2 = MeshSphere(Base=PlaneXY(0, 0, 0), Radius=10, UCount=10, VCount=20)  # disabled
mesh_box_2 = MeshBox(Base={Plane=PlaneXY(0, 0, 0), X=Domain(-10, 10), Y=Domain(-10, 10), Z=Domain(-10, 10)}, XCount=10, YCount=10, ZCount=10)  # disabled
construct_mesh_2 = ConstructMesh(Vertices=[Point(0, 0, 0), Point(10, 0, 0), Point(10, 10, 0), Point(0, 10, 0)], Faces={A=0, B=1, C=2, D=3})  # disabled
mesh_sphere_ex_2 = MeshSphereEx(Base=PlaneXY(0, 0, 0), Radius=10, Count=5)  # disabled
mesh_triangle_2 = MeshTriangle(CornerA=0, CornerB=1, CornerC=2)  # disabled
mesh_colours_2 = MeshColours(Colours=[RGB(127, 255, 0), RGB(0, 100, 0), RGB(34, 139, 34), RGB(124, 252, 0), RGB(154, 205, 50), RGB(173, 255, 47), RGB(50, 205, 50), RGB(152, 251, 152)])  # disabled
mesh_spray_2 = MeshSpray(SprayMode=11)  # disabled
metaball_2 = MetaBall(Plane=PlaneXY(0, 0, 0))  # disabled
voronoi_3 = Voronoi(BruteForceOverride=False)  # disabled
delaunay_edges_2 = DelaunayEdges(Plane=PlaneXY(0, 0, 0))  # -> Connectivity, Edges; disabled
delaunay_mesh_2 = DelaunayMesh(Plane=PlaneXY(0, 0, 0))  # disabled
octree_3 = OcTree(Square=False, Group=5)  # -> Boxes, Points; disabled
metaball_t_4 = MetaBallT(Plane=PlaneXY(0, 0, 0), Threshold=0.5)  # disabled
voronoi_3d_3 = Voronoi3D()  # -> Cells, Boundary; disabled
metaball_t_custom_3 = MetaBallTCustom(Plane=PlaneXY(0, 0, 0), Threshold=0.5)  # disabled
convex_hull_2 = ConvexHull(Plane=PlaneXY(0, 0, 0))  # -> Hull, HullZ, Indices; disabled
delete_faces_2 = DeleteFaces()  # disabled
mesh_surface_2 = MeshSurface(UCount=5, VCount=5, Overhang=True, Equalize=False)  # disabled
cull_faces_2 = CullFaces()  # disabled
mesh_brep_2 = MeshBrep(Settings={GridMaxCount=0, GridMinCount=16, JaggedSeams=False, MaxEdgeLength=0, MinEdgeLength=0.0001, MinTolerance=0, Refine=True, RefineAngle=0, RelativeTolerance=0.65, SimplePlanes=True, Tolerance=0})  # disabled
unweld_mesh_2 = UnweldMesh(Angle=1.570796327)  # disabled
mesh_shadow_2 = MeshShadow(Light=Vector(0, 0, -1), Plane=PlaneXY(0, 0, 0))  # disabled
mesh_join_2 = MeshJoin()  # disabled
delete_vertices_2 = DeleteVertices(Shrink=True)  # disabled
cull_vertices_2 = CullVertices(Shrink=True)  # disabled
weld_mesh_2 = WeldMesh(Angle=3.141592654)  # disabled
flip_mesh_2 = FlipMesh(VertexNormals=True, FaceNormals=True, FaceOrientation=True)  # disabled
mesh_weldvertices_2 = MeshWeldVertices(Tolerance=0.01)  # -> RuntimeMessage, Mesh; disabled
mesh_frompoints_3 = MeshFromPoints()  # disabled
occlusion_2 = Occlusion()  # -> Hits, Occlusion; disabled
simple_mesh_2 = SimpleMesh()  # disabled
mesh_unifynormals_2 = MeshUnifyNormals()  # disabled
quadrangulate_2 = Quadrangulate(Angle=0.03490658504, Ratio=0.875)  # -> Mesh, Count; disabled
triangulate_2 = Triangulate()  # -> Mesh, Count; disabled
mesh_flip_2 = MeshFlip()  # disabled

# ----
# 010_Intersect
# Physical
# Region
# Mathematical
# Shape
contour = Contour(Point=Point(0, 0, 0), Direction=Vector(0, 0, 1))  # disabled
isovist = IsoVist(Count=10, Radius=100)  # -> Points, Distance, Index; disabled
curve_plane = CurvePlane()  # -> Points, ParamsC, ParamsP; disabled
line_line_2 = LineLine()  # -> ParamA, ParamB, PointA, PointB; disabled
mesh_ray = MeshRay()  # -> Point, Hit; disabled
plane_region = PlaneRegion(Plane=PlaneXY(0, 0, 0))  # disabled
brep_plane = BrepPlane(Plane=PlaneXY(0, 0, 0))  # -> Curves, Points; disabled
mesh_plane_3 = MeshPlane()  # disabled
plane_plane = PlanePlane()  # disabled
brep_line = BrepLine(LimitToFirst=False)  # -> Curves, Points; disabled
surface_line = SurfaceLine(LimitToFirst=False)  # -> Curves, Points, UVPoints, Normal; disabled
isovist_ray = IsoVistRay(Radius=100)  # -> Point, Distance, Index; disabled
plane_plane_plane = PlanePlanePlane()  # -> Point, LineAB, LineAC, LineBC; disabled
mesh_mesh = MeshMesh()  # disabled
surface_split_2 = SurfaceSplit()  # disabled
curve_curve = CurveCurve()  # -> Points, ParamsA, ParamsB; disabled
multiple_curves = MultipleCurves()  # -> Points, IndexA, IndexB, ParamA, ParamB; disabled
brep_brep = BrepBrep()  # -> Curves, Points; disabled
brep_curve = BrepCurve()  # -> Curves, Points; disabled
mesh_curve = MeshCurve()  # -> Points, Faces; disabled
surface_curve = SurfaceCurve()  # -> Curves, Points, UVPoints, Normals, Parameters, Tangents; disabled
curve_self = CurveSelf()  # -> Points, Params; disabled
trim_with_region = TrimWithRegion()  # -> Inside, Outside; disabled
trim_with_brep = TrimWithBrep()  # -> Inside, Outside; disabled
split_with_brep = SplitWithBrep()  # -> Curve, Points; disabled
trim_with_regions = TrimWithRegions()  # -> Inside, Outside; disabled
split_with_breps = SplitWithBreps()  # -> Curve, Points; disabled
trim_with_breps = TrimWithBreps()  # -> Inside, Outside; disabled
boundary_volume = BoundaryVolume()  # disabled
mesh_difference = MeshDifference()  # disabled
mesh_intersection = MeshIntersection()  # disabled
region_difference = RegionDifference()  # disabled
region_intersection = RegionIntersection()  # disabled
mesh_split = MeshSplit()  # disabled
solid_difference = SolidDifference()  # disabled
solid_intersection = SolidIntersection()  # disabled
mesh_union = MeshUnion()  # disabled
trim_solid = TrimSolid()  # disabled
region_union = RegionUnion()  # disabled
split_brep = SplitBrep()  # disabled
solid_union = SolidUnion()  # disabled
split_brep_multiple = SplitBrepMultiple()  # disabled

# ----
# 011_Transformations
# Array
# Morph
# Euclidean
# Utility
# Affine
scale = Scale(Center=Point(0, 0, 0), Factor=0.5)  # -> Geometry, Transform; disabled
scale_nu = ScaleNU(Plane=PlaneXY(0, 0, 0), ScaleX=1, ScaleY=1, ScaleZ=1)  # -> Geometry, Transform; disabled
project_2 = Project(Plane=PlaneXY(0, 0, 0))  # -> Geometry, Transform; disabled
project_along = ProjectAlong(Plane=PlaneXY(0, 0, 0), Direction=Vector(0, 0, -1))  # -> Geometry, Transform; disabled
orient_direction = OrientDirection(PointA=Point(0, 0, 0), DirectionA=Vector(0, 0, 1), PointB=Point(0, 0, 0), DirectionB=Vector(0, 0, 1))  # -> Geometry, Transform; disabled
camera_obscura = CameraObscura(Point=Point(0, 0, 0), Factor=1)  # -> Geometry, Transform; disabled
box_mapping = BoxMapping()  # -> Geometry, Transform; disabled
rectangle_mapping = RectangleMapping()  # -> Geometry, Transform; disabled
triangle_mapping = TriangleMapping()  # -> Geometry, Transform; disabled
box_array = BoxArray(Cell={Plane=PlaneXY(0, 0, 0), X=Domain(0, 10), Y=Domain(0, 5), Z=Domain(0, 2)}, XCount=4, YCount=3, ZCount=2)  # -> Geometry, Transform; disabled
curve_array = CurveArray(Count=10)  # -> Geometry, Transform; disabled
linear_array_3 = LinearArray(Direction=Vector(10, 0, 0), Count=10)  # -> Geometry, Transform; disabled
polar_array = PolarArray(Plane=PlaneXY(0, 0, 0), Count=10, Angle=6.283185307)  # -> Geometry, Transform; disabled
rectangular_array = RectangularArray(Cell={Plane=PlaneXY(0, 0, 0), Size=Domain2(u=0..10, v=0..5)}, XCount=6, YCount=3)  # -> Geometry, Transform; disabled
kaleidoscope = Kaleidoscope(Plane=PlaneXY(0, 0, 0), Segments=10)  # -> Geometry, Transform; disabled
mirror = Mirror(Plane=PlaneYZ(0, 0, 0))  # -> Geometry, Transform; disabled
move_2 = Move(Motion=Vector(0, 0, 10))  # -> Geometry, Transform; disabled
orient = Orient(Source=PlaneXY(0, 0, 0), Target=PlaneXY(0, 0, 0))  # -> Geometry, Transform; disabled
move_to_plane = MoveToPlane(Plane=PlaneXY(0, 0, 0), Above=True, Below=True)  # -> Geometry, Transform; disabled
rotate_2 = Rotate(Angle=1.570796327, Plane=PlaneXY(0, 0, 0))  # -> Geometry, Transform; disabled
rotate_3d = Rotate3D(Angle=1.570796327, Center=Point(0, 0, 0), Axis=Vector(0, 0, 1))  # -> Geometry, Transform; disabled
rotate_axis = RotateAxis(Angle=1.570796327, Axis=Line((0, 0, 0), (10, 0, 0)))  # -> Geometry, Transform; disabled
rotate_direction = RotateDirection(Center=Point(0, 0, 0), From=Vector(1, 0, 0), To=Vector(0, 1, 0))  # -> Geometry, Transform; disabled
flow = Flow(ReverseBase=False, ReverseTarget=False, Stretch=True, Rigid=False)  # disabled
bend_deform = BendDeform()  # disabled
twisted_box = TwistedBox()  # disabled
surface_morph = SurfaceMorph()  # disabled
splop = Splop(Plane=PlaneXY(0, 0, 0), Angle=0, Rigid=False)  # disabled
sporph = Sporph(Rigid=False)  # disabled
box_morph = BoxMorph()  # disabled
maelstrom = Maelstrom(Plane=PlaneXY(0, 0, 0), First=0.1, Second=10, Angle=1.570796327, Rigid=False)  # disabled
stretch = Stretch(Axis=Line((0, 0, 0), (10, 10, 0)), Length=20, Rigid=False)  # disabled
twist = Twist(Angle=1.570796327, Infinite=False, Rigid=False)  # disabled
transform_matrix = TransformMatrix(Digits=3)  # disabled
inverse_transform = InverseTransform()  # disabled
transform = Transform()  # disabled
merge_group = MergeGroup()  # disabled
group = Group()  # disabled
split_group = SplitGroup(Wrap=False)  # -> GroupA, GroupB; disabled
ungroup = Ungroup()  # disabled
compound = Compound()  # disabled
split = Split()  # disabled

# ----
# 012_Display
# Preview
# Vector
# Dimensions
make2d = Make2D(TangentEdges=False, TangentSeams=False, AutoComputeMake2D=False)  # -> VisibleCurves, VisibleIndex, VisibleType, HiddenCurves, HiddenIndex, HiddenType; disabled
make2d_parallel_view = Make2DParallelView()  # disabled
make2d_perspective_view = Make2DPerspectiveView()  # disabled
make2d_rhino_view = Make2DRhinoView(Clip=True)  # disabled
text_tag_3d = TextTag3D(Size=1, Justification=7)  # disabled
gradient_hatch = GradientHatch(Colour1=RGB(255, 20, 147), Colour2=RGB(139, 0, 139))  # disabled
pattern_hatch = PatternHatch(Pattern=0, Scale=1, Angle=0)  # disabled
aligned_dimension = AlignedDimension(Plane=PlaneXY(0, 0, 0), Offset=1, Text="{0:0.00}", Size=1)  # disabled
angular_dimension = AngularDimension(Reflex=False, Text="{0:0.0}°", Size=1)  # disabled
arc_dimension = ArcDimension(Offset=2, Text="{0:0.0}°", Size=1)  # disabled
line_dimension = LineDimension(Text="{0:0.00}", Size=1)  # disabled
angular_dimensions_mesh = AngularDimensionsMesh(Text="{0:0.0}°", Size=1, LengthFactor=0.5)  # disabled
text_tag = TextTag()  # disabled
linear_dimension = LinearDimension(Text="{0:0.00}", Size=1)  # disabled
circular_dimension = CircularDimension(Text="{0:0.0}°", Size=1)  # disabled
create_material = CreateMaterial(Diffuse=RGB(255, 105, 180), Specular=RGB(255, 255, 255), Emission=RGB(0, 0, 0), Transparency=0, Shine=0)  # disabled
custom_preview = CustomPreview(Material={diffuse=RGB(221, 160, 221), emission=RGB(66, 48, 66), shine=0.5, specular=RGB(255, 255, 255), transparency=0})  # disabled
vector_display = VectorDisplay()  # disabled
point_list = PointList()  # disabled
point_order = PointOrder()  # disabled
vector_display_ex = VectorDisplayEx(Colour=RGB(0, 0, 0), Width=2)  # disabled

# ==== cluster Remap: Remaps numbers
data = ClusterInput()
min = ClusterInput()
max = ClusterInput()
bnd = Bounds(Numbers=data)
dom = ConstructDomain(DomainStart=min, DomainEnd=max)
remap = RemapNumbers(Value=data, Source=bnd, Target=dom)  # -> Mapped, Clipped
R = ClusterOutput(remap.Mapped)
