# Grasshopper definition 016_exercises_Section_002_PartII.gh (Grasshopper 1.0.7)
# plug-ins: Kangaroo2 Components, MeshEdit Components, Bifocals

# ----
# 030_intersect_mathematical
# - consider and visualize how points, lines and curves
# are created by intersections
# - controling plane region
# - isovist can product very interesting effects
number_slider = Slider(12, range=0..100)  # disabled
number_slider_2 = Slider(6, range=0..10)  # disabled
number_slider_3 = Slider(13, range=0..100)  # disabled
brep_line = BrepLine(LimitToFirst=False)  # -> Curves, Points; disabled
curve_plane = CurvePlane()  # -> Points, ParamsC, ParamsP; disabled
origin = Origin([Point(-45.78873606, -28.06335384, 0), Point(16.72870203, 65.64266703, 0), Point(-58.87617381, 62.3246864, 0), Point(101.0585885, -89.13142274, 0)])  # disabled
xz_plane = XZPlane(Origin=Point(0, 0, 0))  # disabled
xz_plane_2 = XZPlane(Origin=Point(0, 0, 0))  # disabled
number_slider_4 = Slider(2, range=0..2)  # disabled
radial = Radial(Plane=PlaneXY(0, 0, 0), Size=number_slider, ExtentR=number_slider_2, ExtentP=number_slider_2)  # -> Cells, simplify(Points); disabled
number_slider_5 = Slider(0.92, range=0..1)  # disabled
number_slider_6 = Slider(0.33, range=0..1)  # disabled
number_slider_7 = Slider(0.53, range=0..1)  # disabled
number_slider_8 = Slider(0.22, range=0..1)  # disabled
mesh_plane = MeshPlane()  # disabled
number_slider_9 = Slider(5, range=0..10)  # disabled
line_line = LineLine()  # -> ParamA, ParamB, PointA, PointB; disabled
plane_origin = PlaneOrigin(Base=xz_plane_2, Origin=origin)  # disabled
panel = Panel("0")  # disabled
sphere = Sphere(Base=PlaneXY(0, 0, 0), Radius=number_slider_3)  # disabled
mesh_ray = MeshRay()  # -> Point, Hit; disabled
number_slider_10 = Slider(2, range=0..10)  # disabled
number_slider_11 = Slider(6.78, range=0.1..10)  # disabled
number_slider_12 = Slider(1.3, range=0.1..3)  # disabled
explode_tree = ExplodeTree(Data=graft(plane_origin))  # -> Branch0, Branch1, Branch2, Branch3; disabled
flip_matrix = FlipMatrix(Data=radial.Points)  # disabled
pi = Pi(Factor=number_slider_6)  # disabled
pi_2 = Pi(Factor=number_slider_7)  # disabled
pi_3 = Pi(Factor=number_slider_5)  # disabled
plane_plane = PlanePlane()  # disabled
pi_4 = Pi(Factor=number_slider_8)  # disabled
surface_line = SurfaceLine(LimitToFirst=False)  # -> Curves, Points, UVPoints, Normal; disabled
range = Range(Domain=number_slider_4, Steps=number_slider_9)  # disabled
cull_index = CullIndex(List=flip_matrix, Indices=panel, Wrap=True)  # disabled
isovist_ray = IsoVistRay(Radius=100)  # -> Point, Distance, Index; disabled
rotate_3d = Rotate3D(Geometry=explode_tree.Branch0, Angle=pi_4, Center=explode_tree.Branch0, Axis=Vector(0, 0, 1))  # -> Geometry, Transform; disabled
rotate_3d_2 = Rotate3D(Geometry=explode_tree.Branch1, Angle=pi_3, Center=explode_tree.Branch0, Axis=Vector(0, 0, 1))  # -> Geometry, Transform; disabled
rotate_3d_3 = Rotate3D(Geometry=explode_tree.Branch2, Angle=pi_2, Center=explode_tree.Branch2, Axis=Vector(0, 0, 1))  # -> Geometry, Transform; disabled
rotate_3d_4 = Rotate3D(Geometry=explode_tree.Branch3, Angle=pi, Center=explode_tree.Branch3, Axis=Vector(0, 0, 1))  # -> Geometry, Transform; disabled
construct_domain = ConstructDomain(DomainStart=number_slider_12, DomainEnd=number_slider_11)  # disabled
plane_plane_plane = PlanePlanePlane()  # -> Point, LineAB, LineAC, LineBC; disabled
list_length = ListLength(List=cull_index)  # disabled
pi_5 = Pi(Factor=range)  # disabled
contour = Contour(Shape=sphere, Point=Point(0, 0, 0), Direction=Vector(0, 0, 1), Distance=number_slider_10)  # disabled
xz_plane_3 = XZPlane(Origin=Point(0, 0, 0))  # disabled
yz_plane = YZPlane(Origin=Point(0, 0, 0))  # disabled
xy_plane = XYPlane(Origin=Point(0, 0, 0))  # disabled
panel_2 = Panel("3")  # disabled
range_2 = Range(Domain=construct_domain, Steps=expr("x-1", list_length))  # disabled
plane = Plane(PlaneXY(0, 0, 0))  # disabled
series = Series(Start=panel_2, Step=1, Count=list_length)  # disabled
number_slider_13 = Slider(29, range=0..100)  # disabled
number_slider_14 = Slider(11, range=0..100)  # disabled
plane_region = PlaneRegion(Plane=plane, Bounds=flatten([rotate_3d_3.Geometry, rotate_3d.Geometry, rotate_3d_2.Geometry, rotate_3d_4.Geometry]))  # disabled
rotate_3d_5 = Rotate3D(Geometry=xz_plane, Angle=pi_5, Center=xz_plane, Axis=graft([yz_plane, xz_plane_3, xy_plane]))  # -> Geometry, Transform; disabled
curve = Curve(plane_region)  # disabled
construct_point = ConstructPoint(XCoordinate=number_slider_14, YCoordinate=number_slider_13, ZCoordinate=0)  # disabled
brep_plane = BrepPlane(Brep=sphere, Plane=rotate_3d_5.Geometry)  # -> Curves, Points; disabled
origin_2 = Origin(construct_point)  # disabled
xy_plane_2 = XYPlane(Origin=origin_2)  # disabled
number_slider_15 = Slider(248, range=0..1000)  # disabled
number_slider_16 = Slider(242, range=0..1000)  # disabled
multipipe = MultiPipe(Curves=contour, NodeSize=0.5, EndOffset=1, StrutSize=1, Segment=0, KinkAngle=0.6, CubeFit=0, Caps=0)  # disabled
polygon = Polygon(Plane=flatten(cull_index), Radius=flatten(range_2), Segments=flatten(series), FilletRadius=0)  # -> flatten(Polygon), Length; disabled
plane_2 = Plane(xy_plane_2)  # disabled
isovist = IsoVist(Plane=plane_2, Count=number_slider_15, Radius=number_slider_16, Obstacles=polygon.Polygon)  # -> Points, Distance, Index; disabled
line = Line(StartPoint=origin_2, EndPoint=isovist.Points)  # disabled

# ----
# 010_Intersect
# Physical
# Region
# Mathematical
# Shape
contour_2 = Contour(Point=Point(0, 0, 0), Direction=Vector(0, 0, 1))  # disabled
# EXERCISES_INTERSECT
isovist_2 = IsoVist(Count=10, Radius=100)  # -> Points, Distance, Index; disabled
curve_plane_2 = CurvePlane()  # -> Points, ParamsC, ParamsP; disabled
line_line_2 = LineLine()  # -> ParamA, ParamB, PointA, PointB; disabled
mesh_ray_2 = MeshRay()  # -> Point, Hit; disabled
plane_region_2 = PlaneRegion(Plane=PlaneXY(0, 0, 0))  # disabled
brep_plane_2 = BrepPlane(Plane=PlaneXY(0, 0, 0))  # -> Curves, Points; disabled
mesh_plane_2 = MeshPlane()  # disabled
plane_plane_2 = PlanePlane()  # disabled
# MGSM
# Grasshopper for Rhino3D
# http://grasshopperdocs.com/
# https://www.food4rhino.com/en
brep_line_2 = BrepLine(LimitToFirst=False)  # -> Curves, Points; disabled
surface_line_2 = SurfaceLine(LimitToFirst=False)  # -> Curves, Points, UVPoints, Normal; disabled
isovist_ray_2 = IsoVistRay(Radius=100)  # -> Point, Distance, Index; disabled
plane_plane_plane_2 = PlanePlanePlane()  # -> Point, LineAB, LineAC, LineBC; disabled
mesh_mesh = MeshMesh()  # disabled
surface_split = SurfaceSplit()  # disabled
curve_curve = CurveCurve()  # -> Points, ParamsA, ParamsB; disabled
brep_brep = BrepBrep()  # -> Curves, Points; disabled
brep_curve = BrepCurve()  # -> Curves, Points; disabled
mesh_curve = MeshCurve()  # -> Points, Faces; disabled
multiple_curves = MultipleCurves()  # -> Points, IndexA, IndexB, ParamA, ParamB; disabled
surface_curve = SurfaceCurve()  # -> Curves, Points, UVPoints, Normals, Parameters, Tangents; disabled
curve_self = CurveSelf()  # -> Points, Params; disabled
trim_with_region = TrimWithRegion()  # -> Inside, Outside; disabled
trim_with_brep = TrimWithBrep()  # -> Inside, Outside; disabled
split_with_brep = SplitWithBrep()  # -> Curve, Points; disabled
trim_with_regions = TrimWithRegions()  # -> Inside, Outside; disabled
# 001_Introduction
# Ribbon Vanilla Grasshopper
# 
# Params
# Maths
# Sets - data trees
# Vectors
# Curves
# Surfaces
# IntersectionTransformations
# Display
split_with_breps = SplitWithBreps()  # -> Curve, Points; disabled
trim_with_breps = TrimWithBreps()  # -> Inside, Outside; disabled
# 002_ribbon_vanilla_grasshopper
# Grasshopper Canvas for Rhino3D:
# 
# Ribbon:
# 
# File
# - new/open
# - save document/saveas
# - export image
# - document properties
# - user objects/ clusters
# - special folders (components/user objects)
# - preferences
# Display
# 
# - icons, wires, names
# - (consider Bifocals plugin)
# - selected only preview
# - plane size
# - mesh edges
# - gumball
# - canvas widgets
# (Markov, profiler, message balloons)
# Edit
# 
# - cut/copy/paste/delete
# - arrange groups
# - group/ungroup
# - cluster
# - find
# - create component popup
# View
# 
# - obscure components
# - zoom options on canvas
boundary_volume = BoundaryVolume()  # disabled
mesh_difference = MeshDifference()  # disabled
mesh_intersection = MeshIntersection()  # disabled
region_difference = RegionDifference()  # disabled
region_intersection = RegionIntersection()  # disabled
mesh_split = MeshSplit()  # disabled
solid_difference = SolidDifference()  # disabled
solid_intersection = SolidIntersection()  # disabled
mesh_union = MeshUnion()  # disabled
trim_solid = TrimSolid()  # disabled
region_union = RegionUnion()  # disabled
split_brep = SplitBrep()  # disabled
solid_union = SolidUnion()  # disabled
# Solution
# 
# - disable solver
# - scroll button/spacebar
# (cluster/group/preview/enable/solver/
# bake/zoom/find/preferences)
# Help
# 
# - tutorials
# - online forums
# - node references
split_brep_multiple = SplitBrepMultiple()  # disabled

# ----
# - I have seen this used once in generative design series:
# great video series (5 videos)
# Intermediate to advanced levels
occlusion = Occlusion()  # -> Hits, Occlusion; disabled

# ----
# 031_intersect_physical
# - consider and visualize how points, lines and curves
# are created by intersections
number_slider_17 = Slider(12, range=0..100)  # disabled
curve_2 = Curve([<curve referenced from the Rhino model> x2])  # disabled
curve_curve_2 = CurveCurve()  # -> Points, ParamsA, ParamsB; disabled
number_slider_18 = Slider(2, range=0..10)  # disabled
number_slider_19 = Slider(10, range=0..10)  # disabled
loft = Loft(Curves=curve_2, Options={Adjust=False, Closed=False, LoftEnds=0, LoftSimp=0, LoftType=0, Rebuild=10, Refit=0.01})  # disabled
number_slider_20 = Slider(12, range=0..100)  # disabled
number_slider_21 = Slider(2, range=0..10)  # disabled
triangular = Triangular(Plane=PlaneXY(0, 0, 0), Size=number_slider_17, ExtentX=5, ExtentY=5)  # -> Cells, Points; disabled
multiple_curves_2 = MultipleCurves()  # -> Points, IndexA, IndexB, ParamA, ParamB; disabled
divide_surface = DivideSurface(Surface=loft, UCount=number_slider_18, VCount=number_slider_19)  # -> Points, Normals, Parameters; disabled
construct_point_2 = ConstructPoint(XCoordinate=0, YCoordinate=0, ZCoordinate=0)  # disabled
list_length_2 = ListLength(List=triangular.Points)  # disabled
curve_self_2 = CurveSelf()  # -> Points, Params; disabled
construct_domain_2 = ConstructDomain(DomainStart=number_slider_21, DomainEnd=number_slider_20)  # disabled
expression = Expression(x=list_length_2, Expression="x-1")  # disabled
distance = Distance(PointA=divide_surface.Points, PointB=construct_point_2)  # disabled
number_slider_22 = Slider(12, range=0..100)  # disabled
number_slider_23 = Slider(0, range=0..1)  # disabled
number_slider_24 = Slider(12, range=0..100)  # disabled
brep_curve_2 = BrepCurve()  # -> Curves, Points; disabled
range_3 = Range(Domain=construct_domain_2, Steps=expression)  # disabled
flatten_tree = FlattenTree(Tree=distance, Path="{0}")  # disabled
surface_curve_2 = SurfaceCurve()  # -> Curves, Points, UVPoints, Normals, Parameters, Tangents; disabled
construct_domain_3 = ConstructDomain(DomainStart=0, DomainEnd=number_slider_22)  # disabled
bounds = Bounds(Numbers=flatten(flatten_tree))  # disabled
jitter = Jitter(List=range_3, Jitter=number_slider_23, Seed=number_slider_24)  # -> Values, Indices; disabled
cone = Cone(Base=triangular.Points, Radius=jitter.Values, Length=jitter.Values)  # -> Cone, Tip; disabled
reverse = Reverse(Vector=divide_surface.Normals)  # disabled
remap_numbers = RemapNumbers(Value=distance, Source=bounds, Target=construct_domain_3)  # -> Mapped, Clipped; disabled
mesh_curve_2 = MeshCurve()  # -> Points, Faces; disabled
cap_holes = CapHoles(Brep=cone.Cone)  # disabled
mesh_mesh_2 = MeshMesh()  # disabled
line_sdl = LineSDL(Start=divide_surface.Points, Direction=reverse, Length=remap_numbers.Mapped)  # disabled
number_slider_25 = Slider(1, range=0..1)  # disabled
number_slider_26 = Slider(52, range=0..100)  # disabled
brep_brep_2 = BrepBrep(BrepA=flatten(cap_holes), BrepB=cap_holes)  # -> Curves, Points; disabled
panel_3 = Panel("1")  # disabled
end_points = EndPoints(Curve=flatten(line_sdl))  # -> Start, End; disabled
addition = Addition(A=number_slider_18, B=panel_3)  # disabled
boolean_toggle = BooleanToggle(True)  # disabled
point = Point(end_points.End)  # disabled
quad_sphere = QuadSphere(Base=PlaneXY(0, 0, 0), Radius=number_slider_26)  # disabled
multipipe_2 = MultiPipe(
    Curves=brep_brep_2.Curves,
    NodeSize=number_slider_25,
    EndOffset=1,
    StrutSize=1,
    Segment=0,
    KinkAngle=0.6,
    CubeFit=0,
    Caps=0)  # disabled
surface_from_points = SurfaceFromPoints(Points=flatten(point), UCount=addition, Interpolate=boolean_toggle)  # disabled
deconstruct_brep = DeconstructBrep(Brep=quad_sphere)  # -> Faces, Edges, Vertices; disabled
merge = Merge()  # disabled
entwine = Entwine(Branch00=loft, Branch01=surface_from_points, FlattenInputs=True)  # disabled
curve_3 = Curve(deconstruct_brep.Edges)  # disabled
surface_split_2 = SurfaceSplit(Surface=surface_from_points, Curves=deconstruct_brep.Edges)  # disabled
list_item = ListItem(List=surface_split_2, Index=0, Wrap=True)  # disabled
surface = Surface(list_item)  # disabled

# ----
# 032_intersect_region
# - trim and split curves with Breps (3D) and regions (2D)
split_with_brep_2 = SplitWithBrep()  # -> Curve, Points; disabled
split_with_breps_2 = SplitWithBreps()  # -> Curve, Points; disabled
trim_with_brep_2 = TrimWithBrep()  # -> Inside, Outside; disabled
trim_with_breps_2 = TrimWithBreps()  # -> Inside, Outside; disabled
trim_with_region_2 = TrimWithRegion()  # -> Inside, Outside; disabled
trim_with_regions_2 = TrimWithRegions()  # -> Inside, Outside; disabled

# ----
# - split and trim with breps
number_slider_27 = Slider(89, range=0..100)  # disabled
number_slider_28 = Slider(10, range=0..10)  # disabled
range_4 = Range(Domain=Domain(0, 1), Steps=number_slider_27)  # disabled
range_5 = Range(Domain=Domain(0, 1), Steps=number_slider_27)  # disabled
jitter_2 = Jitter(List=range_4, Jitter=1, Seed=2)  # -> Values, Indices; disabled
sphere_2 = Sphere(Base=PlaneXY(0, 0, 0), Radius=number_slider_28)  # disabled
construct_point_3 = ConstructPoint(XCoordinate=range_5, YCoordinate=jitter_2.Values, ZCoordinate=0)  # disabled
evaluate_surface = EvaluateSurface(Surface=reparameterize(sphere_2), Point=construct_point_3)  # -> Point, Normal, UDirection, VDirection, Frame; disabled
number_slider_29 = Slider(10, range=0..10)  # disabled
plane_normal = PlaneNormal(Origin=evaluate_surface.Point, ZAxis=evaluate_surface.Normal)  # disabled
cone_2 = Cone(Base=plane_normal, Radius=expr("x/3", number_slider_29), Length=number_slider_29)  # -> Cone, Tip; disabled
cap_holes_2 = CapHoles(Brep=cone_2.Cone)  # disabled
number_slider_30 = Slider(1.07, range=0..2)  # disabled
panel_4 = Panel("1")  # disabled
range_6 = Range(Domain=number_slider_30, Steps=10)  # disabled
vector_xyz = VectorXYZ(XComponent=panel_4, YComponent=0, ZComponent=panel_4)  # -> Vector, Length; disabled
volume = Volume(Geometry=cap_holes_2)  # -> Volume, Centroid; disabled
pi_6 = Pi(Factor=range_6)  # disabled
rotate_3d_6 = Rotate3D(Geometry=cap_holes_2, Angle=pi_6, Center=volume.Centroid, Axis=vector_xyz.Vector)  # -> Geometry, Transform; disabled
number_slider_31 = Slider(27, range=0..89)  # disabled
number_slider_32 = Slider(1, range=0..10)  # disabled
trim_solid_2 = TrimSolid(Shape=sphere_2, Cutters=rotate_3d_6.Geometry)  # disabled
split_brep_multiple_2 = SplitBrepMultiple(Brep=sphere_2, Cutters=rotate_3d_6.Geometry)  # disabled
panel_5 = Panel("27")  # disabled
panel_6 = Panel("1")  # disabled
cull_index_2 = CullIndex(List=split_brep_multiple_2, Indices=panel_5, Wrap=True)  # disabled
list_item_2 = ListItem(List=split_brep_multiple_2, Index=panel_5, Wrap=True)  # disabled
list_item_3 = ListItem(List=trim_solid_2, Index=panel_6, Wrap=True)  # disabled
geometry = Geometry(list_item_2)  # disabled
geometry_2 = Geometry(cull_index_2)  # disabled
geometry_3 = Geometry(list_item_3)  # disabled

# ----
# 033_intersect_shape
# - be sure to deactivate solver before
#  changing data (with the spacebar or
#  pressing the control wheel to access)
# - now that you are dealing in solids, things
#  begin to slow down
# - it is advised to bake to rhino environment
# and then complete the boolean union
number_slider_33 = Slider(89, range=0..100)  # disabled
number_slider_34 = Slider(10, range=0..10)  # disabled
range_7 = Range(Domain=Domain(0, 1), Steps=number_slider_33)  # disabled
range_8 = Range(Domain=Domain(0, 1), Steps=number_slider_33)  # disabled
jitter_3 = Jitter(List=range_7, Jitter=1, Seed=2)  # -> Values, Indices; disabled
sphere_3 = Sphere(Base=PlaneXY(0, 0, 0), Radius=number_slider_34)  # disabled
construct_point_4 = ConstructPoint(XCoordinate=range_8, YCoordinate=jitter_3.Values, ZCoordinate=0)  # disabled
number_slider_35 = Slider(20, range=15..25)  # disabled
evaluate_surface_2 = EvaluateSurface(Surface=reparameterize(sphere_3), Point=construct_point_4)  # -> Point, Normal, UDirection, VDirection, Frame; disabled
plane_normal_2 = PlaneNormal(Origin=evaluate_surface_2.Point, ZAxis=evaluate_surface_2.Normal)  # disabled
rectangle = Rectangle(Plane=plane_normal_2, XSize=number_slider_35, YSize=number_slider_35, Radius=0)  # -> Rectangle, Length; disabled
boundary_surfaces = BoundarySurfaces(Edges=rectangle.Rectangle)  # disabled
number_slider_36 = Slider(2, range=0..2)  # disabled
panel_7 = Panel("1")  # disabled
boundary_volume_2 = BoundaryVolume(Boundaries=boundary_surfaces)  # disabled
vector_xyz_2 = VectorXYZ(XComponent=panel_7, YComponent=0, ZComponent=panel_7)  # -> Vector, Length; disabled
range_9 = Range(Domain=number_slider_36, Steps=10)  # disabled
volume_2 = Volume(Geometry=boundary_volume_2)  # -> Volume, Centroid; disabled
pi_7 = Pi(Factor=range_9)  # disabled
number_slider_37 = Slider(3, range=0..10)  # disabled
rotate_3d_7 = Rotate3D(Geometry=boundary_volume_2, Angle=pi_7, Center=volume_2.Centroid, Axis=vector_xyz_2.Vector)  # -> Geometry, Transform; disabled
polar_array = PolarArray(Geometry=rotate_3d_7.Geometry, Plane=plane_normal_2, Count=number_slider_37, Angle=6.283185307)  # -> Geometry, Transform; disabled

# ----
# - very simple algorithm, but consider the geometries that can be created
number_slider_38 = Slider(12, range=0..100)  # disabled
square = Square(Plane=PlaneXY(0, 0, 0), Size=number_slider_38, ExtentX=5, ExtentY=5)  # -> Cells, Points; disabled
radial_2 = Radial(Plane=PlaneXY(0, 0, 0), Size=number_slider_38, ExtentR=5, ExtentP=20)  # -> Cells, Points; disabled
hexagonal = Hexagonal(Plane=PlaneXY(0, 0, 0), Size=number_slider_38, ExtentX=5, ExtentY=5)  # -> Cells, Points; disabled
region_difference_2 = RegionDifference(CurvesA=square.Cells, CurvesB=hexagonal.Cells)  # disabled
region_union_2 = RegionUnion(Curves=[square.Cells, hexagonal.Cells])  # disabled
region_intersection_2 = RegionIntersection(CurvesA=region_difference_2, CurvesB=region_union_2)  # disabled

# ----
# - consider what is going on behind the scenes in all the mesh plugins
number_slider_39 = Slider(40, range=0..100)  # disabled
number_slider_40 = Slider(100, range=0..100)  # disabled
number_slider_41 = Slider(4, range=0..5)  # disabled
range_10 = Range(Domain=number_slider_39, Steps=number_slider_40)  # disabled
sine = Sine(Value=range_10)  # disabled
multiplication = Multiplication(A=sine, B=number_slider_41)  # disabled
number_slider_42 = Slider(1.679, range=0..5)  # disabled
construct_point_5 = ConstructPoint(XCoordinate=graft(range_10), YCoordinate=range_10, ZCoordinate=multiplication)  # disabled
surface_from_points_2 = SurfaceFromPoints(Points=flatten(construct_point_5), UCount=expr("x+1", number_slider_40), Interpolate=False)  # disabled
surface_2 = Surface(surface_from_points_2)  # disabled
area = Area(Geometry=surface_2)  # -> Area, Centroid; disabled
dimensions = Dimensions(Surface=surface_2)  # -> UDimension, VDimension; disabled
number_slider_43 = Slider(8, range=0..100)  # disabled
division = Division(A=dimensions.UDimension, B=dimensions.VDimension)  # disabled
scale = Scale(Geometry=surface_2, Center=area.Centroid, Factor=number_slider_42)  # -> Geometry, Transform; disabled
md_slider = MDSlider(
    SliderMode=0,
    slider_value=Point(0.4951607309, 0.2414119069, 0.5),
    x_domain=Domain(0, 1),
    y_domain=Domain(0, 1),
    z_domain=Domain(0, 1))  # disabled
multiplication_2 = Multiplication(A=division, B=number_slider_43)  # disabled
integer = Integer(multiplication_2)  # disabled
divide_surface_2 = DivideSurface(Surface=surface_2, UCount=integer, VCount=number_slider_43)  # -> flatten(Points), Normals, Parameters; disabled
md_slider_2 = MDSlider(
    SliderMode=0,
    slider_value=Point(0.7276408516, 0.09028392548, 0.5),
    x_domain=Domain(0, 1),
    y_domain=Domain(0, 1),
    z_domain=Domain(0, 1))  # disabled
number_slider_44 = Slider(0.243, range=0..2)  # disabled
md_slider_3 = MDSlider(
    SliderMode=0,
    slider_value=Point(0.1948275682, 0.7902063509, 0.5),
    x_domain=Domain(0, 1),
    y_domain=Domain(0, 1),
    z_domain=Domain(0, 1))  # disabled
evaluate_surface_3 = EvaluateSurface(Surface=reparameterize(scale.Geometry), Point=[md_slider_3, md_slider, md_slider_2])  # -> Point, Normal, UDirection, VDirection, Frame; disabled
distance_2 = Distance(PointA=graft(evaluate_surface_3.Point), PointB=divide_surface_2.Points)  # disabled
point_2 = Point(divide_surface_2.Points)  # disabled
expression_2 = Expression(w=flatten(number_slider_44), t=distance_2, Expression="sin(2*w^2*t)")  # disabled
flip_matrix_2 = FlipMatrix(Data=expression_2)  # disabled
number_slider_45 = Slider(7.333, range=0..10)  # disabled
ma = MassMultiplication(Input=flip_matrix_2)  # -> flatten(Result), PartialResults; disabled
multiplication_3 = Multiplication(A=number_slider_45, B=ma.Result)  # disabled
unit_z = UnitZ(Factor=multiplication_3)  # disabled
move = Move(Geometry=divide_surface_2.Points, Motion=unit_z)  # -> Geometry, Transform; disabled
colour_swatch = ColourSwatch(SwatchColor=RGB(236, 45, 255))  # disabled
expression_3 = Expression(u=integer, Expression="u+1")  # disabled
mesh_frompoints = MeshFromPoints(Points=move.Geometry, UDirection=expr("x+1", integer), VDirection=expr("x+1", number_slider_43), Colour=colour_swatch)  # disabled
mesh_box = MeshBox(Base={Plane=PlaneXY(0, 0, 0), X=Domain(-10, 10), Y=Domain(-10, 10), Z=Domain(-10, 10)}, XCount=10, YCount=10, ZCount=10)  # disabled
number_slider_46 = Slider(1.7, range=0..3)  # disabled
deconstruct_mesh = DeconstructMesh(Mesh=mesh_frompoints)  # -> Vertices, Faces, Colours, Normals; disabled
mesh_sphere = MeshSphere(Base=deconstruct_mesh.Vertices, Radius=number_slider_46, UCount=10, VCount=20)  # disabled
mesh_union_2 = MeshUnion(Meshes=flatten([mesh_frompoints, mesh_sphere]))  # disabled
mesh_difference_2 = MeshDifference(MeshesA=mesh_frompoints, MeshesB=mesh_sphere)  # disabled
mesh_intersection_2 = MeshIntersection(MeshesA=mesh_frompoints, MeshesB=mesh_sphere)  # disabled
mesh_split_2 = MeshSplit(Mesh=mesh_frompoints, Splitters=mesh_sphere)  # disabled
panel_8 = Panel("1")  # disabled
list_item_4 = ListItem(List=mesh_split_2, Index=panel_8, Wrap=True)  # disabled
cull_index_3 = CullIndex(List=mesh_split_2, Indices=panel_8, Wrap=True)  # disabled
mesh = Mesh(mesh_difference_2)  # disabled
mesh_2 = Mesh(mesh_intersection_2)  # disabled
mesh_3 = Mesh(mesh_union_2)  # disabled
mesh_4 = Mesh(list_item_4)  # disabled
mesh_5 = Mesh(cull_index_3)  # disabled

# ----
# - keep an eye on your profiler widget
# - consider baking into rhino environment
# and performing these operations with
# boolean tools in rhino
solid_difference_2 = SolidDifference()  # disabled
solid_intersection_2 = SolidIntersection()  # disabled
solid_union_2 = SolidUnion()  # disabled

# ----
# EXERCISES_TRANSFORM
# 034_transformations_affine
# - scale with ranges and series and consider
# center points
# - consider linking all of your parameters to avoid
# collisions and reduce the need for boolean
# operations
number_slider_47 = Slider(12, range=0..100)  # disabled
number_slider_48 = Slider(100, range=0..100)  # disabled
range_11 = Range(Domain=number_slider_47, Steps=number_slider_48)  # disabled
sine_2 = Sine(Value=range_11)  # disabled
cosine = Cosine(Value=range_11)  # disabled
construct_point_6 = ConstructPoint(XCoordinate=sine_2, YCoordinate=cosine, ZCoordinate=range_11)  # disabled
number_slider_49 = Slider(32, range=0..100)  # disabled
nurbs_curve = NurbsCurve(Vertices=construct_point_6, Degree=3, Periodic=False)  # -> Curve, Length, Domain; disabled
divide_curve = DivideCurve(Curve=nurbs_curve.Curve, Count=number_slider_49, Kinks=False)  # -> Points, Tangents, Parameters; disabled
number_slider_50 = Slider(4, range=0..100)  # disabled
align_plane = AlignPlane(Plane=divide_curve.Points, Direction=divide_curve.Tangents)  # -> Plane, Angle; disabled
vector_display = VectorDisplay(Anchor=divide_curve.Points, Vector=divide_curve.Tangents)  # disabled
center_box = CenterBox(Base=PlaneXY(0, 0, 0), X=number_slider_50, Y=expr("x/3", number_slider_50), Z=expr("x/6", number_slider_50))  # disabled
deconstruct_brep_2 = DeconstructBrep(Brep=center_box)  # -> Faces, Edges, Vertices; disabled
panel_9 = Panel("3")  # disabled
list_item_5 = ListItem(List=deconstruct_brep_2.Faces, Index=panel_9, Wrap=True)  # disabled
area_2 = Area(Geometry=list_item_5)  # -> Area, Centroid; disabled
number_slider_51 = Slider(1, range=0..1)  # disabled
number_slider_52 = Slider(0.42, range=0..1)  # disabled
number_slider_53 = Slider(1, range=0..1)  # disabled
orient = Orient(Geometry=center_box, Source=area_2.Centroid, Target=align_plane.Plane)  # -> Geometry, Transform; disabled
scale_2 = Scale(Geometry=orient.Geometry, Center=divide_curve.Points, Factor=number_slider_51)  # -> Geometry, Transform; disabled
scale_nu = ScaleNU(
    Geometry=orient.Geometry,
    Plane=align_plane.Plane,
    ScaleX=number_slider_51,
    ScaleY=number_slider_53,
    ScaleZ=number_slider_52)  # -> Geometry, Transform; disabled

# ----
# - mapping is a good way to orient complex and simple
# geometry
number_slider_54 = Slider(12, range=0..100)  # disabled
number_slider_55 = Slider(12, range=0..100)  # disabled
number_slider_56 = Slider(2, range=0..10)  # disabled
number_slider_57 = Slider(3, range=0..3)  # disabled
number_slider_58 = Slider(2, range=0..10)  # disabled
construct_point_7 = ConstructPoint(XCoordinate=number_slider_54, YCoordinate=0, ZCoordinate=0)  # disabled
number_slider_59 = Slider(3, range=0..10)  # disabled
sphere_4 = Sphere(Base=PlaneXY(0, 0, 0), Radius=number_slider_56)  # disabled
cone_3 = Cone(Base=PlaneXY(0, 0, 0), Radius=number_slider_55, Length=number_slider_55)  # -> Cone, Tip; disabled
polygon_2 = Polygon(Plane=construct_point_7, Radius=number_slider_57, Segments=number_slider_59, FilletRadius=0)  # -> Polygon, Length; disabled
circle = Circle(Plane=construct_point_7, Radius=number_slider_58)  # disabled
bounding_box = BoundingBox(Content=cone_3.Cone, Plane=PlaneXY(0, 0, 0))  # -> Box, Box_2; disabled
bounding_box_2 = BoundingBox(Content=sphere_4, Plane=PlaneXY(0, 0, 0))  # -> Box, Box_2; disabled
polygon_3 = Polygon(Plane=PlaneXY(0, 0, 0), Radius=number_slider_55, Segments=number_slider_59, FilletRadius=0)  # -> Polygon, Length; disabled
polar_array_2 = PolarArray(Geometry=circle, Plane=PlaneXY(0, 0, 0), Count=10, Angle=6.283185307)  # -> Geometry, Transform; disabled
polar_array_3 = PolarArray(Geometry=polygon_2.Polygon, Plane=PlaneXY(0, 0, 0), Count=10, Angle=6.283185307)  # -> Geometry, Transform; disabled
bounding_box_3 = BoundingBox(Content=polygon_3.Polygon, Plane=PlaneXY(0, 0, 0))  # -> Box, Box_2; disabled
bounding_box_4 = BoundingBox(Content=polar_array_2.Geometry, Plane=PlaneXY(0, 0, 0))  # -> Box, Box_2; disabled
box_mapping = BoxMapping(Geometry=cone_3.Cone, Source=bounding_box.Box, Target=bounding_box_2.Box)  # -> Geometry, Transform; disabled
deconstruct_brep_3 = DeconstructBrep(Brep=bounding_box_3.Box)  # -> Faces, Edges, Vertices; disabled
deconstruct_brep_4 = DeconstructBrep(Brep=bounding_box_4.Box)  # -> Faces, Edges, Vertices; disabled
rectangle_mapping = RectangleMapping(Geometry=polygon_3.Polygon, Source=deconstruct_brep_3.Faces, Target=deconstruct_brep_4.Faces)  # -> Geometry, Transform; disabled
triangle_mapping = TriangleMapping(Geometry=circle, Source=polygon_3.Polygon, Target=polar_array_3.Geometry)  # -> Geometry, Transform; disabled
geometry_4 = Geometry(box_mapping.Geometry)  # disabled
curve_4 = Curve(rectangle_mapping.Geometry)  # disabled
curve_5 = Curve(triangle_mapping.Geometry)  # disabled

# ----
# - a bit of fun with camera obscura, orient direction and pathmapper
number_slider_60 = Slider(2, range=0..10)  # disabled
number_slider_61 = Slider(3, range=0..10)  # disabled
number_slider_62 = Slider(1, range=0..1)  # disabled
negative = Negative(Value=number_slider_60)  # disabled
panel_10 = Panel(".1")  # disabled
number_slider_63 = Slider(8, range=0..10)  # disabled
construct_domain_4 = ConstructDomain(DomainStart=negative, DomainEnd=number_slider_60)  # disabled
unit_z_2 = UnitZ(Factor=number_slider_60)  # disabled
construct_domain_5 = ConstructDomain(DomainStart=panel_10, DomainEnd=number_slider_62)  # disabled
multiplication_4 = Multiplication(A=number_slider_61, B=unit_z_2)  # disabled
domain_box = DomainBox(Base=PlaneXY(0, 0, 0), X=construct_domain_4, Y=construct_domain_4, Z=Domain(0, 0.25))  # disabled
range_12 = Range(Domain=construct_domain_5, Steps=number_slider_63)  # disabled
move_2 = Move(Geometry=domain_box, Motion=multiplication_4)  # -> Geometry, Transform; disabled
yz_plane_2 = YZPlane(Origin=Point(0, 0, 0))  # disabled
deconstruct_brep_5 = DeconstructBrep(Brep=domain_box)  # -> Faces, Edges, Vertices; disabled
volume_3 = Volume(Geometry=move_2.Geometry)  # -> Volume, Centroid; disabled
camera_obscura = CameraObscura(Geometry=move_2.Geometry, Point=yz_plane_2, Factor=range_12)  # -> graft(Geometry), Transform; disabled
dispatch = Dispatch(List=deconstruct_brep_5.Vertices, DispatchPattern=[True, False])  # -> ListA, ListB; disabled
camera_obscura_2 = CameraObscura(Geometry=camera_obscura.Geometry, Point=volume_3.Centroid, Factor=range_12)  # -> Geometry, Transform; disabled
line_sdl_2 = LineSDL(Start=volume_3.Centroid, Direction=dispatch.ListB, Length=1)  # disabled
line_sdl_3 = LineSDL(Start=volume_3.Centroid, Direction=dispatch.ListA, Length=1)  # disabled
orient_direction = OrientDirection(
    Geometry=graft(camera_obscura_2.Geometry),
    PointA=volume_3.Centroid,
    DirectionA=line_sdl_3,
    PointB=volume_3.Centroid,
    DirectionB=line_sdl_2)  # -> simplify(Geometry), Transform; disabled
path_mapper = PathMapper(orient_direction.Geometry, source="{A;B}(i)", target="{A}(i)")  # disabled
path_mapper_2 = PathMapper(orient_direction.Geometry, source="{A;B}(i)", target="{B}(i)")  # disabled
geometry_5 = Geometry(path_mapper)  # disabled
geometry_6 = Geometry(path_mapper_2)  # disabled

# ----
# - projecting and projecting with direction
number_slider_64 = Slider(0, range=0..1)  # disabled
number_slider_65 = Slider(0.69, range=0..1)  # disabled
number_slider_66 = Slider(20, range=0..100)  # disabled
number_slider_67 = Slider(4, range=0..10)  # disabled
number_slider_68 = Slider(13, range=0..100)  # disabled
construct_domain_6 = ConstructDomain(DomainStart=number_slider_64, DomainEnd=number_slider_65)  # disabled
division_2 = Division(A=number_slider_66, B=number_slider_67)  # disabled
sphere_5 = Sphere(Base=PlaneXY(0, 0, 0), Radius=number_slider_66)  # disabled
quad_sphere_2 = QuadSphere(Base=PlaneXY(0, 0, 0), Radius=division_2)  # disabled
range_13 = Range(Domain=construct_domain_6, Steps=number_slider_68)  # disabled
deconstruct_brep_6 = DeconstructBrep(Brep=quad_sphere_2)  # -> Faces, graft(Edges), Vertices; disabled
construct_point_8 = ConstructPoint(XCoordinate=range_13, YCoordinate=range_13, ZCoordinate=0)  # disabled
number_slider_69 = Slider(7.32, range=0..10)  # disabled
number_slider_70 = Slider(7.32, range=0..10)  # disabled
number_slider_71 = Slider(7.32, range=0..10)  # disabled
evaluate_surface_4 = EvaluateSurface(Surface=reparameterize(sphere_5), Point=construct_point_8)  # -> Point, Normal, UDirection, VDirection, Frame; disabled
number_slider_72 = Slider(100, range=0..100)  # disabled
align_plane_2 = AlignPlane(Plane=evaluate_surface_4.Point, Direction=evaluate_surface_4.Normal)  # -> Plane, Angle; disabled
plane_normal_3 = PlaneNormal(Origin=evaluate_surface_4.Point, ZAxis=evaluate_surface_4.Normal)  # disabled
construct_point_9 = ConstructPoint(XCoordinate=number_slider_69, YCoordinate=number_slider_70, ZCoordinate=number_slider_71)  # disabled
polygon_4 = Polygon(Plane=plane_normal_3, Radius=number_slider_72, Segments=6, FilletRadius=0)  # -> Polygon, Length; disabled
vector_2pt = Vector2Pt(PointA=construct_point_9, PointB=evaluate_surface_4.Point, Unitize=False)  # -> Vector, Length; disabled
boundary_surfaces_2 = BoundarySurfaces(Edges=polygon_4.Polygon)  # disabled
vector_display_2 = VectorDisplay(Anchor=vector_2pt.Vector, Vector=vector_2pt.Vector)  # disabled
project = Project(Geometry=deconstruct_brep_6.Edges, Plane=boundary_surfaces_2)  # -> Geometry, Transform; disabled
project_along = ProjectAlong(Geometry=deconstruct_brep_6.Edges, Plane=boundary_surfaces_2, Direction=vector_2pt.Vector)  # -> Geometry, Transform; disabled
multipipe_3 = MultiPipe(Curves=project_along.Geometry, NodeSize=0.5, EndOffset=1, StrutSize=1, Segment=0, KinkAngle=0.6, CubeFit=0, Caps=0)  # disabled
multipipe_4 = MultiPipe(Curves=project.Geometry, NodeSize=0.5, EndOffset=1, StrutSize=1, Segment=0, KinkAngle=0.6, CubeFit=0, Caps=0)  # disabled

# ----
# 011_Transformations
# Array
# Morph
# Euclidean
# Utility
# Affine
scale_nu_2 = ScaleNU(Plane=PlaneXY(0, 0, 0), ScaleX=1, ScaleY=1, ScaleZ=1)  # -> Geometry, Transform; disabled
project_2 = Project(Plane=PlaneXY(0, 0, 0))  # -> Geometry, Transform; disabled
project_along_2 = ProjectAlong(Plane=PlaneXY(0, 0, 0), Direction=Vector(0, 0, -1))  # -> Geometry, Transform; disabled
scale_3 = Scale(Center=Point(0, 0, 0), Factor=0.5)  # -> Geometry, Transform; disabled
orient_direction_2 = OrientDirection(PointA=Point(0, 0, 0), DirectionA=Vector(0, 0, 1), PointB=Point(0, 0, 0), DirectionB=Vector(0, 0, 1))  # -> Geometry, Transform; disabled
camera_obscura_3 = CameraObscura(Point=Point(0, 0, 0), Factor=1)  # -> Geometry, Transform; disabled
box_mapping_2 = BoxMapping()  # -> Geometry, Transform; disabled
rectangle_mapping_2 = RectangleMapping()  # -> Geometry, Transform; disabled
triangle_mapping_2 = TriangleMapping()  # -> Geometry, Transform; disabled
box_array = BoxArray(Cell={Plane=PlaneXY(0, 0, 0), X=Domain(0, 10), Y=Domain(0, 5), Z=Domain(0, 2)}, XCount=4, YCount=3, ZCount=2)  # -> Geometry, Transform; disabled
curve_array = CurveArray(Count=10)  # -> Geometry, Transform; disabled
linear_array = LinearArray(Direction=Vector(10, 0, 0), Count=10)  # -> Geometry, Transform; disabled
polar_array_4 = PolarArray(Plane=PlaneXY(0, 0, 0), Count=10, Angle=6.283185307)  # -> Geometry, Transform; disabled
rectangular_array = RectangularArray(Cell={Plane=PlaneXY(0, 0, 0), Size=Domain2(u=0..10, v=0..5)}, XCount=6, YCount=3)  # -> Geometry, Transform; disabled
kaleidoscope = Kaleidoscope(Plane=PlaneXY(0, 0, 0), Segments=10)  # -> Geometry, Transform; disabled
mirror = Mirror(Plane=PlaneYZ(0, 0, 0))  # -> Geometry, Transform; disabled
move_3 = Move(Motion=Vector(0, 0, 10))  # -> Geometry, Transform; disabled
orient_2 = Orient(Source=PlaneXY(0, 0, 0), Target=PlaneXY(0, 0, 0))  # -> Geometry, Transform; disabled
move_to_plane = MoveToPlane(Plane=PlaneXY(0, 0, 0), Above=True, Below=True)  # -> Geometry, Transform; disabled
rotate = Rotate(Angle=1.570796327, Plane=PlaneXY(0, 0, 0))  # -> Geometry, Transform; disabled
rotate_3d_8 = Rotate3D(Angle=1.570796327, Center=Point(0, 0, 0), Axis=Vector(0, 0, 1))  # -> Geometry, Transform; disabled
rotate_axis = RotateAxis(Angle=1.570796327, Axis=Line((0, 0, 0), (10, 0, 0)))  # -> Geometry, Transform; disabled
rotate_direction = RotateDirection(Center=Point(0, 0, 0), From=Vector(1, 0, 0), To=Vector(0, 1, 0))  # -> Geometry, Transform; disabled
flow = Flow(ReverseBase=False, ReverseTarget=False, Stretch=True, Rigid=False)  # disabled
splop = Splop(Plane=PlaneXY(0, 0, 0), Angle=0, Rigid=False)  # disabled
bend_deform = BendDeform()  # disabled
twisted_box = TwistedBox()  # disabled
surface_morph = SurfaceMorph()  # disabled
sporph = Sporph(Rigid=False)  # disabled
box_morph = BoxMorph()  # disabled
maelstrom = Maelstrom(Plane=PlaneXY(0, 0, 0), First=0.1, Second=10, Angle=1.570796327, Rigid=False)  # disabled
stretch = Stretch(Axis=Line((0, 0, 0), (10, 10, 0)), Length=20, Rigid=False)  # disabled
twist = Twist(Angle=1.570796327, Infinite=False, Rigid=False)  # disabled
inverse_transform = InverseTransform()  # disabled
transform_matrix = TransformMatrix(Digits=3)  # disabled
transform = Transform()  # disabled
merge_group = MergeGroup()  # disabled
group = Group()  # disabled
split_group = SplitGroup(Wrap=False)  # -> GroupA, GroupB; disabled
ungroup = Ungroup()  # disabled
compound = Compound()  # disabled
split = Split()  # disabled

number_slider_73 = Slider(1, range=0..1)  # disabled

# ----
# 035_transformations_array
# - great ways to get simple geometry to be more
# complex and exciting to visualize
number_slider_74 = Slider(100, range=0..100)  # disabled
panel_11 = Panel("10")  # disabled
panel_12 = Panel("2")  # disabled
division_3 = Division(A=number_slider_74, B=panel_11)  # disabled
division_4 = Division(B=panel_12)  # disabled
number_slider_75 = Slider(6, range=0..10)  # disabled
range_14 = Range(Domain=division_3, Steps=number_slider_74)  # disabled
division_5 = Division(A=division_3, B=panel_12)  # disabled
base = Base(PlaneXY(0, 0, 0))  # disabled
pi_8 = Pi(Factor=range_14)  # disabled
cosine_2 = Cosine(Value=range_14)  # disabled
sine_3 = Sine(Value=range_14)  # disabled
rectangle_2 = Rectangle(Plane=base, XSize=Domain(-1, 1), YSize=Domain(-2, 2), Radius=0)  # -> Rectangle, Length; disabled
division_6 = Division(A=division_3, B=division_5)  # disabled
number_slider_76 = Slider(2, range=0..2)  # disabled
multiplication_5 = Multiplication(A=pi_8, B=number_slider_75)  # disabled
multiplication_6 = Multiplication(A=pi_8, B=cosine_2)  # disabled
multiplication_7 = Multiplication(A=pi_8, B=sine_3)  # disabled
cylinder = Cylinder(Base=PlaneXY(0, 0, 0), Radius=division_6, Length=division_6)  # disabled
number_slider_77 = Slider(3, range=0..10)  # disabled
construct_point_10 = ConstructPoint(XCoordinate=multiplication_5, YCoordinate=multiplication_6, ZCoordinate=multiplication_7)  # disabled
range_15 = Range(Domain=number_slider_76, Steps=expr("x-1", 10))  # disabled
range_16 = Range(Domain=Domain(0, 1), Steps=10)  # disabled
center_box_2 = CenterBox(Base=base, X=1, Y=1, Z=1)  # disabled
interpolate = Interpolate(Vertices=construct_point_10, Degree=3, Periodic=False, KnotStyle=1)  # -> Curve, Length, Domain; disabled
unit_z_3 = UnitZ(Factor=1)  # disabled
deconstruct_brep_7 = DeconstructBrep(Brep=center_box_2)  # -> Faces, Edges, Vertices; disabled
pi_9 = Pi(Factor=range_15)  # disabled
shatter = Shatter(Curve=reparameterize(interpolate.Curve), Parameters=range_16)  # disabled
curve_middle = CurveMiddle(Curve=shatter)  # disabled
number_slider_78 = Slider(10, range=0..100)  # disabled
rotate_3d_9 = Rotate3D(Geometry=shatter, Angle=pi_9, Center=curve_middle, Axis=unit_z_3)  # -> Geometry, Transform; disabled
polar_array_5 = PolarArray(Geometry=interpolate.Curve, Plane=PlaneXY(0, 0, 0), Count=number_slider_74, Angle=6.283185307)  # -> Geometry, Transform; disabled
linear_array_2 = LinearArray(Geometry=cylinder, Direction=Vector(10, 0, 0), Count=number_slider_74)  # -> Geometry, Transform; disabled
box_array_2 = BoxArray(Geometry=cylinder, Cell=center_box_2, XCount=number_slider_77, YCount=number_slider_77, ZCount=number_slider_77)  # -> Geometry, Transform; disabled
rectangular_array_2 = RectangularArray(Geometry=cylinder, Cell=rectangle_2.Rectangle, XCount=number_slider_77, YCount=number_slider_77)  # -> Geometry, Transform; disabled
curve_array_2 = CurveArray(Geometry=cylinder, Curve=interpolate.Curve, Count=number_slider_74)  # -> Geometry, Transform; disabled
number_slider_79 = Slider(10, range=0..10)  # disabled
polar_array_6 = PolarArray(Geometry=rotate_3d_9.Geometry, Plane=PlaneXY(0, 0, 0), Count=number_slider_78, Angle=pi_9)  # -> Geometry, Transform; disabled
loft_2 = Loft(
    Curves=polar_array_5.Geometry,
    Options={Adjust=False, Closed=True, LoftEnds=0, LoftSimp=0, LoftType=0, Rebuild=10, Refit=0.01})  # disabled
kaleidoscope_2 = Kaleidoscope(Geometry=polar_array_6.Geometry, Plane=PlaneXY(0, 0, 0), Segments=number_slider_79)  # -> Geometry, Transform; disabled
geometry_7 = Geometry(kaleidoscope_2.Geometry)  # disabled

# ----
# 036_transform_euclidean
# - intuitive and commonly used nodes for transformations
# - there are many ways to rotate geometries in grasshopper
rotate_2 = Rotate(Angle=1.570796327, Plane=PlaneXY(0, 0, 0))  # -> Geometry, Transform; disabled
mirror_2 = Mirror(Plane=PlaneYZ(0, 0, 0))  # -> Geometry, Transform; disabled
rotate_plane = RotatePlane()  # disabled
rotate_3d_10 = Rotate3D(Angle=1.570796327, Center=Point(0, 0, 0), Axis=Vector(0, 0, 1))  # -> Geometry, Transform; disabled
move_4 = Move(Motion=Vector(0, 0, 10))  # -> Geometry, Transform; disabled
rotate_axis_2 = RotateAxis(Angle=1.570796327, Axis=Line((0, 0, 0), (10, 0, 0)))  # -> Geometry, Transform; disabled
orient_3 = Orient(Source=PlaneXY(0, 0, 0), Target=PlaneXY(0, 0, 0))  # -> Geometry, Transform; disabled
rotate_direction_2 = RotateDirection(Center=Point(0, 0, 0), From=Vector(1, 0, 0), To=Vector(0, 1, 0))  # -> Geometry, Transform; disabled
# 037_transform_morph
# - these nodes can get "heavy" fast
# careful using them
move_to_plane_2 = MoveToPlane(Plane=PlaneXY(0, 0, 0), Above=True, Below=True)  # -> Geometry, Transform; disabled

flow_2 = Flow(ReverseBase=False, ReverseTarget=False, Stretch=True, Rigid=False)
splop_2 = Splop(Plane=PlaneXY(0, 0, 0), Angle=0, Rigid=False)
bend_deform_2 = BendDeform()
twisted_box_2 = TwistedBox()
surface_morph_2 = SurfaceMorph()
sporph_2 = Sporph(Rigid=False)
box_morph_2 = BoxMorph()
maelstrom_2 = Maelstrom(Plane=PlaneXY(0, 0, 0), First=0.1, Second=10, Angle=1.570796327, Rigid=False)
stretch_2 = Stretch(Axis=Line((0, 0, 0), (10, 10, 0)), Length=20, Rigid=False)
twist_2 = Twist(Angle=1.570796327, Infinite=False, Rigid=False)

# ----
# 012_Display
# Preview
# Vector
# Dimensions
make2d = Make2D(TangentEdges=False, TangentSeams=False, AutoComputeMake2D=False)  # -> VisibleCurves, VisibleIndex, VisibleType, HiddenCurves, HiddenIndex, HiddenType; disabled
make2d_parallel_view = Make2DParallelView()  # disabled
make2d_perspective_view = Make2DPerspectiveView()  # disabled
make2d_rhino_view = Make2DRhinoView(Clip=True)  # disabled
text_tag_3d = TextTag3D(Size=1, Justification=7)  # disabled
gradient_hatch = GradientHatch(Colour1=RGB(255, 20, 147), Colour2=RGB(139, 0, 139))  # disabled
pattern_hatch = PatternHatch(Pattern=0, Scale=1, Angle=0)  # disabled
aligned_dimension = AlignedDimension(Plane=PlaneXY(0, 0, 0), Offset=1, Text="{0:0.00}", Size=1)  # disabled
angular_dimension = AngularDimension(Reflex=False, Text="{0:0.0}°", Size=1)  # disabled
arc_dimension = ArcDimension(Offset=2, Text="{0:0.0}°", Size=1)  # disabled
line_dimension = LineDimension(Text="{0:0.00}", Size=1)  # disabled
angular_dimensions_mesh = AngularDimensionsMesh(Text="{0:0.0}°", Size=1, LengthFactor=0.5)  # disabled
text_tag = TextTag()  # disabled
linear_dimension = LinearDimension(Text="{0:0.00}", Size=1)  # disabled
circular_dimension = CircularDimension(Text="{0:0.0}°", Size=1)  # disabled
create_material = CreateMaterial(Diffuse=RGB(255, 105, 180), Specular=RGB(255, 255, 255), Emission=RGB(0, 0, 0), Transparency=0, Shine=0)  # disabled
custom_preview = CustomPreview(Material={diffuse=RGB(221, 160, 221), emission=RGB(66, 48, 66), shine=0.5, specular=RGB(255, 255, 255), transparency=0})  # disabled
vector_display_3 = VectorDisplay()  # disabled
point_list = PointList()  # disabled
point_order = PointOrder()  # disabled
vector_display_ex = VectorDisplayEx(Colour=RGB(0, 0, 0), Width=2)  # disabled
