# Grasshopper definition 016_exercises_Section_002_continued.gh (Grasshopper 1.0.7)
# plug-ins: Kangaroo2 Components, MeshEdit Components, Bifocals

# ----
# 030_intersect_mathematical
# - consider and visualize how points, lines and curves
# are created by intersections
# - controling plane region
# - isovist can product very interesting effects
number_slider = Slider(12, range=0..100)  # disabled
number_slider_2 = Slider(6, range=0..10)  # disabled
number_slider_3 = Slider(13, range=0..100)  # disabled
brep_line = BrepLine(LimitToFirst=False)  # -> Curves, Points; disabled
curve_plane = CurvePlane()  # -> Points, ParamsC, ParamsP; disabled
origin = Origin([Point(-45.78873606, -28.06335384, 0), Point(16.72870203, 65.64266703, 0), Point(-58.87617381, 62.3246864, 0), Point(101.0585885, -89.13142274, 0)])  # disabled
xz_plane = XZPlane(Origin=Point(0, 0, 0))  # disabled
xz_plane_2 = XZPlane(Origin=Point(0, 0, 0))  # disabled
number_slider_4 = Slider(2, range=0..2)  # disabled
radial = Radial(Plane=PlaneXY(0, 0, 0), Size=number_slider, ExtentR=number_slider_2, ExtentP=number_slider_2)  # -> Cells, simplify(Points); disabled
number_slider_5 = Slider(0.92, range=0..1)  # disabled
number_slider_6 = Slider(0.33, range=0..1)  # disabled
number_slider_7 = Slider(0.53, range=0..1)  # disabled
number_slider_8 = Slider(0.22, range=0..1)  # disabled
mesh_plane = MeshPlane()  # disabled
number_slider_9 = Slider(5, range=0..10)  # disabled
line_line = LineLine()  # -> ParamA, ParamB, PointA, PointB; disabled
plane_origin = PlaneOrigin(Base=xz_plane_2, Origin=origin)  # disabled
panel = Panel("0")  # disabled
sphere = Sphere(Base=PlaneXY(0, 0, 0), Radius=number_slider_3)  # disabled
mesh_ray = MeshRay()  # -> Point, Hit; disabled
number_slider_10 = Slider(2, range=0..10)  # disabled
number_slider_11 = Slider(6.78, range=0.1..10)  # disabled
number_slider_12 = Slider(1.3, range=0.1..3)  # disabled
explode_tree = ExplodeTree(Data=graft(plane_origin))  # -> Branch0, Branch1, Branch2, Branch3; disabled
flip_matrix = FlipMatrix(Data=radial.Points)  # disabled
pi = Pi(Factor=number_slider_6)  # disabled
pi_2 = Pi(Factor=number_slider_7)  # disabled
pi_3 = Pi(Factor=number_slider_5)  # disabled
plane_plane = PlanePlane()  # disabled
pi_4 = Pi(Factor=number_slider_8)  # disabled
surface_line = SurfaceLine(LimitToFirst=False)  # -> Curves, Points, UVPoints, Normal; disabled
range = Range(Domain=number_slider_4, Steps=number_slider_9)  # disabled
cull_index = CullIndex(List=flip_matrix, Indices=panel, Wrap=True)  # disabled
isovist_ray = IsoVistRay(Radius=100)  # -> Point, Distance, Index; disabled
rotate_3d = Rotate3D(Geometry=explode_tree.Branch0, Angle=pi_4, Center=explode_tree.Branch0, Axis=Vector(0, 0, 1))  # -> Geometry, Transform; disabled
rotate_3d_2 = Rotate3D(Geometry=explode_tree.Branch1, Angle=pi_3, Center=explode_tree.Branch0, Axis=Vector(0, 0, 1))  # -> Geometry, Transform; disabled
rotate_3d_3 = Rotate3D(Geometry=explode_tree.Branch2, Angle=pi_2, Center=explode_tree.Branch2, Axis=Vector(0, 0, 1))  # -> Geometry, Transform; disabled
rotate_3d_4 = Rotate3D(Geometry=explode_tree.Branch3, Angle=pi, Center=explode_tree.Branch3, Axis=Vector(0, 0, 1))  # -> Geometry, Transform; disabled
construct_domain = ConstructDomain(DomainStart=number_slider_12, DomainEnd=number_slider_11)  # disabled
plane_plane_plane = PlanePlanePlane()  # -> Point, LineAB, LineAC, LineBC; disabled
list_length = ListLength(List=cull_index)  # disabled
pi_5 = Pi(Factor=range)  # disabled
contour = Contour(Shape=sphere, Point=Point(0, 0, 0), Direction=Vector(0, 0, 1), Distance=number_slider_10)  # disabled
xz_plane_3 = XZPlane(Origin=Point(0, 0, 0))  # disabled
yz_plane = YZPlane(Origin=Point(0, 0, 0))  # disabled
xy_plane = XYPlane(Origin=Point(0, 0, 0))  # disabled
panel_2 = Panel("3")  # disabled
range_2 = Range(Domain=construct_domain, Steps=expr("x-1", list_length))  # disabled
plane = Plane(PlaneXY(0, 0, 0))  # disabled
series = Series(Start=panel_2, Step=1, Count=list_length)  # disabled
number_slider_13 = Slider(29, range=0..100)  # disabled
number_slider_14 = Slider(11, range=0..100)  # disabled
plane_region = PlaneRegion(Plane=plane, Bounds=flatten([rotate_3d_3.Geometry, rotate_3d.Geometry, rotate_3d_2.Geometry, rotate_3d_4.Geometry]))  # disabled
rotate_3d_5 = Rotate3D(Geometry=xz_plane, Angle=pi_5, Center=xz_plane, Axis=graft([yz_plane, xz_plane_3, xy_plane]))  # -> Geometry, Transform; disabled
curve = Curve(plane_region)  # disabled
construct_point = ConstructPoint(XCoordinate=number_slider_14, YCoordinate=number_slider_13, ZCoordinate=0)  # disabled
brep_plane = BrepPlane(Brep=sphere, Plane=rotate_3d_5.Geometry)  # -> Curves, Points; disabled
origin_2 = Origin(construct_point)  # disabled
xy_plane_2 = XYPlane(Origin=origin_2)  # disabled
number_slider_15 = Slider(248, range=0..1000)  # disabled
number_slider_16 = Slider(242, range=0..1000)  # disabled
multipipe = MultiPipe(Curves=contour, NodeSize=0.5, EndOffset=1, StrutSize=1, Segment=0, KinkAngle=0.6, CubeFit=0, Caps=0)  # disabled
polygon = Polygon(Plane=flatten(cull_index), Radius=flatten(range_2), Segments=flatten(series), FilletRadius=0)  # -> flatten(Polygon), Length; disabled
plane_2 = Plane(xy_plane_2)  # disabled
isovist = IsoVist(Plane=plane_2, Count=number_slider_15, Radius=number_slider_16, Obstacles=polygon.Polygon)  # -> Points, Distance, Index; disabled
line = Line(StartPoint=origin_2, EndPoint=isovist.Points)  # disabled

# ----
# - create a custom plate
number_slider_17 = Slider(2, range=0..3)  # disabled
number_slider_18 = Slider(100, range=0..100)  # disabled
range_3 = Range(Domain=number_slider_17, Steps=number_slider_18)  # disabled
circle = Circle(Plane=PlaneXY(0, 0, 0), Radius=number_slider_17)  # disabled
graph_mapper = GraphMapper(
    range_3,
    x0=0,
    x1=1,
    y0=0,
    y1=1,
    container_name="Bezier",
    cpx=[0, 0.2423520237, 0.2895503342, 1],
    cpy=[0, 0.5722799897, 0.7558665276, 1])  # disabled
graph_mapper_2 = GraphMapper(range_3, x0=0, x1=1, y0=0, y1=1, container_name="Sine", Equation_px=[0, 0.32217893], Equation_py=[0, 0.8814396262])  # disabled
addition = Addition(A=number_slider_17, B=range_3)  # disabled
construct_point_2 = ConstructPoint(XCoordinate=addition, YCoordinate=graph_mapper_2, ZCoordinate=graph_mapper)  # disabled
panel_3 = Panel("2.00")  # disabled
unit_z = UnitZ(Factor=1)  # disabled
range_4 = Range(Domain=panel_3, Steps=10)  # disabled
interpolate = Interpolate(Vertices=construct_point_2, Degree=3, Periodic=False, KnotStyle=1)  # -> Curve, Length, Domain; disabled
line_sdl = LineSDL(Start=unit_z, Direction=unit_z, Length=1)  # disabled
pi_6 = Pi(Factor=range_4)  # disabled
number_slider_19 = Slider(6, range=0..100)  # disabled
length = Length(Curve=interpolate.Curve)  # disabled
rotate_axis = RotateAxis(Geometry=interpolate.Curve, Angle=pi_6, Axis=line_sdl)  # -> Geometry, Transform; disabled
number_slider_20 = Slider(0.24, range=0..1)  # disabled
construct_point_3 = ConstructPoint(XCoordinate=0, YCoordinate=0, ZCoordinate=number_slider_19)  # disabled
panel_4 = Panel("-1")  # disabled
cull_index_2 = CullIndex(List=rotate_axis.Geometry, Indices=panel_4, Wrap=True)  # disabled
evaluate_curve = EvaluateCurve(Curve=reparameterize(cull_index_2), Parameter=number_slider_20)  # -> Point, Tangent, Angle; disabled
curve_closest_point = CurveClosestPoint(Point=construct_point_3, Curve=cull_index_2)  # -> Point, Parameter, Distance; disabled
revolution = Revolution(Curve=interpolate.Curve, Axis=line_sdl, Domain=Domain(0, 6.283185307))  # disabled
boundary_surfaces = BoundarySurfaces(Edges=circle)  # disabled
rail_revolution = RailRevolution(Curve=interpolate.Curve, Rail=circle, Axis=line_sdl, Scale=False)  # disabled
loft = Loft(
    Curves=flatten(cull_index_2),
    Options={Adjust=False, Closed=True, LoftEnds=0, LoftSimp=0, LoftType=0, Rebuild=10, Refit=0.01})  # disabled
distance = Distance(PointA=curve_closest_point.Point, PointB=evaluate_curve.Point)  # disabled
sphere_2 = Sphere(Base=curve_closest_point.Point, Radius=distance)  # -> flatten(Sphere); disabled
split_brep_multiple = SplitBrepMultiple(Brep=loft, Cutters=sphere_2)  # disabled
list_item = ListItem(List=split_brep_multiple, Index=0, Wrap=True)  # disabled
geometry = Geometry(list_item)  # disabled
merge = Merge(Data1=boundary_surfaces, Data2=geometry)  # disabled

# ----
# 007_Curve
# Utility
# Spline
# Analysis
# Primitive
# Division
evaluate_length = EvaluateLength(Normalized=True)  # -> Point, Tangent, Parameter; disabled
evaluate_curve_2 = EvaluateCurve()  # -> Point, Tangent, Angle; disabled
horizontal_frame = HorizontalFrame()  # disabled
perp_frame = PerpFrame()  # disabled
curve_closest_point_2 = CurveClosestPoint()  # -> Point, Parameter, Distance; disabled
curve_domain = CurveDomain()  # -> Curve, Domain; disabled
# MGSM
# Grasshopper for Rhino3D
# http://grasshopperdocs.com/
# https://www.food4rhino.com/en
curve_middle = CurveMiddle()  # disabled
# EXERCISES_CURVES
length_2 = Length()  # disabled
point_on_curve = PointOnCurve(parameter=0.5)  # disabled
end_points = EndPoints()  # -> Start, End; disabled
derivatives = Derivatives()  # -> Point, FirstDerivative; disabled
point_in_curves = PointInCurves()  # -> Relationship, Index, Point; disabled
point_in_curve = PointInCurve()  # -> Relationship, Point; disabled
polygon_center = PolygonCenter()  # -> CenterV, CenterE, CenterA; disabled
planar = Planar()  # -> Planar, Plane, Deviation; disabled
control_points = ControlPoints()  # -> Points, Weights, Knots; disabled
extremes = Extremes(Plane=PlaneXY(0, 0, 0))  # -> Highest, Lowest; disabled
divide_distance = DivideDistance()  # -> Points, Tangents, Parameters; disabled
divide_length = DivideLength()  # -> Points, Tangents, Parameters; disabled
divide_curve = DivideCurve(Count=10, Kinks=False)  # -> Points, Tangents, Parameters; disabled
curve_frames = CurveFrames(Count=10)  # -> Frames, Parameters; disabled
horizontal_frames = HorizontalFrames(Count=10)  # -> Frames, Parameters; disabled
perp_frames = PerpFrames(Count=10, Align=True)  # -> Frames, Parameters; disabled
polygon_2 = Polygon(Plane=PlaneXY(0, 0, 0), Radius=3, Segments=6, FilletRadius=0)  # -> Polygon, Length; disabled
rectangle = Rectangle(Plane=PlaneXY(0, 0, 0), XSize=Domain(-1, 1), YSize=Domain(-2, 2), Radius=0)  # -> Rectangle, Length; disabled
ellipse = Ellipse(Plane=PlaneXY(0, 0, 0), Radius1=1, Radius2=1)  # -> Ellipse, Focus1, Focus2; disabled
line_2 = Line()  # disabled
arc_3pt = Arc3Pt()  # -> Arc, Plane, Radius; disabled
arc = Arc(Plane=PlaneXY(0, 0, 0), Radius=1, Angle=Domain(0, 3.141592654))  # -> Arc, Length; disabled
line_sdl_2 = LineSDL(Direction=Vector(0, 0, 1), Length=1)  # disabled
circle_cnr = CircleCNR(Normal=Vector(0, 0, 1), Radius=1)  # disabled
circle_2 = Circle(Plane=PlaneXY(0, 0, 0), Radius=1)  # disabled
tangent_lines_ex = TangentLinesEx()  # -> Tangent1, Tangent2; disabled
# 001_Introduction
# Ribbon Vanilla Grasshopper
# 
# Params
# Maths
# Sets - data trees
# Vectors
# Curves
# Surfaces
# IntersectionTransformations
# Display
tangent_lines = TangentLines()  # -> Tangent1, Tangent2; disabled
iso_curve = IsoCurve()  # -> UIsocurve, VIsocurve; disabled
interpolate_2 = Interpolate(Degree=3, Periodic=False, KnotStyle=1)  # -> Curve, Length, Domain; disabled
nurbs_curve = NurbsCurve(Degree=3, Periodic=False)  # -> Curve, Length, Domain; disabled
polyline = PolyLine(Closed=False)  # disabled
tween_curve = TweenCurve(Factor=0.5, BlendType=0)  # disabled
# 002_ribbon_vanilla_grasshopper
# Grasshopper Canvas for Rhino3D:
# 
# Ribbon:
# 
# File
# - new/open
# - save document/saveas
# - export image
# - document properties
# - user objects/ clusters
# - special folders (components/user objects)
# - preferences
curve_on_surface = CurveOnSurface(Closed=False)  # -> Curve, Length, Domain; disabled
catenary = Catenary(Gravity=Vector(0, 0, -1))  # disabled
blend_curve = BlendCurve(BulgeA=1, BulgeB=1, Continuity=2)  # disabled
explode = Explode(Recursive=True)  # -> Segments, Vertices; disabled
join_curves = JoinCurves(Preserve=False)  # disabled
project = Project(Direction=Vector(0, 0, 1))  # disabled
offset_curve = OffsetCurve(Distance=1, Corners=1)  # disabled
flip_curve = FlipCurve()  # -> Curve, Flag; disabled
rebuild_curve = RebuildCurve(Count=10, Tangents=False)  # disabled
pull_curve = PullCurve()  # disabled
fillet = Fillet()  # disabled
# Display
# 
# - icons, wires, names
# - (consider Bifocals plugin)
# - selected only preview
# - plane size
# - mesh edges
# - gumball
# - canvas widgets
# (Markov, profiler, message balloons)
# Edit
# 
# - cut/copy/paste/delete
# - arrange groups
# - group/ungroup
# - cluster
# - find
# - create component popup
# Solution
# 
# - disable solver
# - scroll button/spacebar
# (cluster/group/preview/enable/solver/
# bake/zoom/find/preferences)
# Help
# 
# - tutorials
# - online forums
# - node references
# View
# 
# - obscure components
# - zoom options on canvas
extend_curve = ExtendCurve(Type=0)  # disabled
seam = Seam()  # disabled

# ----
# - the curve analysis nodes are very interesting
# - consider using the derivatives of a curve
# to explore new variations of geometries
polygon_3 = Polygon(Plane=PlaneXY(0, 0, 0), Radius=3, Segments=6, FilletRadius=0)  # -> Polygon, Length; disabled
populate_2d = Populate2D(Region={Plane=PlaneXY(0, 0, 0), Size=Domain2(u=0..20, v=0..10)}, Count=100, Seed=1)  # disabled
point_in_curves_2 = PointInCurves(Point=populate_2d, Curves=polygon_3.Polygon)  # -> Relationship, Index, Point; disabled
polygon_center_2 = PolygonCenter(Polyline=polygon_3.Polygon)  # -> CenterV, CenterE, CenterA; disabled
planar_2 = Planar(Curve=polygon_3.Polygon)  # -> Planar, Plane, Deviation; disabled
number_slider_21 = Slider(3, range=0..10)  # disabled
cull_pattern = CullPattern(List=populate_2d, CullPattern=point_in_curves_2.Relationship)  # disabled
panel_5 = Panel("6")  # disabled
range_5 = Range(Domain=panel_5, Steps=number_slider_21)  # disabled
unit_z_2 = UnitZ(Factor=range_5)  # disabled
move = Move(Geometry=cull_pattern, Motion=unit_z_2)  # -> Geometry, Transform; disabled
number_slider_22 = Slider(4, range=0..10)  # disabled
sort_points = SortPoints(Points=move.Geometry)  # -> Points, Indices; disabled
unit_x = UnitX(Factor=number_slider_22)  # disabled
nurbs_curve_2 = NurbsCurve(Vertices=move.Geometry, Degree=3, Periodic=False)  # -> Curve, Length, Domain; disabled
number_slider_23 = Slider(1, range=0..1)  # disabled
move_2 = Move(Geometry=nurbs_curve_2.Curve, Motion=unit_x)  # -> Geometry, Transform; disabled
extremes_2 = Extremes(Curve=nurbs_curve_2.Curve, Plane=planar_2.Plane)  # -> Highest, Lowest; disabled
derivatives_2 = Derivatives(Curve=reparameterize(move_2.Geometry), Parameter=number_slider_23)  # -> Point, FirstDerivative, SecondDerivative; disabled
control_points_2 = ControlPoints(Curve=move_2.Geometry)  # -> Points, Weights, Knots; disabled
geometry_2 = Geometry(derivatives_2.FirstDerivative)  # disabled
geometry_3 = Geometry(derivatives_2.SecondDerivative)  # disabled
line_3 = Line(StartPoint=extremes_2.Lowest, EndPoint=geometry_2)  # disabled
line_4 = Line(StartPoint=extremes_2.Highest, EndPoint=geometry_3)  # disabled
line_5 = Line(StartPoint=extremes_2.Highest, EndPoint=geometry_3)  # disabled
line_6 = Line(StartPoint=extremes_2.Highest, EndPoint=geometry_2)  # disabled
revolution_2 = Revolution(Curve=move_2.Geometry, Axis=line_4, Domain=Domain(0, 6.283185307))  # disabled
revolution_3 = Revolution(Curve=move_2.Geometry, Axis=line_5, Domain=Domain(0, 6.283185307))  # disabled
revolution_4 = Revolution(Curve=move_2.Geometry, Axis=line_6, Domain=Domain(0, 6.283185307))  # disabled
revolution_5 = Revolution(Curve=move_2.Geometry, Axis=line_3, Domain=Domain(0, 6.283185307))  # disabled

# ----
# 010_Intersect
# Physical
# Region
# Mathematical
# Shape
contour_2 = Contour(Point=Point(0, 0, 0), Direction=Vector(0, 0, 1))  # disabled
# EXERCISES_INTERSECT
isovist_2 = IsoVist(Count=10, Radius=100)  # -> Points, Distance, Index; disabled
curve_plane_2 = CurvePlane()  # -> Points, ParamsC, ParamsP; disabled
line_line_2 = LineLine()  # -> ParamA, ParamB, PointA, PointB; disabled
mesh_ray_2 = MeshRay()  # -> Point, Hit; disabled
plane_region_2 = PlaneRegion(Plane=PlaneXY(0, 0, 0))  # disabled
brep_plane_2 = BrepPlane(Plane=PlaneXY(0, 0, 0))  # -> Curves, Points; disabled
mesh_plane_2 = MeshPlane()  # disabled
plane_plane_2 = PlanePlane()  # disabled
brep_line_2 = BrepLine(LimitToFirst=False)  # -> Curves, Points; disabled
surface_line_2 = SurfaceLine(LimitToFirst=False)  # -> Curves, Points, UVPoints, Normal; disabled
isovist_ray_2 = IsoVistRay(Radius=100)  # -> Point, Distance, Index; disabled
plane_plane_plane_2 = PlanePlanePlane()  # -> Point, LineAB, LineAC, LineBC; disabled
mesh_mesh = MeshMesh()  # disabled
surface_split = SurfaceSplit()  # disabled
curve_curve = CurveCurve()  # -> Points, ParamsA, ParamsB; disabled
brep_brep = BrepBrep()  # -> Curves, Points; disabled
brep_curve = BrepCurve()  # -> Curves, Points; disabled
mesh_curve = MeshCurve()  # -> Points, Faces; disabled
multiple_curves = MultipleCurves()  # -> Points, IndexA, IndexB, ParamA, ParamB; disabled
surface_curve = SurfaceCurve()  # -> Curves, Points, UVPoints, Normals, Parameters, Tangents; disabled
curve_self = CurveSelf()  # -> Points, Params; disabled
trim_with_region = TrimWithRegion()  # -> Inside, Outside; disabled
trim_with_brep = TrimWithBrep()  # -> Inside, Outside; disabled
split_with_brep = SplitWithBrep()  # -> Curve, Points; disabled
trim_with_regions = TrimWithRegions()  # -> Inside, Outside; disabled
split_with_breps = SplitWithBreps()  # -> Curve, Points; disabled
trim_with_breps = TrimWithBreps()  # -> Inside, Outside; disabled
boundary_volume = BoundaryVolume()  # disabled
mesh_difference = MeshDifference()  # disabled
mesh_intersection = MeshIntersection()  # disabled
region_difference = RegionDifference()  # disabled
region_intersection = RegionIntersection()  # disabled
mesh_split = MeshSplit()  # disabled
solid_difference = SolidDifference()  # disabled
solid_intersection = SolidIntersection()  # disabled
mesh_union = MeshUnion()  # disabled
trim_solid = TrimSolid()  # disabled
region_union = RegionUnion()  # disabled
split_brep = SplitBrep()  # disabled
solid_union = SolidUnion()  # disabled
split_brep_multiple_2 = SplitBrepMultiple()  # disabled

# ----
# - I have seen this used once in generative design series:
# great video series (5 videos)
# Intermediate to advanced levels
occlusion = Occlusion()  # -> Hits, Occlusion; disabled

# ----
# 031_intersect_physical
# - consider and visualize how points, lines and curves
# are created by intersections
number_slider_24 = Slider(12, range=0..100)  # disabled
curve_2 = Curve([<curve referenced from the Rhino model> x2])  # disabled
curve_curve_2 = CurveCurve()  # -> Points, ParamsA, ParamsB; disabled
number_slider_25 = Slider(2, range=0..10)  # disabled
number_slider_26 = Slider(10, range=0..10)  # disabled
loft_2 = Loft(Curves=curve_2, Options={Adjust=False, Closed=False, LoftEnds=0, LoftSimp=0, LoftType=0, Rebuild=10, Refit=0.01})  # disabled
number_slider_27 = Slider(12, range=0..100)  # disabled
number_slider_28 = Slider(2, range=0..10)  # disabled
triangular = Triangular(Plane=PlaneXY(0, 0, 0), Size=number_slider_24, ExtentX=5, ExtentY=5)  # -> Cells, Points; disabled
multiple_curves_2 = MultipleCurves()  # -> Points, IndexA, IndexB, ParamA, ParamB; disabled
divide_surface = DivideSurface(Surface=loft_2, UCount=number_slider_25, VCount=number_slider_26)  # -> Points, Normals, Parameters; disabled
construct_point_4 = ConstructPoint(XCoordinate=0, YCoordinate=0, ZCoordinate=0)  # disabled
list_length_2 = ListLength(List=triangular.Points)  # disabled
curve_self_2 = CurveSelf()  # -> Points, Params; disabled
construct_domain_2 = ConstructDomain(DomainStart=number_slider_28, DomainEnd=number_slider_27)  # disabled
expression = Expression(x=list_length_2, Expression="x-1")  # disabled
distance_2 = Distance(PointA=divide_surface.Points, PointB=construct_point_4)  # disabled
number_slider_29 = Slider(12, range=0..100)  # disabled
number_slider_30 = Slider(0, range=0..1)  # disabled
number_slider_31 = Slider(12, range=0..100)  # disabled
brep_curve_2 = BrepCurve()  # -> Curves, Points; disabled
range_6 = Range(Domain=construct_domain_2, Steps=expression)  # disabled
flatten_tree = FlattenTree(Tree=distance_2, Path="{0}")  # disabled
surface_curve_2 = SurfaceCurve()  # -> Curves, Points, UVPoints, Normals, Parameters, Tangents; disabled
construct_domain_3 = ConstructDomain(DomainStart=0, DomainEnd=number_slider_29)  # disabled
bounds = Bounds(Numbers=flatten(flatten_tree))  # disabled
jitter = Jitter(List=range_6, Jitter=number_slider_30, Seed=number_slider_31)  # -> Values, Indices; disabled
cone = Cone(Base=triangular.Points, Radius=jitter.Values, Length=jitter.Values)  # -> Cone, Tip; disabled
reverse = Reverse(Vector=divide_surface.Normals)  # disabled
remap_numbers = RemapNumbers(Value=distance_2, Source=bounds, Target=construct_domain_3)  # -> Mapped, Clipped; disabled
mesh_curve_2 = MeshCurve()  # -> Points, Faces; disabled
cap_holes = CapHoles(Brep=cone.Cone)  # disabled
mesh_mesh_2 = MeshMesh()  # disabled
line_sdl_3 = LineSDL(Start=divide_surface.Points, Direction=reverse, Length=remap_numbers.Mapped)  # disabled
number_slider_32 = Slider(1, range=0..1)  # disabled
number_slider_33 = Slider(52, range=0..100)  # disabled
brep_brep_2 = BrepBrep(BrepA=flatten(cap_holes), BrepB=cap_holes)  # -> Curves, Points; disabled
panel_6 = Panel("1")  # disabled
end_points_2 = EndPoints(Curve=flatten(line_sdl_3))  # -> Start, End; disabled
addition_2 = Addition(A=number_slider_25, B=panel_6)  # disabled
boolean_toggle = BooleanToggle(True)  # disabled
point = Point(end_points_2.End)  # disabled
quad_sphere = QuadSphere(Base=PlaneXY(0, 0, 0), Radius=number_slider_33)  # disabled
multipipe_2 = MultiPipe(
    Curves=brep_brep_2.Curves,
    NodeSize=number_slider_32,
    EndOffset=1,
    StrutSize=1,
    Segment=0,
    KinkAngle=0.6,
    CubeFit=0,
    Caps=0)  # disabled
surface_from_points = SurfaceFromPoints(Points=flatten(point), UCount=addition_2, Interpolate=boolean_toggle)  # disabled
deconstruct_brep = DeconstructBrep(Brep=quad_sphere)  # -> Faces, Edges, Vertices; disabled
merge_2 = Merge()  # disabled
entwine = Entwine(Branch00=loft_2, Branch01=surface_from_points, FlattenInputs=True)  # disabled
curve_3 = Curve(deconstruct_brep.Edges)  # disabled
surface_split_2 = SurfaceSplit(Surface=surface_from_points, Curves=deconstruct_brep.Edges)  # disabled
list_item_2 = ListItem(List=surface_split_2, Index=0, Wrap=True)  # disabled
surface = Surface(list_item_2)  # disabled

# ----
# 018_curve_division
# - create curve(s) in grasshopper
# - use some of your pervious learned skills
# to manipulate and create new geometries
number_slider_34 = Slider(2, range=0..10)  # disabled
number_slider_35 = Slider(62, range=0..100)  # disabled
range_7 = Range(Domain=number_slider_34, Steps=number_slider_35)  # disabled
graph_mapper_3 = GraphMapper(
    range_7,
    x0=0,
    x1=1,
    y0=0,
    y1=1,
    Ox=0.524131,
    Oy=0.4776169062,
    Px=0.838164866,
    Py=0.4178696871,
    container_name="Parabola")  # disabled
graph_mapper_4 = GraphMapper(
    range_7,
    x0=0,
    x1=1,
    y0=0,
    y1=1,
    container_name="Bezier",
    cpx=[0, 0.09178803116, 0.9158281088, 1],
    cpy=[0, 0.6787392497, 0, 0.5437967181])  # disabled
addition_3 = Addition(A=number_slider_34, B=graph_mapper_3)  # disabled
number_slider_36 = Slider(4, range=0..10)  # disabled
construct_point_5 = ConstructPoint(XCoordinate=addition_3, YCoordinate=graph_mapper_4, ZCoordinate=range_7)  # disabled
number_slider_37 = Slider(3, range=0..10)  # disabled
interpolate_3 = Interpolate(Vertices=construct_point_5, Degree=3, Periodic=False, KnotStyle=1)  # -> Curve, Length, Domain; disabled
domain = Domain(interpolate_3.Domain)  # disabled
divide_domain = DivideDomain(Domain=domain, Count=number_slider_37)  # -> flatten(Segments); disabled
division = Division(A=interpolate_3.Length, B=number_slider_36)  # disabled
construct_point_6 = ConstructPoint(XCoordinate=0, YCoordinate=0, ZCoordinate=0)  # disabled
end_points_3 = EndPoints(Curve=interpolate_3.Curve)  # -> Start, End; disabled
panel_7 = Panel(divide_domain)  # disabled
distance_3 = Distance(PointA=construct_point_6, PointB=end_points_3.Start)  # disabled
divide_distance_2 = DivideDistance(Curve=interpolate_3.Curve, Distance=division)  # -> Points, Tangents, Parameters; disabled
divide_length_2 = DivideLength(Curve=interpolate_3.Curve, Length=division)  # -> Points, Tangents, Parameters; disabled
shatter = Shatter(Curve=interpolate_3.Curve, Parameters=divide_domain)  # disabled
divide_curve_2 = DivideCurve(Curve=interpolate_3.Curve, Count=10, Kinks=False)  # -> Points, Tangents, Parameters; disabled
circle_3 = Circle(Plane=PlaneXY(0, 0, 0), Radius=distance_3)  # disabled
list_item_3 = ListItem(List=shatter, Index=0, Wrap=True)  # -> Item, Item1; disabled
unit_z_3 = UnitZ(Factor=1)  # disabled
curve_4 = Curve(list_item_3.Item)  # disabled
curve_5 = Curve(list_item_3.Item1)  # disabled
line_sdl_4 = LineSDL(Start=unit_z_3, Direction=unit_z_3, Length=1)  # disabled
revolution_6 = Revolution(Curve=curve_4, Axis=line_sdl_4, Domain=Domain(0, 6.283185307))  # disabled
revolution_7 = Revolution(Curve=curve_5, Axis=line_sdl_4, Domain=Domain(0, 6.283185307))  # disabled
surface_2 = Surface(circle_3)  # disabled
merge_3 = Merge(Data1=revolution_7, Data2=revolution_6, Data3=surface_2)  # disabled

# ----
# - curve frames are great for orienting geometry and robotic tool path control
number_slider_38 = Slider(6, range=0..10)  # disabled
number_slider_39 = Slider(3, range=0..10)  # disabled
range_8 = Range(Domain=number_slider_38, Steps=number_slider_39)  # disabled
expression_2 = Expression(Variable_x=range_8, Expression="cos(x^2)")  # disabled
expression_3 = Expression(Variable_x=range_8, Expression="sin(x^2)")  # disabled
construct_point_7 = ConstructPoint(XCoordinate=expression_3, YCoordinate=expression_2, ZCoordinate=range_8)  # disabled
number_slider_40 = Slider(3, range=0..10)  # disabled
interpolate_4 = Interpolate(Vertices=construct_point_7, Degree=3, Periodic=False, KnotStyle=1)  # -> Curve, Length, Domain; disabled
boolean_toggle_2 = BooleanToggle(True)  # disabled
point_on_curve_2 = PointOnCurve(interpolate_4.Curve, parameter=0.746)  # disabled
perp_frames_2 = PerpFrames(Curve=interpolate_4.Curve, Count=number_slider_40, Align=boolean_toggle_2)  # -> Frames, Parameters; disabled
curve_frames_2 = CurveFrames(Curve=interpolate_4.Curve, Count=number_slider_40)  # -> Frames, Parameters; disabled
horizontal_frames_2 = HorizontalFrames(Curve=interpolate_4.Curve, Count=number_slider_40)  # -> Frames, Parameters; disabled
boolean_toggle_3 = BooleanToggle(True)  # disabled
number_slider_41 = Slider(0.57, range=0..1)  # disabled
number_slider_42 = Slider(0.97, range=0..1)  # disabled
number_slider_43 = Slider(0.68, range=0..1)  # disabled
orient = Orient(Geometry=interpolate_4.Curve, Source=point_on_curve_2, Target=horizontal_frames_2.Frames)  # -> Geometry, Transform; disabled
orient_2 = Orient(Geometry=interpolate_4.Curve, Source=point_on_curve_2, Target=curve_frames_2.Frames)  # -> Geometry, Transform; disabled
orient_3 = Orient(Geometry=interpolate_4.Curve, Source=point_on_curve_2, Target=perp_frames_2.Frames)  # -> Geometry, Transform; disabled
multipipe_3 = MultiPipe(
    Curves=orient_2.Geometry,
    NodeSize=0.5,
    EndOffset=1,
    StrutSize=number_slider_43,
    Segment=0,
    KinkAngle=0.6,
    CubeFit=0,
    Caps=boolean_toggle_3)  # disabled
multipipe_4 = MultiPipe(
    Curves=orient_3.Geometry,
    NodeSize=0.5,
    EndOffset=1,
    StrutSize=number_slider_41,
    Segment=0,
    KinkAngle=0.6,
    CubeFit=0,
    Caps=boolean_toggle_3)  # disabled
multipipe_5 = MultiPipe(
    Curves=orient.Geometry,
    NodeSize=0.5,
    EndOffset=1,
    StrutSize=number_slider_42,
    Segment=0,
    KinkAngle=0.6,
    CubeFit=0,
    Caps=boolean_toggle_3)  # disabled

# ----
# 032_intersect_region
# - trim and split curves with Breps (3D) and regions (2D)
split_with_brep_2 = SplitWithBrep()  # -> Curve, Points; disabled
split_with_breps_2 = SplitWithBreps()  # -> Curve, Points; disabled
trim_with_brep_2 = TrimWithBrep()  # -> Inside, Outside; disabled
trim_with_breps_2 = TrimWithBreps()  # -> Inside, Outside; disabled
trim_with_region_2 = TrimWithRegion()  # -> Inside, Outside; disabled
trim_with_regions_2 = TrimWithRegions()  # -> Inside, Outside; disabled

# ----
# 019_curve_primitive
# - create curve(s) in grasshopper
# - use some of your pervious learned skills
# to manipulate and create new geometries
# - consider creating other new geometries with
# the other primitives in curves
number_slider_44 = Slider(12, range=0..100)  # disabled
unit_x_2 = UnitX(Factor=1)  # disabled
unit_y = UnitY(Factor=1)  # disabled
unit_z_4 = UnitZ(Factor=1)  # disabled
construct_point_8 = ConstructPoint(XCoordinate=0, YCoordinate=0, ZCoordinate=0)  # disabled
line_sdl_5 = LineSDL(Start=construct_point_8, Direction=[unit_y, unit_x_2, unit_z_4], Length=number_slider_44)  # disabled
construct_point_9 = ConstructPoint(XCoordinate=unit_x_2, YCoordinate=unit_y, ZCoordinate=unit_z_4)  # disabled
number_slider_45 = Slider(2, range=0..2)  # disabled
line_pt = LinePt(Line=line_sdl_5, Point=construct_point_9)  # disabled
line_7 = Line(StartPoint=construct_point_8, EndPoint=construct_point_9)  # disabled
pi_7 = Pi(Factor=number_slider_45)  # disabled
number_slider_46 = Slider(10, range=0..10)  # disabled
circle_4 = Circle(Plane=line_pt, Radius=number_slider_44)  # disabled
deconstruct_plane = DeconstructPlane(Plane=line_pt)  # -> Origin, XAxis, YAxis, ZAxis; disabled
amplitude = Amplitude(Vector=deconstruct_plane.XAxis, Amplitude=number_slider_46)  # disabled
number_slider_47 = Slider(100, range=0..100)  # disabled
list_item_4 = ListItem(List=line_pt, Index=0, Wrap=True)  # -> Item, Item1, Item2; disabled
list_item_5 = ListItem(List=line_pt, Index=0, Wrap=True)  # -> Item, Item1, Item2; disabled
list_item_6 = ListItem(List=line_pt, Index=0, Wrap=True)  # -> Item, Item1, Item2; disabled
list_item_7 = ListItem(List=circle_4, Index=0, Wrap=True)  # -> Item, Item1, Item2; disabled
rotate_plane = RotatePlane(Plane=list_item_4.Item, Angle=pi_7)  # disabled
curve_middle_2 = CurveMiddle(Curve=circle_4)  # disabled
rotate_plane_2 = RotatePlane(Plane=list_item_5.Item2, Angle=pi_7)  # disabled
rotate_plane_3 = RotatePlane(Plane=list_item_6.Item1, Angle=pi_7)  # disabled
negative = Negative(Value=amplitude)  # disabled
deconstruct_plane_2 = DeconstructPlane(Plane=rotate_plane_3)  # -> Origin, XAxis, YAxis, ZAxis; disabled
deconstruct_plane_3 = DeconstructPlane(Plane=rotate_plane_2)  # -> Origin, XAxis, YAxis, ZAxis; disabled
deconstruct_plane_4 = DeconstructPlane(Plane=rotate_plane)  # -> Origin, XAxis, YAxis, ZAxis; disabled
move_3 = Move(Geometry=curve_middle_2, Motion=negative)  # -> Geometry, Transform; disabled
amplitude_2 = Amplitude(Vector=deconstruct_plane_4.XAxis, Amplitude=number_slider_47)  # disabled
amplitude_3 = Amplitude(Vector=deconstruct_plane_2.XAxis, Amplitude=number_slider_47)  # disabled
tangent_lines_2 = TangentLines(Point=move_3.Geometry, Circle=circle_4)  # -> Tangent1, Tangent2; disabled
amplitude_4 = Amplitude(Vector=deconstruct_plane_3.XAxis, Amplitude=number_slider_47)  # disabled
vector_display = VectorDisplay(
    Anchor=deconstruct_plane_4.Origin,
    Vector=[deconstruct_plane_4.YAxis, deconstruct_plane_4.XAxis, deconstruct_plane_4.ZAxis])  # disabled
move_4 = Move(Geometry=list_item_7.Item, Motion=amplitude_2)  # -> Geometry, Transform; disabled
move_5 = Move(Geometry=list_item_7.Item1, Motion=amplitude_3)  # -> Geometry, Transform; disabled
move_6 = Move(Geometry=list_item_7.Item2, Motion=amplitude_4)  # -> Geometry, Transform; disabled
tangent_lines_ex_2 = TangentLinesEx(CircleA=list_item_7.Item, CircleB=move_4.Geometry)  # -> Tangent1, Tangent2; disabled
tangent_lines_ex_3 = TangentLinesEx(CircleA=list_item_7.Item1, CircleB=move_5.Geometry)  # -> Tangent1, Tangent2; disabled
tangent_lines_ex_4 = TangentLinesEx(CircleA=list_item_7.Item2, CircleB=move_6.Geometry)  # -> Tangent1, Tangent2; disabled
number_slider_48 = Slider(2.6, range=0..10)  # disabled
merge_4 = Merge(
    Data1=circle_4,
    Data2=tangent_lines_ex_2.Tangent1,
    Data3=tangent_lines_ex_2.Tangent2,
    Data4=move_4.Geometry,
    Data5=tangent_lines_ex_3.Tangent1,
    Data6=tangent_lines_ex_3.Tangent2,
    Data7=move_5.Geometry,
    Data8=tangent_lines_ex_2.Tangent2,
    Data9=tangent_lines_ex_4.Tangent1,
    Data10=tangent_lines_ex_4.Tangent2,
    Data11=move_6.Geometry)  # disabled
multipipe_6 = MultiPipe(Curves=merge_4, NodeSize=number_slider_48, EndOffset=1, StrutSize=1, Segment=0, KinkAngle=0.6, CubeFit=0, Caps=0)  # disabled

# ----
# - split and trim with breps
number_slider_49 = Slider(89, range=0..100)  # disabled
number_slider_50 = Slider(10, range=0..10)  # disabled
range_9 = Range(Domain=Domain(0, 1), Steps=number_slider_49)  # disabled
range_10 = Range(Domain=Domain(0, 1), Steps=number_slider_49)  # disabled
jitter_2 = Jitter(List=range_9, Jitter=1, Seed=2)  # -> Values, Indices; disabled
sphere_3 = Sphere(Base=PlaneXY(0, 0, 0), Radius=number_slider_50)  # disabled
construct_point_10 = ConstructPoint(XCoordinate=range_10, YCoordinate=jitter_2.Values, ZCoordinate=0)  # disabled
evaluate_surface = EvaluateSurface(Surface=reparameterize(sphere_3), Point=construct_point_10)  # -> Point, Normal, UDirection, VDirection, Frame; disabled
number_slider_51 = Slider(10, range=0..10)  # disabled
plane_normal = PlaneNormal(Origin=evaluate_surface.Point, ZAxis=evaluate_surface.Normal)  # disabled
cone_2 = Cone(Base=plane_normal, Radius=expr("x/3", number_slider_51), Length=number_slider_51)  # -> Cone, Tip; disabled
cap_holes_2 = CapHoles(Brep=cone_2.Cone)  # disabled
number_slider_52 = Slider(1.07, range=0..2)  # disabled
panel_8 = Panel("1")  # disabled
range_11 = Range(Domain=number_slider_52, Steps=10)  # disabled
vector_xyz = VectorXYZ(XComponent=panel_8, YComponent=0, ZComponent=panel_8)  # -> Vector, Length; disabled
volume = Volume(Geometry=cap_holes_2)  # -> Volume, Centroid; disabled
pi_8 = Pi(Factor=range_11)  # disabled
rotate_3d_6 = Rotate3D(Geometry=cap_holes_2, Angle=pi_8, Center=volume.Centroid, Axis=vector_xyz.Vector)  # -> Geometry, Transform; disabled
number_slider_53 = Slider(27, range=0..89)  # disabled
number_slider_54 = Slider(1, range=0..10)  # disabled
trim_solid_2 = TrimSolid(Shape=sphere_3, Cutters=rotate_3d_6.Geometry)  # disabled
split_brep_multiple_3 = SplitBrepMultiple(Brep=sphere_3, Cutters=rotate_3d_6.Geometry)  # disabled
panel_9 = Panel("27")  # disabled
panel_10 = Panel("1")  # disabled
cull_index_3 = CullIndex(List=split_brep_multiple_3, Indices=panel_9, Wrap=True)  # disabled
list_item_8 = ListItem(List=split_brep_multiple_3, Index=panel_9, Wrap=True)  # disabled
list_item_9 = ListItem(List=trim_solid_2, Index=panel_10, Wrap=True)  # disabled
geometry_4 = Geometry(list_item_8)  # disabled
geometry_5 = Geometry(cull_index_3)  # disabled
geometry_6 = Geometry(list_item_9)  # disabled

# ----
# 033_intersect_shape
# - be sure to deactivate solver before
#  changing data (with the spacebar or
#  pressing the control wheel to access)
# - now that you are dealing in solids, things
#  begin to slow down
# - it is advised to bake to rhino environment
# and then complete the boolean union
number_slider_55 = Slider(89, range=0..100)  # disabled
number_slider_56 = Slider(10, range=0..10)  # disabled
range_12 = Range(Domain=Domain(0, 1), Steps=number_slider_55)  # disabled
range_13 = Range(Domain=Domain(0, 1), Steps=number_slider_55)  # disabled
jitter_3 = Jitter(List=range_12, Jitter=1, Seed=2)  # -> Values, Indices; disabled
sphere_4 = Sphere(Base=PlaneXY(0, 0, 0), Radius=number_slider_56)  # disabled
construct_point_11 = ConstructPoint(XCoordinate=range_13, YCoordinate=jitter_3.Values, ZCoordinate=0)  # disabled
number_slider_57 = Slider(20, range=15..25)  # disabled
evaluate_surface_2 = EvaluateSurface(Surface=reparameterize(sphere_4), Point=construct_point_11)  # -> Point, Normal, UDirection, VDirection, Frame; disabled
plane_normal_2 = PlaneNormal(Origin=evaluate_surface_2.Point, ZAxis=evaluate_surface_2.Normal)  # disabled
rectangle_2 = Rectangle(Plane=plane_normal_2, XSize=number_slider_57, YSize=number_slider_57, Radius=0)  # -> Rectangle, Length; disabled
boundary_surfaces_2 = BoundarySurfaces(Edges=rectangle_2.Rectangle)  # disabled
number_slider_58 = Slider(2, range=0..2)  # disabled
panel_11 = Panel("1")  # disabled
boundary_volume_2 = BoundaryVolume(Boundaries=boundary_surfaces_2)  # disabled
vector_xyz_2 = VectorXYZ(XComponent=panel_11, YComponent=0, ZComponent=panel_11)  # -> Vector, Length; disabled
range_14 = Range(Domain=number_slider_58, Steps=10)  # disabled
volume_2 = Volume(Geometry=boundary_volume_2)  # -> Volume, Centroid; disabled
pi_9 = Pi(Factor=range_14)  # disabled
number_slider_59 = Slider(3, range=0..10)  # disabled
rotate_3d_7 = Rotate3D(Geometry=boundary_volume_2, Angle=pi_9, Center=volume_2.Centroid, Axis=vector_xyz_2.Vector)  # -> Geometry, Transform; disabled
polar_array = PolarArray(Geometry=rotate_3d_7.Geometry, Plane=plane_normal_2, Count=number_slider_59, Angle=6.283185307)  # -> Geometry, Transform; disabled

# ----
# - very simple algorithm, but consider the geometries that can be created
number_slider_60 = Slider(12, range=0..100)  # disabled
square = Square(Plane=PlaneXY(0, 0, 0), Size=number_slider_60, ExtentX=5, ExtentY=5)  # -> Cells, Points; disabled
radial_2 = Radial(Plane=PlaneXY(0, 0, 0), Size=number_slider_60, ExtentR=5, ExtentP=20)  # -> Cells, Points; disabled
hexagonal = Hexagonal(Plane=PlaneXY(0, 0, 0), Size=number_slider_60, ExtentX=5, ExtentY=5)  # -> Cells, Points; disabled
region_difference_2 = RegionDifference(CurvesA=square.Cells, CurvesB=hexagonal.Cells)  # disabled
region_union_2 = RegionUnion(Curves=[square.Cells, hexagonal.Cells])  # disabled
region_intersection_2 = RegionIntersection(CurvesA=region_difference_2, CurvesB=region_union_2)  # disabled

# ----
# - consider what is going on behind the scenes in all the mesh plugins
number_slider_61 = Slider(40, range=0..100)  # disabled
number_slider_62 = Slider(100, range=0..100)  # disabled
number_slider_63 = Slider(4, range=0..5)  # disabled
range_15 = Range(Domain=number_slider_61, Steps=number_slider_62)  # disabled
sine = Sine(Value=range_15)  # disabled
multiplication = Multiplication(A=sine, B=number_slider_63)  # disabled
number_slider_64 = Slider(1.679, range=0..5)  # disabled
construct_point_12 = ConstructPoint(XCoordinate=graft(range_15), YCoordinate=range_15, ZCoordinate=multiplication)  # disabled
surface_from_points_2 = SurfaceFromPoints(Points=flatten(construct_point_12), UCount=expr("x+1", number_slider_62), Interpolate=False)  # disabled
surface_3 = Surface(surface_from_points_2)  # disabled
area = Area(Geometry=surface_3)  # -> Area, Centroid; disabled
dimensions = Dimensions(Surface=surface_3)  # -> UDimension, VDimension; disabled
number_slider_65 = Slider(8, range=0..100)  # disabled
division_2 = Division(A=dimensions.UDimension, B=dimensions.VDimension)  # disabled
scale = Scale(Geometry=surface_3, Center=area.Centroid, Factor=number_slider_64)  # -> Geometry, Transform; disabled
md_slider = MDSlider(
    SliderMode=0,
    slider_value=Point(0.4951607309, 0.2414119069, 0.5),
    x_domain=Domain(0, 1),
    y_domain=Domain(0, 1),
    z_domain=Domain(0, 1))  # disabled
multiplication_2 = Multiplication(A=division_2, B=number_slider_65)  # disabled
integer = Integer(multiplication_2)  # disabled
divide_surface_2 = DivideSurface(Surface=surface_3, UCount=integer, VCount=number_slider_65)  # -> flatten(Points), Normals, Parameters; disabled
md_slider_2 = MDSlider(
    SliderMode=0,
    slider_value=Point(0.7276408516, 0.09028392548, 0.5),
    x_domain=Domain(0, 1),
    y_domain=Domain(0, 1),
    z_domain=Domain(0, 1))  # disabled
number_slider_66 = Slider(0.243, range=0..2)  # disabled
md_slider_3 = MDSlider(
    SliderMode=0,
    slider_value=Point(0.1948275682, 0.7902063509, 0.5),
    x_domain=Domain(0, 1),
    y_domain=Domain(0, 1),
    z_domain=Domain(0, 1))  # disabled
evaluate_surface_3 = EvaluateSurface(Surface=reparameterize(scale.Geometry), Point=[md_slider_3, md_slider, md_slider_2])  # -> Point, Normal, UDirection, VDirection, Frame; disabled
distance_4 = Distance(PointA=graft(evaluate_surface_3.Point), PointB=divide_surface_2.Points)  # disabled
point_2 = Point(divide_surface_2.Points)  # disabled
expression_4 = Expression(w=flatten(number_slider_66), t=distance_4, Expression="sin(2*w^2*t)")  # disabled
flip_matrix_2 = FlipMatrix(Data=expression_4)  # disabled
number_slider_67 = Slider(7.333, range=0..10)  # disabled
ma = MassMultiplication(Input=flip_matrix_2)  # -> flatten(Result), PartialResults; disabled
multiplication_3 = Multiplication(A=number_slider_67, B=ma.Result)  # disabled
unit_z_5 = UnitZ(Factor=multiplication_3)  # disabled
move_7 = Move(Geometry=divide_surface_2.Points, Motion=unit_z_5)  # -> Geometry, Transform; disabled
colour_swatch = ColourSwatch(SwatchColor=RGB(236, 45, 255))  # disabled
expression_5 = Expression(u=integer, Expression="u+1")  # disabled
mesh_frompoints = MeshFromPoints(Points=move_7.Geometry, UDirection=expr("x+1", integer), VDirection=expr("x+1", number_slider_65), Colour=colour_swatch)  # disabled
mesh_box = MeshBox(Base={Plane=PlaneXY(0, 0, 0), X=Domain(-10, 10), Y=Domain(-10, 10), Z=Domain(-10, 10)}, XCount=10, YCount=10, ZCount=10)  # disabled
number_slider_68 = Slider(1.7, range=0..3)  # disabled
deconstruct_mesh = DeconstructMesh(Mesh=mesh_frompoints)  # -> Vertices, Faces, Colours, Normals; disabled
mesh_sphere = MeshSphere(Base=deconstruct_mesh.Vertices, Radius=number_slider_68, UCount=10, VCount=20)  # disabled
mesh_union_2 = MeshUnion(Meshes=flatten([mesh_frompoints, mesh_sphere]))  # disabled
mesh_difference_2 = MeshDifference(MeshesA=mesh_frompoints, MeshesB=mesh_sphere)  # disabled
mesh_intersection_2 = MeshIntersection(MeshesA=mesh_frompoints, MeshesB=mesh_sphere)  # disabled
mesh_split_2 = MeshSplit(Mesh=mesh_frompoints, Splitters=mesh_sphere)  # disabled
panel_12 = Panel("1")  # disabled
list_item_10 = ListItem(List=mesh_split_2, Index=panel_12, Wrap=True)  # disabled
cull_index_4 = CullIndex(List=mesh_split_2, Indices=panel_12, Wrap=True)  # disabled
mesh = Mesh(mesh_difference_2)  # disabled
mesh_2 = Mesh(mesh_intersection_2)  # disabled
mesh_3 = Mesh(mesh_union_2)  # disabled
mesh_4 = Mesh(list_item_10)  # disabled
mesh_5 = Mesh(cull_index_4)  # disabled

# ----
# - keep an eye on your profiler widget
# - consider baking into rhino environment
# and performing these operations with
# boolean tools in rhino
solid_difference_2 = SolidDifference()  # disabled
solid_intersection_2 = SolidIntersection()  # disabled
solid_union_2 = SolidUnion()  # disabled

number_slider_69 = Slider(12, range=0..100)  # disabled
quad_sphere_2 = QuadSphere(Base=PlaneXY(0, 0, 0), Radius=number_slider_69)  # disabled
md_slider_4 = MDSlider(
    SliderMode=0,
    slider_value=Point(0.7588099038, 0.725054485, 0.5),
    x_domain=Domain(0, 1),
    y_domain=Domain(0, 1),
    z_domain=Domain(0, 1))  # disabled
md_slider_5 = MDSlider(
    SliderMode=0,
    slider_value=Point(0.319955221, 0.7363072837, 0.5),
    x_domain=Domain(0, 1),
    y_domain=Domain(0, 1),
    z_domain=Domain(0, 1))  # disabled
deconstruct_brep_2 = DeconstructBrep(Brep=quad_sphere_2)  # -> Faces, Edges, Vertices; disabled
md_slider_6 = MDSlider(
    SliderMode=0,
    slider_value=Point(0.7925757431, 0.7981969322, 0.5),
    x_domain=Domain(0, 1),
    y_domain=Domain(0, 1),
    z_domain=Domain(0, 1))  # disabled
boolean_toggle_4 = BooleanToggle(True)  # disabled
curve_on_surface_2 = CurveOnSurface(Surface=deconstruct_brep_2.Faces, UVCoordinates=[md_slider_5, md_slider_4, md_slider_6], Closed=boolean_toggle_4)  # -> Curve, Length, Domain; disabled
surface_split_3 = SurfaceSplit(Surface=deconstruct_brep_2.Faces, Curves=curve_on_surface_2.Curve)  # disabled
dispatch = Dispatch(List=flatten(surface_split_3), DispatchPattern=[True, False])  # -> ListA, ListB; disabled
geometry_7 = Geometry(dispatch.ListB)  # disabled
geometry_8 = Geometry(dispatch.ListA)  # disabled

# ----
# 020_curve_spline
# - create spline(s) in grasshopper
# - use some of your pervious learned skills
# to manipulate and create new geometries
number_slider_70 = Slider(3, range=0..10)  # disabled
quad_sphere_3 = QuadSphere(Base=PlaneXY(0, 0, 0), Radius=1)  # disabled
deconstruct_brep_3 = DeconstructBrep(Brep=quad_sphere_3)  # -> Faces, Edges, Vertices; disabled
panel_13 = Panel("""4
5
6""")  # disabled
number_slider_71 = Slider(4, range=0..10)  # disabled
range_16 = Range(Domain=Domain(0, 1), Steps=number_slider_70)  # disabled
cull_index_5 = CullIndex(List=deconstruct_brep_3.Faces, Indices=panel_13, Wrap=True)  # disabled
construct_point_13 = ConstructPoint(XCoordinate=range_16, YCoordinate=range_16, ZCoordinate=0)  # -> graft(Point); disabled
populate_geometry = PopulateGeometry(Geometry=cull_index_5, Count=number_slider_71, Seed=number_slider_71)  # disabled
interpolate_5 = Interpolate(Vertices=populate_geometry, Degree=3, Periodic=False, KnotStyle=1)  # -> Curve, Length, Domain; disabled
iso_curve_2 = IsoCurve(Surface=reparameterize(cull_index_5), UVPoint=construct_point_13)  # -> UIsocurve, VIsocurve; disabled
polyline_2 = PolyLine(Vertices=populate_geometry, Closed=False)  # disabled
nurbs_curve_3 = NurbsCurve(Vertices=populate_geometry, Degree=3, Periodic=False)  # -> Curve, Length, Domain; disabled
number_slider_72 = Slider(1, range=-1..1)  # disabled
number_slider_73 = Slider(-1, range=-1..1)  # disabled
explode_tree_2 = ExplodeTree(Data=interpolate_5.Curve)  # -> Branch0, Branch1, Branch2; disabled
curve_6 = Curve(iso_curve_2.VIsocurve)  # disabled
curve_7 = Curve(iso_curve_2.UIsocurve)  # disabled
end_points_4 = EndPoints(Curve=curve_6)  # -> Start, End; disabled
tween_curve_2 = TweenCurve(CurveA=explode_tree_2.Branch1, CurveB=explode_tree_2.Branch2, Factor=0.5, BlendType=0)  # disabled
tween_curve_3 = TweenCurve(CurveA=explode_tree_2.Branch0, CurveB=explode_tree_2.Branch2, Factor=0.5, BlendType=0)  # disabled
number_slider_74 = Slider(3, range=0..10)  # disabled
tween_curve_4 = TweenCurve(CurveA=explode_tree_2.Branch0, CurveB=explode_tree_2.Branch1, Factor=0.5, BlendType=0)  # disabled
vector_xyz_3 = VectorXYZ(XComponent=0, YComponent=0, ZComponent=[number_slider_73, number_slider_72])  # -> Vector, Length; disabled
blend_curve_2 = BlendCurve(CurveA=tween_curve_4, CurveB=tween_curve_3, BulgeA=1, BulgeB=1, Continuity=2)  # disabled
blend_curve_3 = BlendCurve(CurveA=tween_curve_3, CurveB=tween_curve_2, BulgeA=1, BulgeB=1, Continuity=2)  # disabled
blend_curve_4 = BlendCurve(CurveA=tween_curve_4, CurveB=tween_curve_2, BulgeA=1, BulgeB=1, Continuity=2)  # disabled
number_slider_75 = Slider(0.09, range=0..1)  # disabled
catenary_2 = Catenary(PointA=end_points_4.Start, PointB=end_points_4.End, Length=number_slider_74, Gravity=vector_xyz_3.Vector)  # disabled
multipipe_7 = MultiPipe(Curves=catenary_2, NodeSize=number_slider_75, EndOffset=1, StrutSize=1, Segment=0, KinkAngle=0.6, CubeFit=0, Caps=0)  # disabled

# ----
# 021_curve_utility
# - curve utility manipulates curves in many ways
number_slider_76 = Slider(17, range=0..100)  # disabled
polygon_4 = Polygon(Plane=PlaneXY(0, 0, 0), Radius=number_slider_76, Segments=6, FilletRadius=0)  # -> Polygon, Length; disabled
explode_2 = Explode(Curve=polygon_4.Polygon, Recursive=True)  # -> Segments, Vertices; disabled
quad_sphere_4 = QuadSphere(Base=PlaneXY(0, 0, 0), Radius=number_slider_76)  # disabled
quad_sphere_5 = QuadSphere(Base=PlaneXY(0, 0, 0), Radius=number_slider_76)  # disabled
unit_z_6 = UnitZ(Factor=1)  # disabled
number_slider_77 = Slider(0.1, range=0.1..10)  # disabled
point_3 = Point(explode_2.Vertices)  # disabled
curve_8 = Curve(explode_2.Segments)  # disabled
deconstruct_brep_4 = DeconstructBrep(Brep=quad_sphere_4)  # -> Faces, Edges, Vertices; disabled
panel_14 = Panel("{0;0}[(0,2,...)]")  # disabled
fillet_2 = Fillet(Curve=polygon_4.Polygon, Radius=number_slider_77)  # disabled
param_viewer = ParamViewer(curve_8)  # disabled
project_2 = Project(Curve=graft(fillet_2), Brep=quad_sphere_5, Direction=unit_z_6)  # disabled
split_tree = SplitTree(Data=curve_8, Masks=flatten(panel_14))  # -> Positive, Negative; disabled
number_slider_78 = Slider(9.23, range=0..10)  # disabled
number_slider_79 = Slider(1, range=0..1)  # disabled
rebuild_curve_2 = RebuildCurve(Curve=project_2, Count=10, Tangents=False)  # disabled
flip_curve_2 = FlipCurve(Curve=split_tree.Positive)  # -> Curve, Flag; disabled
seam_2 = Seam(Curve=reparameterize(rebuild_curve_2), Seam=number_slider_79)  # -> flatten(Curve); disabled
clean_tree = CleanTree(RemoveNulls=True, RemoveInvalid=True, RemoveEmpty=False, Tree=flip_curve_2.Curve)  # disabled
point_on_curve_3 = PointOnCurve([flip_curve_2.Curve, split_tree.Negative], parameter=0.173)  # disabled
unit_z_7 = UnitZ(Factor=number_slider_78)  # disabled
loft_3 = Loft(Curves=seam_2, Options={Adjust=True, Closed=False, LoftEnds=0, LoftSimp=0, LoftType=0, Rebuild=10, Refit=0.01})  # disabled
offset_curve_2 = OffsetCurve(Curve=clean_tree, Distance=number_slider_78, Corners=1)  # -> flatten(Curve); disabled
pull_curve_2 = PullCurve(Curve=deconstruct_brep_4.Edges, Surface=loft_3)  # disabled
number_slider_80 = Slider(6.24, range=0..10)  # disabled
move_8 = Move(Geometry=offset_curve_2, Motion=unit_z_7)  # -> Geometry, Transform; disabled
clean_tree_2 = CleanTree(RemoveNulls=True, RemoveInvalid=True, RemoveEmpty=False, Tree=pull_curve_2)  # disabled
number_slider_81 = Slider(5, range=0..5)  # disabled
join_curves_2 = JoinCurves(Curves=[split_tree.Negative, flip_curve_2.Curve], Preserve=False)  # disabled
curve_middle_3 = CurveMiddle(Curve=clean_tree_2)  # disabled
sphere_5 = Sphere(Base=curve_middle_3, Radius=number_slider_80)  # disabled
split_brep_multiple_4 = SplitBrepMultiple(Brep=loft_3, Cutters=sphere_5)  # disabled
pipe = Pipe(Curve=join_curves_2, Radius=expr("x/3", number_slider_81), Caps=0)  # disabled
sphere_6 = Sphere(Base=point_on_curve_3, Radius=number_slider_81)  # disabled
loft_4 = Loft(
    Curves=[offset_curve_2, move_8.Geometry],
    Options={Adjust=True, Closed=True, LoftEnds=0, LoftSimp=0, LoftType=0, Rebuild=10, Refit=0.01})  # disabled
list_item_11 = ListItem(List=split_brep_multiple_4, Index=0, Wrap=True)  # disabled

# ----
# EXERCISES_TRANSFORM
# 034_transformations_affine
# - scale with ranges and series and consider
# center points
# - consider linking all of your parameters to avoid
# collisions and reduce the need for boolean
# operations
number_slider_82 = Slider(12, range=0..100)  # disabled
number_slider_83 = Slider(100, range=0..100)  # disabled
range_17 = Range(Domain=number_slider_82, Steps=number_slider_83)  # disabled
sine_2 = Sine(Value=range_17)  # disabled
cosine = Cosine(Value=range_17)  # disabled
construct_point_14 = ConstructPoint(XCoordinate=sine_2, YCoordinate=cosine, ZCoordinate=range_17)  # disabled
number_slider_84 = Slider(32, range=0..100)  # disabled
nurbs_curve_4 = NurbsCurve(Vertices=construct_point_14, Degree=3, Periodic=False)  # -> Curve, Length, Domain; disabled
divide_curve_3 = DivideCurve(Curve=nurbs_curve_4.Curve, Count=number_slider_84, Kinks=False)  # -> Points, Tangents, Parameters; disabled
number_slider_85 = Slider(4, range=0..100)  # disabled
align_plane = AlignPlane(Plane=divide_curve_3.Points, Direction=divide_curve_3.Tangents)  # -> Plane, Angle; disabled
vector_display_2 = VectorDisplay(Anchor=divide_curve_3.Points, Vector=divide_curve_3.Tangents)  # disabled
center_box = CenterBox(Base=PlaneXY(0, 0, 0), X=number_slider_85, Y=expr("x/3", number_slider_85), Z=expr("x/6", number_slider_85))  # disabled
deconstruct_brep_5 = DeconstructBrep(Brep=center_box)  # -> Faces, Edges, Vertices; disabled
panel_15 = Panel("3")  # disabled
list_item_12 = ListItem(List=deconstruct_brep_5.Faces, Index=panel_15, Wrap=True)  # disabled
area_2 = Area(Geometry=list_item_12)  # -> Area, Centroid; disabled
number_slider_86 = Slider(1, range=0..1)  # disabled
number_slider_87 = Slider(0.42, range=0..1)  # disabled
number_slider_88 = Slider(1, range=0..1)  # disabled
orient_4 = Orient(Geometry=center_box, Source=area_2.Centroid, Target=align_plane.Plane)  # -> Geometry, Transform; disabled
scale_2 = Scale(Geometry=orient_4.Geometry, Center=divide_curve_3.Points, Factor=number_slider_86)  # -> Geometry, Transform; disabled
scale_nu = ScaleNU(
    Geometry=orient_4.Geometry,
    Plane=align_plane.Plane,
    ScaleX=number_slider_86,
    ScaleY=number_slider_88,
    ScaleZ=number_slider_87)  # -> Geometry, Transform; disabled

# ----
# - mapping is a good way to orient complex and simple
# geometry
number_slider_89 = Slider(12, range=0..100)  # disabled
number_slider_90 = Slider(12, range=0..100)  # disabled
number_slider_91 = Slider(2, range=0..10)  # disabled
number_slider_92 = Slider(3, range=0..3)  # disabled
number_slider_93 = Slider(2, range=0..10)  # disabled
construct_point_15 = ConstructPoint(XCoordinate=number_slider_89, YCoordinate=0, ZCoordinate=0)  # disabled
number_slider_94 = Slider(3, range=0..10)  # disabled
sphere_7 = Sphere(Base=PlaneXY(0, 0, 0), Radius=number_slider_91)  # disabled
cone_3 = Cone(Base=PlaneXY(0, 0, 0), Radius=number_slider_90, Length=number_slider_90)  # -> Cone, Tip; disabled
polygon_5 = Polygon(Plane=construct_point_15, Radius=number_slider_92, Segments=number_slider_94, FilletRadius=0)  # -> Polygon, Length; disabled
circle_5 = Circle(Plane=construct_point_15, Radius=number_slider_93)  # disabled
bounding_box = BoundingBox(Content=cone_3.Cone, Plane=PlaneXY(0, 0, 0))  # -> Box, Box_2; disabled
bounding_box_2 = BoundingBox(Content=sphere_7, Plane=PlaneXY(0, 0, 0))  # -> Box, Box_2; disabled
polygon_6 = Polygon(Plane=PlaneXY(0, 0, 0), Radius=number_slider_90, Segments=number_slider_94, FilletRadius=0)  # -> Polygon, Length; disabled
polar_array_2 = PolarArray(Geometry=circle_5, Plane=PlaneXY(0, 0, 0), Count=10, Angle=6.283185307)  # -> Geometry, Transform; disabled
polar_array_3 = PolarArray(Geometry=polygon_5.Polygon, Plane=PlaneXY(0, 0, 0), Count=10, Angle=6.283185307)  # -> Geometry, Transform; disabled
bounding_box_3 = BoundingBox(Content=polygon_6.Polygon, Plane=PlaneXY(0, 0, 0))  # -> Box, Box_2; disabled
bounding_box_4 = BoundingBox(Content=polar_array_2.Geometry, Plane=PlaneXY(0, 0, 0))  # -> Box, Box_2; disabled
box_mapping = BoxMapping(Geometry=cone_3.Cone, Source=bounding_box.Box, Target=bounding_box_2.Box)  # -> Geometry, Transform; disabled
deconstruct_brep_6 = DeconstructBrep(Brep=bounding_box_3.Box)  # -> Faces, Edges, Vertices; disabled
deconstruct_brep_7 = DeconstructBrep(Brep=bounding_box_4.Box)  # -> Faces, Edges, Vertices; disabled
rectangle_mapping = RectangleMapping(Geometry=polygon_6.Polygon, Source=deconstruct_brep_6.Faces, Target=deconstruct_brep_7.Faces)  # -> Geometry, Transform; disabled
triangle_mapping = TriangleMapping(Geometry=circle_5, Source=polygon_6.Polygon, Target=polar_array_3.Geometry)  # -> Geometry, Transform; disabled
geometry_9 = Geometry(box_mapping.Geometry)  # disabled
curve_9 = Curve(rectangle_mapping.Geometry)  # disabled
curve_10 = Curve(triangle_mapping.Geometry)  # disabled

# ----
# - a bit of fun with camera obscura, orient direction and pathmapper
number_slider_95 = Slider(2, range=0..10)  # disabled
number_slider_96 = Slider(3, range=0..10)  # disabled
number_slider_97 = Slider(1, range=0..1)  # disabled
negative_2 = Negative(Value=number_slider_95)  # disabled
panel_16 = Panel(".1")  # disabled
number_slider_98 = Slider(8, range=0..10)  # disabled
construct_domain_4 = ConstructDomain(DomainStart=negative_2, DomainEnd=number_slider_95)  # disabled
unit_z_8 = UnitZ(Factor=number_slider_95)  # disabled
construct_domain_5 = ConstructDomain(DomainStart=panel_16, DomainEnd=number_slider_97)  # disabled
multiplication_4 = Multiplication(A=number_slider_96, B=unit_z_8)  # disabled
domain_box = DomainBox(Base=PlaneXY(0, 0, 0), X=construct_domain_4, Y=construct_domain_4, Z=Domain(0, 0.25))  # disabled
range_18 = Range(Domain=construct_domain_5, Steps=number_slider_98)  # disabled
move_9 = Move(Geometry=domain_box, Motion=multiplication_4)  # -> Geometry, Transform; disabled
yz_plane_2 = YZPlane(Origin=Point(0, 0, 0))  # disabled
deconstruct_brep_8 = DeconstructBrep(Brep=domain_box)  # -> Faces, Edges, Vertices; disabled
volume_3 = Volume(Geometry=move_9.Geometry)  # -> Volume, Centroid; disabled
camera_obscura = CameraObscura(Geometry=move_9.Geometry, Point=yz_plane_2, Factor=range_18)  # -> graft(Geometry), Transform; disabled
dispatch_2 = Dispatch(List=deconstruct_brep_8.Vertices, DispatchPattern=[True, False])  # -> ListA, ListB; disabled
camera_obscura_2 = CameraObscura(Geometry=camera_obscura.Geometry, Point=volume_3.Centroid, Factor=range_18)  # -> Geometry, Transform; disabled
line_sdl_6 = LineSDL(Start=volume_3.Centroid, Direction=dispatch_2.ListB, Length=1)  # disabled
line_sdl_7 = LineSDL(Start=volume_3.Centroid, Direction=dispatch_2.ListA, Length=1)  # disabled
orient_direction = OrientDirection(
    Geometry=graft(camera_obscura_2.Geometry),
    PointA=volume_3.Centroid,
    DirectionA=line_sdl_7,
    PointB=volume_3.Centroid,
    DirectionB=line_sdl_6)  # -> simplify(Geometry), Transform; disabled
path_mapper = PathMapper(orient_direction.Geometry, source="{A;B}(i)", target="{A}(i)")  # disabled
path_mapper_2 = PathMapper(orient_direction.Geometry, source="{A;B}(i)", target="{B}(i)")  # disabled
geometry_10 = Geometry(path_mapper)  # disabled
geometry_11 = Geometry(path_mapper_2)  # disabled

# ----
# - projecting and projecting with direction
number_slider_99 = Slider(0, range=0..1)  # disabled
number_slider_100 = Slider(0.69, range=0..1)  # disabled
number_slider_101 = Slider(20, range=0..100)  # disabled
number_slider_102 = Slider(4, range=0..10)  # disabled
number_slider_103 = Slider(13, range=0..100)  # disabled
construct_domain_6 = ConstructDomain(DomainStart=number_slider_99, DomainEnd=number_slider_100)  # disabled
division_3 = Division(A=number_slider_101, B=number_slider_102)  # disabled
sphere_8 = Sphere(Base=PlaneXY(0, 0, 0), Radius=number_slider_101)  # disabled
quad_sphere_6 = QuadSphere(Base=PlaneXY(0, 0, 0), Radius=division_3)  # disabled
range_19 = Range(Domain=construct_domain_6, Steps=number_slider_103)  # disabled
deconstruct_brep_9 = DeconstructBrep(Brep=quad_sphere_6)  # -> Faces, graft(Edges), Vertices; disabled
construct_point_16 = ConstructPoint(XCoordinate=range_19, YCoordinate=range_19, ZCoordinate=0)  # disabled
number_slider_104 = Slider(7.32, range=0..10)  # disabled
number_slider_105 = Slider(7.32, range=0..10)  # disabled
number_slider_106 = Slider(7.32, range=0..10)  # disabled
evaluate_surface_4 = EvaluateSurface(Surface=reparameterize(sphere_8), Point=construct_point_16)  # -> Point, Normal, UDirection, VDirection, Frame; disabled
number_slider_107 = Slider(100, range=0..100)  # disabled
align_plane_2 = AlignPlane(Plane=evaluate_surface_4.Point, Direction=evaluate_surface_4.Normal)  # -> Plane, Angle; disabled
plane_normal_3 = PlaneNormal(Origin=evaluate_surface_4.Point, ZAxis=evaluate_surface_4.Normal)  # disabled
construct_point_17 = ConstructPoint(XCoordinate=number_slider_104, YCoordinate=number_slider_105, ZCoordinate=number_slider_106)  # disabled
polygon_7 = Polygon(Plane=plane_normal_3, Radius=number_slider_107, Segments=6, FilletRadius=0)  # -> Polygon, Length; disabled
vector_2pt = Vector2Pt(PointA=construct_point_17, PointB=evaluate_surface_4.Point, Unitize=False)  # -> Vector, Length; disabled
boundary_surfaces_3 = BoundarySurfaces(Edges=polygon_7.Polygon)  # disabled
vector_display_3 = VectorDisplay(Anchor=vector_2pt.Vector, Vector=vector_2pt.Vector)  # disabled
project_3 = Project(Geometry=deconstruct_brep_9.Edges, Plane=boundary_surfaces_3)  # -> Geometry, Transform; disabled
project_along = ProjectAlong(Geometry=deconstruct_brep_9.Edges, Plane=boundary_surfaces_3, Direction=vector_2pt.Vector)  # -> Geometry, Transform; disabled
multipipe_8 = MultiPipe(Curves=project_along.Geometry, NodeSize=0.5, EndOffset=1, StrutSize=1, Segment=0, KinkAngle=0.6, CubeFit=0, Caps=0)  # disabled
multipipe_9 = MultiPipe(Curves=project_3.Geometry, NodeSize=0.5, EndOffset=1, StrutSize=1, Segment=0, KinkAngle=0.6, CubeFit=0, Caps=0)  # disabled

# ----
# 011_Transformations
# Array
# Morph
# Euclidean
# Utility
# Affine
scale_nu_2 = ScaleNU(Plane=PlaneXY(0, 0, 0), ScaleX=1, ScaleY=1, ScaleZ=1)  # -> Geometry, Transform; disabled
project_4 = Project(Plane=PlaneXY(0, 0, 0))  # -> Geometry, Transform; disabled
project_along_2 = ProjectAlong(Plane=PlaneXY(0, 0, 0), Direction=Vector(0, 0, -1))  # -> Geometry, Transform; disabled
scale_3 = Scale(Center=Point(0, 0, 0), Factor=0.5)  # -> Geometry, Transform; disabled
orient_direction_2 = OrientDirection(PointA=Point(0, 0, 0), DirectionA=Vector(0, 0, 1), PointB=Point(0, 0, 0), DirectionB=Vector(0, 0, 1))  # -> Geometry, Transform; disabled
camera_obscura_3 = CameraObscura(Point=Point(0, 0, 0), Factor=1)  # -> Geometry, Transform; disabled
box_mapping_2 = BoxMapping()  # -> Geometry, Transform; disabled
rectangle_mapping_2 = RectangleMapping()  # -> Geometry, Transform; disabled
triangle_mapping_2 = TriangleMapping()  # -> Geometry, Transform; disabled
box_array = BoxArray(Cell={Plane=PlaneXY(0, 0, 0), X=Domain(0, 10), Y=Domain(0, 5), Z=Domain(0, 2)}, XCount=4, YCount=3, ZCount=2)  # -> Geometry, Transform; disabled
curve_array = CurveArray(Count=10)  # -> Geometry, Transform; disabled
linear_array = LinearArray(Direction=Vector(10, 0, 0), Count=10)  # -> Geometry, Transform; disabled
polar_array_4 = PolarArray(Plane=PlaneXY(0, 0, 0), Count=10, Angle=6.283185307)  # -> Geometry, Transform; disabled
rectangular_array = RectangularArray(Cell={Plane=PlaneXY(0, 0, 0), Size=Domain2(u=0..10, v=0..5)}, XCount=6, YCount=3)  # -> Geometry, Transform; disabled
kaleidoscope = Kaleidoscope(Plane=PlaneXY(0, 0, 0), Segments=10)  # -> Geometry, Transform; disabled
mirror = Mirror(Plane=PlaneYZ(0, 0, 0))  # -> Geometry, Transform; disabled
move_10 = Move(Motion=Vector(0, 0, 10))  # -> Geometry, Transform; disabled
orient_5 = Orient(Source=PlaneXY(0, 0, 0), Target=PlaneXY(0, 0, 0))  # -> Geometry, Transform; disabled
move_to_plane = MoveToPlane(Plane=PlaneXY(0, 0, 0), Above=True, Below=True)  # -> Geometry, Transform; disabled
rotate = Rotate(Angle=1.570796327, Plane=PlaneXY(0, 0, 0))  # -> Geometry, Transform; disabled
rotate_3d_8 = Rotate3D(Angle=1.570796327, Center=Point(0, 0, 0), Axis=Vector(0, 0, 1))  # -> Geometry, Transform; disabled
rotate_axis_2 = RotateAxis(Angle=1.570796327, Axis=Line((0, 0, 0), (10, 0, 0)))  # -> Geometry, Transform; disabled
rotate_direction = RotateDirection(Center=Point(0, 0, 0), From=Vector(1, 0, 0), To=Vector(0, 1, 0))  # -> Geometry, Transform; disabled
flow = Flow(ReverseBase=False, ReverseTarget=False, Stretch=True, Rigid=False)  # disabled
splop = Splop(Plane=PlaneXY(0, 0, 0), Angle=0, Rigid=False)  # disabled
bend_deform = BendDeform()  # disabled
twisted_box = TwistedBox()  # disabled
surface_morph = SurfaceMorph()  # disabled
sporph = Sporph(Rigid=False)  # disabled
box_morph = BoxMorph()  # disabled
maelstrom = Maelstrom(Plane=PlaneXY(0, 0, 0), First=0.1, Second=10, Angle=1.570796327, Rigid=False)  # disabled
stretch = Stretch(Axis=Line((0, 0, 0), (10, 10, 0)), Length=20, Rigid=False)  # disabled
twist = Twist(Angle=1.570796327, Infinite=False, Rigid=False)  # disabled
inverse_transform = InverseTransform()  # disabled
transform_matrix = TransformMatrix(Digits=3)  # disabled
transform = Transform()  # disabled
merge_group = MergeGroup()  # disabled
group = Group()  # disabled
split_group = SplitGroup(Wrap=False)  # -> GroupA, GroupB; disabled
ungroup = Ungroup()  # disabled
compound = Compound()  # disabled
split = Split()  # disabled

number_slider_108 = Slider(1, range=0..1)  # disabled

# ----
# 008_Surface
# Freeform
# Primitive
# Analysis
# SubD
# Utilities
surface_closest_point = SurfaceClosestPoint()  # -> Point, UVPoint, Distance; disabled
area_3 = Area()  # -> Area, Centroid; disabled
volume_4 = Volume()  # -> Volume, Centroid; disabled
evaluate_surface_5 = EvaluateSurface()  # -> Point, Normal, UDirection, VDirection, Frame; disabled
deconstruct_brep_10 = DeconstructBrep()  # -> Faces, Edges, Vertices; disabled
brep_closest_point = BrepClosestPoint()  # -> Point, Normal, Distance; disabled
point_in_brep = PointInBrep(Strict=False)  # disabled
brep_edges = BrepEdges()  # -> Naked, Interior, NonManifold; disabled
point_in_breps = PointInBreps(Strict=False)  # -> Inside, Index; disabled
surface_from_points_3 = SurfaceFromPoints(Interpolate=False)  # disabled
extrude = Extrude()  # disabled
sweep2 = Sweep2(SameHeight=False)  # disabled
_4point_surface = _4PointSurface()  # disabled
pipe_variable = PipeVariable(Caps=0)  # disabled
revolution_8 = Revolution(Domain=Domain(0, 6.283185307))  # disabled
boundary_surfaces_4 = BoundarySurfaces()  # disabled
rail_revolution_2 = RailRevolution(Scale=False)  # disabled
sweep1 = Sweep1(Miter=1)  # disabled
loft_5 = Loft(Options={Adjust=False, Closed=False, LoftEnds=0, LoftSimp=0, LoftType=0, Rebuild=10, Refit=0.01})  # disabled
pipe_2 = Pipe(Radius=1, Caps=0)  # disabled
extrude_linear = ExtrudeLinear(OrientationP=PlaneXY(0, 0, 0))  # disabled
extrude_along = ExtrudeAlong()  # disabled
extrude_point = ExtrudePoint()  # disabled
patch = Patch(Spans=20, Flexibility=1, Trim=True)  # disabled
bounding_box_5 = BoundingBox(Plane=PlaneXY(0, 0, 0))  # -> Box, Box_2; disabled
cylinder = Cylinder(Base=PlaneXY(0, 0, 0), Radius=0.5, Length=1)  # disabled
plane_surface = PlaneSurface(Plane=PlaneXY(0, 0, 0), XSize=Domain(-10, 10), YSize=Domain(-10, 10))  # disabled
quad_sphere_7 = QuadSphere(Base=PlaneXY(0, 0, 0), Radius=1)  # disabled
sphere_9 = Sphere(Base=PlaneXY(0, 0, 0), Radius=1)  # disabled
cone_4 = Cone(Base=PlaneXY(0, 0, 0), Radius=0.5, Length=1)  # -> Cone, Tip; disabled
center_box_2 = CenterBox(Base=PlaneXY(0, 0, 0), X=1, Y=1, Z=1)  # disabled
bounding_box_6 = BoundingBox(Plane=PlaneXY(0, 0, 0), UnionBox=True)  # -> Box, Box_2; disabled
plane_through_shape = PlaneThroughShape(Inflate=1, SectionLogic=False)  # disabled
multipipe_10 = MultiPipe(NodeSize=0.5, EndOffset=1, StrutSize=1, Segment=0, KinkAngle=0.6, CubeFit=0, Caps=0)  # disabled
subd_fuse = SubDFuse(BooleanOption=0, Smoothing=10)  # disabled
subd_from_mesh = SubDFromMesh(Creases=1, Corners=1, Interpolate=False)  # disabled
mesh_from_subd = MeshFromSubD(Density=2)  # disabled
subd_control_polygon = SubDControlPolygon()  # disabled
subd_edges = SubDEdges(NewFormatting=False)  # -> Line, Edge, Tag, Id; disabled
divide_surface_3 = DivideSurface(UCount=10, VCount=10)  # -> Points, Normals, Parameters; disabled
offset_surface = OffsetSurface(Distance=0, Retrim=True)  # disabled
isotrim = Isotrim()  # disabled
flip = Flip()  # -> Surface, Result; disabled
fillet_edge = FilletEdge(Blend=0, Metric=0)  # disabled
brep_join = BrepJoin()  # -> Breps, Closed; disabled
cap_holes_3 = CapHoles()  # disabled
surface_frames = SurfaceFrames(UCount=10, VCount=10)  # -> Frames, Parameters; disabled

# ----
# EXERCISES_SURFACE
# 022_surface_analysis
# - MVP debrep node
number_slider_109 = Slider(14, range=0..100)  # disabled
quad_sphere_8 = QuadSphere(Base=PlaneXY(0, 0, 0), Radius=number_slider_109)  # disabled
deconstruct_brep_11 = DeconstructBrep(Brep=quad_sphere_8)  # -> Faces, Edges, Vertices; disabled
surface_4 = Surface(reparameterize(deconstruct_brep_11.Faces))  # disabled
point_4 = Point(deconstruct_brep_11.Vertices)  # disabled
curve_11 = Curve(deconstruct_brep_11.Edges)  # disabled
area_4 = Area(Geometry=surface_4)  # -> Area, Centroid; disabled
volume_5 = Volume(Geometry=quad_sphere_8)  # -> Volume, Centroid; disabled
list_length_3 = ListLength(List=surface_4)  # disabled
point_5 = Point(area_4.Centroid)  # disabled
point_6 = Point(volume_5.Centroid)  # disabled
number_slider_110 = Slider(0.8, range=0..1)  # disabled
number_slider_111 = Slider(0.2, range=0..1)  # disabled
expression_6 = Expression(Variable_x=list_length_3, Expression="x-1")  # disabled
construct_domain_7 = ConstructDomain(DomainStart=number_slider_111, DomainEnd=number_slider_110)  # disabled
number_slider_112 = Slider(0.469, range=0..1)  # disabled
range_20 = Range(Domain=construct_domain_7, Steps=expression_6)  # disabled
construct_point_18 = ConstructPoint(XCoordinate=graft(range_20), YCoordinate=number_slider_112, ZCoordinate=0)  # disabled
evaluate_surface_6 = EvaluateSurface(Surface=reparameterize(flatten(surface_4)), Point=construct_point_18)  # -> Point, Normal, UDirection, VDirection, Frame; disabled

number_slider_113 = Slider(10, range=0..100)  # disabled
number_slider_114 = Slider(4, range=0..10)  # disabled
number_slider_115 = Slider(89, range=0..100)  # disabled
panel_17 = Panel("{0;*}[(1,3,...)]")  # disabled
number_slider_116 = Slider(187, range=0..1000)  # disabled
number_slider_117 = Slider(100, range=0..100)  # disabled
sphere_10 = Sphere(Base=PlaneXY(0, 0, 0), Radius=number_slider_113)  # disabled
deconstruct_brep_12 = DeconstructBrep(Brep=quad_sphere_8)  # -> Faces, Edges, Vertices; disabled
populate_geometry_2 = PopulateGeometry(Geometry=quad_sphere_8, Count=number_slider_114, Seed=number_slider_115)  # disabled
bounding_box_7 = BoundingBox(Content=sphere_10, Plane=PlaneXY(0, 0, 0), UnionBox=True)  # -> Box, Box_2; disabled
split_tree_2 = SplitTree(Data=deconstruct_brep_12.Faces, Masks=flatten(panel_17))  # -> Positive, Negative; disabled
populate_3d = Populate3D(Region=bounding_box_7.Box, Count=number_slider_117, Seed=number_slider_116)  # disabled
surface_5 = Surface(split_tree_2.Positive)  # disabled
surface_6 = Surface(split_tree_2.Negative)  # disabled
brep_closest_point_2 = BrepClosestPoint(Point=populate_geometry_2, Brep=quad_sphere_8)  # -> Point, Normal, Distance; disabled
clean_tree_3 = CleanTree(RemoveNulls=True, RemoveInvalid=True, RemoveEmpty=False, Tree=surface_6)  # disabled
clean_tree_4 = CleanTree(RemoveNulls=True, RemoveInvalid=True, RemoveEmpty=False, Tree=surface_5)  # disabled
point_in_breps_2 = PointInBreps(Brep=sphere_10, Point=populate_3d, Strict=False)  # -> Inside, Index; disabled
surface_closest_point_2 = SurfaceClosestPoint(Point=populate_geometry_2, Surface=clean_tree_4)  # -> Point, UVPoint, Distance; disabled
cull_pattern_2 = CullPattern(List=populate_3d, CullPattern=point_in_breps_2.Inside)  # disabled
surface_closest_point_3 = SurfaceClosestPoint(Point=populate_geometry_2, Surface=clean_tree_3)  # -> Point, UVPoint, Distance; disabled
cull_pattern_3 = CullPattern(List=populate_3d, CullPattern=point_in_breps_2.Index)  # disabled
shortest_list = ShortestList(ListListA=cull_pattern_2, ListListB=cull_pattern_3, TrimMode=2)  # -> ListListA, ListListB; disabled
cull_duplicates = CullDuplicates(Points=brep_closest_point_2.Point, Tolerance=0.1, CullMode=3)  # -> Points, Indices, Valence; disabled
cull_duplicates_2 = CullDuplicates(Points=surface_closest_point_3.Point, Tolerance=0.1, CullMode=3)  # -> Points, Indices, Valence; disabled
cull_duplicates_3 = CullDuplicates(Points=surface_closest_point_2.Point, Tolerance=0.1, CullMode=3)  # -> Points, Indices, Valence; disabled
sort_points_2 = SortPoints(Points=shortest_list.ListListA)  # -> Points, Indices; disabled
sort_points_3 = SortPoints(Points=shortest_list.ListListB)  # -> Points, Indices; disabled
sort_points_4 = SortPoints(Points=cull_duplicates.Points)  # -> Points, Indices; disabled
sort_points_5 = SortPoints(Points=cull_duplicates_3.Points)  # -> Points, Indices; disabled
sort_points_6 = SortPoints(Points=cull_duplicates_2.Points)  # -> Points, Indices; disabled
line_8 = Line(StartPoint=sort_points_2.Points, EndPoint=sort_points_3.Points)  # disabled
interpolate_6 = Interpolate(Vertices=sort_points_6.Points, Degree=3, Periodic=False, KnotStyle=1)  # -> Curve, Length, Domain; disabled
interpolate_7 = Interpolate(Vertices=sort_points_4.Points, Degree=3, Periodic=False, KnotStyle=1)  # -> Curve, Length, Domain; disabled
interpolate_8 = Interpolate(Vertices=sort_points_5.Points, Degree=3, Periodic=False, KnotStyle=1)  # -> Curve, Length, Domain; disabled
number_slider_118 = Slider(3, range=0..10)  # disabled
loft_6 = Loft(
    Curves=[interpolate_8.Curve, interpolate_6.Curve],
    Options={Adjust=False, Closed=False, LoftEnds=0, LoftSimp=0, LoftType=0, Rebuild=10, Refit=0.01})  # disabled
divide_domain² = DivideDomain²(Domain=loft_6, UCount=number_slider_118, VCount=number_slider_118)  # disabled
md_slider_7 = MDSlider(
    SliderMode=0,
    slider_value=Point(0.5138266959, 0.5967466773, 0.5),
    x_domain=Domain(0, 1),
    y_domain=Domain(0, 1),
    z_domain=Domain(0, 1))  # disabled
isotrim_2 = Isotrim(Surface=loft_6, Domain=divide_domain²)  # disabled
evaluate_surface_7 = EvaluateSurface(Surface=reparameterize(isotrim_2), Point=md_slider_7)  # -> Point, Normal, UDirection, VDirection, Frame; disabled
plane_3 = Plane(evaluate_surface_7.Frame)  # disabled

# ----
# - consider naked edges on breps and surfaces
brep_edges_2 = BrepEdges(Brep=surface_4)  # -> Naked, Interior, NonManifold; disabled
brep_edges_3 = BrepEdges(Brep=quad_sphere_8)  # -> Naked, Interior, NonManifold; disabled
curve_12 = Curve(brep_edges_2.Naked)  # disabled
curve_13 = Curve(brep_edges_3.Naked)  # disabled
curve_14 = Curve(brep_edges_3.Interior)  # disabled

# ----
# 035_transformations_array
# - great ways to get simple geometry to be more
# complex and exciting to visualize
number_slider_119 = Slider(100, range=0..100)  # disabled
panel_18 = Panel("10")  # disabled
panel_19 = Panel("2")  # disabled
division_4 = Division(A=number_slider_119, B=panel_18)  # disabled
division_5 = Division(B=panel_19)  # disabled
number_slider_120 = Slider(6, range=0..10)  # disabled
range_21 = Range(Domain=division_4, Steps=number_slider_119)  # disabled
division_6 = Division(A=division_4, B=panel_19)  # disabled
base = Base(PlaneXY(0, 0, 0))  # disabled
pi_10 = Pi(Factor=range_21)  # disabled
cosine_2 = Cosine(Value=range_21)  # disabled
sine_3 = Sine(Value=range_21)  # disabled
rectangle_3 = Rectangle(Plane=base, XSize=Domain(-1, 1), YSize=Domain(-2, 2), Radius=0)  # -> Rectangle, Length; disabled
division_7 = Division(A=division_4, B=division_6)  # disabled
number_slider_121 = Slider(2, range=0..2)  # disabled
multiplication_5 = Multiplication(A=pi_10, B=number_slider_120)  # disabled
multiplication_6 = Multiplication(A=pi_10, B=cosine_2)  # disabled
multiplication_7 = Multiplication(A=pi_10, B=sine_3)  # disabled
cylinder_2 = Cylinder(Base=PlaneXY(0, 0, 0), Radius=division_7, Length=division_7)  # disabled
number_slider_122 = Slider(3, range=0..10)  # disabled
construct_point_19 = ConstructPoint(XCoordinate=multiplication_5, YCoordinate=multiplication_6, ZCoordinate=multiplication_7)  # disabled
range_22 = Range(Domain=number_slider_121, Steps=expr("x-1", 10))  # disabled
range_23 = Range(Domain=Domain(0, 1), Steps=10)  # disabled
center_box_3 = CenterBox(Base=base, X=1, Y=1, Z=1)  # disabled
interpolate_9 = Interpolate(Vertices=construct_point_19, Degree=3, Periodic=False, KnotStyle=1)  # -> Curve, Length, Domain; disabled
unit_z_9 = UnitZ(Factor=1)  # disabled
deconstruct_brep_13 = DeconstructBrep(Brep=center_box_3)  # -> Faces, Edges, Vertices; disabled
pi_11 = Pi(Factor=range_22)  # disabled
shatter_2 = Shatter(Curve=reparameterize(interpolate_9.Curve), Parameters=range_23)  # disabled
curve_middle_4 = CurveMiddle(Curve=shatter_2)  # disabled
number_slider_123 = Slider(10, range=0..100)  # disabled
rotate_3d_9 = Rotate3D(Geometry=shatter_2, Angle=pi_11, Center=curve_middle_4, Axis=unit_z_9)  # -> Geometry, Transform; disabled
polar_array_5 = PolarArray(Geometry=interpolate_9.Curve, Plane=PlaneXY(0, 0, 0), Count=number_slider_119, Angle=6.283185307)  # -> Geometry, Transform; disabled
linear_array_2 = LinearArray(Geometry=cylinder_2, Direction=Vector(10, 0, 0), Count=number_slider_119)  # -> Geometry, Transform; disabled
box_array_2 = BoxArray(Geometry=cylinder_2, Cell=center_box_3, XCount=number_slider_122, YCount=number_slider_122, ZCount=number_slider_122)  # -> Geometry, Transform; disabled
rectangular_array_2 = RectangularArray(Geometry=cylinder_2, Cell=rectangle_3.Rectangle, XCount=number_slider_122, YCount=number_slider_122)  # -> Geometry, Transform; disabled
curve_array_2 = CurveArray(Geometry=cylinder_2, Curve=interpolate_9.Curve, Count=number_slider_119)  # -> Geometry, Transform; disabled
number_slider_124 = Slider(10, range=0..10)  # disabled
polar_array_6 = PolarArray(Geometry=rotate_3d_9.Geometry, Plane=PlaneXY(0, 0, 0), Count=number_slider_123, Angle=pi_11)  # -> Geometry, Transform; disabled
loft_7 = Loft(
    Curves=polar_array_5.Geometry,
    Options={Adjust=False, Closed=True, LoftEnds=0, LoftSimp=0, LoftType=0, Rebuild=10, Refit=0.01})  # disabled
kaleidoscope_2 = Kaleidoscope(Geometry=polar_array_6.Geometry, Plane=PlaneXY(0, 0, 0), Segments=number_slider_124)  # -> Geometry, Transform; disabled
geometry_12 = Geometry(kaleidoscope_2.Geometry)  # disabled

number_slider_125 = Slider(1, range=0..2)  # disabled
number_slider_126 = Slider(2.15, range=0..10)  # disabled
multipipe_11 = MultiPipe(
    Curves=line_8,
    NodeSize=number_slider_126,
    EndOffset=1,
    StrutSize=1,
    Segment=0,
    KinkAngle=0.6,
    CubeFit=0,
    Caps=number_slider_125)  # disabled

# ----
# 023_surface_freeform
# - Daniel Christev's wonderful surfaces
# guarentees a sq set of points
# on surface, no half holes
# - so much more interesting than the regular
# surface generating nodes
number_slider_127 = Slider(40, range=0..100)  # disabled
number_slider_128 = Slider(100, range=0..100)  # disabled
_4point_surface_2 = _4PointSurface()  # disabled
number_slider_129 = Slider(4, range=0..5)  # disabled
range_24 = Range(Domain=number_slider_127, Steps=number_slider_128)  # disabled
boundary_surfaces_5 = BoundarySurfaces()  # disabled
sine_4 = Sine(Value=range_24)  # disabled
multiplication_8 = Multiplication(A=sine_4, B=number_slider_129)  # disabled
loft_8 = Loft(Options={Adjust=False, Closed=False, LoftEnds=0, LoftSimp=0, LoftType=0, Rebuild=10, Refit=0.01})  # disabled
number_slider_130 = Slider(3.478, range=0..5)  # disabled
construct_point_20 = ConstructPoint(XCoordinate=graft(range_24), YCoordinate=range_24, ZCoordinate=multiplication_8)  # disabled
surface_from_points_4 = SurfaceFromPoints(Points=flatten(construct_point_20), UCount=expr("x+1", number_slider_128), Interpolate=False)  # disabled
surface_7 = Surface(surface_from_points_4)  # disabled
area_5 = Area(Geometry=surface_7)  # -> Area, Centroid; disabled
dimensions_2 = Dimensions(Surface=surface_7)  # -> UDimension, VDimension; disabled
number_slider_131 = Slider(29, range=0..100)  # disabled
extrude_2 = Extrude()  # disabled
division_8 = Division(A=dimensions_2.UDimension, B=dimensions_2.VDimension)  # disabled
scale_4 = Scale(Geometry=surface_7, Center=area_5.Centroid, Factor=number_slider_130)  # -> Geometry, Transform; disabled
md_slider_8 = MDSlider(
    SliderMode=0,
    slider_value=Point(0.5964374077, 0.3989495998, 0.5),
    x_domain=Domain(0, 1),
    y_domain=Domain(0, 1),
    z_domain=Domain(0, 1))  # disabled
multiplication_9 = Multiplication(A=division_8, B=number_slider_131)  # disabled
pipe_3 = Pipe(Radius=1, Caps=0)  # disabled
integer_2 = Integer(multiplication_9)  # disabled
divide_surface_4 = DivideSurface(Surface=surface_7, UCount=integer_2, VCount=number_slider_131)  # -> flatten(Points), Normals, Parameters; disabled
md_slider_9 = MDSlider(
    SliderMode=0,
    slider_value=Point(0.758053798, 0.3364762142, 0.5),
    x_domain=Domain(0, 1),
    y_domain=Domain(0, 1),
    z_domain=Domain(0, 1))  # disabled
number_slider_132 = Slider(0.243, range=0..2)  # disabled
pipe_variable_2 = PipeVariable(Caps=0)  # disabled
md_slider_10 = MDSlider(
    SliderMode=0,
    slider_value=Point(0.1441892298, 0.9533711875, 0.5),
    x_domain=Domain(0, 1),
    y_domain=Domain(0, 1),
    z_domain=Domain(0, 1))  # disabled
evaluate_surface_8 = EvaluateSurface(Surface=reparameterize(scale_4.Geometry), Point=[md_slider_10, md_slider_8, md_slider_9])  # -> Point, Normal, UDirection, VDirection, Frame; disabled
distance_5 = Distance(PointA=graft(evaluate_surface_8.Point), PointB=divide_surface_4.Points)  # disabled
expression_7 = Expression(w=flatten(number_slider_132), t=distance_5, Expression="sin(2*w^2*t)")  # disabled
sweep1_2 = Sweep1(Miter=1)  # disabled
flip_matrix_3 = FlipMatrix(Data=expression_7)  # disabled
number_slider_133 = Slider(7.333, range=0..10)  # disabled
sweep2_2 = Sweep2(SameHeight=False)  # disabled
ma_2 = MassMultiplication(Input=flip_matrix_3)  # -> flatten(Result), PartialResults; disabled
multiplication_10 = Multiplication(A=number_slider_133, B=ma_2.Result)  # disabled
rail_revolution_3 = RailRevolution(Scale=False)  # disabled
unit_z_10 = UnitZ(Factor=multiplication_10)  # disabled
move_11 = Move(Geometry=divide_surface_4.Points, Motion=unit_z_10)  # -> Geometry, Transform; disabled
revolution_9 = Revolution(Domain=Domain(0, 6.283185307))  # disabled
expression_8 = Expression(u=integer_2, Expression="u+1")  # disabled
extrude_along_2 = ExtrudeAlong()  # disabled
extrude_linear_2 = ExtrudeLinear(OrientationP=PlaneXY(0, 0, 0))  # disabled
extrude_point_2 = ExtrudePoint()  # disabled
surface_from_points_5 = SurfaceFromPoints(Points=move_11.Geometry, UCount=expression_8, Interpolate=False)  # disabled
patch_2 = Patch(Spans=20, Flexibility=1, Trim=True)  # disabled

# ----
# - there are many ways to rotate geometries in grasshopper
rotate_2 = Rotate(Angle=1.570796327, Plane=PlaneXY(0, 0, 0))  # -> Geometry, Transform; disabled
# 036_transform_euclidean
# - intuitive and commonly used nodes for transformations
mirror_2 = Mirror(Plane=PlaneYZ(0, 0, 0))  # -> Geometry, Transform; disabled
rotate_plane_4 = RotatePlane()  # disabled
rotate_3d_10 = Rotate3D(Angle=1.570796327, Center=Point(0, 0, 0), Axis=Vector(0, 0, 1))  # -> Geometry, Transform; disabled
move_12 = Move(Motion=Vector(0, 0, 10))  # -> Geometry, Transform; disabled
rotate_axis_3 = RotateAxis(Angle=1.570796327, Axis=Line((0, 0, 0), (10, 0, 0)))  # -> Geometry, Transform; disabled
orient_6 = Orient(Source=PlaneXY(0, 0, 0), Target=PlaneXY(0, 0, 0))  # -> Geometry, Transform; disabled
rotate_direction_2 = RotateDirection(Center=Point(0, 0, 0), From=Vector(1, 0, 0), To=Vector(0, 1, 0))  # -> Geometry, Transform; disabled
move_to_plane_2 = MoveToPlane(Plane=PlaneXY(0, 0, 0), Above=True, Below=True)  # -> Geometry, Transform; disabled

# ----
# 024_surface_primitive
# - Daniel Christev's wonderful surfaces
center_box_4 = CenterBox(Base=PlaneXY(0, 0, 0), X=1, Y=1, Z=1)  # disabled
number_slider_134 = Slider(38, range=0..100)  # disabled
number_slider_135 = Slider(24, range=0..100)  # disabled
cone_5 = Cone(Base=PlaneXY(0, 0, 0), Radius=0.5, Length=1)  # -> Cone, Tip; disabled
plane_surface_2 = PlaneSurface(Plane=PlaneXY(0, 0, 0), XSize=number_slider_134, YSize=number_slider_135)  # disabled
cylinder_3 = Cylinder(Base=PlaneXY(0, 0, 0), Radius=0.5, Length=1)  # disabled
bounding_box_8 = BoundingBox(Content=surface_from_points_5, Plane=PlaneXY(0, 0, 0))  # -> Box, Box_2; disabled
plane_through_shape_2 = PlaneThroughShape(Plane=plane_surface_2, Shape=surface_from_points_5, Inflate=1, SectionLogic=False)  # disabled
bounding_box_9 = BoundingBox(Content=surface_from_points_5, Plane=PlaneXY(0, 0, 0), UnionBox=True)  # -> Box, Box_2; disabled
quad_sphere_9 = QuadSphere(Base=PlaneXY(0, 0, 0), Radius=1)  # disabled
sphere_11 = Sphere(Base=PlaneXY(0, 0, 0), Radius=1)  # disabled

# ----
# 012_Display
# Preview
# Vector
# Dimensions
make2d = Make2D(TangentEdges=False, TangentSeams=False, AutoComputeMake2D=False)  # -> VisibleCurves, VisibleIndex, VisibleType, HiddenCurves, HiddenIndex, HiddenType; disabled
make2d_parallel_view = Make2DParallelView()  # disabled
make2d_perspective_view = Make2DPerspectiveView()  # disabled
make2d_rhino_view = Make2DRhinoView(Clip=True)  # disabled
text_tag_3d = TextTag3D(Size=1, Justification=7)  # disabled
gradient_hatch = GradientHatch(Colour1=RGB(255, 20, 147), Colour2=RGB(139, 0, 139))  # disabled
pattern_hatch = PatternHatch(Pattern=0, Scale=1, Angle=0)  # disabled
aligned_dimension = AlignedDimension(Plane=PlaneXY(0, 0, 0), Offset=1, Text="{0:0.00}", Size=1)  # disabled
angular_dimension = AngularDimension(Reflex=False, Text="{0:0.0}°", Size=1)  # disabled
arc_dimension = ArcDimension(Offset=2, Text="{0:0.0}°", Size=1)  # disabled
line_dimension = LineDimension(Text="{0:0.00}", Size=1)  # disabled
angular_dimensions_mesh = AngularDimensionsMesh(Text="{0:0.0}°", Size=1, LengthFactor=0.5)  # disabled
text_tag = TextTag()  # disabled
linear_dimension = LinearDimension(Text="{0:0.00}", Size=1)  # disabled
circular_dimension = CircularDimension(Text="{0:0.0}°", Size=1)  # disabled
create_material = CreateMaterial(Diffuse=RGB(255, 105, 180), Specular=RGB(255, 255, 255), Emission=RGB(0, 0, 0), Transparency=0, Shine=0)  # disabled
custom_preview = CustomPreview(Material={diffuse=RGB(221, 160, 221), emission=RGB(66, 48, 66), shine=0.5, specular=RGB(255, 255, 255), transparency=0})  # disabled
vector_display_4 = VectorDisplay()  # disabled
point_list = PointList()  # disabled
point_order = PointOrder()  # disabled
vector_display_ex = VectorDisplayEx(Colour=RGB(0, 0, 0), Width=2)  # disabled

# ----
# 025_surface_subD
# - new to Rhino7, very interesting substitution
# for pipe and variable pipe nodes
number_slider_136 = Slider(10, range=0..10)  # disabled
extent_x = ExtentX(5)  # disabled
square_2 = Square(Plane=PlaneXY(0, 0, 0), Size=number_slider_136, ExtentX=extent_x, ExtentY=extent_x)  # -> simplify(Cells), Points; disabled
panel_20 = Panel("{(1to3)}[(1to3)]")  # disabled
curve_15 = Curve(square_2.Cells)  # disabled
split_tree_3 = SplitTree(Data=curve_15, Masks=flatten(panel_20))  # -> Positive, Negative; disabled
number_slider_137 = Slider(24, range=0..100)  # disabled
panel_21 = Panel("{(2)}[(1)]")  # disabled
clean_tree_5 = CleanTree(RemoveNulls=True, RemoveInvalid=True, RemoveEmpty=False, Tree=split_tree_3.Positive)  # disabled
panel_22 = Panel("2")  # disabled
curve_16 = Curve(clean_tree_5)  # disabled
split_tree_4 = SplitTree(Data=curve_16, Masks=flatten(panel_21))  # -> Positive, Negative; disabled
range_25 = Range(Domain=number_slider_137, Steps=panel_22)  # disabled
clean_tree_6 = CleanTree(RemoveNulls=True, RemoveInvalid=True, RemoveEmpty=False, Tree=split_tree_4.Positive)  # disabled
unit_z_11 = UnitZ(Factor=range_25)  # -> graft(UnitVector); disabled
curve_17 = Curve(clean_tree_6)  # disabled
entwine_2 = Entwine(Branch00=split_tree_3.Negative, Branch01=split_tree_4.Negative, Branch02=curve_17, FlattenInputs=True)  # disabled
move_13 = Move(Geometry=entwine_2, Motion=unit_z_11)  # -> simplify(Geometry), Transform; disabled
brep_edges_4 = BrepEdges(Brep=move_13.Geometry)  # -> Naked, Interior, NonManifold; disabled
boundary_surfaces_6 = BoundarySurfaces(Edges=move_13.Geometry)  # disabled
curve_18 = Curve(brep_edges_4.Naked)  # disabled
number_slider_138 = Slider(2.08, range=0..10)  # disabled
number_slider_139 = Slider(1, range=0..1)  # disabled
number_slider_140 = Slider(1.52, range=0..10)  # disabled
number_slider_141 = Slider(1, range=0..2)  # disabled
number_slider_142 = Slider(1, range=0..1)  # disabled
curve_19 = Curve(curve_18)  # disabled
multipipe_12 = MultiPipe(
    Curves=curve_19,
    NodeSize=number_slider_138,
    EndOffset=number_slider_139,
    StrutSize=number_slider_140,
    Segment=0,
    KinkAngle=0.6,
    CubeFit=number_slider_142,
    Caps=number_slider_141)  # disabled
number_slider_143 = Slider(1, range=0..10)  # disabled
mesh_from_subd_2 = MeshFromSubD(SubD=multipipe_12, Density=2)  # disabled
boolean_toggle_5 = BooleanToggle(False)  # disabled
subd_control_polygon_2 = SubDControlPolygon(SubD=multipipe_12)  # disabled
subd_edges_2 = SubDEdges(SubD=multipipe_12, NewFormatting=False)  # -> Line, Edge, Tag, Id; disabled
area_6 = Area(Geometry=multipipe_12)  # -> Area, Centroid; disabled
subd_from_mesh_2 = SubDFromMesh(Mesh=mesh_from_subd_2, Creases=number_slider_143, Corners=1, Interpolate=boolean_toggle_5)  # disabled
curve_20 = Curve(subd_edges_2.Edge)  # disabled
curve_21 = Curve(subd_edges_2.Line)  # disabled
text_tag_3d_2 = TextTag3D(Location=curve_21, Text=subd_edges_2.Id, Size=1, Justification=7)  # disabled
number_slider_144 = Slider(3, range=0..3)  # disabled
scale_5 = Scale(Geometry=multipipe_12, Center=area_6.Centroid, Factor=0.5)  # -> Geometry, Transform; disabled
subd_fuse_2 = SubDFuse(SubDA=multipipe_12, SubDB=scale_5.Geometry, BooleanOption=number_slider_144, Smoothing=10)  # disabled

# ----
# 009_Mesh
# Tiangulation
# Primitive
# Analysis
# Utilities
mesh_area = MeshArea()  # -> Area, Centroid; disabled
mesh_edges = MeshEdges()  # -> NakedEdges, InteriorEdges, NonManifoldEdges; disabled
mesh_convertquads = MeshConvertQuads(ShortDiagonal=True)  # -> Mesh, Split; disabled
mesh_triangulate = MeshTriangulate(ShortDiagonal=True)  # disabled
mesh_eval = MeshEval()  # -> Point, Normal, Colour; disabled
mesh_closest_point = MeshClosestPoint()  # -> Point, Index, Parameter; disabled
face_normals = FaceNormals()  # -> Centers, Normals; disabled
mesh_nakededge = MeshNakedEdge()  # -> V, A, B; disabled
mesh_volume = MeshVolume()  # -> Volume, Centroid; disabled
face_boundaries = FaceBoundaries()  # disabled
mesh_explode = MeshExplode(Interpolate=False)  # disabled
deconstruct_mesh_2 = DeconstructMesh()  # -> Vertices, Faces, Colours, Normals; disabled
deconstruct_face = DeconstructFace()  # -> CornerA, CornerB, CornerC, CornerD; disabled
mesh_inclusion = MeshInclusion(Strict=False)  # disabled
mesh_quad = MeshQuad(CornerA=0, CornerB=1, CornerC=2, CornerD=3)  # disabled
mesh_plane_3 = MeshPlane(Boundary={Plane=PlaneXY(0, 0, 0), Size=Domain2(u=-10..10, v=-10..10)}, WidthCount=10, HeightCount=10)  # -> Mesh, Area; disabled
mesh_sphere_2 = MeshSphere(Base=PlaneXY(0, 0, 0), Radius=10, UCount=10, VCount=20)  # disabled
mesh_box_2 = MeshBox(Base={Plane=PlaneXY(0, 0, 0), X=Domain(-10, 10), Y=Domain(-10, 10), Z=Domain(-10, 10)}, XCount=10, YCount=10, ZCount=10)  # disabled
construct_mesh = ConstructMesh(Vertices=[Point(0, 0, 0), Point(10, 0, 0), Point(10, 10, 0), Point(0, 10, 0)], Faces={A=0, B=1, C=2, D=3})  # disabled
mesh_sphere_ex = MeshSphereEx(Base=PlaneXY(0, 0, 0), Radius=10, Count=5)  # disabled
mesh_triangle = MeshTriangle(CornerA=0, CornerB=1, CornerC=2)  # disabled
mesh_colours = MeshColours(Colours=[RGB(127, 255, 0), RGB(0, 100, 0), RGB(34, 139, 34), RGB(124, 252, 0), RGB(154, 205, 50), RGB(173, 255, 47), RGB(50, 205, 50), RGB(152, 251, 152)])  # disabled
mesh_spray = MeshSpray(SprayMode=11)  # disabled
metaball = MetaBall(Plane=PlaneXY(0, 0, 0))  # disabled
voronoi = Voronoi(BruteForceOverride=False)  # disabled
delaunay_edges = DelaunayEdges(Plane=PlaneXY(0, 0, 0))  # -> Connectivity, Edges; disabled
delaunay_mesh = DelaunayMesh(Plane=PlaneXY(0, 0, 0))  # disabled
octree = OcTree(Square=False, Group=5)  # -> Boxes, Points; disabled
metaball_t = MetaBallT(Plane=PlaneXY(0, 0, 0), Threshold=0.5)  # disabled
voronoi_3d = Voronoi3D()  # -> Cells, Boundary; disabled
metaball_t_custom = MetaBallTCustom(Plane=PlaneXY(0, 0, 0), Threshold=0.5)  # disabled
convex_hull = ConvexHull(Plane=PlaneXY(0, 0, 0))  # -> Hull, HullZ, Indices; disabled
delete_faces = DeleteFaces()  # disabled
mesh_surface = MeshSurface(UCount=5, VCount=5, Overhang=True, Equalize=False)  # disabled
cull_faces = CullFaces()  # disabled
mesh_brep = MeshBrep(Settings={GridMaxCount=0, GridMinCount=16, JaggedSeams=False, MaxEdgeLength=0, MinEdgeLength=0.0001, MinTolerance=0, Refine=True, RefineAngle=0, RelativeTolerance=0.65, SimplePlanes=True, Tolerance=0})  # disabled
unweld_mesh = UnweldMesh(Angle=1.570796327)  # disabled
mesh_shadow = MeshShadow(Light=Vector(0, 0, -1), Plane=PlaneXY(0, 0, 0))  # disabled
mesh_join = MeshJoin()  # disabled
delete_vertices = DeleteVertices(Shrink=True)  # disabled
cull_vertices = CullVertices(Shrink=True)  # disabled
weld_mesh = WeldMesh(Angle=3.141592654)  # disabled
mesh_weldvertices = MeshWeldVertices(Tolerance=0.01)  # -> RuntimeMessage, Mesh; disabled
flip_mesh = FlipMesh(VertexNormals=True, FaceNormals=True, FaceOrientation=True)  # disabled
mesh_frompoints_2 = MeshFromPoints()  # disabled
occlusion_2 = Occlusion()  # -> Hits, Occlusion; disabled
simple_mesh = SimpleMesh()  # disabled
mesh_unifynormals = MeshUnifyNormals()  # disabled
quadrangulate = Quadrangulate(Angle=0.03490658504, Ratio=0.875)  # -> Mesh, Count; disabled
triangulate = Triangulate()  # -> Mesh, Count; disabled
mesh_flip = MeshFlip()  # disabled

# ----
# EXERCISES_MESH
# 026_mesh_analysis
# - download mesh edit plugin for these scripts (Mesh credit: Daniel Christev)
number_slider_145 = Slider(40, range=0..100)  # disabled
number_slider_146 = Slider(100, range=0..100)  # disabled
number_slider_147 = Slider(4, range=0..5)  # disabled
range_26 = Range(Domain=number_slider_145, Steps=number_slider_146)  # disabled
sine_5 = Sine(Value=range_26)  # disabled
multiplication_11 = Multiplication(A=sine_5, B=number_slider_147)  # disabled
number_slider_148 = Slider(1.679, range=0..5)  # disabled
construct_point_21 = ConstructPoint(XCoordinate=graft(range_26), YCoordinate=range_26, ZCoordinate=multiplication_11)  # disabled
surface_from_points_6 = SurfaceFromPoints(Points=flatten(construct_point_21), UCount=expr("x+1", number_slider_146), Interpolate=False)  # disabled
surface_8 = Surface(surface_from_points_6)  # disabled
area_7 = Area(Geometry=surface_8)  # -> Area, Centroid; disabled
dimensions_3 = Dimensions(Surface=surface_8)  # -> UDimension, VDimension; disabled
number_slider_149 = Slider(8, range=0..100)  # disabled
division_9 = Division(A=dimensions_3.UDimension, B=dimensions_3.VDimension)  # disabled
scale_6 = Scale(Geometry=surface_8, Center=area_7.Centroid, Factor=number_slider_148)  # -> Geometry, Transform; disabled
md_slider_11 = MDSlider(
    SliderMode=0,
    slider_value=Point(0.4951607309, 0.2414119069, 0.5),
    x_domain=Domain(0, 1),
    y_domain=Domain(0, 1),
    z_domain=Domain(0, 1))  # disabled
multiplication_12 = Multiplication(A=division_9, B=number_slider_149)  # disabled
integer_3 = Integer(multiplication_12)  # disabled
md_slider_12 = MDSlider(
    SliderMode=0,
    slider_value=Point(0.7276408516, 0.09028392548, 0.5),
    x_domain=Domain(0, 1),
    y_domain=Domain(0, 1),
    z_domain=Domain(0, 1))  # disabled
divide_surface_5 = DivideSurface(Surface=surface_8, UCount=integer_3, VCount=number_slider_149)  # -> flatten(Points), Normals, Parameters; disabled
number_slider_150 = Slider(0.243, range=0..2)  # disabled
md_slider_13 = MDSlider(
    SliderMode=0,
    slider_value=Point(0.1948275682, 0.7902063509, 0.5),
    x_domain=Domain(0, 1),
    y_domain=Domain(0, 1),
    z_domain=Domain(0, 1))  # disabled
evaluate_surface_9 = EvaluateSurface(Surface=reparameterize(scale_6.Geometry), Point=[md_slider_13, md_slider_11, md_slider_12])  # -> Point, Normal, UDirection, VDirection, Frame; disabled
distance_6 = Distance(PointA=graft(evaluate_surface_9.Point), PointB=divide_surface_5.Points)  # disabled
point_7 = Point(divide_surface_5.Points)  # disabled
expression_9 = Expression(w=flatten(number_slider_150), t=distance_6, Expression="sin(2*w^2*t)")  # disabled
flip_matrix_4 = FlipMatrix(Data=expression_9)  # disabled
number_slider_151 = Slider(7.333, range=0..10)  # disabled
ma_3 = MassMultiplication(Input=flip_matrix_4)  # -> flatten(Result), PartialResults; disabled
multiplication_13 = Multiplication(A=number_slider_151, B=ma_3.Result)  # disabled
unit_z_12 = UnitZ(Factor=multiplication_13)  # disabled
move_14 = Move(Geometry=divide_surface_5.Points, Motion=unit_z_12)  # -> Geometry, Transform; disabled
expression_10 = Expression(u=integer_3, Expression="u+1")  # disabled
colour_swatch_2 = ColourSwatch(SwatchColor=RGB(236, 45, 255))  # disabled
mesh_frompoints_3 = MeshFromPoints(
    Points=move_14.Geometry,
    UDirection=expr("x+1", integer_3),
    VDirection=expr("x+1", number_slider_149),
    Colour=colour_swatch_2)  # disabled
surface_from_points_7 = SurfaceFromPoints(Points=move_14.Geometry, UCount=expression_10, Interpolate=False)  # disabled

# ----
# - CTRL-M toggles mesh edges on and off
# - bake and repain mesh in rhino
number_slider_152 = Slider(44, range=0..100)  # disabled
boolean_toggle_6 = BooleanToggle(False)  # disabled
mesh_6 = Mesh(surface_from_points_7)  # disabled
bounding_box_10 = BoundingBox(Content=mesh_6, Plane=PlaneXY(0, 0, 0))  # -> Box, Box_2; disabled
populate_2d_2 = Populate2D(Region=bounding_box_10.Box, Count=number_slider_152, Seed=1)  # disabled
mesh_7 = Mesh(mesh_frompoints_3)  # disabled
number_slider_153 = Slider(12, range=0..100)  # disabled
face_normals_2 = FaceNormals(Mesh=mesh_6)  # -> Centers, Normals; disabled
mesh_convertquads_2 = MeshConvertQuads(Mesh=mesh_6, ShortDiagonal=boolean_toggle_6)  # -> Mesh, Split; disabled
mesh_edges_2 = MeshEdges(Mesh=mesh_6)  # -> NakedEdges, InteriorEdges, NonManifoldEdges; disabled
mesh_triangulate_2 = MeshTriangulate(Mesh=mesh_6, ShortDiagonal=boolean_toggle_6)  # disabled
mesh_area_2 = MeshArea(Mesh=mesh_6)  # -> Area, Centroid; disabled
mesh_closest_point_2 = MeshClosestPoint(Point=populate_2d_2, Mesh=mesh_6)  # -> Point, Index, Parameter; disabled
bounding_box_11 = BoundingBox(Content=mesh_7, Plane=PlaneXY(0, 0, 0))  # -> Box, Box_2; disabled
mesh_addattributes = MeshAddAttributes(Mesh=mesh_6, Clear=False)  # -> RuntimeMessage, Mesh; disabled
data_recorder = DataRecorder(mesh_closest_point_2.Parameter, DataLimit=-10, RecordData=True)  # disabled
mesh_box_3 = MeshBox(Base=bounding_box_11.Box, XCount=10, YCount=10, ZCount=10)  # disabled
amplitude_5 = Amplitude(Vector=face_normals_2.Normals, Amplitude=number_slider_153)  # disabled
point_8 = Point(mesh_area_2.Centroid)  # disabled
sphere_12 = Sphere(Base=face_normals_2.Centers, Radius=1)  # disabled
line_9 = Line(StartPoint=populate_2d_2, EndPoint=mesh_closest_point_2.Point)  # disabled
mesh_8 = Mesh(mesh_convertquads_2.Mesh)  # disabled
mesh_9 = Mesh(mesh_triangulate_2)  # disabled
line_10 = Line(mesh_edges_2.NakedEdges)  # disabled
line_11 = Line(mesh_edges_2.InteriorEdges)  # disabled
line_12 = Line(mesh_edges_2.NonManifoldEdges)  # disabled
mesh_eval_2 = MeshEval(Mesh=mesh_6, Parameter=data_recorder)  # -> Point, Normal, Colour; disabled
panel_23 = Panel(mesh_addattributes.RuntimeMessage)  # disabled
panel_24 = Panel(mesh_convertquads_2.Split)  # disabled
mesh_10 = Mesh(mesh_addattributes.Mesh)  # disabled
galapagos = Galapagos(fitness=mesh_area_2)
mesh_split_3 = MeshSplit(Mesh=mesh_box_3, Splitters=mesh_7)  # disabled
panel_25 = Panel(mesh_closest_point_2.Parameter)  # disabled
vector_display_5 = VectorDisplay(Anchor=face_normals_2.Centers, Vector=amplitude_5)  # disabled
mesh_nakededge_2 = MeshNakedEdge(Mesh=mesh_6)  # -> V, A, B; disabled
point_9 = Point(mesh_eval_2.Point)  # disabled
dispatch_3 = Dispatch(List=mesh_split_3, DispatchPattern=[True, False])  # -> ListA, ListB; disabled
vector_display_6 = VectorDisplay(Anchor=mesh_eval_2.Normal)  # disabled
panel_26 = Panel(mesh_nakededge_2.A)  # disabled
point_10 = Point(mesh_nakededge_2.V)  # disabled
panel_27 = Panel(mesh_nakededge_2.B)  # disabled
mesh_11 = Mesh(dispatch_3.ListA)  # disabled
mesh_12 = Mesh(mesh_7)  # disabled
mesh_join_2 = MeshJoin(Meshes=flatten([mesh_11, mesh_12]))  # disabled
boolean_toggle_7 = BooleanToggle(True)  # disabled
mesh_13 = Mesh(surface_from_points_7)  # disabled
construct_point_22 = ConstructPoint(XCoordinate=0, YCoordinate=0, ZCoordinate=0)  # disabled
mesh_sphere_3 = MeshSphere(Base=PlaneXY(0, 0, 0), Radius=10, UCount=10, VCount=20)  # disabled
deconstruct_mesh_3 = DeconstructMesh(Mesh=mesh_13)  # -> Vertices, Faces, Colours, Normals; disabled
mesh_explode_2 = MeshExplode(Mesh=mesh_13, Interpolate=boolean_toggle_7)  # disabled
mesh_inclusion_2 = MeshInclusion(Mesh=mesh_sphere_3, Point=construct_point_22, Strict=False)  # disabled
deconstruct_face_2 = DeconstructFace(Face=deconstruct_mesh_3.Faces)  # -> CornerA, CornerB, CornerC, CornerD; disabled
face_boundaries_2 = FaceBoundaries(Mesh=mesh_explode_2)  # disabled
panel_29 = Panel(mesh_inclusion_2)  # disabled
panel_30 = Panel(deconstruct_face_2.CornerA)  # disabled
curve_22 = Curve(face_boundaries_2)  # disabled
panel_31 = Panel(deconstruct_face_2.CornerB)  # disabled
panel_32 = Panel(deconstruct_face_2.CornerC)  # disabled
panel_33 = Panel(deconstruct_face_2.CornerD)  # disabled

triangulate_2 = Triangulate(Mesh=mesh_join_2)  # -> Mesh, Count; disabled
quadrangulate_2 = Quadrangulate(Mesh=mesh_join_2, Angle=0.03490658504, Ratio=0.875)  # -> Mesh, Count; disabled

# ----
# 027_mesh_primitive
mesh_plane_4 = MeshPlane(Boundary={Plane=PlaneXY(0, 0, 0), Size=Domain2(u=-10..10, v=-10..10)}, WidthCount=10, HeightCount=10)  # -> Mesh, Area; disabled
mesh_box_4 = MeshBox(Base={Plane=PlaneXY(0, 0, 0), X=Domain(-10, 10), Y=Domain(-10, 10), Z=Domain(-10, 10)}, XCount=10, YCount=10, ZCount=10)  # disabled
mesh_sphere_4 = MeshSphere(Base=PlaneXY(0, 0, 0), Radius=10, UCount=10, VCount=20)  # disabled
mesh_sphere_ex_2 = MeshSphereEx(Base=PlaneXY(0, 0, 0), Radius=10, Count=5)  # disabled
deconstruct_mesh_4 = DeconstructMesh(Mesh=mesh_box_4)  # -> Vertices, Faces, Colours, Normals; disabled
colour_swatch_3 = ColourSwatch(SwatchColor=RGB(231, 255, 255))  # disabled
construct_mesh_2 = ConstructMesh(Vertices=deconstruct_mesh_4.Vertices, Faces=deconstruct_mesh_4.Faces, Colours=colour_swatch_3)  # disabled
deconstruct_face_3 = DeconstructFace(Face=deconstruct_mesh_4.Faces)  # -> CornerA, CornerB, CornerC, CornerD; disabled
mesh_triangle_2 = MeshTriangle(CornerA=deconstruct_face_3.CornerA, CornerB=deconstruct_face_3.CornerB, CornerC=deconstruct_face_3.CornerC)  # disabled
mesh_quad_2 = MeshQuad(
    CornerA=deconstruct_face_3.CornerA,
    CornerB=deconstruct_face_3.CornerB,
    CornerC=deconstruct_face_3.CornerC,
    CornerD=deconstruct_face_3.CornerD)  # disabled
colour_swatch_4 = ColourSwatch(SwatchColor=RGB(223, 122, 255))  # disabled
construct_mesh_3 = ConstructMesh(Vertices=deconstruct_mesh_4.Vertices, Faces=mesh_triangle_2, Colours=colour_swatch_4)  # disabled
colour_swatch_5 = ColourSwatch(SwatchColor=RGB(255, 0, 0))  # disabled
colour_swatch_6 = ColourSwatch(SwatchColor=RGB(0, 255, 255))  # disabled
colour_swatch_7 = ColourSwatch(SwatchColor=RGB(223, 122, 255))  # disabled
colour_swatch_8 = ColourSwatch(SwatchColor=RGB(255, 255, 0))  # disabled
point_11 = Point([<point referenced from the Rhino model> x4])  # disabled
colours = Colours([RGB(127, 255, 0), RGB(0, 100, 0), RGB(34, 139, 34), RGB(124, 252, 0), RGB(154, 205, 50), RGB(173, 255, 47), RGB(50, 205, 50), RGB(152, 251, 152)])  # disabled
mesh_spray_2 = MeshSpray(
    Mesh=construct_mesh_3,
    Points=point_11,
    Colours=[colour_swatch_6, colour_swatch_7, colour_swatch_8, colour_swatch_5],
    SprayMode=11)  # disabled
mesh_colours_2 = MeshColours(Mesh=construct_mesh_3, Colours=colours)  # disabled
panel_34 = Panel(colours)  # disabled

# ----
# 028_mesh_triangulation
# - mesh from points
# - intro to voronoi, metaball, octree, etc...
# - see section 3 for plugin details like
# weaverbird and coccoon
number_slider_154 = Slider(26, range=0..100)  # disabled
number_slider_155 = Slider(71, range=0..100)  # disabled
number_slider_156 = Slider(12, range=0..100)  # disabled
number_slider_157 = Slider(71, range=0..100)  # disabled
number_slider_158 = Slider(71, range=0..100)  # disabled
number_slider_159 = Slider(26, range=0..100)  # disabled
number_slider_160 = Slider(71, range=0..100)  # disabled
number_slider_161 = Slider(26, range=0..100)  # disabled
number_slider_162 = Slider(71, range=0..100)  # disabled
number_slider_163 = Slider(26, range=0..100)  # disabled
number_slider_164 = Slider(26, range=0..100)  # disabled
number_slider_165 = Slider(71, range=0..100)  # disabled
number_slider_166 = Slider(26, range=0..100)  # disabled
center_box_5 = CenterBox(Base=PlaneXY(0, 0, 0), X=number_slider_154, Y=number_slider_154, Z=number_slider_154)  # disabled
center_box_6 = CenterBox(Base=PlaneXY(0, 0, 0), X=number_slider_163, Y=number_slider_163, Z=number_slider_163)  # disabled
center_box_7 = CenterBox(Base=PlaneXY(0, 0, 0), X=number_slider_164, Y=number_slider_164, Z=number_slider_164)  # disabled
center_box_8 = CenterBox(Base=PlaneXY(0, 0, 0), X=number_slider_159, Y=number_slider_159, Z=number_slider_159)  # disabled
center_box_9 = CenterBox(Base=PlaneXY(0, 0, 0), X=number_slider_161, Y=number_slider_161, Z=number_slider_161)  # disabled
center_box_10 = CenterBox(Base=PlaneXY(0, 0, 0), X=number_slider_166, Y=number_slider_166, Z=number_slider_166)  # disabled
populate_3d_2 = Populate3D(Region=center_box_5, Count=number_slider_155, Seed=number_slider_156)  # disabled
populate_3d_3 = Populate3D(Region=center_box_6, Count=number_slider_157, Seed=number_slider_156)  # disabled
populate_3d_4 = Populate3D(Region=center_box_7, Count=number_slider_158, Seed=number_slider_156)  # disabled
populate_3d_5 = Populate3D(Region=center_box_8, Count=number_slider_160, Seed=number_slider_156)  # disabled
populate_3d_6 = Populate3D(Region=center_box_9, Count=number_slider_165, Seed=number_slider_156)  # disabled
populate_3d_7 = Populate3D(Region=center_box_10, Count=number_slider_162, Seed=number_slider_156)  # disabled
deconstruct = Deconstruct(Point=populate_3d_5)  # -> XComponent, YComponent, ZComponent; disabled
number_slider_167 = Slider(0.344, range=0..1)  # disabled
absolute = Absolute(Value=deconstruct.XComponent)  # disabled
number_slider_168 = Slider(7, range=0..10)  # disabled
number_slider_169 = Slider(0.11, range=0..1)  # disabled
boolean_toggle_8 = BooleanToggle(False)  # disabled
multiplication_14 = Multiplication(A=number_slider_167, B=absolute)  # disabled
construct_point_23 = ConstructPoint(XCoordinate=0, YCoordinate=0, ZCoordinate=0)  # disabled
xy_plane_3 = XYPlane(Origin=Point(0, 0, 0))  # disabled
delaunay_edges_2 = DelaunayEdges(Points=populate_3d_2, Plane=PlaneXY(0, 0, 0))  # -> Connectivity, Edges; disabled
delaunay_edges_3 = DelaunayEdges(Points=populate_3d_3, Plane=PlaneXY(0, 0, 0))  # -> Connectivity, Edges; disabled
metaball_t_2 = MetaBallT(Points=populate_3d_5, Plane=PlaneXY(0, 0, 0), Threshold=number_slider_169)  # disabled
voronoi_3d_2 = Voronoi3D(Points=populate_3d_4)  # -> Cells, Boundary; disabled
voronoi_2 = Voronoi(Points=populate_3d_4, Plane=xy_plane_3, BruteForceOverride=False)  # disabled
metaball_t_custom_2 = MetaBallTCustom(Points=populate_3d_5, Charge=multiplication_14, Plane=PlaneXY(0, 0, 0), Threshold=0.5)  # disabled
octree_2 = OcTree(Points=populate_3d_6, Square=boolean_toggle_8, Group=number_slider_168)  # -> Boxes, Points; disabled
convex_hull_2 = ConvexHull(Points=populate_3d_7, Plane=PlaneXY(0, 0, 0))  # -> Hull, HullZ, Indices; disabled
metaball_2 = MetaBall(Points=populate_3d_5, Plane=PlaneXY(0, 0, 0), Point=construct_point_23)  # disabled
delaunay_mesh_2 = DelaunayMesh(Points=populate_3d_2, Plane=PlaneXY(0, 0, 0))  # disabled
delaunay_mesh_3 = DelaunayMesh(Points=populate_3d_3, Plane=PlaneXY(0, 0, 0))  # disabled
curve_23 = Curve(convex_hull_2.Hull)  # disabled
curve_24 = Curve(convex_hull_2.HullZ)  # disabled

# ----
# 029_mesh_utilities
number_slider_170 = Slider(40, range=0..100)  # disabled
number_slider_171 = Slider(100, range=0..100)  # disabled
number_slider_172 = Slider(4, range=0..5)  # disabled
range_27 = Range(Domain=number_slider_170, Steps=number_slider_171)  # disabled
sine_6 = Sine(Value=range_27)  # disabled
multiplication_15 = Multiplication(A=sine_6, B=number_slider_172)  # disabled
number_slider_173 = Slider(1.679, range=0..5)  # disabled
construct_point_24 = ConstructPoint(XCoordinate=graft(range_27), YCoordinate=range_27, ZCoordinate=multiplication_15)  # disabled
surface_from_points_8 = SurfaceFromPoints(Points=flatten(construct_point_24), UCount=expr("x+1", number_slider_171), Interpolate=False)  # disabled
surface_9 = Surface(surface_from_points_8)  # disabled
area_8 = Area(Geometry=surface_9)  # -> Area, Centroid; disabled
dimensions_4 = Dimensions(Surface=surface_9)  # -> UDimension, VDimension; disabled
number_slider_174 = Slider(8, range=0..100)  # disabled
division_10 = Division(A=dimensions_4.UDimension, B=dimensions_4.VDimension)  # disabled
scale_7 = Scale(Geometry=surface_9, Center=area_8.Centroid, Factor=number_slider_173)  # -> Geometry, Transform; disabled
md_slider_14 = MDSlider(
    SliderMode=0,
    slider_value=Point(0.4951607309, 0.2414119069, 0.5),
    x_domain=Domain(0, 1),
    y_domain=Domain(0, 1),
    z_domain=Domain(0, 1))  # disabled
multiplication_16 = Multiplication(A=division_10, B=number_slider_174)  # disabled
integer_4 = Integer(multiplication_16)  # disabled
md_slider_15 = MDSlider(
    SliderMode=0,
    slider_value=Point(0.7276408516, 0.09028392548, 0.5),
    x_domain=Domain(0, 1),
    y_domain=Domain(0, 1),
    z_domain=Domain(0, 1))  # disabled
divide_surface_6 = DivideSurface(Surface=surface_9, UCount=integer_4, VCount=number_slider_174)  # -> flatten(Points), Normals, Parameters; disabled
number_slider_175 = Slider(0.243, range=0..2)  # disabled
md_slider_16 = MDSlider(
    SliderMode=0,
    slider_value=Point(0.1948275682, 0.7902063509, 0.5),
    x_domain=Domain(0, 1),
    y_domain=Domain(0, 1),
    z_domain=Domain(0, 1))  # disabled
evaluate_surface_10 = EvaluateSurface(Surface=reparameterize(scale_7.Geometry), Point=[md_slider_16, md_slider_14, md_slider_15])  # -> Point, Normal, UDirection, VDirection, Frame; disabled
distance_7 = Distance(PointA=graft(evaluate_surface_10.Point), PointB=divide_surface_6.Points)  # disabled
point_12 = Point(divide_surface_6.Points)  # disabled
expression_11 = Expression(w=flatten(number_slider_175), t=distance_7, Expression="sin(2*w^2*t)")  # disabled
flip_matrix_5 = FlipMatrix(Data=expression_11)  # disabled
number_slider_176 = Slider(7.333, range=0..10)  # disabled
ma_4 = MassMultiplication(Input=flip_matrix_5)  # -> flatten(Result), PartialResults; disabled
multiplication_17 = Multiplication(A=number_slider_176, B=ma_4.Result)  # disabled
unit_z_13 = UnitZ(Factor=multiplication_17)  # disabled
move_15 = Move(Geometry=divide_surface_6.Points, Motion=unit_z_13)  # -> Geometry, Transform; disabled
expression_12 = Expression(u=integer_4, Expression="u+1")  # disabled
colour_swatch_9 = ColourSwatch(SwatchColor=RGB(236, 45, 255))  # disabled
mesh_frompoints_4 = MeshFromPoints(
    Points=move_15.Geometry,
    UDirection=expr("x+1", integer_4),
    VDirection=expr("x+1", number_slider_174),
    Colour=colour_swatch_9)  # disabled
surface_from_points_9 = SurfaceFromPoints(Points=move_15.Geometry, UCount=expression_12, Interpolate=False)  # disabled

# ----
# - brep to mesh
brep = Brep(surface_from_points_9)  # disabled
brep_2 = Brep(surface_from_points_9)  # disabled
number_slider_177 = Slider(4, range=0..100)  # disabled
boolean_toggle_9 = BooleanToggle(True)  # disabled
boolean_toggle_10 = BooleanToggle(True)  # disabled
boolean_toggle_11 = BooleanToggle(True)  # disabled
mesh_brep_2 = MeshBrep(
    Brep=brep,
    Settings={GridMaxCount=0, GridMinCount=16, JaggedSeams=False, MaxEdgeLength=0, MinEdgeLength=0.0001, MinTolerance=0, Refine=True, RefineAngle=0, RelativeTolerance=0.65, SimplePlanes=True, Tolerance=0})  # disabled
simple_mesh_2 = SimpleMesh(Brep=brep)  # disabled
surface_10 = Surface(brep_2)  # disabled
flip_mesh_2 = FlipMesh(Mesh=simple_mesh_2, VertexNormals=boolean_toggle_9, FaceNormals=boolean_toggle_10, FaceOrientation=boolean_toggle_11)  # disabled
mesh_unifynormals_2 = MeshUnifyNormals(Mesh=mesh_brep_2)  # disabled
mesh_surface_2 = MeshSurface(Surface=surface_10, UCount=number_slider_177, VCount=number_slider_177, Overhang=True, Equalize=False)  # disabled
mesh_brep_3 = MeshBrep(
    Brep=brep_2,
    Settings={GridMaxCount=0, GridMinCount=16, JaggedSeams=False, MaxEdgeLength=0, MinEdgeLength=0.0001, MinTolerance=0, Refine=True, RefineAngle=0, RelativeTolerance=0.65, SimplePlanes=True, Tolerance=0})  # disabled
number_slider_178 = Slider(7, range=0..10)  # disabled
triangulate_3 = Triangulate(Mesh=mesh_unifynormals_2)  # -> Mesh, Count; disabled
quadrangulate_3 = Quadrangulate(Mesh=mesh_unifynormals_2, Angle=0.03490658504, Ratio=0.875)  # -> Mesh, Count; disabled
deconstruct_mesh_5 = DeconstructMesh(Mesh=mesh_brep_3)  # -> Vertices, Faces, Colours, Normals; disabled
mesh_flip_2 = MeshFlip(Mesh=flip_mesh_2)  # disabled
mesh_weldvertices_2 = MeshWeldVertices(Mesh=[mesh_unifynormals_2, mesh_flip_2], Tolerance=0.01)  # -> RuntimeMessage, Mesh; disabled
list_length_4 = ListLength(List=deconstruct_mesh_5.Vertices)  # disabled
number_slider_179 = Slider(513, range=0..1000)  # disabled
list_length_5 = ListLength(List=deconstruct_mesh_5.Faces)  # disabled
division_11 = Division(A=list_length_4, B=number_slider_178)  # disabled
panel_35 = Panel(mesh_weldvertices_2.RuntimeMessage)  # disabled
range_28 = Range(Domain=list_length_5, Steps=number_slider_179)  # disabled
series_2 = Series(Start=0, Step=number_slider_178, Count=division_11)  # disabled
panel_36 = Panel("""0
11
0""")  # disabled
cull_vertices_2 = CullVertices(Mesh=mesh_brep_3, Pattern=panel_36, Shrink=True)  # disabled
cull_faces_2 = CullFaces(Mesh=mesh_brep_3, Pattern=panel_36)  # disabled
delete_faces_2 = DeleteFaces(Mesh=mesh_brep_3, Indices=range_28)  # disabled
delete_vertices_2 = DeleteVertices(Mesh=mesh_brep_3, Indices=series_2, Shrink=True)  # disabled
mesh_join_3 = MeshJoin(Meshes=[delete_faces_2, delete_vertices_2])  # disabled
panel_37 = Panel(mesh_join_3)  # disabled
weld_mesh_2 = WeldMesh(Mesh=mesh_join_3, Angle=3.141592654)  # disabled
panel_38 = Panel(weld_mesh_2)  # disabled
unweld_mesh_2 = UnweldMesh(Mesh=weld_mesh_2, Angle=1.570796327)  # disabled
panel_39 = Panel(unweld_mesh_2)  # disabled

# ----
# - I have seen this used once in generative design series:
# great video series (5 videos)
# Intermediate to advanced levels
occlusion_3 = Occlusion()  # -> Hits, Occlusion; disabled

# ----
# - parametric mesh shadow
number_slider_180 = Slider(0.09, range=0..1)  # disabled
number_slider_181 = Slider(1, range=0..1)  # disabled
number_slider_182 = Slider(0.49, range=0..1)  # disabled
bounding_box_12 = BoundingBox(Content=delete_vertices_2, Plane=PlaneXY(0, 0, 0))  # -> Box, Box_2; disabled
number_slider_183 = Slider(4, range=0..10)  # disabled
negative_3 = Negative(Value=number_slider_181)  # disabled
deconstruct_brep_14 = DeconstructBrep(Brep=bounding_box_12.Box)  # -> Faces, Edges, Vertices; disabled
vector_xyz_4 = VectorXYZ(XComponent=number_slider_182, YComponent=number_slider_180, ZComponent=negative_3)  # -> Vector, Length; disabled
list_item_13 = ListItem(List=deconstruct_brep_14.Faces, Index=number_slider_183, Wrap=True)  # disabled
number_slider_184 = Slider(0, range=0..100)  # disabled
mesh_shadow_2 = MeshShadow(Mesh=weld_mesh_2, Light=vector_xyz_4.Vector, Plane=list_item_13)  # disabled
panel_40 = Panel("0")  # disabled
cull_index_6 = CullIndex(List=mesh_shadow_2, Indices=panel_40, Wrap=True)  # disabled
list_item_14 = ListItem(List=mesh_shadow_2, Index=number_slider_184, Wrap=True)  # disabled
boundary_surfaces_7 = BoundarySurfaces(Edges=cull_index_6)  # disabled
split_brep_multiple_5 = SplitBrepMultiple(Brep=list_item_14, Cutters=boundary_surfaces_7)  # disabled
list_item_15 = ListItem(List=split_brep_multiple_5, Index=0, Wrap=True)  # -> Item1, Item; disabled

# ----
# 017_curves_analysis
# - create curve(s) in grasshopper
# - use some of your pervious learned skills
# to manipulate and create new geometries
panel_41 = Panel("{(1,3,...)}[(1to4)]")  # disabled
square_3 = Square(Plane=PlaneXY(0, 0, 0), Size=1, ExtentX=5, ExtentY=5)  # -> Cells, simplify(Points); disabled
split_tree_5 = SplitTree(Data=square_3.Points, Masks=flatten(panel_41))  # -> Positive, Negative; disabled
panel_42 = Panel("3")  # disabled
unit_z_14 = UnitZ(Factor=panel_42)  # disabled
point_13 = Point(split_tree_5.Negative)  # disabled
negative_4 = Negative(Value=unit_z_14)  # disabled
move_16 = Move(Geometry=split_tree_5.Positive, Motion=[unit_z_14, negative_4])  # -> Geometry, Transform; disabled
interpolate_10 = Interpolate(Vertices=[split_tree_5.Negative, move_16.Geometry], Degree=3, Periodic=False, KnotStyle=1)  # -> Curve, Length, Domain; disabled
panel_43 = Panel("{(0,2,4)}[]")  # disabled
split_tree_6 = SplitTree(Data=interpolate_10.Curve, Masks=flatten(panel_43))  # -> Positive, Negative; disabled
curve_25 = Curve(split_tree_6.Negative)  # disabled
curve_26 = Curve(split_tree_6.Positive)  # disabled
curve_middle_5 = CurveMiddle(Curve=curve_26)  # disabled
point_on_curve_4 = PointOnCurve(curve_26, parameter=1)  # disabled
end_points_5 = EndPoints(Curve=curve_25)  # -> Start, End; disabled
end_points_6 = EndPoints(Curve=curve_26)  # -> Start, End; disabled
match_tree = MatchTree(Tree=end_points_6.End, Guide=end_points_5.Start)  # disabled
number_slider_185 = Slider(1, range=0..1)  # disabled
number_slider_186 = Slider(0, range=0..1)  # disabled
number_slider_187 = Slider(1, range=0..1)  # disabled
number_slider_188 = Slider(0.3, range=0..1)  # disabled

merge_5 = Merge(Data1=end_points_5.End, Data2=end_points_6.End, Data3=end_points_5.Start)  # disabled

interpolate_11 = Interpolate(Vertices=flatten(merge_5), Degree=3, Periodic=False, KnotStyle=1)  # -> Curve, Length, Domain; disabled
perp_frame_2 = PerpFrame(Curve=reparameterize(interpolate_11.Curve), Parameter=number_slider_186)  # disabled
perp_frame_3 = PerpFrame(Curve=reparameterize(interpolate_11.Curve), Parameter=number_slider_185)  # disabled
horizontal_frame_2 = HorizontalFrame(Curve=reparameterize(interpolate_11.Curve), Parameter=number_slider_185)  # disabled
ellipse_2 = Ellipse(Plane=perp_frame_2, Radius1=1, Radius2=number_slider_187)  # -> Ellipse, Focus1, Focus2; disabled
ellipse_3 = Ellipse(Plane=perp_frame_3, Radius1=1, Radius2=number_slider_188)  # -> Ellipse, Focus1, Focus2; disabled
sweep1_3 = Sweep1(Rail=interpolate_11.Curve, Sections=[ellipse_3.Ellipse, ellipse_2.Ellipse], Miter=1)  # disabled
cap_holes_4 = CapHoles(Brep=sweep1_3)  # disabled
