# Grasshopper definition EX_001_params_geometry.gh (Grasshopper 1.0.7)

# ----
# EXERCISES_PARAMS
# 001_params_geometry
# - generate objects in the rhino environment
# - set single and multiple objects into gh containers
# - activate the geometry pipeline
# - preview
# - enable
# - set geometries and objects
# - internalize
# - extract
point = Point([Point(-212.0233546, 129.2445055, 0), Point(-460.4173601, 379.7514354, 0), Point(79.71081982, 684.7458992, 0), Point(220.2031691, 270.4239343, 384.5471859), Point(247.593769, 95.66776915, 0), Point(142.0265494, -121.7780891, 0), Point(-17.36455418, -277.2568135, 0), Point(-113.3905978, -42.68223788, 0), Point(0.4195369917, -32.03512575, 0), Point(62.54524857, 56.17488496, 0)])
vector = Vector([Vector(-158.8498605, -143.9166498, 0), Vector(-263.547251, 375.8804476, 0), Vector(145.0623379, 383.66393, 0), Vector(251.1789041, -85.67584833, 0), Vector(121.0696902, -261.1946943, 0)])
plane = Plane([Plane(origin=(-181.2731096, -13.59640046, 0), x=(0.1895655332, 0.9818680709, 0), y=(0.9818680709, -0.1895655332, 0)), Plane(origin=(81.12608898, 232.4752641, 0), x=(-0.8677077412, 0.4970747186, 0), y=(-0.2093058975, -0.365370317, 0.9070256737)), Plane(origin=(48.79198648, -205.2636944, 0), x=(-0.01175412047, 0.9999309179, 0), y=(-0.07623963845, -0.0008961918058, 0.9970891206)), Plane(origin=(260.0789505, -13.1009538, 0), x=(-0.9851576172, -0.1716521755, 0), y=(-0.1716521755, 0.9851576172, 0))])
brep = Brep([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])
mesh = Mesh([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])
curve = Curve([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])
line = Line([Line((-159.3014496, 20.18501427, 0), (-68.43933479, 279.6876401, 0)), Line((161.5112541, 86.67592415, 0), (-52.13452583, 432.1882586, 0)), Line((39.34156795, -125.7438887, 0), (205.5980202, -23.31520868, 0)), Line((-21.60115855, 63.85721629, 0), (58.84321312, 146.4748432, 0)), Line((47.49090523, 40.96731092, 0), (-38.82932045, 204.3150125, 0))])
surface = Surface([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])
geometry = Geometry([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])
vector_display = VectorDisplay(Anchor=point)
geometry_2 = Geometry([point, vector, curve, line, plane, brep, mesh, surface])
geometry_pipeline = GeometryPipeline(
    GroupByLayer=False,
    GroupByType=False,
    IncludeHidden=True,
    IncludeLocked=True,
    LayerFilter="*",
    NameFilter="*",
    SublayerFiltering=True,
    TypeFilter=1073741848)
geometry_3 = Geometry(geometry_pipeline)
