# Grasshopper definition EX_002_params_input.gh (Grasshopper 1.0.7)
# plug-ins: MeshEdit Components

# ----
# 002_params_inputs
# - edit/edit snapping/animate on number slider
# - shortcuts to setting sliders
# - input/output features of panel tool
# - multiline data/wire display in panel node
# - shortcuts for setting panel data
# - toggle boolean and consider output
# - lt double click MD slider and set domains
# - apply to surface evaluation
# - reparametize surface
#  - reset MD slider settings
# - construct point and consider x and y values
# - set values list
# - play with display options
# - careful on strings
# - lt click and set color swatch
# - lt double click graph mapper and
# consider domain settings
# - set graph types
# - set graph mapper domain to match your domain
# - generate points and curves
number_slider = Slider(45, range=0..100)
md_slider = MDSlider(
    SliderMode=0,
    slider_value=Point(0.5861794076, 0.556872112, 0.5),
    x_domain=Domain(0, 1),
    y_domain=Domain(0, 1),
    z_domain=Domain(0, 1))
# EXERCISES_PARAMS
number_slider_2 = Slider(0.298, range=0..1)
sphere = Sphere(Base=PlaneXY(0, 0, 0), Radius=number_slider)
quad_sphere = QuadSphere(Base=PlaneXY(0, 0, 0), Radius=number_slider)
value_list = ValueList({"One": 1, "Two": 2, "Three": 2² - 12, "Four": Sqrt(100), "Five": "red", "Six": "blue"}, selected="Six")
colour_swatch = ColourSwatch(SwatchColor=RGB(0, 255, 255))
construct_domain = ConstructDomain(DomainStart=Slider(15, range=0..100), DomainEnd=Slider(100, range=0..100))
panel = Panel(Toggle(False))
range = Range(Domain=construct_domain, Steps=Slider(11, range=0..100))
panel_2 = Panel(value_list)
evaluate_surface = EvaluateSurface(Surface=reparameterize(sphere), Point=md_slider)  # -> Point, Normal, UDirection, VDirection, Frame
construct_point = ConstructPoint(XCoordinate=Slider(0.29, range=0..1), YCoordinate=Slider(0.35, range=0..1), ZCoordinate=0)
deconstruct_brep = DeconstructBrep(Brep=quad_sphere)  # -> Faces, Edges, Vertices
graph_mapper = GraphMapper(
    range,
    x0=0,
    x1=100,
    y0=0,
    y1=100,
    Ox=0.5592483282,
    Oy=0.104008317,
    Px=0.8252333403,
    Py=0.4654753208,
    container_name="Parabola")
evaluate_surface_2 = EvaluateSurface(Surface=reparameterize(deconstruct_brep.Faces), Point=construct_point)  # -> Point, Normal, UDirection, VDirection, Frame
construct_point_2 = ConstructPoint(XCoordinate=range, YCoordinate=graph_mapper, ZCoordinate=0)
interpolate = Interpolate(Vertices=construct_point_2, Degree=3, Periodic=False, KnotStyle=1)  # -> Curve, Length, Domain

# ----
# - lt double click image sampler
# - consider tyhe domains
# - set image
# - set to black and white
# - interpolate
# 
# tutorial online:
# https://www.youtube.com/watch?v=HZzj-d68zCI
# 
# - bring image into grasshopper
# with imgage import and path
# - create bounding box
# - walk through script
# - turn on mesh lines in display
# 
# Consider a circle on every point
# - note interpolate option reduces noise
# - consider displacements
# - custom previews
# - attractor points
# - assign rotations to other geometries
# - into manufacturing...etc.
file_path = FilePath("C:\Users\Sculpture\Documents\2020_Grasshopper\ghfiles2019\January2019\GrassHooperRhino\Image Sampler\10933805_828435007199774_4643817663222164453_n.jpg")  # disabled
number_slider_3 = Slider(12, range=0..100)  # disabled
number_slider_4 = Slider(12, range=0..100)  # disabled
import_image = ImportImage(File=file_path)  # disabled
import_image_2 = ImportImage(File=file_path)  # disabled
import_image_3 = ImportImage(File=file_path)  # disabled
bounding_box = BoundingBox(Content=import_image, Plane=PlaneXY(0, 0, 0))  # -> Box, Box_2; disabled
bounding_box_2 = BoundingBox(Content=import_image_2, Plane=PlaneXY(0, 0, 0))  # -> Box, Box_2; disabled
bounding_box_3 = BoundingBox(Content=import_image_3, Plane=PlaneXY(0, 0, 0))  # -> Box, Box_2; disabled
deconstruct_brep_2 = DeconstructBrep(Brep=bounding_box.Box)  # -> Faces, Edges, Vertices; disabled
deconstruct_brep_3 = DeconstructBrep(Brep=bounding_box_2.Box)  # -> Faces, Edges, Vertices; disabled
deconstruct_brep_4 = DeconstructBrep(Brep=bounding_box_3.Box)  # -> Faces, Edges, Vertices; disabled
number_slider_5 = Slider(100, range=0..100)  # disabled
dimensions = Dimensions(Surface=deconstruct_brep_2.Faces)  # -> UDimension, VDimension; disabled
number_slider_6 = Slider(200, range=0..200)  # disabled
number_slider_7 = Slider(200, range=0..200)  # disabled
dimensions_2 = Dimensions(Surface=deconstruct_brep_3.Faces)  # -> UDimension, VDimension; disabled
dimensions_3 = Dimensions(Surface=deconstruct_brep_4.Faces)  # -> UDimension, VDimension; disabled
division = Division(A=dimensions.UDimension, B=dimensions.VDimension)  # disabled
division_2 = Division(A=dimensions_2.UDimension, B=dimensions_2.VDimension)  # disabled
division_3 = Division(A=dimensions_3.UDimension, B=dimensions_3.VDimension)  # disabled
multiplication = Multiplication(A=division, B=number_slider_5)  # disabled
multiplication_2 = Multiplication(A=division_2, B=number_slider_7)  # disabled
multiplication_3 = Multiplication(A=division_3, B=number_slider_6)  # disabled
number_slider_8 = Slider(1, range=0..1)  # disabled
number_slider_9 = Slider(1, range=0..1)  # disabled
number_slider_10 = Slider(1, range=0..1)  # disabled
integer = Integer(multiplication)  # disabled
integer_2 = Integer(multiplication_3)  # disabled
integer_3 = Integer(multiplication_2)  # disabled
one_over_x = OneOverX(Value=integer)  # disabled
one_over_x_2 = OneOverX(Value=integer)  # disabled
one_over_x_3 = OneOverX(Value=integer_3)  # disabled
one_over_x_4 = OneOverX(Value=integer_3)  # disabled
one_over_x_5 = OneOverX(Value=integer_2)  # disabled
one_over_x_6 = OneOverX(Value=integer_2)  # disabled
rectangular = Rectangular(Plane=PlaneXY(0, 0, 0), SizeX=one_over_x, SizeY=one_over_x_2, ExtentX=integer, ExtentY=number_slider_5)  # -> Cells, Points; disabled
rectangular_2 = Rectangular(Plane=PlaneXY(0, 0, 0), SizeX=one_over_x_4, SizeY=one_over_x_3, ExtentX=integer_3, ExtentY=number_slider_7)  # -> Cells, Points; disabled
rectangular_3 = Rectangular(Plane=PlaneXY(0, 0, 0), SizeX=one_over_x_6, SizeY=one_over_x_5, ExtentX=integer_2, ExtentY=number_slider_6)  # -> Cells, Points; disabled
deconstruct = Deconstruct(Point=rectangular.Points)  # -> XComponent, YComponent, ZComponent; disabled
deconstruct_2 = Deconstruct(Point=rectangular_2.Points)  # -> XComponent, YComponent, ZComponent; disabled
deconstruct_3 = Deconstruct(Point=rectangular_3.Points)  # -> XComponent, YComponent, ZComponent; disabled
rectangular_4 = Rectangular(Plane=PlaneXY(0, 0, 0), SizeX=number_slider_8, SizeY=number_slider_8, ExtentX=integer, ExtentY=number_slider_5)  # -> Cells, Points; disabled
rectangular_5 = Rectangular(Plane=PlaneXY(0, 0, 0), SizeX=number_slider_10, SizeY=number_slider_10, ExtentX=integer_3, ExtentY=number_slider_7)  # -> Cells, Points; disabled
rectangular_6 = Rectangular(Plane=PlaneXY(0, 0, 0), SizeX=number_slider_9, SizeY=number_slider_9, ExtentX=integer_2, ExtentY=number_slider_6)  # -> Cells, Points; disabled
number_slider_11 = Slider(0.47, range=0..1)  # disabled
number_slider_12 = Slider(0.15, range=0..1)  # disabled
image_sampler = ImageSampler(rectangular.Points, Filter="Value", Interpolate=True, Umax=1, Umin=0, Vmax=1, Vmin=0, Wrap=1)  # disabled
image_sampler_2 = ImageSampler(rectangular_3.Points, Filter="Value", Interpolate=True, Umax=1, Umin=0, Vmax=1, Vmin=0, Wrap=1)  # disabled
image_sampler_3 = ImageSampler(rectangular_2.Points, Filter="Value", Interpolate=True, Umax=1, Umin=0, Vmax=1, Vmin=0, Wrap=1)  # disabled
bounds = Bounds(Numbers=flatten(deconstruct.XComponent))  # disabled
bounds_2 = Bounds(Numbers=flatten(deconstruct_2.XComponent))  # disabled
bounds_3 = Bounds(Numbers=flatten(deconstruct_3.XComponent))  # disabled
panel_3 = Panel("12")  # disabled
number_slider_13 = Slider(0.752, range=0.01..2)  # disabled
panel_4 = Panel(".5")  # disabled
multiplication_4 = Multiplication(A=image_sampler, B=panel_3)  # disabled
panel_5 = Panel(image_sampler)  # disabled
panel_6 = Panel(bounds)  # disabled
panel_7 = Panel(image_sampler_2)  # disabled
panel_8 = Panel(image_sampler_3)  # disabled
panel_9 = Panel(bounds_2)  # disabled
panel_10 = Panel(bounds_3)  # disabled
expression = Expression(x=image_sampler_3, y=number_slider_11, Expression="if(x>y,True,False)")  # disabled
unit_z = UnitZ(Factor=multiplication_4)  # disabled
multiplication_5 = Multiplication(A=image_sampler_2, B=number_slider_13)  # disabled
move = Move(Geometry=rectangular_4.Points, Motion=unit_z)  # -> Geometry, Transform; disabled
cull_pattern = CullPattern(List=rectangular_5.Points, CullPattern=expression)  # disabled
cull_pattern_2 = CullPattern(List=image_sampler_3, CullPattern=expression)  # disabled
circle = Circle(Plane=rectangular_6.Points, Radius=multiplication_5)  # disabled
panel_11 = Panel(".5")  # disabled
multiplication_6 = Multiplication(A=panel_11, B=cull_pattern_2)  # disabled
surface_from_points = SurfaceFromPoints(Points=flatten(move.Geometry), UCount=expr("x+1", integer), Interpolate=False)  # disabled
circle_2 = Circle(Plane=cull_pattern, Radius=multiplication_6)  # disabled

mesh_frompoints = MeshFromPoints(Points=flatten(move.Geometry), UDirection=expr("x+1", integer), VDirection=expr("x+1", number_slider_5))  # disabled
