# Grasshopper definition EX_004_maths_domains.gh (Grasshopper 1.0.7)
# plug-ins: Kangaroo2 Components

# ----
# remap/bounds/new domain
number_slider = Slider(82, range=0..100)  # disabled
number_slider_2 = Slider(12, range=0..100)  # disabled
construct_domain = ConstructDomain(DomainStart=number_slider_2, DomainEnd=number_slider)  # disabled
range = Range(Domain=construct_domain, Steps=10)  # disabled
unit_z = UnitZ(Factor=range)  # disabled
construct_point = ConstructPoint(XCoordinate=0, YCoordinate=0, ZCoordinate=0)  # disabled
move = Move(Geometry=construct_point, Motion=unit_z)  # -> Geometry, Transform; disabled
distance = Distance(PointA=construct_point, PointB=move.Geometry)  # disabled
number_slider_3 = Slider(0, range=0..1)  # disabled
number_slider_4 = Slider(0.5, range=0..1)  # disabled
panel = Panel(distance)  # disabled
construct_domain_2 = ConstructDomain(DomainStart=number_slider_3, DomainEnd=number_slider_4)  # disabled
bounds = Bounds(Numbers=distance)  # disabled
remap_numbers = RemapNumbers(Value=distance, Source=bounds, Target=construct_domain_2)  # -> Mapped, Clipped; disabled
remap = Remap(data=distance, min=number_slider_3, max=number_slider_4)  # disabled
panel_2 = Panel(remap_numbers.Mapped)  # disabled
panel_3 = Panel(remap)  # disabled

# ----
# EXERCISES_MATHS
# remap+ cluster plugin
remap_2 = Remap(min=0, max=1)  # disabled

# ----
# -divide domain 2 and isotrim
number_slider_5 = Slider(42, range=0..100)
panel_4 = Panel("8")
populate_2d = Populate2D(Region={Plane=PlaneXY(0, 0, 0), Size=Domain2(u=0..20, v=0..10)}, Count=Slider(7, range=2..12), Seed=number_slider_5)
number_slider_6 = Slider(6, range=0..10)
bounds_2d = Bounds2D(Coordinates=populate_2d)
surface = Surface(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)
quad_sphere = QuadSphere(Base=PlaneXY(0, 0, 0), Radius=1)
divide_domain² = DivideDomain²(Domain=surface, UCount=number_slider_6, VCount=number_slider_6)
deconstruct_brep = DeconstructBrep(Brep=quad_sphere)  # -> Faces, Edges, Vertices
deconstruct_domain² = DeconstructDomain²(Domain=bounds_2d)  # -> UComponent, VComponent
deconstruct_domain²_2 = DeconstructDomain²(Domain=bounds_2d)  # -> UMin, UMax, VMin, VMax
list_item = ListItem(List=deconstruct_brep.Faces, Index=0, Wrap=True)  # -> Item, Item1, Item2, Item3, Item4, Item5
panel_5 = Panel(divide_domain²)
isotrim = Isotrim(Surface=surface, Domain=divide_domain²)
construct_domain² = ConstructDomain²(
    UMin=deconstruct_domain²_2.UMin,
    UMax=deconstruct_domain²_2.VMax,
    VMin=deconstruct_domain²_2.VMin,
    VMax=deconstruct_domain²_2.UMax)
isotrim_2 = Isotrim(Surface=reparameterize(list_item.Item1), Domain=bounds_2d)
isotrim_3 = Isotrim(Surface=reparameterize(list_item.Item3), Domain=construct_domain²)
deconstruct_brep_2 = DeconstructBrep(Brep=isotrim_2)  # -> Faces, Edges, Vertices
deconstruct_brep_3 = DeconstructBrep(Brep=isotrim_3)  # -> Faces, Edges, Vertices
line = Line(StartPoint=deconstruct_brep_2.Vertices, EndPoint=deconstruct_brep_3.Vertices)
merge = Merge(Data1=deconstruct_brep_2.Edges, Data2=deconstruct_brep_3.Edges, Data3=line)  # -> flatten(Result)
multipipe = MultiPipe(Curves=merge, NodeSize=Slider(0.11, range=0..1), EndOffset=1, StrutSize=1, Segment=0, KinkAngle=0.6, CubeFit=0, Caps=0)
bounding_box = BoundingBox(Content=multipipe, Plane=PlaneXY(0, 0, 0))  # -> Box, Box_2
volume = Volume(Geometry=bounding_box.Box)  # -> Volume, Centroid
galapagos = Galapagos(fitness=volume, gene=number_slider_5)

# ----
# 004_maths_domain
# - domain
number_slider_7 = Slider(8.35, range=0..10)  # disabled
number_slider_8 = Slider(3.6, range=0..10)  # disabled
number_slider_9 = Slider(3, range=0..10)  # disabled
construct_domain_3 = ConstructDomain(DomainStart=number_slider_8, DomainEnd=number_slider_7)  # disabled
panel_6 = Panel(construct_domain_3)  # disabled
divide_domain = DivideDomain(Domain=construct_domain_3, Count=number_slider_9)  # disabled
deconstruct_domain = DeconstructDomain(Domain=panel_6)  # -> Start, End; disabled
deconstruct_domain_2 = DeconstructDomain(Domain=divide_domain)  # -> Start, End; disabled
panel_7 = Panel([deconstruct_domain.Start, deconstruct_domain.End])  # disabled
panel_8 = Panel(deconstruct_domain_2.Start)  # disabled
panel_9 = Panel(deconstruct_domain_2.End)  # disabled

surface_2 = Surface(list_item.Item3)

# ==== cluster Remap: Remaps numbers
data = ClusterInput()
min = ClusterInput()
max = ClusterInput()
bnd = Bounds(Numbers=data)
dom = ConstructDomain(DomainStart=min, DomainEnd=max)
remap = RemapNumbers(Value=data, Source=bnd, Target=dom)  # -> Mapped, Clipped
R = ClusterOutput(remap.Mapped)
