# Grasshopper definition EX_005_maths_operators.gh (Grasshopper 1.0.7)

# ----
# EXERCISES_MATHS
# 005_maths_operators
# - operators
number_slider = Slider(3, range=0..4)
number_slider_2 = Slider(26, range=0..100)
range = Range(Domain=number_slider_2, Steps=Slider(3, range=0..10))
range_2 = Range(Domain=number_slider_2, Steps=number_slider)
panel = Panel(range)
negative = Negative(Value=Slider(9, range=0..10))
panel_2 = Panel(range_2)
power = Power(A=Slider(2, range=0..10), B=Slider(3, range=0..10))
factorial = Factorial(Number=Slider(5, range=0..5))
multiplication = Multiplication(A=negative, B=power)
number_slider_3 = Slider(6, range=0..10)
larger_than = LargerThan(FirstNumber=range, SecondNumber=range_2)  # -> LargerThan, OrEqualTo
smaller_than = SmallerThan(FirstNumber=range, SecondNumber=range_2)  # -> SmallerThan, OrEqualTo
equality = Equality(FirstNumber=range, SecondNumber=range_2)  # -> Equality, Inequality
subtraction = Subtraction(A=multiplication, B=power)
addition = Addition(A=multiplication, B=power)
data_recorder = DataRecorder(factorial, DataLimit=-10, RecordData=True)
larger_than_2 = LargerThan(FirstNumber=range, SecondNumber=range_2)  # -> LargerThan, OrEqualTo
smaller_than_2 = SmallerThan(FirstNumber=range, SecondNumber=range_2)  # -> SmallerThan, OrEqualTo
equality_2 = Equality(FirstNumber=range, SecondNumber=range_2)  # -> Equality, Inequality
panel_3 = Panel(equality.Inequality)
panel_4 = Panel(smaller_than.OrEqualTo)
panel_5 = Panel(larger_than.OrEqualTo)
division = Division(A=subtraction, B=number_slider_3)
integer_division = IntegerDivision(A=subtraction, B=number_slider_3)
mass_addition = MassAddition(Input=data_recorder)  # -> Result, PartialResults
mass_multiplication = MassMultiplication(Input=data_recorder)  # -> Result, PartialResults
absolute = Absolute(Value=division)
absolute_2 = Absolute(Value=subtraction)
panel_6 = Panel(integer_division)
modulus = Modulus(A=absolute_2, B=Slider(9, range=0..10))
panel_7 = Panel(mass_addition.Result)
panel_8 = Panel(mass_multiplication.Result)
gate_and = GateAnd(A=panel_5, B=panel_3)
gate_or = GateOr(A=panel_5, B=panel_3)
gate_majority = GateMajority(A=panel_5, B=panel_3, C=panel_4)
gate_not = GateNot(A=panel_5)
gate_nor = GateNor(A=panel_5, B=panel_3)
gate_xor = GateXor(A=panel_5, B=panel_3)
gate_nand = GateNand(A=panel_5, B=panel_3)
gate_xnor = GateXnor(A=panel_5, B=panel_3)
panel_9 = Panel(modulus)
panel_10 = Panel(mass_addition.PartialResults)
panel_11 = Panel(mass_multiplication.PartialResults)
panel_12 = Panel(gate_and)
panel_13 = Panel(gate_or)
panel_14 = Panel(gate_majority)
panel_15 = Panel(gate_not)
panel_16 = Panel(gate_nor)
panel_17 = Panel(gate_xor)
panel_18 = Panel(gate_nand)
panel_19 = Panel(gate_xnor)
cull_pattern = CullPattern(List=range, CullPattern=smaller_than_2.OrEqualTo)
cull_pattern_2 = CullPattern(List=range, CullPattern=equality_2.Equality)
cull_pattern_3 = CullPattern(List=range, CullPattern=smaller_than_2.SmallerThan)
cull_pattern_4 = CullPattern(List=range, CullPattern=smaller_than_2.OrEqualTo)
cull_pattern_5 = CullPattern(List=range, CullPattern=larger_than_2.OrEqualTo)
cull_pattern_6 = CullPattern(List=range_2, CullPattern=larger_than_2.OrEqualTo)
cull_pattern_7 = CullPattern(List=range_2, CullPattern=equality_2.Equality)
cull_pattern_8 = CullPattern(List=range_2, CullPattern=equality_2.Inequality)
cull_pattern_9 = CullPattern(List=range_2, CullPattern=smaller_than_2.SmallerThan)
cull_pattern_10 = CullPattern(List=range_2, CullPattern=smaller_than_2.OrEqualTo)
panel_20 = Panel(cull_pattern)
