# Grasshopper definition EX_006_maths_polynomials.gh (Grasshopper 1.0.7)
# Copyright: © 2017-2018 Pierre Cuvilliers, Caitlin Mueller, Massachusetts Institute of Technology
# plug-ins: The-Dominion

# ----
# EXERCISES_MATHS
# 006_maths_polynomials/script/trig/utilities
# - consider using expression node rather than function node
# - reset variables to x and y
# - play with operators polynomials to explore
# domains and complex number sets
# - graph some 2D geometry in top view
number_slider = Slider(-4, range=-4..4)
construct_domain = ConstructDomain(DomainStart=number_slider, DomainEnd=Slider(3.557, range=-4..4))
number_slider_2 = Slider(2, range=0..10)
number_slider_3 = Slider(10, range=0..10)
range = Range(Domain=construct_domain, Steps=Slider(100, range=0..100))
expression = Expression(x=range, A=number_slider_2, B=number_slider_3, Expression="(Sqrt(A *(x^2) - B))")
expression_2 = Expression(x=range, A=number_slider_2, B=number_slider_3, Expression="A *(x^2) - B")
evaluate = Evaluate()
square_root = SquareRoot(Value=expression_2)
construct_point = ConstructPoint(XCoordinate=range, YCoordinate=square_root, ZCoordinate=0)
panel = Panel(expression_2)
polyline = PolyLine(Vertices=construct_point, Closed=False)
panel_2 = Panel(expression)
panel_3 = Panel(square_root)

# ----
# Trigonometry leads to some of the most
# beautiful curves and tangent lines
number_slider_4 = Slider(-10, range=-10..10)
construct_domain_2 = ConstructDomain(DomainStart=number_slider_4, DomainEnd=Slider(10, range=-10..10))
range_2 = Range(Domain=construct_domain_2, Steps=Slider(100, range=0..100))
sine = Sine(Value=range_2)
cosine = Cosine(Value=range_2)
multiplication = Multiplication(A=sine, B=Slider(7.34, range=0..10))
multiplication_2 = Multiplication(A=Slider(10, range=0..10), B=cosine)
construct_point_2 = ConstructPoint(XCoordinate=multiplication, YCoordinate=multiplication_2, ZCoordinate=range_2)
interpolate = Interpolate(Vertices=construct_point_2, Degree=Slider(3, range=1..3), Periodic=False, KnotStyle=1)  # -> Curve, Length, Domain
radians = Radians(Degrees=Slider(0, range=0..360))
degrees = Degrees(Radians=Slider(0, range=0..2))
pi = Pi(Factor=Slider(0, range=0..2))
golden_ratio = GoldenRatio(Factor=Slider(3, range=0..10))
construct_point_3 = ConstructPoint(XCoordinate=0, YCoordinate=0, ZCoordinate=0)
unit_x = UnitX(Factor=1)
rotate_3d = Rotate3D(Geometry=interpolate.Curve, Angle=degrees(degrees), Center=construct_point_3, Axis=unit_x)  # -> Geometry, Transform
rotate_3d_2 = Rotate3D(Geometry=interpolate.Curve, Angle=pi, Center=construct_point_3, Axis=unit_x)  # -> Geometry, Transform
rotate_3d_3 = Rotate3D(Geometry=interpolate.Curve, Angle=radians, Center=construct_point_3, Axis=unit_x)  # -> Geometry, Transform

# ----
# - programming in the ghpython and C#
# node will lead to scripting in visual studio/code
# or even machine learning beyond the Lunchbox
# plugin nodes
# - all python libraries can be brought into
# grasshopper through the use of the ghpython
# remote plugin
# - see examples:
# ghpython
# C#
# - this all leads to creating your own plugins
number_slider_5 = Slider(0, range=0..10)
number_slider_6 = Slider(10, range=0..10)
construct_point_4 = ConstructPoint(XCoordinate=number_slider_5, YCoordinate=Slider(4.894, range=0..10), ZCoordinate=0)
negative = Negative(Value=number_slider_6)
booleanunion2breps = BooleanUnion2Breps()  # -> out, BooleanedBreps; inputs breps: list of Brep, tol: Double
# ---------- booleanunion2breps: C# usings ----------
using System.IO;
using System.Linq;
using System.Data;
using System.Drawing;
using System.Reflection;
using System.Windows.Forms;
using System.Xml;
using System.Xml.Linq;
using System.Runtime.InteropServices;

using Rhino.DocObjects;
using Rhino.Collections;
using GH_IO;
using GH_IO.Serialization;
# ---------- booleanunion2breps: C# ----------
    //Boolean union the input breps
    Brep[] unionBrep = Brep.CreateBooleanUnion(breps, tol);

    BooleanedBreps = unionBrep;
# ---------- end booleanunion2breps ----------
wsgh_loop = WSGH_loop()  # -> out, a; inputs x: Int32, y: Int32, z: Int32
# ---------- wsgh_loop: Python ----------
__author__ = "Sculpture"
__version__ = "2021.01.18"

import rhinoscriptsyntax as rs

for i in range(x):
    print i
print" "
for i in range(x,y):
    print i
print" "
for i in range(x,y,z):
    print i
# ---------- end wsgh_loop ----------
construct_domain_3 = ConstructDomain(DomainStart=negative, DomainEnd=number_slider_6)
oneliners_lambdas_016 = OneLinersLAMBDAS_016()  # -> out, a
# ---------- oneliners_lambdas_016: Python ----------
__author__ = "Sculpture"
__version__ = "2021.05.27"

import rhinoscriptsyntax as rs

#they are functions without names to be used for single use
#lambda <arguments> : <return expression>

print((lambda x: x + y)(z))
# ---------- end oneliners_lambdas_016 ----------
constructorcreatearc = ConstructorCreateArc()  # -> out, OutArc; inputs p0: Point3d, p1: Point3d, p2: Point3d
# ---------- constructorcreatearc: C# ----------
    //Create an instance of an Arc
    Arc arc = new Arc(p0, p1, p2);

    //check if arc is valid
    if (arc.IsValid) {
      //Assign arc to output
      OutArc = arc;
    }
# ---------- end constructorcreatearc ----------
constructparabola = ConstructParabola(A=Slider(0.99, range=0..10), Domain=construct_domain_3)
constructhyperbola = ConstructHyperbola(
    Plane=construct_point_4,
    A=Slider(2.48, range=0..10),
    B=Slider(2.1, range=0..10),
    H=Slider(4.85, range=0..10),
    Flip=False)
extract2ddrawingmake2d = Extract2DDrawingMake2D()  # -> out, VCurves, HCurves, VCut, HCut; inputs geomList: list of GeometryBase, cplaneList: list of Plane
# ---------- extract2ddrawingmake2d: C# ----------
    //Use the active view in the Rhino document
    var _view = doc.Views.ActiveView;
    //Set Make2D Parameters
    var _hldParams = new HiddenLineDrawingParameters
      {
        AbsoluteTolerance = doc.ModelAbsoluteTolerance,
        IncludeTangentEdges = false,
        IncludeHiddenCurves = true
        };
    _hldParams.SetViewport(_view.ActiveViewport);

    //add objects to hld_param
    foreach (var geom in geomList){
      _hldParams.AddGeometry(geom, Transform.Identity, null);
    }

    //Add clipping planes
    foreach (var cplane in cplaneList ){
      _hldParams.AddClippingPlane(cplane);
    }

    //perform HLD calculation
    var  visibleList = new List<Curve>();
    var  hiddenList = new List<Curve>();
    var  secVisibleList = new List<Curve>();
    var  secHiddenList = new List<Curve>();
    var _hld = HiddenLineDrawing.Compute(_hldParams, true);
    if (_hld != null)
    {
      //transform
      var flatten = Transform.PlanarProjection(Plane.WorldXY);
      BoundingBox pageBox = _hld.BoundingBox(true);
      var delta2D = new Vector2d(0, 0);
      delta2D = delta2D - new Vector2d(pageBox.Min.X, pageBox.Min.Y);
      var delta3D = Transform.Translation(new Vector3d(delta2D.X, delta2D.Y, 0.0));
      flatten = delta3D * flatten;
      //add curves to lists
      foreach (HiddenLineDrawingSegment hldCurve in _hld.Segments)
      {
        if (hldCurve == null ||
          hldCurve.ParentCurve == null ||
          hldCurve.ParentCurve.SilhouetteType == SilhouetteType.None)
          continue;
        var crv = hldCurve.CurveGeometry.DuplicateCurve();
        if (crv != null)
        {
          crv.Transform(flatten);
          if (hldCurve.SegmentVisibility == HiddenLineDrawingSegment.Visibility.Visible)
          {
            if (hldCurve.ParentCurve.SilhouetteType == SilhouetteType.SectionCut)
              secVisibleList.Add(crv);
            else
              visibleList.Add(crv);
          }
          else if (hldCurve.SegmentVisibility == HiddenLineDrawingSegment.Visibility.Hidden)
          {
            if (hldCurve.ParentCurve.SilhouetteType == SilhouetteType.SectionCut)
              secHiddenList.Add(crv);
            else
              hiddenList.Add(crv);
          }
        }
      }
    }

    VCurves = visibleList;
    HCurves = hiddenList;
    VCut = secVisibleList;
    HCut = secHiddenList;
# ---------- end extract2ddrawingmake2d ----------
oneliners_listcomprehension_001 = OneLiners_listcomprehension_001()  # -> out, a
# ---------- oneliners_listcomprehension_001: Python ----------
__author__ = "Sculpture"
__version__ = "2021.05.27"

import rhinoscriptsyntax as rs

#list comprehension

personsOfInterest = {"Batman": 75, 
                    "Joker": 95, 
                    "Penguin": 34,
                    "Cat Woman": 58, 
                    "the Riddler": 100}
                    
favorites = [] #create a list ot output to
for key, val in personsOfInterest.items():
    if val >= 75:
        favorites.append((key,val))

print(favorites)
a = favorites

# now let's look at List comprehension
#[expression + context]
# example [x * 2 for x in range(3) outputs [0, 2, 4]
# ---------- end oneliners_listcomprehension_001 ----------
oneliners_decision_tree_015 = OneLiners_decisionTree_015()  # -> out, a; inputs artA: Int32, artB: Int32, artC: Int32, desA: Int32, desB: Int32, desC: Int32, engA: Int32, engB: Int32, engC: Int32, sample0A: Int32, sample0B: Int32, sample0C: Int32, sample1A: Int32, sample1B: Int32, sample1C: Int32
# ---------- oneliners_decision_tree_015: Python ----------
__author__ = "Sculpture"
__version__ = "2021.05.30"

import rhinoscriptsyntax as rs

#import and do all this JAZZ!
import rhinoscriptsyntax as rs
import scriptcontext as sc
import ghpythonremote

np = sc.sticky['numpy']
scipy = sc.sticky['scipy']
mpl = sc.sticky['matplotlib']
plt = mpl.pyplot
rpy = sc.sticky['rpy']
pandas = sc.sticky['pandas']
skl = sc.sticky['sklearn'] #machine linput5ing models
linm = sc.sticky['sklearn.linear_model']
cluster = sc.sticky['sklearn.cluster']
nb = sc.sticky['sklearn.neighbors']
MLP = sc.sticky['sklearn.neural_network']
TREE = sc.sticky['sklearn.tree']

"""
#data (size / cost)
X = np.array([  [input1[0], input2[0], input3[0], input4[0], input5[0], output6[0]],
                [input1[1], input2[1], input3[1], input4[1], input5[1], output6[1]],
                [input1[2], input2[2], input3[2], input4[2], input5[2], output6[2]],
                [input1[3], input2[3], input3[3], input4[3], input5[3], output6[3]],
                [input1[4], input2[4], input3[4], input4[4], input5[4], output6[4]],
                [input1[5], input2[5], input3[5], input4[5], input5[5], output6[5]],
                [input1[6], input2[6], input3[6], input4[6], input5[6], output6[6]],
                [input1[7], input2[7], input3[7], input4[7], input5[7], output6[7]],
                [input1[8], input2[8], input3[8], input4[8], input5[8], output6[8]],
                [input1[9], input2[9], input3[9], input4[9], input5[9], output6[9]]])

#oneLiner
neural_net = MLP.MLPRegressor(max_iter=10000).fit(X[:,:-1], X[:,-1])

#result
res = neural_net.predict([[sample1,sample2,sample3,sample4,sample5]])
print(res)[0]"""

#data: points in (art, design, engineering) - study field
X = np.array([  [artA, artB, artC, "art"],
                [desA, desB, desC, "design"],
                [engA, engB, engC, "engineering"]])

#oneLiner
Tree = TREE.tree.DecisionTreeClassifier().fit(X[:,:-1], X[:,-1])

#result and puzzle
researcher_0 = Tree.predict([[sample0A, sample0B, sample0C]])
print(researcher_0)[0]

researcher_1 = Tree.predict([[sample1A, sample1B, sample1C]])
print(researcher_1)[0]
# ---------- end oneliners_decision_tree_015 ----------
createmeshfrombrep = CreateMeshFromBrep()  # -> out, OutMesh; inputs brep: Brep
# ---------- createmeshfrombrep: C# ----------
    //Set mesh parameters to default
    MeshingParameters mp = MeshingParameters.Default;

    //Create meshes from brep
    var new_mesh = Mesh.CreateFromBrep(brep, mp);

    //Output
    OutMesh = new_mesh;
# ---------- end createmeshfrombrep ----------
ghpython_script = GhPythonScript()  # -> Out, A
c_script = CSharpScript()  # -> Out, A
vb_script = VBScript()  # -> Out, A
oneliners_calculatingpowerset_005 = OneLiners_calculatingPowerset_005()  # -> out, a
# ---------- oneliners_calculatingpowerset_005: Python ----------
__author__ = "Sculpture"
__version__ = "2021.06.14"

import rhinoscriptsyntax as rs
from functools import reduce

#data
s = {1, 2, 3}

#oneLiner
ps = lambda s: reduce(lambda P, x: P + [subset | {x} for subset in P], s, [set()])

#result
print(ps(s))
# ---------- end oneliners_calculatingpowerset_005 ----------
getoriginpoint = GetOriginPoint()  # -> out, Origin
# ---------- getoriginpoint: C# ----------
    Origin = Point3d.Origin;
# ---------- end getoriginpoint ----------

# ----
# - consider shapening and "smoothing"
# data with the utility nodes
number_slider_7 = Slider(48, range=0..100)
data_recorder = DataRecorder(number_slider_7, DataLimit=-10, RecordData=True)
data_recorder_2 = DataRecorder(number_slider_7, DataLimit=-10, RecordData=True)
data_recorder_3 = DataRecorder(Slider(43.75, range=0..100), DataLimit=-10, RecordData=True)
panel_4 = Panel(data_recorder)
panel_5 = Panel(data_recorder_2)
round = Round(Number=data_recorder_3)  # -> Nearest, Floor, Ceiling
maximum = Maximum(A=panel_4, B=panel_5)
minimum = Minimum(A=panel_4, B=panel_5)
panel_6 = Panel(maximum)
panel_7 = Panel(round.Nearest)
panel_8 = Panel(minimum)
data = Data(data_recorder)
data_2 = Data(data_recorder_2)
data_3 = Data(data_recorder_3)
average = Average(Input=data)
average_2 = Average(Input=data_3)
average_3 = Average(Input=data_2)
panel_9 = Panel([average, average_3, average_2])
number_slider_8 = Slider(0.62, range=0..1)
data_4 = Data(data_recorder)
blur_numbers = BlurNumbers(Numbers=data_4, Strength=number_slider_8, Iterations=1, Lock=True, Wrap=False)
truncate = Truncate(Input=data_4, TruncationFactor=number_slider_8)
smooth_numbers = SmoothNumbers(Numbers=data_4, SmoothDelay=2000)
interpolate_data = InterpolateData(Data=data_4, Parameter=number_slider_8, Interpolation=2)
panel_10 = Panel(blur_numbers)
panel_11 = Panel(interpolate_data)
panel_12 = Panel(smooth_numbers)
panel_13 = Panel(truncate)

expression_3 = Expression(Expression="Format(\"{0}, {1}\", x, y)")

# ----
# Special Plugin
# ghpython remote
gh_python_remote = GHPythonRemote()  # -> out, linked_modules, rpy, import_statements

# ==== cluster GHPythonRemote: Connects the Grasshopper Python component to an external Python instance.
python = PythonScript()  # -> gh_parent_doc_dir
# ---------- python: Python ----------
from os import path

gh_parent_doc_dir = path.abspath(path.dirname(ghenv.Component.OnPingDocument().Owner.OnPingDocument().FilePath))
# ---------- end python ----------
# GH to python remote example.
# Pierre Cuvilliers, 2017-2018
# Released under the MIT license
# github.com/pilcru/ghpythonremote
# Runs and connects to an external python engine, and
# assigns imported modules to scriptcontext.sticky variables.
# 
# Arguments:
#       code (str): Path to the GH_to_python_sticky.py code file.
#       location (str): Path to a python executable, or to a folder
#             containing `python.exe`, or the name of a conda-created
#             virtual environment prefixed by `conda://` (`conda://env_name`).
#             If empty, finds python from your windows %PATH%.
#       run (boolean): Creates the connection, and imports new
#             modules, when turned to True. Kills the connection,
#             and deletes the references to the imports, when turned
#             to False.
#       modules (str list): List of module names to import in the
#             remote python. They will be added to the
#             scriptcontext.sticky dictionary, allowing them to be
#             reused from other python components in the same
#             Grasshopper document. Submodules (for example
#             `numpy.linalg` have to be added explicitly to this list
#             to be available later.
#       log_level (str from ['NOTSET', 'DEBUG', 'INFO', 'WARNING', 'ERROR', 'CRITICAL']):
#             Logging level to use for the local IronPython and the
#             remote python instance.
#       working_dir (str): Working directory for the remote python
#             instance.
# 
# Returns:
#       out (str): Console output with DEBUG information.
#       linked_modules (str list): list of imported module names.
#       rpy (rpyc connection object): The object representing the
#             remote Python interpreter.
location = ClusterInput()  # location (str): Path to a python executable, or to a folder containing `python.exe`, or the name of a conda-created virtual environment prefixed by `conda://` (`conda://env_name`). If empty, finds python from your windows %PATH%.
run = ClusterInput()  # run (boolean): Creates the connection, and imports new modules, when turned to True. Kills the connection,and deletes the references to the imports, when turned to False.
modules = ClusterInput()  # modules (str list): List of module names to import in the remote python. They will be added to the scriptcontext.sticky dictionary, allowing them to be reused from other python components in the same Grasshopper document. Submodules (for example `numpy.linalg` have to be added explicitly to this list to be available later.
list = ValueList({"CRITICAL", "ERROR", "WARNING", "INFO", "DEBUG", "NOTSET"}, selected="DEBUG")
panel = Panel(python)
ghpythonremote = GHPythonRemote(location=location, run=run, modules=modules, log_level=list, working_dir=panel)  # -> out, linked_modules, rpy; inputs run: Boolean, modules: list
# ---------- ghpythonremote: Python ----------
import inspect
import logging
from os import path
import sys
from time import sleep

import scriptcontext

import ghpythonremote
from ghpythonremote.connectors import GrasshopperToPythonRemote

local_log_level = getattr(logging, log_level, logging.WARNING)
logger = logging.getLogger("ghpythonremote")
logger.setLevel(local_log_level)
ch = logging.StreamHandler()
ch.setLevel(local_log_level)
formatter = logging.Formatter("%(levelname)s: %(name)s:\n%(message)s")
ch.setFormatter(formatter)
logger.handlers = []
logger.addHandler(ch)
logger = logging.getLogger("ghpythonremote.GH_to_python")

ROOT = path.abspath(path.dirname(inspect.getfile(ghpythonremote)))
rpyc_server_py = path.join(ROOT, "pythonservice.py")

# Set connection to CLOSED if this is the first run
# and initialize set of linked modules
try:
    remote_python_status
except NameError:
    remote_python_status = "CLOSED"
    lkd_modules = set()

# Wait for connection to connect or terminate
timer = 0
while remote_python_status == "CONNECTING" or remote_python_status == "CLOSING":
    sleep(1)
    timer += 1
    if timer == 10:
        try:
            gh2py_manager.__exit__(*sys.exc_info())
        except Exception:
            pass
        remote_python_status = "CLOSED"
        lkd_modules = set()
        raise RuntimeError(
            "Connection left in an inconsistent state and not returning. Reset "
            "everything."
        )

if run:
    if not remote_python_status == "OPEN":
        remote_python_status = "CONNECTING"
        gh2py_manager = GrasshopperToPythonRemote(
            rpyc_server_py,
            location=location,
            timeout=10,
            port=None,
            log_level=log_level,
            working_dir=working_dir,
        )
        gh2py = gh2py_manager.__enter__()
        remote_python_status = "OPEN"

    # Stuff that we can reach
    rpymod = gh2py.py_remote_modules  # A getter function for a named python module
    rpy = gh2py.connection  # Represents the remote instance root object
    scriptcontext.sticky["rpy"] = rpy
    # Add modules
    for mod in modules:
        try:
            scriptcontext.sticky[mod] = rpymod(mod)
            lkd_modules.add(mod)
        except ImportError:
            gh2py_manager.__exit__(*sys.exc_info())
            raise

elif not remote_python_status == "CLOSED":
    remote_python_status = "CLOSING"
    # Remove linked modules
    for mod in lkd_modules:
        del scriptcontext.sticky[mod]
    del scriptcontext.sticky["rpy"]
    gh2py_manager.__exit__(*sys.exc_info())
    lkd_modules = set()
    remote_python_status = "CLOSED"

# Change variable name because ghpython resets outputs to None before each run
linked_modules = lkd_modules

logger.info("GH to python connection is {}".format(remote_python_status))
# ---------- end ghpythonremote ----------
out = ClusterOutput(ghpythonremote.out)  # Console output.
linked_modules = ClusterOutput(ghpythonremote.linked_modules)  # Names of modules that were successfully added to the scriptcontext.sticky dictionary.
rpy = ClusterOutput(ghpythonremote.rpy)  # The object representing the remote python instance
python_2 = PythonScript(module_names=ghpythonremote.linked_modules)  # -> import_statements; inputs module_names: list
# ---------- python_2: Python ----------
import_statements = ["import scriptcontext as sc"]
for module_name in module_names:
    import_statements.append("{0} = sc.sticky['{0}']".format(module_name))

if len(module_names) == 0:
    import_statements = []
# ---------- end python_2 ----------
import_statements = ClusterOutput(python_2)  # Useful import statements to use the imported modules in your scripts.
