# Grasshopper definition EX_007_sets_lists.gh (Grasshopper 1.0.7)
# plug-ins: Kangaroo2 Components, Fologram For Grasshopper Utilities

# ----
# -pick-and-choose and weave
number_slider = Slider(4.44, range=0..10)
negative = Negative(Value=number_slider)
construct_domain = ConstructDomain(DomainStart=negative, DomainEnd=number_slider)
range = Range(Domain=construct_domain, Steps=Slider(13, range=0..100))
number_slider_2 = Slider(2.11, range=0..10)
sine = Sine(Value=range)
cosine = Cosine(Value=range)
multiplication = Multiplication(A=sine, B=number_slider_2)
multiplication_2 = Multiplication(A=cosine, B=number_slider_2)
construct_point = ConstructPoint(XCoordinate=range, YCoordinate=sine, ZCoordinate=0)
construct_point_2 = ConstructPoint(XCoordinate=range, YCoordinate=multiplication_2, ZCoordinate=0)
gene_pool = GenePool(
    Decimals=0,
    Maximum=1,
    Minimum=0,
    Value=[0.905444046, 0.415763288, 0.8632152173, 0.9259240497, 0.6967985354, 0.9728912525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])
interpolate = Interpolate(Vertices=construct_point, Degree=3, Periodic=False, KnotStyle=1)  # -> Curve, Length, Domain
interpolate_2 = Interpolate(Vertices=construct_point_2, Degree=3, Periodic=False, KnotStyle=1)  # -> Curve, Length, Domain
weave = Weave(Pattern=[0, 1], Stream0=construct_point, Stream1=construct_point_2, NullGaps=False)
pick_n_choose = PickNChoose(Pattern=gene_pool, Stream0=construct_point, Stream1=construct_point_2)
interpolate_3 = Interpolate(Vertices=weave, Degree=3, Periodic=False, KnotStyle=1)  # -> Curve, Length, Domain
interpolate_4 = Interpolate(Vertices=pick_n_choose, Degree=3, Periodic=False, KnotStyle=1)  # -> Curve, Length, Domain

# ----
# -cross reference, longest and sortest lists
number_slider_3 = Slider(10, range=0..10)
number_slider_4 = Slider(3, range=0..10)
negative_2 = Negative(Value=number_slider_3)
negative_3 = Negative(Value=number_slider_4)
construct_domain_2 = ConstructDomain(DomainStart=negative_2, DomainEnd=number_slider_3)
construct_domain_3 = ConstructDomain(DomainStart=negative_3, DomainEnd=number_slider_4)
range_2 = Range(Domain=construct_domain_2, Steps=Slider(4, range=0..10))
range_3 = Range(Domain=construct_domain_3, Steps=Slider(3, range=0..10))
construct_point_3 = ConstructPoint(XCoordinate=graft(range_2), YCoordinate=range_2, ZCoordinate=0)
construct_point_4 = ConstructPoint(XCoordinate=graft(range_3), YCoordinate=range_3, ZCoordinate=Slider(10, range=0..10))
cross_reference = CrossReference(ListListA=construct_point_3, ListListB=construct_point_4, CrossMode=1)  # -> ListListA, ListListB
longest_list = LongestList(ListListA=construct_point_3, ListListB=construct_point_4, PaddingMode=1)  # -> ListListA, ListListB
shortest_list = ShortestList(ListListA=construct_point_3, ListListB=construct_point_4, TrimMode=3)  # -> ListListA, ListListB
point = Point(longest_list.ListListA)
point_2 = Point(shortest_list.ListListA)
point_3 = Point(shortest_list.ListListB)
point_4 = Point(longest_list.ListListB)
point_5 = Point(cross_reference.ListListA)
point_6 = Point(cross_reference.ListListB)
line = Line(StartPoint=point_5, EndPoint=point_6)
line_2 = Line(StartPoint=point_2, EndPoint=point_3)
line_3 = Line(StartPoint=point, EndPoint=point_4)
gene_pool_2 = GenePool(Decimals=0, Maximum=1, Minimum=0, Value=[0.4540602763, 0.5043836301, 0.4745477259, 1])
combine_data = CombineData(Input0=line, Input1=line_2)  # -> Result, Index
dispatch = Dispatch(List=flatten(combine_data.Result), DispatchPattern=gene_pool_2)  # -> ListA, ListB
number_slider_5 = Slider(0.6, range=0..1)
panel = Panel("4")
curve = Curve(dispatch.ListB)
curve_2 = Curve(dispatch.ListA)
multipipe = MultiPipe(Curves=curve_2, NodeSize=number_slider_5, EndOffset=1, StrutSize=1, Segment=0, KinkAngle=0.6, CubeFit=0, Caps=0)
mesh_pipe = MeshPipe(Polylines=curve_2, NumberOfSides=Slider(4, range=3..6), Tolerance=0.1, Radius=number_slider_5, Cap=False, Join=False)
pipe = Pipe(Curve=curve_2, Radius=number_slider_5, Caps=0)

# ----
# 2.
number_slider_6 = Slider(100, range=0..100)

number_slider_7 = Slider(5, range=0..10)

# ----
# - the logic behind list manipulation is essential
# should one want to develop their understanding
# of data trees (lists of lists of lists...)
# with the pathmapper tool in List Tree Nodes
# 
# - generate a list and play with these nodes
number_slider_8 = Slider(0.636, range=0..1)
data_recorder = DataRecorder(number_slider_7, DataLimit=-10, RecordData=True)
number_slider_9 = Slider(3, range=0..10)
panel_2 = Panel(data_recorder)
construct_domain_4 = ConstructDomain(DomainStart="0", DomainEnd=Slider(5, range=0..10))
item_index = ItemIndex(List=data_recorder, Item=number_slider_7)
replace_items = ReplaceItems(List=panel_2, Item=number_slider_7, Indices=number_slider_9, Wrap=False)
partition_list = PartitionList(List=panel_2, Size=number_slider_9)
shift_list = ShiftList(List=replace_items, Shift=Slider(2, range=0..10), Wrap=True)
split_list = SplitList(List=shift_list, Index=Slider(2, range=0..10))  # -> ListA, ListB
sub_list = SubList(List=shift_list, Domain=construct_domain_4, Wrap=True)  # -> List, Index
panel_3 = Panel(item_index)
panel_4 = Panel(split_list.ListB)
panel_5 = Panel(replace_items)
panel_6 = Panel(shift_list)
panel_7 = Panel(split_list.ListA)
panel_8 = Panel(sub_list.List)
insert_items = InsertItems(List=panel_2, Item=panel_3, Indices=panel_3, Wrap=True)
panel_9 = Panel(insert_items)
panel_10 = Panel(partition_list)

# ----
# - list manipulation is essential in grasshopper
# from a simple list to lists of lists of lists of lists...
# - understanding you data is the key to constructing
# controlled, concise, clear and intelligent projects
# 
# 1. reset data recorder
# 2. run animation for 24 frames in number slider
# 3. preview Multipipe
number_slider_10 = Slider(11, range=0..100)
# EXERCISES_SETS
# 007_sets_list
center_box = CenterBox(Base=PlaneXY(0, 0, 0), X=number_slider_10, Y=number_slider_10, Z=number_slider_10)
populate_3d = Populate3D(Region=center_box, Count=Slider(24, range=0..100), Seed=Slider(87, range=0..100))
list_length = ListLength(List=populate_3d)
panel_11 = Panel(list_length)
deconstruct = Deconstruct(Point=populate_3d)  # -> XComponent, YComponent, ZComponent
list_item = ListItem(List=populate_3d, Index=number_slider_6, Wrap=True)
sort_list = SortList(Keys=deconstruct.ZComponent, ValuesValuesA=populate_3d)  # -> Keys, ValuesValuesA
point_7 = Point(list_item)
sort_list_2 = SortList(Keys=deconstruct.YComponent, ValuesValuesA=populate_3d)  # -> Keys, ValuesValuesA
list_item_2 = ListItem(List=sort_list_2.ValuesValuesA, Index=number_slider_6, Wrap=True)
list_item_3 = ListItem(List=sort_list.ValuesValuesA, Index=number_slider_6, Wrap=True)
line_4 = Line(StartPoint=list_item_2, EndPoint=list_item_3)

# ----
# 1.
data_recorder_2 = DataRecorder(line_4, DataLimit=-10, RecordData=True)

clean_tree = CleanTree(RemoveNulls=True, RemoveInvalid=True, RemoveEmpty=False, Tree=data_recorder_2)

# ----
# 3.
multipipe_2 = MultiPipe(Curves=clean_tree, NodeSize=0.5, EndOffset=1, StrutSize=1, Segment=0, KinkAngle=0.6, CubeFit=0, Caps=0)
