# Grasshopper definition EX_009_sets_sequence.gh (Grasshopper 1.0.7)

# ----
# 009_sets_sequence
# - the sequence node is good but nothing beats
# the power of the series and range components
# in grasshopper for generating data
number_slider = Slider(10, range=0..10)  # disabled
# EXERCISES_SETS
number_slider_2 = Slider(0, range=0..10)  # disabled
number_slider_3 = Slider(1, range=0..10)  # disabled
number_slider_4 = Slider(10, range=0..10)  # disabled
number_slider_5 = Slider(4, range=0..10)  # disabled
number_slider_6 = Slider(10, range=0..10)  # disabled
construct_domain = ConstructDomain(DomainStart=number_slider_2, DomainEnd=number_slider)  # disabled
range = Range(Domain=number_slider_5, Steps=10)  # disabled
range_2 = Range(Domain=number_slider_4, Steps=10)  # disabled
pi = Pi(Factor=range)  # disabled
golden_ratio = GoldenRatio(Factor=range_2)  # disabled
fibonacci = Fibonacci(SeedA=0, SeedB=1, Number=number_slider_6)  # disabled
range_3 = Range(Domain=construct_domain, Steps=number_slider)  # disabled
series = Series(Start=number_slider_2, Step=number_slider_3, Count=number_slider)  # disabled
panel = Panel(fibonacci)  # disabled
panel_2 = Panel(pi)  # disabled
panel_3 = Panel(golden_ratio)  # disabled
panel_4 = Panel(series)  # disabled
panel_5 = Panel(range_3)  # disabled
seed = Slider(12, range=0..100)  # disabled
number_slider_7 = Slider(1, range=0..1)  # disabled
number_slider_8 = Slider(4, range=0..10)  # disabled
jitter = Jitter(List=panel_4, Jitter=number_slider_7, Seed=seed)  # -> Values, Indices; disabled
random = Random(Range=panel_5, Number=number_slider_8, Seed=seed)  # disabled
panel_6 = Panel(jitter.Values)  # disabled
panel_7 = Panel(random)  # disabled
random_reduce = RandomReduce(List=panel_6, Reduction=number_slider_8, Seed=seed)  # disabled
number_slider_9 = Slider(2, range=0..10)  # disabled
boolean_toggle = BooleanToggle(False)  # disabled
boolean_toggle_2 = BooleanToggle(True)  # disabled
panel_8 = Panel(random_reduce)  # disabled
duplicate_data = DuplicateData(Data=panel_8, Number=number_slider_9, Order=boolean_toggle_2)  # disabled
duplicate_data_2 = DuplicateData(Data=panel_8, Number=number_slider_9, Order=boolean_toggle)  # disabled
panel_9 = Panel(duplicate_data)  # disabled
panel_10 = Panel(duplicate_data_2)  # disabled
number_slider_10 = Slider(2, range=0..10)  # disabled
gene_pool = GenePool(
    Decimals=0,
    Maximum=1,
    Minimum=0,
    Value=[0.5563034162, 0.1101821131, 0.4184624788, 0.3575948995, 0.7002510963, 0.3821827748, 0.821337548, 0.03640053749, 0.8685297598, 0.6536799626])  # disabled
gene_pool_2 = GenePool(
    Decimals=0,
    Maximum=10,
    Minimum=0,
    Value=[5.563034162, 1.101821131, 4.184624788, 3.575948995, 7.002510963, 3.821827748, 8.21337548, 0.3640053749, 8.685297598, 6.536799626])  # disabled
cull_nth = CullNth(List=panel_9, CullFrequency=number_slider_10)  # disabled
cull_pattern = CullPattern(List=panel_9, CullPattern=gene_pool)  # disabled
cull_index = CullIndex(List=panel_9, Indices=gene_pool_2, Wrap=True)  # disabled
panel_11 = Panel(cull_index)  # disabled
panel_12 = Panel(cull_pattern)  # disabled
panel_13 = Panel(cull_nth)  # disabled
number_slider_11 = Slider(12, range=0..100)  # disabled
repeat_data = RepeatData(Data=panel_11, Length=number_slider_11)  # disabled
panel_14 = Panel(repeat_data)  # disabled
