# Grasshopper definition EX_010_sets_text(annotations in rhino).gh (Grasshopper 1.0.7)

# ----
# 010_sets_text(annotation_in_rhino)
# - concatenate can be a very useful tool
# for labeling 2D graphs in Rhino
# the graph of y = x^2
number_slider = Slider(1.77, range=0..10)  # disabled
negative = Negative(Value=number_slider)  # disabled
number_slider_2 = Slider(6, range=0..10)  # disabled
number_slider_3 = Slider(100, range=0..100)  # disabled
# EXERCISES_SETS
panel = Panel(number_slider)  # disabled
construct_domain = ConstructDomain(DomainStart=negative, DomainEnd=number_slider)  # disabled
panel_2 = Panel(number_slider)  # disabled
panel_3 = Panel(negative)  # disabled
range = Range(Domain=construct_domain, Steps=number_slider_2)  # disabled
panel_4 = Panel(construct_domain)  # disabled
expression = Expression(x=range, y=range, Expression="x^2")  # -> flatten(Result); disabled
construct_point = ConstructPoint(XCoordinate=0, YCoordinate=0, ZCoordinate=0)  # disabled
panel_5 = Panel(range)  # disabled
construct_point_2 = ConstructPoint(XCoordinate=range, YCoordinate=expression, ZCoordinate=0)  # disabled
deconstruct = Deconstruct(Point=construct_point_2)  # -> XComponent, YComponent, ZComponent; disabled
panel_6 = Panel(expression)  # disabled
construct_point_3 = ConstructPoint(XCoordinate=0, YCoordinate=deconstruct.YComponent, ZCoordinate=0)  # disabled
construct_point_4 = ConstructPoint(XCoordinate=deconstruct.XComponent, YCoordinate=0, ZCoordinate=0)  # disabled
interpolate = Interpolate(Vertices=construct_point_2, Degree=3, Periodic=False, KnotStyle=1)  # -> Curve, Length, Domain; disabled
line = Line(StartPoint=construct_point, EndPoint=construct_point_4)  # disabled
line_2 = Line(StartPoint=construct_point, EndPoint=construct_point_3)  # disabled
point_on_curve = PointOnCurve(interpolate.Curve, parameter=0.25)  # disabled
curve_middle = CurveMiddle(Curve=reparameterize(interpolate.Curve))  # disabled
point_on_curve_2 = PointOnCurve(interpolate.Curve, parameter=0.794)  # disabled
panel_7 = Panel(interpolate.Length)  # disabled
panel_8 = Panel("0")  # disabled
panel_9 = Panel("1")  # disabled
evaluate_curve = EvaluateCurve(Curve=reparameterize(interpolate.Curve), Parameter=panel_8)  # -> Point, Tangent, Angle; disabled
evaluate_curve_2 = EvaluateCurve(Curve=reparameterize(interpolate.Curve), Parameter=panel_9)  # -> Point, Tangent, Angle; disabled
panel_10 = Panel(".12")  # disabled
panel_11 = Panel("""  
      Length of y = (x^2) curve""")  # disabled
negative_2 = Negative(Value=evaluate_curve.Tangent)  # disabled
panel_12 = Panel("____ƒ(x) = ")  # disabled
panel_13 = Panel("y    ")  # disabled
panel_14 = Panel("x")  # disabled
panel_15 = Panel("    P = (x,y)")  # disabled
panel_16 = Panel("O    ")  # disabled
concatenate = Concatenate(FragmentA=panel_12, FragmentB=panel_7)  # disabled
list_item = ListItem(List=construct_point_4, Index=0, Wrap=True)  # -> Item1, Item; disabled
list_item_2 = ListItem(List=construct_point_3, Index=0, Wrap=True)  # disabled
panel_17 = Panel("Calculus Magic")  # disabled
polyline = PolyLine(Vertices=construct_point_2, Closed=False)  # disabled
text_tag_3d = TextTag3D(Location=curve_middle, Text=panel_17, Size=panel_10, Justification=1)  # disabled
text_tag_3d_2 = TextTag3D(Location=point_on_curve_2, Text=[panel_11, concatenate], Size=panel_10, Justification=7)  # disabled
text_tag_3d_3 = TextTag3D(Location=list_item_2, Text=panel_13, Size=panel_10, Justification=9)  # disabled
text_tag_3d_4 = TextTag3D(Location=list_item.Item1, Text=panel_14, Size=panel_10, Justification=7)  # disabled
text_tag_3d_5 = TextTag3D(Location=point_on_curve, Text=panel_15, Size=panel_10, Justification=7)  # disabled
text_tag_3d_6 = TextTag3D(Location=construct_point, Text=panel_16, Size=panel_10, Justification=3)  # disabled
vector_display = VectorDisplay(Anchor=evaluate_curve.Point, Vector=negative_2)  # disabled
vector_display_2 = VectorDisplay(Anchor=evaluate_curve_2.Point, Vector=evaluate_curve_2.Tangent)  # disabled
curve = Curve(interpolate.Curve)  # disabled
