# Grasshopper definition EX_011_sets_tree.gh (Grasshopper 1.0.7)
# plug-ins: Kangaroo2 Components

# ----
# EXERCISES_SETS
# 011_sets_tree
# - learning to manipulate
# data trees is essential
# - be sure to use the visualizing
# nodes
number_slider = Slider(2, range=0..10)  # disabled
number_slider_2 = Slider(3, range=0..10)  # disabled
series = Series(Start=0, Step=number_slider, Count=number_slider_2)  # disabled
cross_reference = CrossReference(ListListA=graft(series), ListListB=series, ListListC=series, CrossMode=1)  # -> ListListA, ListListB, ListListC; disabled
construct_point = ConstructPoint(XCoordinate=cross_reference.ListListA, YCoordinate=cross_reference.ListListB, ZCoordinate=cross_reference.ListListC)  # disabled
graft_tree = GraftTree(Tree=construct_point, IncludeEmptyLists=True, IncludeNullItems=True)  # disabled
panel = Panel(graft_tree)  # disabled
boolean_toggle = BooleanToggle(True)  # disabled
panel_2 = Panel("{0}")  # disabled
number_slider_3 = Slider(2, range=0..10)  # disabled
number_slider_4 = Slider(12, range=0..100)  # disabled
flatten_tree = FlattenTree(Tree=construct_point, Path=panel_2)  # disabled
simplify_tree = SimplifyTree(Tree=graft_tree, Front=boolean_toggle)  # disabled
graft_tree_2 = GraftTree(Tree=construct_point, IncludeEmptyLists=True, IncludeNullItems=True)  # disabled
path_mapper = PathMapper(simplify_tree, source="{A;B}", target="{A}")  # disabled
plane = Plane(PlaneXY(0, 0, 0))  # disabled
param_viewer = ParamViewer(simplify_tree)  # disabled
panel_3 = Panel(construct_point)  # disabled
panel_4 = Panel(graft_tree_2)  # disabled
panel_5 = Panel(flatten_tree)  # disabled
panel_6 = Panel(path_mapper)  # disabled
rectangular = Rectangular(Plane=plane, SizeX=number_slider_3, SizeY=number_slider_3, ExtentX=number_slider_4, ExtentY=number_slider_4)  # -> Cells, Points; disabled
number_slider_5 = Slider(1.37, range=0..10)  # disabled
number_slider_6 = Slider(1.37, range=0..10)  # disabled
number_slider_7 = Slider(1.37, range=0..10)  # disabled
param_viewer_2 = ParamViewer(panel_3)  # disabled
param_viewer_3 = ParamViewer(panel_4)  # disabled
param_viewer_4 = ParamViewer(panel_5)  # disabled
param_viewer_5 = ParamViewer(panel_6)  # disabled
panel_7 = Panel(rectangular.Cells)  # disabled
panel_8 = Panel(simplify_tree)  # disabled
point_list = PointList(Points=construct_point, Size=number_slider_5)  # disabled
point_list_2 = PointList(Points=graft_tree_2, Size=number_slider_6)  # disabled
point_list_3 = PointList(Points=flatten_tree, Size=number_slider_7)  # disabled
flip_matrix = FlipMatrix(Data=path_mapper)  # disabled
param_viewer_6 = ParamViewer(panel_8)  # disabled
panel_9 = Panel(flip_matrix)  # disabled
stream_filter = StreamFilter(Gate=0)  # disabled
merge = Merge()  # disabled
param_viewer_7 = ParamViewer(panel_9)  # disabled

number_slider_8 = Slider(120, range=0..1000)  # disabled

# ----
# - clean tree
number_slider_9 = Slider(10, range=0..10)  # disabled
panel_10 = Panel("0")  # disabled
construct_domain = ConstructDomain(DomainStart=panel_10, DomainEnd=number_slider_9)  # disabled
range = Range(Domain=construct_domain, Steps=number_slider_8)  # disabled
circle = Circle(Plane=PlaneXY(0, 0, 0), Radius=range)  # disabled
param_viewer_8 = ParamViewer(circle)  # disabled
panel_11 = Panel(circle)  # disabled
clean_tree = CleanTree(RemoveNulls=True, RemoveInvalid=True, RemoveEmpty=False, Tree=circle)  # disabled
circle_2 = Circle(clean_tree)  # disabled
param_viewer_9 = ParamViewer(circle_2)  # disabled
panel_12 = Panel(circle_2)  # disabled

unit_y = UnitY(Factor=1)  # disabled
unit_z = UnitZ(Factor=1)  # disabled

# ----
# visualizing
#  nodes
number_slider_10 = Slider(1.37, range=0..10)  # disabled
interpolate = Interpolate(Vertices=flip_matrix, Degree=3, Periodic=False, KnotStyle=1)  # -> Curve, Length, Domain; disabled
point_list_4 = PointList(Points=flip_matrix, Size=number_slider_10)  # disabled

number_slider_11 = Slider(0.2, range=0..1)  # disabled

# ----
# - entwine is a great organizational node
# - notince the subtle difference with the
#  merge node
# and the major difference with the
# weave node
number_slider_12 = Slider(2, range=0..2)  # disabled
unit_x = UnitX(Factor=1)  # disabled
pi = Pi(Factor=number_slider_12)  # disabled
rotate_3d = Rotate3D(Geometry=graft(circle_2), Angle=pi, Center=Point(0, 0, 0), Axis=[unit_x, unit_y, unit_z])  # -> flatten(Geometry), Transform; disabled
panel_13 = Panel(rotate_3d.Geometry)  # disabled
param_viewer_10 = ParamViewer(rotate_3d.Geometry)  # disabled
merge_2 = Merge(Data1=circle_2, Data2=rotate_3d.Geometry)  # disabled
entwine = Entwine(Branch00=circle_2, Branch01=rotate_3d.Geometry, FlattenInputs=True)  # disabled
circle_3 = Circle(rotate_3d.Geometry)  # disabled
circle_4 = Circle(circle_2)  # disabled
panel_14 = Panel(merge_2)  # disabled
dispatch = Dispatch(List=entwine, DispatchPattern=[True, False])  # -> ListA, ListB; disabled
circle_5 = Circle(dispatch.ListA)  # disabled
circle_6 = Circle(dispatch.ListB)  # disabled
multipipe = MultiPipe(Curves=circle_5, NodeSize=number_slider_11, EndOffset=1, StrutSize=1, Segment=0, KinkAngle=0.6, CubeFit=0, Caps=0)  # disabled
panel_15 = Panel(entwine)  # disabled
multipipe_2 = MultiPipe(Curves=circle_6, NodeSize=0.5, EndOffset=1, StrutSize=1, Segment=0, KinkAngle=0.6, CubeFit=0, Caps=0)  # disabled

weave = Weave(Pattern=[0, 1], Stream0=circle_2, Stream1=rotate_3d.Geometry, NullGaps=False)  # disabled

# ----
# - consider what the function of
# these two nodes do to the data tree
prune_tree = PruneTree(Minimum=0, Maximum=0)  # disabled
trim_tree = TrimTree(Depth=1)  # disabled

# ----
# - shift paths
number_slider_13 = Slider(2, range=0..10)  # disabled
number_slider_14 = Slider(3, range=0..10)  # disabled
series_2 = Series(Start=0, Step=number_slider_13, Count=number_slider_14)  # disabled
cross_reference_2 = CrossReference(ListListA=graft(series_2), ListListB=series_2, ListListC=series_2, CrossMode=1)  # -> ListListA, ListListB, ListListC; disabled
number_slider_15 = Slider(0.37, range=0..10)  # disabled
construct_point_2 = ConstructPoint(
    XCoordinate=cross_reference_2.ListListA,
    YCoordinate=cross_reference_2.ListListB,
    ZCoordinate=cross_reference_2.ListListC)  # disabled
panel_16 = Panel(construct_point_2)  # disabled
point_list_5 = PointList(Points=construct_point_2, Size=number_slider_15)  # disabled
number_slider_16 = Slider(1, range=-1..1)  # disabled
param_viewer_11 = ParamViewer(panel_16)  # disabled
number_slider_17 = Slider(1.15, range=0..10)  # disabled
shift_paths = ShiftPaths(Data=construct_point_2, Offset=number_slider_16)  # disabled
panel_17 = Panel(shift_paths)  # disabled
param_viewer_12 = ParamViewer(panel_17)  # disabled
point_list_6 = PointList(Points=shift_paths, Size=number_slider_15)  # disabled

# ----
# - tree statistics
number_slider_18 = Slider(2, range=0..10)  # disabled
number_slider_19 = Slider(4, range=0..100)  # disabled
plane_2 = Plane(PlaneXY(0, 0, 0))  # disabled
rectangular_2 = Rectangular(Plane=plane_2, SizeX=number_slider_18, SizeY=number_slider_18, ExtentX=number_slider_19, ExtentY=number_slider_19)  # -> Cells, Points; disabled
point = Point(rectangular_2.Points)  # disabled
curve = Curve(rectangular_2.Cells)  # disabled
panel_18 = Panel(curve)  # disabled
panel_19 = Panel(point)  # disabled
tree_statistics = TreeStatistics(Tree=curve)  # -> Paths, Length, Count; disabled
explode_tree = ExplodeTree(Data=curve)  # -> Branch0, Branch1, Branch2, Branch3, Branch4, Branch5; disabled
explode_tree_2 = ExplodeTree(Data=point)  # -> Branch0, Branch1, Branch2, Branch3, Branch4, Branch5; disabled
tree_statistics_2 = TreeStatistics(Tree=point)  # -> Paths, Length, Count; disabled
panel_20 = Panel(tree_statistics.Paths)  # disabled
panel_21 = Panel(tree_statistics_2.Paths)  # disabled
param_viewer_13 = ParamViewer(panel_19)  # disabled
param_viewer_14 = ParamViewer(panel_18)  # disabled
param_viewer_15 = ParamViewer(panel_21)  # disabled
param_viewer_16 = ParamViewer(panel_20)  # disabled

# ----
# - match tree
# - note simplify
number_slider_20 = Slider(3, range=0..10)  # disabled
number_slider_21 = Slider(4, range=0..10)  # disabled
xz_plane = XZPlane(Origin=Point(0, 0, 0))  # disabled
plane_3 = Plane(PlaneXY(0, 0, 0))  # disabled
rectangular_3 = Rectangular(Plane=plane_3, SizeX=number_slider_20, SizeY=number_slider_20, ExtentX=number_slider_21, ExtentY=number_slider_21)  # -> simplify(Cells), Points; disabled
rectangular_4 = Rectangular(Plane=xz_plane, SizeX=number_slider_20, SizeY=number_slider_20, ExtentX=number_slider_20, ExtentY=number_slider_20)  # -> Cells, Points; disabled
panel_22 = Panel(rectangular_3.Cells)  # disabled
panel_23 = Panel(rectangular_4.Points)  # disabled
param_viewer_17 = ParamViewer(panel_22)  # disabled
param_viewer_18 = ParamViewer(panel_23)  # disabled
match_tree = MatchTree(Tree=rectangular_3.Cells, Guide=rectangular_4.Points)  # disabled
match_tree_2 = MatchTree(Tree=rectangular_4.Points, Guide=rectangular_3.Cells)  # disabled
panel_24 = Panel(match_tree)  # disabled
panel_25 = Panel(match_tree_2)  # disabled
param_viewer_19 = ParamViewer(panel_25)  # disabled
param_viewer_20 = ParamViewer(panel_24)  # disabled

# ----
# - branches and indicies
gene_pool = GenePool(Decimals=0, Maximum=3, Minimum=0, Value=[1.94668296, 0.129544532, 0.8725059688])  # disabled
construct_path = ConstructPath(Indices=gene_pool)  # disabled
panel_26 = Panel(construct_path)  # disabled
deconstruct_path = DeconstructPath(Branch=panel_26)  # disabled
panel_27 = Panel(deconstruct_path)  # disabled

# ----
# - how to use masks
# - consider
# Path Compare
# and
# Replace Paths
# Nodes
number_slider_22 = Slider(2, range=0..10)  # disabled
number_slider_23 = Slider(10, range=0..10)  # disabled
series_3 = Series(Start=0, Step=number_slider_22, Count=number_slider_23)  # disabled
cross_reference_3 = CrossReference(ListListA=graft(series_3), ListListB=series_3, ListListC=series_3, CrossMode=1)  # -> ListListA, ListListB, ListListC; disabled
construct_point_3 = ConstructPoint(
    XCoordinate=cross_reference_3.ListListA,
    YCoordinate=cross_reference_3.ListListB,
    ZCoordinate=cross_reference_3.ListListC)  # disabled
cone = Cone(Base=construct_point_3, Radius=0.5, Length=1)  # -> Cone, Tip; disabled
param_viewer_21 = ParamViewer(construct_point_3)  # disabled
param_viewer_22 = ParamViewer(construct_point_3)  # disabled
panel_28 = Panel(construct_point_3)  # disabled
panel_29 = Panel("{0;0;1}[1]")  # disabled
panel_30 = Panel("{0;*;*}[1]")  # disabled
panel_31 = Panel("{0;0;1}[(0,1,2)]")  # disabled
panel_32 = Panel("{0;0;1}[(1to2)]")  # disabled
panel_33 = Panel("{0;0;1}[(3,4,...)]")  # disabled
panel_34 = Panel("{0;0;1}[(3to4)or(7to8)]")  # disabled
panel_35 = Panel("{*}[1]")  # disabled
panel_36 = Panel("{0;0;1}[(3,4,...,7)]")  # disabled
split_tree = SplitTree(Data=cone.Cone, Masks=flatten(panel_34))  # -> Positive, Negative; disabled
path_compare = PathCompare(Mask="*")  # disabled
replace_paths = ReplacePaths(Search="*")  # disabled
panel_37 = Panel(split_tree.Positive)  # disabled

# ----
# - custom user objects
number_slider_24 = Slider(3, range=0..10)  # disabled
number_slider_25 = Slider(3, range=0..10)  # disabled
number_slider_26 = Slider(3, range=0..10)  # disabled
constructtreeofnumbers = ConstructTreeOfNumbers(branchNum=number_slider_24, countNum=number_slider_25, number=number_slider_26)  # -> out, Numbers; inputs branchNum: Int32, countNum: Int32, number: Int32; disabled
# ---------- constructtreeofnumbers: C# usings ----------
using System.IO;
using System.Linq;
using System.Data;
using System.Drawing;
using System.Reflection;
using System.Windows.Forms;
using System.Xml;
using System.Xml.Linq;
using System.Runtime.InteropServices;

using Rhino.DocObjects;
using Rhino.Collections;
using GH_IO;
using GH_IO.Serialization;
# ---------- constructtreeofnumbers: C# ----------
    DataTree<double> numTree = new DataTree<double>();
    int pathIndex = 0;
    for (int b = 1; b <= branchNum; b++) {
      List<double> numList = new List<double>();
      GH_Path path = new GH_Path(pathIndex);
      pathIndex = pathIndex + 1;
      for (int i = 1; i <= countNum; i++) {
        numList.Add(number * i * b);
      }
      numTree.AddRange(numList, path);
    }
    Numbers = numTree;
# ---------- end constructtreeofnumbers ----------

number_slider_27 = Slider(12, range=-12..12)  # disabled

# ----
# - stream filter and gate
number_slider_28 = Slider(0, range=0..1)  # disabled
stream_gate = StreamGate(Stream=deconstruct_path, Gate=number_slider_28)  # -> Target0, Target1; disabled
panel_38 = Panel(stream_gate.Target1)  # disabled
panel_39 = Panel(stream_gate.Target0)  # disabled
stream_filter_2 = StreamFilter(Gate=0, Stream0=stream_gate.Target0, Stream1=stream_gate.Target1)  # disabled
panel_40 = Panel(stream_filter_2)  # disabled

# ----
# - list item is a great tool for data
# paths and branches
# and items(elements)
number_slider_29 = Slider(0, range=0..100)  # disabled
panel_41 = Panel(tree_statistics.Count)  # disabled
list_item = ListItem(List=tree_statistics.Paths, Index=number_slider_29, Wrap=True)  # disabled
tree_branch = TreeBranch(Tree=rectangular_2.Cells, Path=list_item, MaintainPaths=True)  # disabled
tree_item = TreeItem(Tree=rectangular_2.Cells, Path=tree_statistics.Paths, Index=number_slider_29, Wrap=True)  # disabled
panel_42 = Panel(tree_branch)  # disabled
panel_43 = Panel(tree_item)  # disabled

# ----
# - amazing from BIM Corner
panel_44 = Panel("{0;*;(0,2,...)}[*]")  # disabled
split_tree_2 = SplitTree(Data=cone.Cone, Masks=flatten(panel_44))  # -> Positive, Negative; disabled
unit_z_2 = UnitZ(Factor=number_slider_27)  # disabled
move = Move(Geometry=split_tree_2.Positive, Motion=unit_z_2)  # -> Geometry, Transform; disabled
merge_3 = Merge(Data1=move.Geometry, Data2=split_tree_2.Negative)  # disabled

# ----
# - relative item(s)
number_slider_30 = Slider(10, range=0..10)  # disabled
number_slider_31 = Slider(4, range=0..4)  # disabled
number_slider_32 = Slider(4, range=0..10)  # disabled
number_slider_33 = Slider(10, range=0..10)  # disabled
number_slider_34 = Slider(2, range=0..10)  # disabled
number_slider_35 = Slider(3, range=0..10)  # disabled
series_4 = Series(Start=0, Step=number_slider_30, Count=number_slider_31)  # disabled
series_5 = Series(Start=0, Step=number_slider_34, Count=number_slider_35)  # disabled
series_6 = Series(Start=number_slider_33, Step=number_slider_32, Count=number_slider_31)  # disabled
number_slider_36 = Slider(6, range=0..100)  # disabled
cross_reference_4 = CrossReference(ListListA=graft(series_5), ListListB=series_5, ListListC=series_5, CrossMode=1)  # -> ListListA, ListListB, ListListC; disabled
cross_reference_5 = CrossReference(ListListA=series_4, ListListB=series_4, CrossMode=1)  # -> ListListA, ListListB; disabled
cross_reference_6 = CrossReference(ListListA=series_6, ListListB=series_6, CrossMode=1)  # -> ListListA, ListListB; disabled
construct_point_4 = ConstructPoint(XCoordinate=graft(cross_reference_5.ListListA), YCoordinate=cross_reference_5.ListListB, ZCoordinate=0)  # disabled
construct_point_5 = ConstructPoint(
    XCoordinate=cross_reference_4.ListListA,
    YCoordinate=cross_reference_4.ListListB,
    ZCoordinate=cross_reference_4.ListListC)  # disabled
construct_point_6 = ConstructPoint(XCoordinate=graft(cross_reference_6.ListListA), YCoordinate=cross_reference_6.ListListB, ZCoordinate=number_slider_36)  # disabled
panel_46 = Panel("{0;0;0}[1]")  # disabled
panel_47 = Panel("{0;0;0}[3]")  # disabled
panel_48 = Panel("{0;0;0}[1]")  # disabled
panel_49 = Panel("{0;0;0}[2]")  # disabled
boolean_toggle_2 = BooleanToggle(False)  # disabled
cone_2 = Cone(Base=construct_point_5, Radius=0.5, Length=1)  # -> Cone, Tip; disabled
boolean_toggle_3 = BooleanToggle(True)  # disabled
relative_item = RelativeItem(Tree=construct_point_5, Offset=panel_48, WrapPaths=boolean_toggle_2, WrapItems=boolean_toggle_2)  # -> ItemA, ItemB; disabled
relative_items = RelativeItems(
    TreeA=construct_point_4,
    TreeB=construct_point_6,
    Offset=panel_46,
    WrapPaths=boolean_toggle_3,
    WrapItems=boolean_toggle_3)  # -> ItemA, ItemB; disabled
geometry = Geometry(relative_item.ItemB)  # disabled
geometry_2 = Geometry(relative_item.ItemA)  # disabled
geometry_3 = Geometry(relative_items.ItemA)  # disabled
geometry_4 = Geometry(relative_items.ItemB)  # disabled
line = Line(StartPoint=geometry_2, EndPoint=geometry)  # disabled
number_slider_37 = Slider(2, range=0..10)  # disabled
line_2 = Line(StartPoint=geometry_3, EndPoint=geometry_4)  # disabled
cap_holes = CapHoles(Brep=geometry_2)  # disabled
multipipe_3 = MultiPipe(Curves=line_2, NodeSize=0.5, EndOffset=1, StrutSize=1, Segment=0, KinkAngle=0.6, CubeFit=0, Caps=0)  # disabled
sphere = Sphere(Base=[construct_point_4, construct_point_6], Radius=number_slider_37)  # disabled
panel_50 = Panel("1")  # disabled
volume = Volume(Geometry=cap_holes)  # -> Volume, Centroid; disabled
unit_x_2 = UnitX(Factor=1)  # disabled
pi_2 = Pi(Factor=panel_50)  # disabled
rotate_3d_2 = Rotate3D(Geometry=cap_holes, Angle=pi_2, Center=volume.Centroid, Axis=unit_x_2)  # -> Geometry, Transform; disabled
merge_4 = Merge(Data1=rotate_3d_2.Geometry, Data2=geometry)  # disabled
