# Grasshopper definition EX_011_sets_tree_test_002.gh (Grasshopper 1.0.7)
# plug-ins: Kangaroo2 Components

# ----
# EXERCISES_SETS
# 011_sets_tree
# - learning to manipulate
# data trees is essential
# - be sure to use the visualizing
# nodes
number_slider = Slider(2, range=0..10)  # disabled
number_slider_2 = Slider(3, range=0..10)  # disabled
series = Series(Start=0, Step=number_slider, Count=number_slider_2)  # disabled
cross_reference = CrossReference(ListListA=graft(series), ListListB=series, ListListC=series, CrossMode=1)  # -> ListListA, ListListB, ListListC; disabled
construct_point = ConstructPoint(XCoordinate=cross_reference.ListListA, YCoordinate=cross_reference.ListListB, ZCoordinate=cross_reference.ListListC)  # disabled
graft_tree = GraftTree(Tree=construct_point, IncludeEmptyLists=True, IncludeNullItems=True)  # disabled
panel = Panel(graft_tree)  # disabled
boolean_toggle = BooleanToggle(True)  # disabled
panel_2 = Panel("{0}")  # disabled
number_slider_3 = Slider(2, range=0..10)  # disabled
number_slider_4 = Slider(12, range=0..100)  # disabled
flatten_tree = FlattenTree(Tree=construct_point, Path=panel_2)  # disabled
simplify_tree = SimplifyTree(Tree=graft_tree, Front=boolean_toggle)  # disabled
graft_tree_2 = GraftTree(Tree=construct_point, IncludeEmptyLists=True, IncludeNullItems=True)  # disabled
path_mapper = PathMapper(simplify_tree, source="{A;B}", target="{A}")  # disabled
plane = Plane(PlaneXY(0, 0, 0))  # disabled
param_viewer = ParamViewer(simplify_tree)  # disabled
panel_3 = Panel(construct_point)  # disabled
panel_4 = Panel(graft_tree_2)  # disabled
panel_5 = Panel(flatten_tree)  # disabled
panel_6 = Panel(path_mapper)  # disabled
rectangular = Rectangular(Plane=plane, SizeX=number_slider_3, SizeY=number_slider_3, ExtentX=number_slider_4, ExtentY=number_slider_4)  # -> Cells, Points; disabled
number_slider_5 = Slider(1.16, range=0..10)  # disabled
number_slider_6 = Slider(0.8, range=0..10)  # disabled
number_slider_7 = Slider(0.35, range=0..10)  # disabled
param_viewer_2 = ParamViewer(panel_3)  # disabled
param_viewer_3 = ParamViewer(panel_4)  # disabled
param_viewer_4 = ParamViewer(panel_5)  # disabled
param_viewer_5 = ParamViewer(panel_6)  # disabled
panel_7 = Panel(rectangular.Cells)  # disabled
panel_8 = Panel(simplify_tree)  # disabled
point_list = PointList(Points=construct_point, Size=number_slider_5)  # disabled
point_list_2 = PointList(Points=graft_tree_2, Size=number_slider_6)  # disabled
point_list_3 = PointList(Points=flatten_tree, Size=number_slider_7)  # disabled
flip_matrix = FlipMatrix(Data=path_mapper)  # disabled
polyline = PolyLine(Vertices=panel_4, Closed=False)  # disabled
param_viewer_6 = ParamViewer(panel_8)  # disabled
panel_9 = Panel(flip_matrix)  # disabled
stream_filter = StreamFilter(Gate=0)  # disabled
merge = Merge()  # disabled
param_viewer_7 = ParamViewer(panel_9)  # disabled

number_slider_8 = Slider(24, range=0..1000)  # disabled
number_slider_9 = Slider(1, range=0..1)  # disabled

# ----
# - clean tree
number_slider_10 = Slider(10, range=0..10)  # disabled
panel_10 = Panel("0")  # disabled
construct_domain = ConstructDomain(DomainStart=panel_10, DomainEnd=number_slider_10)  # disabled
range = Range(Domain=construct_domain, Steps=number_slider_8)  # disabled
circle = Circle(Plane=PlaneXY(0, 0, 0), Radius=range)  # disabled
param_viewer_8 = ParamViewer(circle)  # disabled
panel_11 = Panel(circle)  # disabled
clean_tree = CleanTree(RemoveNulls=number_slider_9, RemoveInvalid=number_slider_9, RemoveEmpty=False, Tree=circle)  # disabled
circle_2 = Circle(clean_tree)  # disabled
param_viewer_9 = ParamViewer(circle_2)  # disabled
panel_12 = Panel(circle_2)  # disabled

unit_y = UnitY(Factor=1)  # disabled
unit_z = UnitZ(Factor=1)  # disabled

# ----
# visualizing
#  nodes
number_slider_11 = Slider(1.37, range=0..10)  # disabled
interpolate = Interpolate(Vertices=flip_matrix, Degree=3, Periodic=False, KnotStyle=1)  # -> Curve, Length, Domain; disabled
point_list_4 = PointList(Points=flip_matrix, Size=number_slider_11)  # disabled

number_slider_12 = Slider(0.2, range=0..1)  # disabled

# ----
# - consider what the function of
# these two nodes do to the data tree
prune_tree = PruneTree(Minimum=0, Maximum=0)  # disabled
trim_tree = TrimTree(Depth=1)  # disabled

# ----
# - shift paths
number_slider_13 = Slider(2, range=0..10)
series_2 = Series(Start=0, Step=number_slider_13, Count=Slider(3, range=0..10))
cross_reference_2 = CrossReference(ListListA=graft(series_2), ListListB=series_2, ListListC=series_2, CrossMode=1)  # -> ListListA, ListListB, ListListC
number_slider_14 = Slider(0.37, range=0..10)
construct_point_2 = ConstructPoint(
    XCoordinate=cross_reference_2.ListListA,
    YCoordinate=cross_reference_2.ListListB,
    ZCoordinate=cross_reference_2.ListListC)
panel_13 = Panel(construct_point_2)
point_list_5 = PointList(Points=construct_point_2, Size=number_slider_14)
param_viewer_10 = ParamViewer(panel_13)
number_slider_15 = Slider(1.15, range=0..10)
shift_paths = ShiftPaths(Data=construct_point_2, Offset=Slider(1, range=-1..2))
panel_14 = Panel(shift_paths)
param_viewer_11 = ParamViewer(panel_14)
point_list_6 = PointList(Points=shift_paths, Size=number_slider_14)

# ----
# - tree statistics
number_slider_16 = Slider(2, range=0..10)
number_slider_17 = Slider(4, range=0..100)
plane_2 = Plane(PlaneXY(0, 0, 0))
rectangular_2 = Rectangular(Plane=plane_2, SizeX=number_slider_16, SizeY=number_slider_16, ExtentX=number_slider_17, ExtentY=number_slider_17)  # -> Cells, Points
point = Point(rectangular_2.Points)
curve = Curve(rectangular_2.Cells)
panel_15 = Panel(curve)
panel_16 = Panel(point)
tree_statistics = TreeStatistics(Tree=curve)  # -> Paths, Length, Count
explode_tree = ExplodeTree(Data=curve)  # -> Branch0, Branch1, Branch2, Branch3
explode_tree_2 = ExplodeTree(Data=point)  # -> Branch0, Branch1, Branch2, Branch3, Branch4, Branch5
tree_statistics_2 = TreeStatistics(Tree=point)  # -> Paths, Length, Count
panel_17 = Panel(tree_statistics.Paths)
panel_18 = Panel(tree_statistics_2.Paths)
param_viewer_12 = ParamViewer(panel_16)
param_viewer_13 = ParamViewer(panel_15)
param_viewer_14 = ParamViewer(panel_18)
param_viewer_15 = ParamViewer(panel_17)

# ----
# - match tree
# - note simplify
number_slider_18 = Slider(3, range=0..10)
number_slider_19 = Slider(4, range=0..10)
xz_plane = XZPlane(Origin=Point(0, 0, 0))
plane_3 = Plane(PlaneXY(0, 0, 0))
rectangular_3 = Rectangular(Plane=plane_3, SizeX=number_slider_18, SizeY=number_slider_18, ExtentX=number_slider_19, ExtentY=number_slider_19)  # -> simplify(Cells), Points
rectangular_4 = Rectangular(Plane=xz_plane, SizeX=number_slider_18, SizeY=number_slider_18, ExtentX=number_slider_18, ExtentY=number_slider_18)  # -> Cells, Points
panel_19 = Panel(rectangular_3.Cells)
panel_20 = Panel(rectangular_4.Points)
param_viewer_16 = ParamViewer(panel_19)
param_viewer_17 = ParamViewer(panel_20)
match_tree = MatchTree(Tree=rectangular_3.Cells, Guide=rectangular_4.Points)
match_tree_2 = MatchTree(Tree=rectangular_4.Points, Guide=rectangular_3.Cells)
panel_21 = Panel(match_tree)
panel_22 = Panel(match_tree_2)
param_viewer_18 = ParamViewer(panel_22)
param_viewer_19 = ParamViewer(panel_21)

# ----
# - branches and indicies
gene_pool = GenePool(Decimals=0, Maximum=3, Minimum=0, Value=[2, 0.129544532, 1])
construct_path = ConstructPath(Indices=gene_pool)
panel_23 = Panel(construct_path)
deconstruct_path = DeconstructPath(Branch=panel_23)
panel_24 = Panel(deconstruct_path)

# ----
# - how to use masks
# - consider
# Path Compare
# and
# Replace Paths
# Nodes
number_slider_20 = Slider(2, range=0..10)
series_3 = Series(Start=0, Step=number_slider_20, Count=Slider(3, range=0..10))
cross_reference_3 = CrossReference(ListListA=graft(series_3), ListListB=series_3, ListListC=series_3, CrossMode=1)  # -> ListListA, ListListB, ListListC
construct_point_3 = ConstructPoint(
    XCoordinate=cross_reference_3.ListListA,
    YCoordinate=cross_reference_3.ListListB,
    ZCoordinate=cross_reference_3.ListListC)
cone = Cone(Base=construct_point_3, Radius=0.5, Length=1)  # -> Cone, Tip
param_viewer_20 = ParamViewer(construct_point_3)
param_viewer_21 = ParamViewer(construct_point_3)
panel_25 = Panel(construct_point_3)
panel_26 = Panel("{0;0;1}[1]")
panel_27 = Panel("{0;*;*}[1]")
panel_28 = Panel("{0;0;1}[(1to2)]")
panel_29 = Panel("{0;0;1}[(0,1,2)]")
panel_30 = Panel("{0;0;1}[(3,4,...)]")
panel_31 = Panel("{*}[1]")
panel_32 = Panel("{0;0;1}[(3,4,...,7)]")
split_tree = SplitTree(Data=cone.Cone, Masks=flatten("{0;0;1}[(3to4)or(7to8)]"))  # -> Positive, Negative
path_compare = PathCompare(Mask="*")
replace_paths = ReplacePaths(Search="*")
panel_33 = Panel(split_tree.Positive)

# ----
# - custom user objects
number_slider_21 = Slider(3, range=0..10)
constructtreeofnumbers = ConstructTreeOfNumbers(branchNum=number_slider_21, countNum=Slider(3, range=0..10), number=Slider(3, range=0..10))  # -> out, Numbers; inputs branchNum: Int32, countNum: Int32, number: Int32
# ---------- constructtreeofnumbers: C# usings ----------
using System.IO;
using System.Linq;
using System.Data;
using System.Drawing;
using System.Reflection;
using System.Windows.Forms;
using System.Xml;
using System.Xml.Linq;
using System.Runtime.InteropServices;

using Rhino.DocObjects;
using Rhino.Collections;
using GH_IO;
using GH_IO.Serialization;
# ---------- constructtreeofnumbers: C# ----------
    DataTree<double> numTree = new DataTree<double>();
    int pathIndex = 0;
    for (int b = 1; b <= branchNum; b++) {
      List<double> numList = new List<double>();
      GH_Path path = new GH_Path(pathIndex);
      pathIndex = pathIndex + 1;
      for (int i = 1; i <= countNum; i++) {
        numList.Add(number * i * b);
      }
      numTree.AddRange(numList, path);
    }
    Numbers = numTree;
# ---------- end constructtreeofnumbers ----------

param_viewer_22 = ParamViewer(deconstruct_path)

# ----
# - stream filter and gate
number_slider_22 = Slider(0, range=0..1)
stream_gate = StreamGate(Stream=deconstruct_path, Gate=number_slider_22)  # -> Target0, Target1
panel_34 = Panel(stream_gate.Target1)
panel_35 = Panel(stream_gate.Target0)
stream_filter_2 = StreamFilter(Gate=0, Stream0=stream_gate.Target0, Stream1=stream_gate.Target1)
panel_36 = Panel(stream_filter_2)

# ----
# - list item is a great tool for data
# paths and branches
# and items(elements)
number_slider_23 = Slider(0, range=0..100)
panel_37 = Panel(tree_statistics.Count)
list_item = ListItem(List=tree_statistics.Paths, Index=Slider(1, range=0..10), Wrap=True)
tree_item = TreeItem(Tree=rectangular_2.Cells, Path=tree_statistics.Paths, Index=number_slider_23, Wrap=True)
tree_branch = TreeBranch(Tree=rectangular_2.Cells, Path=list_item, MaintainPaths=True)
panel_38 = Panel(tree_branch)
panel_39 = Panel(tree_item)

# ----
# - amazing from BIM Corner
panel_40 = Panel("{0;*;(0,2,...)}[*]")
split_tree_2 = SplitTree(Data=cone.Cone, Masks=flatten(panel_40))  # -> Positive, Negative
unit_z_2 = UnitZ(Factor=Slider(4.294, range=-12..12))
move = Move(Geometry=split_tree_2.Positive, Motion=unit_z_2)  # -> Geometry, Transform
merge_2 = Merge(Data1=move.Geometry, Data2=split_tree_2.Negative)

panel_41 = Panel(list_item)

# ----
# - relative item(s)
number_slider_24 = Slider(10, range=0..10)  # disabled
number_slider_25 = Slider(4, range=0..4)  # disabled
number_slider_26 = Slider(4, range=0..10)  # disabled
number_slider_27 = Slider(10, range=0..10)  # disabled
number_slider_28 = Slider(2, range=0..10)  # disabled
number_slider_29 = Slider(3, range=0..10)  # disabled
series_4 = Series(Start=0, Step=number_slider_24, Count=number_slider_25)  # disabled
series_5 = Series(Start=0, Step=number_slider_28, Count=number_slider_29)  # disabled
series_6 = Series(Start=number_slider_27, Step=number_slider_26, Count=number_slider_25)  # disabled
number_slider_30 = Slider(6, range=0..100)  # disabled
cross_reference_4 = CrossReference(ListListA=graft(series_5), ListListB=series_5, ListListC=series_5, CrossMode=1)  # -> ListListA, ListListB, ListListC; disabled
cross_reference_5 = CrossReference(ListListA=series_4, ListListB=series_4, CrossMode=1)  # -> ListListA, ListListB; disabled
cross_reference_6 = CrossReference(ListListA=series_6, ListListB=series_6, CrossMode=1)  # -> ListListA, ListListB; disabled
construct_point_4 = ConstructPoint(XCoordinate=graft(cross_reference_5.ListListA), YCoordinate=cross_reference_5.ListListB, ZCoordinate=0)  # disabled
construct_point_5 = ConstructPoint(
    XCoordinate=cross_reference_4.ListListA,
    YCoordinate=cross_reference_4.ListListB,
    ZCoordinate=cross_reference_4.ListListC)  # disabled
construct_point_6 = ConstructPoint(XCoordinate=graft(cross_reference_6.ListListA), YCoordinate=cross_reference_6.ListListB, ZCoordinate=number_slider_30)  # disabled
panel_42 = Panel("{0;0;1}[1]")  # disabled
panel_43 = Panel("{0;0;0}[1]")  # disabled
panel_44 = Panel("{0;0;0}[3]")  # disabled
panel_45 = Panel("{0;0;0}[1]")  # disabled
panel_46 = Panel("{0;0;0}[2]")  # disabled
boolean_toggle_2 = BooleanToggle(False)  # disabled
cone_2 = Cone(Base=construct_point_5, Radius=0.5, Length=1)  # -> Cone, Tip; disabled
boolean_toggle_3 = BooleanToggle(True)  # disabled
relative_item = RelativeItem(Tree=construct_point_5, Offset=panel_45, WrapPaths=boolean_toggle_2, WrapItems=boolean_toggle_2)  # -> ItemA, ItemB; disabled
relative_items = RelativeItems(
    TreeA=construct_point_4,
    TreeB=construct_point_6,
    Offset=panel_43,
    WrapPaths=boolean_toggle_3,
    WrapItems=boolean_toggle_3)  # -> ItemA, ItemB; disabled
geometry = Geometry(relative_item.ItemB)  # disabled
geometry_2 = Geometry(relative_item.ItemA)  # disabled
geometry_3 = Geometry(relative_items.ItemA)  # disabled
geometry_4 = Geometry(relative_items.ItemB)  # disabled
line = Line(StartPoint=geometry_2, EndPoint=geometry)  # disabled
number_slider_31 = Slider(2, range=0..10)  # disabled
line_2 = Line(StartPoint=geometry_3, EndPoint=geometry_4)  # disabled
cap_holes = CapHoles(Brep=geometry_2)  # disabled
multipipe = MultiPipe(Curves=line_2, NodeSize=0.5, EndOffset=1, StrutSize=1, Segment=0, KinkAngle=0.6, CubeFit=0, Caps=0)  # disabled
sphere = Sphere(Base=[construct_point_4, construct_point_6], Radius=number_slider_31)  # disabled
panel_47 = Panel("1")  # disabled
volume = Volume(Geometry=cap_holes)  # -> Volume, Centroid; disabled
unit_x = UnitX(Factor=1)  # disabled
pi = Pi(Factor=panel_47)  # disabled
rotate_3d = Rotate3D(Geometry=cap_holes, Angle=pi, Center=volume.Centroid, Axis=unit_x)  # -> Geometry, Transform; disabled
merge_3 = Merge(Data1=rotate_3d.Geometry, Data2=geometry)  # disabled

# ----
# - entwine is a great organizational node
# - notince the subtle difference with the
#  merge node
# and the major difference with the
# weave node
number_slider_32 = Slider(0.5, range=0..2)  # disabled
unit_x_2 = UnitX(Factor=1)  # disabled
pi_2 = Pi(Factor=number_slider_32)  # disabled
rotate_3d_2 = Rotate3D(Geometry=graft(circle_2), Angle=pi_2, Center=Point(0, 0, 0), Axis=[unit_x_2, unit_y, unit_z])  # -> flatten(Geometry), Transform; disabled
panel_48 = Panel(rotate_3d_2.Geometry)  # disabled
param_viewer_23 = ParamViewer(rotate_3d_2.Geometry)  # disabled
merge_4 = Merge(Data1=circle_2, Data2=rotate_3d_2.Geometry)  # disabled
entwine = Entwine(Branch00=circle_2, Branch01=rotate_3d_2.Geometry, FlattenInputs=True)  # disabled
circle_3 = Circle(rotate_3d_2.Geometry)  # disabled
circle_4 = Circle(circle_2)  # disabled
panel_49 = Panel(merge_4)  # disabled
dispatch = Dispatch(List=entwine, DispatchPattern=[True, False])  # -> ListA, ListB; disabled
circle_5 = Circle(dispatch.ListA)  # disabled
circle_6 = Circle(dispatch.ListB)  # disabled
multipipe_2 = MultiPipe(Curves=circle_5, NodeSize=number_slider_12, EndOffset=1, StrutSize=1, Segment=0, KinkAngle=0.6, CubeFit=0, Caps=0)  # disabled
panel_50 = Panel(entwine)  # disabled

weave = Weave(Pattern=[0, 1], Stream0=circle_2, Stream1=rotate_3d_2.Geometry, NullGaps=False)  # disabled

multipipe_3 = MultiPipe(Curves=weave, NodeSize=0.5, EndOffset=1, StrutSize=1, Segment=0, KinkAngle=0.6, CubeFit=0, Caps=0)  # disabled
