# Grasshopper definition EX_011_sets_tree_test_003.gh (Grasshopper 1.0.7)
# plug-ins: Kangaroo2 Components

# ----
# EXERCISES_SETS
# 011_sets_tree
# - learning to manipulate
# data trees is essential
# - be sure to use the visualizing
# nodes
number_slider = Slider(2, range=0..10)  # disabled
number_slider_2 = Slider(3, range=0..10)  # disabled
series = Series(Start=0, Step=number_slider, Count=number_slider_2)  # disabled
cross_reference = CrossReference(ListListA=graft(series), ListListB=series, ListListC=series, CrossMode=1)  # -> ListListA, ListListB, ListListC; disabled
construct_point = ConstructPoint(XCoordinate=cross_reference.ListListA, YCoordinate=cross_reference.ListListB, ZCoordinate=cross_reference.ListListC)  # disabled
graft_tree = GraftTree(Tree=construct_point, IncludeEmptyLists=True, IncludeNullItems=True)  # disabled
panel = Panel(graft_tree)  # disabled
boolean_toggle = BooleanToggle(True)  # disabled
panel_2 = Panel("{0}")  # disabled
number_slider_3 = Slider(2, range=0..10)  # disabled
number_slider_4 = Slider(12, range=0..100)  # disabled
flatten_tree = FlattenTree(Tree=construct_point, Path=panel_2)  # disabled
simplify_tree = SimplifyTree(Tree=graft_tree, Front=boolean_toggle)  # disabled
graft_tree_2 = GraftTree(Tree=construct_point, IncludeEmptyLists=True, IncludeNullItems=True)  # disabled
path_mapper = PathMapper(simplify_tree, source="{A;B}", target="{A}")  # disabled
plane = Plane(PlaneXY(0, 0, 0))  # disabled
param_viewer = ParamViewer(simplify_tree)  # disabled
panel_3 = Panel(construct_point)  # disabled
panel_4 = Panel(graft_tree_2)  # disabled
panel_5 = Panel(flatten_tree)  # disabled
panel_6 = Panel(path_mapper)  # disabled
rectangular = Rectangular(Plane=plane, SizeX=number_slider_3, SizeY=number_slider_3, ExtentX=number_slider_4, ExtentY=number_slider_4)  # -> Cells, Points; disabled
number_slider_5 = Slider(1.16, range=0..10)  # disabled
number_slider_6 = Slider(0.8, range=0..10)  # disabled
number_slider_7 = Slider(0.35, range=0..10)  # disabled
param_viewer_2 = ParamViewer(panel_3)  # disabled
param_viewer_3 = ParamViewer(panel_4)  # disabled
param_viewer_4 = ParamViewer(panel_5)  # disabled
param_viewer_5 = ParamViewer(panel_6)  # disabled
panel_7 = Panel(rectangular.Cells)  # disabled
panel_8 = Panel(simplify_tree)  # disabled
point_list = PointList(Points=construct_point, Size=number_slider_5)  # disabled
point_list_2 = PointList(Points=graft_tree_2, Size=number_slider_6)  # disabled
point_list_3 = PointList(Points=flatten_tree, Size=number_slider_7)  # disabled
flip_matrix = FlipMatrix(Data=path_mapper)  # disabled
polyline = PolyLine(Vertices=panel_4, Closed=False)  # disabled
param_viewer_6 = ParamViewer(panel_8)  # disabled
panel_9 = Panel(flip_matrix)  # disabled
stream_filter = StreamFilter(Gate=0)  # disabled
merge = Merge()  # disabled
param_viewer_7 = ParamViewer(panel_9)  # disabled

number_slider_8 = Slider(24, range=0..1000)  # disabled
number_slider_9 = Slider(1, range=0..1)  # disabled

# ----
# - clean tree
number_slider_10 = Slider(10, range=0..10)  # disabled
panel_10 = Panel("0")  # disabled
construct_domain = ConstructDomain(DomainStart=panel_10, DomainEnd=number_slider_10)  # disabled
range = Range(Domain=construct_domain, Steps=number_slider_8)  # disabled
circle = Circle(Plane=PlaneXY(0, 0, 0), Radius=range)  # disabled
param_viewer_8 = ParamViewer(circle)  # disabled
panel_11 = Panel(circle)  # disabled
clean_tree = CleanTree(RemoveNulls=number_slider_9, RemoveInvalid=number_slider_9, RemoveEmpty=False, Tree=circle)  # disabled
circle_2 = Circle(clean_tree)  # disabled
param_viewer_9 = ParamViewer(circle_2)  # disabled
panel_12 = Panel(circle_2)  # disabled

unit_y = UnitY(Factor=1)  # disabled
unit_z = UnitZ(Factor=1)  # disabled

# ----
# visualizing
#  nodes
number_slider_11 = Slider(1.37, range=0..10)  # disabled
interpolate = Interpolate(Vertices=flip_matrix, Degree=3, Periodic=False, KnotStyle=1)  # -> Curve, Length, Domain; disabled
point_list_4 = PointList(Points=flip_matrix, Size=number_slider_11)  # disabled

number_slider_12 = Slider(0.2, range=0..1)  # disabled

# ----
# - consider what the function of
# these two nodes do to the data tree
prune_tree = PruneTree(Minimum=0, Maximum=0)  # disabled
trim_tree = TrimTree(Depth=1)  # disabled

# ----
# - shift paths
number_slider_13 = Slider(2, range=0..10)  # disabled
number_slider_14 = Slider(3, range=0..10)  # disabled
series_2 = Series(Start=0, Step=number_slider_13, Count=number_slider_14)  # disabled
cross_reference_2 = CrossReference(ListListA=graft(series_2), ListListB=series_2, ListListC=series_2, CrossMode=1)  # -> ListListA, ListListB, ListListC; disabled
number_slider_15 = Slider(0.37, range=0..10)  # disabled
construct_point_2 = ConstructPoint(
    XCoordinate=cross_reference_2.ListListA,
    YCoordinate=cross_reference_2.ListListB,
    ZCoordinate=cross_reference_2.ListListC)  # disabled
panel_13 = Panel(construct_point_2)  # disabled
point_list_5 = PointList(Points=construct_point_2, Size=number_slider_15)  # disabled
number_slider_16 = Slider(1, range=-1..2)  # disabled
param_viewer_10 = ParamViewer(panel_13)  # disabled
number_slider_17 = Slider(1.15, range=0..10)  # disabled
shift_paths = ShiftPaths(Data=construct_point_2, Offset=number_slider_16)  # disabled
panel_14 = Panel(shift_paths)  # disabled
param_viewer_11 = ParamViewer(panel_14)  # disabled
point_list_6 = PointList(Points=shift_paths, Size=number_slider_15)  # disabled

# ----
# - tree statistics
number_slider_18 = Slider(2, range=0..10)  # disabled
number_slider_19 = Slider(4, range=0..100)  # disabled
plane_2 = Plane(PlaneXY(0, 0, 0))  # disabled
rectangular_2 = Rectangular(Plane=plane_2, SizeX=number_slider_18, SizeY=number_slider_18, ExtentX=number_slider_19, ExtentY=number_slider_19)  # -> Cells, Points; disabled
point = Point(rectangular_2.Points)  # disabled
curve = Curve(rectangular_2.Cells)  # disabled
panel_15 = Panel(curve)  # disabled
panel_16 = Panel(point)  # disabled
tree_statistics = TreeStatistics(Tree=curve)  # -> Paths, Length, Count; disabled
explode_tree = ExplodeTree(Data=curve)  # -> Branch0, Branch1, Branch2, Branch3; disabled
explode_tree_2 = ExplodeTree(Data=point)  # -> Branch0, Branch1, Branch2, Branch3, Branch4, Branch5; disabled
tree_statistics_2 = TreeStatistics(Tree=point)  # -> Paths, Length, Count; disabled
panel_17 = Panel(tree_statistics.Paths)  # disabled
panel_18 = Panel(tree_statistics_2.Paths)  # disabled
param_viewer_12 = ParamViewer(panel_16)  # disabled
param_viewer_13 = ParamViewer(panel_15)  # disabled
param_viewer_14 = ParamViewer(panel_18)  # disabled
param_viewer_15 = ParamViewer(panel_17)  # disabled

# ----
# - match tree
# - note simplify
number_slider_20 = Slider(3, range=0..10)  # disabled
number_slider_21 = Slider(4, range=0..10)  # disabled
xz_plane = XZPlane(Origin=Point(0, 0, 0))  # disabled
plane_3 = Plane(PlaneXY(0, 0, 0))  # disabled
rectangular_3 = Rectangular(Plane=plane_3, SizeX=number_slider_20, SizeY=number_slider_20, ExtentX=number_slider_21, ExtentY=number_slider_21)  # -> simplify(Cells), Points; disabled
rectangular_4 = Rectangular(Plane=xz_plane, SizeX=number_slider_20, SizeY=number_slider_20, ExtentX=number_slider_20, ExtentY=number_slider_20)  # -> Cells, Points; disabled
panel_19 = Panel(rectangular_3.Cells)  # disabled
panel_20 = Panel(rectangular_4.Points)  # disabled
param_viewer_16 = ParamViewer(panel_19)  # disabled
param_viewer_17 = ParamViewer(panel_20)  # disabled
match_tree = MatchTree(Tree=rectangular_3.Cells, Guide=rectangular_4.Points)  # disabled
match_tree_2 = MatchTree(Tree=rectangular_4.Points, Guide=rectangular_3.Cells)  # disabled
panel_21 = Panel(match_tree)  # disabled
panel_22 = Panel(match_tree_2)  # disabled
param_viewer_18 = ParamViewer(panel_22)  # disabled
param_viewer_19 = ParamViewer(panel_21)  # disabled

# ----
# - shift paths
number_slider_22 = Slider(2, range=0..10)  # disabled
number_slider_23 = Slider(3, range=0..10)  # disabled
series_3 = Series(Start=0, Step=number_slider_22, Count=number_slider_23)  # disabled
cross_reference_3 = CrossReference(ListListA=graft(series_3), ListListB=series_3, ListListC=series_3, CrossMode=1)  # -> ListListA, ListListB, ListListC; disabled
number_slider_24 = Slider(0.79, range=0..10)  # disabled
construct_point_3 = ConstructPoint(
    XCoordinate=cross_reference_3.ListListA,
    YCoordinate=cross_reference_3.ListListB,
    ZCoordinate=cross_reference_3.ListListC)  # disabled
panel_23 = Panel(construct_point_3)  # disabled
point_list_7 = PointList(Points=construct_point_3, Size=number_slider_24)  # disabled
number_slider_25 = Slider(0, range=-1..2)  # disabled
param_viewer_20 = ParamViewer(panel_23)  # disabled
number_slider_26 = Slider(0.36, range=0..10)  # disabled
shift_paths_2 = ShiftPaths(Data=construct_point_3, Offset=number_slider_25)  # disabled
panel_24 = Panel(shift_paths_2)  # disabled
point_list_8 = PointList(Points=shift_paths_2, Size=number_slider_26)  # disabled
param_viewer_21 = ParamViewer(panel_24)  # disabled

# ----
# - branches and indicies
gene_pool = GenePool(Decimals=0, Maximum=3, Minimum=0, Value=[2, 0.129544532, 1])  # disabled
construct_path = ConstructPath(Indices=gene_pool)  # disabled
panel_25 = Panel(construct_path)  # disabled
deconstruct_path = DeconstructPath(Branch=panel_25)  # disabled
panel_26 = Panel(deconstruct_path)  # disabled

# ----
# - match tree
# - note simplify
number_slider_27 = Slider(3, range=0..10)
number_slider_28 = Slider(4, range=0..10)
xz_plane_2 = XZPlane(Origin=Point(0, 0, 0))
plane_4 = Plane(PlaneXY(0, 0, 0))
rectangular_5 = Rectangular(Plane=plane_4, SizeX=number_slider_27, SizeY=number_slider_27, ExtentX=number_slider_28, ExtentY=number_slider_28)  # -> simplify(Cells), Points
rectangular_6 = Rectangular(Plane=xz_plane_2, SizeX=number_slider_27, SizeY=number_slider_27, ExtentX=number_slider_27, ExtentY=number_slider_27)  # -> Cells, Points
panel_27 = Panel(rectangular_5.Cells)
panel_28 = Panel(rectangular_6.Points)
param_viewer_22 = ParamViewer(panel_27)
param_viewer_23 = ParamViewer(panel_28)
match_tree_3 = MatchTree(Tree=rectangular_5.Cells, Guide=rectangular_6.Points)
match_tree_4 = MatchTree(Tree=rectangular_6.Points, Guide=rectangular_5.Cells)
panel_29 = Panel(match_tree_3)
panel_30 = Panel(match_tree_4)
param_viewer_24 = ParamViewer(panel_30)
param_viewer_25 = ParamViewer(panel_29)

# ----
# - how to use masks
# - consider
# Path Compare
# and
# Replace Paths
# Nodes
number_slider_29 = Slider(2, range=0..10)  # disabled
number_slider_30 = Slider(3, range=0..10)  # disabled
series_4 = Series(Start=0, Step=number_slider_29, Count=number_slider_30)  # disabled
cross_reference_4 = CrossReference(ListListA=graft(series_4), ListListB=series_4, ListListC=series_4, CrossMode=1)  # -> ListListA, ListListB, ListListC; disabled
construct_point_4 = ConstructPoint(
    XCoordinate=cross_reference_4.ListListA,
    YCoordinate=cross_reference_4.ListListB,
    ZCoordinate=cross_reference_4.ListListC)  # disabled
cone = Cone(Base=construct_point_4, Radius=0.5, Length=1)  # -> Cone, Tip; disabled
param_viewer_26 = ParamViewer(construct_point_4)  # disabled
param_viewer_27 = ParamViewer(construct_point_4)  # disabled
panel_31 = Panel(construct_point_4)  # disabled
panel_32 = Panel("{0;0;1}[1]")  # disabled
panel_33 = Panel("{0;*;*}[1]")  # disabled
panel_34 = Panel("{0;0;1}[(1to2)]")  # disabled
panel_35 = Panel("{0;0;1}[(3to4)or(7to8)]")  # disabled
panel_36 = Panel("{0;0;1}[(0,1,2)]")  # disabled
panel_37 = Panel("{0;0;1}[(3,4,...)]")  # disabled
panel_38 = Panel("{*}[1]")  # disabled
panel_39 = Panel("{0;0;1}[(3,4,...,7)]")  # disabled
split_tree = SplitTree(Data=cone.Cone, Masks=flatten(panel_35))  # -> Positive, Negative; disabled
path_compare = PathCompare(Mask="*")  # disabled
replace_paths = ReplacePaths(Search="*")  # disabled
panel_40 = Panel(split_tree.Positive)  # disabled

# ----
# - custom user objects
number_slider_31 = Slider(3, range=0..10)  # disabled
number_slider_32 = Slider(3, range=0..10)  # disabled
number_slider_33 = Slider(3, range=0..10)  # disabled
constructtreeofnumbers = ConstructTreeOfNumbers(branchNum=number_slider_31, countNum=number_slider_32, number=number_slider_33)  # -> out, Numbers; inputs branchNum: Int32, countNum: Int32, number: Int32; disabled
# ---------- constructtreeofnumbers: C# usings ----------
using System.IO;
using System.Linq;
using System.Data;
using System.Drawing;
using System.Reflection;
using System.Windows.Forms;
using System.Xml;
using System.Xml.Linq;
using System.Runtime.InteropServices;

using Rhino.DocObjects;
using Rhino.Collections;
using GH_IO;
using GH_IO.Serialization;
# ---------- constructtreeofnumbers: C# ----------
    DataTree<double> numTree = new DataTree<double>();
    int pathIndex = 0;
    for (int b = 1; b <= branchNum; b++) {
      List<double> numList = new List<double>();
      GH_Path path = new GH_Path(pathIndex);
      pathIndex = pathIndex + 1;
      for (int i = 1; i <= countNum; i++) {
        numList.Add(number * i * b);
      }
      numTree.AddRange(numList, path);
    }
    Numbers = numTree;
# ---------- end constructtreeofnumbers ----------

# ----
# - tree statistics
number_slider_34 = Slider(4, range=0..100)  # disabled
number_slider_35 = Slider(2, range=0..10)  # disabled
plane_5 = Plane(PlaneXY(0, 0, 0))  # disabled
rectangular_7 = Rectangular(Plane=plane_5, SizeX=number_slider_35, SizeY=number_slider_35, ExtentX=number_slider_34, ExtentY=number_slider_34)  # -> Cells, Points; disabled
point_2 = Point(rectangular_7.Points)  # disabled
curve_2 = Curve(rectangular_7.Cells)  # disabled
panel_41 = Panel(curve_2)  # disabled
panel_42 = Panel(point_2)  # disabled
tree_statistics_3 = TreeStatistics(Tree=curve_2)  # -> Paths, Length, Count; disabled
explode_tree_3 = ExplodeTree(Data=curve_2)  # -> Branch0, Branch1, Branch2, Branch3; disabled
explode_tree_4 = ExplodeTree(Data=point_2)  # -> Branch0, Branch1, Branch2, Branch3, Branch4, Branch5; disabled
tree_statistics_4 = TreeStatistics(Tree=point_2)  # -> Paths, Length, Count; disabled
panel_43 = Panel(tree_statistics_3.Paths)  # disabled
panel_44 = Panel(tree_statistics_4.Paths)  # disabled
param_viewer_28 = ParamViewer(panel_42)  # disabled
param_viewer_29 = ParamViewer(panel_41)  # disabled
param_viewer_30 = ParamViewer(panel_44)  # disabled
param_viewer_31 = ParamViewer(panel_43)  # disabled

# ----
# - branches and indicies
gene_pool_2 = GenePool(Decimals=0, Maximum=3, Minimum=0, Value=[2, 0, 1])  # disabled
construct_path_2 = ConstructPath(Indices=gene_pool_2)  # disabled
panel_45 = Panel(construct_path_2)  # disabled
deconstruct_path_2 = DeconstructPath(Branch=panel_45)  # disabled
panel_46 = Panel(deconstruct_path_2)  # disabled

# ----
# - custom user objects
number_slider_36 = Slider(3, range=0..10)  # disabled
number_slider_37 = Slider(3, range=0..10)  # disabled
number_slider_38 = Slider(3, range=0..10)  # disabled
constructtreeofnumbers_2 = ConstructTreeOfNumbers(branchNum=number_slider_36, countNum=number_slider_37, number=number_slider_38)  # -> out, Numbers; inputs branchNum: Int32, countNum: Int32, number: Int32; disabled; same code as constructtreeofnumbers
param_viewer_32 = ParamViewer(constructtreeofnumbers_2.Numbers)  # disabled
panel_47 = Panel(constructtreeofnumbers_2.Numbers)  # disabled

param_viewer_33 = ParamViewer(deconstruct_path)  # disabled

param_viewer_34 = ParamViewer(deconstruct_path_2)  # disabled

number_slider_39 = Slider(4.294, range=-12..12)  # disabled

# ----
# - stream filter and gate
number_slider_40 = Slider(0, range=0..1)  # disabled
stream_gate = StreamGate(Stream=deconstruct_path, Gate=number_slider_40)  # -> Target0, Target1; disabled
panel_48 = Panel(stream_gate.Target1)  # disabled
panel_49 = Panel(stream_gate.Target0)  # disabled
stream_filter_2 = StreamFilter(Gate=0, Stream0=stream_gate.Target0, Stream1=stream_gate.Target1)  # disabled
panel_50 = Panel(stream_filter_2)  # disabled

number_slider_41 = Slider(1, range=0..10)  # disabled

# ----
# - list item is a great tool for data
# paths and branches
# and items(elements)
number_slider_42 = Slider(0, range=0..100)  # disabled
panel_51 = Panel(tree_statistics.Count)  # disabled
list_item = ListItem(List=tree_statistics.Paths, Index=number_slider_41, Wrap=True)  # disabled
tree_item = TreeItem(Tree=rectangular_2.Cells, Path=tree_statistics.Paths, Index=number_slider_42, Wrap=True)  # disabled
tree_branch = TreeBranch(Tree=rectangular_2.Cells, Path=list_item, MaintainPaths=True)  # disabled
panel_52 = Panel(tree_branch)  # disabled
panel_53 = Panel(tree_item)  # disabled

# ----
# - stream filter and gate
number_slider_43 = Slider(0, range=0..1)  # disabled
stream_gate_2 = StreamGate(Stream=deconstruct_path_2, Gate=number_slider_43)  # -> Target0, Target1; disabled
panel_54 = Panel(stream_gate_2.Target1)  # disabled
panel_55 = Panel(stream_gate_2.Target0)  # disabled
stream_filter_3 = StreamFilter(Gate=0, Stream0=stream_gate_2.Target0, Stream1=stream_gate_2.Target1)  # disabled
panel_56 = Panel(stream_filter_3)  # disabled

# ----
# - amazing from BIM Corner
panel_57 = Panel("{0;*;(0,2,...)}[*]")  # disabled
split_tree_2 = SplitTree(Data=cone.Cone, Masks=flatten(panel_57))  # -> Positive, Negative; disabled
unit_z_2 = UnitZ(Factor=number_slider_39)  # disabled
move = Move(Geometry=split_tree_2.Positive, Motion=unit_z_2)  # -> Geometry, Transform; disabled
merge_2 = Merge(Data1=move.Geometry, Data2=split_tree_2.Negative)  # disabled

# ----
# - list item is a great tool for data
# paths and branches
# and items(elements)
number_slider_44 = Slider(21, range=0..100)  # disabled
number_slider_45 = Slider(3, range=0..10)  # disabled
panel_58 = Panel(tree_statistics_3.Count)  # disabled
list_item_2 = ListItem(List=tree_statistics_3.Paths, Index=number_slider_45, Wrap=True)  # disabled
tree_item_2 = TreeItem(Tree=rectangular_7.Cells, Path=tree_statistics_3.Paths, Index=number_slider_44, Wrap=True)  # disabled
panel_59 = Panel(list_item_2)  # disabled
tree_branch_2 = TreeBranch(Tree=rectangular_7.Cells, Path=list_item_2, MaintainPaths=True)  # disabled
panel_60 = Panel(tree_branch_2)  # disabled
panel_61 = Panel(tree_item_2)  # disabled

panel_62 = Panel(list_item)  # disabled

# ----
# - relative item(s)
number_slider_46 = Slider(10, range=0..10)  # disabled
number_slider_47 = Slider(4, range=0..4)  # disabled
number_slider_48 = Slider(4, range=0..10)  # disabled
number_slider_49 = Slider(10, range=0..10)  # disabled
number_slider_50 = Slider(2, range=0..10)  # disabled
number_slider_51 = Slider(3, range=0..10)  # disabled
series_5 = Series(Start=0, Step=number_slider_46, Count=number_slider_47)  # disabled
series_6 = Series(Start=0, Step=number_slider_50, Count=number_slider_51)  # disabled
series_7 = Series(Start=number_slider_49, Step=number_slider_48, Count=number_slider_47)  # disabled
number_slider_52 = Slider(6, range=0..100)  # disabled
cross_reference_5 = CrossReference(ListListA=graft(series_6), ListListB=series_6, ListListC=series_6, CrossMode=1)  # -> ListListA, ListListB, ListListC; disabled
cross_reference_6 = CrossReference(ListListA=series_5, ListListB=series_5, CrossMode=1)  # -> ListListA, ListListB; disabled
cross_reference_7 = CrossReference(ListListA=series_7, ListListB=series_7, CrossMode=1)  # -> ListListA, ListListB; disabled
construct_point_5 = ConstructPoint(XCoordinate=graft(cross_reference_6.ListListA), YCoordinate=cross_reference_6.ListListB, ZCoordinate=0)  # disabled
construct_point_6 = ConstructPoint(
    XCoordinate=cross_reference_5.ListListA,
    YCoordinate=cross_reference_5.ListListB,
    ZCoordinate=cross_reference_5.ListListC)  # disabled
construct_point_7 = ConstructPoint(XCoordinate=graft(cross_reference_7.ListListA), YCoordinate=cross_reference_7.ListListB, ZCoordinate=number_slider_52)  # disabled
panel_64 = Panel("{0;0;0}[1]")  # disabled
panel_65 = Panel("{0;0;0}[3]")  # disabled
panel_66 = Panel("{0;0;0}[1]")  # disabled
panel_67 = Panel("{0;0;0}[2]")  # disabled
boolean_toggle_2 = BooleanToggle(False)  # disabled
cone_2 = Cone(Base=construct_point_6, Radius=0.5, Length=1)  # -> Cone, Tip; disabled
boolean_toggle_3 = BooleanToggle(True)  # disabled
relative_item = RelativeItem(Tree=construct_point_6, Offset=panel_66, WrapPaths=boolean_toggle_2, WrapItems=boolean_toggle_2)  # -> ItemA, ItemB; disabled
relative_items = RelativeItems(
    TreeA=construct_point_5,
    TreeB=construct_point_7,
    Offset=panel_64,
    WrapPaths=boolean_toggle_3,
    WrapItems=boolean_toggle_3)  # -> ItemA, ItemB; disabled
geometry = Geometry(relative_item.ItemB)  # disabled
geometry_2 = Geometry(relative_item.ItemA)  # disabled
geometry_3 = Geometry(relative_items.ItemA)  # disabled
geometry_4 = Geometry(relative_items.ItemB)  # disabled
line = Line(StartPoint=geometry_2, EndPoint=geometry)  # disabled
number_slider_53 = Slider(2, range=0..10)  # disabled
line_2 = Line(StartPoint=geometry_3, EndPoint=geometry_4)  # disabled
cap_holes = CapHoles(Brep=geometry_2)  # disabled
multipipe = MultiPipe(Curves=line_2, NodeSize=0.5, EndOffset=1, StrutSize=1, Segment=0, KinkAngle=0.6, CubeFit=0, Caps=0)  # disabled
sphere = Sphere(Base=[construct_point_5, construct_point_7], Radius=number_slider_53)  # disabled
panel_68 = Panel("1")  # disabled
volume = Volume(Geometry=cap_holes)  # -> Volume, Centroid; disabled
unit_x = UnitX(Factor=1)  # disabled
pi = Pi(Factor=panel_68)  # disabled
rotate_3d = Rotate3D(Geometry=cap_holes, Angle=pi, Center=volume.Centroid, Axis=unit_x)  # -> Geometry, Transform; disabled
merge_3 = Merge(Data1=rotate_3d.Geometry, Data2=geometry)  # disabled

# ----
# - relative item(s)
number_slider_54 = Slider(10, range=0..10)
number_slider_55 = Slider(4, range=0..5)
series_8 = Series(Start=0, Step=number_slider_54, Count=number_slider_55)
series_9 = Series(Start=0, Step=Slider(2, range=0..10), Count=Slider(3, range=0..10))
series_10 = Series(Start=Slider(10, range=0..10), Step=Slider(4, range=0..10), Count=number_slider_55)
cross_reference_8 = CrossReference(ListListA=graft(series_9), ListListB=series_9, ListListC=series_9, CrossMode=1)  # -> ListListA, ListListB, ListListC
cross_reference_9 = CrossReference(ListListA=series_8, ListListB=series_8, CrossMode=1)  # -> ListListA, ListListB
cross_reference_10 = CrossReference(ListListA=series_10, ListListB=series_10, CrossMode=1)  # -> ListListA, ListListB
construct_point_8 = ConstructPoint(XCoordinate=graft(cross_reference_9.ListListA), YCoordinate=cross_reference_9.ListListB, ZCoordinate=0)
construct_point_9 = ConstructPoint(
    XCoordinate=cross_reference_8.ListListA,
    YCoordinate=cross_reference_8.ListListB,
    ZCoordinate=cross_reference_8.ListListC)
construct_point_10 = ConstructPoint(
    XCoordinate=graft(cross_reference_10.ListListA),
    YCoordinate=cross_reference_10.ListListB,
    ZCoordinate=Slider(12, range=0..20))
panel_69 = Panel("{0;0;1}[1]")
panel_70 = Panel("{0;0;0}[1]")
panel_72 = Panel("{0;0;0}[3]")
panel_73 = Panel("{0;0;0}[2]")
boolean_toggle_4 = BooleanToggle(False)
param_viewer_35 = ParamViewer(construct_point_9)
boolean_toggle_5 = BooleanToggle(False)
relative_item_2 = RelativeItem(Tree=construct_point_9, Offset="{0;0;0}[5]", WrapPaths=boolean_toggle_4, WrapItems=boolean_toggle_4)  # -> ItemA, ItemB
relative_items_2 = RelativeItems(
    TreeA=construct_point_8,
    TreeB=construct_point_10,
    Offset="{0;0;2}[1]",
    WrapPaths=boolean_toggle_5,
    WrapItems=boolean_toggle_5)  # -> ItemA, ItemB
param_viewer_36 = ParamViewer(relative_items_2.ItemA)
param_viewer_37 = ParamViewer(relative_item_2.ItemA)
geometry_5 = Geometry(relative_item_2.ItemB)
geometry_6 = Geometry(relative_item_2.ItemA)
geometry_7 = Geometry(relative_items_2.ItemA)
geometry_8 = Geometry(relative_items_2.ItemB)
cone_3 = Cone(Base=geometry_5, Radius=0.5, Length=1)  # -> Cone, Tip
cone_4 = Cone(Base=geometry_6, Radius=0.5, Length=1)  # -> Cone, Tip
line_3 = Line(StartPoint=geometry_6, EndPoint=geometry_5)
line_4 = Line(StartPoint=geometry_7, EndPoint=geometry_8)
cap_holes_2 = CapHoles(Brep=cone_3.Cone)
cap_holes_3 = CapHoles(Brep=cone_4.Cone)
multipipe_2 = MultiPipe(Curves=line_4, NodeSize=0.5, EndOffset=1, StrutSize=1, Segment=0, KinkAngle=0.6, CubeFit=0, Caps=0)
mesh_sphere = MeshSphere(Base=[construct_point_8, construct_point_10], Radius=Slider(2, range=0..10), UCount=10, VCount=20)
volume_2 = Volume(Geometry=cap_holes_2)  # -> Volume, Centroid
unit_x_2 = UnitX(Factor=1)
volume_3 = Volume(Geometry=cap_holes_3)  # -> Volume, Centroid
unit_x_3 = UnitX(Factor=1)
pi_2 = Pi(Factor="0")
pi_3 = Pi(Factor="1")
rotate_3d_2 = Rotate3D(Geometry=cap_holes_3, Angle=pi_3, Center=volume_3.Centroid, Axis=unit_x_3)  # -> Geometry, Transform
rotate_3d_3 = Rotate3D(Geometry=cap_holes_2, Angle=pi_2, Center=volume_2.Centroid, Axis=unit_x_2)  # -> Geometry, Transform
merge_4 = Merge(Data1=rotate_3d_2.Geometry, Data2=rotate_3d_3.Geometry)

# ----
# - entwine is a great organizational node
# - notince the subtle difference with the
#  merge node
# and the major difference with the
# weave node
number_slider_56 = Slider(0.5, range=0..2)  # disabled
unit_x_4 = UnitX(Factor=1)  # disabled
pi_4 = Pi(Factor=number_slider_56)  # disabled
rotate_3d_4 = Rotate3D(Geometry=graft(circle_2), Angle=pi_4, Center=Point(0, 0, 0), Axis=[unit_x_4, unit_y, unit_z])  # -> flatten(Geometry), Transform; disabled
panel_74 = Panel(rotate_3d_4.Geometry)  # disabled
param_viewer_38 = ParamViewer(rotate_3d_4.Geometry)  # disabled
merge_5 = Merge(Data1=circle_2, Data2=rotate_3d_4.Geometry)  # disabled
entwine = Entwine(Branch00=circle_2, Branch01=rotate_3d_4.Geometry, FlattenInputs=True)  # disabled
circle_3 = Circle(rotate_3d_4.Geometry)  # disabled
circle_4 = Circle(circle_2)  # disabled
panel_75 = Panel(merge_5)  # disabled
dispatch = Dispatch(List=entwine, DispatchPattern=[True, False])  # -> ListA, ListB; disabled
circle_5 = Circle(dispatch.ListA)  # disabled
circle_6 = Circle(dispatch.ListB)  # disabled
multipipe_3 = MultiPipe(Curves=circle_5, NodeSize=number_slider_12, EndOffset=1, StrutSize=1, Segment=0, KinkAngle=0.6, CubeFit=0, Caps=0)  # disabled
panel_76 = Panel(entwine)  # disabled

weave = Weave(Pattern=[0, 1], Stream0=circle_2, Stream1=rotate_3d_4.Geometry, NullGaps=False)  # disabled

multipipe_4 = MultiPipe(Curves=weave, NodeSize=0.5, EndOffset=1, StrutSize=1, Segment=0, KinkAngle=0.6, CubeFit=0, Caps=0)  # disabled

# ----
# - how to use masks
# - consider
# Path Compare
# and
# Replace Paths
# Nodes
number_slider_57 = Slider(2, range=0..10)  # disabled
number_slider_58 = Slider(5, range=0..10)  # disabled
series_11 = Series(Start=0, Step=number_slider_57, Count=number_slider_58)  # disabled
cross_reference_11 = CrossReference(ListListA=graft(series_11), ListListB=series_11, ListListC=series_11, CrossMode=1)  # -> ListListA, ListListB, ListListC; disabled
construct_point_11 = ConstructPoint(
    XCoordinate=cross_reference_11.ListListA,
    YCoordinate=cross_reference_11.ListListB,
    ZCoordinate=cross_reference_11.ListListC)  # disabled
cone_5 = Cone(Base=construct_point_11, Radius=0.5, Length=1)  # -> Cone, Tip; disabled
param_viewer_39 = ParamViewer(construct_point_11)  # disabled
param_viewer_40 = ParamViewer(construct_point_11)  # disabled
panel_77 = Panel(construct_point_11)  # disabled
number_slider_59 = Slider(7.004, range=-12..12)  # disabled
panel_81 = Panel("{0;0;1}[(1to3)]")  # disabled
panel_83 = Panel("{0;0;1}[(3to4)or(7to8)]")  # disabled
split_tree_3 = SplitTree(Data=cone_5.Cone, Masks=flatten(panel_83))  # -> Positive, Negative; disabled
path_compare_2 = PathCompare(Mask="*")  # disabled
replace_paths_2 = ReplacePaths(Search="*")  # disabled
panel_86 = Panel(split_tree_3.Positive)  # disabled

# ----
# - amazing from BIM Corner
panel_87 = Panel("{0;*;(0,2,...)}[*]")  # disabled
split_tree_4 = SplitTree(Data=cone_5.Cone, Masks=flatten(panel_87))  # -> Positive, Negative; disabled
unit_z_3 = UnitZ(Factor=number_slider_59)  # disabled
move_2 = Move(Geometry=split_tree_4.Positive, Motion=unit_z_3)  # -> Geometry, Transform; disabled

cylinder = Cylinder(Base=split_tree_4.Negative, Radius=0.5, Length=1)  # disabled
sphere_2 = Sphere(Base=move_2.Geometry, Radius=1)  # disabled

merge_6 = Merge(Data1=sphere_2, Data2=cylinder)  # disabled
