# Grasshopper definition EX_012_sets_pathmapper_(revisited).gh (Grasshopper 1.0.7)

# ----
# EXERCISES_SETS
# 012_PathMapper(revisited)
# - Pathmapper meets BIM Corner and Daniel Christev
number_slider = Slider(5.88, range=0..10)  # disabled
number_slider_2 = Slider(10, range=0..10)  # disabled
series = Series(Start=0, Step=number_slider, Count=number_slider_2)  # disabled
construct_point = ConstructPoint(XCoordinate=graft(series), YCoordinate=series, ZCoordinate=0)  # disabled
unit_z = UnitZ(Factor=series)  # disabled
move = Move(Geometry=graft(construct_point), Motion=unit_z)  # -> simplify(Geometry), Transform; disabled
path_mapper = PathMapper(move.Geometry, source="{A;B}(i)", target="{item_count - 1 - A;item_count - 1 - B}(i)")  # disabled
path_mapper_2 = PathMapper(move.Geometry, source="{A;B}(i)", target="{A;B}(item_count - 1 - i)")  # disabled
path_mapper_3 = PathMapper(move.Geometry, source="{A;B}(i)", target="{item_count - 1 -i; B}(A)")  # disabled
path_mapper_4 = PathMapper(move.Geometry, source="{A;B}(i)", target="{A;item_count - 1 -i}(B)")  # disabled
path_mapper_5 = PathMapper(move.Geometry, source="{A;B}", target="{path_index}")  # disabled
path_mapper_6 = PathMapper(move.Geometry, source="{A;B}", target="{path_count}")  # disabled
path_mapper_7 = PathMapper(move.Geometry, source="{A;B}", target="{path_count/3}")  # disabled
path_mapper_8 = PathMapper(move.Geometry, source="{A;B}", target="{A}")  # disabled
path_mapper_9 = PathMapper(move.Geometry, source="{A;B}(i)", target="{A;B;i}")  # disabled
path_mapper_10 = PathMapper(move.Geometry, source="{A;B}", target="{A;B}")  # disabled
number_slider_3 = Slider(1.644, range=0..3)  # disabled
path_mapper_11 = PathMapper(move.Geometry, source="{A;B}", target="{0}")  # disabled
point_list = PointList(Points=path_mapper_10, Size=number_slider_3)  # disabled
point_list_2 = PointList(Points=path_mapper_4, Size=number_slider_3)  # disabled
point_list_3 = PointList(Points=path_mapper_3, Size=number_slider_3)  # disabled
panel = Panel(path_mapper_8)  # disabled
panel_2 = Panel(path_mapper_10)  # disabled
panel_3 = Panel(path_mapper_11)  # disabled
panel_4 = Panel(path_mapper_9)  # disabled
panel_5 = Panel(path_mapper_5)  # disabled
panel_6 = Panel(path_mapper_6)  # disabled
panel_7 = Panel(path_mapper)  # disabled
panel_8 = Panel(path_mapper_2)  # disabled
panel_9 = Panel(path_mapper_4)  # disabled
param_viewer = ParamViewer(panel_3)  # disabled
param_viewer_2 = ParamViewer(panel_2)  # disabled
param_viewer_3 = ParamViewer(panel_4)  # disabled
param_viewer_4 = ParamViewer(panel)  # disabled
param_viewer_5 = ParamViewer(panel_8)  # disabled
param_viewer_6 = ParamViewer(panel_5)  # disabled
param_viewer_7 = ParamViewer(panel_6)  # disabled
param_viewer_8 = ParamViewer(panel_7)  # disabled
param_viewer_9 = ParamViewer(panel_9)  # disabled
