# Grasshopper definition EX_013_vector_grid.gh (Grasshopper 1.0.7)
# plug-ins: Bifocals

# ----
# - consider what you could do with populate geometry
# on the surface and inside the form
number_slider = Slider(12, range=0..100)  # disabled
cylinder = Cylinder(Base=PlaneXY(0, 0, 0), Radius=number_slider, Length=number_slider)  # disabled
cap_holes = CapHoles(Brep=cylinder)  # disabled
populate_geometry = PopulateGeometry(Geometry=cap_holes, Count=100, Seed=1)  # disabled
populate_geometry_2 = PopulateGeometry(Geometry=cylinder, Count=100, Seed=1)  # disabled

# ----
# EXERCISES_VECTOR
# 013_vector_grid
# - check out Dr. Vector at ParametricCamp
number_slider_2 = Slider(10, range=0..10)  # disabled
number_slider_3 = Slider(10, range=0..10)  # disabled
yz_plane = YZPlane(Origin=Point(0, 0, 0))  # disabled
rectangular = Rectangular(Plane=yz_plane, SizeX=number_slider_2, SizeY=number_slider_2, ExtentX=number_slider_3, ExtentY=number_slider_3)  # -> Cells, Points; disabled
hexagonal = Hexagonal(Plane=yz_plane, Size=number_slider_2, ExtentX=number_slider_3, ExtentY=number_slider_3)  # -> Cells, Points; disabled
square = Square(Plane=yz_plane, Size=number_slider_3, ExtentX=number_slider_3, ExtentY=number_slider_3)  # -> Cells, Points; disabled
radial = Radial(Plane=yz_plane, Size=number_slider_3, ExtentR=number_slider_3, ExtentP=number_slider_3)  # -> Cells, Points; disabled
triangular = Triangular(Plane=yz_plane, Size=number_slider_3, ExtentX=number_slider_3, ExtentY=number_slider_3)  # -> Cells, Points; disabled
multiplication = Multiplication(A=number_slider_3, B=number_slider_3)  # disabled
bounding_box = BoundingBox(Content=flatten(hexagonal.Cells), Plane=PlaneXY(0, 0, 0), UnionBox=True)  # -> Box, Box_2; disabled
unit_x = UnitX(Factor=multiplication)  # disabled
number_slider_4 = Slider(17, range=0..100)  # disabled
number_slider_5 = Slider(5, range=0..10)  # disabled
extrude = Extrude(Base=hexagonal.Cells, Direction=unit_x)  # disabled
populate_2d = Populate2D(Region=hexagonal.Cells, Count=number_slider_5, Seed=number_slider_4)  # disabled
populate_3d = Populate3D(Region=extrude, Count=number_slider_5, Seed=number_slider_4)  # disabled
bounding_box_2 = BoundingBox(Content=flatten(extrude), Plane=PlaneXY(0, 0, 0), UnionBox=True)  # -> Box, Box_2; disabled
dispatch = Dispatch(List=populate_2d, DispatchPattern=[True, False])  # -> ListA, ListB; disabled
dispatch_2 = Dispatch(List=populate_3d, DispatchPattern=[True, False])  # -> ListA, ListB; disabled
boolean_toggle = BooleanToggle(True)  # disabled
interpolate = Interpolate(Vertices=dispatch.ListA, Degree=3, Periodic=boolean_toggle, KnotStyle=1)  # -> simplify(flatten(Curve)), Length, Domain; disabled
number_slider_6 = Slider(5, range=0..10)  # disabled
interpolate_2 = Interpolate(Vertices=[dispatch_2.ListA, dispatch_2.ListB], Degree=3, Periodic=boolean_toggle, KnotStyle=1)  # -> Curve, Length, Domain; disabled
surface_split = SurfaceSplit(Surface=bounding_box.Box, Curves=interpolate.Curve)  # disabled
pipe = Pipe(Curve=interpolate_2.Curve, Radius=number_slider_6, Caps=1)  # -> simplify(flatten(Pipe)); disabled
list_item = ListItem(List=surface_split, Index=0, Wrap=True)  # disabled
solid_difference = SolidDifference(BrepsA=bounding_box_2.Box, BrepsB=pipe)  # disabled
