# Grasshopper definition EX_014_vector_plane.gh (Grasshopper 1.0.7)
# plug-ins: Bifocals

number_slider = Slider(7, range=0..100)  # disabled
panel = Panel("100")  # disabled
range = Range(Domain=number_slider, Steps=panel)  # disabled
sine = Sine(Value=range)  # disabled
cosine = Cosine(Value=range)  # disabled
multiplication = Multiplication(A=sine, B=number_slider)  # disabled
multiplication_2 = Multiplication(A=cosine, B=number_slider)  # disabled
construct_point = ConstructPoint(XCoordinate=multiplication, YCoordinate=multiplication_2, ZCoordinate=range)  # disabled

# ----
# EXERCISES_VECTOR
# 014_vector_plane
# - figure out how to control your grasshopper
# construction planes similar to how you can utilize
# construction planes in Rhino3D environment
number_slider_2 = Slider(12, range=0..100)  # disabled
panel_2 = Panel("100")  # disabled
range_2 = Range(Domain=number_slider_2, Steps=panel_2)  # disabled
sine_2 = Sine(Value=range_2)  # disabled
cosine_2 = Cosine(Value=range_2)  # disabled
multiplication_3 = Multiplication(A=sine_2, B=number_slider_2)  # disabled
multiplication_4 = Multiplication(A=cosine_2, B=number_slider_2)  # disabled
construct_point_2 = ConstructPoint(XCoordinate=number_slider_2, YCoordinate=multiplication_3, ZCoordinate=multiplication_4)  # disabled
number_slider_3 = Slider(2, range=0..10)  # disabled
interpolate = Interpolate(Vertices=construct_point_2, Degree=3, Periodic=False, KnotStyle=1)  # -> Curve, Length, Domain; disabled
divide_curve = DivideCurve(Curve=interpolate.Curve, Count=number_slider_3, Kinks=False)  # -> Points, Tangents, Parameters; disabled
list_item = ListItem(List=divide_curve.Points, Index=0, Wrap=True)  # disabled
xy_plane = XYPlane(Origin=Point(0, 0, 0))  # disabled
xz_plane = XZPlane(Origin=Point(0, 0, 0))  # disabled
yz_plane = YZPlane(Origin=Point(0, 0, 0))  # disabled
plane_normal = PlaneNormal(Origin=list_item, ZAxis=xy_plane)  # disabled
construct_plane = ConstructPlane(Origin=list_item, XAxis=xy_plane, YAxis=xz_plane)  # disabled
curve = Curve(interpolate.Curve)  # disabled
deconstruct_plane = DeconstructPlane(Plane=construct_plane)  # -> Origin, XAxis, YAxis, ZAxis; disabled
xy_plane_2 = XYPlane(Origin=deconstruct_plane.XAxis)  # disabled
xz_plane_2 = XZPlane(Origin=deconstruct_plane.YAxis)  # disabled
yz_plane_2 = YZPlane(Origin=deconstruct_plane.ZAxis)  # disabled
number_slider_4 = Slider(0, range=0..2)  # disabled
plane_origin = PlaneOrigin(Base=yz_plane_2, Origin=deconstruct_plane.Origin)  # disabled
boolean_toggle = BooleanToggle(True)  # disabled
boolean_toggle_2 = BooleanToggle(True)  # disabled
boolean_toggle_3 = BooleanToggle(False)  # disabled
flip_plane = FlipPlane(Plane=plane_origin, ReverseX=boolean_toggle, ReverseY=boolean_toggle_2, SwapAxes=boolean_toggle_3)  # disabled
pi = Pi(Factor=number_slider_4)  # disabled
rotate_plane = RotatePlane(Plane=flip_plane, Angle=pi)  # disabled
rotate = Rotate(Angle=1.570796327, Plane=PlaneXY(0, 0, 0))  # -> Geometry, Transform; disabled
rotate_3d = Rotate3D(Angle=1.570796327, Center=Point(0, 0, 0), Axis=Vector(0, 0, 1))  # -> Geometry, Transform; disabled
rotate_axis = RotateAxis(Angle=1.570796327, Axis=Line((0, 0, 0), (10, 0, 0)))  # -> Geometry, Transform; disabled
rotate_direction = RotateDirection(Center=Point(0, 0, 0), From=Vector(1, 0, 0), To=Vector(0, 1, 0))  # -> Geometry, Transform; disabled
plane_closest_point = PlaneClosestPoint(Point=construct_point, Plane=rotate_plane)  # -> Point, UVPoint, Distance; disabled
line = Line(StartPoint=construct_point, EndPoint=plane_closest_point.Point)  # disabled
loft = Loft(Curves=line, Options={Adjust=False, Closed=False, LoftEnds=0, LoftSimp=0, LoftType=0, Rebuild=10, Refit=0.01})  # disabled

# ----
# -understanding plane manipulation is essential
# for understanding robotic tool paths and
# organizing axis origins and planes
# 
# - try creating diffenent planes in on the gh canvas
number_slider_5 = Slider(67, range=0..100)  # disabled
quad_sphere = QuadSphere(Base=PlaneXY(0, 0, 0), Radius=1)  # disabled
panel_3 = Panel("2")  # disabled
panel_4 = Panel("2")  # disabled
populate_geometry = PopulateGeometry(Geometry=quad_sphere, Count=panel_3, Seed=1)  # disabled
populate_geometry_2 = PopulateGeometry(Geometry=quad_sphere, Count=panel_4, Seed=number_slider_5)  # disabled
dispatch = Dispatch(List=populate_geometry_2, DispatchPattern=[True, False])  # -> ListA, ListB; disabled
dispatch_2 = Dispatch(List=populate_geometry, DispatchPattern=[True, False])  # -> ListA, ListB; disabled
line_2 = Line(StartPoint=dispatch.ListA, EndPoint=dispatch.ListB)  # disabled
line_3 = Line(StartPoint=dispatch_2.ListA, EndPoint=dispatch_2.ListB)  # disabled
plane_3pt = Plane3Pt(PointA=dispatch_2.ListA, PointB=dispatch_2.ListB, PointC=dispatch.ListA)  # disabled
plane_fit = PlaneFit(Points=[populate_geometry, populate_geometry_2])  # -> Plane, Deviation; disabled
line_line = LineLine(LineA=line_3, LineB=line_2)  # disabled
line_pt = LinePt(Line=line_3, Point=populate_geometry_2)  # disabled
number_slider_6 = Slider(4.2, range=0..10)  # disabled
plane_normal_2 = PlaneNormal(Origin=line_pt, ZAxis=Vector(0, 0, 1))  # disabled
deconstruct = Deconstruct(Point=dispatch.ListA)  # -> XComponent, YComponent, ZComponent; disabled
plane_offset = PlaneOffset(BasePlane=line_line, Offset=number_slider_6)  # disabled
adjust_plane = AdjustPlane(Plane=line_line, Normal=plane_normal_2)  # disabled
vector_xyz = VectorXYZ(XComponent=deconstruct.XComponent, YComponent=deconstruct.YComponent, ZComponent=deconstruct.ZComponent)  # -> Vector, Length; disabled
align_plane = AlignPlane(Plane=plane_offset, Direction=vector_xyz.Vector)  # -> Plane, Angle; disabled
vector_display = VectorDisplay(Anchor=dispatch.ListA, Vector=vector_xyz.Vector)  # disabled
number_slider_7 = Slider(0.1, range=0.1..1.1)  # disabled
number_slider_8 = Slider(10, range=0..10)  # disabled
plane_coordinates = PlaneCoordinates(Point=align_plane.Plane, System=PlaneXY(0, 0, 0))  # -> XCoordinate, YCoordinate, ZCoordinate; disabled
number_slider_9 = Slider(0.1, range=0.1..1.1)  # disabled
panel_5 = Panel("2")  # disabled
multiplication_5 = Multiplication(A=number_slider_8, B=panel_5)  # disabled
panel_6 = Panel([plane_coordinates.XCoordinate, plane_coordinates.YCoordinate, plane_coordinates.ZCoordinate])  # disabled
construct_domain = ConstructDomain(DomainStart=number_slider_9, DomainEnd=multiplication_5)  # disabled
construct_domain_2 = ConstructDomain(DomainStart=number_slider_7, DomainEnd=number_slider_8)  # disabled
integer = Integer(number_slider_8)  # disabled
range_3 = Range(Domain=construct_domain_2, Steps=10)  # disabled
range_4 = Range(Domain=construct_domain, Steps=integer)  # disabled

number_slider_10 = Slider(24, range=0..100)  # disabled
number_slider_11 = Slider(31, range=0..100)  # disabled
ellipse = Ellipse(Plane=PlaneXY(0, 0, 0), Radius1=number_slider_10, Radius2=number_slider_11)  # -> Ellipse, Focus1, Focus2; disabled
perp_frames = PerpFrames(Curve=ellipse.Ellipse, Count=10, Align=True)  # -> Frames, Parameters; disabled
xy_plane_3 = XYPlane(Origin=Point(0, 0, 0))  # disabled
xz_plane_3 = XZPlane(Origin=Point(0, 0, 0))  # disabled
yz_plane_3 = YZPlane(Origin=Point(0, 0, 0))  # disabled
align_planes = AlignPlanes(Planes=perp_frames.Frames, Master=graft([adjust_plane, xy_plane_3, xz_plane_3, yz_plane_3]))  # -> flatten(Planes); disabled

polygon = Polygon(Plane=graft(align_planes), Radius=range_3, Segments=6, FilletRadius=0)  # -> Polygon, Length; disabled
area = Area(Geometry=polygon.Polygon)  # -> Area, Centroid; disabled
rotate_3d_2 = Rotate3D(Geometry=polygon.Polygon, Angle=range_4, Center=area.Centroid, Axis=Vector(0, 0, 1))  # -> Geometry, Transform; disabled
