# Grasshopper definition EX_015_vector_point.gh (Grasshopper 1.0.7)
# plug-ins: Bifocals, Kangaroo2 Components

# ----
# EXERCISES_VECTOR
# 015_vector_point
# - construct point is one of the most
# important nodes for creating your
# own algorithmic and computational
# geometries
gene_pool = GenePool(Decimals=2, Maximum=10, Minimum=0, Value=[0, 4.67, 10])  # disabled
construct_point = ConstructPoint(XCoordinate=graft(gene_pool), YCoordinate=gene_pool, ZCoordinate=0)  # disabled
unit_z = UnitZ(Factor=gene_pool)  # disabled
move = Move(Geometry=graft(construct_point), Motion=unit_z)  # -> Geometry, Transform; disabled
interpolate = Interpolate(Vertices=move.Geometry, Degree=3, Periodic=False, KnotStyle=1)  # -> Curve, Length, Domain; disabled
panel = Panel("{0;*;*}[1]")  # disabled
split_tree = SplitTree(Data=move.Geometry, Masks=flatten(panel))  # -> Positive, Negative; disabled
deconstruct = Deconstruct(Point=move.Geometry)  # -> XComponent, YComponent, ZComponent; disabled
point = Point(split_tree.Positive)  # disabled
point_2 = Point(split_tree.Negative)  # disabled
panel_2 = Panel(deconstruct.XComponent)  # disabled
clean_tree = CleanTree(RemoveNulls=True, RemoveInvalid=True, RemoveEmpty=False, Tree=point)  # disabled
clean_tree_2 = CleanTree(RemoveNulls=True, RemoveInvalid=True, RemoveEmpty=False, Tree=point_2)  # disabled
panel_3 = Panel(deconstruct.YComponent)  # disabled
number_slider = Slider(0, range=0..2)  # disabled
panel_4 = Panel("4")  # disabled
panel_5 = Panel(deconstruct.ZComponent)  # disabled
list_item = ListItem(List=flatten(clean_tree), Index=panel_4, Wrap=True)  # disabled
pi = Pi(Factor=number_slider)  # disabled
plane_origin = PlaneOrigin(Base=list_item, Origin=list_item)  # disabled
rotate = Rotate(Geometry=clean_tree, Angle=pi, Plane=plane_origin)  # -> Geometry, Transform; disabled
dispatch = Dispatch(List=rotate.Geometry, DispatchPattern=[True, False])  # -> ListA, ListB; disabled
number_slider_2 = Slider(0.13, range=0..1)  # disabled
line = Line(StartPoint=flatten(clean_tree_2), EndPoint=rotate.Geometry)  # disabled
distance = Distance(PointA=dispatch.ListA, PointB=dispatch.ListB)  # disabled
multipipe = MultiPipe(Curves=line, NodeSize=number_slider_2, EndOffset=1, StrutSize=1, Segment=0, KinkAngle=0.6, CubeFit=0, Caps=0)  # disabled
panel_6 = Panel(distance)  # disabled

# ----
# - creating your own geometries with projecting points
# and sorting points
number_slider_3 = Slider(5, range=0..10)  # disabled
square = Square(Plane=PlaneXY(0, 0, 0), Size=1, ExtentX=number_slider_3, ExtentY=number_slider_3)  # -> Cells, Points; disabled
rectangular = Rectangular(Plane=PlaneXY(0, 0, 0), SizeX=1, SizeY=2, ExtentX=number_slider_3, ExtentY=number_slider_3)  # -> Cells, Points; disabled
hexagonal = Hexagonal(Plane=PlaneXY(0, 0, 0), Size=1, ExtentX=number_slider_3, ExtentY=number_slider_3)  # -> Cells, Points; disabled
triangular = Triangular(Plane=PlaneXY(0, 0, 0), Size=1, ExtentX=number_slider_3, ExtentY=number_slider_3)  # -> Cells, Points; disabled
number_slider_4 = Slider(84, range=0..100)  # disabled
merge = Merge(Data1=rectangular.Points, Data2=square.Points, Data3=hexagonal.Points, Data4=triangular.Points)  # -> flatten(Result); disabled
param_viewer = ParamViewer(merge)  # disabled
quad_sphere = QuadSphere(Base=PlaneXY(0, 0, 0), Radius=number_slider_3)  # disabled
cull_duplicates = CullDuplicates(Points=merge, Tolerance=0.1, CullMode=3)  # -> Points, Indices, Valence; disabled
list_item_2 = ListItem(List=flatten(hexagonal.Cells), Index=number_slider_4, Wrap=True)  # disabled
deconstruct_brep = DeconstructBrep(Brep=quad_sphere)  # -> Faces, Edges, Vertices; disabled
param_viewer_2 = ParamViewer(cull_duplicates.Points)  # disabled
interpolate_2 = Interpolate(Vertices=cull_duplicates.Points, Degree=3, Periodic=False, KnotStyle=1)  # -> Curve, Length, Domain; disabled
sort_points = SortPoints(Points=cull_duplicates.Points)  # -> Points, Indices; disabled
list_item_3 = ListItem(List=deconstruct_brep.Faces, Index=0, Wrap=True)  # disabled
interpolate_3 = Interpolate(Vertices=sort_points.Points, Degree=3, Periodic=False, KnotStyle=1)  # -> Curve, Length, Domain; disabled
sort_along_curve = SortAlongCurve(Points=sort_points.Points, Curve=list_item_2)  # -> Points, Indices; disabled
interpolate_4 = Interpolate(Vertices=sort_along_curve.Points, Degree=3, Periodic=False, KnotStyle=1)  # -> Curve, Length, Domain; disabled
unit_z_2 = UnitZ(Factor=1)  # disabled
project_point = ProjectPoint(Point=flatten(sort_along_curve.Points), Direction=unit_z_2, Geometry=list_item_3)  # -> Point, Index; disabled
number_slider_5 = Slider(9, range=0..10)  # disabled
gene_pool_2 = GenePool(Decimals=3, Maximum=1, Minimum=0, Value=[0.164, 0.267, 0.379, 0.5, 0.56, 0.626, 0.699, 0.812, 0.935, 1])  # disabled
clean_tree_3 = CleanTree(RemoveNulls=True, RemoveInvalid=True, RemoveEmpty=False, Tree=project_point.Point)  # disabled
range = Range(Domain=Domain(0, 1), Steps=number_slider_5)  # disabled
sort_points_2 = SortPoints(Points=clean_tree_3)  # -> Points, Indices; disabled
interpolate_5 = Interpolate(Vertices=clean_tree_3, Degree=3, Periodic=False, KnotStyle=1)  # -> Curve, Length, Domain; disabled
graph_mapper = GraphMapper(
    range,
    x0=0,
    x1=1,
    y0=0,
    y1=1,
    container_name="Sine",
    Equation_px=[0, 0.3154438436],
    Equation_py=[0.03192579746, 0.1892549992])  # disabled
pipe_variable = PipeVariable(Curve=reparameterize(interpolate_5.Curve), Parameters=gene_pool_2, Radii=graph_mapper, Caps=0)  # disabled

# ----
# - closesty and point and points
number_slider_6 = Slider(67, range=50..70)  # disabled
panel_7 = Panel("4")  # disabled
range_2 = Range(Domain=number_slider_6, Steps=panel_7)  # disabled
rectangular_2 = Rectangular(Plane=PlaneXY(0, 0, 0), SizeX=panel_7, SizeY=panel_7, ExtentX=panel_7, ExtentY=panel_7)  # -> Cells, Points; disabled
md_slider = MDSlider(
    SliderMode=0,
    slider_value=Point(0.6438405107, 0.5249946408, 0.5),
    x_domain=Domain(0, 1),
    y_domain=Domain(0, 1),
    z_domain=Domain(0, 1))  # disabled
unit_z_3 = UnitZ(Factor=range_2)  # disabled
surface = Surface(reparameterize(rectangular_2.Cells))  # disabled
point_3 = Point(rectangular_2.Points)  # disabled
evaluate_surface = EvaluateSurface(Surface=reparameterize(surface), Point=md_slider)  # -> Point, Normal, UDirection, VDirection, Frame; disabled
number_slider_7 = Slider(51, range=0..100)  # disabled
number_slider_8 = Slider(54, range=0..100)  # disabled
move_2 = Move(Geometry=graft(rectangular_2.Points), Motion=unit_z_3)  # -> Geometry, Transform; disabled
expression = Expression(x=panel_7, Expression="x+1")  # disabled
bounding_box = BoundingBox(Content=flatten(move_2.Geometry), Plane=PlaneXY(0, 0, 0), UnionBox=True)  # -> Box, Box_2; disabled
move_3 = Move(Geometry=graft(evaluate_surface.Point), Motion=unit_z_3)  # -> Geometry, Transform; disabled
bounding_box_2 = BoundingBox(Content=flatten(move_3.Geometry), Plane=PlaneXY(0, 0, 0), UnionBox=True)  # -> Box, Box_2; disabled
populate_geometry = PopulateGeometry(Geometry=bounding_box.Box, Count=expression, Seed=number_slider_7)  # disabled
populate_geometry_2 = PopulateGeometry(Geometry=bounding_box_2.Box, Count=expression, Seed=number_slider_8)  # disabled
closest_points = ClosestPoints(Point=evaluate_surface.Point, Cloud=populate_geometry, Count=expression)  # -> ClosestPoint, CPIndex, Distance; disabled
closest_point = ClosestPoint(Point=move_3.Geometry, Cloud=populate_geometry_2)  # -> ClosestPoint, CPIndex, Distance; disabled
panel_8 = Panel("{0;*}[(0,2,...)]")  # disabled
panel_9 = Panel("{(0,2,...);(1,3,...)}[(*)]")  # disabled
line_2 = Line(StartPoint=move_2.Geometry, EndPoint=closest_points.ClosestPoint)  # -> simplify(Line); disabled
line_3 = Line(StartPoint=move_3.Geometry, EndPoint=closest_point.ClosestPoint)  # -> simplify(Line); disabled
point_4 = Point(closest_points.ClosestPoint)  # disabled
point_5 = Point(closest_point.ClosestPoint)  # disabled
param_viewer_3 = ParamViewer(line_2)  # disabled
split_tree_2 = SplitTree(Data=line_2, Masks=flatten(panel_9))  # -> Positive, Negative; disabled
clean_tree_4 = CleanTree(RemoveNulls=True, RemoveInvalid=True, RemoveEmpty=False, Tree=split_tree_2.Positive)  # disabled
loft = Loft(Curves=clean_tree_4, Options={Adjust=False, Closed=False, LoftEnds=0, LoftSimp=0, LoftType=0, Rebuild=10, Refit=0.01})  # disabled
bounding_box_3 = BoundingBox(Content=loft, Plane=PlaneXY(0, 0, 0))  # -> Box, Box_2; disabled
volume = Volume(Geometry=bounding_box_3.Box)  # -> Volume, Centroid; disabled
galapagos = Galapagos()
