# Grasshopper definition EX_016_vector_vector.gh (Grasshopper 1.0.7)
# plug-ins: Bifocals

# ----
# - cross product and
# dot product
number_slider = Slider(3, range=0..10)  # disabled
unit_x = UnitX(Factor=1)  # disabled
unit_y = UnitY(Factor=1)  # disabled
unit_z = UnitZ(Factor=1)  # disabled
number_slider_2 = Slider(1.17, range=0..2)  # disabled
construct_point = ConstructPoint(XCoordinate=0, YCoordinate=0, ZCoordinate=0)  # disabled
amplitude = Amplitude(Vector=[unit_x, unit_y, unit_z], Amplitude=number_slider)  # disabled
explode_tree = ExplodeTree(Data=graft(amplitude))  # -> Branch0, Branch1, Branch2; disabled
pi = Pi(Factor=number_slider_2)  # disabled
explode_tree_2 = ExplodeTree(Data=graft(amplitude))  # -> Branch0, Branch1, Branch2; disabled
vector_display = VectorDisplay(Anchor=construct_point, Vector=amplitude)  # disabled
rotate = Rotate(Vector=explode_tree.Branch0, Axis=explode_tree.Branch1, Angle=pi)  # disabled
rotate_2 = Rotate(Vector=explode_tree.Branch1, Axis=explode_tree.Branch2, Angle=pi)  # disabled
rotate_3 = Rotate(Vector=explode_tree.Branch2, Axis=explode_tree.Branch0, Angle=pi)  # disabled
cross_product = CrossProduct(VectorA=explode_tree_2.Branch1, VectorB=explode_tree_2.Branch2, Unitize=False)  # -> Vector, Length; disabled
cross_product_2 = CrossProduct(VectorA=explode_tree_2.Branch0, VectorB=explode_tree_2.Branch1, Unitize=False)  # -> Vector, Length; disabled
cross_product_3 = CrossProduct(VectorA=explode_tree_2.Branch0, VectorB=explode_tree_2.Branch2, Unitize=False)  # -> Vector, Length; disabled
reverse = Reverse(Vector=rotate)  # disabled
reverse_2 = Reverse(Vector=rotate_2)  # disabled
reverse_3 = Reverse(Vector=rotate_3)  # disabled
vector_display_2 = VectorDisplay(Anchor=construct_point, Vector=cross_product_3.Vector)  # disabled
vector_display_3 = VectorDisplay(Anchor=construct_point, Vector=cross_product.Vector)  # disabled
vector_display_4 = VectorDisplay(Anchor=construct_point, Vector=cross_product_2.Vector)  # disabled
dot_product = DotProduct(VectorA=explode_tree.Branch0, VectorB=rotate, Unitize=False)  # disabled
dot_product_2 = DotProduct(VectorA=explode_tree.Branch1, VectorB=rotate_2, Unitize=False)  # disabled
dot_product_3 = DotProduct(VectorA=explode_tree.Branch2, VectorB=rotate_3, Unitize=False)  # disabled
vector_length = VectorLength(Vector=cross_product.Vector)  # disabled
angle = Angle(VectorA=explode_tree.Branch2, VectorB=rotate_3)  # -> Angle, Reflex; disabled
panel = Panel(vector_length)  # disabled
panel_2 = Panel(cross_product.Length)  # disabled
panel_3 = Panel(angle.Angle)  # disabled
panel_4 = Panel(dot_product_2)  # disabled
panel_5 = Panel(dot_product)  # disabled
panel_6 = Panel(dot_product_3)  # disabled

number_slider_3 = Slider(3, range=0..10)  # disabled

# ----
# 016_vector_vector
# - try creating vectors like points but be sure to
# visualize them
number_slider_4 = Slider(4, range=0..10)  # disabled
number_slider_5 = Slider(2, range=0..10)  # disabled
number_slider_6 = Slider(6, range=0..10)  # disabled
# EXERCISES_VECTOR
construct_point_2 = ConstructPoint(XCoordinate=0, YCoordinate=0, ZCoordinate=0)  # disabled
vector_xyz = VectorXYZ(XComponent=number_slider_5, YComponent=number_slider_4, ZComponent=number_slider_6)  # -> Vector, Length; disabled
construct_point_3 = ConstructPoint(XCoordinate=number_slider_5, YCoordinate=number_slider_4, ZCoordinate=number_slider_6)  # disabled
deconstruct = Deconstruct(Point=vector_xyz.Vector)  # -> XComponent, YComponent, ZComponent; disabled
deconstruct_vector = DeconstructVector(Vector=vector_xyz.Vector)  # -> XComponent, YComponent, ZComponent; disabled
boolean_toggle = BooleanToggle(True)  # disabled
vector_2pt = Vector2Pt(PointA=construct_point_2, PointB=construct_point_3, Unitize=False)  # -> Vector, Length; disabled
unit_x_2 = UnitX(Factor=1)  # disabled
unit_y_2 = UnitY(Factor=1)  # disabled
unit_z_2 = UnitZ(Factor=1)  # disabled
vector_2pt_2 = Vector2Pt(PointA=construct_point_2, PointB=construct_point_3, Unitize=boolean_toggle)  # -> Vector, Length; disabled
unit_vector = UnitVector(Vector=vector_2pt.Vector)  # disabled
amplitude_2 = Amplitude(Vector=unit_z_2, Amplitude=number_slider_3)  # disabled
vector_display_5 = VectorDisplay(Anchor=vector_2pt.Vector, Vector=vector_2pt.Vector)  # disabled
vector_display_6 = VectorDisplay(Anchor=unit_vector, Vector=unit_vector)  # disabled
vector_display_7 = VectorDisplay(Anchor=vector_2pt_2.Vector, Vector=vector_2pt_2.Vector)  # disabled
vector_display_8 = VectorDisplay(Anchor=unit_z_2, Vector=amplitude_2)  # disabled
vector_display_9 = VectorDisplay(Anchor=unit_x_2, Vector=unit_x_2)  # disabled
vector_display_10 = VectorDisplay(Anchor=unit_y_2, Vector=unit_y_2)  # disabled
