# Grasshopper definition EX_017_curve_analysis.gh (Grasshopper 1.0.7)

# ----
# - create a custom plate
number_slider = Slider(2, range=0..3)  # disabled
number_slider_2 = Slider(100, range=0..100)  # disabled
range = Range(Domain=number_slider, Steps=number_slider_2)  # disabled
circle = Circle(Plane=PlaneXY(0, 0, 0), Radius=number_slider)  # disabled
graph_mapper = GraphMapper(
    range,
    x0=0,
    x1=1,
    y0=0,
    y1=1,
    container_name="Bezier",
    cpx=[0, 0.2423520237, 0.2895503342, 1],
    cpy=[0, 0.5722799897, 0.7558665276, 1])  # disabled
graph_mapper_2 = GraphMapper(range, x0=0, x1=1, y0=0, y1=1, container_name="Sine", Equation_px=[0, 0.32217893], Equation_py=[0, 0.8814396262])  # disabled
addition = Addition(A=number_slider, B=range)  # disabled
construct_point = ConstructPoint(XCoordinate=addition, YCoordinate=graph_mapper_2, ZCoordinate=graph_mapper)  # disabled
panel = Panel("2.00")  # disabled
unit_z = UnitZ(Factor=1)  # disabled
range_2 = Range(Domain=panel, Steps=10)  # disabled
interpolate = Interpolate(Vertices=construct_point, Degree=3, Periodic=False, KnotStyle=1)  # -> Curve, Length, Domain; disabled
line_sdl = LineSDL(Start=unit_z, Direction=unit_z, Length=1)  # disabled
pi = Pi(Factor=range_2)  # disabled
number_slider_3 = Slider(6, range=0..100)  # disabled
length = Length(Curve=interpolate.Curve)  # disabled
rotate_axis = RotateAxis(Geometry=interpolate.Curve, Angle=pi, Axis=line_sdl)  # -> Geometry, Transform; disabled
number_slider_4 = Slider(0.24, range=0..1)  # disabled
construct_point_2 = ConstructPoint(XCoordinate=0, YCoordinate=0, ZCoordinate=number_slider_3)  # disabled
panel_2 = Panel("-1")  # disabled
cull_index = CullIndex(List=rotate_axis.Geometry, Indices=panel_2, Wrap=True)  # disabled
evaluate_curve = EvaluateCurve(Curve=reparameterize(cull_index), Parameter=number_slider_4)  # -> Point, Tangent, Angle; disabled
curve_closest_point = CurveClosestPoint(Point=construct_point_2, Curve=cull_index)  # -> Point, Parameter, Distance; disabled
revolution = Revolution(Curve=interpolate.Curve, Axis=line_sdl, Domain=Domain(0, 6.283185307))  # disabled
boundary_surfaces = BoundarySurfaces(Edges=circle)  # disabled
rail_revolution = RailRevolution(Curve=interpolate.Curve, Rail=circle, Axis=line_sdl, Scale=False)  # disabled
loft = Loft(
    Curves=flatten(cull_index),
    Options={Adjust=False, Closed=True, LoftEnds=0, LoftSimp=0, LoftType=0, Rebuild=10, Refit=0.01})  # disabled
distance = Distance(PointA=curve_closest_point.Point, PointB=evaluate_curve.Point)  # disabled
sphere = Sphere(Base=curve_closest_point.Point, Radius=distance)  # -> flatten(Sphere); disabled
split_brep_multiple = SplitBrepMultiple(Brep=loft, Cutters=sphere)  # disabled
list_item = ListItem(List=split_brep_multiple, Index=0, Wrap=True)  # disabled
geometry = Geometry(list_item)  # disabled
merge = Merge(Data1=boundary_surfaces, Data2=geometry)  # disabled

# ----
# - the curve analysis nodes are very interesting
# - consider using the derivatives of a curve
# to explore new variations of geometries
polygon = Polygon(Plane=PlaneXY(0, 0, 0), Radius=3, Segments=6, FilletRadius=0)  # -> Polygon, Length; disabled
populate_2d = Populate2D(Region={Plane=PlaneXY(0, 0, 0), Size=Domain2(u=0..20, v=0..10)}, Count=100, Seed=1)  # disabled
point_in_curves = PointInCurves(Point=populate_2d, Curves=polygon.Polygon)  # -> Relationship, Index, Point; disabled
polygon_center = PolygonCenter(Polyline=polygon.Polygon)  # -> CenterV, CenterE, CenterA; disabled
planar = Planar(Curve=polygon.Polygon)  # -> Planar, Plane, Deviation; disabled
number_slider_5 = Slider(3, range=0..10)  # disabled
cull_pattern = CullPattern(List=populate_2d, CullPattern=point_in_curves.Relationship)  # disabled
panel_3 = Panel("6")  # disabled
range_3 = Range(Domain=panel_3, Steps=number_slider_5)  # disabled
unit_z_2 = UnitZ(Factor=range_3)  # disabled
move = Move(Geometry=cull_pattern, Motion=unit_z_2)  # -> Geometry, Transform; disabled
number_slider_6 = Slider(4, range=0..10)  # disabled
sort_points = SortPoints(Points=move.Geometry)  # -> Points, Indices; disabled
unit_x = UnitX(Factor=number_slider_6)  # disabled
nurbs_curve = NurbsCurve(Vertices=move.Geometry, Degree=3, Periodic=False)  # -> Curve, Length, Domain; disabled
number_slider_7 = Slider(1, range=0..1)  # disabled
move_2 = Move(Geometry=nurbs_curve.Curve, Motion=unit_x)  # -> Geometry, Transform; disabled
extremes = Extremes(Curve=nurbs_curve.Curve, Plane=planar.Plane)  # -> Highest, Lowest; disabled
derivatives = Derivatives(Curve=reparameterize(move_2.Geometry), Parameter=number_slider_7)  # -> Point, FirstDerivative, SecondDerivative; disabled
control_points = ControlPoints(Curve=move_2.Geometry)  # -> Points, Weights, Knots; disabled
geometry_2 = Geometry(derivatives.FirstDerivative)  # disabled
geometry_3 = Geometry(derivatives.SecondDerivative)  # disabled
line = Line(StartPoint=extremes.Lowest, EndPoint=geometry_2)  # disabled
line_2 = Line(StartPoint=extremes.Highest, EndPoint=geometry_3)  # disabled
line_3 = Line(StartPoint=extremes.Highest, EndPoint=geometry_3)  # disabled
line_4 = Line(StartPoint=extremes.Highest, EndPoint=geometry_2)  # disabled
revolution_2 = Revolution(Curve=move_2.Geometry, Axis=line_2, Domain=Domain(0, 6.283185307))  # disabled
revolution_3 = Revolution(Curve=move_2.Geometry, Axis=line_3, Domain=Domain(0, 6.283185307))  # disabled
revolution_4 = Revolution(Curve=move_2.Geometry, Axis=line_4, Domain=Domain(0, 6.283185307))  # disabled
revolution_5 = Revolution(Curve=move_2.Geometry, Axis=line, Domain=Domain(0, 6.283185307))  # disabled

# ----
# 017_curves_analysis
# - create curve(s) in grasshopper
# - use some of your pervious learned skills
# to manipulate and create new geometries
panel_4 = Panel("{(1,3,...)}[(1to4)]")  # disabled
# EXERCISES_CURVES
square = Square(Plane=PlaneXY(0, 0, 0), Size=1, ExtentX=5, ExtentY=5)  # -> Cells, simplify(Points); disabled
split_tree = SplitTree(Data=square.Points, Masks=flatten(panel_4))  # -> Positive, Negative; disabled
panel_5 = Panel("3")  # disabled
unit_z_3 = UnitZ(Factor=panel_5)  # disabled
point = Point(split_tree.Negative)  # disabled
negative = Negative(Value=unit_z_3)  # disabled
move_3 = Move(Geometry=split_tree.Positive, Motion=[unit_z_3, negative])  # -> Geometry, Transform; disabled
interpolate_2 = Interpolate(Vertices=[split_tree.Negative, move_3.Geometry], Degree=3, Periodic=False, KnotStyle=1)  # -> Curve, Length, Domain; disabled
panel_6 = Panel("{(0,2,4)}[]")  # disabled
split_tree_2 = SplitTree(Data=interpolate_2.Curve, Masks=flatten(panel_6))  # -> Positive, Negative; disabled
curve = Curve(split_tree_2.Negative)  # disabled
curve_2 = Curve(split_tree_2.Positive)  # disabled
curve_middle = CurveMiddle(Curve=curve_2)  # disabled
point_on_curve = PointOnCurve(curve_2, parameter=1)  # disabled
end_points = EndPoints(Curve=curve)  # -> Start, End; disabled
end_points_2 = EndPoints(Curve=curve_2)  # -> Start, End; disabled
match_tree = MatchTree(Tree=end_points_2.End, Guide=end_points.Start)  # disabled
number_slider_8 = Slider(1, range=0..1)  # disabled
number_slider_9 = Slider(0, range=0..1)  # disabled
number_slider_10 = Slider(1, range=0..1)  # disabled
number_slider_11 = Slider(0.3, range=0..1)  # disabled

merge_2 = Merge(Data1=end_points.End, Data2=end_points_2.End, Data3=end_points.Start)  # disabled

interpolate_3 = Interpolate(Vertices=flatten(merge_2), Degree=3, Periodic=False, KnotStyle=1)  # -> Curve, Length, Domain; disabled
perp_frame = PerpFrame(Curve=reparameterize(interpolate_3.Curve), Parameter=number_slider_9)  # disabled
perp_frame_2 = PerpFrame(Curve=reparameterize(interpolate_3.Curve), Parameter=number_slider_8)  # disabled
horizontal_frame = HorizontalFrame(Curve=reparameterize(interpolate_3.Curve), Parameter=number_slider_8)  # disabled
ellipse = Ellipse(Plane=perp_frame, Radius1=1, Radius2=number_slider_10)  # -> Ellipse, Focus1, Focus2; disabled
ellipse_2 = Ellipse(Plane=perp_frame_2, Radius1=1, Radius2=number_slider_11)  # -> Ellipse, Focus1, Focus2; disabled
sweep1 = Sweep1(Rail=interpolate_3.Curve, Sections=[ellipse_2.Ellipse, ellipse.Ellipse], Miter=1)  # disabled
cap_holes = CapHoles(Brep=sweep1)  # disabled
