# Grasshopper definition EX_018_curve_division.gh (Grasshopper 1.0.7)
# plug-ins: Kangaroo2 Components

# ----
# EXERCISES_CURVES
# 018_curve_division
# - create curve(s) in grasshopper
# - use some of your pervious learned skills
# to manipulate and create new geometries
number_slider = Slider(2, range=0..10)  # disabled
number_slider_2 = Slider(62, range=0..100)  # disabled
range = Range(Domain=number_slider, Steps=number_slider_2)  # disabled
graph_mapper = GraphMapper(range, x0=0, x1=1, y0=0, y1=1, Ox=0.524131, Oy=0.4776169062, Px=0.838164866, Py=0.4178696871, container_name="Parabola")  # disabled
graph_mapper_2 = GraphMapper(
    range,
    x0=0,
    x1=1,
    y0=0,
    y1=1,
    container_name="Bezier",
    cpx=[0, 0.09178803116, 0.9158281088, 1],
    cpy=[0, 0.6787392497, 0, 0.5437967181])  # disabled
addition = Addition(A=number_slider, B=graph_mapper)  # disabled
number_slider_3 = Slider(4, range=0..10)  # disabled
construct_point = ConstructPoint(XCoordinate=addition, YCoordinate=graph_mapper_2, ZCoordinate=range)  # disabled
number_slider_4 = Slider(3, range=0..10)  # disabled
interpolate = Interpolate(Vertices=construct_point, Degree=3, Periodic=False, KnotStyle=1)  # -> Curve, Length, Domain; disabled
domain = Domain(interpolate.Domain)  # disabled
divide_domain = DivideDomain(Domain=domain, Count=number_slider_4)  # -> flatten(Segments); disabled
division = Division(A=interpolate.Length, B=number_slider_3)  # disabled
construct_point_2 = ConstructPoint(XCoordinate=0, YCoordinate=0, ZCoordinate=0)  # disabled
end_points = EndPoints(Curve=interpolate.Curve)  # -> Start, End; disabled
panel = Panel(divide_domain)  # disabled
distance = Distance(PointA=construct_point_2, PointB=end_points.Start)  # disabled
divide_distance = DivideDistance(Curve=interpolate.Curve, Distance=division)  # -> Points, Tangents, Parameters; disabled
divide_length = DivideLength(Curve=interpolate.Curve, Length=division)  # -> Points, Tangents, Parameters; disabled
shatter = Shatter(Curve=interpolate.Curve, Parameters=divide_domain)  # disabled
divide_curve = DivideCurve(Curve=interpolate.Curve, Count=10, Kinks=False)  # -> Points, Tangents, Parameters; disabled
circle = Circle(Plane=PlaneXY(0, 0, 0), Radius=distance)  # disabled
list_item = ListItem(List=shatter, Index=0, Wrap=True)  # -> Item, Item1; disabled
unit_z = UnitZ(Factor=1)  # disabled
curve = Curve(list_item.Item)  # disabled
curve_2 = Curve(list_item.Item1)  # disabled
line_sdl = LineSDL(Start=unit_z, Direction=unit_z, Length=1)  # disabled
revolution = Revolution(Curve=curve, Axis=line_sdl, Domain=Domain(0, 6.283185307))  # disabled
revolution_2 = Revolution(Curve=curve_2, Axis=line_sdl, Domain=Domain(0, 6.283185307))  # disabled
surface = Surface(circle)  # disabled
merge = Merge(Data1=revolution_2, Data2=revolution, Data3=surface)  # disabled

# ----
# - curve frames are great for orienting geometry and robotic tool path control
number_slider_5 = Slider(6, range=0..10)  # disabled
number_slider_6 = Slider(3, range=0..10)  # disabled
range_2 = Range(Domain=number_slider_5, Steps=number_slider_6)  # disabled
expression = Expression(Variable_x=range_2, Expression="cos(x^2)")  # disabled
expression_2 = Expression(Variable_x=range_2, Expression="sin(x^2)")  # disabled
construct_point_3 = ConstructPoint(XCoordinate=expression_2, YCoordinate=expression, ZCoordinate=range_2)  # disabled
number_slider_7 = Slider(3, range=0..10)  # disabled
interpolate_2 = Interpolate(Vertices=construct_point_3, Degree=3, Periodic=False, KnotStyle=1)  # -> Curve, Length, Domain; disabled
boolean_toggle = BooleanToggle(True)  # disabled
point_on_curve = PointOnCurve(interpolate_2.Curve, parameter=0.746)  # disabled
perp_frames = PerpFrames(Curve=interpolate_2.Curve, Count=number_slider_7, Align=boolean_toggle)  # -> Frames, Parameters; disabled
curve_frames = CurveFrames(Curve=interpolate_2.Curve, Count=number_slider_7)  # -> Frames, Parameters; disabled
horizontal_frames = HorizontalFrames(Curve=interpolate_2.Curve, Count=number_slider_7)  # -> Frames, Parameters; disabled
boolean_toggle_2 = BooleanToggle(True)  # disabled
number_slider_8 = Slider(0.57, range=0..1)  # disabled
number_slider_9 = Slider(0.97, range=0..1)  # disabled
number_slider_10 = Slider(0.68, range=0..1)  # disabled
orient = Orient(Geometry=interpolate_2.Curve, Source=point_on_curve, Target=horizontal_frames.Frames)  # -> Geometry, Transform; disabled
orient_2 = Orient(Geometry=interpolate_2.Curve, Source=point_on_curve, Target=curve_frames.Frames)  # -> Geometry, Transform; disabled
orient_3 = Orient(Geometry=interpolate_2.Curve, Source=point_on_curve, Target=perp_frames.Frames)  # -> Geometry, Transform; disabled
multipipe = MultiPipe(
    Curves=orient_2.Geometry,
    NodeSize=0.5,
    EndOffset=1,
    StrutSize=number_slider_10,
    Segment=0,
    KinkAngle=0.6,
    CubeFit=0,
    Caps=boolean_toggle_2)  # disabled
multipipe_2 = MultiPipe(
    Curves=orient_3.Geometry,
    NodeSize=0.5,
    EndOffset=1,
    StrutSize=number_slider_8,
    Segment=0,
    KinkAngle=0.6,
    CubeFit=0,
    Caps=boolean_toggle_2)  # disabled
multipipe_3 = MultiPipe(
    Curves=orient.Geometry,
    NodeSize=0.5,
    EndOffset=1,
    StrutSize=number_slider_9,
    Segment=0,
    KinkAngle=0.6,
    CubeFit=0,
    Caps=boolean_toggle_2)  # disabled
