# Grasshopper definition EX_019_curve_primitive.gh (Grasshopper 1.0.7)
# plug-ins: Kangaroo2 Components

# ----
# 019_curve_primitive
# - create curve(s) in grasshopper
# - use some of your pervious learned skills
# to manipulate and create new geometries
# - consider creating other new geometries with
# the other primitives in curves
number_slider = Slider(12, range=0..100)  # disabled
unit_x = UnitX(Factor=1)  # disabled
unit_y = UnitY(Factor=1)  # disabled
unit_z = UnitZ(Factor=1)  # disabled
# EXERCISES_CURVES
construct_point = ConstructPoint(XCoordinate=0, YCoordinate=0, ZCoordinate=0)  # disabled
line_sdl = LineSDL(Start=construct_point, Direction=[unit_y, unit_x, unit_z], Length=number_slider)  # disabled
construct_point_2 = ConstructPoint(XCoordinate=unit_x, YCoordinate=unit_y, ZCoordinate=unit_z)  # disabled
number_slider_2 = Slider(2, range=0..2)  # disabled
line_pt = LinePt(Line=line_sdl, Point=construct_point_2)  # disabled
line = Line(StartPoint=construct_point, EndPoint=construct_point_2)  # disabled
pi = Pi(Factor=number_slider_2)  # disabled
number_slider_3 = Slider(10, range=0..10)  # disabled
circle = Circle(Plane=line_pt, Radius=number_slider)  # disabled
deconstruct_plane = DeconstructPlane(Plane=line_pt)  # -> Origin, XAxis, YAxis, ZAxis; disabled
amplitude = Amplitude(Vector=deconstruct_plane.XAxis, Amplitude=number_slider_3)  # disabled
list_item = ListItem(List=line_pt, Index=0, Wrap=True)  # -> Item, Item1, Item2; disabled
number_slider_4 = Slider(100, range=0..100)  # disabled
list_item_2 = ListItem(List=line_pt, Index=0, Wrap=True)  # -> Item, Item1, Item2; disabled
list_item_3 = ListItem(List=line_pt, Index=0, Wrap=True)  # -> Item, Item1, Item2; disabled
list_item_4 = ListItem(List=circle, Index=0, Wrap=True)  # -> Item, Item1, Item2; disabled
rotate_plane = RotatePlane(Plane=list_item.Item, Angle=pi)  # disabled
curve_middle = CurveMiddle(Curve=circle)  # disabled
rotate_plane_2 = RotatePlane(Plane=list_item_2.Item2, Angle=pi)  # disabled
rotate_plane_3 = RotatePlane(Plane=list_item_3.Item1, Angle=pi)  # disabled
negative = Negative(Value=amplitude)  # disabled
deconstruct_plane_2 = DeconstructPlane(Plane=rotate_plane_3)  # -> Origin, XAxis, YAxis, ZAxis; disabled
deconstruct_plane_3 = DeconstructPlane(Plane=rotate_plane_2)  # -> Origin, XAxis, YAxis, ZAxis; disabled
deconstruct_plane_4 = DeconstructPlane(Plane=rotate_plane)  # -> Origin, XAxis, YAxis, ZAxis; disabled
move = Move(Geometry=curve_middle, Motion=negative)  # -> Geometry, Transform; disabled
amplitude_2 = Amplitude(Vector=deconstruct_plane_4.XAxis, Amplitude=number_slider_4)  # disabled
amplitude_3 = Amplitude(Vector=deconstruct_plane_2.XAxis, Amplitude=number_slider_4)  # disabled
tangent_lines = TangentLines(Point=move.Geometry, Circle=circle)  # -> Tangent1, Tangent2; disabled
amplitude_4 = Amplitude(Vector=deconstruct_plane_3.XAxis, Amplitude=number_slider_4)  # disabled
vector_display = VectorDisplay(
    Anchor=deconstruct_plane_4.Origin,
    Vector=[deconstruct_plane_4.YAxis, deconstruct_plane_4.XAxis, deconstruct_plane_4.ZAxis])  # disabled
move_2 = Move(Geometry=list_item_4.Item, Motion=amplitude_2)  # -> Geometry, Transform; disabled
move_3 = Move(Geometry=list_item_4.Item1, Motion=amplitude_3)  # -> Geometry, Transform; disabled
move_4 = Move(Geometry=list_item_4.Item2, Motion=amplitude_4)  # -> Geometry, Transform; disabled
tangent_lines_ex = TangentLinesEx(CircleA=list_item_4.Item, CircleB=move_2.Geometry)  # -> Tangent1, Tangent2; disabled
tangent_lines_ex_2 = TangentLinesEx(CircleA=list_item_4.Item1, CircleB=move_3.Geometry)  # -> Tangent1, Tangent2; disabled
tangent_lines_ex_3 = TangentLinesEx(CircleA=list_item_4.Item2, CircleB=move_4.Geometry)  # -> Tangent1, Tangent2; disabled
number_slider_5 = Slider(2.6, range=0..10)  # disabled
merge = Merge(
    Data1=circle,
    Data2=tangent_lines_ex.Tangent1,
    Data3=tangent_lines_ex.Tangent2,
    Data4=move_2.Geometry,
    Data5=tangent_lines_ex_2.Tangent1,
    Data6=tangent_lines_ex_2.Tangent2,
    Data7=move_3.Geometry,
    Data8=tangent_lines_ex.Tangent2,
    Data9=tangent_lines_ex_3.Tangent1,
    Data10=tangent_lines_ex_3.Tangent2,
    Data11=move_4.Geometry)  # disabled
multipipe = MultiPipe(Curves=merge, NodeSize=number_slider_5, EndOffset=1, StrutSize=1, Segment=0, KinkAngle=0.6, CubeFit=0, Caps=0)  # disabled
