# Grasshopper definition EX_020_curve_spline.gh (Grasshopper 1.0.7)
# plug-ins: Kangaroo2 Components

number_slider = Slider(12, range=0..100)  # disabled
quad_sphere = QuadSphere(Base=PlaneXY(0, 0, 0), Radius=number_slider)  # disabled
md_slider = MDSlider(
    SliderMode=0,
    slider_value=Point(0.7588099038, 0.725054485, 0.5),
    x_domain=Domain(0, 1),
    y_domain=Domain(0, 1),
    z_domain=Domain(0, 1))  # disabled
md_slider_2 = MDSlider(
    SliderMode=0,
    slider_value=Point(0.319955221, 0.7363072837, 0.5),
    x_domain=Domain(0, 1),
    y_domain=Domain(0, 1),
    z_domain=Domain(0, 1))  # disabled
deconstruct_brep = DeconstructBrep(Brep=quad_sphere)  # -> Faces, Edges, Vertices; disabled
md_slider_3 = MDSlider(
    SliderMode=0,
    slider_value=Point(0.7925757431, 0.7981969322, 0.5),
    x_domain=Domain(0, 1),
    y_domain=Domain(0, 1),
    z_domain=Domain(0, 1))  # disabled
boolean_toggle = BooleanToggle(True)  # disabled
curve_on_surface = CurveOnSurface(Surface=deconstruct_brep.Faces, UVCoordinates=[md_slider_2, md_slider, md_slider_3], Closed=boolean_toggle)  # -> Curve, Length, Domain; disabled
surface_split = SurfaceSplit(Surface=deconstruct_brep.Faces, Curves=curve_on_surface.Curve)  # disabled
dispatch = Dispatch(List=flatten(surface_split), DispatchPattern=[True, False])  # -> ListA, ListB; disabled
geometry = Geometry(dispatch.ListB)  # disabled
geometry_2 = Geometry(dispatch.ListA)  # disabled

# ----
# 020_curve_spline
# - create spline(s) in grasshopper
# - use some of your pervious learned skills
# to manipulate and create new geometries
number_slider_2 = Slider(3, range=0..10)  # disabled
# EXERCISES_CURVES
quad_sphere_2 = QuadSphere(Base=PlaneXY(0, 0, 0), Radius=1)  # disabled
deconstruct_brep_2 = DeconstructBrep(Brep=quad_sphere_2)  # -> Faces, Edges, Vertices; disabled
panel = Panel("""4
5
6""")  # disabled
number_slider_3 = Slider(4, range=0..10)  # disabled
range = Range(Domain=Domain(0, 1), Steps=number_slider_2)  # disabled
cull_index = CullIndex(List=deconstruct_brep_2.Faces, Indices=panel, Wrap=True)  # disabled
construct_point = ConstructPoint(XCoordinate=range, YCoordinate=range, ZCoordinate=0)  # -> graft(Point); disabled
populate_geometry = PopulateGeometry(Geometry=cull_index, Count=number_slider_3, Seed=number_slider_3)  # disabled
interpolate = Interpolate(Vertices=populate_geometry, Degree=3, Periodic=False, KnotStyle=1)  # -> Curve, Length, Domain; disabled
iso_curve = IsoCurve(Surface=reparameterize(cull_index), UVPoint=construct_point)  # -> UIsocurve, VIsocurve; disabled
polyline = PolyLine(Vertices=populate_geometry, Closed=False)  # disabled
nurbs_curve = NurbsCurve(Vertices=populate_geometry, Degree=3, Periodic=False)  # -> Curve, Length, Domain; disabled
number_slider_4 = Slider(1, range=-1..1)  # disabled
number_slider_5 = Slider(-1, range=-1..1)  # disabled
explode_tree = ExplodeTree(Data=interpolate.Curve)  # -> Branch0, Branch1, Branch2; disabled
curve = Curve(iso_curve.VIsocurve)  # disabled
curve_2 = Curve(iso_curve.UIsocurve)  # disabled
end_points = EndPoints(Curve=curve)  # -> Start, End; disabled
tween_curve = TweenCurve(CurveA=explode_tree.Branch1, CurveB=explode_tree.Branch2, Factor=0.5, BlendType=0)  # disabled
tween_curve_2 = TweenCurve(CurveA=explode_tree.Branch0, CurveB=explode_tree.Branch2, Factor=0.5, BlendType=0)  # disabled
number_slider_6 = Slider(3, range=0..10)  # disabled
tween_curve_3 = TweenCurve(CurveA=explode_tree.Branch0, CurveB=explode_tree.Branch1, Factor=0.5, BlendType=0)  # disabled
vector_xyz = VectorXYZ(XComponent=0, YComponent=0, ZComponent=[number_slider_5, number_slider_4])  # -> Vector, Length; disabled
blend_curve = BlendCurve(CurveA=tween_curve_3, CurveB=tween_curve_2, BulgeA=1, BulgeB=1, Continuity=2)  # disabled
blend_curve_2 = BlendCurve(CurveA=tween_curve_2, CurveB=tween_curve, BulgeA=1, BulgeB=1, Continuity=2)  # disabled
blend_curve_3 = BlendCurve(CurveA=tween_curve_3, CurveB=tween_curve, BulgeA=1, BulgeB=1, Continuity=2)  # disabled
number_slider_7 = Slider(0.09, range=0..1)  # disabled
catenary = Catenary(PointA=end_points.Start, PointB=end_points.End, Length=number_slider_6, Gravity=vector_xyz.Vector)  # disabled
multipipe = MultiPipe(Curves=catenary, NodeSize=number_slider_7, EndOffset=1, StrutSize=1, Segment=0, KinkAngle=0.6, CubeFit=0, Caps=0)  # disabled
