# Grasshopper definition EX_021_curve_utility.gh (Grasshopper 1.0.7)

# ----
# 021_curve_utility
# - curve utility manipulates curves in many ways
number_slider = Slider(17, range=0..100)  # disabled
# EXERCISES_CURVES
polygon = Polygon(Plane=PlaneXY(0, 0, 0), Radius=number_slider, Segments=6, FilletRadius=0)  # -> Polygon, Length; disabled
explode = Explode(Curve=polygon.Polygon, Recursive=True)  # -> Segments, Vertices; disabled
quad_sphere = QuadSphere(Base=PlaneXY(0, 0, 0), Radius=number_slider)  # disabled
quad_sphere_2 = QuadSphere(Base=PlaneXY(0, 0, 0), Radius=number_slider)  # disabled
unit_z = UnitZ(Factor=1)  # disabled
number_slider_2 = Slider(0.1, range=0.1..10)  # disabled
point = Point(explode.Vertices)  # disabled
curve = Curve(explode.Segments)  # disabled
deconstruct_brep = DeconstructBrep(Brep=quad_sphere)  # -> Faces, Edges, Vertices; disabled
panel = Panel("{0;0}[(0,2,...)]")  # disabled
fillet = Fillet(Curve=polygon.Polygon, Radius=number_slider_2)  # disabled
param_viewer = ParamViewer(curve)  # disabled
project = Project(Curve=graft(fillet), Brep=quad_sphere_2, Direction=unit_z)  # disabled
split_tree = SplitTree(Data=curve, Masks=flatten(panel))  # -> Positive, Negative; disabled
number_slider_3 = Slider(9.23, range=0..10)  # disabled
number_slider_4 = Slider(1, range=0..1)  # disabled
rebuild_curve = RebuildCurve(Curve=project, Count=10, Tangents=False)  # disabled
flip_curve = FlipCurve(Curve=split_tree.Positive)  # -> Curve, Flag; disabled
seam = Seam(Curve=reparameterize(rebuild_curve), Seam=number_slider_4)  # -> flatten(Curve); disabled
clean_tree = CleanTree(RemoveNulls=True, RemoveInvalid=True, RemoveEmpty=False, Tree=flip_curve.Curve)  # disabled
point_on_curve = PointOnCurve([flip_curve.Curve, split_tree.Negative], parameter=0.173)  # disabled
unit_z_2 = UnitZ(Factor=number_slider_3)  # disabled
loft = Loft(Curves=seam, Options={Adjust=True, Closed=False, LoftEnds=0, LoftSimp=0, LoftType=0, Rebuild=10, Refit=0.01})  # disabled
offset_curve = OffsetCurve(Curve=clean_tree, Distance=number_slider_3, Corners=1)  # -> flatten(Curve); disabled
pull_curve = PullCurve(Curve=deconstruct_brep.Edges, Surface=loft)  # disabled
number_slider_5 = Slider(6.24, range=0..10)  # disabled
move = Move(Geometry=offset_curve, Motion=unit_z_2)  # -> Geometry, Transform; disabled
clean_tree_2 = CleanTree(RemoveNulls=True, RemoveInvalid=True, RemoveEmpty=False, Tree=pull_curve)  # disabled
number_slider_6 = Slider(5, range=0..5)  # disabled
join_curves = JoinCurves(Curves=[split_tree.Negative, flip_curve.Curve], Preserve=False)  # disabled
curve_middle = CurveMiddle(Curve=clean_tree_2)  # disabled
sphere = Sphere(Base=curve_middle, Radius=number_slider_5)  # disabled
split_brep_multiple = SplitBrepMultiple(Brep=loft, Cutters=sphere)  # disabled
pipe = Pipe(Curve=join_curves, Radius=expr("x/3", number_slider_6), Caps=0)  # disabled
sphere_2 = Sphere(Base=point_on_curve, Radius=number_slider_6)  # disabled
loft_2 = Loft(
    Curves=[offset_curve, move.Geometry],
    Options={Adjust=True, Closed=True, LoftEnds=0, LoftSimp=0, LoftType=0, Rebuild=10, Refit=0.01})  # disabled
list_item = ListItem(List=split_brep_multiple, Index=0, Wrap=True)  # disabled
