# Grasshopper definition EX_022_surface_analysis.gh (Grasshopper 1.0.7)
# plug-ins: Kangaroo2 Components

# ----
# EXERCISES_SURFACE
# 022_surface_analysis
# - MVP debrep node
number_slider = Slider(14, range=0..100)  # disabled
quad_sphere = QuadSphere(Base=PlaneXY(0, 0, 0), Radius=number_slider)  # disabled
deconstruct_brep = DeconstructBrep(Brep=quad_sphere)  # -> Faces, Edges, Vertices; disabled
surface = Surface(reparameterize(deconstruct_brep.Faces))  # disabled
point = Point(deconstruct_brep.Vertices)  # disabled
curve = Curve(deconstruct_brep.Edges)  # disabled
area = Area(Geometry=surface)  # -> Area, Centroid; disabled
volume = Volume(Geometry=quad_sphere)  # -> Volume, Centroid; disabled
list_length = ListLength(List=surface)  # disabled
point_2 = Point(area.Centroid)  # disabled
point_3 = Point(volume.Centroid)  # disabled
number_slider_2 = Slider(0.8, range=0..1)  # disabled
number_slider_3 = Slider(0.2, range=0..1)  # disabled
expression = Expression(Variable_x=list_length, Expression="x-1")  # disabled
construct_domain = ConstructDomain(DomainStart=number_slider_3, DomainEnd=number_slider_2)  # disabled
number_slider_4 = Slider(0.469, range=0..1)  # disabled
range = Range(Domain=construct_domain, Steps=expression)  # disabled
construct_point = ConstructPoint(XCoordinate=graft(range), YCoordinate=number_slider_4, ZCoordinate=0)  # disabled
evaluate_surface = EvaluateSurface(Surface=reparameterize(flatten(surface)), Point=construct_point)  # -> Point, Normal, UDirection, VDirection, Frame; disabled

number_slider_5 = Slider(10, range=0..100)  # disabled
number_slider_6 = Slider(4, range=0..10)  # disabled
number_slider_7 = Slider(89, range=0..100)  # disabled
panel = Panel("{0;*}[(1,3,...)]")  # disabled
number_slider_8 = Slider(187, range=0..1000)  # disabled
number_slider_9 = Slider(100, range=0..100)  # disabled
sphere = Sphere(Base=PlaneXY(0, 0, 0), Radius=number_slider_5)  # disabled
deconstruct_brep_2 = DeconstructBrep(Brep=quad_sphere)  # -> Faces, Edges, Vertices; disabled
populate_geometry = PopulateGeometry(Geometry=quad_sphere, Count=number_slider_6, Seed=number_slider_7)  # disabled
bounding_box = BoundingBox(Content=sphere, Plane=PlaneXY(0, 0, 0), UnionBox=True)  # -> Box, Box_2; disabled
split_tree = SplitTree(Data=deconstruct_brep_2.Faces, Masks=flatten(panel))  # -> Positive, Negative; disabled
populate_3d = Populate3D(Region=bounding_box.Box, Count=number_slider_9, Seed=number_slider_8)  # disabled
surface_2 = Surface(split_tree.Positive)  # disabled
surface_3 = Surface(split_tree.Negative)  # disabled
brep_closest_point = BrepClosestPoint(Point=populate_geometry, Brep=quad_sphere)  # -> Point, Normal, Distance; disabled
clean_tree = CleanTree(RemoveNulls=True, RemoveInvalid=True, RemoveEmpty=False, Tree=surface_3)  # disabled
clean_tree_2 = CleanTree(RemoveNulls=True, RemoveInvalid=True, RemoveEmpty=False, Tree=surface_2)  # disabled
point_in_breps = PointInBreps(Brep=sphere, Point=populate_3d, Strict=False)  # -> Inside, Index; disabled
surface_closest_point = SurfaceClosestPoint(Point=populate_geometry, Surface=clean_tree_2)  # -> Point, UVPoint, Distance; disabled
cull_pattern = CullPattern(List=populate_3d, CullPattern=point_in_breps.Inside)  # disabled
surface_closest_point_2 = SurfaceClosestPoint(Point=populate_geometry, Surface=clean_tree)  # -> Point, UVPoint, Distance; disabled
cull_pattern_2 = CullPattern(List=populate_3d, CullPattern=point_in_breps.Index)  # disabled
shortest_list = ShortestList(ListListA=cull_pattern, ListListB=cull_pattern_2, TrimMode=2)  # -> ListListA, ListListB; disabled
cull_duplicates = CullDuplicates(Points=brep_closest_point.Point, Tolerance=0.1, CullMode=3)  # -> Points, Indices, Valence; disabled
cull_duplicates_2 = CullDuplicates(Points=surface_closest_point_2.Point, Tolerance=0.1, CullMode=3)  # -> Points, Indices, Valence; disabled
cull_duplicates_3 = CullDuplicates(Points=surface_closest_point.Point, Tolerance=0.1, CullMode=3)  # -> Points, Indices, Valence; disabled
sort_points = SortPoints(Points=shortest_list.ListListA)  # -> Points, Indices; disabled
sort_points_2 = SortPoints(Points=shortest_list.ListListB)  # -> Points, Indices; disabled
sort_points_3 = SortPoints(Points=cull_duplicates.Points)  # -> Points, Indices; disabled
sort_points_4 = SortPoints(Points=cull_duplicates_3.Points)  # -> Points, Indices; disabled
sort_points_5 = SortPoints(Points=cull_duplicates_2.Points)  # -> Points, Indices; disabled
line = Line(StartPoint=sort_points.Points, EndPoint=sort_points_2.Points)  # disabled
interpolate = Interpolate(Vertices=sort_points_5.Points, Degree=3, Periodic=False, KnotStyle=1)  # -> Curve, Length, Domain; disabled
interpolate_2 = Interpolate(Vertices=sort_points_3.Points, Degree=3, Periodic=False, KnotStyle=1)  # -> Curve, Length, Domain; disabled
interpolate_3 = Interpolate(Vertices=sort_points_4.Points, Degree=3, Periodic=False, KnotStyle=1)  # -> Curve, Length, Domain; disabled
number_slider_10 = Slider(3, range=0..10)  # disabled
loft = Loft(
    Curves=[interpolate_3.Curve, interpolate.Curve],
    Options={Adjust=False, Closed=False, LoftEnds=0, LoftSimp=0, LoftType=0, Rebuild=10, Refit=0.01})  # disabled
divide_domain² = DivideDomain²(Domain=loft, UCount=number_slider_10, VCount=number_slider_10)  # disabled
md_slider = MDSlider(
    SliderMode=0,
    slider_value=Point(0.5138266959, 0.5967466773, 0.5),
    x_domain=Domain(0, 1),
    y_domain=Domain(0, 1),
    z_domain=Domain(0, 1))  # disabled
isotrim = Isotrim(Surface=loft, Domain=divide_domain²)  # disabled
evaluate_surface_2 = EvaluateSurface(Surface=reparameterize(isotrim), Point=md_slider)  # -> Point, Normal, UDirection, VDirection, Frame; disabled
plane = Plane(evaluate_surface_2.Frame)  # disabled

# ----
# - consider naked edges on breps and surfaces
brep_edges = BrepEdges(Brep=surface)  # -> Naked, Interior, NonManifold; disabled
brep_edges_2 = BrepEdges(Brep=quad_sphere)  # -> Naked, Interior, NonManifold; disabled
curve_2 = Curve(brep_edges.Naked)  # disabled
curve_3 = Curve(brep_edges_2.Naked)  # disabled
curve_4 = Curve(brep_edges_2.Interior)  # disabled

number_slider_11 = Slider(1, range=0..2)  # disabled
number_slider_12 = Slider(2.15, range=0..10)  # disabled
multipipe = MultiPipe(
    Curves=line,
    NodeSize=number_slider_12,
    EndOffset=1,
    StrutSize=1,
    Segment=0,
    KinkAngle=0.6,
    CubeFit=0,
    Caps=number_slider_11)  # disabled
