# Grasshopper definition EX_023_surface_freeform.gh (Grasshopper 1.0.7)

# ----
# EXERCISES_SURFACE
# 023_surface_freeform
# - Daniel Christev's wonderful surfaces
# - so much more interesting than the regular
# surface generating nodes
number_slider = Slider(40, range=0..100)
number_slider_2 = Slider(100, range=0..100)
_4point_surface = _4PointSurface()
range = Range(Domain=number_slider, Steps=number_slider_2)
boundary_surfaces = BoundarySurfaces()
sine = Sine(Value=range)
multiplication = Multiplication(A=sine, B=Slider(4, range=0..5))
loft = Loft(Options={Adjust=False, Closed=False, LoftEnds=0, LoftSimp=0, LoftType=0, Rebuild=10, Refit=0.01})
construct_point = ConstructPoint(XCoordinate=graft(range), YCoordinate=range, ZCoordinate=multiplication)
surface_from_points = SurfaceFromPoints(Points=flatten(construct_point), UCount=expr("x+1", number_slider_2), Interpolate=False)
surface = Surface(surface_from_points)
area = Area(Geometry=surface)  # -> Area, Centroid
dimensions = Dimensions(Surface=surface)  # -> UDimension, VDimension
number_slider_3 = Slider(29, range=0..100)
extrude = Extrude()
division = Division(A=dimensions.UDimension, B=dimensions.VDimension)
scale = Scale(Geometry=surface, Center=area.Centroid, Factor=Slider(3.478, range=0..5))  # -> Geometry, Transform
md_slider = MDSlider(
    SliderMode=0,
    slider_value=Point(0.4647302395, 0.5404129028, 0.5),
    x_domain=Domain(0, 1),
    y_domain=Domain(0, 1),
    z_domain=Domain(0, 1))
multiplication_2 = Multiplication(A=division, B=number_slider_3)
pipe = Pipe(Radius=1, Caps=0)
integer = Integer(multiplication_2)
divide_surface = DivideSurface(Surface=surface, UCount=integer, VCount=number_slider_3)  # -> flatten(Points), Normals, Parameters
md_slider_2 = MDSlider(
    SliderMode=0,
    slider_value=Point(0.3866250813, 0.4665967329, 0.5),
    x_domain=Domain(0, 1),
    y_domain=Domain(0, 1),
    z_domain=Domain(0, 1))
pipe_variable = PipeVariable(Caps=0)
md_slider_3 = MDSlider(
    SliderMode=0,
    slider_value=Point(0.5929695688, 0.4704442838, 0.5),
    x_domain=Domain(0, 1),
    y_domain=Domain(0, 1),
    z_domain=Domain(0, 1))
evaluate_surface = EvaluateSurface(Surface=reparameterize(scale.Geometry), Point=[md_slider_3, md_slider, md_slider_2])  # -> Point, Normal, UDirection, VDirection, Frame
distance = Distance(PointA=graft(evaluate_surface.Point), PointB=divide_surface.Points)
expression = Expression(w=flatten(Slider(0.243, range=0..2)), t=distance, Expression="sin(2*w^2*t)")
sweep1 = Sweep1(Miter=1)
flip_matrix = FlipMatrix(Data=expression)
sweep2 = Sweep2(SameHeight=False)
ma = MassMultiplication(Input=flip_matrix)  # -> flatten(Result), PartialResults
multiplication_3 = Multiplication(A=Slider(7.333, range=0..10), B=ma.Result)
rail_revolution = RailRevolution(Scale=False)
unit_z = UnitZ(Factor=multiplication_3)
move = Move(Geometry=divide_surface.Points, Motion=unit_z)  # -> Geometry, Transform
revolution = Revolution(Domain=Domain(0, 6.283185307))
expression_2 = Expression(u=integer, Expression="u+1")
extrude_along = ExtrudeAlong()
extrude_linear = ExtrudeLinear(OrientationP=PlaneXY(0, 0, 0))
extrude_point = ExtrudePoint()
surface_from_points_2 = SurfaceFromPoints(Points=move.Geometry, UCount=expression_2, Interpolate=False)
patch = Patch(Spans=20, Flexibility=1, Trim=True)

# ----
# 024_surface_primitive
# - Daniel Christev's wonderful surfaces
center_box = CenterBox(Base=PlaneXY(0, 0, 0), X=1, Y=1, Z=1)
cone = Cone(Base=PlaneXY(0, 0, 0), Radius=0.5, Length=1)  # -> Cone, Tip
plane_surface = PlaneSurface(Plane=PlaneXY(0, 0, 0), XSize=Slider(38, range=0..100), YSize=Slider(24, range=0..100))
cylinder = Cylinder(Base=PlaneXY(0, 0, 0), Radius=0.5, Length=1)
bounding_box = BoundingBox(Content=surface_from_points_2, Plane=PlaneXY(0, 0, 0))  # -> Box, Box_2
plane_through_shape = PlaneThroughShape(Plane=plane_surface, Shape=surface_from_points_2, Inflate=1, SectionLogic=False)
bounding_box_2 = BoundingBox(Content=surface_from_points_2, Plane=PlaneXY(0, 0, 0), UnionBox=True)  # -> Box, Box_2
quad_sphere = QuadSphere(Base=PlaneXY(0, 0, 0), Radius=1)
sphere = Sphere(Base=PlaneXY(0, 0, 0), Radius=1)
