# Grasshopper definition EX_024_surface_primitive.gh (Grasshopper 1.0.7)

# ----
# EXERCISES_SURFACE
# 023_surface_freeform
# - Daniel Christev's wonderful surfaces
# - so much more interesting than the regular
# surface generating nodes
number_slider = Slider(40, range=0..100)  # disabled
number_slider_2 = Slider(100, range=0..100)  # disabled
_4point_surface = _4PointSurface()  # disabled
number_slider_3 = Slider(4, range=0..5)  # disabled
range = Range(Domain=number_slider, Steps=number_slider_2)  # disabled
boundary_surfaces = BoundarySurfaces()  # disabled
sine = Sine(Value=range)  # disabled
multiplication = Multiplication(A=sine, B=number_slider_3)  # disabled
loft = Loft(Options={Adjust=False, Closed=False, LoftEnds=0, LoftSimp=0, LoftType=0, Rebuild=10, Refit=0.01})  # disabled
number_slider_4 = Slider(3.478, range=0..5)  # disabled
construct_point = ConstructPoint(XCoordinate=graft(range), YCoordinate=range, ZCoordinate=multiplication)  # disabled
surface_from_points = SurfaceFromPoints(Points=flatten(construct_point), UCount=expr("x+1", number_slider_2), Interpolate=False)  # disabled
surface = Surface(surface_from_points)  # disabled
area = Area(Geometry=surface)  # -> Area, Centroid; disabled
dimensions = Dimensions(Surface=surface)  # -> UDimension, VDimension; disabled
number_slider_5 = Slider(29, range=0..100)  # disabled
extrude = Extrude()  # disabled
division = Division(A=dimensions.UDimension, B=dimensions.VDimension)  # disabled
scale = Scale(Geometry=surface, Center=area.Centroid, Factor=number_slider_4)  # -> Geometry, Transform; disabled
md_slider = MDSlider(
    SliderMode=0,
    slider_value=Point(0.5964374077, 0.3989495998, 0.5),
    x_domain=Domain(0, 1),
    y_domain=Domain(0, 1),
    z_domain=Domain(0, 1))  # disabled
multiplication_2 = Multiplication(A=division, B=number_slider_5)  # disabled
pipe = Pipe(Radius=1, Caps=0)  # disabled
integer = Integer(multiplication_2)  # disabled
divide_surface = DivideSurface(Surface=surface, UCount=integer, VCount=number_slider_5)  # -> flatten(Points), Normals, Parameters; disabled
md_slider_2 = MDSlider(
    SliderMode=0,
    slider_value=Point(0.758053798, 0.3364762142, 0.5),
    x_domain=Domain(0, 1),
    y_domain=Domain(0, 1),
    z_domain=Domain(0, 1))  # disabled
number_slider_6 = Slider(0.243, range=0..2)  # disabled
pipe_variable = PipeVariable(Caps=0)  # disabled
md_slider_3 = MDSlider(
    SliderMode=0,
    slider_value=Point(0.1441892298, 0.9533711875, 0.5),
    x_domain=Domain(0, 1),
    y_domain=Domain(0, 1),
    z_domain=Domain(0, 1))  # disabled
evaluate_surface = EvaluateSurface(Surface=reparameterize(scale.Geometry), Point=[md_slider_3, md_slider, md_slider_2])  # -> Point, Normal, UDirection, VDirection, Frame; disabled
distance = Distance(PointA=graft(evaluate_surface.Point), PointB=divide_surface.Points)  # disabled
expression = Expression(w=flatten(number_slider_6), t=distance, Expression="sin(2*w^2*t)")  # disabled
sweep1 = Sweep1(Miter=1)  # disabled
flip_matrix = FlipMatrix(Data=expression)  # disabled
number_slider_7 = Slider(7.333, range=0..10)  # disabled
sweep2 = Sweep2(SameHeight=False)  # disabled
ma = MassMultiplication(Input=flip_matrix)  # -> flatten(Result), PartialResults; disabled
multiplication_3 = Multiplication(A=number_slider_7, B=ma.Result)  # disabled
rail_revolution = RailRevolution(Scale=False)  # disabled
unit_z = UnitZ(Factor=multiplication_3)  # disabled
move = Move(Geometry=divide_surface.Points, Motion=unit_z)  # -> Geometry, Transform; disabled
revolution = Revolution(Domain=Domain(0, 6.283185307))  # disabled
expression_2 = Expression(u=integer, Expression="u+1")  # disabled
extrude_along = ExtrudeAlong()  # disabled
extrude_linear = ExtrudeLinear(OrientationP=PlaneXY(0, 0, 0))  # disabled
extrude_point = ExtrudePoint()  # disabled
surface_from_points_2 = SurfaceFromPoints(Points=move.Geometry, UCount=expression_2, Interpolate=False)  # disabled
patch = Patch(Spans=20, Flexibility=1, Trim=True)  # disabled

# ----
# 024_surface_primitive
# - Daniel Christev's wonderful surfaces
center_box = CenterBox(Base=PlaneXY(0, 0, 0), X=1, Y=1, Z=1)  # disabled
number_slider_8 = Slider(38, range=0..100)  # disabled
number_slider_9 = Slider(24, range=0..100)  # disabled
cone = Cone(Base=PlaneXY(0, 0, 0), Radius=0.5, Length=1)  # -> Cone, Tip; disabled
plane_surface = PlaneSurface(Plane=PlaneXY(0, 0, 0), XSize=number_slider_8, YSize=number_slider_9)  # disabled
cylinder = Cylinder(Base=PlaneXY(0, 0, 0), Radius=0.5, Length=1)  # disabled
bounding_box = BoundingBox(Content=surface_from_points_2, Plane=PlaneXY(0, 0, 0))  # -> Box, Box_2; disabled
plane_through_shape = PlaneThroughShape(Plane=plane_surface, Shape=surface_from_points_2, Inflate=1, SectionLogic=False)  # disabled
bounding_box_2 = BoundingBox(Content=surface_from_points_2, Plane=PlaneXY(0, 0, 0), UnionBox=True)  # -> Box, Box_2; disabled
quad_sphere = QuadSphere(Base=PlaneXY(0, 0, 0), Radius=1)  # disabled
sphere = Sphere(Base=PlaneXY(0, 0, 0), Radius=1)  # disabled
