# Grasshopper definition EX_025_surface_subD.gh (Grasshopper 1.0.7)
# plug-ins: Kangaroo2 Components, Bifocals

# ----
# EXERCISES_SURFACE
# 025_surface_subD
# - new to Rhino7, very interesting substitution
# for pipe and variable pipe nodes
number_slider = Slider(10, range=0..10)  # disabled
extent_x = ExtentX(5)  # disabled
square = Square(Plane=PlaneXY(0, 0, 0), Size=number_slider, ExtentX=extent_x, ExtentY=extent_x)  # -> simplify(Cells), Points; disabled
panel = Panel("{(1to3)}[(1to3)]")  # disabled
curve = Curve(square.Cells)  # disabled
split_tree = SplitTree(Data=curve, Masks=flatten(panel))  # -> Positive, Negative; disabled
number_slider_2 = Slider(24, range=0..100)  # disabled
panel_2 = Panel("{(2)}[(1)]")  # disabled
clean_tree = CleanTree(RemoveNulls=True, RemoveInvalid=True, RemoveEmpty=False, Tree=split_tree.Positive)  # disabled
panel_3 = Panel("2")  # disabled
curve_2 = Curve(clean_tree)  # disabled
split_tree_2 = SplitTree(Data=curve_2, Masks=flatten(panel_2))  # -> Positive, Negative; disabled
range = Range(Domain=number_slider_2, Steps=panel_3)  # disabled
clean_tree_2 = CleanTree(RemoveNulls=True, RemoveInvalid=True, RemoveEmpty=False, Tree=split_tree_2.Positive)  # disabled
unit_z = UnitZ(Factor=range)  # -> graft(UnitVector); disabled
curve_3 = Curve(clean_tree_2)  # disabled
entwine = Entwine(Branch00=split_tree.Negative, Branch01=split_tree_2.Negative, Branch02=curve_3, FlattenInputs=True)  # disabled
move = Move(Geometry=entwine, Motion=unit_z)  # -> simplify(Geometry), Transform; disabled
brep_edges = BrepEdges(Brep=move.Geometry)  # -> Naked, Interior, NonManifold; disabled
boundary_surfaces = BoundarySurfaces(Edges=move.Geometry)  # disabled
curve_4 = Curve(brep_edges.Naked)  # disabled
number_slider_3 = Slider(1, range=0..1)  # disabled
number_slider_4 = Slider(1.52, range=0..10)  # disabled
number_slider_5 = Slider(2.08, range=0..10)  # disabled
number_slider_6 = Slider(1, range=0..1)  # disabled
number_slider_7 = Slider(1, range=0..2)  # disabled
curve_5 = Curve(curve_4)  # disabled
multipipe = MultiPipe(
    Curves=curve_5,
    NodeSize=number_slider_5,
    EndOffset=number_slider_3,
    StrutSize=number_slider_4,
    Segment=0,
    KinkAngle=0.6,
    CubeFit=number_slider_6,
    Caps=number_slider_7)  # disabled
number_slider_8 = Slider(1, range=0..10)  # disabled
boolean_toggle = BooleanToggle(False)  # disabled
number_slider_9 = Slider(3, range=0..3)  # disabled

mp = MultiPipe(
    Curves=curve_5,
    NodeSize=number_slider_5,
    EndOffset=number_slider_3,
    StrutSize=number_slider_4,
    Segment=0,
    KinkAngle=number_slider_6,
    CubeFit=number_slider_7)  # disabled

mesh_from_subd = MeshFromSubD(SubD=mp, Density=2)  # disabled
subd_control_polygon = SubDControlPolygon(SubD=mp)  # disabled
subd_edges = SubDEdges(SubD=mp, NewFormatting=False)  # -> Line, Edge, Tag, Id; disabled
area = Area(Geometry=mp)  # -> Area, Centroid; disabled
subd_from_mesh = SubDFromMesh(Mesh=mesh_from_subd, Creases=number_slider_8, Corners=1, Interpolate=boolean_toggle)  # disabled
curve_6 = Curve(subd_edges.Edge)  # disabled
curve_7 = Curve(subd_edges.Line)  # disabled
text_tag_3d = TextTag3D(Location=curve_7, Text=subd_edges.Id, Size=1, Justification=7)  # disabled
scale = Scale(Geometry=mp, Center=area.Centroid, Factor=0.5)  # -> Geometry, Transform; disabled
subd_fuse = SubDFuse(SubDA=mp, SubDB=scale.Geometry, BooleanOption=number_slider_9, Smoothing=10)  # disabled
