# Grasshopper definition EX_026_mesh_analysis.gh (Grasshopper 1.0.7)
# plug-ins: MeshEdit Components, Bifocals

# ----
# EXERCISES_MESH
# 026_mesh_analysis
# - download mesh edit plugin for these scripts (Mesh credit: Daniel Christev)
number_slider = Slider(40, range=0..100)  # disabled
number_slider_2 = Slider(100, range=0..100)  # disabled
number_slider_3 = Slider(4, range=0..5)  # disabled
range = Range(Domain=number_slider, Steps=number_slider_2)  # disabled
sine = Sine(Value=range)  # disabled
multiplication = Multiplication(A=sine, B=number_slider_3)  # disabled
number_slider_4 = Slider(1.679, range=0..5)  # disabled
construct_point = ConstructPoint(XCoordinate=graft(range), YCoordinate=range, ZCoordinate=multiplication)  # disabled
surface_from_points = SurfaceFromPoints(Points=flatten(construct_point), UCount=expr("x+1", number_slider_2), Interpolate=False)  # disabled
surface = Surface(surface_from_points)  # disabled
area = Area(Geometry=surface)  # -> Area, Centroid; disabled
dimensions = Dimensions(Surface=surface)  # -> UDimension, VDimension; disabled
number_slider_5 = Slider(8, range=0..100)  # disabled
division = Division(A=dimensions.UDimension, B=dimensions.VDimension)  # disabled
scale = Scale(Geometry=surface, Center=area.Centroid, Factor=number_slider_4)  # -> Geometry, Transform; disabled
md_slider = MDSlider(
    SliderMode=0,
    slider_value=Point(0.4951607309, 0.2414119069, 0.5),
    x_domain=Domain(0, 1),
    y_domain=Domain(0, 1),
    z_domain=Domain(0, 1))  # disabled
multiplication_2 = Multiplication(A=division, B=number_slider_5)  # disabled
integer = Integer(multiplication_2)  # disabled
md_slider_2 = MDSlider(
    SliderMode=0,
    slider_value=Point(0.7276408516, 0.09028392548, 0.5),
    x_domain=Domain(0, 1),
    y_domain=Domain(0, 1),
    z_domain=Domain(0, 1))  # disabled
divide_surface = DivideSurface(Surface=surface, UCount=integer, VCount=number_slider_5)  # -> flatten(Points), Normals, Parameters; disabled
number_slider_6 = Slider(0.243, range=0..2)  # disabled
md_slider_3 = MDSlider(
    SliderMode=0,
    slider_value=Point(0.1948275682, 0.7902063509, 0.5),
    x_domain=Domain(0, 1),
    y_domain=Domain(0, 1),
    z_domain=Domain(0, 1))  # disabled
evaluate_surface = EvaluateSurface(Surface=reparameterize(scale.Geometry), Point=[md_slider_3, md_slider, md_slider_2])  # -> Point, Normal, UDirection, VDirection, Frame; disabled
distance = Distance(PointA=graft(evaluate_surface.Point), PointB=divide_surface.Points)  # disabled
point = Point(divide_surface.Points)  # disabled
expression = Expression(w=flatten(number_slider_6), t=distance, Expression="sin(2*w^2*t)")  # disabled
flip_matrix = FlipMatrix(Data=expression)  # disabled
number_slider_7 = Slider(7.333, range=0..10)  # disabled
ma = MassMultiplication(Input=flip_matrix)  # -> flatten(Result), PartialResults; disabled
multiplication_3 = Multiplication(A=number_slider_7, B=ma.Result)  # disabled
unit_z = UnitZ(Factor=multiplication_3)  # disabled
move = Move(Geometry=divide_surface.Points, Motion=unit_z)  # -> Geometry, Transform; disabled
expression_2 = Expression(u=integer, Expression="u+1")  # disabled
colour_swatch = ColourSwatch(SwatchColor=RGB(236, 45, 255))  # disabled
mesh_frompoints = MeshFromPoints(Points=move.Geometry, UDirection=expr("x+1", integer), VDirection=expr("x+1", number_slider_5), Colour=colour_swatch)  # disabled
surface_from_points_2 = SurfaceFromPoints(Points=move.Geometry, UCount=expression_2, Interpolate=False)  # disabled

# ----
# - CTRL-M toggles mesh edges on and off
# - bake and repair mesh in rhino
number_slider_8 = Slider(44, range=0..100)  # disabled
boolean_toggle = BooleanToggle(False)  # disabled
mesh = Mesh(surface_from_points_2)  # disabled
bounding_box = BoundingBox(Content=mesh, Plane=PlaneXY(0, 0, 0))  # -> Box, Box_2; disabled
populate_2d = Populate2D(Region=bounding_box.Box, Count=number_slider_8, Seed=1)  # disabled
mesh_2 = Mesh(mesh_frompoints)  # disabled
number_slider_9 = Slider(12, range=0..100)  # disabled
face_normals = FaceNormals(Mesh=mesh)  # -> Centers, Normals; disabled
mesh_convertquads = MeshConvertQuads(Mesh=mesh, ShortDiagonal=boolean_toggle)  # -> Mesh, Split; disabled
mesh_edges = MeshEdges(Mesh=mesh)  # -> NakedEdges, InteriorEdges, NonManifoldEdges; disabled
mesh_triangulate = MeshTriangulate(Mesh=mesh, ShortDiagonal=boolean_toggle)  # disabled
mesh_area = MeshArea(Mesh=mesh)  # -> Area, Centroid; disabled
mesh_closest_point = MeshClosestPoint(Point=populate_2d, Mesh=mesh)  # -> Point, Index, Parameter; disabled
bounding_box_2 = BoundingBox(Content=mesh_2, Plane=PlaneXY(0, 0, 0))  # -> Box, Box_2; disabled
mesh_addattributes = MeshAddAttributes(Mesh=mesh, Clear=False)  # -> RuntimeMessage, Mesh; disabled
data_recorder = DataRecorder(mesh_closest_point.Parameter, DataLimit=-10, RecordData=True)  # disabled
mesh_box = MeshBox(Base=bounding_box_2.Box, XCount=10, YCount=10, ZCount=10)  # disabled
amplitude = Amplitude(Vector=face_normals.Normals, Amplitude=number_slider_9)  # disabled
point_2 = Point(mesh_area.Centroid)  # disabled
sphere = Sphere(Base=face_normals.Centers, Radius=1)  # disabled
line = Line(StartPoint=populate_2d, EndPoint=mesh_closest_point.Point)  # disabled
mesh_3 = Mesh(mesh_convertquads.Mesh)  # disabled
mesh_4 = Mesh(mesh_triangulate)  # disabled
line_2 = Line(mesh_edges.NakedEdges)  # disabled
line_3 = Line(mesh_edges.NonManifoldEdges)  # disabled
line_4 = Line(mesh_edges.InteriorEdges)  # disabled
mesh_eval = MeshEval(Mesh=mesh, Parameter=data_recorder)  # -> Point, Normal, Colour; disabled
panel = Panel(mesh_addattributes.RuntimeMessage)  # disabled
panel_2 = Panel(mesh_convertquads.Split)  # disabled
mesh_5 = Mesh(mesh_addattributes.Mesh)  # disabled
galapagos = Galapagos()
mesh_split = MeshSplit(Mesh=mesh_box, Splitters=mesh_2)  # disabled
panel_3 = Panel(mesh_closest_point.Parameter)  # disabled
vector_display = VectorDisplay(Anchor=face_normals.Centers, Vector=amplitude)  # disabled
mesh_nakededge = MeshNakedEdge(Mesh=mesh)  # -> V, A, B; disabled
point_3 = Point(mesh_eval.Point)  # disabled
dispatch = Dispatch(List=mesh_split, DispatchPattern=[True, False])  # -> ListA, ListB; disabled
vector_display_2 = VectorDisplay(Anchor=mesh_eval.Normal)  # disabled
panel_4 = Panel(mesh_nakededge.A)  # disabled
point_4 = Point(mesh_nakededge.V)  # disabled
panel_5 = Panel(mesh_nakededge.B)  # disabled
mesh_6 = Mesh(mesh_2)  # disabled
mesh_7 = Mesh(dispatch.ListA)  # disabled
mesh_join = MeshJoin(Meshes=flatten([mesh_7, mesh_6]))  # disabled
boolean_toggle_2 = BooleanToggle(True)  # disabled
mesh_8 = Mesh(surface_from_points_2)  # disabled
construct_point_2 = ConstructPoint(XCoordinate=0, YCoordinate=0, ZCoordinate=0)  # disabled
mesh_sphere = MeshSphere(Base=PlaneXY(0, 0, 0), Radius=10, UCount=10, VCount=20)  # disabled
deconstruct_mesh = DeconstructMesh(Mesh=mesh_8)  # -> Vertices, Faces, Colours, Normals; disabled
mesh_explode = MeshExplode(Mesh=mesh_8, Interpolate=boolean_toggle_2)  # disabled
mesh_inclusion = MeshInclusion(Mesh=mesh_sphere, Point=construct_point_2, Strict=False)  # disabled
deconstruct_face = DeconstructFace(Face=deconstruct_mesh.Faces)  # -> CornerA, CornerB, CornerC, CornerD; disabled
face_boundaries = FaceBoundaries(Mesh=mesh_explode)  # disabled
panel_7 = Panel(mesh_inclusion)  # disabled
panel_8 = Panel(deconstruct_face.CornerA)  # disabled
curve = Curve(face_boundaries)  # disabled
panel_9 = Panel(deconstruct_face.CornerB)  # disabled
panel_10 = Panel(deconstruct_face.CornerC)  # disabled
panel_11 = Panel(deconstruct_face.CornerD)  # disabled

triangulate = Triangulate(Mesh=mesh_join)  # -> Mesh, Count; disabled
quadrangulate = Quadrangulate(Mesh=mesh_join, Angle=0.03490658504, Ratio=0.875)  # -> Mesh, Count; disabled
