# Grasshopper definition EX_027_mesh_primitive.gh (Grasshopper 1.0.7)

# ----
# 027_mesh_primitive
mesh_plane = MeshPlane(Boundary={Plane=PlaneXY(0, 0, 0), Size=Domain2(u=-10..10, v=-10..10)}, WidthCount=10, HeightCount=10)  # -> Mesh, Area; disabled
# EXERCISES_MESH
mesh_box = MeshBox(Base={Plane=PlaneXY(0, 0, 0), X=Domain(-10, 10), Y=Domain(-10, 10), Z=Domain(-10, 10)}, XCount=10, YCount=10, ZCount=10)  # disabled
mesh_sphere = MeshSphere(Base=PlaneXY(0, 0, 0), Radius=10, UCount=10, VCount=20)  # disabled
mesh_sphere_ex = MeshSphereEx(Base=PlaneXY(0, 0, 0), Radius=10, Count=5)  # disabled
deconstruct_mesh = DeconstructMesh(Mesh=mesh_box)  # -> Vertices, Faces, Colours, Normals; disabled
colour_swatch = ColourSwatch(SwatchColor=RGB(231, 255, 255))  # disabled
construct_mesh = ConstructMesh(Vertices=deconstruct_mesh.Vertices, Faces=deconstruct_mesh.Faces, Colours=colour_swatch)  # disabled
deconstruct_face = DeconstructFace(Face=deconstruct_mesh.Faces)  # -> CornerA, CornerB, CornerC, CornerD; disabled
mesh_triangle = MeshTriangle(CornerA=deconstruct_face.CornerA, CornerB=deconstruct_face.CornerB, CornerC=deconstruct_face.CornerC)  # disabled
mesh_quad = MeshQuad(
    CornerA=deconstruct_face.CornerA,
    CornerB=deconstruct_face.CornerB,
    CornerC=deconstruct_face.CornerC,
    CornerD=deconstruct_face.CornerD)  # disabled
colour_swatch_2 = ColourSwatch(SwatchColor=RGB(223, 122, 255))  # disabled
construct_mesh_2 = ConstructMesh(Vertices=deconstruct_mesh.Vertices, Faces=mesh_triangle, Colours=colour_swatch_2)  # disabled
colour_swatch_3 = ColourSwatch(SwatchColor=RGB(255, 0, 0))  # disabled
colour_swatch_4 = ColourSwatch(SwatchColor=RGB(0, 255, 255))  # disabled
colour_swatch_5 = ColourSwatch(SwatchColor=RGB(223, 122, 255))  # disabled
colour_swatch_6 = ColourSwatch(SwatchColor=RGB(255, 255, 0))  # disabled
point = Point([<point referenced from the Rhino model> x4])  # disabled
colours = Colours([RGB(127, 255, 0), RGB(0, 100, 0), RGB(34, 139, 34), RGB(124, 252, 0), RGB(154, 205, 50), RGB(173, 255, 47), RGB(50, 205, 50), RGB(152, 251, 152)])  # disabled
mesh_spray = MeshSpray(
    Mesh=construct_mesh_2,
    Points=point,
    Colours=[colour_swatch_4, colour_swatch_5, colour_swatch_6, colour_swatch_3],
    SprayMode=11)  # disabled
mesh_colours = MeshColours(Mesh=construct_mesh_2, Colours=colours)  # disabled
panel = Panel(colours)  # disabled
