# Grasshopper definition EX_028_mesh_triangulation.gh (Grasshopper 1.0.7)

# ----
# EXERCISES_MESH
# 028_mesh_triangulation
# - mesh from points
# - intro to voronoi, metaball, octree, etc...
# - see section 3 for plugin details like
# weaverbird and coccoon
number_slider = Slider(26, range=0..100)  # disabled
number_slider_2 = Slider(71, range=0..100)  # disabled
number_slider_3 = Slider(12, range=0..100)  # disabled
number_slider_4 = Slider(26, range=0..100)  # disabled
number_slider_5 = Slider(71, range=0..100)  # disabled
number_slider_6 = Slider(26, range=0..100)  # disabled
number_slider_7 = Slider(71, range=0..100)  # disabled
number_slider_8 = Slider(26, range=0..100)  # disabled
number_slider_9 = Slider(71, range=0..100)  # disabled
number_slider_10 = Slider(26, range=0..100)  # disabled
number_slider_11 = Slider(71, range=0..100)  # disabled
number_slider_12 = Slider(26, range=0..100)  # disabled
number_slider_13 = Slider(71, range=0..100)  # disabled
center_box = CenterBox(Base=PlaneXY(0, 0, 0), X=number_slider, Y=number_slider, Z=number_slider)  # disabled
center_box_2 = CenterBox(Base=PlaneXY(0, 0, 0), X=number_slider_4, Y=number_slider_4, Z=number_slider_4)  # disabled
center_box_3 = CenterBox(Base=PlaneXY(0, 0, 0), X=number_slider_6, Y=number_slider_6, Z=number_slider_6)  # disabled
center_box_4 = CenterBox(Base=PlaneXY(0, 0, 0), X=number_slider_8, Y=number_slider_8, Z=number_slider_8)  # disabled
center_box_5 = CenterBox(Base=PlaneXY(0, 0, 0), X=number_slider_10, Y=number_slider_10, Z=number_slider_10)  # disabled
center_box_6 = CenterBox(Base=PlaneXY(0, 0, 0), X=number_slider_12, Y=number_slider_12, Z=number_slider_12)  # disabled
populate_3d = Populate3D(Region=center_box, Count=number_slider_2, Seed=number_slider_3)  # disabled
populate_3d_2 = Populate3D(Region=center_box_2, Count=number_slider_5, Seed=number_slider_3)  # disabled
populate_3d_3 = Populate3D(Region=center_box_3, Count=number_slider_7, Seed=number_slider_3)  # disabled
populate_3d_4 = Populate3D(Region=center_box_4, Count=number_slider_9, Seed=number_slider_3)  # disabled
populate_3d_5 = Populate3D(Region=center_box_5, Count=number_slider_11, Seed=number_slider_3)  # disabled
populate_3d_6 = Populate3D(Region=center_box_6, Count=number_slider_13, Seed=number_slider_3)  # disabled
deconstruct = Deconstruct(Point=populate_3d_4)  # -> XComponent, YComponent, ZComponent; disabled
number_slider_14 = Slider(0.344, range=0..1)  # disabled
absolute = Absolute(Value=deconstruct.XComponent)  # disabled
number_slider_15 = Slider(7, range=0..10)  # disabled
number_slider_16 = Slider(0.11, range=0..1)  # disabled
boolean_toggle = BooleanToggle(False)  # disabled
multiplication = Multiplication(A=number_slider_14, B=absolute)  # disabled
construct_point = ConstructPoint(XCoordinate=0, YCoordinate=0, ZCoordinate=0)  # disabled
xy_plane = XYPlane(Origin=Point(0, 0, 0))  # disabled
delaunay_edges = DelaunayEdges(Points=populate_3d, Plane=PlaneXY(0, 0, 0))  # -> Connectivity, Edges; disabled
delaunay_edges_2 = DelaunayEdges(Points=populate_3d_2, Plane=PlaneXY(0, 0, 0))  # -> Connectivity, Edges; disabled
metaball_t = MetaBallT(Points=populate_3d_4, Plane=PlaneXY(0, 0, 0), Threshold=number_slider_16)  # disabled
voronoi_3d = Voronoi3D(Points=populate_3d_3)  # -> Cells, Boundary; disabled
voronoi = Voronoi(Points=populate_3d_3, Plane=xy_plane, BruteForceOverride=False)  # disabled
metaball_t_custom = MetaBallTCustom(Points=populate_3d_4, Charge=multiplication, Plane=PlaneXY(0, 0, 0), Threshold=0.5)  # disabled
octree = OcTree(Points=populate_3d_5, Square=boolean_toggle, Group=number_slider_15)  # -> Boxes, Points; disabled
convex_hull = ConvexHull(Points=populate_3d_6, Plane=PlaneXY(0, 0, 0))  # -> Hull, HullZ, Indices; disabled
metaball = MetaBall(Points=populate_3d_4, Plane=PlaneXY(0, 0, 0), Point=construct_point)  # disabled
delaunay_mesh = DelaunayMesh(Points=populate_3d, Plane=PlaneXY(0, 0, 0))  # disabled
delaunay_mesh_2 = DelaunayMesh(Points=populate_3d_2, Plane=PlaneXY(0, 0, 0))  # disabled
curve = Curve(convex_hull.Hull)  # disabled
curve_2 = Curve(convex_hull.HullZ)  # disabled
