# Grasshopper definition EX_029_mesh_utilities.gh (Grasshopper 1.0.7)
# plug-ins: MeshEdit Components

# ----
# EXERCISES_MESH
# 029_mesh_utilities
number_slider = Slider(40, range=0..100)  # disabled
number_slider_2 = Slider(100, range=0..100)  # disabled
number_slider_3 = Slider(4, range=0..5)  # disabled
range = Range(Domain=number_slider, Steps=number_slider_2)  # disabled
sine = Sine(Value=range)  # disabled
multiplication = Multiplication(A=sine, B=number_slider_3)  # disabled
number_slider_4 = Slider(1.679, range=0..5)  # disabled
construct_point = ConstructPoint(XCoordinate=graft(range), YCoordinate=range, ZCoordinate=multiplication)  # disabled
surface_from_points = SurfaceFromPoints(Points=flatten(construct_point), UCount=expr("x+1", number_slider_2), Interpolate=False)  # disabled
surface = Surface(surface_from_points)  # disabled
area = Area(Geometry=surface)  # -> Area, Centroid; disabled
dimensions = Dimensions(Surface=surface)  # -> UDimension, VDimension; disabled
number_slider_5 = Slider(8, range=0..100)  # disabled
division = Division(A=dimensions.UDimension, B=dimensions.VDimension)  # disabled
scale = Scale(Geometry=surface, Center=area.Centroid, Factor=number_slider_4)  # -> Geometry, Transform; disabled
md_slider = MDSlider(
    SliderMode=0,
    slider_value=Point(0.4951607309, 0.2414119069, 0.5),
    x_domain=Domain(0, 1),
    y_domain=Domain(0, 1),
    z_domain=Domain(0, 1))  # disabled
multiplication_2 = Multiplication(A=division, B=number_slider_5)  # disabled
integer = Integer(multiplication_2)  # disabled
divide_surface = DivideSurface(Surface=surface, UCount=integer, VCount=number_slider_5)  # -> flatten(Points), Normals, Parameters; disabled
md_slider_2 = MDSlider(
    SliderMode=0,
    slider_value=Point(0.7276408516, 0.09028392548, 0.5),
    x_domain=Domain(0, 1),
    y_domain=Domain(0, 1),
    z_domain=Domain(0, 1))  # disabled
number_slider_6 = Slider(0.243, range=0..2)  # disabled
md_slider_3 = MDSlider(
    SliderMode=0,
    slider_value=Point(0.1948275682, 0.7902063509, 0.5),
    x_domain=Domain(0, 1),
    y_domain=Domain(0, 1),
    z_domain=Domain(0, 1))  # disabled
evaluate_surface = EvaluateSurface(Surface=reparameterize(scale.Geometry), Point=[md_slider_3, md_slider, md_slider_2])  # -> Point, Normal, UDirection, VDirection, Frame; disabled
distance = Distance(PointA=graft(evaluate_surface.Point), PointB=divide_surface.Points)  # disabled
point = Point(divide_surface.Points)  # disabled
expression = Expression(w=flatten(number_slider_6), t=distance, Expression="sin(2*w^2*t)")  # disabled
flip_matrix = FlipMatrix(Data=expression)  # disabled
number_slider_7 = Slider(7.333, range=0..10)  # disabled
ma = MassMultiplication(Input=flip_matrix)  # -> flatten(Result), PartialResults; disabled
multiplication_3 = Multiplication(A=number_slider_7, B=ma.Result)  # disabled
unit_z = UnitZ(Factor=multiplication_3)  # disabled
move = Move(Geometry=divide_surface.Points, Motion=unit_z)  # -> Geometry, Transform; disabled
expression_2 = Expression(u=integer, Expression="u+1")  # disabled
colour_swatch = ColourSwatch(SwatchColor=RGB(236, 45, 255))  # disabled
mesh_frompoints = MeshFromPoints(Points=move.Geometry, UDirection=expr("x+1", integer), VDirection=expr("x+1", number_slider_5), Colour=colour_swatch)  # disabled
surface_from_points_2 = SurfaceFromPoints(Points=move.Geometry, UCount=expression_2, Interpolate=False)  # disabled

# ----
# - brep to mesh
brep = Brep(surface_from_points_2)  # disabled
brep_2 = Brep(surface_from_points_2)  # disabled
number_slider_8 = Slider(4, range=0..100)  # disabled
boolean_toggle = BooleanToggle(True)  # disabled
boolean_toggle_2 = BooleanToggle(True)  # disabled
boolean_toggle_3 = BooleanToggle(True)  # disabled
mesh_brep = MeshBrep(
    Brep=brep,
    Settings={GridMaxCount=0, GridMinCount=16, JaggedSeams=False, MaxEdgeLength=0, MinEdgeLength=0.0001, MinTolerance=0, Refine=True, RefineAngle=0, RelativeTolerance=0.65, SimplePlanes=True, Tolerance=0})  # disabled
simple_mesh = SimpleMesh(Brep=brep)  # disabled
surface_2 = Surface(brep_2)  # disabled
flip_mesh = FlipMesh(Mesh=simple_mesh, VertexNormals=boolean_toggle, FaceNormals=boolean_toggle_2, FaceOrientation=boolean_toggle_3)  # disabled
mesh_unifynormals = MeshUnifyNormals(Mesh=mesh_brep)  # disabled
mesh_surface = MeshSurface(Surface=surface_2, UCount=number_slider_8, VCount=number_slider_8, Overhang=True, Equalize=False)  # disabled
mesh_brep_2 = MeshBrep(
    Brep=brep_2,
    Settings={GridMaxCount=0, GridMinCount=16, JaggedSeams=False, MaxEdgeLength=0, MinEdgeLength=0.0001, MinTolerance=0, Refine=True, RefineAngle=0, RelativeTolerance=0.65, SimplePlanes=True, Tolerance=0})  # disabled
number_slider_9 = Slider(7, range=0..10)  # disabled
triangulate = Triangulate(Mesh=mesh_unifynormals)  # -> Mesh, Count; disabled
quadrangulate = Quadrangulate(Mesh=mesh_unifynormals, Angle=0.03490658504, Ratio=0.875)  # -> Mesh, Count; disabled
deconstruct_mesh = DeconstructMesh(Mesh=mesh_brep_2)  # -> Vertices, Faces, Colours, Normals; disabled
mesh_flip = MeshFlip(Mesh=flip_mesh)  # disabled
mesh_weldvertices = MeshWeldVertices(Mesh=[mesh_unifynormals, mesh_flip], Tolerance=0.01)  # -> RuntimeMessage, Mesh; disabled
list_length = ListLength(List=deconstruct_mesh.Vertices)  # disabled
number_slider_10 = Slider(513, range=0..1000)  # disabled
list_length_2 = ListLength(List=deconstruct_mesh.Faces)  # disabled
division_2 = Division(A=list_length, B=number_slider_9)  # disabled
panel = Panel(mesh_weldvertices.RuntimeMessage)  # disabled
range_2 = Range(Domain=list_length_2, Steps=number_slider_10)  # disabled
series = Series(Start=0, Step=number_slider_9, Count=division_2)  # disabled
panel_2 = Panel("""0
11
0""")  # disabled
cull_vertices = CullVertices(Mesh=mesh_brep_2, Pattern=panel_2, Shrink=True)  # disabled
cull_faces = CullFaces(Mesh=mesh_brep_2, Pattern=panel_2)  # disabled
delete_faces = DeleteFaces(Mesh=mesh_brep_2, Indices=range_2)  # disabled
delete_vertices = DeleteVertices(Mesh=mesh_brep_2, Indices=series, Shrink=True)  # disabled
mesh_join = MeshJoin(Meshes=[delete_faces, delete_vertices])  # disabled
panel_3 = Panel(mesh_join)  # disabled
weld_mesh = WeldMesh(Mesh=mesh_join, Angle=3.141592654)  # disabled
panel_4 = Panel(weld_mesh)  # disabled
unweld_mesh = UnweldMesh(Mesh=weld_mesh, Angle=1.570796327)  # disabled
panel_5 = Panel(unweld_mesh)  # disabled

# ----
# - I have seen this used once in generative design series:
# great video series (5 videos)
# Intermediate to advanced levels
occlusion = Occlusion()  # -> Hits, Occlusion; disabled

# ----
# - parametric mesh shadow
number_slider_11 = Slider(1, range=0..1)  # disabled
number_slider_12 = Slider(0.49, range=0..1)  # disabled
number_slider_13 = Slider(0.09, range=0..1)  # disabled
bounding_box = BoundingBox(Content=delete_vertices, Plane=PlaneXY(0, 0, 0))  # -> Box, Box_2; disabled
number_slider_14 = Slider(4, range=0..10)  # disabled
negative = Negative(Value=number_slider_11)  # disabled
deconstruct_brep = DeconstructBrep(Brep=bounding_box.Box)  # -> Faces, Edges, Vertices; disabled
vector_xyz = VectorXYZ(XComponent=number_slider_12, YComponent=number_slider_13, ZComponent=negative)  # -> Vector, Length; disabled
list_item = ListItem(List=deconstruct_brep.Faces, Index=number_slider_14, Wrap=True)  # disabled
number_slider_15 = Slider(0, range=0..100)  # disabled
mesh_shadow = MeshShadow(Mesh=weld_mesh, Light=vector_xyz.Vector, Plane=list_item)  # disabled
panel_6 = Panel("0")  # disabled
cull_index = CullIndex(List=mesh_shadow, Indices=panel_6, Wrap=True)  # disabled
list_item_2 = ListItem(List=mesh_shadow, Index=number_slider_15, Wrap=True)  # disabled
boundary_surfaces = BoundarySurfaces(Edges=cull_index)  # disabled
split_brep_multiple = SplitBrepMultiple(Brep=list_item_2, Cutters=boundary_surfaces)  # disabled
list_item_3 = ListItem(List=split_brep_multiple, Index=0, Wrap=True)  # -> Item1, Item; disabled
