# Grasshopper definition EX_030_intersect_mathematical.gh (Grasshopper 1.0.7)
# plug-ins: Kangaroo2 Components

# ----
# 030_intersect_mathematical
# - consider and visualize how points, lines and curves
# are created by intersections
# - controling plane region
# - isovist can product very interesting effects
number_slider = Slider(12, range=0..100)  # disabled
number_slider_2 = Slider(6, range=0..10)  # disabled
number_slider_3 = Slider(13, range=0..100)  # disabled
# EXERCISES_INTERSECT
brep_line = BrepLine(LimitToFirst=False)  # -> Curves, Points; disabled
curve_plane = CurvePlane()  # -> Points, ParamsC, ParamsP; disabled
origin = Origin([Point(-45.78873606, -28.06335384, 0), Point(16.72870203, 65.64266703, 0), Point(-58.87617381, 62.3246864, 0), Point(101.0585885, -89.13142274, 0)])  # disabled
xz_plane = XZPlane(Origin=Point(0, 0, 0))  # disabled
xz_plane_2 = XZPlane(Origin=Point(0, 0, 0))  # disabled
number_slider_4 = Slider(2, range=0..2)  # disabled
radial = Radial(Plane=PlaneXY(0, 0, 0), Size=number_slider, ExtentR=number_slider_2, ExtentP=number_slider_2)  # -> Cells, simplify(Points); disabled
number_slider_5 = Slider(0.33, range=0..1)  # disabled
number_slider_6 = Slider(0.92, range=0..1)  # disabled
number_slider_7 = Slider(0.53, range=0..1)  # disabled
number_slider_8 = Slider(0.22, range=0..1)  # disabled
mesh_plane = MeshPlane()  # disabled
number_slider_9 = Slider(5, range=0..10)  # disabled
line_line = LineLine()  # -> ParamA, ParamB, PointA, PointB; disabled
plane_origin = PlaneOrigin(Base=xz_plane_2, Origin=origin)  # disabled
panel = Panel("0")  # disabled
sphere = Sphere(Base=PlaneXY(0, 0, 0), Radius=number_slider_3)  # disabled
mesh_ray = MeshRay()  # -> Point, Hit; disabled
number_slider_10 = Slider(2, range=0..10)  # disabled
number_slider_11 = Slider(6.78, range=0.1..10)  # disabled
number_slider_12 = Slider(1.3, range=0.1..3)  # disabled
explode_tree = ExplodeTree(Data=graft(plane_origin))  # -> Branch0, Branch1, Branch2, Branch3; disabled
flip_matrix = FlipMatrix(Data=radial.Points)  # disabled
pi = Pi(Factor=number_slider_5)  # disabled
pi_2 = Pi(Factor=number_slider_7)  # disabled
pi_3 = Pi(Factor=number_slider_6)  # disabled
plane_plane = PlanePlane()  # disabled
pi_4 = Pi(Factor=number_slider_8)  # disabled
surface_line = SurfaceLine(LimitToFirst=False)  # -> Curves, Points, UVPoints, Normal; disabled
range = Range(Domain=number_slider_4, Steps=number_slider_9)  # disabled
cull_index = CullIndex(List=flip_matrix, Indices=panel, Wrap=True)  # disabled
isovist_ray = IsoVistRay(Radius=100)  # -> Point, Distance, Index; disabled
rotate_3d = Rotate3D(Geometry=explode_tree.Branch0, Angle=pi_4, Center=explode_tree.Branch0, Axis=Vector(0, 0, 1))  # -> Geometry, Transform; disabled
rotate_3d_2 = Rotate3D(Geometry=explode_tree.Branch1, Angle=pi_3, Center=explode_tree.Branch0, Axis=Vector(0, 0, 1))  # -> Geometry, Transform; disabled
rotate_3d_3 = Rotate3D(Geometry=explode_tree.Branch2, Angle=pi_2, Center=explode_tree.Branch2, Axis=Vector(0, 0, 1))  # -> Geometry, Transform; disabled
rotate_3d_4 = Rotate3D(Geometry=explode_tree.Branch3, Angle=pi, Center=explode_tree.Branch3, Axis=Vector(0, 0, 1))  # -> Geometry, Transform; disabled
construct_domain = ConstructDomain(DomainStart=number_slider_12, DomainEnd=number_slider_11)  # disabled
plane_plane_plane = PlanePlanePlane()  # -> Point, LineAB, LineAC, LineBC; disabled
list_length = ListLength(List=cull_index)  # disabled
pi_5 = Pi(Factor=range)  # disabled
contour = Contour(Shape=sphere, Point=Point(0, 0, 0), Direction=Vector(0, 0, 1), Distance=number_slider_10)  # disabled
xz_plane_3 = XZPlane(Origin=Point(0, 0, 0))  # disabled
yz_plane = YZPlane(Origin=Point(0, 0, 0))  # disabled
xy_plane = XYPlane(Origin=Point(0, 0, 0))  # disabled
panel_2 = Panel("3")  # disabled
range_2 = Range(Domain=construct_domain, Steps=expr("x-1", list_length))  # disabled
plane = Plane(PlaneXY(0, 0, 0))  # disabled
series = Series(Start=panel_2, Step=1, Count=list_length)  # disabled
number_slider_13 = Slider(29, range=0..100)  # disabled
number_slider_14 = Slider(11, range=0..100)  # disabled
plane_region = PlaneRegion(Plane=plane, Bounds=flatten([rotate_3d_3.Geometry, rotate_3d.Geometry, rotate_3d_2.Geometry, rotate_3d_4.Geometry]))  # disabled
rotate_3d_5 = Rotate3D(Geometry=xz_plane, Angle=pi_5, Center=xz_plane, Axis=graft([yz_plane, xz_plane_3, xy_plane]))  # -> Geometry, Transform; disabled
curve = Curve(plane_region)  # disabled
construct_point = ConstructPoint(XCoordinate=number_slider_14, YCoordinate=number_slider_13, ZCoordinate=0)  # disabled
brep_plane = BrepPlane(Brep=sphere, Plane=rotate_3d_5.Geometry)  # -> Curves, Points; disabled
origin_2 = Origin(construct_point)  # disabled
xy_plane_2 = XYPlane(Origin=origin_2)  # disabled
number_slider_15 = Slider(248, range=0..1000)  # disabled
number_slider_16 = Slider(242, range=0..1000)  # disabled
multipipe = MultiPipe(Curves=contour, NodeSize=0.5, EndOffset=1, StrutSize=1, Segment=0, KinkAngle=0.6, CubeFit=0, Caps=0)  # disabled
polygon = Polygon(Plane=flatten(cull_index), Radius=flatten(range_2), Segments=flatten(series), FilletRadius=0)  # -> flatten(Polygon), Length; disabled
plane_2 = Plane(xy_plane_2)  # disabled
isovist = IsoVist(Plane=plane_2, Count=number_slider_15, Radius=number_slider_16, Obstacles=polygon.Polygon)  # -> Points, Distance, Index; disabled
line = Line(StartPoint=origin_2, EndPoint=isovist.Points)  # disabled

# ----
# - I have seen this used once in generative design series:
# great video series (5 videos)
# Intermediate to advanced levels
occlusion = Occlusion()  # -> Hits, Occlusion; disabled
