# Grasshopper definition EX_031_intersect_physical.gh (Grasshopper 1.0.7)
# plug-ins: Kangaroo2 Components

# ----
# 031_intersect_physical
# - consider and visualize how points, lines and curves
# are created by intersections
number_slider = Slider(12, range=0..100)  # disabled
curve = Curve([<curve referenced from the Rhino model> x2])  # disabled
# EXERCISES_INTERSECT
curve_curve = CurveCurve()  # -> Points, ParamsA, ParamsB; disabled
number_slider_2 = Slider(2, range=0..10)  # disabled
number_slider_3 = Slider(10, range=0..10)  # disabled
loft = Loft(Curves=curve, Options={Adjust=False, Closed=False, LoftEnds=0, LoftSimp=0, LoftType=0, Rebuild=10, Refit=0.01})  # disabled
number_slider_4 = Slider(2, range=0..10)  # disabled
number_slider_5 = Slider(12, range=0..100)  # disabled
triangular = Triangular(Plane=PlaneXY(0, 0, 0), Size=number_slider, ExtentX=5, ExtentY=5)  # -> Cells, Points; disabled
multiple_curves = MultipleCurves()  # -> Points, IndexA, IndexB, ParamA, ParamB; disabled
divide_surface = DivideSurface(Surface=loft, UCount=number_slider_2, VCount=number_slider_3)  # -> Points, Normals, Parameters; disabled
construct_point = ConstructPoint(XCoordinate=0, YCoordinate=0, ZCoordinate=0)  # disabled
list_length = ListLength(List=triangular.Points)  # disabled
curve_self = CurveSelf()  # -> Points, Params; disabled
construct_domain = ConstructDomain(DomainStart=number_slider_4, DomainEnd=number_slider_5)  # disabled
expression = Expression(x=list_length, Expression="x-1")  # disabled
distance = Distance(PointA=divide_surface.Points, PointB=construct_point)  # disabled
number_slider_6 = Slider(12, range=0..100)  # disabled
number_slider_7 = Slider(0, range=0..1)  # disabled
number_slider_8 = Slider(12, range=0..100)  # disabled
brep_curve = BrepCurve()  # -> Curves, Points; disabled
range = Range(Domain=construct_domain, Steps=expression)  # disabled
flatten_tree = FlattenTree(Tree=distance, Path="{0}")  # disabled
surface_curve = SurfaceCurve()  # -> Curves, Points, UVPoints, Normals, Parameters, Tangents; disabled
construct_domain_2 = ConstructDomain(DomainStart=0, DomainEnd=number_slider_6)  # disabled
bounds = Bounds(Numbers=flatten(flatten_tree))  # disabled
jitter = Jitter(List=range, Jitter=number_slider_7, Seed=number_slider_8)  # -> Values, Indices; disabled
cone = Cone(Base=triangular.Points, Radius=jitter.Values, Length=jitter.Values)  # -> Cone, Tip; disabled
reverse = Reverse(Vector=divide_surface.Normals)  # disabled
remap_numbers = RemapNumbers(Value=distance, Source=bounds, Target=construct_domain_2)  # -> Mapped, Clipped; disabled
mesh_curve = MeshCurve()  # -> Points, Faces; disabled
cap_holes = CapHoles(Brep=cone.Cone)  # disabled
mesh_mesh = MeshMesh()  # disabled
line_sdl = LineSDL(Start=divide_surface.Points, Direction=reverse, Length=remap_numbers.Mapped)  # disabled
number_slider_9 = Slider(1, range=0..1)  # disabled
number_slider_10 = Slider(52, range=0..100)  # disabled
brep_brep = BrepBrep(BrepA=flatten(cap_holes), BrepB=cap_holes)  # -> Curves, Points; disabled
panel = Panel("1")  # disabled
end_points = EndPoints(Curve=flatten(line_sdl))  # -> Start, End; disabled
addition = Addition(A=number_slider_2, B=panel)  # disabled
boolean_toggle = BooleanToggle(True)  # disabled
point = Point(end_points.End)  # disabled
quad_sphere = QuadSphere(Base=PlaneXY(0, 0, 0), Radius=number_slider_10)  # disabled
multipipe = MultiPipe(Curves=brep_brep.Curves, NodeSize=number_slider_9, EndOffset=1, StrutSize=1, Segment=0, KinkAngle=0.6, CubeFit=0, Caps=0)  # disabled
surface_from_points = SurfaceFromPoints(Points=flatten(point), UCount=addition, Interpolate=boolean_toggle)  # disabled
deconstruct_brep = DeconstructBrep(Brep=quad_sphere)  # -> Faces, Edges, Vertices; disabled
merge = Merge()  # disabled
entwine = Entwine(Branch00=loft, Branch01=surface_from_points, FlattenInputs=True)  # disabled
curve_2 = Curve(deconstruct_brep.Edges)  # disabled
surface_split = SurfaceSplit(Surface=surface_from_points, Curves=deconstruct_brep.Edges)  # disabled
list_item = ListItem(List=surface_split, Index=0, Wrap=True)  # disabled
surface = Surface(list_item)  # disabled
