# Grasshopper definition EX_033_intersect_shape.gh (Grasshopper 1.0.7)
# plug-ins: MeshEdit Components

# ----
# - split and trim with breps
number_slider = Slider(89, range=0..100)  # disabled
number_slider_2 = Slider(10, range=0..10)  # disabled
range = Range(Domain=Domain(0, 1), Steps=number_slider)  # disabled
range_2 = Range(Domain=Domain(0, 1), Steps=number_slider)  # disabled
jitter = Jitter(List=range, Jitter=1, Seed=2)  # -> Values, Indices; disabled
sphere = Sphere(Base=PlaneXY(0, 0, 0), Radius=number_slider_2)  # disabled
construct_point = ConstructPoint(XCoordinate=range_2, YCoordinate=jitter.Values, ZCoordinate=0)  # disabled
evaluate_surface = EvaluateSurface(Surface=reparameterize(sphere), Point=construct_point)  # -> Point, Normal, UDirection, VDirection, Frame; disabled
number_slider_3 = Slider(10, range=0..10)  # disabled
plane_normal = PlaneNormal(Origin=evaluate_surface.Point, ZAxis=evaluate_surface.Normal)  # disabled
cone = Cone(Base=plane_normal, Radius=expr("x/3", number_slider_3), Length=number_slider_3)  # -> Cone, Tip; disabled
cap_holes = CapHoles(Brep=cone.Cone)  # disabled
number_slider_4 = Slider(1.07, range=0..2)  # disabled
panel = Panel("1")  # disabled
range_3 = Range(Domain=number_slider_4, Steps=10)  # disabled
vector_xyz = VectorXYZ(XComponent=panel, YComponent=0, ZComponent=panel)  # -> Vector, Length; disabled
volume = Volume(Geometry=cap_holes)  # -> Volume, Centroid; disabled
pi = Pi(Factor=range_3)  # disabled
rotate_3d = Rotate3D(Geometry=cap_holes, Angle=pi, Center=volume.Centroid, Axis=vector_xyz.Vector)  # -> Geometry, Transform; disabled
number_slider_5 = Slider(27, range=0..89)  # disabled
number_slider_6 = Slider(1, range=0..10)  # disabled
trim_solid = TrimSolid(Shape=sphere, Cutters=rotate_3d.Geometry)  # disabled
split_brep_multiple = SplitBrepMultiple(Brep=sphere, Cutters=rotate_3d.Geometry)  # disabled
panel_2 = Panel("27")  # disabled
panel_3 = Panel("1")  # disabled
cull_index = CullIndex(List=split_brep_multiple, Indices=panel_2, Wrap=True)  # disabled
list_item = ListItem(List=split_brep_multiple, Index=panel_2, Wrap=True)  # disabled
list_item_2 = ListItem(List=trim_solid, Index=panel_3, Wrap=True)  # disabled
geometry = Geometry(list_item)  # disabled
geometry_2 = Geometry(cull_index)  # disabled
geometry_3 = Geometry(list_item_2)  # disabled

# ----
# 033_intersect_shape
# - be sure to deactivate solver before
#  changing data (with the spacebar or
#  pressing the control wheel to access)
# - now that you are dealing in solids, things
#  begin to slow down
# - it is advised to bake to rhino environment
# and then complete the boolean union
number_slider_7 = Slider(89, range=0..100)  # disabled
# EXERCISES_INTERSECT
number_slider_8 = Slider(10, range=0..10)  # disabled
range_4 = Range(Domain=Domain(0, 1), Steps=number_slider_7)  # disabled
range_5 = Range(Domain=Domain(0, 1), Steps=number_slider_7)  # disabled
jitter_2 = Jitter(List=range_4, Jitter=1, Seed=2)  # -> Values, Indices; disabled
sphere_2 = Sphere(Base=PlaneXY(0, 0, 0), Radius=number_slider_8)  # disabled
construct_point_2 = ConstructPoint(XCoordinate=range_5, YCoordinate=jitter_2.Values, ZCoordinate=0)  # disabled
number_slider_9 = Slider(20, range=15..25)  # disabled
evaluate_surface_2 = EvaluateSurface(Surface=reparameterize(sphere_2), Point=construct_point_2)  # -> Point, Normal, UDirection, VDirection, Frame; disabled
plane_normal_2 = PlaneNormal(Origin=evaluate_surface_2.Point, ZAxis=evaluate_surface_2.Normal)  # disabled
rectangle = Rectangle(Plane=plane_normal_2, XSize=number_slider_9, YSize=number_slider_9, Radius=0)  # -> Rectangle, Length; disabled
boundary_surfaces = BoundarySurfaces(Edges=rectangle.Rectangle)  # disabled
number_slider_10 = Slider(2, range=0..2)  # disabled
panel_4 = Panel("1")  # disabled
boundary_volume = BoundaryVolume(Boundaries=boundary_surfaces)  # disabled
vector_xyz_2 = VectorXYZ(XComponent=panel_4, YComponent=0, ZComponent=panel_4)  # -> Vector, Length; disabled
range_6 = Range(Domain=number_slider_10, Steps=10)  # disabled
volume_2 = Volume(Geometry=boundary_volume)  # -> Volume, Centroid; disabled
pi_2 = Pi(Factor=range_6)  # disabled
number_slider_11 = Slider(3, range=0..10)  # disabled
rotate_3d_2 = Rotate3D(Geometry=boundary_volume, Angle=pi_2, Center=volume_2.Centroid, Axis=vector_xyz_2.Vector)  # -> Geometry, Transform; disabled
polar_array = PolarArray(Geometry=rotate_3d_2.Geometry, Plane=plane_normal_2, Count=number_slider_11, Angle=6.283185307)  # -> Geometry, Transform; disabled

# ----
# - very simple algorithm, but consider the geometries that can be created
number_slider_12 = Slider(12, range=0..100)  # disabled
square = Square(Plane=PlaneXY(0, 0, 0), Size=number_slider_12, ExtentX=5, ExtentY=5)  # -> Cells, Points; disabled
radial = Radial(Plane=PlaneXY(0, 0, 0), Size=number_slider_12, ExtentR=5, ExtentP=20)  # -> Cells, Points; disabled
hexagonal = Hexagonal(Plane=PlaneXY(0, 0, 0), Size=number_slider_12, ExtentX=5, ExtentY=5)  # -> Cells, Points; disabled
region_difference = RegionDifference(CurvesA=square.Cells, CurvesB=hexagonal.Cells)  # disabled
region_union = RegionUnion(Curves=[square.Cells, hexagonal.Cells])  # disabled
region_intersection = RegionIntersection(CurvesA=region_difference, CurvesB=region_union)  # disabled

# ----
# - consider what is going on behind the scenes in all the mesh plugins
number_slider_13 = Slider(40, range=0..100)  # disabled
number_slider_14 = Slider(100, range=0..100)  # disabled
number_slider_15 = Slider(4, range=0..5)  # disabled
range_7 = Range(Domain=number_slider_13, Steps=number_slider_14)  # disabled
sine = Sine(Value=range_7)  # disabled
multiplication = Multiplication(A=sine, B=number_slider_15)  # disabled
number_slider_16 = Slider(1.679, range=0..5)  # disabled
construct_point_3 = ConstructPoint(XCoordinate=graft(range_7), YCoordinate=range_7, ZCoordinate=multiplication)  # disabled
surface_from_points = SurfaceFromPoints(Points=flatten(construct_point_3), UCount=expr("x+1", number_slider_14), Interpolate=False)  # disabled
surface = Surface(surface_from_points)  # disabled
area = Area(Geometry=surface)  # -> Area, Centroid; disabled
dimensions = Dimensions(Surface=surface)  # -> UDimension, VDimension; disabled
number_slider_17 = Slider(8, range=0..100)  # disabled
division = Division(A=dimensions.UDimension, B=dimensions.VDimension)  # disabled
scale = Scale(Geometry=surface, Center=area.Centroid, Factor=number_slider_16)  # -> Geometry, Transform; disabled
md_slider = MDSlider(
    SliderMode=0,
    slider_value=Point(0.4951607309, 0.2414119069, 0.5),
    x_domain=Domain(0, 1),
    y_domain=Domain(0, 1),
    z_domain=Domain(0, 1))  # disabled
multiplication_2 = Multiplication(A=division, B=number_slider_17)  # disabled
integer = Integer(multiplication_2)  # disabled
divide_surface = DivideSurface(Surface=surface, UCount=integer, VCount=number_slider_17)  # -> flatten(Points), Normals, Parameters; disabled
md_slider_2 = MDSlider(
    SliderMode=0,
    slider_value=Point(0.7276408516, 0.09028392548, 0.5),
    x_domain=Domain(0, 1),
    y_domain=Domain(0, 1),
    z_domain=Domain(0, 1))  # disabled
number_slider_18 = Slider(0.243, range=0..2)  # disabled
md_slider_3 = MDSlider(
    SliderMode=0,
    slider_value=Point(0.1948275682, 0.7902063509, 0.5),
    x_domain=Domain(0, 1),
    y_domain=Domain(0, 1),
    z_domain=Domain(0, 1))  # disabled
evaluate_surface_3 = EvaluateSurface(Surface=reparameterize(scale.Geometry), Point=[md_slider_3, md_slider, md_slider_2])  # -> Point, Normal, UDirection, VDirection, Frame; disabled
distance = Distance(PointA=graft(evaluate_surface_3.Point), PointB=divide_surface.Points)  # disabled
point = Point(divide_surface.Points)  # disabled
expression = Expression(w=flatten(number_slider_18), t=distance, Expression="sin(2*w^2*t)")  # disabled
flip_matrix = FlipMatrix(Data=expression)  # disabled
number_slider_19 = Slider(7.333, range=0..10)  # disabled
ma = MassMultiplication(Input=flip_matrix)  # -> flatten(Result), PartialResults; disabled
multiplication_3 = Multiplication(A=number_slider_19, B=ma.Result)  # disabled
unit_z = UnitZ(Factor=multiplication_3)  # disabled
move = Move(Geometry=divide_surface.Points, Motion=unit_z)  # -> Geometry, Transform; disabled
colour_swatch = ColourSwatch(SwatchColor=RGB(236, 45, 255))  # disabled
expression_2 = Expression(u=integer, Expression="u+1")  # disabled
mesh_frompoints = MeshFromPoints(Points=move.Geometry, UDirection=expr("x+1", integer), VDirection=expr("x+1", number_slider_17), Colour=colour_swatch)  # disabled
mesh_box = MeshBox(Base={Plane=PlaneXY(0, 0, 0), X=Domain(-10, 10), Y=Domain(-10, 10), Z=Domain(-10, 10)}, XCount=10, YCount=10, ZCount=10)  # disabled
number_slider_20 = Slider(1.7, range=0..3)  # disabled
deconstruct_mesh = DeconstructMesh(Mesh=mesh_frompoints)  # -> Vertices, Faces, Colours, Normals; disabled
mesh_sphere = MeshSphere(Base=deconstruct_mesh.Vertices, Radius=number_slider_20, UCount=10, VCount=20)  # disabled
mesh_union = MeshUnion(Meshes=flatten([mesh_frompoints, mesh_sphere]))  # disabled
mesh_difference = MeshDifference(MeshesA=mesh_frompoints, MeshesB=mesh_sphere)  # disabled
mesh_intersection = MeshIntersection(MeshesA=mesh_frompoints, MeshesB=mesh_sphere)  # disabled
mesh_split = MeshSplit(Mesh=mesh_frompoints, Splitters=mesh_sphere)  # disabled
panel_5 = Panel("1")  # disabled
list_item_3 = ListItem(List=mesh_split, Index=panel_5, Wrap=True)  # disabled
cull_index_2 = CullIndex(List=mesh_split, Indices=panel_5, Wrap=True)  # disabled
mesh = Mesh(mesh_difference)  # disabled
mesh_2 = Mesh(mesh_intersection)  # disabled
mesh_3 = Mesh(mesh_union)  # disabled
mesh_4 = Mesh(list_item_3)  # disabled
mesh_5 = Mesh(cull_index_2)  # disabled

# ----
# - keep an eye on your profiler widget
# - consider baking into rhino environment
# and performing these operations with
# boolean tools in rhino
solid_difference = SolidDifference()  # disabled
solid_intersection = SolidIntersection()  # disabled
solid_union = SolidUnion()  # disabled
