# Grasshopper definition EX_035_transformations_array.gh (Grasshopper 1.0.7)

# ----
# 035_transformations_array
# - great ways to get simple geometry to be more
# complex and exciting to visualize
number_slider = Slider(100, range=0..100)  # disabled
panel = Panel("10")  # disabled
panel_2 = Panel("2")  # disabled
division = Division(A=number_slider, B=panel)  # disabled
division_2 = Division(B=panel_2)  # disabled
number_slider_2 = Slider(6, range=0..10)  # disabled
range = Range(Domain=division, Steps=number_slider)  # disabled
division_3 = Division(A=division, B=panel_2)  # disabled
# EXERCISES_TRANSFORM
base = Base(PlaneXY(0, 0, 0))  # disabled
pi = Pi(Factor=range)  # disabled
cosine = Cosine(Value=range)  # disabled
sine = Sine(Value=range)  # disabled
rectangle = Rectangle(Plane=base, XSize=Domain(-1, 1), YSize=Domain(-2, 2), Radius=0)  # -> Rectangle, Length; disabled
division_4 = Division(A=division, B=division_3)  # disabled
number_slider_3 = Slider(2, range=0..2)  # disabled
multiplication = Multiplication(A=pi, B=number_slider_2)  # disabled
multiplication_2 = Multiplication(A=pi, B=cosine)  # disabled
multiplication_3 = Multiplication(A=pi, B=sine)  # disabled
cylinder = Cylinder(Base=PlaneXY(0, 0, 0), Radius=division_4, Length=division_4)  # disabled
number_slider_4 = Slider(3, range=0..10)  # disabled
construct_point = ConstructPoint(XCoordinate=multiplication, YCoordinate=multiplication_2, ZCoordinate=multiplication_3)  # disabled
range_2 = Range(Domain=number_slider_3, Steps=expr("x-1", 10))  # disabled
range_3 = Range(Domain=Domain(0, 1), Steps=10)  # disabled
center_box = CenterBox(Base=base, X=1, Y=1, Z=1)  # disabled
interpolate = Interpolate(Vertices=construct_point, Degree=3, Periodic=False, KnotStyle=1)  # -> Curve, Length, Domain; disabled
unit_z = UnitZ(Factor=1)  # disabled
deconstruct_brep = DeconstructBrep(Brep=center_box)  # -> Faces, Edges, Vertices; disabled
pi_2 = Pi(Factor=range_2)  # disabled
shatter = Shatter(Curve=reparameterize(interpolate.Curve), Parameters=range_3)  # disabled
curve_middle = CurveMiddle(Curve=shatter)  # disabled
number_slider_5 = Slider(10, range=0..100)  # disabled
rotate_3d = Rotate3D(Geometry=shatter, Angle=pi_2, Center=curve_middle, Axis=unit_z)  # -> Geometry, Transform; disabled
polar_array = PolarArray(Geometry=interpolate.Curve, Plane=PlaneXY(0, 0, 0), Count=number_slider, Angle=6.283185307)  # -> Geometry, Transform; disabled
linear_array = LinearArray(Geometry=cylinder, Direction=Vector(10, 0, 0), Count=number_slider)  # -> Geometry, Transform; disabled
box_array = BoxArray(Geometry=cylinder, Cell=center_box, XCount=number_slider_4, YCount=number_slider_4, ZCount=number_slider_4)  # -> Geometry, Transform; disabled
rectangular_array = RectangularArray(Geometry=cylinder, Cell=rectangle.Rectangle, XCount=number_slider_4, YCount=number_slider_4)  # -> Geometry, Transform; disabled
curve_array = CurveArray(Geometry=cylinder, Curve=interpolate.Curve, Count=number_slider)  # -> Geometry, Transform; disabled
number_slider_6 = Slider(10, range=0..10)  # disabled
polar_array_2 = PolarArray(Geometry=rotate_3d.Geometry, Plane=PlaneXY(0, 0, 0), Count=number_slider_5, Angle=pi_2)  # -> Geometry, Transform; disabled
loft = Loft(
    Curves=polar_array.Geometry,
    Options={Adjust=False, Closed=True, LoftEnds=0, LoftSimp=0, LoftType=0, Rebuild=10, Refit=0.01})  # disabled
kaleidoscope = Kaleidoscope(Geometry=polar_array_2.Geometry, Plane=PlaneXY(0, 0, 0), Segments=number_slider_6)  # -> Geometry, Transform; disabled
geometry = Geometry(kaleidoscope.Geometry)  # disabled
