# Grasshopper definition EX_036_transformations_euclidean.gh (Grasshopper 1.0.7)

# ----
# 036_transform_euclidean
# - intuitive and commonly used nodes for transformations
# - there are many ways to rotate geometries in grasshopper
rotate = Rotate(Angle=1.570796327, Plane=PlaneXY(0, 0, 0))  # -> Geometry, Transform
# EXERCISES_TRANSFORM
mirror = Mirror(Plane=PlaneYZ(0, 0, 0))  # -> Geometry, Transform
rotate_plane = RotatePlane()
rotate_3d = Rotate3D(Angle=1.570796327, Center=Point(0, 0, 0), Axis=Vector(0, 0, 1))  # -> Geometry, Transform
move = Move(Motion=Vector(0, 0, 10))  # -> Geometry, Transform
rotate_axis = RotateAxis(Angle=1.570796327, Axis=Line((0, 0, 0), (10, 0, 0)))  # -> Geometry, Transform
orient = Orient(Source=PlaneXY(0, 0, 0), Target=PlaneXY(0, 0, 0))  # -> Geometry, Transform
rotate_direction = RotateDirection(Center=Point(0, 0, 0), From=Vector(1, 0, 0), To=Vector(0, 1, 0))  # -> Geometry, Transform
move_to_plane = MoveToPlane(Plane=PlaneXY(0, 0, 0), Above=True, Below=True)  # -> Geometry, Transform
transform_matrix = TransformMatrix(rotate_direction.Transform, Digits=3)
panel = Panel(rotate_direction.Transform)

ghpython_script = GhPythonScript()  # -> Out, A
