# Grasshopper definition EX_037_transformations_morph.gh (Grasshopper 1.0.7)

# ----
# - bend and flow as useful but the others are a
# bit "heavy" and computational control is given up
# to these "micro plugins"
# - best to maintain a computational understanding
# of what is actually going on
# - they are fun to play with if you have interesting
# geometry that  you would like to deform
maelstrom = Maelstrom(Plane=PlaneXY(0, 0, 0), First=0.1, Second=10, Angle=1.570796327, Rigid=False)  # disabled
bend_deform = BendDeform()  # disabled
splop = Splop(Plane=PlaneXY(0, 0, 0), Angle=0, Rigid=False)  # disabled
flow = Flow(ReverseBase=False, ReverseTarget=False, Stretch=True, Rigid=False)  # disabled
sporph = Sporph(Rigid=False)  # disabled
stretch = Stretch(Axis=Line((0, 0, 0), (10, 10, 0)), Length=20, Rigid=False)  # disabled
surface_morph = SurfaceMorph()  # disabled
twist = Twist(Angle=1.570796327, Infinite=False, Rigid=False)  # disabled

# ----
# THE PITFALLS OF PLUGINS
panel = Panel("7")  # disabled

# ----
# EXERCISES_TRANSFORM
# 037_transform_morph
# - these nodes can get "heavy" fast
# careful using them
number_slider = Slider(13, range=0..100)  # disabled
range = Range(Domain=Domain(0, 1), Steps=panel)  # disabled
cylinder = Cylinder(Base=PlaneXY(0, 0, 0), Radius=number_slider, Length=number_slider)  # disabled
construct_point = ConstructPoint(XCoordinate=range, YCoordinate=range, ZCoordinate=0)  # disabled
number_slider_2 = Slider(0.49, range=0..1)  # disabled
evaluate_surface = EvaluateSurface(Surface=reparameterize(cylinder), Point=construct_point)  # -> Point, Normal, UDirection, VDirection, Frame; disabled
sort_points = SortPoints(Points=evaluate_surface.Point)  # -> Points, Indices; disabled
jitter = Jitter(List=evaluate_surface.Point, Jitter=number_slider_2, Seed=2)  # -> Values, Indices; disabled
list_item = ListItem(List=jitter.Values, Index=0, Wrap=True)  # -> Item, Item1, Item2, Item3, Item4, Item5, Item6, Item7; disabled
bounding_box = BoundingBox(Content=cylinder, Plane=PlaneXY(0, 0, 0))  # -> Box, Box_2; disabled
twisted_box = TwistedBox(
    CornerA=list_item.Item,
    CornerB=list_item.Item1,
    CornerC=list_item.Item2,
    CornerD=list_item.Item3,
    CornerE=list_item.Item4,
    CornerF=list_item.Item5,
    CornerG=list_item.Item6,
    CornerH=list_item.Item7)  # disabled
box_morph = BoxMorph(Geometry=cylinder, Reference=bounding_box.Box, Target=twisted_box)  # disabled
