# Grasshopper definition EX_038_transformations_utility.gh (Grasshopper 1.0.7)
# plug-ins: Bifocals

# ----
# - try and set to memory the transformation 4x4
# matix patterns for each transform
# and you will gain control of your own
# transformations using data (0 to 1.000)
number_slider = Slider(12, range=0..100)  # disabled
scale = Scale(Center=Point(0, 0, 0), Factor=0.5)  # -> Geometry, Transform; disabled
cone = Cone(Base=PlaneXY(0, 0, 0), Radius=number_slider, Length=number_slider)  # -> Cone, Tip; disabled
transform_matrix = TransformMatrix(scale.Transform, Digits=3)  # disabled
transform = Transform(Geometry=cone.Cone, Transform=scale.Transform)  # disabled
split = Split(Transform=transform_matrix)  # disabled
inverse_transform = InverseTransform(Transform=transform_matrix)  # disabled
panel = Panel(split)  # disabled
transform_2 = Transform(Geometry=transform, Transform=transform_matrix)  # disabled

panel_2 = Panel("""1
0
0
-1
0
1
.34
4
0
0
1
.77
0
0
0
.5""")  # disabled
panel_3 = Panel("4")  # disabled
construct_matrix = ConstructMatrix(Rows=panel_3, Columns=panel_3, Values=panel_2)  # disabled
cone_2 = Cone(Base=PlaneXY(0, 0, 0), Radius=0.5, Length=1)  # -> Cone, Tip; disabled
transform_matrix_2 = TransformMatrix(construct_matrix, Digits=3)  # disabled
transform_3 = Transform(Geometry=cone_2.Cone, Transform=construct_matrix)  # disabled
display_matrix = DisplayMatrix(transform_matrix_2)  # disabled

# ----
# EXERCISES_TRANSFORM
group = Group()  # disabled

number_slider_2 = Slider(1, range=0..1)  # disabled
number_slider_3 = Slider(0.68, range=0..1)  # disabled
number_slider_4 = Slider(1, range=0..1)  # disabled
number_slider_5 = Slider(0.67, range=0..1)  # disabled
number_slider_6 = Slider(0.08, range=0..1)  # disabled
number_slider_7 = Slider(0.84, range=0..1)  # disabled
number_slider_8 = Slider(0.73, range=0..1)  # disabled
rectangular_array = RectangularArray(Cell={Plane=PlaneXY(0, 0, 0), Size=Domain2(u=0..10, v=0..5)}, XCount=6, YCount=3)  # -> Geometry, Transform; disabled
kaleidoscope = Kaleidoscope(Plane=PlaneXY(0, 0, 0), Segments=10)  # -> Geometry, Transform; disabled
number_slider_9 = Slider(0.89, range=0..1)  # disabled
number_slider_10 = Slider(5, range=0..100)  # disabled
cone_3 = Cone(Base=PlaneXY(0, 0, 0), Radius=0.5, Length=1)  # -> Cone, Tip; disabled
cap_holes = CapHoles(Brep=cone_3.Cone)  # disabled
unit_x = UnitX(Factor=1)  # disabled
unit_y = UnitY(Factor=1)  # disabled
unit_z = UnitZ(Factor=1)  # disabled
bounding_box = BoundingBox(Content=cap_holes, Plane=PlaneXY(0, 0, 0))  # -> Box, Box_2; disabled
vector_xyz = VectorXYZ(XComponent=0, YComponent=number_slider_2, ZComponent=0)  # -> Vector, Length; disabled
construct_point = ConstructPoint(XCoordinate=number_slider_10, YCoordinate=0, ZCoordinate=0)  # disabled
construct_point_2 = ConstructPoint(XCoordinate=0, YCoordinate=0, ZCoordinate=number_slider_10)  # disabled
linear_array = LinearArray(Direction=Vector(10, 0, 0), Count=10)  # -> Geometry, Transform; disabled
polar_array = PolarArray(Plane=PlaneXY(0, 0, 0), Count=10, Angle=6.283185307)  # -> Geometry, Transform; disabled
volume = Volume(Geometry=cap_holes)  # -> Volume, Centroid; disabled
construct_point_3 = ConstructPoint(XCoordinate=number_slider_5, YCoordinate=number_slider_4, ZCoordinate=number_slider_6)  # disabled
construct_point_4 = ConstructPoint(XCoordinate=number_slider_7, YCoordinate=number_slider_3, ZCoordinate=number_slider_8)  # disabled
rectangle = Rectangle(Plane=volume.Centroid, XSize=Domain(-1, 1), YSize=Domain(-2, 2), Radius=0)  # -> Rectangle, Length; disabled
rectangle_2 = Rectangle(Plane=PlaneXY(0, 0, 0), XSize=Domain(-1, 1), YSize=Domain(-2, 2), Radius=0)  # -> Rectangle, Length; disabled
number_slider_11 = Slider(0.391, range=0..2)  # disabled
number_slider_12 = Slider(0.716, range=0..2)  # disabled
xy_plane = XYPlane(Origin=Point(0, 0, 0))  # disabled
unit_x_2 = UnitX(Factor=number_slider_10)  # disabled
yz_plane = YZPlane(Origin=Point(0, 0, 0))  # disabled
xz_plane = XZPlane(Origin=Point(0, 0, 0))  # disabled
xy_plane_2 = XYPlane(Origin=Point(0, 0, 0))  # disabled
center_box = CenterBox(Base=PlaneXY(0, 0, 0), X=1, Y=1, Z=1)  # disabled
construct_plane = ConstructPlane(Origin=Point(0, 0, 0), XAxis=vector_xyz.Vector, YAxis=Vector(0, 1, 0))  # disabled
xy_plane_3 = XYPlane(Origin=construct_point_2)  # disabled
curve = Curve(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)  # disabled
camera_obscura = CameraObscura(Geometry=cone_3.Cone, Point=Point(0, 0, 0), Factor=1)  # -> Geometry, Transform; disabled
scale_2 = Scale(Geometry=cone_3.Cone, Center=Point(0, 0, 0), Factor=0.5)  # -> Geometry, Transform; disabled
shear_angle = ShearAngle(Geometry=cone_3.Cone, Base=PlaneXY(0, 0, 0), AngleX=number_slider_11, AngleY=number_slider_12)  # -> Geometry, Transform; disabled
shear = Shear(Geometry=cone_3.Cone, Base=PlaneXY(0, 0, 0), Grip=construct_point_3, Target=construct_point_4)  # -> Geometry, Transform; disabled
scale_nu = ScaleNU(Geometry=cone_3.Cone, Plane=PlaneXY(0, 0, 0), ScaleX=number_slider_9, ScaleY=number_slider_9, ScaleZ=number_slider_9)  # -> Geometry, Transform; disabled
box_mapping = BoxMapping(Geometry=cone_3.Cone, Source=bounding_box.Box, Target=center_box)  # -> Geometry, Transform; disabled
orient_direction = OrientDirection(Geometry=cone_3.Cone, PointA=volume.Centroid, DirectionA=unit_x, PointB=volume.Centroid, DirectionB=unit_z)  # -> Geometry, Transform; disabled
project_along = ProjectAlong(Geometry=cone_3.Cone, Plane=PlaneXY(0, 0, 0), Direction=Vector(0, 0, -1))  # -> Geometry, Transform; disabled
project = Project(Geometry=cone_3.Cone, Plane=construct_plane)  # -> Geometry, Transform; disabled
triangle_mapping = TriangleMapping()  # -> Geometry, Transform; disabled
rectangle_mapping = RectangleMapping(Geometry=cone_3.Cone, Source=rectangle.Rectangle, Target=rectangle_2.Rectangle)  # -> Geometry, Transform; disabled
orient = Orient(Geometry=cone_3.Cone, Source=PlaneXY(0, 0, 0), Target=PlaneXY(0, 0, 0))  # -> Geometry, Transform; disabled
rotate = Rotate(Geometry=cone_3.Cone, Angle=1.570796327, Plane=[xy_plane_2, xz_plane, yz_plane])  # -> Geometry, Transform; disabled
rotate_3d = Rotate3D(Geometry=cone_3.Cone, Angle=1.570796327, Center=Point(0, 0, 0), Axis=Vector(0, 0, 1))  # -> Geometry, Transform; disabled
rotate_axis = RotateAxis(Geometry=cone_3.Cone, Angle=1.570796327, Axis=Line((0, 0, 0), (10, 0, 0)))  # -> Geometry, Transform; disabled
rotate_direction = RotateDirection(Geometry=cone_3.Cone, Center=Point(0, 0, 0), From=Vector(1, 0, 0), To=Vector(0, 1, 0))  # -> Geometry, Transform; disabled
move = Move(Geometry=cone_3.Cone, Motion=unit_x_2)  # -> Geometry, Transform; disabled
box_array = BoxArray(
    Geometry=cone_3.Cone,
    Cell={Plane=PlaneXY(0, 0, 0), X=Domain(0, 10), Y=Domain(0, 5), Z=Domain(0, 2)},
    XCount=4,
    YCount=3,
    ZCount=2)  # -> Geometry, Transform; disabled
mirror = Mirror(Geometry=cone_3.Cone, Plane=xy_plane)  # -> Geometry, Transform; disabled
move_to_plane = MoveToPlane(Geometry=cone_3.Cone, Plane=xy_plane_3, Above=True, Below=True)  # -> Geometry, Transform; disabled
move_away_from = MoveAwayFrom(Geometry=cone_3.Cone, Emitter=construct_point, Distance=number_slider_10)  # -> Geometry, Transform; disabled
curve_array = CurveArray(Geometry=cone_3.Cone, Curve=curve, Count=10)  # -> Geometry, Transform; disabled
transform_matrix_3 = TransformMatrix(orient_direction.Transform, Digits=3)  # disabled
transform_matrix_4 = TransformMatrix(scale_2.Transform, Digits=3)  # disabled
transform_matrix_5 = TransformMatrix(scale_nu.Transform, Digits=3)  # disabled
transform_matrix_6 = TransformMatrix(project.Transform, Digits=3)  # disabled
transform_matrix_7 = TransformMatrix(camera_obscura.Transform, Digits=3)  # disabled
transform_matrix_8 = TransformMatrix(shear_angle.Transform, Digits=3)  # disabled
transform_matrix_9 = TransformMatrix(box_mapping.Transform, Digits=3)  # disabled
transform_matrix_10 = TransformMatrix(project_along.Transform, Digits=3)  # disabled
transform_matrix_11 = TransformMatrix(rectangle_mapping.Transform, Digits=3)  # disabled
transform_matrix_12 = TransformMatrix(shear.Transform, Digits=3)  # disabled
transform_matrix_13 = TransformMatrix(rotate.Transform, Digits=3)  # disabled
transform_matrix_14 = TransformMatrix(rotate_3d.Transform, Digits=3)  # disabled
transform_matrix_15 = TransformMatrix(rotate_axis.Transform, Digits=3)  # disabled
transform_matrix_16 = TransformMatrix(rotate_direction.Transform, Digits=3)  # disabled
transform_matrix_17 = TransformMatrix(box_array.Transform, Digits=3)  # disabled
transform_matrix_18 = TransformMatrix(curve_array.Transform, Digits=3)  # disabled
transform_matrix_19 = TransformMatrix(mirror.Transform, Digits=3)  # disabled
transform_matrix_20 = TransformMatrix(move.Transform, Digits=3)  # disabled
transform_matrix_21 = TransformMatrix(move_away_from.Transform, Digits=3)  # disabled
transform_matrix_22 = TransformMatrix(move_to_plane.Transform, Digits=3)  # disabled
transform_matrix_23 = TransformMatrix(orient.Transform, Digits=3)  # disabled
transform_4 = Transform(Geometry=camera_obscura.Geometry, Transform=transform_matrix_7)  # disabled
transform_5 = Transform(Geometry=scale_2.Geometry, Transform=transform_matrix_4)  # disabled
transform_6 = Transform(Geometry=scale_nu.Geometry, Transform=transform_matrix_5)  # disabled
transform_7 = Transform(Geometry=shear.Geometry, Transform=transform_matrix_12)  # disabled
transform_8 = Transform(Geometry=shear_angle.Geometry, Transform=transform_matrix_8)  # disabled
transform_9 = Transform(Geometry=box_mapping.Geometry, Transform=transform_matrix_9)  # disabled
transform_10 = Transform(Geometry=orient_direction.Geometry, Transform=transform_matrix_3)  # disabled
transform_11 = Transform(Geometry=project.Geometry, Transform=transform_matrix_6)  # disabled
transform_12 = Transform(Geometry=project_along.Geometry, Transform=transform_matrix_10)  # disabled
transform_13 = Transform(Geometry=rectangle_mapping.Geometry, Transform=transform_matrix_11)  # disabled

number_slider_13 = Slider(0.71, range=0..1)  # disabled
compound = Compound()  # disabled
panel_4 = Panel("15")  # disabled
range = Range(Domain=number_slider_13, Steps=panel_4)  # disabled
split_2 = Split()  # disabled
panel_5 = Panel("4")  # disabled
construct_matrix_2 = ConstructMatrix(Rows=panel_5, Columns=panel_5, Values=range)  # disabled
deconstruct_matrix = DeconstructMatrix(Matrix=construct_matrix_2)  # -> Rows, Columns, Values; disabled
inverse_transform_2 = InverseTransform()  # disabled
transform_matrix_24 = TransformMatrix(construct_matrix_2, Digits=3)  # disabled
display_matrix_2 = DisplayMatrix(transform_matrix_24)  # disabled
invert_matrix = InvertMatrix(Tolerance=0)  # -> Matrix, Success; disabled
swap_columns = SwapColumns()  # disabled
swap_rows = SwapRows()  # disabled
transpose_matrix = TransposeMatrix()  # disabled

# ----
# - incredibly powerful tool when combining Math_matrices with 4x4  transformation utility
number_slider_14 = Slider(0.71, range=0..1)  # disabled
panel_6 = Panel("15")  # disabled
range_2 = Range(Domain=number_slider_14, Steps=panel_6)  # disabled
panel_7 = Panel("4")  # disabled
construct_matrix_3 = ConstructMatrix(Rows=panel_7, Columns=panel_7, Values=range_2)  # disabled
deconstruct_matrix_2 = DeconstructMatrix(Matrix=construct_matrix_3)  # -> Rows, Columns, Values; disabled
display_matrix_3 = DisplayMatrix(construct_matrix_3)  # disabled
transform_matrix_25 = TransformMatrix(construct_matrix_3, Digits=3)  # disabled
invert_matrix_2 = InvertMatrix(Tolerance=0)  # -> Matrix, Success; disabled
swap_columns_2 = SwapColumns()  # disabled
swap_rows_2 = SwapRows()  # disabled
transpose_matrix_2 = TransposeMatrix()  # disabled

# ----
# 038_transform_utility
# - straight forward nodes for grouping and organizing
ungroup = Ungroup()  # disabled
merge_group = MergeGroup()  # disabled
split_group = SplitGroup(Wrap=False)  # -> GroupA, GroupB; disabled
