# Grasshopper definition EX_039_display_dimensions.gh (Grasshopper 1.0.7)

# ----
# 039_display_dimensions
# - provides some interesting parametric
# documentation in the Rhino Environment
# - colors and hatching patterns
number_slider = Slider(1, range=0..1)  # disabled
# EXERCISES_DISPLAY
number_slider_2 = Slider(12, range=0..100)  # disabled
vector_xyz = VectorXYZ(XComponent=number_slider, YComponent=number_slider, ZComponent=0)  # -> Vector, Length; disabled
construct_point = ConstructPoint(XCoordinate=0, YCoordinate=0, ZCoordinate=0)  # disabled
number_slider_3 = Slider(1.13, range=0..2)  # disabled
line_sdl = LineSDL(Start=construct_point, Direction=vector_xyz.Vector, Length=1)  # disabled
number_slider_4 = Slider(2, range=0..2)  # disabled
number_slider_5 = Slider(8, range=0..8)  # disabled
circle = Circle(Plane=PlaneXY(0, 0, 0), Radius=number_slider_2)  # disabled
colour_swatch = ColourSwatch(SwatchColor=RGB(95, 209, 255))  # disabled
colour_swatch_2 = ColourSwatch(SwatchColor=RGB(205, 24, 255))  # disabled
pi = Pi(Factor=number_slider_3)  # disabled
pattern_hatch = PatternHatch(Boundaries=circle, Pattern=number_slider_5, Scale=number_slider_4, Angle=pi)  # disabled
gradient_hatch = GradientHatch(Boundaries=circle, Axis=line_sdl, Colour1=colour_swatch, Colour2=colour_swatch_2)  # disabled

# ----
# - aligned, angled, arc, circle dimensions
number_slider_6 = Slider(27, range=0..100)  # disabled
divide_length = DivideLength(Curve=reparameterize(circle), Length=number_slider_6)  # -> Points, Tangents, Parameters; disabled
number_slider_7 = Slider(14, range=0..100)  # disabled
number_slider_8 = Slider(2, range=0..2)  # disabled
point_on_curve = PointOnCurve(circle, parameter=0.209)  # disabled
point_on_curve_2 = PointOnCurve(circle, parameter=0.574)  # disabled
point_on_curve_3 = PointOnCurve(circle, parameter=0.785)  # disabled
shatter = Shatter(Curve=reparameterize(circle), Parameters=divide_length.Parameters)  # disabled
boolean_toggle = BooleanToggle(False)  # disabled
line = Line(StartPoint=point_on_curve, EndPoint=point_on_curve_2)  # disabled
line_2 = Line(StartPoint=point_on_curve, EndPoint=point_on_curve_3)  # disabled
xy_plane = XYPlane(Origin=Point(0, 0, 0))  # disabled
list_item = ListItem(List=flatten(shatter), Index=0, Wrap=True)  # disabled
aligned_dimension = AlignedDimension(
    Plane=xy_plane,
    PointA=point_on_curve,
    PointB=point_on_curve_2,
    Offset=number_slider_7,
    Text="{0:0.00}",
    Size=number_slider_8)  # disabled
line_dimension = LineDimension(Line=line, Text="{0:0.00}", Size=number_slider_8)  # disabled
angular_dimension = AngularDimension(
    Center=point_on_curve,
    PointA=point_on_curve_2,
    PointB=point_on_curve_3,
    Reflex=boolean_toggle,
    Text="{0:0.0}°",
    Size=number_slider_8)  # disabled
circular_dimension = CircularDimension(Circle=circle, PointA=point_on_curve_2, PointB=point_on_curve_3, Text="{0:0.0}°", Size=1)  # disabled
arc_dimension = ArcDimension(Arc=list_item, Offset=2, Text="{0:0.0}°", Size=1)  # disabled
end_points = EndPoints(Curve=line)  # -> Start, End; disabled
angular_dimensions_mesh = AngularDimensionsMesh(Text="{0:0.0}°", Size=1, LengthFactor=0.5)  # disabled
linear_dimension = LinearDimension(Line=line, PointA=end_points.Start, PointB=end_points.End, Text="{0:0.00}", Size=number_slider_8)  # disabled

# ----
# - make 2D in grasshopper instead of Rhino
# - experiment and see if it is good for your process
number_slider_9 = Slider(12, range=0..100)  # disabled
number_slider_10 = Slider(26, range=0..100)  # disabled
make2d = Make2D(TangentEdges=False, TangentSeams=False, AutoComputeMake2D=False)  # -> VisibleCurves, VisibleIndex, VisibleType, HiddenCurves, HiddenIndex, HiddenType; disabled
cone = Cone(Base=PlaneXY(0, 0, 0), Radius=number_slider_9, Length=number_slider_9)  # -> Cone, Tip; disabled
construct_point_2 = ConstructPoint(XCoordinate=number_slider_10, YCoordinate=number_slider_10, ZCoordinate=0)  # disabled
make2d_parallel_view = Make2DParallelView()  # disabled
bounding_box = BoundingBox(Content=cone.Cone, Plane=PlaneXY(0, 0, 0))  # -> Box, Box_2; disabled
number_slider_11 = Slider(3, range=0..5)  # disabled
make2d_perspective_view = Make2DPerspectiveView()  # disabled
deconstruct_brep = DeconstructBrep(Brep=bounding_box.Box_2)  # -> Faces, Edges, Vertices; disabled
panel = Panel("MyFirstView")  # disabled
make2d_rhino_view = Make2DRhinoView(Clip=True)  # disabled
boolean_toggle_2 = BooleanToggle(True)  # disabled
list_item_2 = ListItem(List=deconstruct_brep.Faces, Index=number_slider_11, Wrap=True)  # disabled
make2d_parallel_view_2 = Make2DParallelView(Projection=bounding_box.Box)  # disabled
make2d_perspective_view_2 = Make2DPerspectiveView(Camera=construct_point_2, Frame=list_item_2)  # disabled
make2d_rhino_view_2 = Make2DRhinoView(Name=panel, Clip=boolean_toggle_2)  # disabled
make2d_2 = Make2D(Geometry=cone.Cone, View=make2d_perspective_view_2, TangentEdges=False, TangentSeams=False, AutoComputeMake2D=False)  # -> VisibleCurves, VisibleIndex, VisibleType, HiddenCurves, HiddenIndex, HiddenType; disabled

# ----
# - go to top view and select all 3D text tags
# using text tags for graphs (matplotlib substitution 3D)
# Creating Circles and estimating circumference:
# 
# x² + y² = Coefficient
# x² + y² = 0
# x² + y² = 1
# x² + y² = 4
# x² + y² = 9
# x² + y² = 16
# x² + y² = 25
# x² + y² = 36
# x² + y² = 49
# x² + y² = 64
# x² + y² = 81
# x² + y² = 100
text_tag_3d = TextTag3D(Size=1, Justification=7)  # disabled
text_tag = TextTag()  # disabled
number_slider_12 = Slider(2, range=0..5)  # disabled
panel_2 = Panel("""0
1
4
9
16
25
36
49
64
81
100""")  # disabled
list_item_3 = ListItem(List=panel_2, Index=number_slider_12, Wrap=True)  # disabled
square_root = SquareRoot(Value=list_item_3)  # disabled
panel_3 = Panel(square_root)  # disabled
negative = Negative(Value=panel_3)  # disabled
panel_4 = Panel(panel_3)  # disabled
number_slider_13 = Slider(100, range=2..100)  # disabled
construct_domain = ConstructDomain(DomainStart=negative, DomainEnd=panel_3)  # disabled
panel_6 = Panel(negative)  # disabled
range = Range(Domain=construct_domain, Steps=number_slider_13)  # -> flatten(Range); disabled
expression = Expression(x=range, C=list_item_3, Expression="Sqrt(C - x^2)")  # disabled
panel_7 = Panel(construct_domain)  # disabled
panel_8 = Panel("-1")  # disabled
multiplication = Multiplication(A=expression, B=panel_8)  # disabled
panel_9 = Panel(range)  # disabled
construct_point_3 = ConstructPoint(XCoordinate=range, YCoordinate=expression, ZCoordinate=0)  # disabled
construct_point_4 = ConstructPoint(XCoordinate=range, YCoordinate=multiplication, ZCoordinate=0)  # disabled
construct_point_5 = ConstructPoint(XCoordinate=0, YCoordinate=0, ZCoordinate=0)  # disabled
panel_10 = Panel(expression)  # disabled
interpolate = Interpolate(Vertices=construct_point_3, Degree=3, Periodic=False, KnotStyle=1)  # -> Curve, Length, Domain; disabled
interpolate_2 = Interpolate(Vertices=construct_point_4, Degree=3, Periodic=False, KnotStyle=1)  # -> Curve, Length, Domain; disabled
deconstruct = Deconstruct(Point=construct_point_3)  # -> XComponent, YComponent, ZComponent; disabled
join_curves = JoinCurves(Curves=[interpolate_2.Curve, interpolate.Curve], Preserve=False)  # disabled
construct_point_6 = ConstructPoint(XCoordinate=0, YCoordinate=deconstruct.YComponent, ZCoordinate=0)  # disabled
construct_point_7 = ConstructPoint(XCoordinate=deconstruct.XComponent, YCoordinate=0, ZCoordinate=0)  # disabled
curve_middle = CurveMiddle(Curve=join_curves)  # disabled
point_on_curve_4 = PointOnCurve(join_curves, parameter=0.75)  # disabled
length = Length(Curve=join_curves)  # disabled
point_on_curve_5 = PointOnCurve(join_curves, parameter=0.669)  # disabled
point_on_curve_6 = PointOnCurve(join_curves, parameter=0.553)  # disabled
point_on_curve_7 = PointOnCurve(join_curves, parameter=0.411)  # disabled
panel_11 = Panel("0")  # disabled
panel_12 = Panel("1")  # disabled
line_3 = Line(StartPoint=construct_point_5, EndPoint=construct_point_7)  # disabled
line_4 = Line(StartPoint=construct_point_5, EndPoint=construct_point_6)  # disabled
panel_13 = Panel(length)  # disabled
evaluate_curve = EvaluateCurve(Curve=reparameterize(join_curves), Parameter=panel_11)  # -> Point, Tangent, Angle; disabled
evaluate_curve_2 = EvaluateCurve(Curve=reparameterize(join_curves), Parameter=panel_12)  # -> Point, Tangent, Angle; disabled
panel_14 = Panel(".12")  # disabled
panel_15 = Panel("""  
      Circumference of 
      y = Sqrt(C + x^2) 
      circle""")  # disabled
negative_2 = Negative(Value=evaluate_curve.Tangent)  # disabled
panel_16 = Panel("____")  # disabled
panel_17 = Panel("y    ")  # disabled
panel_18 = Panel("x")  # disabled
panel_19 = Panel("    P = (x,y)")  # disabled
panel_20 = Panel("O    ")  # disabled
concatenate = Concatenate(FragmentA=panel_16, FragmentB=panel_13)  # disabled
list_item_4 = ListItem(List=construct_point_7, Index=0, Wrap=True)  # -> Item1, Item; disabled
list_item_5 = ListItem(List=construct_point_6, Index=0, Wrap=True)  # disabled
panel_21 = Panel("     creating circles")  # disabled
polyline = PolyLine(Vertices=construct_point_3, Closed=False)  # disabled
boundary_surfaces = BoundarySurfaces(Edges=join_curves)  # disabled
text_tag_3d_2 = TextTag3D(Location=point_on_curve_6, Text=panel_21, Size=panel_14, Justification=1)  # disabled
text_tag_3d_3 = TextTag3D(Location=construct_point_5, Text=panel_20, Size=panel_14, Justification=3)  # disabled
text_tag_3d_4 = TextTag3D(Location=point_on_curve_7, Text=[panel_15, concatenate], Size=panel_14, Justification=7)  # disabled
text_tag_3d_5 = TextTag3D(Location=point_on_curve_4, Text=panel_3, Size=panel_14, Justification=3)  # disabled
text_tag_3d_6 = TextTag3D(Location=list_item_4.Item1, Text=panel_3, Size=panel_14, Justification=2)  # disabled
text_tag_3d_7 = TextTag3D(Location=point_on_curve_5, Text=panel_19, Size=panel_14, Justification=7)  # disabled
vector_display = VectorDisplay(Anchor=evaluate_curve.Point, Vector=negative_2)  # disabled
vector_display_2 = VectorDisplay(Anchor=evaluate_curve_2.Point, Vector=evaluate_curve_2.Tangent)  # disabled
curve = Curve(join_curves)  # disabled
area = Area(Geometry=boundary_surfaces)  # -> Area, Centroid; disabled
panel_22 = Panel(area.Area)  # disabled
