# Grasshopper definition EX_040_display_preview_vector.gh (Grasshopper 1.0.7)

# ----
# 040_display_preview/vector
# - color
# - point list and order
# - vector display
number_slider = Slider(12, range=0..100)  # disabled
number_slider_2 = Slider(0.707, range=0..1)  # disabled
number_slider_3 = Slider(100, range=0..100)  # disabled
# EXERCISES_DISPLAY
number_slider_4 = Slider(12, range=0..100)  # disabled
colour_swatch = ColourSwatch(SwatchColor=RGB(213, 59, 255))  # disabled
colour_swatch_2 = ColourSwatch(SwatchColor=RGB(229, 245, 0))  # disabled
colour_swatch_3 = ColourSwatch(SwatchColor=RGB(46, 219, 255))  # disabled
number_slider_5 = Slider(6, range=0..10)  # disabled
square = Square(Plane=PlaneXY(0, 0, 0), Size=number_slider, ExtentX=5, ExtentY=5)  # -> Cells, Points; disabled
sphere = Sphere(Base=PlaneXY(0, 0, 0), Radius=number_slider_4)  # disabled
number_slider_6 = Slider(7.17, range=0..10)  # disabled
create_material = CreateMaterial(
    Diffuse=colour_swatch_2,
    Specular=colour_swatch,
    Emission=colour_swatch_3,
    Transparency=number_slider_2,
    Shine=number_slider_3)  # disabled
colour_swatch_4 = ColourSwatch(SwatchColor=RGB(81, 220, 255))  # disabled
custom_preview = CustomPreview(Geometry=sphere, Material=create_material)  # disabled
point_order = PointOrder(Points=square.Points)  # disabled
point_list = PointList(Points=square.Points, Size=number_slider_5)  # disabled
vector_display = VectorDisplay(Anchor=square.Points, Vector=square.Points)  # disabled
vector_display_ex = VectorDisplayEx(Point=square.Points, Vector=square.Points, Colour=colour_swatch_4, Width=number_slider_6)  # disabled
