# Grasshopper definition EX_041_plugins_lunchbox_basic.gh (Grasshopper 1.0.7)
# plug-ins: LunchBox, LunchBoxML, Human

# ---- group: LBML_NonlinearRegression-CurvePlot / Sample Points
pt = Point([Point(25.0973048, 20.94949138, 0), Point(26.33156766, 20.61724581, 0), Point(30.5683667, 18.61734927, 0), Point(29.70665446, 19.958941, 0), Point(33.87801945, 19.41892409, 0), Point(35.13680678, 17.85952601, 0)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])
pdecon = Deconstruct(Point=pt)  # -> graft(XComponent), YComponent, ZComponent
preview = CustomPreview(Geometry=pt, Shader=ColourSwatch(SwatchColor=RGB(255, 0, 115)))

# ---- group: LBML_NonlinearRegression-SurfacePlot / Sample Points
number_slider = Slider(34, range=0..50)
panel = Panel("0 to 30")
random = Random(Range="0 to 5", Number=number_slider, Seed="10")
random_2 = Random(Range=panel, Number=number_slider, Seed="8")
random_3 = Random(Range=panel, Number=number_slider, Seed="5")
pt_2 = ConstructPoint(XCoordinate=random_3, YCoordinate=random_2, ZCoordinate=random)
entwine = Entwine(Branch00=random_3, Branch01=random_2, FlattenInputs=True)
flip = FlipMatrix(Data=entwine)
dots = DotDisplay(Point=pt_2, Colour=ColourSwatch(SwatchColor=RGB(255, 0, 115)), Size=Slider(0.227, range=0..1))

# ---- group: LBML_LinearRegression-LinePlot / Input points
pt_3 = Point([Point(48.85484087, 42.93944115, 0), Point(47.54230675, 39.26946931, 0), Point(46.48351837, 36.27833523, 0), Point(17.5074815, 13.16084453, 0), Point(31.61152177, 22.39151598, 0), Point(36.3971641, 22.07227592, 0)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])
pdecon_2 = Deconstruct(Point=pt_3)  # -> XComponent, YComponent, ZComponent
preview_2 = CustomPreview(Geometry=pt_3, Shader=ColourSwatch(SwatchColor=RGB(223, 220, 115)))

# ---- group: LBML_MultivariateLinearRegression / Sample Data
# Company Info: Authored by Proving Ground
# 
# http://ProvingGround.io
# Copyright (c) 2017 Proving Ground LLC
pt_4 = Point([Point(1.351036543, 3.971966414, -8.539178762), Point(1.230609394, 8.840402651, -6.562385308), Point(3.995575449, 4.68975127, -8.247727393), Point(10.00861558, 18.09229774, -2.805719973), Point(18.62721199, 5.908814564, -7.752735527), Point(20.1565894, 17.80562482, -2.922121448)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])
pdecon_3 = Deconstruct(Point=pt_4)  # -> XComponent, YComponent, ZComponent
preview_3 = CustomPreview(Geometry=pt_4, Shader=ColourSwatch(SwatchColor=RGB(254, 109, 115)))
entwine_2 = Entwine(Branch00=pdecon_3.YComponent, Branch01=pdecon_3.ZComponent, FlattenInputs=True)
flip_2 = FlipMatrix(Data=entwine_2)

# ---- group: LBML_NonlinearRegression-CurvePlot
# Company Info: Authored by Proving Ground
# 
# http://ProvingGround.io
# Copyright (c) 2017 Proving Ground LLC
number_slider_2 = Slider(57, range=0..100)
number_slider_3 = Slider(17, range=0..50)

# ---- group: LBML_NonlinearRegression-SurfacePlot / Test Points
number_slider_4 = Slider(16, range=0..50)
range = Range(Domain=panel, Steps=number_slider_4)
range_2 = Range(Domain=panel, Steps=number_slider_4)
crossref = CrossReference(ListA=range_2, ListB=range, CrossMode=1)  # -> ListA, ListB
entwine_3 = Entwine(Branch00=crossref.ListA, Branch01=crossref.ListB, FlattenInputs=True)
flip_3 = FlipMatrix(Data=entwine_3)

# ---- group: LBML_LinearRegression-LinePlot / X Test
series = Series(Start=0, Step=5, Count=10)

# ---- group: LBML_NonlinearRegression-CurvePlot / Test X Value
series_2 = Series(Start=0, Step=2, Count=25)  # -> graft(Series)

# ---- group: LBML_MultivariateLinearRegression / Test Data
series_3 = Series(Start=0, Step=5, Count=10)

# ---- group: LBML_LinearRegression-LinePlot
# Company Info: Authored by Proving Ground
# 
# http://ProvingGround.io
# Copyright (c) 2017 Proving Ground LLC
linereg = LinearRegression(TestData=series, Inputs=pdecon_2.XComponent, Output=pdecon_2.YComponent, RandomSeed=5)

# ---- group: LBML_NonlinearRegression-CurvePlot / Nonlinear Solver
seqminreg = SequentialMinimalOptimizationRegression(
    TestData=series_2,
    Inputs=pdecon.XComponent,
    Output=pdecon.YComponent,
    Degree=number_slider_3,
    Complexity=number_slider_2,
    RandomSeed=5)  # -> Result, Score, Error

# ---- group: LBML_MultivariateLinearRegression / Multivariate Linerar Regression
multilinereg = MultivariateLinearRegression(TestData=graft(series_3), Inputs=graft(pdecon_3.XComponent), Output=flip_2, RandomSeed=5)

# ---- group: LBML_LinearRegression-LinePlot / LIne Plot
pt_5 = ConstructPoint(XCoordinate=series, YCoordinate=linereg, ZCoordinate=0)
pline = PolyLine(Vertices=pt_5, Closed=False)
previewlw = CustomPreviewLineweights(Geometry=pline, Shader=ColourSwatch(SwatchColor=RGB(44, 252, 255)), Thickness=Slider(10, range=0..10), Absolute=False)

# ---- group: LBML_NonlinearRegression-CurvePlot / Fit Curve
pt_6 = ConstructPoint(XCoordinate=flatten(series_2), YCoordinate=flatten(seqminreg.Result), ZCoordinate=0)
intcrv = Interpolate(Vertices=pt_6, Degree=3, Periodic=False, KnotStyle=1)  # -> Curve, Length, Domain
previewlw_2 = CustomPreviewLineweights(
    Geometry=intcrv.Curve,
    Shader=ColourSwatch(SwatchColor=RGB(255, 255, 255)),
    Thickness=Slider(4, range=0..5),
    Absolute=False)

# ---- group: LBML_MultivariateLinearRegression / Curve Plot
flip_4 = FlipMatrix(Data=multilinereg)
branch = TreeBranch(Tree=flip_4, Path="{1}", MaintainPaths=True)
branch_2 = TreeBranch(Tree=flip_4, Path="{0}", MaintainPaths=True)
pt_7 = ConstructPoint(XCoordinate=series_3, YCoordinate=branch_2, ZCoordinate=branch)
pline_2 = PolyLine(Vertices=pt_7, Closed=False)
previewlw_3 = CustomPreviewLineweights(Geometry=pline_2, Shader=ColourSwatch(SwatchColor=RGB(0, 185, 255)), Thickness=Slider(4, range=0..10), Absolute=False)

# ---- group: LBML_NonlinearRegression-SurfacePlot
# Company Info: Authored by Proving Ground
# 
# http://ProvingGround.io
# Copyright (c) 2017 Proving Ground LLC
sigma = Slider(1.761, range=0..50)
nonlinereg = NonlinearRegression(TestData=flip_3, Inputs=flip, Output=random, Degree=sigma, Complexity=100, RandomSeed=5)  # -> Result, Score, Error

# ---- group: LBML_NonlinearRegression-SurfacePlot / Prediction Points
pt_8 = ConstructPoint(XCoordinate=crossref.ListA, YCoordinate=crossref.ListB, ZCoordinate=flatten(nonlinereg.Result))
preview_4 = CustomPreview(Geometry=pt_8, Shader=ColourSwatch(SwatchColor=RGB(9, 176, 255)))

# ----
# 041_Lunchbox_basic
# - lunchox can be used for simple
# paneling and creating archtectures
# 
# Alphonso Peluso's great example of
# how to extend plugins
number_slider_5 = Slider(4.42, range=0..10)
# PLUGINS CAN BE USED SIMPLY AND CAN BE DELVED INTO ON A MORE ADVANCED LEVEL
# THE KEY IS TO UNDERSTAND HOW THEY WERE CONTRUCTED FROM THE VANILLA RIBBON NODES THAT COME WITH GRASSHOPPER FOR RHINO7
# ONLY THEN WILL YOU BE ABLE TO START PROGRAMMING AND COMPILING YOUR OWN PLUGINS THAT HAVE YET TO BE CREATED FOR THE PARAMETRIC AND COMPUTATIONAL DESIGNER/ARCHITECT AND ENGINEER
# LunchBox is a plug-in for Grasshopper for
#  exploring mathematical shapes, paneling,
#  structures, and workflow.  We have also
#  introduced new components for general
#  machine learning implementations such as
#  regression analysis, clustering, and
#  networks.
number_slider_6 = Slider(10, range=0..10)
# Lunchbox (panelization and structure creation)
# Data
# Generate
# Machine Learning (proving ground)
# Math
# Panels
# Structure
# Utilities
# Workflow
ellipse = Ellipse(Plane=PlaneXY(0, 0, 0), Radius1=number_slider_6, Radius2=Slider(7.06, range=0..10))  # -> Ellipse, Focus1, Focus2
ellipse_2 = Ellipse(Plane=PlaneXY(0, 0, 0), Radius1=Slider(6.75, range=0..10), Radius2=number_slider_5)  # -> Ellipse, Focus1, Focus2
unit_z = UnitZ(Factor=Slider(5.09, range=0..10))
# 042_Lunchbox_advanced
# - lunchbox is great for getting your thinking
# about machine learning
# - download the examples from the creator,
# Proving Ground, to get started
# - here is a simple example from their tutorials
number_slider_7 = Slider(2, range=0..10)
move = Move(Geometry=ellipse_2.Ellipse, Motion=unit_z)  # -> Geometry, Transform
space_truss_structure_2 = SpaceTrussStructure2(UDivisions=10, VDivisions=10)  # -> PrimaryLines, PrimaryLines_2, WebLines, StructureNodes
number_slider_8 = Slider(32, range=0..100)
number_slider_9 = Slider(6, range=0..10)
number_slider_10 = Slider(0.09, range=0..0.1)
multiplication = Multiplication(A=number_slider_10, B="2")
number_slider_11 = Slider(0.13, range=0..1)
mesh_sphere = MeshSphere(Base=PlaneXY(0, 0, 0), Radius=10, UCount=10, VCount=20)

# ----
# - untrimmed srf
loft = Loft(
    Curves=[ellipse.Ellipse, move.Geometry],
    Options={Adjust=False, Closed=False, LoftEnds=0, LoftSimp=0, LoftType=0, Rebuild=10, Refit=0.01})

# ----
# panels
diamond_panels = DiamondPanels(Surface=loft, UDivisions=number_slider_9, VDivisions=number_slider_8)  # -> DiamondPanels, TriPanels

# ----
# panels frames
panel_frame = PanelFrame(Panel=[diamond_panels.DiamondPanels, diamond_panels.TriPanels], ScaleFactor=Slider(0.64, range=0..1))  # -> PanelFrame, Panel

surface = Surface(loft)
space_truss_structure_1 = SpaceTrussStructure1(Surface=surface, UDivisions=Slider(6, range=0..10), VDivisions=Slider(20, range=0..100), TrussDepth=number_slider_7)  # -> PrimaryLines, PrimaryLines_2, WebLines, StructureNodes
diagrid_structure = DiagridStructure(Surface=surface, UDivisions=Slider(6, range=0..10), VDivisions=Slider(21, range=0..100), Type=Slider(3, range=0..10))  # -> StructureLines, StructureNodes
hexagon_cells = HexagonCells(Surface=loft, UDivisions=number_slider_9, VDivisions=number_slider_8, TParameter=Slider(0.22, range=0..1))  # -> HexagonCells, Centers
perp_frames = PerpFrames(Curve=diagrid_structure.StructureLines, Count=10, Align=True)  # -> Frames, Parameters
sphere = Sphere(Base=space_truss_structure_1.StructureNodes, Radius=multiplication)
pipe = Pipe(
    Curve=[space_truss_structure_1.PrimaryLines, space_truss_structure_1.PrimaryLines_2, space_truss_structure_1.WebLines],
    Radius=number_slider_10,
    Caps=0)
scale = Scale(Geometry=hexagon_cells.HexagonCells, Center=hexagon_cells.Centers, Factor=Slider(0.66, range=0..1))  # -> Geometry, Transform
polygon = Polygon(Plane=perp_frames.Frames, Radius=Slider(0.19, range=0..1), Segments="3", FilletRadius=0)  # -> Polygon, Length
pipe_2 = Pipe(Curve=diagrid_structure.StructureLines, Radius=number_slider_11, Caps=0)
curve = Curve(graft(hexagon_cells.HexagonCells))
curve_2 = Curve(graft(scale.Geometry))
loft_2 = Loft(
    Curves=[curve, curve_2],
    Options={Adjust=False, Closed=False, LoftEnds=0, LoftSimp=0, LoftType=0, Rebuild=10, Refit=0.01})
sphere_2 = Sphere(Base=diagrid_structure.StructureNodes, Radius=expr("x*2", number_slider_11))
loft_3 = Loft(Curves=polygon.Polygon, Options={Adjust=False, Closed=False, LoftEnds=0, LoftSimp=0, LoftType=0, Rebuild=10, Refit=0.01})
geometry = Geometry(panel_frame.PanelFrame)
geometry_2 = Geometry(loft_2)
