# Grasshopper definition EX_042_plugins_lunchbox_advanced.gh (Grasshopper 1.0.7)
# plug-ins: LunchBox, LunchBoxML, Human

# ---- group: LBML_NonlinearRegression-CurvePlot / Sample Points
pt = Point([Point(25.0973048, 20.94949138, 0), Point(26.33156766, 20.61724581, 0), Point(30.5683667, 18.61734927, 0), Point(29.70665446, 19.958941, 0), Point(33.87801945, 19.41892409, 0), Point(35.13680678, 17.85952601, 0)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])  # disabled
swatch = ColourSwatch(SwatchColor=RGB(255, 0, 115))  # disabled
pdecon = Deconstruct(Point=pt)  # -> graft(XComponent), YComponent, ZComponent; disabled
preview = CustomPreview(Geometry=pt, Shader=swatch)  # disabled

# ---- group: LBML_NonlinearRegression-SurfacePlot / Sample Points
number_slider = Slider(34, range=0..50)  # disabled
panel = Panel("0 to 30")  # disabled
panel_2 = Panel("0 to 5")  # disabled
panel_3 = Panel("5")  # disabled
panel_4 = Panel("10")  # disabled
panel_5 = Panel("8")  # disabled
random = Random(Range=panel_2, Number=number_slider, Seed=panel_4)  # disabled
random_2 = Random(Range=panel, Number=number_slider, Seed=panel_5)  # disabled
random_3 = Random(Range=panel, Number=number_slider, Seed=panel_3)  # disabled
pt_2 = ConstructPoint(XCoordinate=random_3, YCoordinate=random_2, ZCoordinate=random)  # disabled
entwine = Entwine(Branch00=random_3, Branch01=random_2, FlattenInputs=True)  # disabled
number_slider_2 = Slider(0.227, range=0..1)  # disabled
swatch_2 = ColourSwatch(SwatchColor=RGB(255, 0, 115))  # disabled
flip = FlipMatrix(Data=entwine)  # disabled
dots = DotDisplay(Point=pt_2, Colour=swatch_2, Size=number_slider_2)  # disabled

# ---- group: LBML_LinearRegression-LinePlot / Input points
pt_3 = Point([Point(48.85484087, 42.93944115, 0), Point(47.54230675, 39.26946931, 0), Point(46.48351837, 36.27833523, 0), Point(17.5074815, 13.16084453, 0), Point(31.61152177, 22.39151598, 0), Point(36.3971641, 22.07227592, 0)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])  # disabled
swatch_3 = ColourSwatch(SwatchColor=RGB(223, 220, 115))  # disabled
pdecon_2 = Deconstruct(Point=pt_3)  # -> XComponent, YComponent, ZComponent; disabled
preview_2 = CustomPreview(Geometry=pt_3, Shader=swatch_3)  # disabled

# ---- group: LBML_MultivariateLinearRegression / Sample Data
# Company Info: Authored by Proving Ground
# 
# http://ProvingGround.io
# Copyright (c) 2017 Proving Ground LLC
pt_4 = Point([Point(1.351036543, 3.971966414, -8.539178762), Point(1.230609394, 8.840402651, -6.562385308), Point(3.995575449, 4.68975127, -8.247727393), Point(10.00861558, 18.09229774, -2.805719973), Point(18.62721199, 5.908814564, -7.752735527), Point(20.1565894, 17.80562482, -2.922121448)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])  # disabled
swatch_4 = ColourSwatch(SwatchColor=RGB(254, 109, 115))  # disabled
pdecon_3 = Deconstruct(Point=pt_4)  # -> XComponent, YComponent, ZComponent; disabled
preview_3 = CustomPreview(Geometry=pt_4, Shader=swatch_4)  # disabled
entwine_2 = Entwine(Branch00=pdecon_3.YComponent, Branch01=pdecon_3.ZComponent, FlattenInputs=True)  # disabled
flip_2 = FlipMatrix(Data=entwine_2)  # disabled

# ---- group: LBML_NonlinearRegression-CurvePlot
# Company Info: Authored by Proving Ground
# 
# http://ProvingGround.io
# Copyright (c) 2017 Proving Ground LLC
number_slider_3 = Slider(57, range=0..100)  # disabled
number_slider_4 = Slider(17, range=0..50)  # disabled

# ---- group: LBML_NonlinearRegression-SurfacePlot / Test Points
number_slider_5 = Slider(16, range=0..50)  # disabled
range = Range(Domain=panel, Steps=number_slider_5)  # disabled
range_2 = Range(Domain=panel, Steps=number_slider_5)  # disabled
crossref = CrossReference(ListA=range_2, ListB=range, CrossMode=1)  # -> ListA, ListB; disabled
entwine_3 = Entwine(Branch00=crossref.ListA, Branch01=crossref.ListB, FlattenInputs=True)  # disabled
flip_3 = FlipMatrix(Data=entwine_3)  # disabled

# ---- group: LBML_LinearRegression-LinePlot / X Test
series = Series(Start=0, Step=5, Count=10)  # disabled

# ---- group: LBML_NonlinearRegression-CurvePlot / Test X Value
series_2 = Series(Start=0, Step=2, Count=25)  # -> graft(Series); disabled

# ---- group: LBML_MultivariateLinearRegression / Test Data
series_3 = Series(Start=0, Step=5, Count=10)  # disabled

# ---- group: LBML_LinearRegression-LinePlot
# Company Info: Authored by Proving Ground
# 
# http://ProvingGround.io
# Copyright (c) 2017 Proving Ground LLC
linereg = LinearRegression(TestData=series, Inputs=pdecon_2.XComponent, Output=pdecon_2.YComponent, RandomSeed=5)  # disabled

# ---- group: LBML_NonlinearRegression-CurvePlot / Nonlinear Solver
seqminreg = SequentialMinimalOptimizationRegression(
    TestData=series_2,
    Inputs=pdecon.XComponent,
    Output=pdecon.YComponent,
    Degree=number_slider_4,
    Complexity=number_slider_3,
    RandomSeed=5)  # -> Result, Score, Error; disabled

# ---- group: LBML_MultivariateLinearRegression / Multivariate Linerar Regression
multilinereg = MultivariateLinearRegression(TestData=graft(series_3), Inputs=graft(pdecon_3.XComponent), Output=flip_2, RandomSeed=5)  # disabled

# ---- group: LBML_LinearRegression-LinePlot / LIne Plot
pt_5 = ConstructPoint(XCoordinate=series, YCoordinate=linereg, ZCoordinate=0)  # disabled
number_slider_6 = Slider(10, range=0..10)  # disabled
pline = PolyLine(Vertices=pt_5, Closed=False)  # disabled
swatch_5 = ColourSwatch(SwatchColor=RGB(44, 252, 255))  # disabled
previewlw = CustomPreviewLineweights(Geometry=pline, Shader=swatch_5, Thickness=number_slider_6, Absolute=False)  # disabled

# ---- group: LBML_NonlinearRegression-CurvePlot / Fit Curve
pt_6 = ConstructPoint(XCoordinate=flatten(series_2), YCoordinate=flatten(seqminreg.Result), ZCoordinate=0)  # disabled
number_slider_7 = Slider(4, range=0..5)  # disabled
swatch_6 = ColourSwatch(SwatchColor=RGB(255, 255, 255))  # disabled
intcrv = Interpolate(Vertices=pt_6, Degree=3, Periodic=False, KnotStyle=1)  # -> Curve, Length, Domain; disabled
previewlw_2 = CustomPreviewLineweights(Geometry=intcrv.Curve, Shader=swatch_6, Thickness=number_slider_7, Absolute=False)  # disabled

# ---- group: LBML_MultivariateLinearRegression / Curve Plot
flip_4 = FlipMatrix(Data=multilinereg)  # disabled
panel_6 = Panel("{1}")  # disabled
panel_7 = Panel("{0}")  # disabled
branch = TreeBranch(Tree=flip_4, Path=panel_6, MaintainPaths=True)  # disabled
branch_2 = TreeBranch(Tree=flip_4, Path=panel_7, MaintainPaths=True)  # disabled
pt_7 = ConstructPoint(XCoordinate=series_3, YCoordinate=branch_2, ZCoordinate=branch)  # disabled
pline_2 = PolyLine(Vertices=pt_7, Closed=False)  # disabled
number_slider_8 = Slider(4, range=0..10)  # disabled
swatch_7 = ColourSwatch(SwatchColor=RGB(0, 185, 255))  # disabled
previewlw_3 = CustomPreviewLineweights(Geometry=pline_2, Shader=swatch_7, Thickness=number_slider_8, Absolute=False)  # disabled

# ---- group: LBML_NonlinearRegression-SurfacePlot
# Company Info: Authored by Proving Ground
# 
# http://ProvingGround.io
# Copyright (c) 2017 Proving Ground LLC
sigma = Slider(1.761, range=0..50)  # disabled
nonlinereg = NonlinearRegression(TestData=flip_3, Inputs=flip, Output=random, Degree=sigma, Complexity=100, RandomSeed=5)  # -> Result, Score, Error; disabled

# ---- group: LBML_NonlinearRegression-SurfacePlot / Prediction Points
pt_8 = ConstructPoint(XCoordinate=crossref.ListA, YCoordinate=crossref.ListB, ZCoordinate=flatten(nonlinereg.Result))  # disabled
swatch_8 = ColourSwatch(SwatchColor=RGB(9, 176, 255))  # disabled
preview_4 = CustomPreview(Geometry=pt_8, Shader=swatch_8)  # disabled

# ----
# PLUGINS CAN BE USED SIMPLY AND CAN BE DELVED INTO ON A MORE ADVANCED LEVEL
# THE KEY IS TO UNDERSTAND HOW THEY WERE CONTRUCTED FROM THE VANILLA RIBBON NODES THAT COME WITH GRASSHOPPER FOR RHINO7
# ONLY THEN WILL YOU BE ABLE TO START PROGRAMMING AND COMPILING YOUR OWN PLUGINS THAT HAVE YET TO BE CREATED FOR THE PARAMETRIC AND COMPUTATIONAL DESIGNER/ARCHITECT AND ENGINEER
# LunchBox is a plug-in for Grasshopper for
#  exploring mathematical shapes, paneling,
#  structures, and workflow.  We have also
#  introduced new components for general
#  machine learning implementations such as
#  regression analysis, clustering, and
#  networks.
# 041_Lunchbox_basic
# - lunchox can be used for simple
# paneling and creating archtectures
# 
# Alphonso Peluso's great example of
# how to extend plugins
number_slider_9 = Slider(10, range=0..10)  # disabled
number_slider_10 = Slider(7.06, range=0..10)  # disabled
number_slider_11 = Slider(6.75, range=0..10)  # disabled
number_slider_12 = Slider(4.42, range=0..10)  # disabled
number_slider_13 = Slider(5.09, range=0..10)  # disabled
# Lunchbox (panelization and structure creation)
# Data
# Generate
# Machine Learning (proving ground)
# Math
# Panels
# Structure
# Utilities
# Workflow
ellipse = Ellipse(Plane=PlaneXY(0, 0, 0), Radius1=number_slider_9, Radius2=number_slider_10)  # -> Ellipse, Focus1, Focus2; disabled
ellipse_2 = Ellipse(Plane=PlaneXY(0, 0, 0), Radius1=number_slider_11, Radius2=number_slider_12)  # -> Ellipse, Focus1, Focus2; disabled
unit_z = UnitZ(Factor=number_slider_13)  # disabled
number_slider_14 = Slider(6, range=0..10)  # disabled
# 042_Lunchbox_advanced
# - lunchbox is great for getting your thinking
# about machine learning
# - download the examples from the creator,
# Proving Ground, to get started
# - here is a simple example from their tutorials
number_slider_15 = Slider(2, range=0..10)  # disabled
number_slider_16 = Slider(20, range=0..100)  # disabled
move = Move(Geometry=ellipse_2.Ellipse, Motion=unit_z)  # -> Geometry, Transform; disabled
space_truss_structure_2 = SpaceTrussStructure2(UDivisions=10, VDivisions=10)  # -> PrimaryLines, PrimaryLines_2, WebLines, StructureNodes; disabled
number_slider_17 = Slider(3, range=0..10)  # disabled
number_slider_18 = Slider(20, range=0..100)  # disabled
number_slider_19 = Slider(6, range=0..10)  # disabled
number_slider_20 = Slider(6, range=0..10)  # disabled
number_slider_21 = Slider(32, range=0..100)  # disabled
number_slider_22 = Slider(0.22, range=0..1)  # disabled
number_slider_23 = Slider(0.09, range=0..0.1)  # disabled
panel_8 = Panel("2")  # disabled
number_slider_24 = Slider(0.5, range=0..1)  # disabled
number_slider_25 = Slider(0.64, range=0..1)  # disabled
multiplication = Multiplication(A=number_slider_23, B=panel_8)  # disabled
number_slider_26 = Slider(0.19, range=0..1)  # disabled
number_slider_27 = Slider(0.13, range=0..1)  # disabled
panel_9 = Panel("3")  # disabled

# ----
# - untrimmed srf
loft = Loft(
    Curves=[ellipse.Ellipse, move.Geometry],
    Options={Adjust=False, Closed=False, LoftEnds=0, LoftSimp=0, LoftType=0, Rebuild=10, Refit=0.01})  # disabled

# ----
# panels
diamond_panels = DiamondPanels(Surface=loft, UDivisions=number_slider_20, VDivisions=number_slider_21)  # -> DiamondPanels, TriPanels; disabled

# ----
# panels frames
panel_frame = PanelFrame(Panel=[diamond_panels.DiamondPanels, diamond_panels.TriPanels], ScaleFactor=number_slider_25)  # -> PanelFrame, Panel; disabled

surface = Surface(loft)  # disabled
space_truss_structure_1 = SpaceTrussStructure1(Surface=surface, UDivisions=number_slider_14, VDivisions=number_slider_16, TrussDepth=number_slider_15)  # -> PrimaryLines, PrimaryLines_2, WebLines, StructureNodes; disabled
diagrid_structure = DiagridStructure(Surface=surface, UDivisions=number_slider_19, VDivisions=number_slider_18, Type=number_slider_17)  # -> StructureLines, StructureNodes; disabled
hexagon_cells = HexagonCells(Surface=loft, UDivisions=number_slider_20, VDivisions=number_slider_21, TParameter=number_slider_22)  # -> HexagonCells, Centers; disabled
perp_frames = PerpFrames(Curve=diagrid_structure.StructureLines, Count=10, Align=True)  # -> Frames, Parameters; disabled
sphere = Sphere(Base=space_truss_structure_1.StructureNodes, Radius=multiplication)  # disabled
pipe = Pipe(
    Curve=[space_truss_structure_1.PrimaryLines, space_truss_structure_1.PrimaryLines_2, space_truss_structure_1.WebLines],
    Radius=number_slider_23,
    Caps=0)  # disabled
scale = Scale(Geometry=hexagon_cells.HexagonCells, Center=hexagon_cells.Centers, Factor=number_slider_24)  # -> Geometry, Transform; disabled
polygon = Polygon(Plane=perp_frames.Frames, Radius=number_slider_26, Segments=panel_9, FilletRadius=0)  # -> Polygon, Length; disabled
pipe_2 = Pipe(Curve=diagrid_structure.StructureLines, Radius=number_slider_27, Caps=0)  # disabled
curve = Curve(graft(hexagon_cells.HexagonCells))  # disabled
curve_2 = Curve(graft(scale.Geometry))  # disabled
sphere_2 = Sphere(Base=diagrid_structure.StructureNodes, Radius=expr("x*2", number_slider_27))  # disabled
loft_2 = Loft(
    Curves=[curve, curve_2],
    Options={Adjust=False, Closed=False, LoftEnds=0, LoftSimp=0, LoftType=0, Rebuild=10, Refit=0.01})  # disabled
loft_3 = Loft(Curves=polygon.Polygon, Options={Adjust=False, Closed=False, LoftEnds=0, LoftSimp=0, LoftType=0, Rebuild=10, Refit=0.01})  # disabled
geometry = Geometry(panel_frame.PanelFrame)  # disabled
geometry_2 = Geometry(loft_2)  # disabled
