# Grasshopper definition EX_043_plugins_panelingTools_RajaaIssa.gh (Grasshopper 1.0.7)
# plug-ins: PTComponentLibrary, Kangaroo2 Components

# ----
# PLUGINS CAN BE USED SIMPLY AND CAN BE DELVED INTO ON A MORE ADVANCED LEVEL
# THE KEY IS TO UNDERSTAND HOW THEY WERE CONTRUCTED FROM THE VANILLA RIBBON NODES THAT COME WITH GRASSHOPPER FOR RHINO7
# ONLY THEN WILL YOU BE ABLE TO START PROGRAMMING AND COMPILING YOUR OWN PLUGINS THAT HAVE YET TO BE CREATED FOR THE PARAMETRIC AND COMPUTATIONAL DESIGNER/ARCHITECT AND ENGINEER
# PanelingTools for Rhino and Grasshopper
#  by Robert McNeel & Associates is widely
#  used by designers, architects, and building
#  professionals. It supports intuitive design of
#  paneling concepts as well as help
#  rationalize complex geometry into a format
#  that is suitable for analysis and fabrication.
# 043_Paneling_Tools_Rjaa_Issa
# - check out the work of Rajaa Issa at:
# https://wiki.mcneel.com/rhino/home/essentialmathematics
# https://vimeo.com/474292031
number_slider = Slider(26, range=0..100)
range = Range(Domain=number_slider, Steps=Slider(99, range=0..100))
# Panelling Tools
# Curve
# Grid
# Grid Attractors
# Grid Utility
# Panel 2D
# Panel 3D
# Panel Utility
# Param
sine = Sine(Value=range)
multiplication = Multiplication(A=sine, B=Slider(1, range=0..1))
addition = Addition(A=multiplication, B=Slider(11, range=0..100))
construct_point = ConstructPoint(XCoordinate=addition, YCoordinate=0, ZCoordinate=range)
construct_point_2 = ConstructPoint(XCoordinate=0, YCoordinate=0, ZCoordinate=0)
interpolate = Interpolate(Vertices=construct_point, Degree=3, Periodic=False, KnotStyle=1)  # -> Curve, Length, Domain
line_sdl = LineSDL(Start=construct_point_2, Direction=Vector(0, 0, 1), Length=1)
revolution = Revolution(Curve=interpolate.Curve, Axis=line_sdl, Domain=Domain(0, 6.283185307))
surface_domain_number = SurfaceDomainNumber(Surface=revolution, UNumber=Slider(6, range=0..100), VNumber=Slider(6, range=0..100))
curve_attraction = CurveAttraction(Grid=surface_domain_number, CrvAtts=line_sdl, Magnitude=Slider(2, range=0..10))  # -> Grid, Weights
cellulate = Cellulate(Grid=curve_attraction.Grid)  # -> flatten(Wires), Cells, Meshes
join_curves = JoinCurves(Curves=cellulate.Wires, Preserve=False)
control_points = ControlPoints(Curve=join_curves)  # -> Points, Weights, Knots
interpolate_2 = Interpolate(Vertices=control_points.Points, Degree=3, Periodic=False, KnotStyle=1)  # -> Curve, Length, Domain
multipipe = MultiPipe(Curves=interpolate_2.Curve, NodeSize=0.5, EndOffset=1, StrutSize=1, Segment=0, KinkAngle=0.6, CubeFit=0, Caps=0)
