# Grasshopper definition EX_044_plugins_kangaroo_cellularGrowth.gh (Grasshopper 1.0.7)
# plug-ins: PTComponentLibrary, Kangaroo2 Components

# ----
# PLUGINS CAN BE USED SIMPLY AND CAN BE DELVED INTO ON A MORE ADVANCED LEVEL
# THE KEY IS TO UNDERSTAND HOW THEY WERE CONTRUCTED FROM THE VANILLA RIBBON NODES THAT COME WITH GRASSHOPPER FOR RHINO7
# ONLY THEN WILL YOU BE ABLE TO START PROGRAMMING AND COMPILING YOUR OWN PLUGINS THAT HAVE YET TO BE CREATED FOR THE PARAMETRIC AND COMPUTATIONAL DESIGNER/ARCHITECT AND ENGINEER
# PanelingTools for Rhino and Grasshopper
#  by Robert McNeel & Associates is widely
#  used by designers, architects, and building
#  professionals. It supports intuitive design of
#  paneling concepts as well as help
#  rationalize complex geometry into a format
#  that is suitable for analysis and fabrication.
# 043_Paneling_Tools_Rjaa_Issa
# - check out the work of Rajaa Issa at:
# https://wiki.mcneel.com/rhino/home/essentialmathematics
# https://vimeo.com/474292031
number_slider = Slider(26, range=0..100)  # disabled
number_slider_2 = Slider(99, range=0..100)  # disabled
range = Range(Domain=number_slider, Steps=number_slider_2)  # disabled
number_slider_3 = Slider(1, range=0..1)  # disabled
number_slider_4 = Slider(11, range=0..100)  # disabled
# Panelling Tools
# Curve
# Grid
# Grid Attractors
# Grid Utility
# Panel 2D
# Panel 3D
# Panel Utility
# Param
sine = Sine(Value=range)  # disabled
multiplication = Multiplication(A=sine, B=number_slider_3)  # disabled
addition = Addition(A=multiplication, B=number_slider_4)  # disabled
construct_point = ConstructPoint(XCoordinate=addition, YCoordinate=0, ZCoordinate=range)  # disabled
construct_point_2 = ConstructPoint(XCoordinate=0, YCoordinate=0, ZCoordinate=0)  # disabled
number_slider_5 = Slider(6, range=0..100)  # disabled
number_slider_6 = Slider(6, range=0..100)  # disabled
interpolate = Interpolate(Vertices=construct_point, Degree=3, Periodic=False, KnotStyle=1)  # -> Curve, Length, Domain; disabled
line_sdl = LineSDL(Start=construct_point_2, Direction=Vector(0, 0, 1), Length=1)  # disabled
revolution = Revolution(Curve=interpolate.Curve, Axis=line_sdl, Domain=Domain(0, 6.283185307))  # disabled
number_slider_7 = Slider(2, range=0..10)  # disabled
surface_domain_number = SurfaceDomainNumber(Surface=revolution, UNumber=number_slider_6, VNumber=number_slider_5)  # disabled
curve_attraction = CurveAttraction(Grid=surface_domain_number, CrvAtts=line_sdl, Magnitude=number_slider_7)  # -> Grid, Weights; disabled
cellulate = Cellulate(Grid=curve_attraction.Grid)  # -> flatten(Wires), Cells, Meshes; disabled
cellulate_2 = Cellulate(Grid=curve_attraction.Grid)  # -> flatten(Wires), Cells, Meshes; disabled
join_curves = JoinCurves(Curves=cellulate.Wires, Preserve=False)  # disabled
join_curves_2 = JoinCurves(Curves=cellulate_2.Wires, Preserve=False)  # disabled
control_points = ControlPoints(Curve=join_curves)  # -> Points, Weights, Knots; disabled
control_points_2 = ControlPoints(Curve=join_curves_2)  # -> Points, Weights, Knots; disabled
interpolate_2 = Interpolate(Vertices=control_points_2.Points, Degree=3, Periodic=False, KnotStyle=1)  # -> Curve, Length, Domain; disabled
interpolate_3 = Interpolate(Vertices=control_points.Points, Degree=3, Periodic=False, KnotStyle=1)  # -> Curve, Length, Domain; disabled
join_curves_3 = JoinCurves(Curves=flatten([interpolate_3.Curve, interpolate_2.Curve]), Preserve=False)  # disabled
multipipe = MultiPipe(Curves=join_curves_3, NodeSize=0.5, EndOffset=1, StrutSize=1, Segment=0, KinkAngle=0.6, CubeFit=0, Caps=0)  # disabled
