# Grasshopper definition EX_045_plugins_c.Gediminas Kirdeikis_Kangaroo.gh (Grasshopper 1.0.7)
# plug-ins: Kangaroo2 Components, Pufferfish, Anemone

number_slider = Slider(1000, range=0..1000)  # disabled
curve = Curve(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)  # disabled
boolean_toggle = BooleanToggle(True)  # disabled
divide_curve = DivideCurve(Curve=curve, Count=number_slider, Kinks=False)  # -> Points, Tangents, Parameters; disabled
polyline = PolyLine(Vertices=divide_curve.Points, Closed=boolean_toggle)  # disabled
explode = Explode(Curve=polyline, Recursive=True)  # -> Segments, Vertices; disabled
curve_2 = Curve(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)  # disabled
mesh = Mesh(curve_2)  # disabled
number_slider_2 = Slider(11.09, range=1..20)  # disabled
length = Length(Curve=explode.Segments)  # disabled
average = Average(Input=length)  # disabled
number_slider_3 = Slider(0.99, range=0..10)  # disabled
onmesh = OnMesh(Points=divide_curve.Points, Mesh=mesh, Strength=1)  # disabled
multiplication = Multiplication(A=average, B=number_slider_2)  # disabled
length_line = LengthLine(Line=explode.Segments, Length=multiplication, Strength=10)  # disabled
spherecollide = SphereCollide(Points=divide_curve.Points, Radius=number_slider_2, Strength=number_slider_3)  # disabled
boolean_toggle_2 = BooleanToggle(True)  # disabled
button = Button()  # disabled
solver = Solver(GoalObjects=[length_line, spherecollide, onmesh], Reset=button, Threshold=1e-15, Tolerance=0.0001, On=boolean_toggle_2)  # -> I, V, O; disabled
boolean_toggle_3 = BooleanToggle(True)  # disabled
boolean_toggle_4 = BooleanToggle(True)  # disabled
polyline_2 = PolyLine(Vertices=solver.V, Closed=boolean_toggle_3)  # disabled
panel = Panel("2000")  # disabled
panel_2 = Panel("3")  # disabled
rebuild_curve = RebuildCurve(Curve=polyline_2, Count=panel, Degree=panel_2, EndTangents=boolean_toggle_4)  # disabled

number_slider_4 = Slider(1000, range=0..1000)  # disabled
curve_3 = Curve(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)  # disabled
divide_curve_2 = DivideCurve(Curve=curve_3, Count=number_slider_4, Kinks=False)  # -> Points, Tangents, Parameters; disabled

# ----
# 044_Kangaroo_cellular_growth
number_slider_5 = Slider(500, range=0..1000)  # disabled
# PLUGINS CAN BE USED SIMPLY AND CAN BE DELVED INTO ON A MORE ADVANCED LEVEL
# THE KEY IS TO UNDERSTAND HOW THEY WERE CONTRUCTED FROM THE VANILLA RIBBON NODES THAT COME WITH GRASSHOPPER FOR RHINO7
# ONLY THEN WILL YOU BE ABLE TO START PROGRAMMING AND COMPILING YOUR OWN PLUGINS THAT HAVE YET TO BE CREATED FOR THE PARAMETRIC AND COMPUTATIONAL DESIGNER/ARCHITECT AND ENGINEER
curve_4 = Curve(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)  # disabled
# Cellular Growth with Kangaroo
# Gediminas Kirdeikis has a great overview
# in stand alone grasshopper with the Kangaroo plugin
# - this script/video summarizes the
# 6 hour, complete, detailed C# scripting series by Long Nguyen
# https://www.youtube.com/watch?v=viEpaivq9A0&t=607s
boolean_toggle_5 = BooleanToggle(True)  # disabled
divide_curve_3 = DivideCurve(Curve=curve_4, Count=number_slider_5, Kinks=False)  # -> Points, Tangents, Parameters; disabled
polyline_3 = PolyLine(Vertices=divide_curve_3.Points, Closed=boolean_toggle_5)  # disabled
explode_2 = Explode(Curve=polyline_3, Recursive=True)  # -> Segments, Vertices; disabled
number_slider_6 = Slider(5.64, range=1..10)  # disabled
length_2 = Length(Curve=explode_2.Segments)  # disabled
average_2 = Average(Input=length_2)  # disabled
number_slider_7 = Slider(3.31, range=0..10)  # disabled
multiplication_2 = Multiplication(A=average_2, B=number_slider_6)  # disabled
length_line_2 = LengthLine(Line=explode_2.Segments, Length=multiplication_2, Strength=10)  # disabled
spherecollide_2 = SphereCollide(Points=divide_curve_3.Points, Radius=number_slider_6, Strength=number_slider_7)  # disabled
boolean_toggle_6 = BooleanToggle(True)  # disabled
button_2 = Button()  # disabled
solver_2 = Solver(GoalObjects=[length_line_2, spherecollide_2], Reset=button_2, Threshold=1e-15, Tolerance=0.0001, On=boolean_toggle_6)  # -> I, V, O; disabled
boolean_toggle_7 = BooleanToggle(True)  # disabled
polyline_4 = PolyLine(Vertices=solver_2.V, Closed=boolean_toggle_7)  # disabled

boolean_toggle_8 = BooleanToggle(True)  # disabled
polyline_5 = PolyLine(Vertices=divide_curve_2.Points, Closed=boolean_toggle_8)  # disabled
explode_3 = Explode(Curve=polyline_5, Recursive=True)  # -> Segments, Vertices; disabled

solver_3 = Solver(Reset=False, Threshold=1e-15, Tolerance=0.0001, On=True)  # -> I, V, O; disabled

# ----
# 045_c.Gediminas Kirdeikis_Kangaroo_cellular_growth
number_slider_8 = Slider(10, range=0..10)  # disabled
button_3 = Button()  # disabled
loop_start = LoopStart(Repeat=number_slider_8, Trigger=button_3)  # -> port, Counter, Data; disabled
boolean_toggle_9 = BooleanToggle(True)  # disabled
curve_5 = Curve(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)  # disabled
mesh_2 = Mesh(curve_5)  # disabled
curve_6 = Curve(loop_start.Data)  # disabled
number_slider_9 = Slider(5, range=5..10)  # disabled

panel_3 = Panel("0 to 10")  # disabled
panel_4 = Panel("1 to 10")  # disabled
remap_numbers = RemapNumbers(Value=loop_start.Counter, Source=panel_3, Target=panel_4)  # -> Mapped, Clipped; disabled

length_3 = Length(Curve=explode_3.Segments)  # disabled
average_3 = Average(Input=length_3)  # disabled
multiplication_3 = Multiplication(A=average_3, B=remap_numbers.Mapped)  # disabled

number_slider_10 = Slider(0.79, range=0..10)  # disabled
length_line_3 = LengthLine(Line=explode_3.Segments, Length=multiplication_3, Strength=10)  # disabled
spherecollide_3 = SphereCollide(Points=divide_curve_2.Points, Radius=multiplication_3, Strength=number_slider_10)  # disabled
onmesh_2 = OnMesh(Points=divide_curve_2.Points, Mesh=mesh_2, Strength=1)  # disabled

boolean_toggle_10 = BooleanToggle(True)  # disabled
panel_5 = Panel("500")  # disabled
panel_6 = Panel(".95")  # disabled
stepsolver = StepSolver(
    GoalObjects=[length_line_3, onmesh_2, spherecollide_3],
    Tolerance=0.0001,
    Momentum=boolean_toggle_10,
    Damping=panel_6,
    SubIterations=panel_5,
    Animate=boolean_toggle_9)  # -> I, V, O; disabled

boolean_toggle_11 = BooleanToggle(True)  # disabled
boolean_toggle_12 = BooleanToggle(True)  # disabled
polyline_6 = PolyLine(Vertices=stepsolver.V, Closed=boolean_toggle_11)  # disabled
panel_7 = Panel("2000")  # disabled
panel_8 = Panel("3")  # disabled
rebuild_curve_2 = RebuildCurve(Curve=polyline_6, Count=panel_7, Degree=panel_8, EndTangents=boolean_toggle_12)  # disabled

merge = Merge(Data1=curve_6, Data2=rebuild_curve_2)  # -> flatten(Result); disabled
clean_tree = CleanTree(RemoveNulls=True, RemoveInvalid=True, RemoveEmpty=False, Tree=merge)  # disabled
loop_end = LoopEnd(port=loop_start.port, Exit=False, Data=clean_tree, TimeOutVal=0, pausedState=False, state="Constant output")  # disabled
list_length = ListLength(List=loop_end)  # disabled
series = Series(Start=0, Step=number_slider_9, Count=list_length)  # disabled
unit_z = UnitZ(Factor=series)  # disabled
move = Move(Geometry=loop_end, Motion=unit_z)  # -> Geometry, Transform; disabled
loft = Loft(Curves=move.Geometry, Options={Adjust=False, Closed=False, LoftEnds=0, LoftSimp=0, LoftType=0, Rebuild=10, Refit=0.01})  # disabled
cap_holes = CapHoles(Brep=loft)  # disabled
