# Grasshopper definition EX_046_plugins_metaball.gh (Grasshopper 1.0.7)
# plug-ins: Pufferfish

# ----
# PLUGINS CAN BE USED SIMPLY AND CAN BE DELVED INTO ON A MORE ADVANCED LEVEL
# THE KEY IS TO UNDERSTAND HOW THEY WERE CONTRUCTED FROM THE VANILLA RIBBON NODES THAT COME WITH GRASSHOPPER FOR RHINO7
# ONLY THEN WILL YOU BE ABLE TO START PROGRAMMING AND COMPILING YOUR OWN PLUGINS THAT HAVE YET TO BE CREATED FOR THE PARAMETRIC AND COMPUTATIONAL DESIGNER/ARCHITECT AND ENGINEER
# 046_metaball_example
# - Parametric House makes use of genepool in
# metaball(t) custom
# - control points with charge and slicing
metaball_t = MetaBallT(Plane=PlaneXY(0, 0, 0), Threshold=0.5)  # disabled
number_slider = Slider(2, range=-12..12)  # disabled
panel = Panel("-12 to 12")  # disabled
number_slider_2 = Slider(57, range=0..100)  # disabled
number_slider_3 = Slider(0.39, range=0..2)  # disabled
rectangle = Rectangle(Plane=PlaneXY(0, 0, 0), XSize=panel, YSize=panel, Radius=0)  # -> Rectangle, Length; disabled
construct_point = ConstructPoint(XCoordinate=0, YCoordinate=0, ZCoordinate=number_slider)  # disabled
metaball_t_2 = MetaBallT(Plane=PlaneXY(0, 0, 0), Threshold=0.5)  # disabled
panel_2 = Panel("4")  # disabled
populate_2d = Populate2D(Region=rectangle.Rectangle, Count=panel_2, Seed=number_slider_2)  # disabled
unit_z = UnitZ(Factor=number_slider_3)  # disabled
gene_pool = GenePool(Decimals=2, Maximum=50, Minimum=5, Value=[28.40347521, 28.33930024, 14.72990515, 31.79194266])  # disabled
xy_plane = XYPlane(Origin=construct_point)  # disabled
linear_array = LinearArray(Geometry=xy_plane, Direction=unit_z, Count=10)  # -> Geometry, Transform; disabled
metaball_t_custom = MetaBallTCustom(Plane=PlaneXY(0, 0, 0), Threshold=0.5)  # disabled
number_slider_4 = Slider(4.77, range=0..10)  # disabled
number_slider_5 = Slider(0.48, range=0..1)  # disabled
number_slider_6 = Slider(4, range=0..100)  # disabled
metaball_t_custom_2 = MetaBallTCustom(Points=populate_2d, Charge=gene_pool, Plane=linear_array.Geometry, Threshold=number_slider_5, Accuracy=number_slider_4)  # disabled
number_slider_7 = Slider(25, range=0..100)  # disabled
smooth_polyline = SmoothPolyline(Polyline=metaball_t_custom_2, Strength=1, Times=number_slider_6)  # disabled
panel_3 = Panel("3")  # disabled
rebuild_curve = RebuildCurve(Curve=smooth_polyline, Count=number_slider_7, Degree=panel_3, EndTangents=False)  # disabled
surface = Surface(rebuild_curve)  # disabled
