# Grasshopper definition EX_047_plugins_coccoon.gh (Grasshopper 1.0.7)
# plug-ins: MarchingCubes, Bifocals

number_slider = Slider(14, range=0..100)  # disabled
number_slider_2 = Slider(8, range=0..100)  # disabled
number_slider_3 = Slider(12, range=0..100)  # disabled
negative = Negative(Value=number_slider)  # disabled
negative_2 = Negative(Value=number_slider_2)  # disabled
construct_domain = ConstructDomain(DomainStart=negative, DomainEnd=number_slider)  # disabled
construct_domain_2 = ConstructDomain(DomainStart=negative_2, DomainEnd=number_slider_2)  # disabled
construct_domain_3 = ConstructDomain(DomainStart=0, DomainEnd=number_slider_3)  # disabled
number_slider_4 = Slider(29, range=0..100)  # disabled
number_slider_5 = Slider(8, range=2..20)  # disabled
domain_box = DomainBox(Base=PlaneXY(0, 0, 0), X=construct_domain, Y=construct_domain_2, Z=construct_domain_3)  # disabled
populate_3d = Populate3D(Region=domain_box, Count=number_slider_5, Seed=number_slider_4)  # disabled
number_slider_6 = Slider(16, range=0..30)  # disabled
number_slider_7 = Slider(2, range=0..10)  # disabled
construct_domain_4 = ConstructDomain(DomainStart=number_slider_7, DomainEnd=number_slider_6)  # disabled
number_slider_8 = Slider(1.3, range=1..2)  # disabled
random = Random(Range=construct_domain_4, Number=number_slider_5, Seed=2)  # disabled
point_charge = PointCharge(Point=populate_3d, Radius=random, ChargeStrength=number_slider_8)  # disabled
number_slider_9 = Slider(1.71, range=0.1..2)  # disabled
number_slider_10 = Slider(0.379, range=-0.5..0.5)  # disabled
boolean_toggle = BooleanToggle(True)  # disabled
cocoon = Cocoon(Charges=point_charge, Iso=number_slider_10, CellSize=number_slider_9, Execute=boolean_toggle, Simple=False)  # -> Mesh, RefinementData; disabled

number_slider_11 = Slider(14, range=0..100)
number_slider_12 = Slider(8, range=0..100)
negative_3 = Negative(Value=number_slider_11)
negative_4 = Negative(Value=number_slider_12)
construct_domain_5 = ConstructDomain(DomainStart=negative_3, DomainEnd=number_slider_11)
construct_domain_6 = ConstructDomain(DomainStart=negative_4, DomainEnd=number_slider_12)
construct_domain_7 = ConstructDomain(DomainStart=0, DomainEnd=Slider(10, range=0..100))
domain_box_2 = DomainBox(Base=PlaneXY(0, 0, 0), X=construct_domain_5, Y=construct_domain_6, Z=construct_domain_7)

# ----
# PLUGINS CAN BE USED SIMPLY AND CAN BE DELVED INTO ON A MORE ADVANCED LEVEL
# THE KEY IS TO UNDERSTAND HOW THEY WERE CONTRUCTED FROM THE VANILLA RIBBON NODES THAT COME WITH GRASSHOPPER FOR RHINO7
# ONLY THEN WILL YOU BE ABLE TO START PROGRAMMING AND COMPILING YOUR OWN PLUGINS THAT HAVE YET TO BE CREATED FOR THE PARAMETRIC AND COMPUTATIONAL DESIGNER/ARCHITECT AND ENGINEER
# 047_coccoon_example
# - great plugin for volumetric modeling
# available at: http://www.bespokegeometry.com/2015/07/22/cocoon/
cocoon_2 = Cocoon(Simple=False)  # -> Mesh, RefinementData
refine = Refine()
brep_charge = BrepCharge()
curve_charge = CurveCharge()
curve_group_charge = CurveGroupCharge()
point_charge_2 = PointCharge()
number_slider_13 = Slider(22, range=0..100)

deconstruct_brep = DeconstructBrep(Brep=domain_box_2)  # -> Faces, Edges, Vertices
list_item = ListItem(List=deconstruct_brep.Faces, Index=Slider(5, range=0..10), Wrap=True)
list_item_2 = ListItem(List=deconstruct_brep.Faces, Index=Slider(4, range=0..10), Wrap=True)
brep_wireframe = BrepWireframe(Brep=list_item, Density=-1)
brep_wireframe_2 = BrepWireframe(Brep=list_item_2, Density=-1)
number_slider_14 = Slider(5, range=0..10)
join_curves = JoinCurves(Curves=brep_wireframe, Preserve=False)
join_curves_2 = JoinCurves(Curves=brep_wireframe_2, Preserve=False)
populate_2d = Populate2D(Region=join_curves, Count=number_slider_14, Seed=Slider(39, range=0..100))
populate_2d_2 = Populate2D(Region=join_curves_2, Count=Slider(5, range=0..10), Seed=Slider(72, range=0..100))
unit_z = UnitZ(Factor=Slider(12, range=0..100))
reverse = Reverse(Vector=unit_z)
line = Line(StartPoint=populate_2d, EndPoint=populate_2d_2)
bezier_span = BezierSpan(StartPoint=populate_2d_2, StartTangent=unit_z, EndPoint=populate_2d, EndTangent=reverse)  # -> Curve, Length, Domain

number_slider_15 = Slider(8, range=2..20)
populate_3d_2 = Populate3D(Region=domain_box_2, Count=number_slider_15, Seed=Slider(26, range=0..100))
construct_domain_8 = ConstructDomain(DomainStart=Slider(6, range=0..10), DomainEnd=Slider(10, range=0..10))
construct_domain_9 = ConstructDomain(DomainStart=Slider(6, range=0..10), DomainEnd=Slider(7, range=0..10))
random_2 = Random(Range=construct_domain_8, Number=number_slider_15, Seed=number_slider_13)
random_3 = Random(Range=construct_domain_9, Number=number_slider_14, Seed=number_slider_13)
point_charge_3 = PointCharge(Point=populate_3d_2, Radius=random_2, ChargeStrength=Slider(1.32, range=1..2))
curve_charge_2 = CurveCharge(Curve=bezier_span.Curve, Radius=random_3, ChargeStrengths=Slider(1.32, range=1..2))
cocoon_3 = Cocoon(
    Charges=curve_charge_2,
    Iso=Slider(0.2, range=-0.5..0.5),
    CellSize=Slider(1.44, range=0.1..2),
    Execute=Toggle(True),
    Simple=False)  # -> Mesh, RefinementData
cocoon_4 = Cocoon(
    Charges=point_charge_3,
    Iso=Slider(0.145, range=-0.5..0.5),
    CellSize=Slider(1.62, range=0.1..2),
    Execute=Toggle(True),
    Simple=False)  # -> Mesh, RefinementData
mesh = Mesh(cocoon_4.Mesh)
mesh_2 = Mesh(cocoon_3.Mesh)

mesh_3 = Mesh(domain_box_2)
mesh_split = MeshSplit(Mesh=mesh_3, Splitters=mesh)
list_item_3 = ListItem(List=mesh_split, Index=Slider(3, range=0..3), Wrap=True)  # -> Item, Item1, Item2, Item3, Item4
mesh_4 = Mesh(list_item_3.Item2)
mesh_5 = Mesh(list_item_3.Item4)
