# Grasshopper definition EX_048_plugins_voronoi.gh (Grasshopper 1.0.7)
# plug-ins: MeshEdit Components, LunchBox

# ----
# David Copete *
number_slider = Slider(1.7, range=0..10)  # disabled
number_slider_2 = Slider(109, range=0..200)  # disabled
multiplication = Multiplication(A=number_slider_2, B=number_slider)  # disabled

# ----
# PLUGINS CAN BE USED SIMPLY AND CAN BE DELVED INTO ON A MORE ADVANCED LEVEL
# THE KEY IS TO UNDERSTAND HOW THEY WERE CONTRUCTED FROM THE VANILLA RIBBON NODES THAT COME WITH GRASSHOPPER FOR RHINO7
# ONLY THEN WILL YOU BE ABLE TO START PROGRAMMING AND COMPILING YOUR OWN PLUGINS THAT HAVE YET TO BE CREATED FOR THE PARAMETRIC AND COMPUTATIONAL DESIGNER/ARCHITECT AND ENGINEER
# 048_voronoil_example
# - this is probably the most used and over used
# algorithm used on the internet in grasshopper
# BEWARE!
# - here are some great samples of David Copete
# https://www.copetedavid.com/shop
# requires the Lunchbox download
voronoi = Voronoi(BruteForceOverride=False)  # disabled
panel = Panel("100")  # disabled
rectangle = Rectangle(Plane=PlaneXY(0, 0, 0), XSize=panel, YSize=panel, Radius=0)  # -> Rectangle, Length; disabled
number_slider_3 = Slider(62, range=0..300)  # disabled
voronoi_3d = Voronoi3D()  # -> Cells, Boundary; disabled
hexagon_cells = HexagonCells(Surface=rectangle.Rectangle, UDivisions=number_slider_2, VDivisions=multiplication, TParameter=0.25)  # -> HexagonCells, Centers; disabled
populate_2d = Populate2D(Region=rectangle.Rectangle, Count=number_slider_3, Seed=1)  # disabled
voronoi_groups = VoronoiGroups(Boundary={Plane=PlaneXY(0, 0, 0), Size=Domain2(u=-10..10, v=-10..10)})  # -> Diagram1, Diagram2; disabled
number_slider_4 = Slider(0.6771, range=0..1)  # disabled
voronoi_cell = VoronoiCell()  # disabled
point = Point(hexagon_cells.Centers)  # disabled
number_slider_5 = Slider(0.0039, range=0..1)  # disabled
image_sampler = ImageSampler(point, Filter="Value", Interpolate=True, Umax=100, Umin=0, Vmax=100, Vmin=0, Wrap=1)  # disabled
number_slider_6 = Slider(0.3474, range=0..1)  # disabled
_3d_voronoi = _3DVoronoi()  # -> _3DVoronoiCells, Connectivity; disabled
construct_domain = ConstructDomain(DomainStart=number_slider_4, DomainEnd=number_slider_5)  # disabled
bounds = Bounds(Numbers=image_sampler)  # disabled
voronoi_2 = Voronoi(Points=hexagon_cells.Centers, Boundary=rectangle.Rectangle, BruteForceOverride=False)  # disabled
remap_numbers = RemapNumbers(Value=image_sampler, Source=bounds, Target=construct_domain)  # -> Mapped, Clipped; disabled
point_2 = Point(populate_2d)  # disabled
smaller_than = SmallerThan(FirstNumber=remap_numbers.Mapped, SecondNumber=number_slider_6)  # -> SmallerThan, OrEqualTo; disabled
larger_than = LargerThan(FirstNumber=remap_numbers.Mapped, SecondNumber=number_slider_6)  # -> LargerThan, OrEqualTo; disabled
cull_pattern = CullPattern(List=point, CullPattern=larger_than.LargerThan)  # disabled
cull_pattern_2 = CullPattern(List=point_2, CullPattern=smaller_than.SmallerThan)  # disabled
point_3 = Point([cull_pattern, cull_pattern_2])  # disabled
voronoi_3 = Voronoi(Points=point_3, Boundary=rectangle.Rectangle, BruteForceOverride=False)  # disabled
