# Grasshopper definition EX_049_plugins_weaverbird.gh (Grasshopper 1.0.7)
# plug-ins: Weaverbird, MeshEdit Components

# ----
# - download mesh edit plugin for these scripts (Mesh credit: Daniel Christev)
number_slider = Slider(40, range=0..100)  # disabled
number_slider_2 = Slider(100, range=0..100)  # disabled
number_slider_3 = Slider(4, range=0..5)  # disabled
range = Range(Domain=number_slider, Steps=number_slider_2)  # disabled
sine = Sine(Value=range)  # disabled
multiplication = Multiplication(A=sine, B=number_slider_3)  # disabled
number_slider_4 = Slider(1.679, range=0..5)  # disabled
construct_point = ConstructPoint(XCoordinate=graft(range), YCoordinate=range, ZCoordinate=multiplication)  # disabled
surface_from_points = SurfaceFromPoints(Points=flatten(construct_point), UCount=expr("x+1", number_slider_2), Interpolate=False)  # disabled
surface = Surface(surface_from_points)  # disabled
area = Area(Geometry=surface)  # -> Area, Centroid; disabled
dimensions = Dimensions(Surface=surface)  # -> UDimension, VDimension; disabled
number_slider_5 = Slider(10, range=0..20)  # disabled
division = Division(A=dimensions.UDimension, B=dimensions.VDimension)  # disabled
scale = Scale(Geometry=surface, Center=area.Centroid, Factor=number_slider_4)  # -> Geometry, Transform; disabled
md_slider = MDSlider(
    SliderMode=0,
    slider_value=Point(0.5964374077, 0.3989495998, 0.5),
    x_domain=Domain(0, 1),
    y_domain=Domain(0, 1),
    z_domain=Domain(0, 1))  # disabled
multiplication_2 = Multiplication(A=division, B=number_slider_5)  # disabled
integer = Integer(multiplication_2)  # disabled
divide_surface = DivideSurface(Surface=surface, UCount=integer, VCount=number_slider_5)  # -> flatten(Points), Normals, Parameters; disabled
md_slider_2 = MDSlider(
    SliderMode=0,
    slider_value=Point(0.758053798, 0.3364762142, 0.5),
    x_domain=Domain(0, 1),
    y_domain=Domain(0, 1),
    z_domain=Domain(0, 1))  # disabled
number_slider_6 = Slider(0.243, range=0..2)  # disabled
md_slider_3 = MDSlider(
    SliderMode=0,
    slider_value=Point(0.1948275682, 0.7902063509, 0.5),
    x_domain=Domain(0, 1),
    y_domain=Domain(0, 1),
    z_domain=Domain(0, 1))  # disabled
evaluate_surface = EvaluateSurface(Surface=reparameterize(scale.Geometry), Point=[md_slider_3, md_slider, md_slider_2])  # -> Point, Normal, UDirection, VDirection, Frame; disabled
distance = Distance(PointA=graft(evaluate_surface.Point), PointB=divide_surface.Points)  # disabled
point = Point(divide_surface.Points)  # disabled
expression = Expression(w=flatten(number_slider_6), t=distance, Expression="sin(2*w^2*t)")  # disabled
flip_matrix = FlipMatrix(Data=expression)  # disabled
number_slider_7 = Slider(7.333, range=0..10)  # disabled
ma = MassMultiplication(Input=flip_matrix)  # -> flatten(Result), PartialResults; disabled
multiplication_3 = Multiplication(A=number_slider_7, B=ma.Result)  # disabled
unit_z = UnitZ(Factor=multiplication_3)  # disabled
move = Move(Geometry=divide_surface.Points, Motion=unit_z)  # -> Geometry, Transform; disabled
expression_2 = Expression(u=integer, Expression="u+1")  # disabled
mesh_frompoints = MeshFromPoints(Points=move.Geometry, UDirection=expr("x+1", integer), VDirection=expr("x+1", number_slider_5))  # disabled
surface_from_points_2 = SurfaceFromPoints(Points=move.Geometry, UCount=expression_2, Interpolate=False)  # disabled

number_slider_8 = Slider(38, range=0..100)  # disabled
number_slider_9 = Slider(21, range=0..100)  # disabled
number_slider_10 = Slider(20, range=0..100)  # disabled

number_slider_11 = Slider(1.73, range=0..10)  # disabled
number_slider_12 = Slider(3.2, range=0..10)  # disabled
number_slider_13 = Slider(1.45, range=0..10)  # disabled

# ----
# 049_weaverbird_example
# - credit Daniel Christev with mesh generator
# -
# weaverbird is a powerful plugin
# - Alfonso Peluso has some great samples online
# https://www.youtube.com/watch?v=eYjFq4_miw0
# - applying multiple values
number_slider_14 = Slider(2, range=0..5)  # disabled
# PLUGINS CAN BE USED SIMPLY AND CAN BE DELVED INTO ON A MORE ADVANCED LEVEL
# THE KEY IS TO UNDERSTAND HOW THEY WERE CONTRUCTED FROM THE VANILLA RIBBON NODES THAT COME WITH GRASSHOPPER FOR RHINO7
# ONLY THEN WILL YOU BE ABLE TO START PROGRAMMING AND COMPILING YOUR OWN PLUGINS THAT HAVE YET TO BE CREATED FOR THE PARAMETRIC AND COMPUTATIONAL DESIGNER/ARCHITECT AND ENGINEER
weaverbird_s_tile = WeaverbirdsTile(FillStrategy=1, OptIn=2)  # disabled
mesh = Mesh(mesh_frompoints)  # disabled
weaverbird_s_catmull_clark_subdivision = WeaverbirdsCatmullClarkSubdivision(MeshCurves=mesh, Level=number_slider_14, SmoothNakedEdges=1)  # disabled
weaverbird_s_loop_subdivision = WeaverbirdsLoopSubdivision(MeshCurves=mesh, Level=number_slider_14, SmoothNakedEdges=1)  # disabled
weaverbird_s_constant_quads_split_subdiv = WeaverbirdsConstantQuadsSplitSubdivision(MeshCurves=mesh, Level=number_slider_14, SmoothNakedEdges=1)  # disabled
weaverbird_s_mesh_from_lines_weave_back = WeaverbirdsMeshFromLinesWeaveBack(MaximumValence=4)  # disabled
weaverbird_s_picture_frame = WeaverbirdsPictureFrame(
    MeshPolylines=weaverbird_s_catmull_clark_subdivision,
    Distance=[number_slider_9, number_slider_8, number_slider_10],
    InsetType=0)  # disabled
weaverbird_s_mesh_thicken = WeaverbirdsMeshThicken(MeshCurves=weaverbird_s_picture_frame, Distance=[number_slider_11, number_slider_12, number_slider_13], OffsetType=0)  # disabled
number_slider_15 = Slider(2, range=1..3)  # disabled
weaverbird_s_catmull_clark_subdivision_2 = WeaverbirdsCatmullClarkSubdivision(MeshCurves=weaverbird_s_mesh_thicken, Level=number_slider_15, SmoothNakedEdges=1)  # disabled
