# Grasshopper definition EX_050_plugins_octree.gh (Grasshopper 1.0.7)
# plug-ins: Weaverbird

# ----
# 050_octree_example
# - OM! has some of the best music videos for
# learning grasshopper online
# https://www.youtube.com/watch?v=2ZdsI_p9Ifo
number_slider = Slider(35, range=0..100)  # disabled
number_slider_2 = Slider(100, range=0..100)  # disabled
# PLUGINS CAN BE USED SIMPLY AND CAN BE DELVED INTO ON A MORE ADVANCED LEVEL
# THE KEY IS TO UNDERSTAND HOW THEY WERE CONTRUCTED FROM THE VANILLA RIBBON NODES THAT COME WITH GRASSHOPPER FOR RHINO7
# ONLY THEN WILL YOU BE ABLE TO START PROGRAMMING AND COMPILING YOUR OWN PLUGINS THAT HAVE YET TO BE CREATED FOR THE PARAMETRIC AND COMPUTATIONAL DESIGNER/ARCHITECT AND ENGINEER
octree = OcTree(Square=False, Group=5)  # -> Boxes, Points; disabled
geometry = Geometry(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)  # disabled
number_slider_3 = Slider(-3.62, range=-100..100.01)  # disabled
boolean_toggle = BooleanToggle(True)  # disabled
populate_geometry = PopulateGeometry(Geometry=geometry, Count=number_slider_2, Seed=number_slider)  # disabled
quadtree = QuadTree(Plane=PlaneXY(0, 0, 0), Square=False, Group=5)  # -> Quads, Points; disabled
octree_2 = OcTree(Points=populate_geometry, Square=boolean_toggle, Group=number_slider_3)  # -> Boxes, Points; disabled
quad_remesh = QuadRemesh(Settings={aqc=True, as=50, dhe=True, gci=0, null=False, pme=0, sa=0, tqc=2000})  # disabled
geometry_2 = Geometry(octree_2.Boxes)  # disabled
number_slider_4 = Slider(2.607, range=0..10)  # disabled
area = Area(Geometry=geometry_2)  # -> Area, Centroid; disabled
quad_remesh_settings = QuadRemeshSettings(TargetCount=1000, AdaptiveSize=0, AdaptiveCount=False, HardEdges=False, SeamEdges=0, Symmetry=0, GuideCurves=0)  # disabled
scale = Scale(Geometry=geometry_2, Center=area.Centroid, Factor=number_slider_4)  # -> Geometry, Transform; disabled
solid_union = SolidUnion(Breps=scale.Geometry)  # disabled
boolean_toggle_2 = BooleanToggle(False)  # disabled
number_slider_5 = Slider(2, range=1..3)  # disabled
mesh = Mesh(solid_union)  # disabled
weaverbird_s_join_meshes_and_weld = WeaverbirdsJoinMeshesAndWeld(Mesh=mesh, Weld=boolean_toggle_2)  # disabled
weaverbird_s_loop_subdivision = WeaverbirdsLoopSubdivision(MeshCurves=weaverbird_s_join_meshes_and_weld, Level=number_slider_5, SmoothNakedEdges=1)  # disabled
number_slider_6 = Slider(23, range=0..100)  # disabled
number_slider_7 = Slider(2, range=0..10)  # disabled
weaverbird_s_picture_frame = WeaverbirdsPictureFrame(MeshPolylines=weaverbird_s_loop_subdivision, Distance=number_slider_6, InsetType=0)  # disabled
weaverbird_s_mesh_thicken = WeaverbirdsMeshThicken(MeshCurves=weaverbird_s_picture_frame, Distance=number_slider_7, OffsetType=0)  # disabled
colour_swatch = ColourSwatch(SwatchColor=RGB(9, 188, 255))  # disabled
colour_swatch_2 = ColourSwatch(SwatchColor=RGB(255, 145, 0))  # disabled
custom_preview = CustomPreview(Geometry=scale.Geometry, Material=colour_swatch)  # disabled
custom_preview_2 = CustomPreview(Geometry=weaverbird_s_mesh_thicken, Material=colour_swatch_2)  # disabled
