# Grasshopper definition EX_051_plugins_subD.gh (Grasshopper 1.0.7)
# plug-ins: Kangaroo2 Components, MeshEdit Components, Weaverbird

number_slider = Slider(47, range=0..100)  # disabled
number_slider_2 = Slider(86, range=0..100)  # disabled
number_slider_3 = Slider(52, range=0..100)  # disabled
number_slider_4 = Slider(81, range=0..100)  # disabled
construct_point = ConstructPoint(XCoordinate=number_slider, YCoordinate=number_slider_3, ZCoordinate=number_slider_2)  # disabled
construct_point_2 = ConstructPoint(XCoordinate=number_slider_4, YCoordinate=number_slider_4, ZCoordinate=number_slider_4)  # disabled
number_slider_5 = Slider(12, range=0..100)  # disabled
number_slider_6 = Slider(26, range=0..100)  # disabled
number_slider_7 = Slider(49, range=0..100)  # disabled
number_slider_8 = Slider(35, range=0..100)  # disabled
number_slider_9 = Slider(22, range=0..100)  # disabled
number_slider_10 = Slider(76, range=0..100)  # disabled
xy_plane = XYPlane(Origin=construct_point)  # disabled
xy_plane_2 = XYPlane(Origin=construct_point_2)  # disabled
center_box = CenterBox(Base=xy_plane, X=number_slider_6, Y=number_slider_9, Z=number_slider_10)  # disabled
center_box_2 = CenterBox(Base=xy_plane_2, X=number_slider_5, Y=number_slider_7, Z=number_slider_8)  # disabled
panel = Panel("4")  # disabled
mesh_box = MeshBox(Base=center_box, XCount=panel, YCount=panel, ZCount=panel)  # disabled
mesh_box_2 = MeshBox(Base=center_box_2, XCount=panel, YCount=panel, ZCount=panel)  # disabled
number_slider_11 = Slider(0, range=0..3)  # disabled
number_slider_12 = Slider(0.1, range=0..1)  # disabled
subd_fuse = SubDFuse(SubDA=mesh_box, SubDB=mesh_box_2, BooleanOption=number_slider_11, Smoothing=number_slider_12)  # disabled
custom_preview = CustomPreview(
    Geometry=subd_fuse,
    Material={diffuse=RGB(221, 160, 221), emission=RGB(66, 48, 66), shine=0.5, specular=RGB(255, 255, 255), transparency=0})  # disabled
null_item = NullItem(Item=subd_fuse)  # -> NullFlags, InvalidFlags, Description; disabled
panel_2 = Panel(null_item.NullFlags)  # disabled
subd_from_mesh = SubDFromMesh(Mesh=mesh_box, Creases=1, Corners=1, Interpolate=False)  # disabled
subd_from_mesh_2 = SubDFromMesh(Mesh=mesh_box_2, Creases=1, Corners=1, Interpolate=False)  # disabled
merge = Merge(Data1=subd_from_mesh, Data2=subd_from_mesh_2)  # disabled
stream_filter = StreamFilter(Gate=panel_2, Stream0=subd_fuse, Stream1=merge)  # disabled
custom_preview_2 = CustomPreview(
    Geometry=stream_filter,
    Material={diffuse=RGB(221, 160, 221), emission=RGB(66, 48, 66), shine=0.5, specular=RGB(255, 255, 255), transparency=0})  # disabled

# ----
# PLUGINS CAN BE USED SIMPLY AND CAN BE DELVED INTO ON A MORE ADVANCED LEVEL
# THE KEY IS TO UNDERSTAND HOW THEY WERE CONTRUCTED FROM THE VANILLA RIBBON NODES THAT COME WITH GRASSHOPPER FOR RHINO7
# ONLY THEN WILL YOU BE ABLE TO START PROGRAMMING AND COMPILING YOUR OWN PLUGINS THAT HAVE YET TO BE CREATED FOR THE PARAMETRIC AND COMPUTATIONAL DESIGNER/ARCHITECT AND ENGINEER
# 051_subD_example
mesh_from_subd = MeshFromSubD(Density=2)  # disabled
subd_from_mesh_3 = SubDFromMesh(Creases=1, Corners=1, Interpolate=False)  # disabled
multipipe = MultiPipe(NodeSize=0.5, EndOffset=1, StrutSize=1, Segment=0, KinkAngle=0.6, CubeFit=0, Caps=0)  # disabled
subd_control_polygon = SubDControlPolygon()  # disabled
subd_edges = SubDEdges(NewFormatting=False)  # -> Line, Edge, Tag, Id; disabled
subd_fuse_2 = SubDFuse(BooleanOption=0, Smoothing=10)  # disabled

# ----
# - download mesh edit plugin for these scripts (Mesh credit: Daniel Christev)
number_slider_13 = Slider(40, range=0..100)  # disabled
number_slider_14 = Slider(100, range=0..100)  # disabled
number_slider_15 = Slider(4, range=0..5)  # disabled
range = Range(Domain=number_slider_13, Steps=number_slider_14)  # disabled
sine = Sine(Value=range)  # disabled
multiplication = Multiplication(A=sine, B=number_slider_15)  # disabled
number_slider_16 = Slider(1.679, range=0..5)  # disabled
construct_point_3 = ConstructPoint(XCoordinate=graft(range), YCoordinate=range, ZCoordinate=multiplication)  # disabled
surface_from_points = SurfaceFromPoints(Points=flatten(construct_point_3), UCount=expr("x+1", number_slider_14), Interpolate=False)  # disabled
surface = Surface(surface_from_points)  # disabled
area = Area(Geometry=surface)  # -> Area, Centroid; disabled
dimensions = Dimensions(Surface=surface)  # -> UDimension, VDimension; disabled
number_slider_17 = Slider(5, range=0..20)  # disabled
division = Division(A=dimensions.UDimension, B=dimensions.VDimension)  # disabled
scale = Scale(Geometry=surface, Center=area.Centroid, Factor=number_slider_16)  # -> Geometry, Transform; disabled
md_slider = MDSlider(
    SliderMode=0,
    slider_value=Point(0.5964374077, 0.3989495998, 0.5),
    x_domain=Domain(0, 1),
    y_domain=Domain(0, 1),
    z_domain=Domain(0, 1))  # disabled
multiplication_2 = Multiplication(A=division, B=number_slider_17)  # disabled
integer = Integer(multiplication_2)  # disabled
divide_surface = DivideSurface(Surface=surface, UCount=integer, VCount=number_slider_17)  # -> flatten(Points), Normals, Parameters; disabled
md_slider_2 = MDSlider(
    SliderMode=0,
    slider_value=Point(0.758053798, 0.3364762142, 0.5),
    x_domain=Domain(0, 1),
    y_domain=Domain(0, 1),
    z_domain=Domain(0, 1))  # disabled
number_slider_18 = Slider(0.095, range=0..2)  # disabled
md_slider_3 = MDSlider(
    SliderMode=0,
    slider_value=Point(0.1948275682, 0.7902063509, 0.5),
    x_domain=Domain(0, 1),
    y_domain=Domain(0, 1),
    z_domain=Domain(0, 1))  # disabled
evaluate_surface = EvaluateSurface(Surface=reparameterize(scale.Geometry), Point=[md_slider_3, md_slider, md_slider_2])  # -> Point, Normal, UDirection, VDirection, Frame; disabled
distance = Distance(PointA=graft(evaluate_surface.Point), PointB=divide_surface.Points)  # disabled
point = Point(divide_surface.Points)  # disabled
expression = Expression(w=flatten(number_slider_18), t=distance, Expression="sin(2*w^2*t)")  # disabled
flip_matrix = FlipMatrix(Data=expression)  # disabled
number_slider_19 = Slider(4.657, range=0..10)  # disabled
ma = MassMultiplication(Input=flip_matrix)  # -> flatten(Result), PartialResults; disabled
multiplication_3 = Multiplication(A=number_slider_19, B=ma.Result)  # disabled
unit_z = UnitZ(Factor=multiplication_3)  # disabled
move = Move(Geometry=divide_surface.Points, Motion=unit_z)  # -> Geometry, Transform; disabled
expression_2 = Expression(u=integer, Expression="u+1")  # disabled
mesh_frompoints = MeshFromPoints(Points=move.Geometry, UDirection=expr("x+1", integer), VDirection=expr("x+1", number_slider_17))  # disabled
surface_from_points_2 = SurfaceFromPoints(Points=move.Geometry, UCount=expression_2, Interpolate=False)  # disabled

# ----
# Great Tutorial: How to Rhino
# 
# https://www.youtube.com/watch?v=G1axZyqURwI
mesh = Mesh(mesh_frompoints)  # disabled
number_slider_20 = Slider(1, range=1..2)  # disabled
number_slider_21 = Slider(1, range=1..2)  # disabled
boolean_toggle = BooleanToggle(False)  # disabled
weld_mesh = WeldMesh(Mesh=mesh, Angle=3.141592654)  # disabled
subd_from_mesh_4 = SubDFromMesh(Mesh=mesh, Creases=number_slider_20, Corners=number_slider_21, Interpolate=boolean_toggle)  # disabled
nakedvertices = NakedVertices(Mesh=weld_mesh)  # -> ClothedIndex, NakedIndex, ClothedPts, NakedPts; disabled
subd_edges_2 = SubDEdges(SubD=subd_from_mesh_4, NewFormatting=False)  # -> Line, Edge, Tag, Id; disabled
point_2 = Point(nakedvertices.NakedPts)  # disabled
panel_3 = Panel(subd_edges_2.Tag)  # disabled
curve = Curve(subd_edges_2.Line)  # disabled
curve_2 = Curve(subd_edges_2.Edge)  # disabled
panel_4 = Panel("*crease*")  # disabled
panel_5 = Panel("*smooth*")  # disabled
panel_6 = Panel("*naked*")  # disabled
panel_7 = Panel("*interior*")  # disabled
match_text = MatchText(Text=panel_3, Pattern=panel_4, Case=True)  # disabled
panel_8 = Panel(match_text)  # disabled
cull_pattern = CullPattern(List=curve_2, CullPattern=match_text)  # disabled
join_curves = JoinCurves(Curves=cull_pattern, Preserve=False)  # disabled
panel_9 = Panel(cull_pattern)  # disabled
pipe = Pipe(Curve=join_curves, Radius=1, Caps=0)  # disabled
custom_preview_3 = CustomPreview(
    Geometry=pipe,
    Material={diffuse=RGB(221, 160, 221), emission=RGB(66, 48, 66), shine=0.5, specular=RGB(255, 255, 255), transparency=0})  # disabled

number_slider_22 = Slider(3, range=0..4)  # disabled
subd = SubD(subd_from_mesh_4)  # disabled
mesh_from_subd_2 = MeshFromSubD(SubD=subd, Density=number_slider_22)  # disabled
mesh_from_subd_3 = ValueList({"One": 0, "Two": 1}, selected="One")  # disabled
mesh_edges = MeshEdges(Mesh=mesh_from_subd_2)  # -> NakedEdges, InteriorEdges, NonManifoldEdges; disabled
face_boundaries = FaceBoundaries(Mesh=mesh_from_subd_2)  # disabled
subd_control_polygon_2 = SubDControlPolygon(SubD=mesh_from_subd_2)  # disabled
discontinuity = Discontinuity(Curve=face_boundaries, Level=1)  # -> Points, Parameters; disabled
stream_filter_2 = StreamFilter(Gate=mesh_from_subd_3, Stream0=mesh_from_subd_2, Stream1=subd_control_polygon_2)  # disabled
custom_preview_4 = CustomPreview(
    Geometry=stream_filter_2,
    Material={diffuse=RGB(221, 160, 221), emission=RGB(66, 48, 66), shine=0.5, specular=RGB(255, 255, 255), transparency=0})  # disabled
list_item = ListItem(List=discontinuity.Points, Index=0, Wrap=True)  # -> Item, Item1, Item2, Item3; disabled
number_slider_23 = Slider(4, range=0..10)  # disabled
line = Line(StartPoint=list_item.Item, EndPoint=list_item.Item2)  # disabled
line_2 = Line(StartPoint=list_item.Item1, EndPoint=list_item.Item3)  # disabled
divide_curve = DivideCurve(Curve=line_2, Count=number_slider_23, Kinks=False)  # -> Points, Tangents, Parameters; disabled
divide_curve_2 = DivideCurve(Curve=line, Count=number_slider_23, Kinks=False)  # -> Points, Tangents, Parameters; disabled
interpolate = Interpolate(Vertices=divide_curve.Points, Degree=3, Periodic=False, KnotStyle=1)  # -> Curve, Length, Domain; disabled
interpolate_2 = Interpolate(Vertices=divide_curve_2.Points, Degree=3, Periodic=False, KnotStyle=1)  # -> Curve, Length, Domain; disabled
curve_curve = CurveCurve(CurveA=interpolate_2.Curve, CurveB=interpolate.Curve)  # -> Points, ParamsA, ParamsB; disabled
curve_3 = Curve(mesh_edges.NakedEdges)  # disabled
shatter = Shatter(Curve=interpolate_2.Curve, Parameters=curve_curve.ParamsA)  # disabled
shatter_2 = Shatter(Curve=interpolate.Curve, Parameters=curve_curve.ParamsB)  # disabled
merge_2 = Merge(Data1=shatter, Data2=shatter_2)  # -> flatten(Result); disabled
end_points = EndPoints(Curve=merge_2)  # -> Start, End; disabled
line_3 = Line(StartPoint=end_points.Start, EndPoint=end_points.End)  # disabled
merge_3 = Merge(Data1=curve_3, Data2=line_3)  # -> flatten(Result); disabled
number_slider_24 = Slider(0.333, range=0..1)  # disabled
weaverbird_s_mesh_from_lines_weave_back = WeaverbirdsMeshFromLinesWeaveBack(Lines=merge_3, MaximumValence=4)  # disabled
number_slider_25 = Slider(0.167, range=0..1)  # disabled
number_slider_26 = Slider(10, range=0..10)  # disabled
weaverbird_s_stellate_cumulation = WeaverbirdsStellateCumulation(MeshPolylines=weaverbird_s_mesh_from_lines_weave_back, Distance=number_slider_24)  # disabled
unit_z_2 = UnitZ(Factor=number_slider_25)  # disabled
weaverbird_s_picture_frame = WeaverbirdsPictureFrame(MeshPolylines=weaverbird_s_stellate_cumulation, Distance=number_slider_26, InsetType=0)  # disabled
negative = Negative(Value=unit_z_2)  # disabled
weaverbird_s_mesh_thicken = WeaverbirdsMeshThicken(MeshCurves=weaverbird_s_picture_frame, Distance=negative, OffsetType=0)  # disabled
number_slider_27 = Slider(2, range=1..3)  # disabled
weaverbird_s_catmull_clark_subdivision = WeaverbirdsCatmullClarkSubdivision(MeshCurves=weaverbird_s_mesh_thicken, Level=number_slider_27, SmoothNakedEdges=1)  # disabled

number_slider_28 = Slider(1, range=0..1)  # disabled
multipipe_2 = MultiPipe(Curves=curve, NodeSize=number_slider_28, EndOffset=1, StrutSize=1, Segment=0, KinkAngle=0.6, CubeFit=0, Caps=0)  # disabled
