# Grasshopper definition EX_054_plugins_fireflyPart2.gh (Grasshopper 1.0.7)
# plug-ins: Firefly.X, Bifocals, FologramForGrasshopper

number_slider = Slider(0.02, range=0..0.1)  # disabled
boolean_toggle = BooleanToggle(True)  # disabled
number_slider_2 = Slider(68, range=0..100)  # disabled
number_slider_3 = Slider(15, range=0..100)  # disabled
number_slider_4 = Slider(4, range=0..100)  # disabled
sound_capture = SoundCapture(TimePeriod=number_slider, StartStopSoundCapture=boolean_toggle)  # -> WavePressureSamplesFromLeftChannel, WavePressureSamplesFromRightChannel, Volume; disabled
number_slider_5 = Slider(65, range=0..100)  # disabled
center_box = CenterBox(Base=PlaneXY(0, 0, 0), X=number_slider_2, Y=number_slider_2, Z=number_slider_2)  # disabled
webcam_video_stream = WebCamVideoStream()  # disabled
timer = Timer(Interval=20, TimerInterval=20, Target=sound_capture)  # disabled
number_slider_6 = Slider(2, range=0..100)  # disabled
number_slider_7 = Slider(0, range=0..100)  # disabled
number_slider_8 = Slider(4, range=0..100)  # disabled
populate_3d = Populate3D(Region=center_box, Count=number_slider_4, Seed=number_slider_3)  # disabled
populate_3d_2 = Populate3D(Region=center_box, Count=number_slider_4, Seed=1)  # disabled
number_slider_9 = Slider(0.528, range=0.02..2)  # disabled
number_slider_10 = Slider(3, range=0..100)  # disabled
center_box_2 = CenterBox(Base=PlaneXY(0, 0, 0), X=number_slider_5, Y=number_slider_5, Z=number_slider_5)  # disabled
color_correction = ColorCorrection(
    BitmapToModify=webcam_video_stream,
    AlphaMultiplier=1,
    RedMultiplier=number_slider_7,
    GreenMultiplier=number_slider_8,
    BlueMultiplier=number_slider_6)  # disabled
data_recorder = DataRecorder(sound_capture.Volume, DataLimit=12, RecordData=True)  # disabled
nurbs_curve = NurbsCurve(Vertices=populate_3d, Degree=3, Periodic=False)  # -> Curve, Length, Domain; disabled
nurbs_curve_2 = NurbsCurve(Vertices=populate_3d_2, Degree=3, Periodic=False)  # -> Curve, Length, Domain; disabled
multiplication = Multiplication(A=data_recorder, B=number_slider_9)  # disabled
populate_3d_3 = Populate3D(Region=center_box_2, Count=number_slider_10, Seed=multiplication)  # disabled
video_averages = VideoAverages(BitmapToModify=color_correction, MinimumPointOfBoundingArea=Point(0, 0, 0), MaximumPointOfBoundingArea=Point(1, 1, 0))  # -> AverageColor, AverageMovementVector, CentroidOfMovement, CentroidOfRedPixels, CentroidOfGreenPixels, CentroidOfBluePixels; disabled
number_slider_11 = Slider(88, range=0..100)  # disabled
gene_pool = GenePool(Decimals=3, Maximum=1, Minimum=0, Value=[0, 0.113, 0.317, 0.437, 0.549, 0.62, 0.682, 0.739, 0.803, 0.851, 0.957, 1])  # disabled
proximity_3d = Proximity3D(Points=populate_3d_3, Group=5)  # -> Links, Topology; disabled
create_material = CreateMaterial(Diffuse=video_averages.AverageColor, Specular=RGB(255, 255, 255), Emission=RGB(0, 0, 0), Transparency=0, Shine=0)  # disabled
nurbs_curve_3 = NurbsCurve(
    Vertices=[video_averages.CentroidOfRedPixels, video_averages.CentroidOfGreenPixels, video_averages.CentroidOfBluePixels, video_averages.AverageColor, video_averages.AverageMovementVector, video_averages.CentroidOfMovement],
    Degree=3,
    Periodic=False)  # -> reparameterize(Curve), Length, Domain; disabled
scale = Scale(Geometry=nurbs_curve_3.Curve, Center=Point(0, 0, 0), Factor=number_slider_11)  # -> Geometry, Transform; disabled
pipe_variable = PipeVariable(Curve=scale.Geometry, Parameters=gene_pool, Radii=multiplication, Caps=2)  # disabled
colour_rgb = ColourRGB(Alpha=255, Red=0, Green=0, Blue=0)  # disabled
custom_preview = CustomPreview(Geometry=pipe_variable, Material=create_material)  # disabled
sync_object = SyncObject(
    GM=pipe_variable,
    AlwaysIncludeTextureCoordinates=False,
    Clickable=False,
    DefaultCurveThicknessMillimeters=2.5,
    DefaultGlossPercent=0,
    DefaultMaterialColor=RGB(0, 255, 255),
    DefaultSpecularPercent=0,
    Grabbable=False,
    Interactive=False,
    Occlusion=False,
    Outline=False,
    hasSerializedData=True)  # disabled
