# Grasshopper definition MGSM_exercises_Section_003_Plugins.gh (Grasshopper 1.0.7)
# plug-ins: MeshEdit Components, MarchingCubes, Kangaroo2 Components, LunchBox, LunchBoxML, Human, PTComponentLibrary, Pufferfish, Anemone, Weaverbird

# ---- group: LBML_NonlinearRegression-CurvePlot / Sample Points
pt = Point([Point(25.0973048, 20.94949138, 0), Point(26.33156766, 20.61724581, 0), Point(30.5683667, 18.61734927, 0), Point(29.70665446, 19.958941, 0), Point(33.87801945, 19.41892409, 0), Point(35.13680678, 17.85952601, 0)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])  # disabled
swatch = ColourSwatch(SwatchColor=RGB(255, 0, 115))  # disabled
pdecon = Deconstruct(Point=pt)  # -> graft(XComponent), YComponent, ZComponent; disabled
preview = CustomPreview(Geometry=pt, Shader=swatch)  # disabled

# ---- group: LBML_NonlinearRegression-SurfacePlot / Sample Points
number_slider = Slider(34, range=0..50)  # disabled
panel = Panel("0 to 30")  # disabled
panel_2 = Panel("0 to 5")  # disabled
panel_3 = Panel("5")  # disabled
panel_4 = Panel("10")  # disabled
panel_5 = Panel("8")  # disabled
random = Random(Range=panel_2, Number=number_slider, Seed=panel_4)  # disabled
random_2 = Random(Range=panel, Number=number_slider, Seed=panel_5)  # disabled
random_3 = Random(Range=panel, Number=number_slider, Seed=panel_3)  # disabled
pt_2 = ConstructPoint(XCoordinate=random_3, YCoordinate=random_2, ZCoordinate=random)  # disabled
entwine = Entwine(Branch00=random_3, Branch01=random_2, FlattenInputs=True)  # disabled
number_slider_2 = Slider(0.227, range=0..1)  # disabled
swatch_2 = ColourSwatch(SwatchColor=RGB(255, 0, 115))  # disabled
flip = FlipMatrix(Data=entwine)  # disabled
dots = DotDisplay(Point=pt_2, Colour=swatch_2, Size=number_slider_2)  # disabled

# ---- group: LBML_LinearRegression-LinePlot / Input points
# Meshedit is a set of components which
#  extend Grasshopper's ability to work with
#  meshes.
# Hal/Kuka/Robotics/tocoABB
# KUKA|prc enables you to program
#  industrial
#  robots directly out of the parametric
#  modelling environment, including a full
#  kinematic simulation of the robot. The
#  generated files can be executed at the
#  KUKA robot, without requiring any additional
#  software.
# fologram
# Use Fologram to view and share Rhino and
# Grasshopper instantly in mixed reality on
# HoloLens 1, HoloLens 2, Oculus Quest, iOS
#  and Android. Geometry, layers and
# grasshopper parameters can be edited in
# real time in Fologram to create powerful
# tools for design, communication,
# collaboration and fabrication.
# ghpython remote
# GH Python Remote is a special component
#  that lets you use regular Python code
#  directly in the GHPython component, like
#  importing Numpy, Scipy, matlplotib et al.
# 
# C#
pt_3 = Point([Point(48.85484087, 42.93944115, 0), Point(47.54230675, 39.26946931, 0), Point(46.48351837, 36.27833523, 0), Point(17.5074815, 13.16084453, 0), Point(31.61152177, 22.39151598, 0), Point(36.3971641, 22.07227592, 0)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])  # disabled
# Elk is a set of tools to generate map and
#  topographical surfaces using open source
#  data from OpenStreetMap.org and USGS.
# Multivariate Linear Regression - 3D Line Plot
# Version:  2017.07.27
swatch_3 = ColourSwatch(SwatchColor=RGB(223, 220, 115))  # disabled
pdecon_2 = Deconstruct(Point=pt_3)  # -> XComponent, YComponent, ZComponent; disabled
preview_2 = CustomPreview(Geometry=pt_3, Shader=swatch_3)  # disabled

# ---- group: LBML_MultivariateLinearRegression / Sample Data
# Company Info: Authored by Proving Ground
# 
# http://ProvingGround.io
# Copyright (c) 2017 Proving Ground LLC
# Firefly offers a set of software tools
#  dedicated to bridging the gap between
#  Grasshopper (a free plug-in for Rhino) and
#  micro-controllers like the Arduino. It allows
#  near real-time data flow between the digital
#  and physical worlds – enabling the possibility
#  to explore virtual and physical prototypes
#  with unprecedented fluidity.
pt_4 = Point([Point(1.351036543, 3.971966414, -8.539178762), Point(1.230609394, 8.840402651, -6.562385308), Point(3.995575449, 4.68975127, -8.247727393), Point(10.00861558, 18.09229774, -2.805719973), Point(18.62721199, 5.908814564, -7.752735527), Point(20.1565894, 17.80562482, -2.922121448)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])  # disabled
swatch_4 = ColourSwatch(SwatchColor=RGB(254, 109, 115))  # disabled
pdecon_3 = Deconstruct(Point=pt_4)  # -> XComponent, YComponent, ZComponent; disabled
preview_3 = CustomPreview(Geometry=pt_4, Shader=swatch_4)  # disabled
entwine_2 = Entwine(Branch00=pdecon_3.YComponent, Branch01=pdecon_3.ZComponent, FlattenInputs=True)  # disabled
flip_2 = FlipMatrix(Data=entwine_2)  # disabled

# ---- group: LBML_NonlinearRegression-CurvePlot
# Nonlinear Regression
# Version:  2017.7.23
# Company Info: Authored by Proving Ground
# 
# http://ProvingGround.io
# Copyright (c) 2017 Proving Ground LLC
number_slider_3 = Slider(57, range=0..100)  # disabled
number_slider_4 = Slider(17, range=0..50)  # disabled

# ---- group: LBML_NonlinearRegression-SurfacePlot / Test Points
number_slider_5 = Slider(16, range=0..50)  # disabled
range = Range(Domain=panel, Steps=number_slider_5)  # disabled
range_2 = Range(Domain=panel, Steps=number_slider_5)  # disabled
crossref = CrossReference(ListA=range_2, ListB=range, CrossMode=1)  # -> ListA, ListB; disabled
entwine_3 = Entwine(Branch00=crossref.ListA, Branch01=crossref.ListB, FlattenInputs=True)  # disabled
flip_3 = FlipMatrix(Data=entwine_3)  # disabled

# ---- group: LBML_LinearRegression-LinePlot / X Test
series = Series(Start=0, Step=5, Count=10)  # disabled

# ---- group: LBML_NonlinearRegression-CurvePlot / Test X Value
series_2 = Series(Start=0, Step=2, Count=25)  # -> graft(Series); disabled

# ---- group: LBML_MultivariateLinearRegression / Test Data
series_3 = Series(Start=0, Step=5, Count=10)  # disabled

# ---- group: LBML_LinearRegression-LinePlot
# Linear Regression
# Version:  2017/07/21
# Company Info: Authored by Proving Ground
# 
# http://ProvingGround.io
# Copyright (c) 2017 Proving Ground LLC
linereg = LinearRegression(TestData=series, Inputs=pdecon_2.XComponent, Output=pdecon_2.YComponent, RandomSeed=5)  # disabled

# ---- group: LBML_NonlinearRegression-CurvePlot / Nonlinear Solver
seqminreg = SequentialMinimalOptimizationRegression(
    TestData=series_2,
    Inputs=pdecon.XComponent,
    Output=pdecon.YComponent,
    Degree=number_slider_4,
    Complexity=number_slider_3,
    RandomSeed=5)  # -> Result, Score, Error; disabled

# ---- group: LBML_MultivariateLinearRegression / Multivariate Linerar Regression
multilinereg = MultivariateLinearRegression(TestData=graft(series_3), Inputs=graft(pdecon_3.XComponent), Output=flip_2, RandomSeed=5)  # disabled

# ---- group: LBML_LinearRegression-LinePlot / LIne Plot
pt_5 = ConstructPoint(XCoordinate=series, YCoordinate=linereg, ZCoordinate=0)  # disabled
number_slider_6 = Slider(10, range=0..10)  # disabled
pline = PolyLine(Vertices=pt_5, Closed=False)  # disabled
swatch_5 = ColourSwatch(SwatchColor=RGB(44, 252, 255))  # disabled
previewlw = CustomPreviewLineweights(Geometry=pline, Shader=swatch_5, Thickness=number_slider_6, Absolute=False)  # disabled

# ---- group: LBML_NonlinearRegression-CurvePlot / Fit Curve
pt_6 = ConstructPoint(XCoordinate=flatten(series_2), YCoordinate=flatten(seqminreg.Result), ZCoordinate=0)  # disabled
number_slider_7 = Slider(4, range=0..5)  # disabled
swatch_6 = ColourSwatch(SwatchColor=RGB(255, 255, 255))  # disabled
intcrv = Interpolate(Vertices=pt_6, Degree=3, Periodic=False, KnotStyle=1)  # -> Curve, Length, Domain; disabled
previewlw_2 = CustomPreviewLineweights(Geometry=intcrv.Curve, Shader=swatch_6, Thickness=number_slider_7, Absolute=False)  # disabled

# ---- group: LBML_MultivariateLinearRegression / Curve Plot
flip_4 = FlipMatrix(Data=multilinereg)  # disabled
panel_6 = Panel("{1}")  # disabled
panel_7 = Panel("{0}")  # disabled
branch = TreeBranch(Tree=flip_4, Path=panel_6, MaintainPaths=True)  # disabled
branch_2 = TreeBranch(Tree=flip_4, Path=panel_7, MaintainPaths=True)  # disabled
pt_7 = ConstructPoint(XCoordinate=series_3, YCoordinate=branch_2, ZCoordinate=branch)  # disabled
pline_2 = PolyLine(Vertices=pt_7, Closed=False)  # disabled
number_slider_8 = Slider(4, range=0..10)  # disabled
swatch_7 = ColourSwatch(SwatchColor=RGB(0, 185, 255))  # disabled
previewlw_3 = CustomPreviewLineweights(Geometry=pline_2, Shader=swatch_7, Thickness=number_slider_8, Absolute=False)  # disabled

# ---- group: LBML_NonlinearRegression-SurfacePlot
# Nonlinear Regression
# Version:  2017.7.27
# Company Info: Authored by Proving Ground
# 
# http://ProvingGround.io
# Copyright (c) 2017 Proving Ground LLC
sigma = Slider(1.761, range=0..50)  # disabled
nonlinereg = NonlinearRegression(TestData=flip_3, Inputs=flip, Output=random, Degree=sigma, Complexity=100, RandomSeed=5)  # -> Result, Score, Error; disabled

# ---- group: LBML_NonlinearRegression-SurfacePlot / Prediction Points
pt_8 = ConstructPoint(XCoordinate=crossref.ListA, YCoordinate=crossref.ListB, ZCoordinate=flatten(nonlinereg.Result))  # disabled
swatch_8 = ColourSwatch(SwatchColor=RGB(9, 176, 255))  # disabled
preview_4 = CustomPreview(Geometry=pt_8, Shader=swatch_8)  # disabled

# ----
# Display
# 
# - icons, wires, names
# - (consider Bifocals plugin)
# - selected only preview
# - plane size
# - mesh edges
# - gumball
# - canvas widgets
# (Markov, profiler, message balloons)
# View
# 
# - obscure components
# - zoom options on canvas
# PanelingTools for Rhino and Grasshopper
#  by Robert McNeel & Associates is widely
#  used by designers, architects, and building
#  professionals. It supports intuitive design of
#  paneling concepts as well as help
#  rationalize complex geometry into a format
#  that is suitable for analysis and fabrication.
# 043_Paneling_Tools_Rjaa_Issa
# - check out the work of Rajaa Issa at:
# https://wiki.mcneel.com/rhino/home/essentialmathematics
# https://vimeo.com/474292031
number_slider_9 = Slider(26, range=0..100)  # disabled
number_slider_10 = Slider(99, range=0..100)  # disabled
range_3 = Range(Domain=number_slider_9, Steps=number_slider_10)  # disabled
number_slider_11 = Slider(1, range=0..1)  # disabled
number_slider_12 = Slider(11, range=0..100)  # disabled
# Solution
# 
# - disable solver
# - scroll button/spacebar
# (cluster/group/preview/enable/solver/
# bake/zoom/find/preferences)
# Panelling Tools
# Curve
# Grid
# Grid Attractors
# Grid Utility
# Panel 2D
# Panel 3D
# Panel Utility
# Param
sine = Sine(Value=range_3)  # disabled
multiplication = Multiplication(A=sine, B=number_slider_11)  # disabled
# Help
# 
# - tutorials
# - online forums
# - node references
addition = Addition(A=multiplication, B=number_slider_12)  # disabled
construct_point = ConstructPoint(XCoordinate=addition, YCoordinate=0, ZCoordinate=range_3)  # disabled
construct_point_2 = ConstructPoint(XCoordinate=0, YCoordinate=0, ZCoordinate=0)  # disabled
number_slider_13 = Slider(6, range=0..100)  # disabled
number_slider_14 = Slider(6, range=0..100)  # disabled
interpolate = Interpolate(Vertices=construct_point, Degree=3, Periodic=False, KnotStyle=1)  # -> Curve, Length, Domain; disabled
line_sdl = LineSDL(Start=construct_point_2, Direction=Vector(0, 0, 1), Length=1)  # disabled
revolution = Revolution(Curve=interpolate.Curve, Axis=line_sdl, Domain=Domain(0, 6.283185307))  # disabled
number_slider_15 = Slider(2, range=0..10)  # disabled
surface_domain_number = SurfaceDomainNumber(Surface=revolution, UNumber=number_slider_14, VNumber=number_slider_13)  # disabled
curve_attraction = CurveAttraction(Grid=surface_domain_number, CrvAtts=line_sdl, Magnitude=number_slider_15)  # -> Grid, Weights; disabled
cellulate = Cellulate(Grid=curve_attraction.Grid)  # -> flatten(Wires), Cells, Meshes; disabled
cellulate_2 = Cellulate(Grid=curve_attraction.Grid)  # -> flatten(Wires), Cells, Meshes; disabled
join_curves = JoinCurves(Curves=cellulate.Wires, Preserve=False)  # disabled
join_curves_2 = JoinCurves(Curves=cellulate_2.Wires, Preserve=False)  # disabled
control_points = ControlPoints(Curve=join_curves)  # -> Points, Weights, Knots; disabled
control_points_2 = ControlPoints(Curve=join_curves_2)  # -> Points, Weights, Knots; disabled
interpolate_2 = Interpolate(Vertices=control_points_2.Points, Degree=3, Periodic=False, KnotStyle=1)  # -> Curve, Length, Domain; disabled
interpolate_3 = Interpolate(Vertices=control_points.Points, Degree=3, Periodic=False, KnotStyle=1)  # -> Curve, Length, Domain; disabled
join_curves_3 = JoinCurves(Curves=flatten([interpolate_3.Curve, interpolate_2.Curve]), Preserve=False)  # disabled
multipipe = MultiPipe(Curves=join_curves_3, NodeSize=0.5, EndOffset=1, StrutSize=1, Segment=0, KinkAngle=0.6, CubeFit=0, Caps=0)  # disabled

number_slider_16 = Slider(1000, range=0..1000)  # disabled
curve = Curve(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)  # disabled
boolean_toggle = BooleanToggle(True)  # disabled
divide_curve = DivideCurve(Curve=curve, Count=number_slider_16, Kinks=False)  # -> Points, Tangents, Parameters; disabled
polyline = PolyLine(Vertices=divide_curve.Points, Closed=boolean_toggle)  # disabled
curve_2 = Curve(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)  # disabled
explode = Explode(Curve=polyline, Recursive=True)  # -> Segments, Vertices; disabled
mesh = Mesh(curve_2)  # disabled
number_slider_17 = Slider(11.09, range=1..20)  # disabled
length = Length(Curve=explode.Segments)  # disabled
average = Average(Input=length)  # disabled
number_slider_18 = Slider(0.99, range=0..10)  # disabled
onmesh = OnMesh(Points=divide_curve.Points, Mesh=mesh, Strength=1)  # disabled
multiplication_2 = Multiplication(A=average, B=number_slider_17)  # disabled
length_line = LengthLine(Line=explode.Segments, Length=multiplication_2, Strength=10)  # disabled
spherecollide = SphereCollide(Points=divide_curve.Points, Radius=number_slider_17, Strength=number_slider_18)  # disabled
boolean_toggle_2 = BooleanToggle(True)  # disabled
button = Button()  # disabled
solver = Solver(GoalObjects=[length_line, spherecollide, onmesh], Reset=button, Threshold=1e-15, Tolerance=0.0001, On=boolean_toggle_2)  # -> I, V, O; disabled
boolean_toggle_3 = BooleanToggle(True)  # disabled
boolean_toggle_4 = BooleanToggle(True)  # disabled
polyline_2 = PolyLine(Vertices=solver.V, Closed=boolean_toggle_3)  # disabled
panel_8 = Panel("2000")  # disabled
panel_9 = Panel("3")  # disabled
rebuild_curve = RebuildCurve(Curve=polyline_2, Count=panel_8, Degree=panel_9, EndTangents=boolean_toggle_4)  # disabled

number_slider_19 = Slider(1000, range=0..1000)  # disabled
curve_3 = Curve(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)  # disabled
divide_curve_2 = DivideCurve(Curve=curve_3, Count=number_slider_19, Kinks=False)  # -> Points, Tangents, Parameters; disabled

# ----
# 044_Kangaroo_cellular_growth
number_slider_20 = Slider(500, range=0..1000)  # disabled
curve_4 = Curve(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)  # disabled
boolean_toggle_5 = BooleanToggle(True)  # disabled
divide_curve_3 = DivideCurve(Curve=curve_4, Count=number_slider_20, Kinks=False)  # -> Points, Tangents, Parameters; disabled
polyline_3 = PolyLine(Vertices=divide_curve_3.Points, Closed=boolean_toggle_5)  # disabled
explode_2 = Explode(Curve=polyline_3, Recursive=True)  # -> Segments, Vertices; disabled
number_slider_21 = Slider(5.64, range=1..10)  # disabled
length_2 = Length(Curve=explode_2.Segments)  # disabled
average_2 = Average(Input=length_2)  # disabled
number_slider_22 = Slider(3.31, range=0..10)  # disabled
multiplication_3 = Multiplication(A=average_2, B=number_slider_21)  # disabled
length_line_2 = LengthLine(Line=explode_2.Segments, Length=multiplication_3, Strength=10)  # disabled
spherecollide_2 = SphereCollide(Points=divide_curve_3.Points, Radius=number_slider_21, Strength=number_slider_22)  # disabled
boolean_toggle_6 = BooleanToggle(True)  # disabled
button_2 = Button()  # disabled
solver_2 = Solver(GoalObjects=[length_line_2, spherecollide_2], Reset=button_2, Threshold=1e-15, Tolerance=0.0001, On=boolean_toggle_6)  # -> I, V, O; disabled
boolean_toggle_7 = BooleanToggle(True)  # disabled
polyline_4 = PolyLine(Vertices=solver_2.V, Closed=boolean_toggle_7)  # disabled

boolean_toggle_8 = BooleanToggle(True)  # disabled
polyline_5 = PolyLine(Vertices=divide_curve_2.Points, Closed=boolean_toggle_8)  # disabled
explode_3 = Explode(Curve=polyline_5, Recursive=True)  # -> Segments, Vertices; disabled

# ----
# Cellular Growth with Kangaroo
# Kangaroo is a Live Physics engine for
# interactive simulation, form-finding,
#  optimization and constraint solving.
# Gediminas Kirdeikis has a great overview
# in stand alone grasshopper with the Kangaroo plugin
# - this script/video summarizes the
# 6 hour, complete, detailed C# scripting series by Long Nguyen
# https://www.youtube.com/watch?v=viEpaivq9A0&t=607s
solver_3 = Solver(Reset=False, Threshold=1e-15, Tolerance=0.0001, On=True)  # -> I, V, O; disabled

# ----
# 009_Mesh
# Tiangulation
# Primitive
# Analysis
# Utilities
mesh_area = MeshArea()  # -> Area, Centroid; disabled
mesh_edges = MeshEdges()  # -> NakedEdges, InteriorEdges, NonManifoldEdges; disabled
mesh_convertquads = MeshConvertQuads(ShortDiagonal=True)  # -> Mesh, Split; disabled
mesh_triangulate = MeshTriangulate(ShortDiagonal=True)  # disabled
mesh_eval = MeshEval()  # -> Point, Normal, Colour; disabled
mesh_closest_point = MeshClosestPoint()  # -> Point, Index, Parameter; disabled
# Metaball - Cocoon - Voronoi - Weaverbird - Octree - SubD
# 
# https://www.cs.cmu.edu/afs/cs.cmu.edu/academic/class/15394u-s20/lectures/weaverbird/weaverbird.html
# Weaverbird
# Weaverbird is a topological mesh editor
#  where it allows both Rhino and
# Grasshopper used to do mesh editing,
# subdivisions, and mesh transformations. In
#  other words, Weaverbird can make some
# nice looking mesh 'skins' of your model with
# fewer and less complicated scripts. This
# plug-in is able to reconstruct the shape of
# the model and subdivisions of any mesh
# (including ones made with polylines).
face_normals = FaceNormals()  # -> Centers, Normals; disabled
mesh_nakededge = MeshNakedEdge()  # -> V, A, B; disabled
mesh_volume = MeshVolume()  # -> Volume, Centroid; disabled
face_boundaries = FaceBoundaries()  # disabled
mesh_explode = MeshExplode(Interpolate=False)  # disabled
deconstruct_mesh = DeconstructMesh()  # -> Vertices, Faces, Colours, Normals; disabled
deconstruct_face = DeconstructFace()  # -> CornerA, CornerB, CornerC, CornerD; disabled
mesh_inclusion = MeshInclusion(Strict=False)  # disabled
mesh_quad = MeshQuad(CornerA=0, CornerB=1, CornerC=2, CornerD=3)  # disabled
mesh_plane = MeshPlane(Boundary={Plane=PlaneXY(0, 0, 0), Size=Domain2(u=-10..10, v=-10..10)}, WidthCount=10, HeightCount=10)  # -> Mesh, Area; disabled
mesh_sphere = MeshSphere(Base=PlaneXY(0, 0, 0), Radius=10, UCount=10, VCount=20)  # disabled
mesh_box = MeshBox(Base={Plane=PlaneXY(0, 0, 0), X=Domain(-10, 10), Y=Domain(-10, 10), Z=Domain(-10, 10)}, XCount=10, YCount=10, ZCount=10)  # disabled
construct_mesh = ConstructMesh(Vertices=[Point(0, 0, 0), Point(10, 0, 0), Point(10, 10, 0), Point(0, 10, 0)], Faces={A=0, B=1, C=2, D=3})  # disabled
mesh_sphere_ex = MeshSphereEx(Base=PlaneXY(0, 0, 0), Radius=10, Count=5)  # disabled
mesh_triangle = MeshTriangle(CornerA=0, CornerB=1, CornerC=2)  # disabled
mesh_colours = MeshColours(Colours=[RGB(127, 255, 0), RGB(0, 100, 0), RGB(34, 139, 34), RGB(124, 252, 0), RGB(154, 205, 50), RGB(173, 255, 47), RGB(50, 205, 50), RGB(152, 251, 152)])  # disabled
mesh_spray = MeshSpray(SprayMode=11)  # disabled
metaball = MetaBall(Plane=PlaneXY(0, 0, 0))  # disabled
voronoi = Voronoi(BruteForceOverride=False)  # disabled
delaunay_edges = DelaunayEdges(Plane=PlaneXY(0, 0, 0))  # -> Connectivity, Edges; disabled
delaunay_mesh = DelaunayMesh(Plane=PlaneXY(0, 0, 0))  # disabled
octree = OcTree(Square=False, Group=5)  # -> Boxes, Points; disabled
metaball_t = MetaBallT(Plane=PlaneXY(0, 0, 0), Threshold=0.5)  # disabled
voronoi_3d = Voronoi3D()  # -> Cells, Boundary; disabled
metaball_t_custom = MetaBallTCustom(Plane=PlaneXY(0, 0, 0), Threshold=0.5)  # disabled
convex_hull = ConvexHull(Plane=PlaneXY(0, 0, 0))  # -> Hull, HullZ, Indices; disabled
delete_faces = DeleteFaces()  # disabled
mesh_surface = MeshSurface(UCount=5, VCount=5, Overhang=True, Equalize=False)  # disabled
cull_faces = CullFaces()  # disabled
mesh_brep = MeshBrep(Settings={GridMaxCount=0, GridMinCount=16, JaggedSeams=False, MaxEdgeLength=0, MinEdgeLength=0.0001, MinTolerance=0, Refine=True, RefineAngle=0, RelativeTolerance=0.65, SimplePlanes=True, Tolerance=0})  # disabled
unweld_mesh = UnweldMesh(Angle=1.570796327)  # disabled
mesh_shadow = MeshShadow(Light=Vector(0, 0, -1), Plane=PlaneXY(0, 0, 0))  # disabled
mesh_join = MeshJoin()  # disabled
delete_vertices = DeleteVertices(Shrink=True)  # disabled
cull_vertices = CullVertices(Shrink=True)  # disabled
weld_mesh = WeldMesh(Angle=3.141592654)  # disabled
flip_mesh = FlipMesh(VertexNormals=True, FaceNormals=True, FaceOrientation=True)  # disabled
mesh_weldvertices = MeshWeldVertices(Tolerance=0.01)  # -> RuntimeMessage, Mesh; disabled
mesh_frompoints = MeshFromPoints()  # disabled
occlusion = Occlusion()  # -> Hits, Occlusion; disabled
simple_mesh = SimpleMesh()  # disabled
mesh_unifynormals = MeshUnifyNormals()  # disabled
quadrangulate = Quadrangulate(Angle=0.03490658504, Ratio=0.875)  # -> Mesh, Count; disabled
triangulate = Triangulate()  # -> Mesh, Count; disabled
mesh_flip = MeshFlip()  # disabled

# ----
# 046_metaball_example
# - Parametric House makes use of genepool in
# metaball(t) custom
# - control points with charge and slicing
metaball_t_2 = MetaBallT(Plane=PlaneXY(0, 0, 0), Threshold=0.5)  # disabled
number_slider_23 = Slider(2, range=-12..12)  # disabled
panel_10 = Panel("-12 to 12")  # disabled
number_slider_24 = Slider(57, range=0..100)  # disabled
number_slider_25 = Slider(0.39, range=0..2)  # disabled
rectangle = Rectangle(Plane=PlaneXY(0, 0, 0), XSize=panel_10, YSize=panel_10, Radius=0)  # -> Rectangle, Length; disabled
construct_point_3 = ConstructPoint(XCoordinate=0, YCoordinate=0, ZCoordinate=number_slider_23)  # disabled
metaball_t_3 = MetaBallT(Plane=PlaneXY(0, 0, 0), Threshold=0.5)  # disabled
panel_11 = Panel("4")  # disabled
populate_2d = Populate2D(Region=rectangle.Rectangle, Count=panel_11, Seed=number_slider_24)  # disabled
unit_z = UnitZ(Factor=number_slider_25)  # disabled
gene_pool = GenePool(Decimals=2, Maximum=50, Minimum=5, Value=[28.40347521, 28.33930024, 14.72990515, 31.79194266])  # disabled
xy_plane = XYPlane(Origin=construct_point_3)  # disabled
linear_array = LinearArray(Geometry=xy_plane, Direction=unit_z, Count=10)  # -> Geometry, Transform; disabled
metaball_t_custom_2 = MetaBallTCustom(Plane=PlaneXY(0, 0, 0), Threshold=0.5)  # disabled
number_slider_26 = Slider(4.77, range=0..10)  # disabled
number_slider_27 = Slider(0.48, range=0..1)  # disabled
number_slider_28 = Slider(4, range=0..100)  # disabled
metaball_t_custom_3 = MetaBallTCustom(Points=populate_2d, Charge=gene_pool, Plane=linear_array.Geometry, Threshold=number_slider_27, Accuracy=number_slider_26)  # disabled
number_slider_29 = Slider(25, range=0..100)  # disabled
smooth_polyline = SmoothPolyline(Polyline=metaball_t_custom_3, Strength=1, Times=number_slider_28)  # disabled
panel_12 = Panel("3")  # disabled
rebuild_curve_2 = RebuildCurve(Curve=smooth_polyline, Count=number_slider_29, Degree=panel_12, EndTangents=False)  # disabled
surface = Surface(rebuild_curve_2)  # disabled

number_slider_30 = Slider(14, range=0..100)  # disabled
number_slider_31 = Slider(8, range=0..100)  # disabled
number_slider_32 = Slider(10, range=0..100)  # disabled
negative = Negative(Value=number_slider_30)  # disabled
negative_2 = Negative(Value=number_slider_31)  # disabled
construct_domain = ConstructDomain(DomainStart=negative, DomainEnd=number_slider_30)  # disabled
construct_domain_2 = ConstructDomain(DomainStart=negative_2, DomainEnd=number_slider_31)  # disabled
construct_domain_3 = ConstructDomain(DomainStart=0, DomainEnd=number_slider_32)  # disabled
domain_box = DomainBox(Base=PlaneXY(0, 0, 0), X=construct_domain, Y=construct_domain_2, Z=construct_domain_3)  # disabled

number_slider_33 = Slider(14, range=0..100)  # disabled
number_slider_34 = Slider(8, range=0..100)  # disabled
number_slider_35 = Slider(10, range=0..100)  # disabled
negative_3 = Negative(Value=number_slider_33)  # disabled
negative_4 = Negative(Value=number_slider_34)  # disabled
construct_domain_4 = ConstructDomain(DomainStart=negative_3, DomainEnd=number_slider_33)  # disabled
construct_domain_5 = ConstructDomain(DomainStart=negative_4, DomainEnd=number_slider_34)  # disabled
construct_domain_6 = ConstructDomain(DomainStart=0, DomainEnd=number_slider_35)  # disabled
number_slider_36 = Slider(8, range=2..20)  # disabled
number_slider_37 = Slider(26, range=0..100)  # disabled
domain_box_2 = DomainBox(Base=PlaneXY(0, 0, 0), X=construct_domain_4, Y=construct_domain_5, Z=construct_domain_6)  # disabled
populate_3d = Populate3D(Region=domain_box_2, Count=number_slider_36, Seed=number_slider_37)  # disabled
number_slider_38 = Slider(16, range=0..30)  # disabled
number_slider_39 = Slider(2, range=0..10)  # disabled
construct_domain_7 = ConstructDomain(DomainStart=number_slider_39, DomainEnd=number_slider_38)  # disabled
number_slider_40 = Slider(1.32, range=1..2)  # disabled
random_4 = Random(Range=construct_domain_7, Number=number_slider_36, Seed=2)  # disabled
point_charge = PointCharge(Point=populate_3d, Radius=random_4, ChargeStrength=number_slider_40)  # disabled
number_slider_41 = Slider(1.62, range=0.1..2)  # disabled
number_slider_42 = Slider(0.145, range=-0.5..0.5)  # disabled
boolean_toggle_9 = BooleanToggle(True)  # disabled
cocoon = Cocoon(Charges=point_charge, Iso=number_slider_42, CellSize=number_slider_41, Execute=boolean_toggle_9, Simple=False)  # -> Mesh, RefinementData; disabled

# ----
# 047_coccoonl_example
# - great plugin for volumetric modeling
# available at: http://www.bespokegeometry.com/2015/07/22/cocoon/
cocoon_2 = Cocoon(Simple=False)  # -> Mesh, RefinementData; disabled
refine = Refine()  # disabled
brep_charge = BrepCharge()  # disabled
curve_charge = CurveCharge()  # disabled
curve_group_charge = CurveGroupCharge()  # disabled
point_charge_2 = PointCharge()  # disabled
number_slider_43 = Slider(22, range=0..100)  # disabled

number_slider_44 = Slider(5, range=0..10)  # disabled
number_slider_45 = Slider(4, range=0..10)  # disabled
deconstruct_brep = DeconstructBrep(Brep=domain_box)  # -> Faces, Edges, Vertices; disabled
list_item = ListItem(List=deconstruct_brep.Faces, Index=number_slider_44, Wrap=True)  # disabled
list_item_2 = ListItem(List=deconstruct_brep.Faces, Index=number_slider_45, Wrap=True)  # disabled
brep_wireframe = BrepWireframe(Brep=list_item, Density=-1)  # disabled
brep_wireframe_2 = BrepWireframe(Brep=list_item_2, Density=-1)  # disabled
number_slider_46 = Slider(5, range=0..10)  # disabled
number_slider_47 = Slider(12, range=0..100)  # disabled
number_slider_48 = Slider(5, range=0..10)  # disabled
number_slider_49 = Slider(37, range=0..100)  # disabled
join_curves_4 = JoinCurves(Curves=brep_wireframe, Preserve=False)  # disabled
join_curves_5 = JoinCurves(Curves=brep_wireframe_2, Preserve=False)  # disabled
number_slider_50 = Slider(12, range=0..100)  # disabled
populate_2d_2 = Populate2D(Region=join_curves_4, Count=number_slider_46, Seed=number_slider_47)  # disabled
populate_2d_3 = Populate2D(Region=join_curves_5, Count=number_slider_48, Seed=number_slider_49)  # disabled
unit_z_2 = UnitZ(Factor=number_slider_50)  # disabled
reverse = Reverse(Vector=unit_z_2)  # disabled
line = Line(StartPoint=populate_2d_2, EndPoint=populate_2d_3)  # disabled
bezier_span = BezierSpan(StartPoint=populate_2d_3, StartTangent=unit_z_2, EndPoint=populate_2d_2, EndTangent=reverse)  # -> Curve, Length, Domain; disabled

number_slider_51 = Slider(8, range=2..20)  # disabled
number_slider_52 = Slider(26, range=0..100)  # disabled
populate_3d_2 = Populate3D(Region=domain_box, Count=number_slider_51, Seed=number_slider_52)  # disabled
number_slider_53 = Slider(10, range=0..10)  # disabled
number_slider_54 = Slider(6, range=0..10)  # disabled
number_slider_55 = Slider(7, range=0..10)  # disabled
number_slider_56 = Slider(6, range=0..10)  # disabled
construct_domain_8 = ConstructDomain(DomainStart=number_slider_54, DomainEnd=number_slider_53)  # disabled
construct_domain_9 = ConstructDomain(DomainStart=number_slider_56, DomainEnd=number_slider_55)  # disabled
number_slider_57 = Slider(1.32, range=1..2)  # disabled
number_slider_58 = Slider(1.32, range=1..2)  # disabled
random_5 = Random(Range=construct_domain_8, Number=number_slider_51, Seed=number_slider_43)  # disabled
random_6 = Random(Range=construct_domain_9, Number=number_slider_46, Seed=number_slider_43)  # disabled
point_charge_3 = PointCharge(Point=populate_3d_2, Radius=random_5, ChargeStrength=number_slider_57)  # disabled
curve_charge_2 = CurveCharge(Curve=bezier_span.Curve, Radius=random_6, ChargeStrengths=number_slider_58)  # disabled
number_slider_59 = Slider(1.44, range=0.1..2)  # disabled
number_slider_60 = Slider(0.2, range=-0.5..0.5)  # disabled
number_slider_61 = Slider(1.62, range=0.1..2)  # disabled
number_slider_62 = Slider(0.145, range=-0.5..0.5)  # disabled
boolean_toggle_10 = BooleanToggle(True)  # disabled
boolean_toggle_11 = BooleanToggle(True)  # disabled
cocoon_3 = Cocoon(Charges=curve_charge_2, Iso=number_slider_60, CellSize=number_slider_59, Execute=boolean_toggle_10, Simple=False)  # -> Mesh, RefinementData; disabled
cocoon_4 = Cocoon(Charges=point_charge_3, Iso=number_slider_62, CellSize=number_slider_61, Execute=boolean_toggle_11, Simple=False)  # -> Mesh, RefinementData; disabled
mesh_2 = Mesh(cocoon_4.Mesh)  # disabled
mesh_3 = Mesh(cocoon_3.Mesh)  # disabled

mesh_4 = Mesh(domain_box)  # disabled
mesh_split = MeshSplit(Mesh=mesh_4, Splitters=mesh_2)  # disabled
list_item_3 = ListItem(List=mesh_split, Index=0, Wrap=True)  # -> Item, Item1, Item2; disabled
mesh_5 = Mesh(list_item_3.Item1)  # disabled
mesh_6 = Mesh(list_item_3.Item2)  # disabled

# ----
# David Copete *
number_slider_63 = Slider(1.7, range=0..10)  # disabled
number_slider_64 = Slider(109, range=0..200)  # disabled
multiplication_4 = Multiplication(A=number_slider_64, B=number_slider_63)  # disabled

# ----
# 048_voronoil_example
# - this is probably the most used and over used
# algorithm used on the internet in grasshopper
# BEWARE!
# - here are some great samples of David Copete
# https://www.copetedavid.com/shop
# requires the Lunchbox download
voronoi_2 = Voronoi(BruteForceOverride=False)  # disabled
panel_13 = Panel("100")  # disabled
rectangle_2 = Rectangle(Plane=PlaneXY(0, 0, 0), XSize=panel_13, YSize=panel_13, Radius=0)  # -> Rectangle, Length; disabled
number_slider_65 = Slider(62, range=0..300)  # disabled
voronoi_3d_2 = Voronoi3D()  # -> Cells, Boundary; disabled
hexagon_cells = HexagonCells(Surface=rectangle_2.Rectangle, UDivisions=number_slider_64, VDivisions=multiplication_4, TParameter=0.25)  # -> HexagonCells, Centers; disabled
populate_2d_4 = Populate2D(Region=rectangle_2.Rectangle, Count=number_slider_65, Seed=1)  # disabled
voronoi_groups = VoronoiGroups(Boundary={Plane=PlaneXY(0, 0, 0), Size=Domain2(u=-10..10, v=-10..10)})  # -> Diagram1, Diagram2; disabled
number_slider_66 = Slider(0.6771, range=0..1)  # disabled
voronoi_cell = VoronoiCell()  # disabled
point = Point(hexagon_cells.Centers)  # disabled
number_slider_67 = Slider(0.0039, range=0..1)  # disabled
image_sampler = ImageSampler(
    point,
    FilePath="C:\Users\Sculpture\Documents\2020Grasshopper\ghfiles2019\January2019\GrassHooperRhino\Image Sampler\10933805_828435007199774_4643817663222164453_n.jpg",
    Filter="Value",
    Interpolate=True,
    Umax=100,
    Umin=0,
    Vmax=100,
    Vmin=0,
    Wrap=1)  # disabled
number_slider_68 = Slider(0.3474, range=0..1)  # disabled
_3d_voronoi = _3DVoronoi()  # -> _3DVoronoiCells, Connectivity; disabled
construct_domain_10 = ConstructDomain(DomainStart=number_slider_66, DomainEnd=number_slider_67)  # disabled
bounds = Bounds(Numbers=image_sampler)  # disabled
voronoi_3 = Voronoi(Points=hexagon_cells.Centers, Boundary=rectangle_2.Rectangle, BruteForceOverride=False)  # disabled
remap_numbers = RemapNumbers(Value=image_sampler, Source=bounds, Target=construct_domain_10)  # -> Mapped, Clipped; disabled
point_2 = Point(populate_2d_4)  # disabled
smaller_than = SmallerThan(FirstNumber=remap_numbers.Mapped, SecondNumber=number_slider_68)  # -> SmallerThan, OrEqualTo; disabled
larger_than = LargerThan(FirstNumber=remap_numbers.Mapped, SecondNumber=number_slider_68)  # -> LargerThan, OrEqualTo; disabled
cull_pattern = CullPattern(List=point, CullPattern=larger_than.LargerThan)  # disabled
cull_pattern_2 = CullPattern(List=point_2, CullPattern=smaller_than.SmallerThan)  # disabled
point_3 = Point([cull_pattern, cull_pattern_2])  # disabled
voronoi_4 = Voronoi(Points=point_3, Boundary=rectangle_2.Rectangle, BruteForceOverride=False)  # disabled

# ----
# - download mesh edit plugin for these scripts (Mesh credit: Daniel Christev)
number_slider_69 = Slider(40, range=0..100)  # disabled
number_slider_70 = Slider(100, range=0..100)  # disabled
number_slider_71 = Slider(4, range=0..5)  # disabled
range_4 = Range(Domain=number_slider_69, Steps=number_slider_70)  # disabled
sine_2 = Sine(Value=range_4)  # disabled
multiplication_5 = Multiplication(A=sine_2, B=number_slider_71)  # disabled
number_slider_72 = Slider(1.679, range=0..5)  # disabled
construct_point_4 = ConstructPoint(XCoordinate=graft(range_4), YCoordinate=range_4, ZCoordinate=multiplication_5)  # disabled
surface_from_points = SurfaceFromPoints(Points=flatten(construct_point_4), UCount=expr("x+1", number_slider_70), Interpolate=False)  # disabled
surface_2 = Surface(surface_from_points)  # disabled
area = Area(Geometry=surface_2)  # -> Area, Centroid; disabled
dimensions = Dimensions(Surface=surface_2)  # -> UDimension, VDimension; disabled
number_slider_73 = Slider(10, range=0..20)  # disabled
division = Division(A=dimensions.UDimension, B=dimensions.VDimension)  # disabled
scale = Scale(Geometry=surface_2, Center=area.Centroid, Factor=number_slider_72)  # -> Geometry, Transform; disabled
md_slider = MDSlider(
    SliderMode=0,
    slider_value=Point(0.5964374077, 0.3989495998, 0.5),
    x_domain=Domain(0, 1),
    y_domain=Domain(0, 1),
    z_domain=Domain(0, 1))  # disabled
multiplication_6 = Multiplication(A=division, B=number_slider_73)  # disabled
integer = Integer(multiplication_6)  # disabled
divide_surface = DivideSurface(Surface=surface_2, UCount=integer, VCount=number_slider_73)  # -> flatten(Points), Normals, Parameters; disabled
md_slider_2 = MDSlider(
    SliderMode=0,
    slider_value=Point(0.758053798, 0.3364762142, 0.5),
    x_domain=Domain(0, 1),
    y_domain=Domain(0, 1),
    z_domain=Domain(0, 1))  # disabled
number_slider_74 = Slider(0.243, range=0..2)  # disabled
md_slider_3 = MDSlider(
    SliderMode=0,
    slider_value=Point(0.1948275682, 0.7902063509, 0.5),
    x_domain=Domain(0, 1),
    y_domain=Domain(0, 1),
    z_domain=Domain(0, 1))  # disabled
evaluate_surface = EvaluateSurface(Surface=reparameterize(scale.Geometry), Point=[md_slider_3, md_slider, md_slider_2])  # -> Point, Normal, UDirection, VDirection, Frame; disabled
distance = Distance(PointA=graft(evaluate_surface.Point), PointB=divide_surface.Points)  # disabled
point_4 = Point(divide_surface.Points)  # disabled
expression = Expression(w=flatten(number_slider_74), t=distance, Expression="sin(2*w^2*t)")  # disabled
flip_matrix = FlipMatrix(Data=expression)  # disabled
number_slider_75 = Slider(7.333, range=0..10)  # disabled
ma = MassMultiplication(Input=flip_matrix)  # -> flatten(Result), PartialResults; disabled
multiplication_7 = Multiplication(A=number_slider_75, B=ma.Result)  # disabled
unit_z_3 = UnitZ(Factor=multiplication_7)  # disabled
move = Move(Geometry=divide_surface.Points, Motion=unit_z_3)  # -> Geometry, Transform; disabled
expression_2 = Expression(u=integer, Expression="u+1")  # disabled
mesh_frompoints_2 = MeshFromPoints(Points=move.Geometry, UDirection=expr("x+1", integer), VDirection=expr("x+1", number_slider_73))  # disabled
surface_from_points_2 = SurfaceFromPoints(Points=move.Geometry, UCount=expression_2, Interpolate=False)  # disabled

number_slider_76 = Slider(38, range=0..100)  # disabled
number_slider_77 = Slider(21, range=0..100)  # disabled
number_slider_78 = Slider(20, range=0..100)  # disabled

number_slider_79 = Slider(1.73, range=0..10)  # disabled
number_slider_80 = Slider(3.2, range=0..10)  # disabled
number_slider_81 = Slider(1.45, range=0..10)  # disabled

# ----
# 049_weaverbird_example
# - credit Daniel Christev with mesh generator
# -
# weaverbird is a powerful plugin
# - Alfonso Peluso has some great samples online
# https://www.youtube.com/watch?v=eYjFq4_miw0
# - applying multiple values
number_slider_82 = Slider(2, range=0..5)  # disabled
weaverbird_s_tile = WeaverbirdsTile(FillStrategy=1, OptIn=2)  # disabled
mesh_7 = Mesh(mesh_frompoints_2)  # disabled
weaverbird_s_catmull_clark_subdivision = WeaverbirdsCatmullClarkSubdivision(MeshCurves=mesh_7, Level=number_slider_82, SmoothNakedEdges=1)  # disabled
weaverbird_s_loop_subdivision = WeaverbirdsLoopSubdivision(MeshCurves=mesh_7, Level=number_slider_82, SmoothNakedEdges=1)  # disabled
weaverbird_s_constant_quads_split_subdiv = WeaverbirdsConstantQuadsSplitSubdivision(MeshCurves=mesh_7, Level=number_slider_82, SmoothNakedEdges=1)  # disabled
weaverbird_s_mesh_from_lines_weave_back = WeaverbirdsMeshFromLinesWeaveBack(MaximumValence=4)  # disabled
weaverbird_s_picture_frame = WeaverbirdsPictureFrame(
    MeshPolylines=weaverbird_s_catmull_clark_subdivision,
    Distance=[number_slider_77, number_slider_76, number_slider_78],
    InsetType=0)  # disabled
weaverbird_s_mesh_thicken = WeaverbirdsMeshThicken(MeshCurves=weaverbird_s_picture_frame, Distance=[number_slider_79, number_slider_80, number_slider_81], OffsetType=0)  # disabled
number_slider_83 = Slider(2, range=1..3)  # disabled
weaverbird_s_catmull_clark_subdivision_2 = WeaverbirdsCatmullClarkSubdivision(MeshCurves=weaverbird_s_mesh_thicken, Level=number_slider_83, SmoothNakedEdges=1)  # disabled

# ----
# 050_octree_example
# - OM! has some of the best music videos for
# learning grasshopper online
# https://www.youtube.com/watch?v=2ZdsI_p9Ifo
number_slider_84 = Slider(35, range=0..100)  # disabled
number_slider_85 = Slider(100, range=0..100)  # disabled
octree_2 = OcTree(Square=False, Group=5)  # -> Boxes, Points; disabled
geometry = Geometry(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)  # disabled
number_slider_86 = Slider(-3.62, range=-100..100.01)  # disabled
boolean_toggle_12 = BooleanToggle(True)  # disabled
populate_geometry = PopulateGeometry(Geometry=geometry, Count=number_slider_85, Seed=number_slider_84)  # disabled
quadtree = QuadTree(Plane=PlaneXY(0, 0, 0), Square=False, Group=5)  # -> Quads, Points; disabled
octree_3 = OcTree(Points=populate_geometry, Square=boolean_toggle_12, Group=number_slider_86)  # -> Boxes, Points; disabled
quad_remesh = QuadRemesh(Settings={aqc=True, as=50, dhe=True, gci=0, null=False, pme=0, sa=0, tqc=2000})  # disabled
geometry_2 = Geometry(octree_3.Boxes)  # disabled
number_slider_87 = Slider(2.607, range=0..10)  # disabled
area_2 = Area(Geometry=geometry_2)  # -> Area, Centroid; disabled
quad_remesh_settings = QuadRemeshSettings(TargetCount=1000, AdaptiveSize=0, AdaptiveCount=False, HardEdges=False, SeamEdges=0, Symmetry=0, GuideCurves=0)  # disabled
scale_2 = Scale(Geometry=geometry_2, Center=area_2.Centroid, Factor=number_slider_87)  # -> Geometry, Transform; disabled
solid_union = SolidUnion(Breps=scale_2.Geometry)  # disabled
boolean_toggle_13 = BooleanToggle(False)  # disabled
number_slider_88 = Slider(2, range=1..3)  # disabled
mesh_8 = Mesh(solid_union)  # disabled
weaverbird_s_join_meshes_and_weld = WeaverbirdsJoinMeshesAndWeld(Mesh=mesh_8, Weld=boolean_toggle_13)  # disabled
weaverbird_s_loop_subdivision_2 = WeaverbirdsLoopSubdivision(MeshCurves=weaverbird_s_join_meshes_and_weld, Level=number_slider_88, SmoothNakedEdges=1)  # disabled
number_slider_89 = Slider(23, range=0..100)  # disabled
number_slider_90 = Slider(2, range=0..10)  # disabled
weaverbird_s_picture_frame_2 = WeaverbirdsPictureFrame(MeshPolylines=weaverbird_s_loop_subdivision_2, Distance=number_slider_89, InsetType=0)  # disabled
weaverbird_s_mesh_thicken_2 = WeaverbirdsMeshThicken(MeshCurves=weaverbird_s_picture_frame_2, Distance=number_slider_90, OffsetType=0)  # disabled
colour_swatch = ColourSwatch(SwatchColor=RGB(9, 188, 255))  # disabled
colour_swatch_2 = ColourSwatch(SwatchColor=RGB(255, 145, 0))  # disabled
custom_preview = CustomPreview(Geometry=scale_2.Geometry, Material=colour_swatch)  # disabled
custom_preview_2 = CustomPreview(Geometry=weaverbird_s_mesh_thicken_2, Material=colour_swatch_2)  # disabled

number_slider_91 = Slider(47, range=0..100)  # disabled
number_slider_92 = Slider(86, range=0..100)  # disabled
number_slider_93 = Slider(52, range=0..100)  # disabled
number_slider_94 = Slider(81, range=0..100)  # disabled
construct_point_5 = ConstructPoint(XCoordinate=number_slider_91, YCoordinate=number_slider_93, ZCoordinate=number_slider_92)  # disabled
construct_point_6 = ConstructPoint(XCoordinate=number_slider_94, YCoordinate=number_slider_94, ZCoordinate=number_slider_94)  # disabled
number_slider_95 = Slider(12, range=0..100)  # disabled
number_slider_96 = Slider(26, range=0..100)  # disabled
number_slider_97 = Slider(49, range=0..100)  # disabled
number_slider_98 = Slider(35, range=0..100)  # disabled
number_slider_99 = Slider(22, range=0..100)  # disabled
number_slider_100 = Slider(76, range=0..100)  # disabled
xy_plane_2 = XYPlane(Origin=construct_point_5)  # disabled
xy_plane_3 = XYPlane(Origin=construct_point_6)  # disabled
center_box = CenterBox(Base=xy_plane_2, X=number_slider_96, Y=number_slider_99, Z=number_slider_100)  # disabled
center_box_2 = CenterBox(Base=xy_plane_3, X=number_slider_95, Y=number_slider_97, Z=number_slider_98)  # disabled
panel_14 = Panel("4")  # disabled
mesh_box_2 = MeshBox(Base=center_box, XCount=panel_14, YCount=panel_14, ZCount=panel_14)  # disabled
mesh_box_3 = MeshBox(Base=center_box_2, XCount=panel_14, YCount=panel_14, ZCount=panel_14)  # disabled
number_slider_101 = Slider(0, range=0..3)  # disabled
number_slider_102 = Slider(0.1, range=0..1)  # disabled
subd_fuse = SubDFuse(SubDA=mesh_box_2, SubDB=mesh_box_3, BooleanOption=number_slider_101, Smoothing=number_slider_102)  # disabled
custom_preview_3 = CustomPreview(
    Geometry=subd_fuse,
    Material={diffuse=RGB(221, 160, 221), emission=RGB(66, 48, 66), shine=0.5, specular=RGB(255, 255, 255), transparency=0})  # disabled
null_item = NullItem(Item=subd_fuse)  # -> NullFlags, InvalidFlags, Description; disabled
panel_15 = Panel(null_item.NullFlags)  # disabled
subd_from_mesh = SubDFromMesh(Mesh=mesh_box_2, Creases=1, Corners=1, Interpolate=False)  # disabled
subd_from_mesh_2 = SubDFromMesh(Mesh=mesh_box_3, Creases=1, Corners=1, Interpolate=False)  # disabled
merge = Merge(Data1=subd_from_mesh, Data2=subd_from_mesh_2)  # disabled
stream_filter = StreamFilter(Gate=panel_15, Stream0=subd_fuse, Stream1=merge)  # disabled
custom_preview_4 = CustomPreview(
    Geometry=stream_filter,
    Material={diffuse=RGB(221, 160, 221), emission=RGB(66, 48, 66), shine=0.5, specular=RGB(255, 255, 255), transparency=0})  # disabled

# ----
# 051_subD_example
mesh_from_subd = MeshFromSubD(Density=2)  # disabled
subd_from_mesh_3 = SubDFromMesh(Creases=1, Corners=1, Interpolate=False)  # disabled
multipipe_2 = MultiPipe(NodeSize=0.5, EndOffset=1, StrutSize=1, Segment=0, KinkAngle=0.6, CubeFit=0, Caps=0)  # disabled
subd_control_polygon = SubDControlPolygon()  # disabled
subd_edges = SubDEdges(NewFormatting=False)  # -> Line, Edge, Tag, Id; disabled
subd_fuse_2 = SubDFuse(BooleanOption=0, Smoothing=10)  # disabled

# ----
# - download mesh edit plugin for these scripts (Mesh credit: Daniel Christev)
number_slider_103 = Slider(40, range=0..100)  # disabled
number_slider_104 = Slider(100, range=0..100)  # disabled
number_slider_105 = Slider(4, range=0..5)  # disabled
range_5 = Range(Domain=number_slider_103, Steps=number_slider_104)  # disabled
sine_3 = Sine(Value=range_5)  # disabled
multiplication_8 = Multiplication(A=sine_3, B=number_slider_105)  # disabled
number_slider_106 = Slider(1.679, range=0..5)  # disabled
construct_point_7 = ConstructPoint(XCoordinate=graft(range_5), YCoordinate=range_5, ZCoordinate=multiplication_8)  # disabled
surface_from_points_3 = SurfaceFromPoints(Points=flatten(construct_point_7), UCount=expr("x+1", number_slider_104), Interpolate=False)  # disabled
surface_3 = Surface(surface_from_points_3)  # disabled
area_3 = Area(Geometry=surface_3)  # -> Area, Centroid; disabled
dimensions_2 = Dimensions(Surface=surface_3)  # -> UDimension, VDimension; disabled
number_slider_107 = Slider(5, range=0..20)  # disabled
division_2 = Division(A=dimensions_2.UDimension, B=dimensions_2.VDimension)  # disabled
scale_3 = Scale(Geometry=surface_3, Center=area_3.Centroid, Factor=number_slider_106)  # -> Geometry, Transform; disabled
md_slider_4 = MDSlider(
    SliderMode=0,
    slider_value=Point(0.5964374077, 0.3989495998, 0.5),
    x_domain=Domain(0, 1),
    y_domain=Domain(0, 1),
    z_domain=Domain(0, 1))  # disabled
multiplication_9 = Multiplication(A=division_2, B=number_slider_107)  # disabled
integer_2 = Integer(multiplication_9)  # disabled
divide_surface_2 = DivideSurface(Surface=surface_3, UCount=integer_2, VCount=number_slider_107)  # -> flatten(Points), Normals, Parameters; disabled
md_slider_5 = MDSlider(
    SliderMode=0,
    slider_value=Point(0.758053798, 0.3364762142, 0.5),
    x_domain=Domain(0, 1),
    y_domain=Domain(0, 1),
    z_domain=Domain(0, 1))  # disabled
number_slider_108 = Slider(0.095, range=0..2)  # disabled
md_slider_6 = MDSlider(
    SliderMode=0,
    slider_value=Point(0.1948275682, 0.7902063509, 0.5),
    x_domain=Domain(0, 1),
    y_domain=Domain(0, 1),
    z_domain=Domain(0, 1))  # disabled
evaluate_surface_2 = EvaluateSurface(Surface=reparameterize(scale_3.Geometry), Point=[md_slider_6, md_slider_4, md_slider_5])  # -> Point, Normal, UDirection, VDirection, Frame; disabled
distance_2 = Distance(PointA=graft(evaluate_surface_2.Point), PointB=divide_surface_2.Points)  # disabled
point_5 = Point(divide_surface_2.Points)  # disabled
expression_3 = Expression(w=flatten(number_slider_108), t=distance_2, Expression="sin(2*w^2*t)")  # disabled
flip_matrix_2 = FlipMatrix(Data=expression_3)  # disabled
number_slider_109 = Slider(4.657, range=0..10)  # disabled
ma_2 = MassMultiplication(Input=flip_matrix_2)  # -> flatten(Result), PartialResults; disabled
multiplication_10 = Multiplication(A=number_slider_109, B=ma_2.Result)  # disabled
unit_z_4 = UnitZ(Factor=multiplication_10)  # disabled
move_2 = Move(Geometry=divide_surface_2.Points, Motion=unit_z_4)  # -> Geometry, Transform; disabled
expression_4 = Expression(u=integer_2, Expression="u+1")  # disabled
mesh_frompoints_3 = MeshFromPoints(Points=move_2.Geometry, UDirection=expr("x+1", integer_2), VDirection=expr("x+1", number_slider_107))  # disabled
# Ladybug (environmental analysis)
# 
# https://www.food4rhino.com/en/app/ladybug-tools
# 
# all sample files depend on ghpython node
# which comes with Rhino 6/7
# 
# - it is worth noting that if you render out your own images
# you may want to save the sun paths and sun lighting for
# a program plugin like Vray and others
# - no point committing to a visual in gh if you are just
#  going to change it in a rendering engine later
# Ladybug allows you to import and analyze
#  standard weather data in Grasshopper;
# draw diagrams like Sun-path, wind-rose,
#  radiation-rose, etc; customize the diagrams
#  in several ways; run radiation analysis,
# shadow studies, and view analysis.
# 
# Ladybug allows you to import and analyze
#  standard weather data in Grasshopper;
#  draw diagrams like Sun-path, wind-rose,
#  radiation-rose, etc; customize the diagrams
#  in several ways; run radiation analysis,
#  shadow studies, and view analysis.
# 
# Honeybee connects Grasshopper3D to
#  validated simulation engines such as
#  EnergyPlus/OpenStudio and Radiance for
#  building energy, comfort, daylighting and
#  lighting simulation.
# 
# Dragonfly enables the creation and
#  manipulation of large-scale EnergyPlus and
#  Radiance models by capitalizing on an
#  abstracted 2D representation of building
#  geometry, where all rooms are assumed to
#  be extrusions of floor plates.
# 
# Butterfly connects Grasshopper to the
#  OpenFOAM engine, wich can be used to
#  run advanced computational fluid dynamic
#  (CFD) simulations.
surface_from_points_4 = SurfaceFromPoints(Points=move_2.Geometry, UCount=expression_4, Interpolate=False)  # disabled

# ----
# Great Tutorial: How to Rhino
# 
# https://www.youtube.com/watch?v=G1axZyqURwI
mesh_9 = Mesh(mesh_frompoints_3)  # disabled
number_slider_110 = Slider(1, range=1..2)  # disabled
number_slider_111 = Slider(1, range=1..2)  # disabled
boolean_toggle_14 = BooleanToggle(False)  # disabled
weld_mesh_2 = WeldMesh(Mesh=mesh_9, Angle=3.141592654)  # disabled
subd_from_mesh_4 = SubDFromMesh(Mesh=mesh_9, Creases=number_slider_110, Corners=number_slider_111, Interpolate=boolean_toggle_14)  # disabled
nakedvertices = NakedVertices(Mesh=weld_mesh_2)  # -> ClothedIndex, NakedIndex, ClothedPts, NakedPts; disabled
subd_edges_2 = SubDEdges(SubD=subd_from_mesh_4, NewFormatting=False)  # -> Line, Edge, Tag, Id; disabled
point_6 = Point(nakedvertices.NakedPts)  # disabled
panel_16 = Panel(subd_edges_2.Tag)  # disabled
curve_5 = Curve(subd_edges_2.Line)  # disabled
curve_6 = Curve(subd_edges_2.Edge)  # disabled
panel_17 = Panel("*crease*")  # disabled
panel_18 = Panel("*smooth*")  # disabled
panel_19 = Panel("*naked*")  # disabled
panel_20 = Panel("*interior*")  # disabled
match_text = MatchText(Text=panel_16, Pattern=panel_17, Case=True)  # disabled
panel_21 = Panel(match_text)  # disabled
cull_pattern_3 = CullPattern(List=curve_6, CullPattern=match_text)  # disabled
join_curves_6 = JoinCurves(Curves=cull_pattern_3, Preserve=False)  # disabled
panel_22 = Panel(cull_pattern_3)  # disabled
pipe = Pipe(Curve=join_curves_6, Radius=1, Caps=0)  # disabled
custom_preview_5 = CustomPreview(
    Geometry=pipe,
    Material={diffuse=RGB(221, 160, 221), emission=RGB(66, 48, 66), shine=0.5, specular=RGB(255, 255, 255), transparency=0})  # disabled

number_slider_112 = Slider(3, range=0..4)  # disabled
subd = SubD(subd_from_mesh_4)  # disabled
mesh_from_subd_2 = MeshFromSubD(SubD=subd, Density=number_slider_112)  # disabled
mesh_from_subd_3 = ValueList({"One": 0, "Two": 1}, selected="One")  # disabled
mesh_edges_2 = MeshEdges(Mesh=mesh_from_subd_2)  # -> NakedEdges, InteriorEdges, NonManifoldEdges; disabled
face_boundaries_2 = FaceBoundaries(Mesh=mesh_from_subd_2)  # disabled
subd_control_polygon_2 = SubDControlPolygon(SubD=mesh_from_subd_2)  # disabled
discontinuity = Discontinuity(Curve=face_boundaries_2, Level=1)  # -> Points, Parameters; disabled
stream_filter_2 = StreamFilter(Gate=mesh_from_subd_3, Stream0=mesh_from_subd_2, Stream1=subd_control_polygon_2)  # disabled
custom_preview_6 = CustomPreview(
    Geometry=stream_filter_2,
    Material={diffuse=RGB(221, 160, 221), emission=RGB(66, 48, 66), shine=0.5, specular=RGB(255, 255, 255), transparency=0})  # disabled
list_item_4 = ListItem(List=discontinuity.Points, Index=0, Wrap=True)  # -> Item, Item1, Item2, Item3; disabled
number_slider_113 = Slider(4, range=0..10)  # disabled
line_2 = Line(StartPoint=list_item_4.Item, EndPoint=list_item_4.Item2)  # disabled
line_3 = Line(StartPoint=list_item_4.Item1, EndPoint=list_item_4.Item3)  # disabled
divide_curve_4 = DivideCurve(Curve=line_3, Count=number_slider_113, Kinks=False)  # -> Points, Tangents, Parameters; disabled
divide_curve_5 = DivideCurve(Curve=line_2, Count=number_slider_113, Kinks=False)  # -> Points, Tangents, Parameters; disabled
interpolate_4 = Interpolate(Vertices=divide_curve_4.Points, Degree=3, Periodic=False, KnotStyle=1)  # -> Curve, Length, Domain; disabled
interpolate_5 = Interpolate(Vertices=divide_curve_5.Points, Degree=3, Periodic=False, KnotStyle=1)  # -> Curve, Length, Domain; disabled
curve_curve = CurveCurve(CurveA=interpolate_5.Curve, CurveB=interpolate_4.Curve)  # -> Points, ParamsA, ParamsB; disabled
curve_7 = Curve(mesh_edges_2.NakedEdges)  # disabled
shatter = Shatter(Curve=interpolate_5.Curve, Parameters=curve_curve.ParamsA)  # disabled
shatter_2 = Shatter(Curve=interpolate_4.Curve, Parameters=curve_curve.ParamsB)  # disabled
merge_2 = Merge(Data1=shatter, Data2=shatter_2)  # -> flatten(Result); disabled
end_points = EndPoints(Curve=merge_2)  # -> Start, End; disabled
line_4 = Line(StartPoint=end_points.Start, EndPoint=end_points.End)  # disabled
merge_3 = Merge(Data1=curve_7, Data2=line_4)  # -> flatten(Result); disabled
number_slider_114 = Slider(0.333, range=0..1)  # disabled
weaverbird_s_mesh_from_lines_weave_back_2 = WeaverbirdsMeshFromLinesWeaveBack(Lines=merge_3, MaximumValence=4)  # disabled
number_slider_115 = Slider(0.167, range=0..1)  # disabled
number_slider_116 = Slider(10, range=0..10)  # disabled
weaverbird_s_stellate_cumulation = WeaverbirdsStellateCumulation(MeshPolylines=weaverbird_s_mesh_from_lines_weave_back_2, Distance=number_slider_114)  # disabled
unit_z_5 = UnitZ(Factor=number_slider_115)  # disabled
weaverbird_s_picture_frame_3 = WeaverbirdsPictureFrame(MeshPolylines=weaverbird_s_stellate_cumulation, Distance=number_slider_116, InsetType=0)  # disabled
negative_5 = Negative(Value=unit_z_5)  # disabled
weaverbird_s_mesh_thicken_3 = WeaverbirdsMeshThicken(MeshCurves=weaverbird_s_picture_frame_3, Distance=negative_5, OffsetType=0)  # disabled
number_slider_117 = Slider(2, range=1..3)  # disabled
weaverbird_s_catmull_clark_subdivision_3 = WeaverbirdsCatmullClarkSubdivision(MeshCurves=weaverbird_s_mesh_thicken_3, Level=number_slider_117, SmoothNakedEdges=1)  # disabled

number_slider_118 = Slider(1, range=0..1)  # disabled
multipipe_3 = MultiPipe(Curves=curve_5, NodeSize=number_slider_118, EndOffset=1, StrutSize=1, Segment=0, KinkAngle=0.6, CubeFit=0, Caps=0)  # disabled

# ----
# MGSM
# Grasshopper for Rhino3D
# http://grasshopperdocs.com/
# https://www.food4rhino.com/en
# PLUGINS CAN BE USED SIMPLY AND CAN BE DELVED INTO ON A MORE ADVANCED LEVEL
# THE KEY IS TO UNDERSTAND HOW THEY WERE CONTRUCTED FROM THE VANILLA RIBBON NODES THAT COME WITH GRASSHOPPER FOR RHINO7
# ONLY THEN WILL YOU BE ABLE TO START PROGRAMMING AND COMPILING YOUR OWN PLUGINS THAT HAVE YET TO BE CREATED FOR THE PARAMETRIC AND COMPUTATIONAL DESIGNER/ARCHITECT AND ENGINEER
# Vanilla Grasshopper
# Data Trees
# Ladybug
# Weaverbird
# FireFly
# Lunchbox
# Pufferfish
# Hal/Kuka/Robotics/tocoABB
# Paneling tools
# Kangaroo
# fologram
# Galapogos
# ghpython
# ghpython remote
# C#
# LunchBox is a plug-in for Grasshopper for
#  exploring mathematical shapes, paneling,
#  structures, and workflow.  We have also
#  introduced new components for general
#  machine learning implementations such as
#  regression analysis, clustering, and
#  networks.
# 041_Lunchbox_basic
# - lunchox can be used for simple
# paneling and creating archtectures
# 
# Alphonso Peluso's great example of
# how to extend plugins
# The Pufferfish is one of few animals which
#  is capable of changing its shape.
# This plugin is a set of 330 components
# which focuses on Tweens, Blends, Morphs,
#  Averages, Transformations, & Interpolations
#  - essentially Shape Changing. Pufferfish mainly
#  uses parameters and factors for inputs for more
#  custom control over operations like tweens and
#  grids as opposed to grasshoppers usual division
#  count inputs. These components are
#  accompanied by support components which
#  are useful methods for tween / blend /
#  morph / lattice operations such as making
# curves compatible, a custom curve graph
#  mapper, and a multi-threaded morph to
# twisted box.
number_slider_119 = Slider(10, range=0..10)  # disabled
number_slider_120 = Slider(7.06, range=0..10)  # disabled
number_slider_121 = Slider(6.75, range=0..10)  # disabled
# Ladybug allows you to import and analyze
#  standard weather data in Grasshopper;
# draw diagrams like Sun-path, wind-rose,
#  radiation-rose, etc; customize the diagrams
#  in several ways; run radiation analysis,
# shadow studies, and view analysis.
# Kangaroo is a Live Physics engine for
# interactive simulation, form-finding,
#  optimization and constraint solving.
number_slider_122 = Slider(4.42, range=0..10)  # disabled
number_slider_123 = Slider(5.09, range=0..10)  # disabled
# Lunchbox (panelization and structure creation)
# Data
# Generate
# Machine Learning (proving ground)
# Math
# Panels
# Structure
# Utilities
# Workflow
ellipse = Ellipse(Plane=PlaneXY(0, 0, 0), Radius1=number_slider_119, Radius2=number_slider_120)  # -> Ellipse, Focus1, Focus2; disabled
ellipse_2 = Ellipse(Plane=PlaneXY(0, 0, 0), Radius1=number_slider_121, Radius2=number_slider_122)  # -> Ellipse, Focus1, Focus2; disabled
unit_z_6 = UnitZ(Factor=number_slider_123)  # disabled
# ghPython
# This is the Rhino 5 for Windows version.
#  Rhino for Mac and Rhino WIP+6 all come
#  with their own GhPython interpreter, that is
#  specific and needs no tweaking.
number_slider_124 = Slider(6, range=0..10)  # disabled
number_slider_125 = Slider(20, range=0..100)  # disabled
# Galapogos
# goat is an optimization add-on component
#  for Rhino's Grasshopper. It perfectly
#  complements galapagos, David Rutten's
#  evolutionary solver. Relying on gradient-free
#  optimization algorithms, the component
# pursues a mathematical rigorous approach
#  delivering fast and deterministic results. At
# every run, goat will yield the same optimal
#  result.
# 042_Lunchbox_advanced
# - lunchbox is great for getting your thinking
# about machine learning
# - download the examples from the creator,
# Proving Ground, to get started
# - here is a simple example from their tutorials
number_slider_126 = Slider(2, range=0..10)  # disabled
move_3 = Move(Geometry=ellipse_2.Ellipse, Motion=unit_z_6)  # -> Geometry, Transform; disabled
space_truss_structure_2 = SpaceTrussStructure2(UDivisions=10, VDivisions=10)  # -> PrimaryLines, PrimaryLines_2, WebLines, StructureNodes; disabled
number_slider_127 = Slider(20, range=0..100)  # disabled
number_slider_128 = Slider(3, range=0..10)  # disabled
number_slider_129 = Slider(6, range=0..10)  # disabled
number_slider_130 = Slider(6, range=0..10)  # disabled
number_slider_131 = Slider(32, range=0..100)  # disabled
number_slider_132 = Slider(0.22, range=0..1)  # disabled
number_slider_133 = Slider(0.09, range=0..0.1)  # disabled
panel_23 = Panel("2")  # disabled
number_slider_134 = Slider(0.5, range=0..1)  # disabled
number_slider_135 = Slider(0.64, range=0..1)  # disabled
multiplication_11 = Multiplication(A=number_slider_133, B=panel_23)  # disabled
number_slider_136 = Slider(0.19, range=0..1)  # disabled
number_slider_137 = Slider(0.13, range=0..1)  # disabled
panel_24 = Panel("3")  # disabled

# ----
# - untrimmed srf
loft = Loft(
    Curves=[ellipse.Ellipse, move_3.Geometry],
    Options={Adjust=False, Closed=False, LoftEnds=0, LoftSimp=0, LoftType=0, Rebuild=10, Refit=0.01})  # disabled

# ----
# 001_Introduction
# Ribbon Vanilla Grasshopper
# 
# Params
# Maths
# Sets - data trees
# Vectors
# Curves
# Surfaces
# IntersectionTransformations
# Display
# panels
diamond_panels = DiamondPanels(Surface=loft, UDivisions=number_slider_130, VDivisions=number_slider_131)  # -> DiamondPanels, TriPanels; disabled

# ----
# 002_ribbon_vanilla_grasshopper
# Grasshopper Canvas for Rhino3D:
# 
# Ribbon:
# 
# File
# - new/open
# - save document/saveas
# - export image
# - document properties
# - user objects/ clusters
# - special folders (components/user objects)
# - preferences
# panels frames
panel_frame = PanelFrame(Panel=[diamond_panels.DiamondPanels, diamond_panels.TriPanels], ScaleFactor=number_slider_135)  # -> PanelFrame, Panel; disabled

surface_4 = Surface(loft)  # disabled
space_truss_structure_1 = SpaceTrussStructure1(Surface=surface_4, UDivisions=number_slider_124, VDivisions=number_slider_125, TrussDepth=number_slider_126)  # -> PrimaryLines, PrimaryLines_2, WebLines, StructureNodes; disabled
diagrid_structure = DiagridStructure(Surface=surface_4, UDivisions=number_slider_129, VDivisions=number_slider_127, Type=number_slider_128)  # -> StructureLines, StructureNodes; disabled
hexagon_cells_2 = HexagonCells(Surface=loft, UDivisions=number_slider_130, VDivisions=number_slider_131, TParameter=number_slider_132)  # -> HexagonCells, Centers; disabled
perp_frames = PerpFrames(Curve=diagrid_structure.StructureLines, Count=10, Align=True)  # -> Frames, Parameters; disabled
sphere = Sphere(Base=space_truss_structure_1.StructureNodes, Radius=multiplication_11)  # disabled
pipe_2 = Pipe(
    Curve=[space_truss_structure_1.PrimaryLines, space_truss_structure_1.PrimaryLines_2, space_truss_structure_1.WebLines],
    Radius=number_slider_133,
    Caps=0)  # disabled
scale_4 = Scale(Geometry=hexagon_cells_2.HexagonCells, Center=hexagon_cells_2.Centers, Factor=number_slider_134)  # -> Geometry, Transform; disabled
polygon = Polygon(Plane=perp_frames.Frames, Radius=number_slider_136, Segments=panel_24, FilletRadius=0)  # -> Polygon, Length; disabled
pipe_3 = Pipe(Curve=diagrid_structure.StructureLines, Radius=number_slider_137, Caps=0)  # disabled
curve_8 = Curve(graft(hexagon_cells_2.HexagonCells))  # disabled
curve_9 = Curve(graft(scale_4.Geometry))  # disabled
sphere_2 = Sphere(Base=diagrid_structure.StructureNodes, Radius=expr("x*2", number_slider_137))  # disabled
loft_2 = Loft(
    Curves=[curve_8, curve_9],
    Options={Adjust=False, Closed=False, LoftEnds=0, LoftSimp=0, LoftType=0, Rebuild=10, Refit=0.01})  # disabled
loft_3 = Loft(Curves=polygon.Polygon, Options={Adjust=False, Closed=False, LoftEnds=0, LoftSimp=0, LoftType=0, Rebuild=10, Refit=0.01})  # disabled
# Edit
# 
# - cut/copy/paste/delete
# - arrange groups
# - group/ungroup
# - cluster
# - find
# - create component popup
geometry_3 = Geometry(panel_frame.PanelFrame)  # disabled
geometry_4 = Geometry(loft_2)  # disabled

# ----
# 045_c.Gediminas Kirdeikis_Kangaroo_cellular_growth
number_slider_138 = Slider(10, range=0..10)  # disabled
button_3 = Button()  # disabled
loop_start = LoopStart(Repeat=number_slider_138, Trigger=button_3)  # -> port, Counter, Data; disabled
boolean_toggle_15 = BooleanToggle(True)  # disabled
curve_10 = Curve(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)  # disabled
mesh_10 = Mesh(curve_10)  # disabled
curve_11 = Curve(loop_start.Data)  # disabled
number_slider_139 = Slider(5, range=5..10)  # disabled

panel_25 = Panel("0 to 10")  # disabled
panel_26 = Panel("1 to 10")  # disabled
remap_numbers_2 = RemapNumbers(Value=loop_start.Counter, Source=panel_25, Target=panel_26)  # -> Mapped, Clipped; disabled

length_3 = Length(Curve=explode_3.Segments)  # disabled
average_3 = Average(Input=length_3)  # disabled
multiplication_12 = Multiplication(A=average_3, B=remap_numbers_2.Mapped)  # disabled

number_slider_140 = Slider(0.79, range=0..10)  # disabled
length_line_3 = LengthLine(Line=explode_3.Segments, Length=multiplication_12, Strength=10)  # disabled
spherecollide_3 = SphereCollide(Points=divide_curve_2.Points, Radius=multiplication_12, Strength=number_slider_140)  # disabled
onmesh_2 = OnMesh(Points=divide_curve_2.Points, Mesh=mesh_10, Strength=1)  # disabled

boolean_toggle_16 = BooleanToggle(True)  # disabled
panel_27 = Panel("500")  # disabled
panel_28 = Panel(".95")  # disabled
stepsolver = StepSolver(
    GoalObjects=[length_line_3, spherecollide_3, onmesh_2],
    Tolerance=0.0001,
    Momentum=boolean_toggle_16,
    Damping=panel_28,
    SubIterations=panel_27,
    Animate=boolean_toggle_15)  # -> I, V, O; disabled

boolean_toggle_17 = BooleanToggle(True)  # disabled
boolean_toggle_18 = BooleanToggle(True)  # disabled
polyline_6 = PolyLine(Vertices=stepsolver.V, Closed=boolean_toggle_17)  # disabled
panel_29 = Panel("2000")  # disabled
panel_30 = Panel("3")  # disabled
rebuild_curve_3 = RebuildCurve(Curve=polyline_6, Count=panel_29, Degree=panel_30, EndTangents=boolean_toggle_18)  # disabled

merge_4 = Merge(Data1=curve_11, Data2=rebuild_curve_3)  # -> flatten(Result); disabled
clean_tree = CleanTree(RemoveNulls=True, RemoveInvalid=True, RemoveEmpty=False, Tree=merge_4)  # disabled
loop_end = LoopEnd(port=loop_start.port, Exit=False, Data=clean_tree, TimeOutVal=0, pausedState=False, state="Constant output")  # disabled
list_length = ListLength(List=loop_end)  # disabled
series_4 = Series(Start=0, Step=number_slider_139, Count=list_length)  # disabled
unit_z_7 = UnitZ(Factor=series_4)  # disabled
move_4 = Move(Geometry=loop_end, Motion=unit_z_7)  # -> Geometry, Transform; disabled
loft_4 = Loft(Curves=move_4.Geometry, Options={Adjust=False, Closed=False, LoftEnds=0, LoftSimp=0, LoftType=0, Rebuild=10, Refit=0.01})  # disabled
cap_holes = CapHoles(Brep=loft_4)  # disabled
